# Dynamo custom node GIStoBIM.GetLocationdataNetherlands.dyf (Dynamo 1.3.1.1736)
# category: GIStoBIM.Geoservices
# Gives locationdata based on an adress in the Netherlands

code_block = CodeBlock { "http://geodata.nationaalgeoregister.nl/locatieserver/v3/free?wt=json&q="; " and "; }
city = Input(city: string)  # name of the city in the Netherlands
streetname = Input(streetname: string)  # streetname
housenumber = Input(housenumber: string)  # housenumber
concat = String.Concat(code_block.out0, city, code_block.out1, streetname, code_block.out1, housenumber)
watch = Watch(concat)
web_request = WebRequest(watch)
string = StringInput("\"gekoppeld_perceel\":[")
split = String.Split(web_request, string)
lastItem = List.LastItem(split)
string_2 = StringInput("-")
split_2 = String.Split(lastItem, string_2)
code_block_2 = CodeBlock { 1; 2; }
kadastraal_sectie = List.GetItemAtIndex(list=split_2, index=code_block_2.out0)
sectie_kadaster = Output(kadastraal_sectie)
kadastraal_sectie_2 = List.GetItemAtIndex(list=split_2, index=code_block_2.out1)
string_3 = StringInput("\"")
split_3 = String.Split(kadastraal_sectie_2, string_3)
kadastraal_perceel = List.FirstItem(split_3)
perceel_kadaster = Output(kadastraal_perceel)
string_4 = StringInput("centroide_ll\":\"POINT(")
split_4 = String.Split(web_request, string_4)
lastItem_2 = List.LastItem(split_4)
string_5 = StringInput(" ")
split_5 = String.Split(lastItem_2, string_5)
LONGITUDE = List.FirstItem(split_5)
longitude = Output(LONGITUDE)
code_block_3 = CodeBlock { 1; 2; }
get_item_at_index = List.GetItemAtIndex(list=split_5, index=code_block_3.out0)
string_6 = StringInput(")")
split_6 = String.Split(get_item_at_index, string_6)
LATITUDE = List.FirstItem(split_6)
latitude = Output(LATITUDE)
string_7 = StringInput("\"postcode\":\"")
split_7 = String.Split(web_request, string_7)
code_block_4 = CodeBlock { 1; 0; }
getItemAtIndex = List.GetItemAtIndex(list=split_7, index=code_block_4.out0)
string_8 = StringInput("\",\"provincienaam\"")
split_8 = String.Split(getItemAtIndex, string_8)
getItemAtIndex_2 = List.GetItemAtIndex(list=split_8, index=code_block_4.out1)
postalcode = Output(getItemAtIndex_2)
string_9 = StringInput("centroide_rd\":\"POINT(")
split_9 = String.Split(web_request, string_9)
code_block_5 = CodeBlock { 1; 0; ")"; }
getItemAtIndex_3 = List.GetItemAtIndex(list=split_9, index=code_block_5.out0)
string_10 = StringInput(" ")
split_10 = String.Split(getItemAtIndex_3, string_10)
getItemAtIndex_4 = List.GetItemAtIndex(list=split_10, index=code_block_5.out0)
split_11 = String.Split(getItemAtIndex_4, code_block_5.out2)
getItemAtIndex_5 = List.GetItemAtIndex(list=split_11, index=code_block_5.out1)
toNumber = String.ToNumber(getItemAtIndex_5)
round = Math.Round(toNumber)
RD_coordinate_Y_meters = Output(round)  # "RD-coordinate Y(meters)"
getItemAtIndex_6 = List.GetItemAtIndex(list=split_10, index=code_block_5.out1)
toNumber_2 = String.ToNumber(getItemAtIndex_6)
round_2 = Math.Round(toNumber_2)
RD_coordinate_X_meters = Output(round_2)  # "RD-coordinate X(meters)"
