# Dynamo graph 1.3 Geocoding+Google Maps.dyn (Dynamo 2.2.1.5175)

code_block = CodeBlock { "27700"; }
GIS2BIM_SearchCRS = Custom[GIS2BIM_SearchCRS](EPSG_Code=code_block)  # Search for a Coordinate Reference System
watch = Watch(GIS2BIM_SearchCRS.NameCRS)
code_block_2 = CodeBlock { "morrison street"; "85"; "Edinburgh "; "Scotland"; }
GIS2BIM_GeocodingNominatimAPI = Custom[GIS2BIM_GeocodingNominatimAPI](Streetname=code_block_2.out0, Housenumber=code_block_2.out1, Place=code_block_2.out2, Country=code_block_2.out3)  # gets WGS-84 coordinate from address with Open Streets Maps API
code_block_3 = CodeBlock { 500; }
GIS2BIM_GoogleEarth = Custom[GIS2BIM_GoogleEarth](Latitude=GIS2BIM_GeocodingNominatimAPI.Latitude, Longitude=GIS2BIM_GeocodingNominatimAPI.Longitude, WidthBoundingBox=code_block_3)  # Download Google Earth
watch_image = WatchImageCore(image=GIS2BIM_GoogleEarth)
GIS2BIM_TransformCRS_epsg = Custom[GIS2BIM_TransformCRS_epsg](TargetCRS=code_block, xCoordinate=GIS2BIM_GeocodingNominatimAPI.Longitude, yCoordinate=GIS2BIM_GeocodingNominatimAPI.Latitude)  # Uses the API of http://epsg.io to transform Coordinate Reference Systems
