# Dynamo graph 2.1 Web Map Services.dyn (Dynamo 2.2.1.5175)

code_block = CodeBlock { "27700"; }
GIS2BIM_SearchCRS = Custom[GIS2BIM_SearchCRS](EPSG_Code=code_block)  # Search for a Coordinate Reference System
watch = Watch(GIS2BIM_SearchCRS.NameCRS)
code_block_2 = CodeBlock { "morrison street"; "150"; "Edinburgh "; "Scotland"; }
GIS2BIM_GeocodingNominatimAPI = Custom[GIS2BIM_GeocodingNominatimAPI](Streetname=code_block_2.out0, Housenumber=code_block_2.out1, Place=code_block_2.out2, Country=code_block_2.out3)  # gets WGS-84 coordinate from address with Open Streets Maps API
GIS2BIM_TransformCRS_epsg = Custom[GIS2BIM_TransformCRS_epsg](TargetCRS=code_block, xCoordinate=GIS2BIM_GeocodingNominatimAPI.Longitude, yCoordinate=GIS2BIM_GeocodingNominatimAPI.Latitude)  # Uses the API of http://epsg.io to transform Coordinate Reference Systems
code_block_3 = CodeBlock { 500; }
GIS2BIM_CreateBoundingBox = Custom[GIS2BIM_CreateBoundingBox](CoordinateX=GIS2BIM_TransformCRS_epsg.Xtransformed, CoordinateY=GIS2BIM_TransformCRS_epsg.Ytransformed, BoxWidth=code_block_3, BoxHeight=code_block_3)  # create boundingboxstring for webrequests based on coördinates and dimensions
GIS2BIM_ScotlandGeoservicesLibrary = Custom[GIS2BIM_ScotlandGeoservicesLibrary](BoundingBoxEPSG27700=GIS2BIM_CreateBoundingBox.Boxstring)  # Webservices in Scotland
GIS2BIM_WebrequestWMS = Custom[GIS2BIM_WebrequestWMS](WMSwebrequest=GIS2BIM_ScotlandGeoservicesLibrary.ELF_Cadastral_Parcel_WMS)  # a webrequest based on WMS-protocol
watch_image = WatchImageCore(image=GIS2BIM_WebrequestWMS)
code_block_4 = CodeBlock { 1000; }
GIS2BIM_GoogleEarth = Custom[GIS2BIM_GoogleEarth](Latitude=GIS2BIM_GeocodingNominatimAPI.Latitude, Longitude=GIS2BIM_GeocodingNominatimAPI.Longitude, WidthBoundingBox=code_block_4)  # Download Google Earth
watch_image_2 = WatchImageCore(image=GIS2BIM_GoogleEarth)
link_kadaster = CodeBlock()
# ---------- link_kadaster.designscript (12 lines) ----------
"http://ros.datafeed.locationcentre.co.uk/";
"geoserver/wms?";
"&request=GetMap";
"&VERSION=1.3.0";
"&STYLES=CP.CadastralParcel";
"&layers=CP.CadastralParcel";
"&bbox=";
"&width=2000";
"&height=2000";
"&format=image/png";
"&crs=EPSG:27700";
//ELF Cadastral Parcel
# ----------------------------------------
concat = String.Concat(string0=link_kadaster.out0, string1=link_kadaster.out1, string2=link_kadaster.out2, string3=link_kadaster.out3, string4=link_kadaster.out4, string5=link_kadaster.out5, string6=link_kadaster.out6, string7=GIS2BIM_CreateBoundingBox.Boxstring, string8=link_kadaster.out7, string9=link_kadaster.out8, string10=link_kadaster.out9, string11=link_kadaster.out10)
watch_2 = Watch(concat)
