# Dynamo graph 3.2 GIS2BIM_BAG 3D.dyn (Dynamo 2.2.1.5175)

# group: GEOCODING
code_block = CodeBlock { "dordrecht"; "lange geldersekade"; "1"; }
GIS2BIM_GetLocationdataNetherlands = Custom[GIS2BIM_GetLocationdataNetherlands](City=code_block.out0, Streetname=code_block.out1, Housenumber=code_block.out2)  # Gives locationdata based on an adress in the Netherlands

code_block_2 = CodeBlock(RDX=GIS2BIM_GetLocationdataNetherlands.RDcoordinateXmeters, RDY=GIS2BIM_GetLocationdataNetherlands.RDcoordinateYmeters) { RDX; RDY; }
width_boundingbox = CodeBlock { 300; }
GIS2BIM_CreateBoundingBox = Custom[GIS2BIM_CreateBoundingBox](CoordinateX=code_block_2.RDX, CoordinateY=code_block_2.RDY, BoxWidth=width_boundingbox, BoxHeight=width_boundingbox)  # create boundingboxstring for webrequests based on coördinates and dimensions

# group: BOUNDINGBOX EN CONSTRUEER WEBREQUEST
GIS2BIM_NetherlandsGeoservicesLibrary = Custom[GIS2BIM_NetherlandsGeoservicesLibrary](BoundingBoxEPSG28992=GIS2BIM_CreateBoundingBox.Boxstring)  # Library with multiple webadresses which can be used for WFS and WMS webrequests

GIS2BIM_BAG3D = Custom[GIS2BIM_BAG3D](BAG3DTUDelft_OGCWFS=GIS2BIM_NetherlandsGeoservicesLibrary.3D_BAG_TU_Delft_OGC_WFS, RdX=code_block_2.RDX, RdY=code_block_2.RDY)  # frozen; Perform a WFS(Web Feature Service) webrequest based on a boundingbox of RD-coordinates(28992). Retrieve an xml-file. Read the metadata and create 3D-solids. Maximum of 1000 buildings per request.

# group: OR USE REVIT SITE LOCATION
code_block_3 = CodeBlock { "4326"; "28992"; }
GIS2BIM_GetRevitSiteLocation = Custom[GIS2BIM_GetRevitSiteLocation]()  # Gets the properties of the current Site Location of the active Revit Project
GIS2BIM_TransformCRS_epsg = Custom[GIS2BIM_TransformCRS_epsg](SourceCRS=code_block_3.out0, TargetCRS=code_block_3.out1, xCoordinate=GIS2BIM_GetRevitSiteLocation.Lon, yCoordinate=GIS2BIM_GetRevitSiteLocation.Lat)  # Uses the API of http://epsg.io to transform Coordinate Reference Systems

file_path = Filename(".\Metric Mass.rft")  # graph input
web_request = WebRequest(url=GIS2BIM_NetherlandsGeoservicesLibrary.TOP10NL_wegdeelvlak_OGC_WMS_SVG)
GIS2BIM_SVGToCurves = Custom[GIS2BIM_SVGToCurves](SVGString=web_request, Width=width_boundingbox, Height=width_boundingbox)  # Beta version of converting SVG to Curves
web_request_2 = WebRequest(url=GIS2BIM_NetherlandsGeoservicesLibrary.TOP10NL_waterdeelvlak_OGC_WMS_SVG)
GIS2BIM_SVGToCurves_2 = Custom[GIS2BIM_SVGToCurves](SVGString=web_request_2, Width=width_boundingbox, Height=width_boundingbox)
code_block_4 = CodeBlock(bh=width_boundingbox)
# ---------- code_block_4.designscript (5 lines) ----------
b=0.5*bh*1000;
Point.ByCoordinates(-b-5000,-b-5000);
Point.ByCoordinates(-b-5000,b+5000);
Point.ByCoordinates(b+5000,-b-5000);
Point.ByCoordinates(b+5000,b+5000);
# ----------------------------------------
list_create = List.Create(item0=code_block_4.out2, item1=code_block_4.out3, item2=code_block_4.out4, item3=code_block_4.out1)
code_block_5 = CodeBlock()
# ---------- code_block_5.designscript (2 lines) ----------
//number of pixels Geotiff
"200";
# ----------------------------------------
code_block_6 = CodeBlock { -3; }
code_block_7 = CodeBlock()
# ---------- code_block_7.designscript (2 lines) ----------
//temp filepath Geotiff
"C:/TEMP/test21.tiff";
# ----------------------------------------
code_block_8 = CodeBlock()
# ---------- code_block_8.designscript (10 lines) ----------
//CHOOSE AHN-LAYER

//maaiveld resolutie 0.5 m
"ahn3_05m_dtm";
//maaiveld+bomen+gebouwen enz. resolutie 0.5 m
"ahn3_05m_dsm";
//maaiveld resolutie 5 m
"ahn3_5m_dtm";
//maaiveld+bomen+gebouwen enz. resolutie 5 m
"ahn3_5m_dsm";
# ----------------------------------------
GIS2BIM_AHN3toPoints = Custom[GIS2BIM_AHN3toPoints](RdX=code_block_2.RDX, RdY=code_block_2.RDY, BoundinxboxWidth=width_boundingbox, ResolutionGeotiff=code_block_5, WaterlevelHeight=code_block_6, FilepathName=code_block_7, Layer=code_block_8.out0)  # Load AHN3 via Geotiff WCS. Transform to local coordinates
join = List.Join(list0=list_create, list1=GIS2BIM_AHN3toPoints.Points)
byPoints = Topography.ByPoints(points=join)
python_script = Python(IN[0]=GIS2BIM_SVGToCurves_2.Structured_Curves, IN[1]=byPoints)
# ---------- python_script.python (52 lines) ----------
import clr

clr.AddReference('RevitAPI')
from Autodesk.Revit.DB import *
from Autodesk.Revit.DB.Architecture import *
import System.Collections.Generic
from System.Collections.Generic import List

clr.AddReference('RevitNodes')
import Revit
clr.ImportExtensions(Revit.GeometryConversion)

clr.AddReference('RevitServices')
from RevitServices.Transactions import TransactionManager
from RevitServices.Persistence import DocumentManager

doc = DocumentManager.Instance.CurrentDBDocument

# Get input variables
subregions = IN[0]
host = UnwrapElement(IN[1])

# Init variables
curveLoops = []
createdSubRegions = []
error = []

TransactionManager.Instance.EnsureInTransaction(doc)

# Get groups of curves (exploded polycurves!) and creates per group a SubRegion
for i in subregions:
	# Init CurveLoop for every curve group
	x = CurveLoop()
	
	# Iterate the seperate curves -> convert type to Revit Type -> add to CurveLoop
	for j in i:
		x.Append(j.ToRevitType())
	curveLoops.append(x)
	
	# Add layer to list
	y = [x]
	yI = List[CurveLoop](y)
	
	if SiteSubRegion.IsValidBoundary(yI):
		# Create SubRegion out of the CurveLoop group and add its to 'createdSubregions'
		newSubRegion = SiteSubRegion.Create(doc, yI, host.Id)
		createdSubRegions.append(newSubRegion)
	
TransactionManager.Instance.TransactionTaskDone()

# Output
OUT = createdSubRegions
# ----------------------------------------
code_block_9 = CodeBlock { "Material"; }
code_block_10 = CodeBlock { "z1_water_buiten_20gr"; }
setParameterByName = Element.SetParameterByName(element=python_script, parameterName=code_block_9, value=code_block_10)
byName = Material.ByName(name=code_block_10)
code_block_11 = CodeBlock { "s1_asfalt"; }
byName_2 = Material.ByName(name=code_block_11)
