# Dynamo graph 3.2 Location Analysis 2D maps.dyn "Location Analysis 2D maps" (Dynamo 2.2.1.5175)

# group: 4 Web Map Service(WMS)
code_block = CodeBlock { a[0]; a[1]; a[2]; a[3]; a[4]; a[5]; a[6]; a[7]; a[8]; a[9]; }  # unwired: a
watch_image = WatchImageCore(image=code_block.out0)
watch_image_2 = WatchImageCore(image=code_block.out2)
watch_image_3 = WatchImageCore(image=code_block.out1)
watch_image_4 = WatchImageCore(image=code_block.out3)
watch_image_5 = WatchImageCore(image=code_block.out5)
watch_image_6 = WatchImageCore(image=code_block.out4)
watch_image_7 = WatchImageCore(image=code_block.out6)
watch_image_8 = WatchImageCore(image=code_block.out7)
watch_image_9 = WatchImageCore(image=code_block.out8)
watch_image_10 = WatchImageCore(image=code_block.out9)

# group: 2. GEOCODING/COORDINATE REFERENCE SYSTEM
code_block_2 = CodeBlock { "dordrecht"; "werf van schouten"; "501"; }
GIS2BIM_GetLocationdataNetherlands = Custom[GIS2BIM_GetLocationdataNetherlands](City=code_block_2.out0, Streetname=code_block_2.out1, Housenumber=code_block_2.out2)  # Gives locationdata based on an adress in the Netherlands

code_block_3 = CodeBlock { 150; }
locationAnalysisNetherlands = Custom[GIS2BIM.LocationAnalysisNetherlands](Rdx=GIS2BIM_GetLocationdataNetherlands.RDcoordinateXmeters, Rdy=GIS2BIM_GetLocationdataNetherlands.RDcoordinateYmeters, WidthSmallBoundingbox=code_block_3)  # Location Analysis of a location in The Netherlands
watch_image_11 = WatchImageCore(image=locationAnalysisNetherlands.WMTS_Opentopo_Medium)
watch_image_12 = WatchImageCore(image=locationAnalysisNetherlands.WMTS_Opentopo_Large)
watch_image_13 = WatchImageCore(image=locationAnalysisNetherlands.WMTS_BGT_Small)
watch_image_14 = WatchImageCore(image=locationAnalysisNetherlands.WMTS_AHN3_Small)
watch_image_15 = WatchImageCore(image=locationAnalysisNetherlands.WMTS_geomorfologischekaart50000)
watch_image_16 = WatchImageCore(image=locationAnalysisNetherlands.WMTS_bodemkaart50000)
watch_image_17 = WatchImageCore(image=locationAnalysisNetherlands.WMTS_natura2000)
watch_image_18 = WatchImageCore(image=locationAnalysisNetherlands.WMS_Small_Luchtfoto_2016)
watch_image_19 = WatchImageCore(image=locationAnalysisNetherlands.WMS_Small_Luchtfoto_2017)
watch_image_20 = WatchImageCore(image=locationAnalysisNetherlands.WMS_Small_Luchtfoto_2018)
watch_image_21 = WatchImageCore(image=locationAnalysisNetherlands.WMS_Geluidskaart_alle_bronnen)
watch_image_22 = WatchImageCore(image=locationAnalysisNetherlands.WMS_Bestemmingsplan_bouwvlak)
watch_image_23 = WatchImageCore(image=locationAnalysisNetherlands.WMTS_Opentopo_Small)
watch_image_24 = WatchImageCore(image=locationAnalysisNetherlands.WMTS_Kadaster_Small)
create = List.Create(item0=watch_image_23, item1=watch_image_24)
GIS2BIM_MergeImages = Custom[GIS2BIM_MergeImages](images=create)  # Merges a list of images to 1 image
watch_image_25 = WatchImageCore(image=GIS2BIM_MergeImages)
watch_image_26 = WatchImageCore(image=locationAnalysisNetherlands.WMS_Bestemmingsplankaart)
watch_image_27 = WatchImageCore(image=locationAnalysisNetherlands.WMS_CBS_WOZ_waarde_2011)
watch_image_28 = WatchImageCore(image=locationAnalysisNetherlands.WMS_CBS_WOZ_waarde_2011_Legenda)

# group: COORDINATE REFERENCE SYSTEMS
code_block_4 = CodeBlock { "4326"; "28992"; }
GIS2BIM_DoubleToString = Custom[GIS2BIM_DoubleToString](CoordinateDouble=GIS2BIM_GetLocationdataNetherlands.RDcoordinateXmeters)  # Converts a double to a string
GIS2BIM_DoubleToString_2 = Custom[GIS2BIM_DoubleToString](CoordinateDouble=GIS2BIM_GetLocationdataNetherlands.RDcoordinateYmeters)
GIS2BIM_TransformCRS_epsg = Custom[GIS2BIM_TransformCRS_epsg](SourceCRS=code_block_4.out1, TargetCRS=code_block_4.out0, xCoordinate=GIS2BIM_DoubleToString, yCoordinate=GIS2BIM_DoubleToString_2)  # Uses the API of http://epsg.io to transform Coordinate Reference Systems
code_block_5 = CodeBlock { "28992"; }
GIS2BIM_SearchCRS = Custom[GIS2BIM_SearchCRS](EPSG_Code=code_block_5)  # Search for a Coordinate Reference System
