# Grasshopper definition 3D BAG.gh (Grasshopper 1.0.7)
# plug-ins: Pufferfish, LunchBox

panel = Panel("http://3dbag.bk.tudelft.nl/data/wfs?&request=GetFeature&typeName=BAG3D:pand3d&outputFormat=GML3&bbox=108311,446935,108711,447335")
c_script = CSharpScript(url=panel)  # -> out, A; inputs url: String
# ---------- c_script: C# usings ----------
using System.IO;
# ---------- c_script: C# ----------
    System.Net.HttpWebRequest req = (System.Net.HttpWebRequest) System.Net.WebRequest.Create(url);

    System.Net.HttpWebResponse res = (System.Net.HttpWebResponse) req.GetResponse();

    // Get the stream associated with the response.
    Stream receiveStream = res.GetResponseStream();
    StreamReader readStream = new StreamReader (receiveStream, System.Text.Encoding.UTF8);

    A = readStream.ReadToEnd();

    res.Close();
    readStream.Close();
# ---------- end c_script ----------
panel_2 = Panel(""".//{3dbag}identificatie
.//{3dbag}bouwjaar
.//{http://www.opengis.net/gml}posList
.//{3dbag}ground-0.00
.//{3dbag}ground-0.50
.//{3dbag}roof-0.00
.//{3dbag}roof-0.99
.//{3dbag}roof-0.50""")
xml = ReadXMLByTag(XML=c_script.A, XMLTag="gml:posList")  # -> XMLInnerText, XMLInnerXML
idexlist = ItemIndexList(List=".//{3dbag}identificatie")
idexlist_2 = ItemIndexList()
python = GhPythonScript(xml=c_script.A, XPATH=panel_2)  # -> out, a
# ---------- python: Python ----------
__author__ = "Maarten"
__version__ = "2018.12.15"

#import rhinoscriptsyntax as rs

import sys
sys.path.append("C:\Program Files (x86)\IronPython 2.7\Lib")

import xml.etree.ElementTree as ET 
xml = xml
xpathlist = XPATH

root = ET.fromstring(xml)

xpathsfound = []

for i in xpathlist:
	xpathsfound.append(root.findall(i))
	
xpathresult = []
for i in range(len(xpathsfound)):
	xtext = []
	for j in range(len(xpathsfound[0])):
		try: xtext.append(xpathsfound[i][j].text)
		except: xtext.append("_none")
	xpathresult.append(xtext)

a = xpathresult
# ---------- end python ----------
