# Dynamo custom node GIS2BIM.BGT2D.dyf "GIStoBIM.BGT2D" (Dynamo 1.3.1.1736)
# category: GIS2BIM.DutchGEO
# Create 2D BGT siteplan from set of GML-files

FilledRegionRoad2 = Input()
View = Input()
Directory = Input()

# group: GML INPUT
bgt_lagen = CodeBlock()
# ---------- bgt_lagen.designscript (18 lines) ----------
"bgt_overigbouwwerk.gml";
"bgt_begroeidterreindeel.gml";
"bgt_functioneelgebied.gml";
"bgt_gebouwinstallatie.gml";
"bgt_kunstwerkdeel.gml";
"bgt_onbegroeidterreindeel.gml";
"bgt_ondersteunendwegdeel.gml";
"bgt_overigescheiding.gml";
"bgt_scheiding.gml";
"bgt_spoor.gml";
"bgt_tunneldeel.gml";
"bgt_kunstwerkdeel.gml";
"bgt_overbruggingsdeel.gml";
"bgt_wegdeel.gml";
"bgt_ondersteunendwaterdeel.gml";
"bgt_waterdeel.gml";
"bgt_openbareruimtelabel.gml";
"bgt_vegetatieobject.gml";
# ----------------------------------------
create = List.Create(bgt_lagen.out0, bgt_lagen.out1, bgt_lagen.out2, bgt_lagen.out3, bgt_lagen.out4, bgt_lagen.out5, bgt_lagen.out6, bgt_lagen.out7, bgt_lagen.out8, bgt_lagen.out9, bgt_lagen.out10, bgt_lagen.out11, bgt_lagen.out12, bgt_lagen.out13, bgt_lagen.out14, bgt_lagen.out15, bgt_lagen.out16, bgt_lagen.out17)
string = StringInput("\")
concat = String.Concat(Directory, string)  # unwired: arg2
map = List.Map(list=create, f_x=concat)

RDx = Input()
RDy = Input()
BoundingboxWidth = Input()

# group: CREATE BOUNDINGBOX AND FILTER GML
string_2 = StringInput(".//{http://www.opengis.net/gml}posList")
filterGML = Custom[GIStoBIM.FilterGML](xPATH=string_2, CoordinateX=RDx, CoordinateY=RDy, Boundingbox=BoundingboxWidth)  # filter GML-file based on boundingbox; unwired: GMLFile
map_2 = List.Map(list=map, f_x=filterGML.Polycurves)

watch = Watch(map_2)
LineStyleBGT_onbegroeidterreindeel = Input()

# group: PLACE TREES
code_block = CodeBlock { 17; }
getItemAtIndex = List.GetItemAtIndex(list=map, index=code_block)
string_3 = StringInput(".//{http://www.opengis.net/gml}pos")
filterGML_2 = Custom[GIStoBIM.FilterGML](GMLFile=getItemAtIndex, xPATH=string_3, CoordinateX=RDx, CoordinateY=RDy, Boundingbox=BoundingboxWidth)
flatten = Flatten(filterGML_2.Points)

DetailcomponentTree = Input()

# group: clockwork familyinstance by point in view
code_block_2 = CodeBlock(item=flatten) { Flatten({item}); }
python_script = Python(IN[0]=code_block_2, IN[1]=DetailcomponentTree, IN[2]=View)
# ---------- python_script.python (31 lines) ----------
import clr
clr.AddReference('RevitAPI')
from Autodesk.Revit.DB import *

clr.AddReference("RevitNodes")
import Revit
clr.ImportExtensions(Revit.Elements)
clr.ImportExtensions(Revit.GeometryConversion)

clr.AddReference("RevitServices")
import RevitServices
from RevitServices.Persistence import DocumentManager
from RevitServices.Transactions import TransactionManager

doc = DocumentManager.Instance.CurrentDBDocument
points = UnwrapElement(IN[0])
famtype = UnwrapElement(IN[1])
lvl = UnwrapElement(IN[2])
elementlist = list()
counter = 0

TransactionManager.Instance.EnsureInTransaction(doc)
# make sure familysymbol is active
if famtype.IsActive == False:
	famtype.Activate()
	doc.Regenerate()
for point in points:
	newobj = doc.Create.NewFamilyInstance(point.ToXyz(),famtype,lvl)
	elementlist.append(newobj.ToDSType(False))
TransactionManager.Instance.TransactionTaskDone()
OUT = elementlist
# ----------------------------------------
python_script_2 = Python(IN[0]=flatten, IN[1]=python_script)
# ---------- python_script_2.python (4 lines) ----------
check = IN[0]
items = IN[1]
if isinstance(check, (list)): OUT = items
else: OUT = items[0]
# ----------------------------------------

Output = Output(python_script_2)  # ""
FilledRegionGreen2 = Input()
FilledRegionPand = Input()
FilledRegionGreen1 = Input()
FilledRegionRoad = Input()
FilledRegionWater = Input()

# group: CREATE FILLED REGIONS
code_block_3 = CodeBlock { 5; }
getItemAtIndex_2 = List.GetItemAtIndex(list=watch, index=code_block_3)
explode = Geometry.Explode(getItemAtIndex_2)
byCurves = FilledRegion.ByCurves(View, explode, FilledRegionGreen2)
code_block_4 = CodeBlock { 0; }
getItemAtIndex_3 = List.GetItemAtIndex(list=watch, index=code_block_4)
explode_2 = Geometry.Explode(getItemAtIndex_3)
byCurves_2 = FilledRegion.ByCurves(View, explode_2, FilledRegionPand)
code_block_5 = CodeBlock { 1; }
getItemAtIndex_4 = List.GetItemAtIndex(list=watch, index=code_block_5)
explode_3 = Geometry.Explode(getItemAtIndex_4)
byCurves_3 = FilledRegion.ByCurves(View, explode_3, FilledRegionGreen1)
byCurves_4 = FilledRegion.ByCurves(View, explode_3, FilledRegionGreen2)
code_block_6 = CodeBlock { 11; }
getItemAtIndex_5 = List.GetItemAtIndex(list=watch, index=code_block_6)
explode_4 = Geometry.Explode(getItemAtIndex_5)
byCurves_5 = FilledRegion.ByCurves(View, explode_4, FilledRegionRoad)
code_block_7 = CodeBlock { 12; }
getItemAtIndex_6 = List.GetItemAtIndex(list=watch, index=code_block_7)
explode_5 = Geometry.Explode(getItemAtIndex_6)
byCurves_6 = FilledRegion.ByCurves(View, explode_5, FilledRegionRoad)
code_block_8 = CodeBlock { 13; }
getItemAtIndex_7 = List.GetItemAtIndex(list=watch, index=code_block_8)
explode_6 = Geometry.Explode(getItemAtIndex_7)
byCurves_7 = FilledRegion.ByCurves(View, explode_6, FilledRegionRoad)
code_block_9 = CodeBlock { 14; }
getItemAtIndex_8 = List.GetItemAtIndex(list=watch, index=code_block_9)
explode_7 = Geometry.Explode(getItemAtIndex_8)
byCurves_8 = FilledRegion.ByCurves(View, explode_7, FilledRegionWater)
code_block_10 = CodeBlock { 15; }
getItemAtIndex_9 = List.GetItemAtIndex(list=watch, index=code_block_10)
explode_8 = Geometry.Explode(getItemAtIndex_9)
byCurves_9 = FilledRegion.ByCurves(View, explode_8, FilledRegionWater)

Output_2 = Output(byCurves)  # ""
Output_3 = Output(byCurves_2)  # ""
Output_4 = Output(byCurves_3)  # ""
Output_5 = Output(byCurves_4)  # ""
Output_6 = Output(byCurves_5)  # ""
Output_7 = Output(byCurves_6)  # ""
Output_8 = Output(byCurves_7)  # ""
Output_9 = Output(byCurves_8)  # ""
Output_10 = Output(byCurves_9)  # ""
LineStyleBGT_functioneelgebied = Input()
LineStyleBGT_gebouwinstallatie = Input()
LineStyleBGT_kunstwerkdeel = Input()
Output_11 = Output()  # ""; unwired: arg0
LineStyleBGT_ondersteunendwegdeel = Input()
LineStyleBGT_overigescheiding = Input()
LineStyleBGT_scheiding = Input()
LineStyleBGT_spoor = Input()
LineStyleBGT_tunneldeel = Input()

# group: CREATE DETAILLINES
code_block_11 = CodeBlock(t3=watch)
# ---------- code_block_11.designscript (9 lines) ----------
DSCore.List.GetItemAtIndex(t3, 2);
DSCore.List.GetItemAtIndex(t3, 3);
DSCore.List.GetItemAtIndex(t3, 4);
DSCore.List.GetItemAtIndex(t3, 5);
DSCore.List.GetItemAtIndex(t3, 6);
DSCore.List.GetItemAtIndex(t3, 7);
DSCore.List.GetItemAtIndex(t3, 8);
DSCore.List.GetItemAtIndex(t3, 9);
DSCore.List.GetItemAtIndex(t3, 10);
# ----------------------------------------
createDetailLinesFromPolygons = Custom[GIStoBIM.CreateDetailLinesFromPolygons](View=View, PolyCurves=code_block_11.out3, Linestyle=LineStyleBGT_onbegroeidterreindeel)  # Create detaillines from polygons in a view
createDetailLinesFromPolygons_2 = Custom[GIStoBIM.CreateDetailLinesFromPolygons](View=View, PolyCurves=code_block_11.out0, Linestyle=LineStyleBGT_functioneelgebied)
createDetailLinesFromPolygons_3 = Custom[GIStoBIM.CreateDetailLinesFromPolygons](View=View, PolyCurves=code_block_11.out1, Linestyle=LineStyleBGT_gebouwinstallatie)
createDetailLinesFromPolygons_4 = Custom[GIStoBIM.CreateDetailLinesFromPolygons](View=View, PolyCurves=code_block_11.out0, Linestyle=LineStyleBGT_kunstwerkdeel)
createDetailLinesFromPolygons_5 = Custom[GIStoBIM.CreateDetailLinesFromPolygons](View=View, PolyCurves=code_block_11.out4, Linestyle=LineStyleBGT_ondersteunendwegdeel)
createDetailLinesFromPolygons_6 = Custom[GIStoBIM.CreateDetailLinesFromPolygons](View=View, PolyCurves=code_block_11.out5, Linestyle=LineStyleBGT_overigescheiding)
createDetailLinesFromPolygons_7 = Custom[GIStoBIM.CreateDetailLinesFromPolygons](View=View, PolyCurves=code_block_11.out6, Linestyle=LineStyleBGT_scheiding)
createDetailLinesFromPolygons_8 = Custom[GIStoBIM.CreateDetailLinesFromPolygons](View=View, PolyCurves=code_block_11.out7, Linestyle=LineStyleBGT_spoor)
createDetailLinesFromPolygons_9 = Custom[GIStoBIM.CreateDetailLinesFromPolygons](View=View, PolyCurves=code_block_11.out8, Linestyle=LineStyleBGT_tunneldeel)

Output_12 = Output(createDetailLinesFromPolygons_2)  # ""
Output_13 = Output(createDetailLinesFromPolygons_3)  # ""
Output_14 = Output(createDetailLinesFromPolygons_4)  # ""
Output_15 = Output(createDetailLinesFromPolygons_5)  # ""
Output_16 = Output(createDetailLinesFromPolygons_6)  # ""
Output_17 = Output(createDetailLinesFromPolygons_7)  # ""
Output_18 = Output(createDetailLinesFromPolygons_8)  # ""
Output_19 = Output(createDetailLinesFromPolygons_9)  # ""
