# Dynamo custom node GIS2BIM.BuildCMDLASZIP.dyf "GIStoBIM.BuildCMDLASZIP" (Dynamo 1.3.1.1736)
# category: GIS2BIM.Pointcloud
# create scriptfile to run laszip

DirectoryPointcloud = Input()

# group: create datetimestamp
now = DateTime.Now()
timeOfDay = DateTime.TimeOfDay(now)
python_script = Python(IN[0]=timeOfDay)
# ---------- python_script.python (21 lines) ----------
#Copyright(c) 2016, Dimitar Venkov
# @5devene, dimitar.ven@gmail.com

import clr

def tolist(obj1):
	if hasattr(obj1,"__iter__"): return obj1
	else: return [obj1]

def output1(l1):
	if len(l1) == 1: return l1[0]
	else: return l1

num1 = tolist(IN[0])
out1 = []
for i in xrange(len(num1)):
	s1 = str(num1[i])
	if s1[-2:] == ".0": out1.append(s1[:-2])
	else: out1.append(s1)

OUT = output1(out1)
# ----------------------------------------
string = StringInput(":")
string_2 = StringInput("")
replace = String.Replace(str=python_script, searchFor=string, replaceWith=string_2)
string_3 = StringInput(".")
split = String.Split(replace, string_3)
firstItem = List.FirstItem(split)

FilePathLASZIP = Input()
string_4 = StringInput(" -i ")
Files = Input()
Filter = Input()
Reduce = Input()
Crop = Input()
Translate = Input()
Merge = Input()
PathFileFormat = Input()
code_block = CodeBlock(lasToolExe=FilePathLASZIP, importPointsFile=string_4, path=DirectoryPointcloud, files=Files, filter=Filter, reduce=Reduce, crop=Crop, translate=Translate, merge=Merge, filePath=PathFileFormat) { lasToolExe+importPointsFile+path+files+filter+reduce+crop+translate+merge+filePath; }

# group: build cmd comments and path setting
combine = FilePath.Combine(DirectoryPointcloud, firstItem)
commentmarker = StringInput("REM ")
code_block_2 = CodeBlock { "GIStoBIM"; }
code_block_3 = CodeBlock(commentMarker=commentmarker, dynName=code_block_2)
# ---------- code_block_3.designscript (20 lines) ----------
{
commentMarker+"Script based on script made by Ekko Nap",
commentMarker+"Batchscript is made with "+dynName,
commentMarker+"The program is running as a backgroundprocess. It can take some timeondproces.",
{},
"@ECHO OFF",
{}
};

//insert path setting and lastools input



{
{},
"@ECHO ON",
{},
commentMarker+"laszip is ready",
commentMarker+"credits laszip from LAStools: https://rapidlasso.com/laszip/ twitter: @LAStools email: info@rapidlasso.com"
};
# ----------------------------------------
string_5 = StringInput("set PATH=%PATH%;")
code_block_4 = CodeBlock(s1=string_5, path=DirectoryPointcloud) { s1+path; }
join = List.Join(code_block_3.out0, code_block_4, code_block, code_block_3.out1)
code_block_5 = CodeBlock(multiline_array=join) { "startLAStools.cmd"; multiline_array; }
code_block_6 = CodeBlock(path=combine, str=code_block_5.out0) { path+str; }
writeToFile = CSV.WriteToFile(code_block_6, code_block_5.multiline_array)

FilePathScriptFile = Output(code_block_6)
CommandsLASZIP = Output(code_block)
