# Dynamo custom node GIS2BIM.CombineImages.dyf "GIStoBIM.CombineImages" (Dynamo 1.3.1.1736)
# category: GIS2BIM.WebrequestActions
# combine images from wmts webrequest

ImageList = Input()  # list of filelocation of images
TileRows = Input()  # list of tilerows
minimumItem = List.MinimumItem(TileRows)
NumberOfPixels = Input()  # number of pixels
code_block = CodeBlock(rows=TileRows, minrow=minimumItem, pixel=NumberOfPixels) { (rows-minrow)*pixel; }
TileColumns = Input()  # list of tilecolumns
minimumItem_2 = List.MinimumItem(TileColumns)
code_block_2 = CodeBlock(columns=TileColumns, mincolumn=minimumItem_2, pixel=NumberOfPixels) { (columns-mincolumn)*pixel; }

# group: GET FOLDERNAME FROM PATH
firstItem = List.FirstItem(ImageList)
code_block_3 = CodeBlock { 0; }
length = String.Length(firstItem)
code_block_4 = CodeBlock { "/"; }
split = String.Split(firstItem, code_block_4)
lastItem = List.LastItem(split)
length_2 = String.Length(lastItem)
sub = length - length_2
substring = String.Substring(str=firstItem, startIndex=code_block_3, length=sub)

Layer = Input()  # name of layer
now = DateTime.Now()
timeOfDay = DateTime.TimeOfDay(now)
python_script = Python(IN[0]=timeOfDay)
# ---------- python_script.python (21 lines) ----------
#Copyright(c) 2016, Dimitar Venkov
# @5devene, dimitar.ven@gmail.com

import clr

def tolist(obj1):
	if hasattr(obj1,"__iter__"): return obj1
	else: return [obj1]

def output1(l1):
	if len(l1) == 1: return l1[0]
	else: return l1

num1 = tolist(IN[0])
out1 = []
for i in xrange(len(num1)):
	s1 = str(num1[i])
	if s1[-2:] == ".0": out1.append(s1[:-2])
	else: out1.append(s1)

OUT = output1(out1)
# ----------------------------------------
code_block_5 = CodeBlock { 8; 0; ".png"; }
substring_2 = String.Substring(str=python_script, startIndex=code_block_5.out1, length=code_block_5.out0)
code_block_6 = CodeBlock { ":"; ""; }
replace = String.Replace(str=substring_2, searchFor=code_block_6.out0, replaceWith=code_block_6.out1)
concat = String.Concat(substring, Layer, replace, code_block_5.out2)
python_script_2 = Python(IN[0]=ImageList, IN[1]=code_block, IN[2]=code_block_2, IN[3]=NumberOfPixels, IN[4]=concat)
# ---------- python_script_2.python (43 lines) ----------
import sys

sys.path.append("C:\Program Files (x86)\IronPython 2.7\Lib")
from math import *
import itertools
from itertools import islice

import clr

clr.AddReference("System.Drawing")
from System.Drawing import Image
from System.Drawing import Bitmap
from System.Drawing import Graphics
from System.Drawing.Imaging import ImageFormat
from System.IO import Path
from os import listdir

# The inputs to this node will be stored as a list in the IN variables.
ImageLocations = IN[0]
PixelY = IN[1]
PixelX = IN[2]
PixelWidth = IN[3]
ImageNewPath = IN[4]

TileWidth = int(sqrt(len(ImageLocations)))

# create image object for the new image
ImageWidthNew = TileWidth * PixelWidth
ImageHeightNew = TileWidth * PixelWidth
img = Bitmap(ImageWidthNew, ImageHeightNew)
g = Graphics.FromImage(img)

x=0
for ImageLocation in ImageLocations:
	a = ImageLocations[x]
	b = PixelY[x]
	c = PixelX[x]
	g.DrawImage(Image.FromFile(a), c, b)
	x= x+1
	
img.Save(ImageNewPath, ImageFormat.Png)

OUT = ImageNewPath
# ----------------------------------------
fromPath = FileObject(python_script_2)  # "File.FromPath"
readFromFile = Image.ReadFromFile(fromPath)
Watch_image = Output(readFromFile)
ImagePath = Output(concat)
