# Dynamo custom node GIS2BIM.CreateBoundingBox.dyf "GIStoBIM.CreateBoundingBox" (Dynamo 1.3.1.1736)
# category: GIS2BIM.WebrequestActions
# create boundingboxstring for webrequests based on coördinates and dimensions

CoordinateX = Input(CoordinateX: double)
BoxWidth = Input(BoxWidth: double)  # width of the boundingbox
number = DoubleInput(0.5)
mul = BoxWidth * number
x_linksonder = CoordinateX - mul
round = Math.Round(x_linksonder)
toString = Python(IN[0]=round)  # "Springs.Number.ToString"
# ---------- toString.python (21 lines) ----------
#Copyright(c) 2016, Dimitar Venkov
# @5devene, dimitar.ven@gmail.com

import clr

def tolist(obj1):
	if hasattr(obj1,"__iter__"): return obj1
	else: return [obj1]

def output1(l1):
	if len(l1) == 1: return l1[0]
	else: return l1

num1 = tolist(IN[0])
out1 = []
for i in xrange(len(num1)):
	s1 = str(num1[i])
	if s1[-2:] == ".0": out1.append(s1[:-2])
	else: out1.append(s1)

OUT = output1(out1)
# ----------------------------------------
string = StringInput(",")
CoordinateY = Input(CoordinateY: double)
BoxHeight = Input(BoxHeight: double)  # height of the boundingbox
number_2 = DoubleInput(0.5)
mul_2 = BoxHeight * number_2
y_linksonder = CoordinateY - mul_2
round_2 = Math.Round(y_linksonder)
toString_2 = Python(IN[0]=round_2)  # "Springs.Number.ToString"; same code as toString
x_rechtsboven = mul + CoordinateX
round_3 = Math.Round(x_rechtsboven)
toString_3 = Python(IN[0]=round_3)  # "Springs.Number.ToString"; same code as toString
y_rechtsboven = mul_2 + CoordinateY
round_4 = Math.Round(y_rechtsboven)
toString_4 = Python(IN[0]=round_4)  # "Springs.Number.ToString"; same code as toString
concat = String.Concat(toString, string, toString_2, string, toString_3, string, toString_4)
Boxstring = Output(concat)  # "Boxstring: string"
