# Dynamo custom node GIS2BIM.CreateBoundingBoxLATLONG.dyf "GIStoBIM.CreateBoundingBoxLATLONG" (Dynamo 1.3.1.1736)
# category: GIS2BIM.WebrequestActions
# create boundingbox with from lat/long coordinate in degrees

Lat = Input(Lat: string)
toNumber = String.ToNumber(Lat)
Long = Input(Long: string)
toNumber_2 = String.ToNumber(Long)
WidthMeters = Input(WidthMeters: double)
code_block = CodeBlock(width=WidthMeters) { width/1000; }
python_script = Python(IN[0]=toNumber, IN[1]=toNumber_2, IN[2]=code_block)
# ---------- python_script.python (134 lines) ----------
import clr
clr.AddReference('ProtoGeometry')
from Autodesk.DesignScript.Geometry import *
import math

#The inputs to this node will be stored as a list in the IN variables.
dataEnteringNode = IN
lat = IN[0]
long = IN[1]
width = IN[2]

class GeoLocation:
    '''

#    Class representing a coordinate on a sphere, most likely Earth.
#    This class is based from the code smaple in this paper:
#        http://janmatuschek.de/LatitudeLongitudeBoundingCoordinates
#    The owner of that website, Jan Philip Matuschek, is the full owner of
#    his intellectual property. This class is simply a Python port of his very
#    useful Java code. All code written by Jan Philip Matuschek and ported by me
#    (which is all of this class) is owned by Jan Philip Matuschek.
#    '''

    MIN_LAT = math.radians(-90)
    MAX_LAT = math.radians(90)
    MIN_LON = math.radians(-180)
    MAX_LON = math.radians(180)
    EARTH_RADIUS = 6378.1  # kilometers

    @classmethod
    def from_degrees(cls, deg_lat, deg_lon):
        rad_lat = math.radians(deg_lat)
        rad_lon = math.radians(deg_lon)
        return GeoLocation(rad_lat, rad_lon, deg_lat, deg_lon)

    @classmethod
    def from_radians(cls, rad_lat, rad_lon):
        deg_lat = math.degrees(rad_lat)
        deg_lon = math.degrees(rad_lon)
        return GeoLocation(rad_lat, rad_lon, deg_lat, deg_lon)

    def __init__(
            self,
            rad_lat,
            rad_lon,
            deg_lat,
            deg_lon
    ):
        self.rad_lat = float(rad_lat)
        self.rad_lon = float(rad_lon)
        self.deg_lat = float(deg_lat)
        self.deg_lon = float(deg_lon)
        self._check_bounds()

    def __str__(self):
        degree_sign = u'\N{DEGREE SIGN}'
        return ("({0:.4f}deg, {1:.4f}deg) = ({2:.6f}rad, {3:.6f}rad)").format(
            self.deg_lat, self.deg_lon, self.rad_lat, self.rad_lon)

    def _check_bounds(self):

        if (self.rad_lat < GeoLocation.MIN_LAT
            or self.rad_lat > GeoLocation.MAX_LAT
            or self.rad_lon < GeoLocation.MIN_LON
            or self.rad_lon > GeoLocation.MAX_LON):
            raise Exception("Illegal arguments")

    def distance_to(self, other, radius=EARTH_RADIUS):

        '''

        Computes the great circle distance between this GeoLocation instance
        and the other.
        '''

        return radius * math.acos(
            math.sin(self.rad_lat) * math.sin(other.rad_lat) +
            math.cos(self.rad_lat) *
            math.cos(other.rad_lat) *
            math.cos(self.rad_lon - other.rad_lon)
        )

    def bounding_locations(self, distance, radius=EARTH_RADIUS):

        '''
        Computes the bounding coordinates of all points on the surface
        of a sphere that has a great circle distance to the point represented
        by this GeoLocation instance that is less or equal to the distance argument.

        Param:
            distance - the distance from the point represented by this GeoLocation
                       instance. Must be measured in the same unit as the radius
                       argument (which is kilometers by default)
            radius   - the radius of the sphere. defaults to Earth's radius.
        Returns a list of two GeoLoations - the SW corner and the NE corner - that
        represents the bounding box.
        '''

        if radius < 0 or distance < 0:
            raise Exception("Illegal arguments")

        # angular distance in radians on a great circle

        rad_dist = distance / radius
        min_lat = self.rad_lat - rad_dist
        max_lat = self.rad_lat + rad_dist

        if min_lat > GeoLocation.MIN_LAT and max_lat < GeoLocation.MAX_LAT:
            delta_lon = math.asin(math.sin(rad_dist) / math.cos(self.rad_lat))
            min_lon = self.rad_lon - delta_lon
            if min_lon < GeoLocation.MIN_LON:
                min_lon += 2 * math.pi
            max_lon = self.rad_lon + delta_lon

            if max_lon > GeoLocation.MAX_LON:
                max_lon -= 2 * math.pi

        # a pole is within the distance
        else:

            min_lat = max(min_lat, GeoLocation.MIN_LAT)
            max_lat = min(max_lat, GeoLocation.MAX_LAT)
            min_lon = GeoLocation.MIN_LON
            max_lon = GeoLocation.MAX_LON

        return [GeoLocation.from_radians(min_lat, min_lon),
                GeoLocation.from_radians(max_lat, max_lon)]

loc = GeoLocation.from_degrees(lat,long)
distance = width
SW_loc, NE_loc = loc.bounding_locations(distance)

#Assign your output to the OUT variable.
OUT = SW_loc, NE_loc
# ----------------------------------------
firstItem = List.FirstItem(python_script)
string_from_array = FromArray(firstItem)
string = StringInput("=")
string_2 = StringInput("(")
string_3 = StringInput(")")
string_4 = StringInput("deg")
string_5 = StringInput(",")
split = String.Split(string_from_array, string, string_2, string_3, string_4, string_5)
code_block_2 = CodeBlock { 1; }
getItemAtIndex = List.GetItemAtIndex(list=split, index=code_block_2)
toNumber_3 = String.ToNumber(getItemAtIndex)
West = Output(toNumber_3)
lastItem = List.LastItem(python_script)
string_from_array_2 = FromArray(lastItem)
string_6 = StringInput("=")
string_7 = StringInput("(")
string_8 = StringInput(")")
string_9 = StringInput("deg")
string_10 = StringInput(",")
split_2 = String.Split(string_from_array_2, string_6, string_7, string_8, string_9, string_10)
code_block_3 = CodeBlock { 1; }
getItemAtIndex_2 = List.GetItemAtIndex(list=split_2, index=code_block_3)
toNumber_4 = String.ToNumber(getItemAtIndex_2)
East = Output(toNumber_4)
code_block_4 = CodeBlock { 0; }
getItemAtIndex_3 = List.GetItemAtIndex(list=split_2, index=code_block_4)
toNumber_5 = String.ToNumber(getItemAtIndex_3)
North = Output(toNumber_5)
code_block_5 = CodeBlock { 0; }
getItemAtIndex_4 = List.GetItemAtIndex(list=split, index=code_block_5)
toNumber_6 = String.ToNumber(getItemAtIndex_4)
South = Output(toNumber_6)
