# Dynamo custom node GIS2BIM.CreatePointFromGML.dyf "GIStoBIM.CreatePointFromGML" (Dynamo 1.3.1.1736)
# category: GIS2BIM.Geometry
# Create Points from space seperated GML

from_meters_to_millimeters = CodeBlock { 1000; }
XML = Input()
Tagname = Input(Tagname: string="gml:pos")
getXMLNode = Lists.DataSets.GetXMLNode(XML, Tagname)
flatten = Flatten(getXMLNode)
code_block = CodeBlock { " "; }
split = String.Split(flatten, code_block)
toNumber = String.ToNumber(split)
code_block_2 = CodeBlock { 1; 2; 0; }
rd_x = List.TakeEveryNthItem(arg1=code_block_2.out1, arg2=code_block_2.out0)  # unwired: arg0
map = List.Map(list=toNumber, f_x=rd_x)
mul = from_meters_to_millimeters * map
ModX = Input()
mul_2 = ModX * from_meters_to_millimeters
x_convert_to_local_axis = mul - mul_2
rd_y = List.TakeEveryNthItem(arg1=code_block_2.out1, arg2=code_block_2.out2)  # unwired: arg0
map_2 = List.Map(list=toNumber, f_x=rd_y)
mul_3 = from_meters_to_millimeters * map_2
ModY = Input()
mul_4 = ModY * from_meters_to_millimeters
y_convert_to_local_axis = mul_3 - mul_4
code_block_3 = CodeBlock { 0; }
byCoordinates = Point.ByCoordinates(x=x_convert_to_local_axis, y=y_convert_to_local_axis, z=code_block_3)
flatten_2 = Flatten(byCoordinates)
Point = Output(flatten_2)
