# Dynamo custom node GIS2BIM.CreatePointsPolygonFromGMLxyz.dyf "GIStoBIM.CreatePointsPolygonFromGMLxyz" (Dynamo 1.3.1.1736)
# category: GIS2BIM.Geometry
# Create points and polygons from a xml/gml-file with x,y and z value

from_meters_to_millimeters = CodeBlock { 1000; }
XML = Input()  # result webrequest
Xmltagname = Input()  # tagname within xml
getXMLNode = Lists.DataSets.GetXMLNode(XML, Xmltagname)
flatten = Flatten(getXMLNode)
code_block = CodeBlock { " "; " 0.0"; ""; }
replace = String.Replace(searchFor=code_block.out1, replaceWith=code_block.out2)  # unwired: str
map = List.Map(list=flatten, f_x=replace)
split = String.Split(map, code_block.out0)
string = StringInput("0")
eq = _ == string  # unwired: arg0
map_2 = List.Map(list=split, f_x=eq)
filterByBoolMask = List.FilterByBoolMask(list=split, mask=map_2)
toNumber = String.ToNumber(filterByBoolMask.out)
code_block_2 = CodeBlock { 1; 2; 0; }
rd_x = List.TakeEveryNthItem(arg1=code_block_2.out1, arg2=code_block_2.out0)  # unwired: arg0
map_3 = List.Map(list=toNumber, f_x=rd_x)
mul = from_meters_to_millimeters * map_3
DeltaX = Input()  # X-value of transformation of points and polygons
mul_2 = DeltaX * from_meters_to_millimeters
x_convert_to_local_axis = mul - mul_2
rd_y = List.TakeEveryNthItem(arg1=code_block_2.out1, arg2=code_block_2.out2)  # unwired: arg0
map_4 = List.Map(list=toNumber, f_x=rd_y)
mul_3 = from_meters_to_millimeters * map_4
DeltaY = Input()  # Y-value of transformation of points and polygons
mul_4 = DeltaY * from_meters_to_millimeters
y_convert_to_local_axis = mul_3 - mul_4
code_block_3 = CodeBlock { 0; }
byCoordinates = Point.ByCoordinates(x=x_convert_to_local_axis, y=y_convert_to_local_axis, z=code_block_3)
pruneDuplicates = Point.PruneDuplicates(points=byCoordinates)
Connectpolygon = Input(Connectpolygon: bool=true)  # Connect polygons from the xml
byPoints = PolyCurve.ByPoints(points=pruneDuplicates, connectLastToFirst=Connectpolygon)
PolyCurves = Output(byPoints)
Points = Output(pruneDuplicates)
