# Dynamo custom node GIS2BIM.DownloadAHN.dyf "GIStoBIM.DownloadAHN" (Dynamo 1.3.1.1736)
# category: GIS2BIM.DutchGEO
# get the mapnumber(s) of the AHN based on a given boundingbox

Urlwebrequest = Input()
web_request = WebRequest(Urlwebrequest)
code_block = CodeBlock { "ahn2:bladnr"; }
getXMLNode = Lists.DataSets.GetXMLNode(web_request, code_block)
code_block_2 = CodeBlock { 2; }
flatten = List.Flatten(list=getXMLNode, amt=code_block_2)
Mapnumber = Output(flatten)  # "Mapnumber: string"
code_block_3 = CodeBlock()
# ---------- code_block_3.designscript (3 lines) ----------
"http://geodata.nationaalgeoregister.nl/ahn2/extract/ahn2_gefilterd/u";
"http://geodata.nationaalgeoregister.nl/ahn2/extract/ahn2_uitgefilterd/u";
"https://geodata.nationaalgeoregister.nl/ahn3/extract/ahn3_laz/C_";
# ----------------------------------------
code_block_4 = CodeBlock { ".laz.zip"; ".LAZ"; }
concat = String.Concat(code_block_3.out0, arg2=code_block_4.out0)  # unwired: arg1
map = List.Map(list=flatten, f_x=concat)
Downloadlink_AHN2_gefilterd = Output(map)  # "Downloadlink_AHN2_gefilterd: string"
concat_2 = String.Concat(code_block_3.out1, arg2=code_block_4.out0)  # unwired: arg1
map_2 = List.Map(list=flatten, f_x=concat_2)
Downloadlink_AHN2_uitgefilterd = Output(map_2)  # "Downloadlink_AHN2_uitgefilterd: string"
toUpper = String.ToUpper(flatten)
concat_3 = String.Concat(code_block_3.out2, arg2=code_block_4.out1)  # unwired: arg1
map_3 = List.Map(list=toUpper, f_x=concat_3)
downloadlink_AHN3 = Output(map_3)  # "downloadlink_AHN3: string"
