# Dynamo custom node GIS2BIM.DownloadLASZIP.dyf "GIStoBIM.DownloadLASZIP" (Dynamo 1.3.1.1736)
# category: GIS2BIM.Pointcloud
# download and unzip laszip

code_block = CodeBlock { "https://github.com/DutchSailor/GIStoBIM/raw/master/supportfiles/laszip.zip"; }
Directory = Input()
code_block_2 = CodeBlock { "/laszip.zip"; "/laszip.exe"; }
concat = String.Concat(Directory, code_block_2.out0)
python_script = Python(IN[0]=code_block, IN[1]=concat)
# ---------- python_script.python (10 lines) ----------
import sys
sys.path.append("C:\Program Files (x86)\IronPython 2.7\Lib")
from System.Net import WebClient

url= IN[0]
filoc= IN[1]

WebClient().DownloadFile(url, filoc)

OUT= filoc
# ----------------------------------------
unzipFile = Custom[GIStoBIM.UnzipFile](FilePathZipFile=python_script, DirectoryToExtractTo=Directory)  # Unzip zip-file
concat_2 = String.Concat(Directory, code_block_2.out1)
Laszip = Output(concat_2)
Pathzipfile = Output(concat)
