# Dynamo custom node GIS2BIM.GetLocationdataNetherlands.dyf "GIStoBIM.GetLocationdataNetherlands" (Dynamo 1.3.1.1736)
# category: GIS2BIM.DutchGEO
# Gives locationdata based on an adress in the Netherlands

code_block = CodeBlock { "http://geodata.nationaalgeoregister.nl/locatieserver/v3/free?wt=json&q="; " and "; }
City = Input(City: string)  # name of the city in the Netherlands
Streetname = Input(Streetname: string)  # streetname
Housenumber = Input(Housenumber: string)  # housenumber
concat = String.Concat(code_block.out0, City, code_block.out1, Streetname, code_block.out1, Housenumber)
watch = Watch(concat)
web_request = WebRequest(watch)
string = StringInput("centroide_rd\":\"POINT(")
split = String.Split(web_request, string)
code_block_2 = CodeBlock { 1; 0; ")"; }
getItemAtIndex = List.GetItemAtIndex(list=split, index=code_block_2.out0)
string_2 = StringInput(" ")
split_2 = String.Split(getItemAtIndex, string_2)
getItemAtIndex_2 = List.GetItemAtIndex(list=split_2, index=code_block_2.out1)
toNumber = String.ToNumber(getItemAtIndex_2)
round = Math.Round(toNumber)
RDcoordinate_X_meters = Output(round)  # "RDcoordinate X(meters)"
getItemAtIndex_3 = List.GetItemAtIndex(list=split_2, index=code_block_2.out0)
split_3 = String.Split(getItemAtIndex_3, code_block_2.out2)
getItemAtIndex_4 = List.GetItemAtIndex(list=split_3, index=code_block_2.out1)
toNumber_2 = String.ToNumber(getItemAtIndex_4)
round_2 = Math.Round(toNumber_2)
RDcoordinate_Y_meters = Output(round_2)  # "RDcoordinate Y(meters)"
string_3 = StringInput("\"postcode\":\"")
split_4 = String.Split(web_request, string_3)
code_block_3 = CodeBlock { 1; 0; }
getItemAtIndex_5 = List.GetItemAtIndex(list=split_4, index=code_block_3.out0)
string_4 = StringInput("\",\"provincienaam\"")
split_5 = String.Split(getItemAtIndex_5, string_4)
getItemAtIndex_6 = List.GetItemAtIndex(list=split_5, index=code_block_3.out1)
Postalcode = Output(getItemAtIndex_6)
string_5 = StringInput("\"gekoppeld_perceel\":[")
split_6 = String.Split(web_request, string_5)
lastItem = List.LastItem(split_6)
string_6 = StringInput("-")
split_7 = String.Split(lastItem, string_6)
code_block_4 = CodeBlock { 1; 2; }
kadastraal_sectie = List.GetItemAtIndex(list=split_7, index=code_block_4.out0)
Sectie_kadaster = Output(kadastraal_sectie)
kadastraal_sectie_2 = List.GetItemAtIndex(list=split_7, index=code_block_4.out1)
string_7 = StringInput("\"")
split_8 = String.Split(kadastraal_sectie_2, string_7)
kadastraal_perceel = List.FirstItem(split_8)
Perceel_kadaster = Output(kadastraal_perceel)
string_8 = StringInput("centroide_ll\":\"POINT(")
split_9 = String.Split(web_request, string_8)
lastItem_2 = List.LastItem(split_9)
string_9 = StringInput(" ")
split_10 = String.Split(lastItem_2, string_9)
LONGITUDE = List.FirstItem(split_10)
Longitude = Output(LONGITUDE)
code_block_5 = CodeBlock { 1; 2; }
get_item_at_index = List.GetItemAtIndex(list=split_10, index=code_block_5.out0)
string_10 = StringInput(")")
split_11 = String.Split(get_item_at_index, string_10)
LATITUDE = List.FirstItem(split_11)
Latitude = Output(LATITUDE)
URLWebrequest = Output(watch)
