# Dynamo custom node GIS2BIM.GetMortonCodeCoordinate.dyf "GIStoBIM.GetMortonCodeCoordinate" (Dynamo 1.3.1.1736)
# category: GIS2BIM.WebrequestActions
# Get mortoncode(bitshifting) given 2 coordinates and tiledimension

X = Input(X: double)  # X-coordinate
Y = Input(Y: double)  # Y-coordinate
ModX = Input(ModX: double=-100000)  # Modification of X-coordinate
ModY = Input(ModY: double=200000)  # Modification of Y-coordinate
TileDimension = Input(TileDimension: double=2000)
python_script = Python(IN[0]=X, IN[1]=Y, IN[2]=ModX, IN[3]=ModY, IN[4]=TileDimension)
# ---------- python_script.python (29 lines) ----------
import clr
clr.AddReference('ProtoGeometry')
from Autodesk.DesignScript.Geometry import *
import sys
sys.path.append("C:\Program Files (x86)\IronPython 2.7\Lib")

import math

#The inputs to this node will be stored as a list in the IN variables.
dataEnteringNode = IN
X = IN[0]
Y = IN[1]
Xmod=IN[2]
Ymod=IN[3]
TILE=IN[4]

x = bin(int(math.floor(((X - Xmod)/TILE))))
y = bin(int(math.floor(((Y - Ymod)/TILE))))

x = str(x[2:])
y = str(y[2:])

res = "".join(i + j for i, j in zip(y, x))
z=(res)

z = int(z, 2)

#Assign your output to the OUT variable.
OUT = z
# ----------------------------------------
Z = Output(python_script)
