# Dynamo custom node GIS2BIM.LASZIPCommands.dyf "GIStoBIM.LASZIPCommands" (Dynamo 1.3.1.1736)
# category: GIS2BIM.Pointcloud
# commandline options for LASZIP

Targetdirectory = Input()
Filename = Input(Filename: string)

# group: TARGET DIRECTORY AND FILETYPE
string = StringInput("\"")
code_block = CodeBlock(stringmark=string, path=Targetdirectory, filename=Filename) { " -odir "+stringmark+path+stringmark+" -o "+stringmark+filename; }
code_block_2 = CodeBlock(stringmark=string) { ".las"+stringmark; }
code_block_3 = CodeBlock(stringmark=string) { ".pts"+stringmark+" -oparse xyzc"; }

code_block_4 = CodeBlock(las1=code_block, las2=code_block_2) { las1+las2; }
LASZIPCommand_LASfileformat = Output(code_block_4)
code_block_5 = CodeBlock(txt1=code_block, txt2=code_block_3) { txt1+txt2; }
LASZIPCommand_PTSfileformat = Output(code_block_5)
string_2 = StringInput("/")
code_block_6 = CodeBlock(path=Targetdirectory, slash=string_2, name=Filename) { path+slash+name+".pts"; }
FilePathPTS = Output(code_block_6)
code_block_7 = CodeBlock(path=Targetdirectory, slash=string_2, name=Filename) { path+slash+name+".las"; }
FilePathLAS = Output(code_block_7)
KeepEveryNthPoint = Input()

# group: REDUCE POINTCLOUD SIZE
code_block_8 = CodeBlock { " -keep_every_nth "; }
string_from_object = FromObject(KeepEveryNthPoint)
code_block_9 = CodeBlock(a=code_block_8, b=string_from_object) { a+b; }

LASZIPCommand_ReducePointCLoudSize = Output(code_block_9)
ClassificationToKeep = Input()

# group: FILTER CLASSIFICATION
code_block_10 = CodeBlock { " -keep_classification "; }
code_block_11 = CodeBlock(a=code_block_10, b=ClassificationToKeep) { a+b; }

LASZIPCommand_FilterClassification = Output(code_block_11)
string_3 = StringInput("\*.laz")
LASZIPCommand_AllLAZfiles = Output(string_3)
string_4 = StringInput(" -merged")
LASZIPCommand_MergeLAZfiles = Output(string_4)
string_5 = StringInput("\"")
LAZFile = Input()
code_block_12 = CodeBlock(Stringmarker=string_5, Path=LAZFile) { Stringmarker+Path+Stringmarker+" "; }
LASZIPCommand_SingleLAZfile = Output(code_block_12)
X = Input()
BoundingboxwidthMeters = Input()
Y = Input()

# group: CROP OPTIONS
string_6 = StringInput(" -inside")
code_block_13 = CodeBlock(bbox=BoundingboxwidthMeters) { bbox*0.5; }
sub = X - code_block_13
sub_2 = Y - code_block_13
add = X + code_block_13
add_2 = Y + code_block_13
create = List.Create(sub, sub_2, add, add_2)
code_block_14 = CodeBlock(cropBox=create) { cropBox; }
crop_string = CodeBlock(x=string_6, cropBox=code_block_14) { x+" "+cropBox[0]+" "+cropBox[1]+" "+cropBox[2]+" "+cropBox[3]; }

LASZIPCommand_Cropoptions = Output(crop_string)
TranslateX = Input()
TranslateY = Input()
code_block_15 = CodeBlock(xvalue=TranslateX, yvalue=TranslateY) { " -translate_x "+xvalue+" -translate_y "+yvalue; }
LASZIPCommand_Translate = Output(code_block_15)
code_block_16 = CodeBlock(path=Targetdirectory, name=Filename) { path+name+".csv"; }
FilePathCSV = Output(code_block_16)
code_block_17 = CodeBlock(stringmark=string) { ".csv"+stringmark+" -oparse xyzc -sep comma"; }
code_block_18 = CodeBlock(txt1=code_block, txt2=code_block_17) { txt1+txt2; }
LASZIPCommand_csvfileformat = Output(code_block_18)
