# Dynamo custom node GIS2BIM.PTStoPoints.dyf "GIStoBIM.PTStoPoints" (Dynamo 1.3.1.1736)
# category: GIS2BIM.Pointcloud
# convert a pts-file(ascii) to dynamo points

PTSFile = Input()
readText = File.ReadText(PTSFile)
python_script = Python(IN[0]=readText)
# ---------- python_script.python (25 lines) ----------
import clr
# Import RevitNodes

clr.AddReference("RevitNodes")
import Revit
import sys
sys.path.append("C:\Program Files (x86)\IronPython 2.7\Lib")

import itertools

clr.AddReference('ProtoGeometry')
from Autodesk.DesignScript.Geometry import *

input = IN[0]

pointlist = input.split()

def grouper(n, it):
    "grouper(3, 'ABCDEFG') --> ABC DEF G"
    it = iter(it)
    return iter(lambda: list(itertools.islice(it, n)), [])

pointlist = list(grouper(4, pointlist))

OUT = pointlist
# ----------------------------------------
code_block = CodeBlock(t2=python_script)
# ---------- code_block.designscript (5 lines) ----------
t1 = DSCore.List.Transpose(t2);
t5 = 1000*String.ToNumber(DSCore.List.GetItemAtIndex(t1, 0));
t6 = 1000*String.ToNumber(DSCore.List.GetItemAtIndex(t1, 1));
t7 = 1000*String.ToNumber(DSCore.List.GetItemAtIndex(t1, 2));
points = Point.ByCoordinates(t5,t6,t7);
# ----------------------------------------
Points = Output(code_block.points)
