# Dynamo custom node GIS2BIM.SetImageWidth.dyf "GIStoBIM.SetImageWidth" (Dynamo 1.3.1.1736)
# category: GIS2BIM.WebrequestActions
# set width of imported raster image

categories = Categories("RasterImages")
all_elements_of_category = ElementsOfCategory(categories)
name = Element.Name(all_elements_of_category)
Imagename = Input()  # name of the rasterimage in revit
eq = name == Imagename
filterByBoolMask = List.FilterByBoolMask(list=all_elements_of_category, mask=eq)
flatten = Flatten(filterByBoolMask.in)
code_block = CodeBlock { "Width"; }
Imagewidth = Input()  # desired width of the image
setParameterByName = Element.SetParameterByName(element=flatten, parameterName=code_block, value=Imagewidth)
