# Dynamo custom node GIS2BIM.UnzipFile.dyf "GIStoBIM.UnzipFile" (Dynamo 1.3.1.1736)
# category: GIS2BIM.WebrequestActions
# Unzip zip-file

FilePathZipFile = Input()
DirectoryToExtractTo = Input()
python_script = Python(IN[0]=FilePathZipFile, IN[1]=DirectoryToExtractTo)
# ---------- python_script.python (13 lines) ----------
import clr
clr.AddReference("System.IO.Compression.FileSystem")
from System.IO.Compression import ZipFile

#The inputs to this node will be stored as a list in the IN variables.
dataEnteringNode = IN
tzip = IN[0]
tpath = IN[1]

ZipFile.ExtractToDirectory(tzip, tpath)

#Assign your output to the OUT variable.
OUT = tpath
# ----------------------------------------
Directory = Output(python_script)
