# Dynamo custom node GIS2BIM.WMTSGeoservicesLibraryNetherlands.dyf "GIStoBIM.WMTSGeoservicesLibraryNetherlands" (Dynamo 1.3.1.1736)
# category: GIS2BIM.DutchGEO
# library with webrequests of WMTS-services in the Netherlands

code_block = CodeBlock { ""; }
join = String.Join(code_block)  # unwired: arg1, arg2
TileRow = Input()
python_script = Python(IN[0]=TileRow)
# ---------- python_script.python (21 lines) ----------
#Copyright(c) 2016, Dimitar Venkov
# @5devene, dimitar.ven@gmail.com

import clr

def tolist(obj1):
	if hasattr(obj1,"__iter__"): return obj1
	else: return [obj1]

def output1(l1):
	if len(l1) == 1: return l1[0]
	else: return l1

num1 = tolist(IN[0])
out1 = []
for i in xrange(len(num1)):
	s1 = str(num1[i])
	if s1[-2:] == ".0": out1.append(s1[:-2])
	else: out1.append(s1)

OUT = output1(out1)
# ----------------------------------------
link_kadaster = CodeBlock()
# ---------- link_kadaster.designscript (11 lines) ----------
"http://geodata.nationaalgeoregister.nl/";
"tiles/service/wmts?";
"&request=GetTile";
"&VERSION=1.0.0";
"&LAYER=";
"&STYLE=default";
"&TILEMATRIXSET=EPSG:28992";
"&TILEMATRIX=EPSG:28992:";
"&TILEROW=";
"&TILECOL=";
"&FORMAT=image/png8";
# ----------------------------------------
Layer = Input()
Zoomlevel = Input()
python_script_2 = Python(IN[0]=Zoomlevel)  # same code as python_script
concat = String.Concat(link_kadaster.out0, link_kadaster.out1, link_kadaster.out2, link_kadaster.out3, link_kadaster.out4, Layer, link_kadaster.out5, link_kadaster.out6, link_kadaster.out7, python_script_2, link_kadaster.out8)  # unwired: arg11
map = List.Map(list=python_script, f_x=concat)
TileColumn = Input()
python_script_3 = Python(IN[0]=TileColumn)  # same code as python_script
concat_2 = String.Concat(link_kadaster.out9, arg2=link_kadaster.out10)  # unwired: arg1
map_2 = List.Map(list=python_script_3, f_x=concat_2)
combine = List.Combine(join, map, map_2)
URL = Output(combine)
