# Dynamo custom node GIS2BIM.WMTSLayersNetherlands.dyf "GIStoBIM.WMTSLayersNetherlands" (Dynamo 1.3.1.1736)
# category: GIS2BIM.DutchGEO
# Library with layers for webrequests of WMTS-services in the Netherlands

code_block = CodeBlock()
# ---------- code_block.designscript (39 lines) ----------
"brtachtergrondkaart";
"brtachtergrondkaartgrijs";
"brtachtergrondkaartpastel";
"bro";
"top10nlv2";
"kadastralekaartv2";
"kadastralekaartv3";
"natura2000";
"aan";
"top50vector";
"bag";
"top25raster";
"top50raster";
"top100raster";
"top250raster";
"top500raster";
"top1000raster";
"nok2011";
"brpgewaspercelen";
"bgtstandaard";
"bgtlijngericht";
"bgtachtergrond";
"bgtomtrekgericht";
"ahn1_100m";
"ahn1_25m";
"ahn1_5m";
"ahn2_5m";
"ahn2_05m_non";
"ahn2_05m_int";
"ahn2_05m_ruw";
"ahn3_5m_dsm";
"ahn3_5m_dtm";
"ahn3_05m_dsm";
"ahn3_05m_dtm";
"opentopo";
"opentopoachtergrondkaart";
"2016_ortho25";
"2016_ortho25IR";
"lufolabels";
# ----------------------------------------
kadastralekaartv3 = Output(code_block.out6)
top1000raster = Output(code_block.out16)
brpgewaspercelen = Output(code_block.out18)
opentopoachtergrondkaart = Output(code_block.out35)
n2016_ortho25IR = Output(code_block.out37)  # "2016_ortho25IR"
bgtomtrekgericht = Output(code_block.out22)
bgtachtergrond = Output(code_block.out21)
bgtlijngericht = Output(code_block.out20)
kadastralekaartv2 = Output(code_block.out5)
natura2000 = Output(code_block.out7)
top50vector = Output(code_block.out9)
top25raster = Output(code_block.out11)
top50raster = Output(code_block.out12)
top100raster = Output(code_block.out13)
top250raster = Output(code_block.out14)
top500raster = Output(code_block.out15)
nok2011 = Output(code_block.out17)
bgtstandaard = Output(code_block.out19)
ahn3_5m_dtm = Output(code_block.out31)
ahn3_05m_dsm = Output(code_block.out32)
ahn3_05m_dtm = Output(code_block.out33)
opentopo = Output(code_block.out34)
n2016_ortho25 = Output(code_block.out36)  # "2016_ortho25"
lufolabels = Output(code_block.out38)
ahn3_5m_dsm = Output(code_block.out30)
ahn2_05m_ruw = Output(code_block.out29)
ahn1_25m = Output(code_block.out24)
ahn1_5m = Output(code_block.out25)
ahn2_5m = Output(code_block.out26)
ahn2_05m_non = Output(code_block.out27)
ahn2_05m_int = Output(code_block.out28)
ahn1_100m = Output(code_block.out23)
top10nlv2 = Output(code_block.out4)
aan = Output(code_block.out8)
bag = Output(code_block.out10)
brtachtergrondkaart = Output(code_block.out0)
brtachtergrondkaartgrijs = Output(code_block.out1)
brtachtergrondkaartpastel = Output(code_block.out2)
bro = Output(code_block.out3)
