# Dynamo custom node GIS2BIM.WMTSRequestAndImport.dyf "GIStoBIM.WMTSRequestAndImport" (Dynamo 1.3.1.1736)
# category: GIS2BIM.DutchGEO
# total node with WMTS webrequest and import of image in view

Zoomlevel = Input()
WMTSScaleSetNetherlands = Custom[GIStoBIM.WMTSScaleSetNetherlands](Zoomlevel=Zoomlevel)  # gives resolution, scaledenominator and number of tiles
Rdx = Input()
Rdy = Input()
WMTSZoomLevelTileRow = Custom[GIStoBIM.WMTSZoomLevelTileRow](Resolution=WMTSScaleSetNetherlands.Resolutie_m_pixel, Rdx=Rdx, Rdy=Rdy)  # gives the tilerow and tilecolumn for the WMTS webrequest
pixelWidth = CodeBlock { 256; }
Boundingboxwidth = Input()
WMTSTileListFromBbox = Custom[GIStoBIM.WMTSTileListFromBbox](TileRow=WMTSZoomLevelTileRow.TileRow, TileColumn=WMTSZoomLevelTileRow.TileColumn, Resolution=WMTSScaleSetNetherlands.Resolutie_m_pixel, PixelWidth=pixelWidth, Bbox=Boundingboxwidth)  # gives list of tilerows and tilecolums
View = Input()
Layer = Input()
WMTSGeoservicesLibraryNetherlands = Custom[GIStoBIM.WMTSGeoservicesLibraryNetherlands](TileRow=WMTSTileListFromBbox.TileRows, TileColumn=WMTSTileListFromBbox.TileColumns, Zoomlevel=WMTSScaleSetNetherlands.Zoomlevel, Layer=Layer)  # library with webrequests of WMTS-services in the Netherlands
TemppathFiles = Input()
webrequestWMTS = Custom[GIStoBIM.WebrequestWMTS](WMTSWebrequest=WMTSGeoservicesLibraryNetherlands, Temppath=TemppathFiles, TileRow=WMTSTileListFromBbox.TileRows, TileColumn=WMTSTileListFromBbox.TileColumns, Layer=Layer, Zoomlevel=Zoomlevel)
combineImages = Custom[GIStoBIM.CombineImages](ImageList=webrequestWMTS.TileFiles, TileRows=WMTSTileListFromBbox.TileRows, TileColumns=WMTSTileListFromBbox.TileColumns, NumberOfPixels=pixelWidth, Layer=webrequestWMTS.Layer)  # combine images from wmts webrequest
importImageInView = Custom[GIStoBIM.ImportImageInView](ImageWidthMeters=WMTSTileListFromBbox.TotalTileWidthMetrs, View=View, ImagePath=combineImages.ImagePath, Deltax=WMTSZoomLevelTileRow.DeltaX, Deltay=WMTSZoomLevelTileRow.DeltaY)  # Import rasterimage in view
Image = Output(combineImages.Watch_image)
