# Dynamo custom node GIS2BIM.WMTSScaleSetNetherlands.dyf "GIStoBIM.WMTSScaleSetNetherlands" (Dynamo 1.3.1.1736)
# category: GIS2BIM.DutchGEO
# gives resolution, scaledenominator and number of tiles

COMMENTS = CodeBlock()
# ---------- COMMENTS.designscript (3 lines) ----------
"Well-known scale set Nederland";
"https://www.geonovum.nl/sites/default/files/nederlandse_richtlijn_tiling_-_versie_1.1.pdf";
"Zoomlevel,Resolutie(m/pixel), scaleDenominator, numberofTiles)";
# ----------------------------------------
code_block = CodeBlock()
# ---------- code_block.designscript (17 lines) ----------
Zoomniveau0 = {0,3440.640,12288000,1};
Zoomniveau1 = {1,1720.320,6144000,2};
Zoomniveau2 = {2,860.160,3072000,4};
Zoomniveau3 = {3,430.080,1536000,8};
Zoomniveau4 = {4,215.040,768000,16};
Zoomniveau5 = {5,107.520,384000,32};
Zoomniveau6 = {6,53.720,192000,64};
Zoomniveau7 = {7,26.880,96000,128};
Zoomniveau8 = {8,13.440,48000,256};
Zoomniveau9 = {9,6.720,24000,512};
Zoomniveau10 = {10,3.360,12000,1024};
Zoomniveau11 = {11,1.680,6000,2048};
Zoomniveau12 = {12,0.840,3000,4096};
Zoomniveau13 = {13,0.420,1500,8192};
Zoomniveau14 = {14,0.210,750,16384};
Zoomniveau15 = {15,0.105,375,32768};
Zoomniveau16 = {16,0.0575,187.5,65536};
# ----------------------------------------
create = List.Create(code_block.Zoomniveau0, code_block.Zoomniveau1, code_block.Zoomniveau2, code_block.Zoomniveau3, code_block.Zoomniveau4, code_block.Zoomniveau5, code_block.Zoomniveau6, code_block.Zoomniveau7, code_block.Zoomniveau8, code_block.Zoomniveau9, code_block.Zoomniveau10, code_block.Zoomniveau11, code_block.Zoomniveau12, code_block.Zoomniveau13, code_block.Zoomniveau14, code_block.Zoomniveau15, code_block.Zoomniveau16)
Zoomlevel = Input(Zoomlevel: int=14)
code_block_2 = CodeBlock(t2=create, index=Zoomlevel) { t3 = DSCore.List.GetItemAtIndex(t2, index); }
code_block_3 = CodeBlock(t3=code_block_2) { t4 = DSCore.List.GetItemAtIndex(t3, 0); }
Zoomlevel_2 = Output(code_block_3)  # "Zoomlevel"
code_block_4 = CodeBlock(t3=code_block_2) { t4 = DSCore.List.GetItemAtIndex(t3, 1); }
Resolutie_m_pixel = Output(code_block_4)  # "Resolutie(m/pixel)"
code_block_5 = CodeBlock(t3=code_block_2) { t4 = DSCore.List.GetItemAtIndex(t3, 2); }
ScaleDenominator = Output(code_block_5)
code_block_6 = CodeBlock(t3=code_block_2) { t4 = DSCore.List.GetItemAtIndex(t3, 3); }
Numberoftiles = Output(code_block_6)
