# Dynamo custom node GIS2BIM.WebrequestWMTS.dyf "GIStoBIM.WebrequestWMTS" (Dynamo 1.3.1.1736)
# category: GIS2BIM.WebrequestActions

WMTSWebrequest = Input()
code_block = CodeBlock { ""; }
join = String.Join(code_block)  # unwired: arg1, arg2
TileRow = Input()
code_block_2 = CodeBlock(TileRow=TileRow) { TileRow; }
python_script = Python(IN[0]=code_block_2)
# ---------- python_script.python (21 lines) ----------
#Copyright(c) 2016, Dimitar Venkov
# @5devene, dimitar.ven@gmail.com

import clr

def tolist(obj1):
	if hasattr(obj1,"__iter__"): return obj1
	else: return [obj1]

def output1(l1):
	if len(l1) == 1: return l1[0]
	else: return l1

num1 = tolist(IN[0])
out1 = []
for i in xrange(len(num1)):
	s1 = str(num1[i])
	if s1[-2:] == ".0": out1.append(s1[:-2])
	else: out1.append(s1)

OUT = output1(out1)
# ----------------------------------------
Temppath = Input()
code_block_3 = CodeBlock { "TR"; "TC"; ".png"; }
concat = String.Concat(Temppath, code_block_3.out0)  # unwired: arg2
map = List.Map(list=python_script, f_x=concat)
TileColumn = Input()
code_block_4 = CodeBlock(TileColumn=TileColumn) { TileColumn; }
python_script_2 = Python(IN[0]=code_block_4)  # same code as python_script
code_block_5 = CodeBlock { "Z"; }
Zoomlevel = Input()
code_block_6 = CodeBlock(Zoomlevel=Zoomlevel) { Zoomlevel; }
python_script_3 = Python(IN[0]=code_block_6)  # same code as python_script
Layer = Input()
code_block_7 = CodeBlock(Layer=Layer) { Layer; }
concat_2 = String.Concat(code_block_3.out1, arg2=code_block_5, arg3=python_script_3, arg4=code_block_7, arg5=code_block_3.out2)  # unwired: arg1
map_2 = List.Map(list=python_script_2, f_x=concat_2)
combine = List.Combine(join, map, map_2)
python_script_4 = Python(IN[0]=WMTSWebrequest, IN[1]=combine)
# ---------- python_script_4.python (11 lines) ----------
import sys
sys.path.append("C:\Program Files (x86)\IronPython 2.7\Lib")
from urllib import urlretrieve

urls= IN[0]
tempfiles= IN[1]

for url, tempfile in zip(urls, tempfiles):
    urlretrieve(url, tempfile)

OUT= tempfiles
# ----------------------------------------

# group: WAIT UNTIL ALL FILES ARE DOWNLOADED
python_script_5 = Python(IN[0]=python_script_4)
# ---------- python_script_5.python (20 lines) ----------
import sys

sys.path.append("C:\Program Files (x86)\IronPython 2.7\Lib")

import clr

clr.AddReference("mscorlib")
from System.IO import File

# The inputs to this node will be stored as a list in the IN variables.
FileLocations = IN[0]

x=0

Bools = []
for FileLocation in FileLocations:
	Bools.append(File.Exists(FileLocation))
	x= x+1

OUT = Bools
# ----------------------------------------
countTrue = CountTrue(python_script_5)
count = Count(python_script_5)
eq = countTrue == count
code_block_8 = CodeBlock { "waiting..."; }
if_ = If(test=eq, true=python_script_4, false=code_block_8)

TileFiles = Output(if_)
Layer_2 = Output(Layer)  # "Layer"
