# Dynamo custom node GIStoBIM.BGT2D.dyf (Dynamo 1.3.1.1736)
# category: GIStoBIM.DutchGEO
# Create 2D BGT siteplan from set of GML-files

view = Input()
Directory = Input()

# group: GML INPUT
bgt_lagen = CodeBlock()
# ---------- bgt_lagen.designscript (18 lines) ----------
"bgt_overigbouwwerk.gml";
"bgt_begroeidterreindeel.gml";
"bgt_functioneelgebied.gml";
"bgt_gebouwinstallatie.gml";
"bgt_kunstwerkdeel.gml";
"bgt_onbegroeidterreindeel.gml";
"bgt_ondersteunendwegdeel.gml";
"bgt_overigescheiding.gml";
"bgt_scheiding.gml";
"bgt_spoor.gml";
"bgt_tunneldeel.gml";
"bgt_kunstwerkdeel.gml";
"bgt_overbruggingsdeel.gml";
"bgt_wegdeel.gml";
"bgt_ondersteunendwaterdeel.gml";
"bgt_waterdeel.gml";
"bgt_openbareruimtelabel.gml";
"bgt_vegetatieobject.gml";
# ----------------------------------------
create = List.Create(bgt_lagen.out0, bgt_lagen.out1, bgt_lagen.out2, bgt_lagen.out3, bgt_lagen.out4, bgt_lagen.out5, bgt_lagen.out6, bgt_lagen.out7, bgt_lagen.out8, bgt_lagen.out9, bgt_lagen.out10, bgt_lagen.out11, bgt_lagen.out12, bgt_lagen.out13, bgt_lagen.out14, bgt_lagen.out15, bgt_lagen.out16, bgt_lagen.out17)
string = StringInput("\")
concat = String.Concat(Directory, string)  # unwired: arg2
map = List.Map(list=create, f_x=concat)

rdx = Input()
rdy = Input()
bbox = Input()

# group: CREATE BOUNDINGBOX AND FILTER GML
string_2 = StringInput(".//{http://www.opengis.net/gml}posList")
filterGML = Custom[GIStoBIM.FilterGML](xPATH=string_2, coordinateX=rdx, coordinateY=rdy, boundingbox=bbox)  # filter GML-file based on boundingbox; unwired: gmlFile
map_2 = List.Map(list=map, f_x=filterGML.polycurves)

watch = Watch(map_2)
FilledRegionRoad = Input()
FilledRegionWater = Input()
FilledRegionPand = Input()
FilledRegionGreen1 = Input()
FilledRegionGreen2 = Input()

# group: CREATE FILLED REGIONS
code_block = CodeBlock { 12; }
getItemAtIndex = List.GetItemAtIndex(list=watch, index=code_block)
explode = Geometry.Explode(getItemAtIndex)
byCurves = FilledRegion.ByCurves(view, explode, FilledRegionRoad)
code_block_2 = CodeBlock { 13; }
getItemAtIndex_2 = List.GetItemAtIndex(list=watch, index=code_block_2)
explode_2 = Geometry.Explode(getItemAtIndex_2)
byCurves_2 = FilledRegion.ByCurves(view, explode_2, FilledRegionRoad)
code_block_3 = CodeBlock { 14; }
getItemAtIndex_3 = List.GetItemAtIndex(list=watch, index=code_block_3)
explode_3 = Geometry.Explode(getItemAtIndex_3)
byCurves_3 = FilledRegion.ByCurves(view, explode_3, FilledRegionWater)
code_block_4 = CodeBlock { 15; }
getItemAtIndex_4 = List.GetItemAtIndex(list=watch, index=code_block_4)
explode_4 = Geometry.Explode(getItemAtIndex_4)
byCurves_4 = FilledRegion.ByCurves(view, explode_4, FilledRegionWater)
code_block_5 = CodeBlock { 0; }
getItemAtIndex_5 = List.GetItemAtIndex(list=watch, index=code_block_5)
explode_5 = Geometry.Explode(getItemAtIndex_5)
byCurves_5 = FilledRegion.ByCurves(view, explode_5, FilledRegionPand)
code_block_6 = CodeBlock { 1; }
getItemAtIndex_6 = List.GetItemAtIndex(list=watch, index=code_block_6)
explode_6 = Geometry.Explode(getItemAtIndex_6)
byCurves_6 = FilledRegion.ByCurves(view, explode_6, FilledRegionGreen1)
byCurves_7 = FilledRegion.ByCurves(view, explode_6, FilledRegionGreen2)
code_block_7 = CodeBlock { 11; }
getItemAtIndex_7 = List.GetItemAtIndex(list=watch, index=code_block_7)
explode_7 = Geometry.Explode(getItemAtIndex_7)
byCurves_8 = FilledRegion.ByCurves(view, explode_7, FilledRegionRoad)
code_block_8 = CodeBlock { 5; }
getItemAtIndex_8 = List.GetItemAtIndex(list=watch, index=code_block_8)
explode_8 = Geometry.Explode(getItemAtIndex_8)
byCurves_9 = FilledRegion.ByCurves(view, explode_8, FilledRegionGreen2)

DetailcomponentTree = Input()

# group: PLACE TREES
code_block_9 = CodeBlock { 17; }
getItemAtIndex_9 = List.GetItemAtIndex(list=map, index=code_block_9)
string_3 = StringInput(".//{http://www.opengis.net/gml}pos")
filterGML_2 = Custom[GIStoBIM.FilterGML](gmlFile=getItemAtIndex_9, xPATH=string_3, coordinateX=rdx, coordinateY=rdy, boundingbox=bbox)
flatten = Flatten(filterGML_2.points)
byPointInView = Custom[FamilyInstance.ByPointInView](point=flatten, familyType=DetailcomponentTree, view=view)  # Places a family instance at a given point in a given view (e.g. a detail component).

FilledRegionRoad2 = Input()
LineStyleBGT_functioneelgebied = Input()
LineStyleBGT_gebouwinstallatie = Input()
LineStyleBGT_kunstwerkdeel = Input()
LineStyleBGT_onbegroeidterreindeel = Input()
LineStyleBGT_ondersteunendwegdeel = Input()
LineStyleBGT_overigescheiding = Input()
LineStyleBGT_scheiding = Input()
LineStyleBGT_spoor = Input()
LineStyleBGT_tunneldeel = Input()

# group: CREATE DETAILLINES
code_block_10 = CodeBlock(t3=watch)
# ---------- code_block_10.designscript (9 lines) ----------
DSCore.List.GetItemAtIndex(t3, 2);
DSCore.List.GetItemAtIndex(t3, 3);
DSCore.List.GetItemAtIndex(t3, 4);
DSCore.List.GetItemAtIndex(t3, 5);
DSCore.List.GetItemAtIndex(t3, 6);
DSCore.List.GetItemAtIndex(t3, 7);
DSCore.List.GetItemAtIndex(t3, 8);
DSCore.List.GetItemAtIndex(t3, 9);
DSCore.List.GetItemAtIndex(t3, 10);
# ----------------------------------------
createDetailLinesFromPolygons = Custom[GIStoBIM.CreateDetailLinesFromPolygons](view=view, polyCurves=code_block_10.out0, linestyle=LineStyleBGT_functioneelgebied)  # Create detaillines from polygons in a view
createDetailLinesFromPolygons_2 = Custom[GIStoBIM.CreateDetailLinesFromPolygons](view=view, polyCurves=code_block_10.out1, linestyle=LineStyleBGT_gebouwinstallatie)
createDetailLinesFromPolygons_3 = Custom[GIStoBIM.CreateDetailLinesFromPolygons](view=view, polyCurves=code_block_10.out0, linestyle=LineStyleBGT_kunstwerkdeel)
createDetailLinesFromPolygons_4 = Custom[GIStoBIM.CreateDetailLinesFromPolygons](view=view, polyCurves=code_block_10.out3, linestyle=LineStyleBGT_onbegroeidterreindeel)
createDetailLinesFromPolygons_5 = Custom[GIStoBIM.CreateDetailLinesFromPolygons](view=view, polyCurves=code_block_10.out4, linestyle=LineStyleBGT_ondersteunendwegdeel)
createDetailLinesFromPolygons_6 = Custom[GIStoBIM.CreateDetailLinesFromPolygons](view=view, polyCurves=code_block_10.out5, linestyle=LineStyleBGT_overigescheiding)
createDetailLinesFromPolygons_7 = Custom[GIStoBIM.CreateDetailLinesFromPolygons](view=view, polyCurves=code_block_10.out6, linestyle=LineStyleBGT_scheiding)
createDetailLinesFromPolygons_8 = Custom[GIStoBIM.CreateDetailLinesFromPolygons](view=view, polyCurves=code_block_10.out7, linestyle=LineStyleBGT_spoor)
createDetailLinesFromPolygons_9 = Custom[GIStoBIM.CreateDetailLinesFromPolygons](view=view, polyCurves=code_block_10.out8, linestyle=LineStyleBGT_tunneldeel)
