# Dynamo custom node GIStoBIM.CreateDetailLinesFromPolygons.dyf (Dynamo 1.3.1.1736)
# category: GIStoBIM.Geometry
# Create detaillines from polygons in a view

polyCurves = Input()
explode = Geometry.Explode(polyCurves)
view = Input()
fromCurve = Custom[DetailLine.FromCurve](curve=explode, view=view)  # Creates a detail line based on a given curve
code_block = CodeBlock { "Line Style"; }
element_types = ElementTypes("GraphicsStyle")
all_elements_of_type = ElementsOfType(element_types)
linestyle = Input()
boolean = BoolSelector(false)
filterByName = Custom[Elements.FilterByName](elements=all_elements_of_type, searchString=linestyle, ignoreCase=boolean)  # Retrieves those elements from a collection whose names match the search string
setParameterByName = Element.SetParameterByName(element=fromCurve, parameterName=code_block, value=filterByName.first)
