# Dynamo custom node GIStoBIM.CreatePointsPolygonFromGMLxy.dyf (Dynamo 1.3.1.1736)
# category: GIStoBIM.Geometry
# Create point and polygons from a GML-file

from_meters_to_millimeters = CodeBlock { 1000; }
xml = Input()  # result webrequest
xmltagname = Input()  # tagname within xml
getXMLNode = Lists.DataSets.GetXMLNode(xml, xmltagname)
flatten = Flatten(getXMLNode)
code_block = CodeBlock { " "; }
split = String.Split(flatten, code_block)
string = StringInput("0")
eq = _ == string  # unwired: arg0
map = List.Map(list=split, f_x=eq)
filterByBoolMask = List.FilterByBoolMask(list=split, mask=map)
toNumber = String.ToNumber(filterByBoolMask.out)
code_block_2 = CodeBlock { 1; 2; 0; }
rd_x = List.TakeEveryNthItem(arg1=code_block_2.out1, arg2=code_block_2.out0)  # unwired: arg0
map_2 = List.Map(list=toNumber, f_x=rd_x)
mul = from_meters_to_millimeters * map_2
deltaX = Input()  # X-value of transformation of points and polygons
mul_2 = deltaX * from_meters_to_millimeters
x_convert_to_local_axis = mul - mul_2
rd_y = List.TakeEveryNthItem(arg1=code_block_2.out1, arg2=code_block_2.out2)  # unwired: arg0
map_3 = List.Map(list=toNumber, f_x=rd_y)
mul_3 = from_meters_to_millimeters * map_3
deltaY = Input()  # Y-value of transformation of points and polygons
mul_4 = deltaY * from_meters_to_millimeters
y_convert_to_local_axis = mul_3 - mul_4
code_block_3 = CodeBlock { 0; }
byCoordinates = Point.ByCoordinates(x=x_convert_to_local_axis, y=y_convert_to_local_axis, z=code_block_3)
pruneDuplicates = Point.PruneDuplicates(points=byCoordinates)
connectpolygon = Input(connectpolygon: bool=true)  # Connect polygons from the xml
byPoints = PolyCurve.ByPoints(points=pruneDuplicates, connectLastToFirst=connectpolygon)
PolyCurves = Output(byPoints)
Points = Output(pruneDuplicates)
