# Dynamo custom node GIStoBIM.GeoservicesLibraryNetherlands.dyf (Dynamo 1.3.1.1736)
# category: GIStoBIM.Geoservices
# Library with multiple webadresses which can be used for WFS and WMS webrequests

link_kadaster = CodeBlock()
# ---------- link_kadaster.designscript (5 lines) ----------
"http://geodata.nationaalgeoregister.nl/";
"kadastralekaartv2/wfs?";
"&request=GetFeature";
"&typeName=kadastralekaartv2:kadastralegrens";
"&bbox=";
# ----------------------------------------
BoundingBox = Input()
concat = String.Concat(link_kadaster.out0, link_kadaster.out1, link_kadaster.out2, link_kadaster.out3, link_kadaster.out4, BoundingBox)
n1_kadastrale_grenzen_WFS = Output(concat)  # "1 kadastrale grenzen(WFS)"
code_block = CodeBlock()
# ---------- code_block.designscript (6 lines) ----------
"http://afnemers.ruimtelijkeplannen.nl/afnemers/services?";
"&service=WFS";
"&version=1.1.0";
"&request=GetFeature";
"&typeName=app:Bouwvlak";
"&bbox=";
# ----------------------------------------
concat_2 = String.Concat(code_block.out0, code_block.out1, code_block.out2, code_block.out3, code_block.out4, code_block.out5, BoundingBox)
n2_ruimtelijke_plannen_WFS = Output(concat_2)  # "2 ruimtelijke plannen(WFS)"
code_block_2 = CodeBlock()
# ---------- code_block_2.designscript (5 lines) ----------
"http://geodata.nationaalgeoregister.nl/bag/wfs?";
"service=wfs&version=2.0.0&";
"request=GetFeature&typeName=";
"bag:verblijfsobject&";
"bbox=";
# ----------------------------------------
concat_3 = String.Concat(code_block_2.out0, code_block_2.out1, code_block_2.out2, code_block_2.out3, code_block_2.out4, BoundingBox)
n3_bag_verblijfsobject_WFS = Output(concat_3)  # "3 bag verblijfsobject(WFS)"
code_block_3 = CodeBlock()
# ---------- code_block_3.designscript (5 lines) ----------
"http://geodata.nationaalgeoregister.nl/bag/wfs?";
"service=wfs&version=2.0.0&";
"request=GetFeature&typeName=";
"bag:pand&";
"bbox=";
# ----------------------------------------
concat_4 = String.Concat(code_block_3.out0, code_block_3.out1, code_block_3.out2, code_block_3.out3, code_block_3.out4, BoundingBox)
n4_bag_pand_WFS = Output(concat_4)  # "4 bag pand(WFS)"
link_kadaster_2 = CodeBlock()
# ---------- link_kadaster_2.designscript (11 lines) ----------
"http://geodata.nationaalgeoregister.nl/";
"luchtfoto/rgb/wms?";
"&request=GetMap";
"&VERSION=1.3.0";
"&STYLES=default";
"&layers=2016_ortho25";
"&bbox=";
"&width=2000";
"&height=2000";
"&format=image/png";
"&crs=EPSG:28992";
# ----------------------------------------
concat_5 = String.Concat(link_kadaster_2.out0, link_kadaster_2.out1, link_kadaster_2.out2, link_kadaster_2.out3, link_kadaster_2.out4, link_kadaster_2.out5, link_kadaster_2.out6, BoundingBox, link_kadaster_2.out7, link_kadaster_2.out8, link_kadaster_2.out9, link_kadaster_2.out10)
n5_luchtfoto_2016_WMS = Output(concat_5)  # "5 luchtfoto 2016(WMS)"
link_kadaster_3 = CodeBlock()
# ---------- link_kadaster_3.designscript (11 lines) ----------
"http://geodata.nationaalgeoregister.nl/";
"cbsvierkanten100mv2/wms?";
"&request=GetMap";
"&VERSION=1.3.0";
"&STYLES=cbsvierkanten100mv2:cbsvierkanten100m_woz_waarde_woning";
"&layers=vierkant100m2011";
"&bbox=";
"&width=2000";
"&height=2000";
"&format=image/png";
"&crs=EPSG:28992";
# ----------------------------------------
concat_6 = String.Concat(link_kadaster_3.out0, link_kadaster_3.out1, link_kadaster_3.out2, link_kadaster_3.out3, link_kadaster_3.out4, link_kadaster_3.out5, link_kadaster_3.out6, BoundingBox, link_kadaster_3.out7, link_kadaster_3.out8, link_kadaster_3.out9, link_kadaster_3.out10)
n6_CBS_WOZ_waarde_2011_100m_WMS = Output(concat_6)  # "6 CBS WOZ-waarde 2011 100m (WMS)"
code_block_4 = CodeBlock { "http://geodata.nationaalgeoregister.nl/cbsvierkanten100mv2/ows?service=WMS&request=GetLegendGraphic&format=image%2Fpng&width=20&height=20&layer=vierkant100m2011&style=cbsvierkanten100m_woz_waarde_woning"; }
n6_legenda = Output(code_block_4)  # "6 legenda"
