# Dynamo custom node GIStoBIM.GetMortonCodeCoordinate.dyf (Dynamo 1.3.1.1736)
# category: GIStoBIM.WebrequestActions
# Get mortoncode given 2 coordinates and tiledimension

X = Input(X: double)  # X-coordinate
Y = Input(Y: double)  # Y-coordinate
modX = Input(modX: double=-100000)  # Modification of X-coordinate
modY = Input(modY: double=200000)  # Modification of Y-coordinate
tileDimension = Input(tileDimension: double=2000)
python_script = Python(IN[0]=X, IN[1]=Y, IN[2]=modX, IN[3]=modY, IN[4]=tileDimension)
# ---------- python_script.python (29 lines) ----------
import clr
clr.AddReference('ProtoGeometry')
from Autodesk.DesignScript.Geometry import *
import sys
sys.path.append("C:\Program Files (x86)\IronPython 2.7\Lib")

import math

#The inputs to this node will be stored as a list in the IN variables.
dataEnteringNode = IN
X = IN[0]
Y = IN[1]
Xmod=IN[2]
Ymod=IN[3]
TILE=IN[4]

x = bin(int(math.floor(((X - Xmod)/TILE))))
y = bin(int(math.floor(((Y - Ymod)/TILE))))

x = str(x[2:])
y = str(y[2:])

res = "".join(i + j for i, j in zip(y, x))
z=(res)

z = int(z, 2)

#Assign your output to the OUT variable.
OUT = z
# ----------------------------------------
Z = Output(python_script)
