# Dynamo custom node GIStoBIM.Kadaster.dyf (Dynamo 1.3.1.1736)
# category: GIStoBIM.Geometry
# Draw propertylines and place streetnames and housenumbers from the dutch kadaster

view = Input(view: Revit.View)
UrlWebrequestKadastraleAnnotatie = Input()
web_request = WebRequest(UrlWebrequestKadastraleAnnotatie)
deltaX = Input()  # X-value of transformation of points and polygons
deltaY = Input()  # Y-value of transformation of points and polygons
createPointFromGML = Custom[GIStoBIM.CreatePointFromGML](XML=web_request, modX=deltaX, modY=deltaY)  # Create Points from space seperated GML

# group: GET DATA FROM XML FOR HOUSENUMBER AND STREETNAME
code_block = CodeBlock { "kadastralekaartv3:classificatiecode"; }
getXMLNode = Lists.DataSets.GetXMLNode(web_request, code_block)
flatten = Flatten(getXMLNode)
code_block_2 = CodeBlock { "kadastralekaartv3:tekst"; }
getXMLNode_2 = Lists.DataSets.GetXMLNode(web_request, code_block_2)
flatten_2 = Flatten(getXMLNode_2)
code_block_3 = CodeBlock { "kadastralekaartv3:rotatiehoek"; }
getXMLNode_3 = Lists.DataSets.GetXMLNode(web_request, code_block_3)
flatten_3 = Flatten(getXMLNode_3)

TextTypeHousenumber = Input()
byName = TextNoteType.ByName(TextTypeHousenumber)

# group: PLACE TEXTNOTE FOR HOUSENUMBER
string = StringInput("Z02")
eq = string == flatten
filterByBoolMask = List.FilterByBoolMask(list=flatten_2, mask=eq)
flatten_4 = Flatten(filterByBoolMask.in)
string_2 = StringInput("Center")

TextTypeStreetname = Input()
byName_2 = TextNoteType.ByName(TextTypeStreetname)

# group: PLACE TEXTNOTE FOR STREETNAME
filterByBoolMask_2 = List.FilterByBoolMask(list=createPointFromGML, mask=eq)
filterByBoolMask_3 = List.FilterByBoolMask(list=flatten_3, mask=eq)
flatten_5 = Flatten(filterByBoolMask_2.out)
flatten_6 = Flatten(filterByBoolMask.out)
boolean = BoolSelector(true)
changeCase = String.ChangeCase(flatten_6, boolean)
string_3 = StringInput("Center")
flatten_7 = Flatten(filterByBoolMask_3.out)
toNumber = String.ToNumber(flatten_7)
byLocation = TextNote.ByLocation(view=view, location=flatten_5, text=changeCase, alignment=string_3, type=byName_2, rotation=toNumber)

# group (continued): PLACE TEXTNOTE FOR HOUSENUMBER
flatten_8 = Flatten(filterByBoolMask_2.in)
flatten_9 = Flatten(filterByBoolMask_3.in)
toNumber_2 = String.ToNumber(flatten_9)
byLocation_2 = TextNote.ByLocation(view=view, location=flatten_8, text=flatten_4, alignment=string_2, type=byName, rotation=toNumber_2)

PercelenaAnnotatie = Input(PercelenaAnnotatie: bool=false)
UrlWebrequestKadastraleGrenzen = Input()
code_block_4 = CodeBlock { "test"; }
if_ = If(test=PercelenaAnnotatie, true=UrlWebrequestKadastraleGrenzen, false=code_block_4)
TextTypePerceel = Input()

# group: PLACE TEXTNOTE FOR KADASTRAAL PERCEEL
web_request_2 = WebRequest(if_)
code_block_5 = CodeBlock { "gml:pos"; }
code_block_6 = CodeBlock { "kadastralekaartv3:perceelnummer_deltax"; }
getXMLNode_4 = Lists.DataSets.GetXMLNode(web_request_2, code_block_6)
flatten_10 = Flatten(getXMLNode_4)
toNumber_3 = String.ToNumber(flatten_10)
add = deltaX + toNumber_3
code_block_7 = CodeBlock { "kadastralekaartv3:perceelnummer_deltay"; }
getXMLNode_5 = Lists.DataSets.GetXMLNode(web_request_2, code_block_7)
flatten_11 = Flatten(getXMLNode_5)
toNumber_4 = String.ToNumber(flatten_11)
add_2 = deltaY + toNumber_4
createPointFromGML_2 = Custom[GIStoBIM.CreatePointFromGML](XML=web_request_2, Tagname=code_block_5, modX=add, modY=add_2)
code_block_8 = CodeBlock { "kadastralekaartv3:perceelnummer"; }
getXMLNode_6 = Lists.DataSets.GetXMLNode(web_request_2, code_block_8)
flatten_12 = Flatten(getXMLNode_6)
string_4 = StringInput("Center")
byName_3 = TextNoteType.ByName(TextTypePerceel)
code_block_9 = CodeBlock { "kadastralekaartv3:perceelnummer_rotatie"; }
getXMLNode_7 = Lists.DataSets.GetXMLNode(web_request_2, code_block_9)
flatten_13 = Flatten(getXMLNode_7)
flatten_14 = Flatten(flatten_13)
toNumber_5 = String.ToNumber(flatten_14)
byLocation_3 = TextNote.ByLocation(view=view, location=createPointFromGML_2, text=flatten_12, alignment=string_4, type=byName_3, rotation=toNumber_5)
