# Dynamo custom node GIStoBIM.KadasterPercelen.dyf (Dynamo 1.3.1.1736)
# category: GIStoBIM.Geometry
# Draw propertylines and place streetnames and housenumbers from the dutch kadaster

view = Input(view: Revit.View)
UrlWebrequestKadastraleGrenzen = Input()
deltaX = Input()  # X-value of transformation of points and polygons
deltaY = Input()  # Y-value of transformation of points and polygons
TextTypePerceel = Input()

# group: PLACE TEXTNOTE FOR KADASTRAAL PERCEEL
web_request = WebRequest(UrlWebrequestKadastraleGrenzen)
code_block = CodeBlock { "gml:pos"; }
code_block_2 = CodeBlock { "kadastralekaartv3:perceelnummer_deltax"; }
getXMLNode = Lists.DataSets.GetXMLNode(web_request, code_block_2)
flatten = Flatten(getXMLNode)
toNumber = String.ToNumber(flatten)
add = deltaX + toNumber
code_block_3 = CodeBlock { "kadastralekaartv3:perceelnummer_deltay"; }
getXMLNode_2 = Lists.DataSets.GetXMLNode(web_request, code_block_3)
flatten_2 = Flatten(getXMLNode_2)
toNumber_2 = String.ToNumber(flatten_2)
add_2 = deltaY + toNumber_2
createPointFromGML = Custom[GIStoBIM.CreatePointFromGML](XML=web_request, Tagname=code_block, modX=add, modY=add_2)  # Create Points from space seperated GML
code_block_4 = CodeBlock { "kadastralekaartv3:perceelnummer"; }
getXMLNode_3 = Lists.DataSets.GetXMLNode(web_request, code_block_4)
flatten_3 = Flatten(getXMLNode_3)
string = StringInput("Center")
byName = TextNoteType.ByName(TextTypePerceel)
code_block_5 = CodeBlock { "kadastralekaartv3:perceelnummer_rotatie"; }
getXMLNode_4 = Lists.DataSets.GetXMLNode(web_request, code_block_5)
flatten_4 = Flatten(getXMLNode_4)
flatten_5 = Flatten(flatten_4)
toNumber_3 = String.ToNumber(flatten_5)
byLocation = TextNote.ByLocation(view=view, location=createPointFromGML, text=flatten_3, alignment=string, type=byName, rotation=toNumber_3)
