# Dynamo custom node GIStoBIM.LASZIPCommands.dyf (Dynamo 1.3.1.1736)
# category: GIStoBIM.Pointcloud
# commandline options for LASZIP

Targetdirectory = Input()
Filename = Input(Filename: string)

# group: TARGET DIRECTORY AND FILETYPE
string = StringInput("\"")
code_block = CodeBlock(stringmark=string, path=Targetdirectory, filename=Filename) { " -odir "+stringmark+path+stringmark+" -o "+stringmark+filename; }
code_block_2 = CodeBlock(stringmark=string) { ".las"+stringmark; }
code_block_3 = CodeBlock(stringmark=string) { ".txt"+stringmark+" -oparse xyzc"; }

code_block_4 = CodeBlock(las1=code_block, las2=code_block_2) { las1+las2; }
LAS = Output(code_block_4)
code_block_5 = CodeBlock(txt1=code_block, txt2=code_block_3) { txt1+txt2; }
TXT = Output(code_block_5)
code_block_6 = CodeBlock(path=Targetdirectory, name=Filename) { path+name+".txt"; }
FilePathTXT = Output(code_block_6)
code_block_7 = CodeBlock(path=Targetdirectory, name=Filename) { path+name+".las"; }
FilePathLAS = Output(code_block_7)
KeepEveryNthPoint = Input()

# group: REDUCE POINTCLOUD SIZE
code_block_8 = CodeBlock { " -keep_every_nth "; }
string_from_object = FromObject(KeepEveryNthPoint)
code_block_9 = CodeBlock(a=code_block_8, b=string_from_object) { a+b; }

ReducePointCLoudSize = Output(code_block_9)
ClassificationToKeep = Input()

# group: FILTER CLASSIFICATION
code_block_10 = CodeBlock { " -keep_classification "; }
code_block_11 = CodeBlock(a=code_block_10, b=ClassificationToKeep) { a+b; }

FilterClassification = Output(code_block_11)
string_2 = StringInput("\*.laz")
AllLAZ = Output(string_2)
string_3 = StringInput(" -merged")
Merged = Output(string_3)
string_4 = StringInput("\"")
LAZFile = Input()
code_block_12 = CodeBlock(Stringmarker=string_4, Path=LAZFile) { Stringmarker+Path+Stringmarker+" "; }
SpecificLAZ = Output(code_block_12)
x = Input()
boundingboxwidthMeters = Input()
y = Input()

# group: CROP OPTIONS
string_5 = StringInput(" -inside")
code_block_13 = CodeBlock(bbox=boundingboxwidthMeters) { bbox*0.5; }
sub = x - code_block_13
sub_2 = y - code_block_13
add = x + code_block_13
add_2 = y + code_block_13
create = List.Create(sub, sub_2, add, add_2)
code_block_14 = CodeBlock(cropBox=create) { cropBox; }
crop_string = CodeBlock(x=string_5, cropBox=code_block_14) { x+" "+cropBox[0]+" "+cropBox[1]+" "+cropBox[2]+" "+cropBox[3]; }

Cropoptions = Output(crop_string)
