# Dynamo custom node GIStoBIM.SetImageWidth.dyf (Dynamo 1.3.1.1736)
# category: GIStoBIM.WebrequestActions
# set width of imported raster image

categories = Categories("RasterImages")
all_elements_of_category = ElementsOfCategory(categories)
name = Element.Name(all_elements_of_category)
imagename = Input()  # name of the rasterimage in revit
eq = name == imagename
filterByBoolMask = List.FilterByBoolMask(list=all_elements_of_category, mask=eq)
flatten = Flatten(filterByBoolMask.in)
code_block = CodeBlock { "Width"; }
imagewidth = Input()  # desired width of the image
setParameterByName = Element.SetParameterByName(element=flatten, parameterName=code_block, value=imagewidth)
