# Dynamo custom node GIStoBIM.WMTSRequestAndImport.dyf (Dynamo 1.3.1.1736)
# category: GIStoBIM.DutchGEO
# total node with WMTS webrequest and import of image in view

Zoomlevel = Input()
WMTSScaleSetNetherlands = Custom[GIStoBIM.WMTSScaleSetNetherlands](Zoomlevel=Zoomlevel)  # gives resolution, scaledenominator and number of tiles
rdx = Input()
rdy = Input()
WMTSZoomLevelTileRow = Custom[GIStoBIM.WMTSZoomLevelTileRow](Resolution=WMTSScaleSetNetherlands.Resolutie_m_pixel, Rdx=rdx, Rdy=rdy)  # gives the tilerow and tilecolumn for the WMTS webrequest
pixelWidth = CodeBlock { 256; }
Boundingboxwidth = Input()
WMTSTileListFromBbox = Custom[GIStoBIM.WMTSTileListFromBbox](TileRow=WMTSZoomLevelTileRow.TileRow, TileColumn=WMTSZoomLevelTileRow.TileColumn, Resolution=WMTSScaleSetNetherlands.Resolutie_m_pixel, PixelWidth=pixelWidth, bbox=Boundingboxwidth)  # gives list of tilerows and tilecolums
view = Input()
layer = Input()
WMTSGeoservicesLibraryNetherlands = Custom[GIStoBIM.WMTSGeoservicesLibraryNetherlands](TileRow=WMTSTileListFromBbox.TileRows, TileColumn=WMTSTileListFromBbox.TileColumns, Zoomlevel=WMTSScaleSetNetherlands.Zoomlevel, Layer=layer)  # library with webrequests of WMTS-services in the Netherlands
TemppathFiles = Input()
webrequestWMTS = Custom[GIStoBIM.WebrequestWMTS](WMTSWebrequest=WMTSGeoservicesLibraryNetherlands, temppath=TemppathFiles, TileRow=WMTSTileListFromBbox.TileRows, TileColumn=WMTSTileListFromBbox.TileColumns, Layer=layer, Zoomlevel=Zoomlevel)
combineImages = Custom[GIStoBIM.CombineImages](ImageList=webrequestWMTS.TileFiles, TileRows=WMTSTileListFromBbox.TileRows, TileColumns=WMTSTileListFromBbox.TileColumns, NumberOfPixels=pixelWidth, Layer=webrequestWMTS.Layer)  # combine images from wmts webrequest
importImageInView = Custom[GIStoBIM.ImportImageInView](ImageWidthMeters=WMTSTileListFromBbox.TotalTileWidthMetrs, view=view, ImagePath=combineImages.ImagePath, deltax=WMTSZoomLevelTileRow.DeltaX, deltay=WMTSZoomLevelTileRow.DeltaY)  # Import rasterimage in view
image = Output(combineImages.watch_image)
