# Dynamo custom node GIStoBIM.WMTSZoomLevelTileRow.dyf (Dynamo 1.3.1.1736)
# category: GIStoBIM.WebrequestActions
# gives the tilerow and tilecolumn for the WMTS webrequest

YCorner = Input(YCorner: double=903402.0)
Rdy = Input()
sub = YCorner - Rdy
PixelWidth = Input(PixelWidth: int=256)
Resolution = Input(Resolution: double)
code_block = CodeBlock(PixelWidth=PixelWidth, MetersPerPixel=Resolution) { PixelWidth*MetersPerPixel; }
NumberofTiles = Input(NumberofTiles: int)
width_height_sum_tiles = code_block * NumberofTiles
div = sub / width_height_sum_tiles
mul = div * NumberofTiles
round = Math.Round(mul)
code_block_2 = CodeBlock(row=round) { row; }
python_script = Python(IN[0]=code_block_2)
# ---------- python_script.python (21 lines) ----------
#Copyright(c) 2016, Dimitar Venkov
# @5devene, dimitar.ven@gmail.com

import clr

def tolist(obj1):
	if hasattr(obj1,"__iter__"): return obj1
	else: return [obj1]

def output1(l1):
	if len(l1) == 1: return l1[0]
	else: return l1

num1 = tolist(IN[0])
out1 = []
for i in xrange(len(num1)):
	s1 = str(num1[i])
	if s1[-2:] == ".0": out1.append(s1[:-2])
	else: out1.append(s1)

OUT = output1(out1)
# ----------------------------------------
TileRow = Output(python_script)
Rdx = Input()
XCorner = Input(XCorner: double=-285401.92)
sub_2 = Rdx - XCorner
div_2 = sub_2 / width_height_sum_tiles
mul_2 = div_2 * NumberofTiles
round_2 = Math.Round(mul_2)
code_block_3 = CodeBlock(column=round_2) { column; }
python_script_2 = Python(IN[0]=code_block_3)  # same code as python_script
TileColumn = Output(python_script_2)
sub_3 = mul_2 - round_2
code_block_4 = CodeBlock(Tilepercentage=sub_3, Pixel=PixelWidth, MeterPerPixel=Resolution) { Tilepercentage*Pixel*MeterPerPixel*1000; }
round_3 = Math.Round(code_block_4)
DeltaX = Output(round_3)
sub_4 = mul - round
code_block_5 = CodeBlock(Tilepercentage=sub_4, Pixel=PixelWidth, MeterPerPixel=Resolution) { Tilepercentage*Pixel*MeterPerPixel*1000; }
round_4 = Math.Round(code_block_5)
DeltaY = Output(round_4)
