# Dynamo custom node GIStoBIM.WebrequestWMS.dyf (Dynamo 1.3.1.1736)
# category: GIStoBIM.WebrequestActions
# imports the result(image) of a webrequest based on WMS-protocol into a view in Revit

WMSwebrequest = Input(WMSwebrequest: string)  # url for WMS webrequest
tempfolder = Input(tempfolder: string="C:/TEMP/")  # windowsfolder to save image
filename = Input()  # filename

# group: WEBREQUEST FOR FILE
code_block = CodeBlock { ".png"; }
concat = String.Concat(filename, code_block)
concat_2 = String.Concat(tempfolder, concat)
python_script = Python(IN[0]=WMSwebrequest, IN[1]=concat_2)
# ---------- python_script.python (11 lines) ----------
import sys
sys.path.append("C:\Program Files (x86)\IronPython 2.7\Lib")
from urllib import urlretrieve

url= IN[0]
tempfile= IN[1]


urlretrieve(url, tempfile)

OUT= tempfile
# ----------------------------------------
fromPath = FileObject(python_script)  # "File.FromPath"
readFromFile = Image.ReadFromFile(fromPath)
watch_image = Output(readFromFile)

view = Input()

# group: IMPORT IMAGE IN VIEW(PYTHONSCRIPT FROM DYNAMOFORUM, BY KONRAD S SOBON)
string = StringInput("/")
string_2 = StringInput("\")
replace = String.Replace(str=python_script, searchFor=string, replaceWith=string_2)
python_script_2 = Python()
# ---------- python_script_2.python (19 lines) ----------
import clr
clr.AddReference('ProtoGeometry')
from Autodesk.DesignScript.Geometry import *
#The inputs to this node will be stored as a list in the IN variables.

clr.AddReference("RevitServices")
import RevitServices
from RevitServices.Persistence import DocumentManager
from RevitServices.Transactions import TransactionManager

clr.AddReference("RevitAPI")
import Autodesk 
from Autodesk.Revit.DB import * 
import System

dataEnteringNode = IN

#Assign your output to the OUT variable.
OUT = System.Enum.GetValues(BoxPlacement)
# ----------------------------------------
code_block_2 = CodeBlock(IN=python_script_2) { IN[0]; }
code_block_3 = CodeBlock { Autodesk.Point.ByCoordinates(0,0,0); 200; }
python_script_3 = Python(IN[0]=code_block_2, IN[1]=code_block_3.out0, IN[2]=code_block_3.out1)
# ---------- python_script_3.python (37 lines) ----------
# Created by Konrad K Sobon
import clr
clr.AddReference('ProtoGeometry')
from Autodesk.DesignScript.Geometry import *
#The inputs to this node will be stored as a list in the IN variables.

clr.AddReference("RevitAPI")
import Autodesk 
from Autodesk.Revit.DB import * 

dataEnteringNode = IN

placement = IN[0]
refPt = IN[1]
res = IN[2]

iio= ImageImportOptions()

def toRvtPoint(point):
	x = point.X
	y = point.Y
	z = point.Z
	return XYZ(x,y,z)
	
message = None
if placement != None:
	iio.Placement = placement
if refPt !=None:
	iio.RefPoint = toRvtPoint(refPt)
else: 
	message = "Please specify placement point."
if res !=None:
	iio.Resolution = res
else:
	iio.Resolution = 72
	
OUT = iio
# ----------------------------------------
boolean = BoolSelector(true)
import_image = Python(IN[0]=replace, IN[1]=python_script_3, IN[2]=view, IN[3]=boolean)
# ---------- import_image.python (53 lines) ----------
#From Konrad K Sobon
#

import clr
clr.AddReference("ProtoGeometry")
from Autodesk.DesignScript.Geometry import *

# Import Element wrapper extension methods
clr.AddReference("RevitNodes")
import Revit
clr.ImportExtensions(Revit.Elements)

# Import geometry conversion extension methods
clr.ImportExtensions(Revit.GeometryConversion)

# Import DocumentManager and TransactionManager
clr.AddReference("RevitServices")
import RevitServices
from RevitServices.Persistence import DocumentManager
from RevitServices.Transactions import TransactionManager

doc = DocumentManager.Instance.CurrentDBDocument
uiapp = DocumentManager.Instance.CurrentUIApplication
app = uiapp.Application

#Import RevitAPI
clr.AddReference("RevitAPI")
import Autodesk
from Autodesk.Revit.DB import *

#inputs
dataEnteringNode = IN

filePath = IN[0]
iio = IN[1]
view = UnwrapElement(IN[2])
RunIt = IN[3]

if RunIt:
	# Start Transaction
	doc = DocumentManager.Instance.CurrentDBDocument
	TransactionManager.Instance.EnsureInTransaction(doc)

	newElement = clr.StrongBox[Element]()
	elementOut = doc.Import(file = filePath, options = iio, view = view, element = newElement)
	
	#End Transaction
	TransactionManager.Instance.TransactionTaskDone()
	message = filePath
else: 
	message = "Nee"
	
OUT = message
# ----------------------------------------

boundingboxwidth_m = Input()  # "boundingboxwidth[m]"; width of the bounding box
code_block_4 = CodeBlock(bb=boundingboxwidth_m) { bb*1000; }

# group: SET IMAGE WIDTH
string_3 = StringInput("\")
split = String.Split(import_image, string_3)
lastItem = List.LastItem(split)
setImageWidth = Custom[GIStoBIM.SetImageWidth](imagename=lastItem, imagewidth=code_block_4)  # set width of imported raster image
