# Dynamo graph ArcGISAPI.dyn (Dynamo 1.3.1.1736)

code_block = CodeBlock { "waterstreet"; "1"; "honolulu"; "USA"; }
geoCodingGoogleAPI = Custom[GIS2BIM.GeoCodingGoogleAPI](Streetname=code_block.out0, Housenumber=code_block.out1, Place=code_block.out2, Country=code_block.out3)  # gets coordinate from adress with google API
createPointsPolygonFromGMLxy = Custom[GIS2BIM.CreatePointsPolygonFromGMLxy]()  # Create point and polygons from a GML-file; unwired: XML, Xmltagname, DeltaX, DeltaY
createPointFromGML = Custom[GIS2BIM.CreatePointFromGML]()  # Create Points from space seperated GML; unwired: XML, ModX, ModY
createPointsPolygonFromGMLxyz = Custom[GIS2BIM.CreatePointsPolygonFromGMLxyz]()  # Create points and polygons from a xml/gml-file with x,y and z value; unwired: XML, Xmltagname, DeltaX, DeltaY
downloadLASZIP = Custom[GIS2BIM.DownloadLASZIP]()  # download and unzip laszip; unwired: Directory
