# Dynamo graph Pointcloud.dyn (Dynamo 1.3.1.1736)

folder = CodeBlock { "D:/GEO/AHN2"; }

# group: DOWNLOAD LASZIP
downloadLASZIP = Custom[GIS2BIM.DownloadLASZIP](Directory=folder)  # download and unzip laszip
string = StringInput("/")
string_2 = StringInput("\")
replace = String.Replace(str=folder, searchFor=string, replaceWith=string_2)

code_block = CodeBlock { "papendrecht"; "westeind"; "85"; }
getLocationdataNetherlands = Custom[GIS2BIM.GetLocationdataNetherlands](City=code_block.out0, Streetname=code_block.out1, Housenumber=code_block.out2)  # Gives locationdata based on an adress in the Netherlands
boundingboxWidthInMeters = CodeBlock { 200; }
newFileName = CodeBlock { "AHNtest4"; }
classificationToKeep = CodeBlock { 6; }
keepEveryNthPoint = CodeBlock { 10; }
pathLAZFile = CodeBlock { "D:/GEO/AHN2/C_38CZ2.LAZ"; }
use_this_as_input_if_you_do_not = CodeBlock { ""; }  # "USE THIS AS INPUT IF YOU DO NOT WANT TO USE CERTAIN EDITS"

# group: BUILD CMD
code_block_2 = CodeBlock { -1; }
mul = getLocationdataNetherlands.RDcoordinate_X_meters * code_block_2
code_block_3 = CodeBlock { -1; }
mul_2 = getLocationdataNetherlands.RDcoordinate_Y_meters * code_block_3
LASZIPCommands = Custom[GIS2BIM.LASZIPCommands](X=getLocationdataNetherlands.RDcoordinate_X_meters, Y=getLocationdataNetherlands.RDcoordinate_Y_meters, BoundingboxwidthMeters=boundingboxWidthInMeters, Targetdirectory=folder, Filename=newFileName, ClassificationToKeep=classificationToKeep, KeepEveryNthPoint=keepEveryNthPoint, LAZFile=pathLAZFile, TranslateX=mul, TranslateY=mul_2)  # commandline options for LASZIP
buildCMDLASZIP = Custom[GIS2BIM.BuildCMDLASZIP](FilePathLASZIP=downloadLASZIP.Laszip, DirectoryPointcloud=replace, Files=LASZIPCommands.LASZIPCommand_AllLAZfiles, Filter=LASZIPCommands.LASZIPCommand_FilterClassification, Reduce=LASZIPCommands.LASZIPCommand_ReducePointCLoudSize, Crop=LASZIPCommands.LASZIPCommand_Cropoptions, Merge=use_this_as_input_if_you_do_not, PathFileFormat=LASZIPCommands.LASZIPCommand_PTSfileformat, Translate=LASZIPCommands.LASZIPCommand_Translate)  # create scriptfile to run laszip

# note: Run the script
watch = Watch(buildCMDLASZIP.CommandsLASZIP)

# group: DOWNLOAD AHN
string_3 = StringInput("""import sys
sys.path.append("C:\Program Files (x86)\IronPython 2.7\Lib")
import webbrowser

links = IN[0]

for link in links:
 webbrowser.open(link)
 
OUT = links""")
createBoundingBox = Custom[GIS2BIM.CreateBoundingBox](CoordinateX=getLocationdataNetherlands.RDcoordinate_X_meters, CoordinateY=getLocationdataNetherlands.RDcoordinate_Y_meters, BoxWidth=boundingboxWidthInMeters, BoxHeight=boundingboxWidthInMeters)  # create boundingboxstring for webrequests based on coördinates and dimensions
geoservicesLibraryNetherlands = Custom[GIS2BIM.GeoservicesLibraryNetherlands](BoundingBox=createBoundingBox)  # Library with multiple webadresses which can be used for WFS and WMS webrequests
downloadAHN = Custom[GIS2BIM.DownloadAHN](Urlwebrequest=geoservicesLibraryNetherlands.11_AHN2_webrequest_bladindex)  # get the mapnumber(s) of the AHN based on a given boundingbox
open_downloadlink = PythonStringNode(script=string_3, IN[0]=downloadAHN.downloadlink_AHN3)

# note: Unfreeze this node to convert the pts-file to dynamo points
PTStoPoints = Custom[GIS2BIM.PTStoPoints](PTSFile=LASZIPCommands.FilePathPTS)  # frozen; convert a pts-file(ascii) to dynamo points
byPoints = Topography.ByPoints(PTStoPoints)  # frozen
