# Dynamo custom node GIS2BIM.CreatePointsPolygonFromGMLxy.dyf (Dynamo 1.3.1.1736)
# category: GIS2BIM.Geometry
# Create point and polygons from a GML-file

from_meters_to_millimeters = CodeBlock { 1000; }
XML = Input()  # result webrequest
XPATHSTRING = Input(XPATHSTRING: string=".//{http://www.opengis.net/gml/3.2}posList")  # XPATHSTRING

# group: PYTHON FROM BAKERY
python_script = Python(IN[0]=XML, IN[1]=XPATHSTRING)
# ---------- python_script.python (53 lines) ----------
import clr
import sys
clr.AddReference('ProtoGeometry')
from Autodesk.DesignScript.Geometry import *
sys.path.append("C:\Program Files (x86)\IronPython 2.7\Lib")
#from xml.parsers.expat import expat -- can't find this
import xml.etree.ElementTree as ET
#The inputs to this node will be stored as a list in the IN variables.
xml = IN[0]
xpathstr = IN[1]

root = ET.fromstring(xml)

xpathfound = root.findall(xpathstr)
#xparentstr = xpathstr + "/.."
#xparentfound = root.findall(xpathstr+"/..")
xtags, xtext, xcountattrib, xattrib, xattvals, xcountiter, xitertags, xitervals, xparents = [], [], [], [], [], [], [], [], []
for x in xpathfound:
	xtags.append(x.tag)
	if x.text:
		try:
			xtext.append(x.text)
		except:
			xtext.append("_none_")
	else:
		xtext.append("_none_")
	if x.keys():
		xcountattrib.append(len(x.items()))
		for name, value in x.items():
			xattrib.append(name)
			xattvals.append(value)
#PARENT CODE BELOW IS TOO SLOW
#			try:
#				xparents.append(root.find(xpathstr + "/" + name + "/.."))
#			except:
#				xparents.append("no parent found")
	else:
		xcountattrib.append(1)
		xattrib.append("_none_")
		xattvals.append("_none_")

#THIS METHOD NOT GREAT
#	if x.iter():
#		xcountiter.append(len(x.iter()))
#		for name, value in x.iter():
#			xitertags.append(name)
#			xitervals.append(value)
#for y in xparentfound:
#	xparents.append(y.tag)

OUT = root, str(root), xpathfound, xtags, xtext, xcountattrib, xattrib, xattvals
#, xparents 
#, xparentfound#, xparents#, xcountiter, xitertags, xitervals
# ----------------------------------------

code_block = CodeBlock { 4; }
getItemAtIndex = List.GetItemAtIndex(list=python_script, index=code_block)
code_block_2 = CodeBlock { " "; }
split = String.Split(getItemAtIndex, code_block_2)
string = StringInput("0")
eq = _ == string  # unwired: arg0
map = List.Map(list=split, f_x=eq)
filterByBoolMask = List.FilterByBoolMask(list=split, mask=map)
toNumber = String.ToNumber(filterByBoolMask.out)
code_block_3 = CodeBlock { 1; 2; 0; }
rd_x = List.TakeEveryNthItem(arg1=code_block_3.out1, arg2=code_block_3.out0)  # unwired: arg0
map_2 = List.Map(list=toNumber, f_x=rd_x)
mul = from_meters_to_millimeters * map_2
DeltaX = Input()  # X-value of transformation of points and polygons
mul_2 = DeltaX * from_meters_to_millimeters
x_convert_to_local_axis = mul - mul_2
rd_y = List.TakeEveryNthItem(arg1=code_block_3.out1, arg2=code_block_3.out2)  # unwired: arg0
map_3 = List.Map(list=toNumber, f_x=rd_y)
mul_3 = from_meters_to_millimeters * map_3
DeltaY = Input()  # Y-value of transformation of points and polygons
mul_4 = DeltaY * from_meters_to_millimeters
y_convert_to_local_axis = mul_3 - mul_4
code_block_4 = CodeBlock { 0; }
byCoordinates = Point.ByCoordinates(x=x_convert_to_local_axis, y=y_convert_to_local_axis, z=code_block_4)
pruneDuplicates = Point.PruneDuplicates(points=byCoordinates)
Connectpolygon = Input(Connectpolygon: bool=true)  # Connect polygons from the xml
byPoints = PolyCurve.ByPoints(points=pruneDuplicates, connectLastToFirst=Connectpolygon)
PolyCurves = Output(byPoints)
Points = Output(pruneDuplicates)
