# Dynamo custom node GIS2BIM.DownloadAHN.dyf (Dynamo 1.3.1.1736)
# category: GIS2BIM.DutchGEO
# get the mapnumber(s) of the AHN based on a given boundingbox

Urlwebrequest = Input()
web_request = WebRequest(Urlwebrequest)

# group: BAKERY
python_script = Python(IN[0]=web_request)
# ---------- python_script.python (22 lines) ----------
import sys
sys.path.append("C:\Program Files (x86)\IronPython 2.7\Lib")

import clr
clr.AddReference('ProtoGeometry')
from Autodesk.DesignScript.Geometry import *

import xml.etree.ElementTree as ET

xml = IN[0]

root = ET.fromstring(xml)

# for loop to get each element in an array
XMLelements = []
for elem in root.iter():
	XMLelements.append(elem)
	
 #xpathfound = root.findall(xpathstr)

# put returnValue in OUT
OUT = XMLelements
# ----------------------------------------
python_script_2 = Python(IN[0]=python_script)
# ---------- python_script_2.python (30 lines) ----------
import clr
import sys
clr.AddReference('ProtoGeometry')
from Autodesk.DesignScript.Geometry import *
sys.path.append("C:\Program Files (x86)\IronPython 2.7\Lib")
#from xml.parsers.expat import expat -- can't find this
import xml.etree.ElementTree as ET
#The inputs to this node will be stored as a list in the IN variables.
xmElems = IN[0]

#xmParsed = xmTree.parse(xmlFile)
#root = xmTree.getroot()
itertaglist, iterattriblist, attribnames, attribvals, itertexts = [], [], [], [], []
for elem in xmElems:
	itertaglist.append(elem.tag)
	if elem.keys():
		iterattriblist.append(len(elem.items()))
		for name, value in elem.items():
			attribnames.append(name)
			attribvals.append(value)
	else:
		iterattriblist.append(0)
		attribnames.append("no name")
		attribvals.append("no values")
	try:
		itertexts.append(elem.text)
	except:
		itertexts.append("no texts")

OUT = itertaglist, itertexts, iterattriblist, attribnames, attribvals
# ----------------------------------------

code_block = CodeBlock { 1; }
getItemAtIndex = List.GetItemAtIndex(list=python_script_2, index=code_block)
code_block_2 = CodeBlock { 3; }
getItemAtIndex_2 = List.GetItemAtIndex(list=getItemAtIndex, index=code_block_2)
Mapnumber = Output(getItemAtIndex_2)  # "Mapnumber: string"
code_block_3 = CodeBlock()
# ---------- code_block_3.designscript (3 lines) ----------
"http://geodata.nationaalgeoregister.nl/ahn2/extract/ahn2_gefilterd/u";
"http://geodata.nationaalgeoregister.nl/ahn2/extract/ahn2_uitgefilterd/u";
"https://geodata.nationaalgeoregister.nl/ahn3/extract/ahn3_laz/C_";
# ----------------------------------------
code_block_4 = CodeBlock { ".laz.zip"; ".LAZ"; }
concat = String.Concat(code_block_3.out0, arg2=code_block_4.out0)  # unwired: arg1
map = List.Map(list=getItemAtIndex_2, f_x=concat)
Downloadlink_AHN2_gefilterd = Output(map)  # "Downloadlink_AHN2_gefilterd: string"
concat_2 = String.Concat(code_block_3.out1, arg2=code_block_4.out0)  # unwired: arg1
map_2 = List.Map(list=getItemAtIndex_2, f_x=concat_2)
Downloadlink_AHN2_uitgefilterd = Output(map_2)  # "Downloadlink_AHN2_uitgefilterd: string"
toUpper = String.ToUpper(getItemAtIndex_2)
concat_3 = String.Concat(code_block_3.out2, arg2=code_block_4.out1)  # unwired: arg1
map_3 = List.Map(list=toUpper, f_x=concat_3)
downloadlink_AHN3 = Output(map_3)  # "downloadlink_AHN3: string"
