# Dynamo custom node GIS2BIM.GetSharedCoordinate.dyf (Dynamo 1.3.1.1736)
# category: GIS2BIM.Coordinates
# Get the current shared coordinate

categories = Categories("ProjectBasePoint")
all_elements_of_category = ElementsOfCategory(categories)
string = StringInput("E/W")
getParameterValueByName = Element.GetParameterValueByName(element=all_elements_of_category, parameterName=string)
code_block = CodeBlock { 1000; }
div = getParameterValueByName / code_block
flatten = Flatten(div)
flatten_2 = Flatten(flatten)
firstItem = List.FirstItem(flatten_2)
RdxMeters = Output(firstItem)
string_2 = StringInput("N/S")
getParameterValueByName_2 = Element.GetParameterValueByName(element=all_elements_of_category, parameterName=string_2)
div_2 = getParameterValueByName_2 / code_block
flatten_3 = Flatten(div_2)
flatten_4 = Flatten(flatten_3)
firstItem_2 = List.FirstItem(flatten_4)
RdyMeters = Output(firstItem_2)
