# Dynamo graph WFSKadsterBAG.dyn (Dynamo 1.3.1.1736)

# group: INPUT
code_block = CodeBlock { "Dordrecht"; "lange geldersekade"; "2"; }
views = Views()
code_block_2 = CodeBlock { "2.5 mm"; "3.5 mm"; "2.5 mm zwart"; }
boundingboxwidth_m = CodeBlock { 250; }
lineStyleKadaster = CodeBlock { "kadastrale_grens"; }
lineStyleBAGPand = StringInput("pen rood")
code_block_3 = CodeBlock { "C:/TEMP/"; }
nameArialPhoto = CodeBlock { "luchtfoto14"; }

# group: GET GEOSERVICES
getLocationdataNetherlands = Custom[GIS2BIM.GetLocationdataNetherlands](City=code_block.out0, Streetname=code_block.out1, Housenumber=code_block.out2)  # Gives locationdata based on an adress in the Netherlands
createBoundingBox = Custom[GIS2BIM.CreateBoundingBox](CoordinateX=getLocationdataNetherlands.RDcoordinate_X_meters, CoordinateY=getLocationdataNetherlands.RDcoordinate_Y_meters, BoxWidth=boundingboxwidth_m, BoxHeight=boundingboxwidth_m)  # create boundingboxstring for webrequests based on coördinates and dimensions
geoservicesLibraryNetherlands = Custom[GIS2BIM.GeoservicesLibraryNetherlands](BoundingBox=createBoundingBox)  # Library with multiple webadresses which can be used for WFS and WMS webrequests

# group: KADASTER ANNOTATION
kadasterPercelen = Custom[GIS2BIM.KadasterPercelen](DeltaX=getLocationdataNetherlands.RDcoordinate_X_meters, DeltaY=getLocationdataNetherlands.RDcoordinate_Y_meters, View=views, TextTypePerceel=code_block_2.out2, UrlWebrequestKadasterPerceel=geoservicesLibraryNetherlands.8_kadastrale_perceel)  # Draw propertylines and place streetnames and housenumbers from the dutch kadaster
kadasterHouseNumbers = Custom[GIS2BIM.KadasterHouseNumbers](UrlWebrequestKadasterAnnotation=geoservicesLibraryNetherlands.7_kadastrale_annotatie, DeltaX=getLocationdataNetherlands.RDcoordinate_X_meters, DeltaY=getLocationdataNetherlands.RDcoordinate_Y_meters, View=views, TextTypeHousenumber=code_block_2.out0, TextTypeStreetname=code_block_2.out1)

# group: KADASTRALE PERCELEN(GRENZEN)
web_request = WebRequest(geoservicesLibraryNetherlands.8_kadastrale_perceel)
code_block_4 = CodeBlock { "gml:posList"; }
createPointsPolygonFromGMLxy = Custom[GIS2BIM.CreatePointsPolygonFromGMLxy](XML=web_request, Xmltagname=code_block_4, DeltaX=getLocationdataNetherlands.RDcoordinate_X_meters, DeltaY=getLocationdataNetherlands.RDcoordinate_Y_meters)  # Create point and polygons from a GML-file
createDetailLinesFromPolygons = Custom[GIS2BIM.CreateDetailLinesFromPolygons](View=views, PolyCurves=createPointsPolygonFromGMLxy.PolyCurves, Linestyle=lineStyleKadaster)  # Create detaillines from polygons in a view

# group: GET AERIAL PHOTO
webrequestWMS = Custom[GIS2BIM.WebrequestWMS](WMSwebrequest=geoservicesLibraryNetherlands.5_luchtfoto_2016_WMS, Boundingboxwidth=boundingboxwidth_m, View=views, Tempfolder=code_block_3, Filename=nameArialPhoto)  # imports the result(image) of a webrequest based on WMS-protocol into a view in Revit
watch_image = WatchImageCore(webrequestWMS)

filledregiontypebag_pand = FilledRegionTypes()

# group: BAG: pand
web_request_2 = WebRequest(geoservicesLibraryNetherlands.4_bag_pand_WFS)
code_block_5 = CodeBlock { "gml:posList"; }
boolean = BoolSelector(true)
createPointsPolygonFromGMLxyz = Custom[GIS2BIM.CreatePointsPolygonFromGMLxyz](XML=web_request_2, Xmltagname=code_block_5, DeltaX=getLocationdataNetherlands.RDcoordinate_X_meters, DeltaY=getLocationdataNetherlands.RDcoordinate_Y_meters, Connectpolygon=boolean)  # Create points and polygons from a xml/gml-file with x,y and z value
createDetailLinesFromPolygons_2 = Custom[GIS2BIM.CreateDetailLinesFromPolygons](View=views, PolyCurves=createPointsPolygonFromGMLxyz.PolyCurves, Linestyle=lineStyleBAGPand)
explode = Geometry.Explode(createPointsPolygonFromGMLxyz.PolyCurves)
byCurves = FilledRegion.ByCurves(views, explode, filledregiontypebag_pand)

setSharedCoordinate = Custom[GIS2BIM.SetSharedCoordinate](X=getLocationdataNetherlands.RDcoordinate_X_meters, Y=getLocationdataNetherlands.RDcoordinate_Y_meters)  # Set shared coordinate/project basepoint
