# Dynamo custom node GIS2BIM.WebrequestWMS2.dyf "GIS2BIM.WebrequestWMS" (Dynamo 1.3.2.2480)
# category: GIS2BIM.WebrequestActions
# a webrequest based on WMS-protocol

WMSwebrequest = Input(WMSwebrequest: string)  # url for WMS webrequest
Tempfolder = Input(Tempfolder: string="C:/TEMP/")  # windowsfolder to save image
Filename = Input()  # filename

# group: WEBREQUEST FOR FILE
code_block = CodeBlock { ".png"; }
concat = String.Concat(Filename, code_block)
concat_2 = String.Concat(Tempfolder, concat)
python_script = Python(IN[0]=WMSwebrequest, IN[1]=concat_2)
# ---------- python_script.python (11 lines) ----------
import sys
sys.path.append("C:\Program Files (x86)\IronPython 2.7\Lib")
from urllib import urlretrieve

url= IN[0]
tempfile= IN[1]


urlretrieve(url, tempfile)

OUT= tempfile
# ----------------------------------------
fromPath = FileObject(python_script)  # "File.FromPath"
readFromFile = Image.ReadFromFile(fromPath)
watch_image = Output(readFromFile)

imagepath = Output(python_script)
