# Dynamo custom node GIS2BIM.DownloadBGTdata.dyf (Dynamo 1.3.1.1736)
# category: GIS2BIM.DutchGEO
# Download BGT-data(dutch GIS-information)

code_block = CodeBlock()
# ---------- code_block.designscript (2 lines) ----------
"https://downloads.pdok.nl/service/extract.zip?extractname=bgt&extractset=citygml&excludedtypes=plaatsbepalingspunt&history=true&tiles=%7B%22layers%22%3A%5B%7B%22aggregateLevel%22%3A0%2C%22codes%22%3A%5B";
"%5D%7D%5D%7D";
# ----------------------------------------
Mortoncode = Input()
numberToString = Python(IN[0]=Mortoncode)  # "Spring.NumberToString"
# ---------- numberToString.python (21 lines) ----------
#Copyright(c) 2016, Dimitar Venkov
# @5devene, dimitar.ven@gmail.com

import clr

def tolist(obj1):
	if hasattr(obj1,"__iter__"): return obj1
	else: return [obj1]

def output1(l1):
	if len(l1) == 1: return l1[0]
	else: return l1

num1 = tolist(IN[0])
out1 = []
for i in xrange(len(num1)):
	s1 = str(num1[i])
	if s1[-2:] == ".0": out1.append(s1[:-2])
	else: out1.append(s1)

OUT = output1(out1)
# ----------------------------------------
concat = String.Concat(code_block.out0, numberToString, code_block.out1)
Directory = Input()
string = StringInput("\")
code_block_2 = CodeBlock { ".zip"; }
concat_2 = String.Concat(Directory, string, numberToString, code_block_2)
python_script = Python(IN[0]=concat, IN[1]=concat_2)
# ---------- python_script.python (10 lines) ----------
import sys
sys.path.append("C:\Program Files (x86)\IronPython 2.7\Lib")
from System.Net import WebClient

url= IN[0]
filoc= IN[1]

WebClient().DownloadFile(url, filoc)

OUT= filoc
# ----------------------------------------
Location = Output(python_script)  # "Location:string"
string_2 = StringInput("\")
concat_3 = String.Concat(Directory, string_2, numberToString, string_2)
Directory_2 = Output(concat_3)  # "Directory:string"
Downloadlink = Output(concat)  # "Downloadlink: string"
