# Dynamo custom node GIS2BIM.GetRevitSiteLocation.dyf (Dynamo 1.3.2.2480)
# category: GIS2BIM.Revit
# Gets the properties of the current Site Location of the active Revit Project

toggle = Input(toggle: bool=true)
python_script = Python(IN[0]=toggle)
# ---------- python_script.python (27 lines) ----------
#©2017 Ekko Nap, ekko@groosman.com
#licensed under MIT

import clr
clr.AddReference("RevitServices")
import RevitServices
from RevitServices.Persistence import DocumentManager
from RevitServices.Transactions import TransactionManager
import math

doc = DocumentManager.Instance.CurrentDBDocument

projectLocation = doc.ActiveProjectLocation
siteLocation = projectLocation.SiteLocation

#SiteLocation = projectLocation.GetSiteLocation(); // 2018
#from https://github.com/jeremytammik/the_building_coder_samples/blob/master/BuildingCoder/BuildingCoder/CmdUnrotateNorth.cs
#untested

bool = IN[0]

if bool==1:
	latitude=siteLocation.Latitude
	longitude=siteLocation.Longitude
	name=siteLocation.PlaceName

OUT = latitude*180/math.pi, longitude*180/math.pi, name
# ----------------------------------------
code_block = CodeBlock(out=python_script) { lat=out[0]; lon=out[1]; name=out[2]; }
Name = Output(code_block.name)
Lon = Output(code_block.lon)
Lat = Output(code_block.lat)
byLatitudeAndLongitude = DynamoUnits.Location.ByLatitudeAndLongitude(code_block.lat, code_block.lon, code_block.name)
Location = Output(byLatitudeAndLongitude)
