# Dynamo custom node GIS2BIM.GoogleStaticMapsAPI.dyf (Dynamo 1.3.2.2480)
# category: GIS2BIM.Geoservices.WorldWide
# Use the Google Static Maps API to download map or aerialphoto

code_block = CodeBlock()
# ---------- code_block.designscript (13 lines) ----------
"https://maps.googleapis.com/maps/api/staticmap?";
"maptype=satellite";
"maptype=roadmap";
"maptype=terrain";
"maptype=hybrid";
"&center=";
"37.530101";
",";
"38.600062";
"&zoom=";
"21";
"&size=2000x2000";
"&key=";
# ----------------------------------------
Latitude = Input(Latitude: double)
string_from_object = FromObject(Latitude)
code_block_2 = CodeBlock { ","; "."; }
replace = String.Replace(str=string_from_object, searchFor=code_block_2.out0, replaceWith=code_block_2.out1)
Longitude = Input(Longitude: double)
string_from_object_2 = FromObject(Longitude)
code_block_3 = CodeBlock { ","; "."; }
replace_2 = String.Replace(str=string_from_object_2, searchFor=code_block_3.out0, replaceWith=code_block_3.out1)
Zoomlevel = Input(Zoomlevel: string="21")
GoogleAPIKey = Input(GoogleAPIKey: string="")
concat = String.Concat(code_block.out5, replace, code_block.out7, replace_2, code_block.out9, Zoomlevel, code_block.out11, code_block.out12, GoogleAPIKey)
concat_2 = String.Concat(code_block.out0, code_block.out1, concat)
URL_Google_Satellite = Output(concat_2)
concat_3 = String.Concat(code_block.out0, code_block.out3, concat)
URL_Google_Terrain = Output(concat_3)
concat_4 = String.Concat(code_block.out0, code_block.out4, concat)
URL_Google_Hybrid = Output(concat_4)
concat_5 = String.Concat(code_block.out0, code_block.out2, concat)
URL_Google_Roadmap = Output(concat_5)
