# Dynamo custom node GIS2BIM.HawaiGeoservicesLibrary.dyf (Dynamo 1.3.2.2480)
# category: GIS2BIM.Geoservices.America
# Library with multiple webadresses which can be used for WFS and WMS webrequests

code_block = CodeBlock { "http://webserverholis.honolulugis.org/arcgis/rest/services/Public/Cadastral/MapServer/1/"; }
Hawai_Cadastral_Tax_Parcel = Output(code_block)
code_block_2 = CodeBlock { "http://webserverholis.honolulugis.org/arcgis/rest/services/Public/Cadastral/MapServer/2/"; }
Hawai_Cadastral_Regulatory_Parcel = Output(code_block_2)
code_block_3 = CodeBlock { "http://webserverholis.honolulugis.org/arcgis/rest/services/Public/Cadastral/MapServer/3/"; }
Hawai_Cadastral_Address = Output(code_block_3)
