# Dynamo custom node GIS2BIM.KadasterPercelen.dyf (Dynamo 1.3.2.2480)
# category: GIS2BIM.DutchGEO
# Draw propertylines and place streetnames and housenumbers from the dutch kadaster

View = Input(View: Revit.View)
UrlWebrequestKadasterPerceel = Input()
DeltaX = Input()  # X-value of transformation of points and polygons
string = StringInput(".//{http://kadastralekaartv3.geonovum.nl}perceelnummer_deltax")
code_block = CodeBlock { 4; }
DeltaY = Input()  # Y-value of transformation of points and polygons
string_2 = StringInput(".//{http://kadastralekaartv3.geonovum.nl}perceelnummer_deltay")
code_block_2 = CodeBlock { 4; }
code_block_3 = CodeBlock { 1000; }
string_3 = StringInput(".//{http://kadastralekaartv3.geonovum.nl}perceelnummer")
code_block_4 = CodeBlock { 4; }
TextTypePerceel = Input()

# group: PLACE TEXTNOTE FOR KADASTRAAL PERCEEL
web_request = WebRequest(UrlWebrequestKadasterPerceel)
string_4 = StringInput("Center")
byName = TextNoteType.ByName(TextTypePerceel)

python_script = Python(IN[0]=web_request, IN[1]=string)
# ---------- python_script.python (53 lines) ----------
import clr
import sys
clr.AddReference('ProtoGeometry')
from Autodesk.DesignScript.Geometry import *
sys.path.append("C:\Program Files (x86)\IronPython 2.7\Lib")
#from xml.parsers.expat import expat -- can't find this
import xml.etree.ElementTree as ET
#The inputs to this node will be stored as a list in the IN variables.
xml = IN[0]
xpathstr = IN[1]

root = ET.fromstring(xml)

xpathfound = root.findall(xpathstr)
#xparentstr = xpathstr + "/.."
#xparentfound = root.findall(xpathstr+"/..")
xtags, xtext, xcountattrib, xattrib, xattvals, xcountiter, xitertags, xitervals, xparents = [], [], [], [], [], [], [], [], []
for x in xpathfound:
	xtags.append(x.tag)
	if x.text:
		try:
			xtext.append(x.text)
		except:
			xtext.append("_none_")
	else:
		xtext.append("_none_")
	if x.keys():
		xcountattrib.append(len(x.items()))
		for name, value in x.items():
			xattrib.append(name)
			xattvals.append(value)
#PARENT CODE BELOW IS TOO SLOW
#			try:
#				xparents.append(root.find(xpathstr + "/" + name + "/.."))
#			except:
#				xparents.append("no parent found")
	else:
		xcountattrib.append(1)
		xattrib.append("_none_")
		xattvals.append("_none_")

#THIS METHOD NOT GREAT
#	if x.iter():
#		xcountiter.append(len(x.iter()))
#		for name, value in x.iter():
#			xitertags.append(name)
#			xitervals.append(value)
#for y in xparentfound:
#	xparents.append(y.tag)

OUT = root, str(root), xpathfound, xtags, xtext, xcountattrib, xattrib, xattvals
#, xparents 
#, xparentfound#, xparents#, xcountiter, xitertags, xitervals
# ----------------------------------------
getItemAtIndex = List.GetItemAtIndex(list=python_script, index=code_block)

# group (continued): PLACE TEXTNOTE FOR KADASTRAAL PERCEEL
flatten = Flatten(getItemAtIndex)
toNumber = String.ToNumber(flatten)
add = DeltaX + toNumber

python_script_2 = Python(IN[0]=web_request, IN[1]=string_2)  # same code as python_script
getItemAtIndex_2 = List.GetItemAtIndex(list=python_script_2, index=code_block_2)

# group (continued): PLACE TEXTNOTE FOR KADASTRAAL PERCEEL
flatten_2 = Flatten(getItemAtIndex_2)
toNumber_2 = String.ToNumber(flatten_2)
add_2 = DeltaY + toNumber_2
createPointFromGML = Custom[GIS2BIM.CreatePointFromGML](XML=web_request, ModX=add, ModY=add_2, UnitsConversionFactor=code_block_3)  # Create Points from space seperated GML

python_script_3 = Python(IN[0]=web_request, IN[1]=string_3)  # same code as python_script
getItemAtIndex_3 = List.GetItemAtIndex(list=python_script_3, index=code_block_4)

# group (continued): PLACE TEXTNOTE FOR KADASTRAAL PERCEEL
flatten_3 = Flatten(getItemAtIndex_3)

string_5 = StringInput(".//{http://kadastralekaartv3.geonovum.nl}perceelnummer_rotatie")
python_script_4 = Python(IN[0]=web_request, IN[1]=string_5)  # same code as python_script
code_block_5 = CodeBlock { 4; }
getItemAtIndex_4 = List.GetItemAtIndex(list=python_script_4, index=code_block_5)

# group (continued): PLACE TEXTNOTE FOR KADASTRAAL PERCEEL
flatten_4 = Flatten(getItemAtIndex_4)
flatten_5 = Flatten(flatten_4)
toNumber_3 = String.ToNumber(flatten_5)
byLocation = TextNote.ByLocation(view=View, location=createPointFromGML, text=flatten_3, alignment=string_4, type=byName, rotation=toNumber_3)
