# Dynamo custom node GIS2BIM.SetRevitSiteLocation.dyf (Dynamo 1.3.2.2480)
# category: GIS2BIM.Revit
# Sets the properties of the current Site Location of the active Revit Project

toggle = Input(toggle: bool=true)
lat = Input(lat: string)  # latitude, between -90 and 90
toNumber = String.ToNumber(lat)
lon = Input(lon: string)  # longitude, between -180 and 180
toNumber_2 = String.ToNumber(lon)
name = Input(name: string = "User Defined")  # address or place name
python_script = Python(IN[0]=toggle, IN[1]=toNumber, IN[2]=toNumber_2, IN[3]=name)
# ---------- python_script.python (34 lines) ----------
#©2017 Ekko Nap, ekko@groosman.com
#licensed under MIT

import clr
clr.AddReference("RevitServices")
import RevitServices
from RevitServices.Persistence import DocumentManager
from RevitServices.Transactions import TransactionManager
import math

doc = DocumentManager.Instance.CurrentDBDocument

projectLocation = doc.ActiveProjectLocation
siteLocation = projectLocation.SiteLocation

#SiteLocation = projectLocation.GetSiteLocation(); // 2018
#from https://github.com/jeremytammik/the_building_coder_samples/blob/master/BuildingCoder/BuildingCoder/CmdUnrotateNorth.cs
#untested

bool = IN[0]
latitude = IN[1]
longitude = IN[2]
name = IN[3]

if bool==1:
	TransactionManager.Instance.EnsureInTransaction(doc)

	newLatitude=siteLocation.Latitude=latitude*math.pi/180
	newLongitude=siteLocation.Longitude=longitude*math.pi/180
	newName=siteLocation.PlaceName=name
	
	TransactionManager.Instance.TransactionTaskDone()

OUT = newLatitude*180/math.pi, newLongitude*180/math.pi, newName
# ----------------------------------------
code_block = CodeBlock(out=python_script) { lat=out[0]; lon=out[1]; name=out[2]; }
byLatitudeAndLongitude = DynamoUnits.Location.ByLatitudeAndLongitude(code_block.lat, code_block.lon, code_block.name)
Location = Output(byLatitudeAndLongitude)
lat_2 = Output(code_block.lat)  # "lat"
lon_2 = Output(code_block.lon)  # "lon"
name_2 = Output(code_block.name)  # "name"
