# Dynamo custom node GIS2BIM.SpainGeoservicesLibrary.dyf (Dynamo 1.3.2.2480)
# category: GIS2BIM.Geoservices.Europe
# Geoserviceslibrary of Spain

code_block = CodeBlock()
# ---------- code_block.designscript (5 lines) ----------
"http://ovc.catastro.meh.es/INSPIRE/wfsCP.aspx?service=wfs";
"&request=getfeature";
"&Typenames=cp.cadastralparcel";
"&SRSname=EPSG::25830";
"&bbox=";
# ----------------------------------------
Boundingbox = Input()  # Input From Boundingboxnode from GIS2BIM
concat = String.Concat(code_block.out0, code_block.out1, code_block.out2, code_block.out3, code_block.out4, Boundingbox)
Cadastre_Parcels = Output(concat)
