# Dynamo custom node GIS2BIM.SuggestLocationdata.dyf (Dynamo 1.3.0.875)
# category: GIS2BIM.DutchGEO
# Suggests the adress in the Netherlands that best matches the given search terms.
# https://github.com/PDOK/locatieserver/wiki/API-Locatieserver

code_block = CodeBlock { "adres onbekend"; }
string = StringInput("http://geodata.nationaalgeoregister.nl/locatieserver/v3/suggest?q=")
code_block_2 = CodeBlock { " and "; }
search_terms = Input()
flatten = Flatten(search_terms)
string_from_object = FromObject(flatten)
length = String.Length(string_from_object)
code_block_3 = CodeBlock(x=length) { x>0; }
filterByBoolMask = List.FilterByBoolMask(list=string_from_object, mask=code_block_3)
join = String.Join(code_block_2, filterByBoolMask.in)
code_block_4 = CodeBlock(PDOKgeosearchstring=string, zoektermen=join) { PDOKgeosearchstring+zoektermen; }
web_request = WebRequest(code_block_4)
string_2 = StringInput("\"maxScore\":")
string_3 = StringInput(",\"docs\":")
string_4 = StringInput(",\"highlighting\":{")
split = String.Split(web_request, string_2, string_3, string_4)
code_block_5 = CodeBlock(x=split) { list=x[0]; maxScore=list[1]; adresses=list[2]; }
string_5 = StringInput("type\":\"")
string_6 = StringInput("weergavenaam\":\"")
string_7 = StringInput("\",\"")
string_8 = StringInput("score\":")
string_9 = StringInput("}")
split_2 = String.Split(code_block_5.adresses, string_5, string_6, string_7, string_8, string_9)
code_block_6 = CodeBlock { 5; 3; 5; 2; }
takeEveryNthItem = List.TakeEveryNthItem(split_2, code_block_6.out0, code_block_6.out1)
takeEveryNthItem_2 = List.TakeEveryNthItem(split_2, code_block_6.out0, code_block_6.out3)
code_block_7 = CodeBlock(x=takeEveryNthItem_2) { x=="adres"; }
filterByBoolMask_2 = List.FilterByBoolMask(list=takeEveryNthItem, mask=code_block_7)
code_block_8 = CodeBlock { " "; ","; }
split_3 = String.Split(filterByBoolMask_2.in, code_block_8.out0, code_block_8.out1)
code_block_9 = CodeBlock(onbekend=code_block, adres=split_3) { s=onbekend; {adres, {{s,s,s,s}}}; }
toNumber = String.ToNumber(code_block_5.maxScore)
code_block_10 = CodeBlock(x=toNumber) { max=x; a=x>0; b=x==0; {a,b}; }
filterByBoolMask_3 = List.FilterByBoolMask(list=code_block_9.out1, mask=code_block_10.out3)
code_block_11 = CodeBlock(s=filterByBoolMask_3.in) { x=s[0]; }
code_block_12 = CodeBlock(x=code_block_11) { List.GetItemAtIndex(x<1>, 0); List.GetItemAtIndex(x<1>, 1); List.GetItemAtIndex(x<1>, 2); List.GetItemAtIndex(x<1>, 3); }
plaatsnaam = Output(code_block_12.out3)
postcode = Output(code_block_12.out2)
straatnaam = Output(code_block_12.out0)
huisnummer = Output(code_block_12.out1)
code_block_13 = CodeBlock(adres=filterByBoolMask_2.in, onbekend=code_block) { {adres,{onbekend}}; }
filterByBoolMask_4 = List.FilterByBoolMask(list=code_block_13, mask=code_block_10.out3)
code_block_14 = CodeBlock(s=filterByBoolMask_4.in) { x=s[0]; }
adres = Output(code_block_14)
takeEveryNthItem_3 = List.TakeEveryNthItem(split_2, code_block_6.out0, code_block_6.out2)
filterByBoolMask_5 = List.FilterByBoolMask(list=takeEveryNthItem_3, mask=code_block_7)
toNumber_2 = String.ToNumber(filterByBoolMask_5.in)
code_block_15 = CodeBlock(x=toNumber_2, max=code_block_10.max) { Math.Round(x/max*100); }
string_from_object_2 = FromObject(code_block_15)
code_block_16 = CodeBlock { "."; ","; }
split_4 = String.Split(string_from_object_2, code_block_16.out0, code_block_16.out1)
code_block_17 = CodeBlock(x=split_4)
# ---------- code_block_17.designscript (2 lines) ----------
{List.GetItemAtIndex(x<1>, 0)+"%",
{"0%"}};
# ----------------------------------------
filterByBoolMask_6 = List.FilterByBoolMask(list=code_block_17, mask=code_block_10.out3)
code_block_18 = CodeBlock(s=filterByBoolMask_6.in) { x=s[0]; }
score = Output(code_block_18)
