# Dynamo custom node GIS2BIM.SystemDrawingBitmapToJPG.dyf (Dynamo 1.3.1.1736)
# category: GIS2BIM.Image
# Save an System.Drawing.Bitmap object as a jpg-file

SystemDrawingBitmap = Input()
FileName = Input()
python_script = Python(IN[0]=SystemDrawingBitmap, IN[1]=FileName)
# ---------- python_script.python (23 lines) ----------
import sys

sys.path.append("C:\Program Files (x86)\IronPython 2.7\Lib")
from math import *
import itertools
from itertools import islice

import clr

clr.AddReference("System.Drawing")
from System.Drawing import Image
from System.Drawing import Bitmap
from System.Drawing import Graphics
from System.Drawing.Imaging import ImageFormat
from System.IO import Path
from os import listdir

bmp = IN[0]
filoc=IN[1]

bmp.Save(filoc, ImageFormat.Jpeg)

OUT = filoc
# ----------------------------------------
FileName_2 = Output(python_script)  # "FileName"
