# Dynamo custom node GIS2BIM.WMTSTileListFromBbox.dyf (Dynamo 1.3.1.1736)
# category: GIS2BIM.WMTS/TMS
# gives list of tilerows and tilecolums

TileColumn = Input(TileColumn:string)
toNumber = String.ToNumber(TileColumn)
BboxWidthInMeters = Input(BboxWidthInMeters:double)
PixelWidth = Input(PixelWidth:double)
Resolution = Input(Resolution: double)
code_block = CodeBlock(pixel=PixelWidth, resolutie=Resolution) { tilewidth=pixel*resolutie; }
code_block_2 = CodeBlock(bbox=BboxWidthInMeters, tilewidth=code_block) { Math.Ceiling(bbox/tilewidth); }
code_block_3 = CodeBlock(a=code_block_2) { Math.Ceiling(a/2)*2; }
code_block_4 = CodeBlock(TileColumn=toNumber, n=code_block_3) { (TileColumn-(n/2))..(TileColumn+(n/2))..#n+1; }
count = List.Count(code_block_4)
mul = count * count
NumberOfTiles = Output(mul)
TileRow = Input(TileRow:string)
toNumber_2 = String.ToNumber(TileRow)
code_block_5 = CodeBlock(TileRow=toNumber_2, n=code_block_3) { (TileRow-(n/2))..(TileRow+(n/2))..#n+1; }
byCoordinates = Point.ByCoordinates(x=code_block_5, y=code_block_4, lacing=CrossProduct)
X = Point.X(byCoordinates)
flatten = Flatten(X)
TileRows = Output(flatten)
Y = Point.Y(byCoordinates)
flatten_2 = Flatten(Y)
TileColumns = Output(flatten_2)
UniqueTileColumns = Output(code_block_4)
UniqueTileRows = Output(code_block_5)
count_2 = Count(code_block_5)
code_block_6 = CodeBlock(pixel=PixelWidth, numberoftiles=count_2, resolution=Resolution) { pixel*numberoftiles*resolution; }
TotalTileWidthMetrs = Output(code_block_6)
