# Dynamo graph WMTS Example Netherlands Topo.dyn (Dynamo 1.3.3.4111)

zoomlevel = CodeBlock { 14; 100; "C:/TEMP/opentopo2.jpeg"; }
WMTSScaleSetNetherlands = Custom[GIS2BIM.WMTSScaleSetNetherlands](Zoomlevel=zoomlevel.out0)  # gives resolution, scaledenominator and number of tiles
code_block = CodeBlock { "Dordrecht"; "werf van schouten"; "501"; }
getLocationdataNetherlands = Custom[GIS2BIM.GetLocationdataNetherlands](City=code_block.out0, Streetname=code_block.out1, Housenumber=code_block.out2)  # Gives locationdata based on an adress in the Netherlands
WMTSZoomLevelTileRow = Custom[GIS2BIM.WMTSZoomLevelTileRow](Resolution=WMTSScaleSetNetherlands.Resolutie_m_pixel, Rdx=getLocationdataNetherlands.RDcoordinateX_meters_double, Rdy=getLocationdataNetherlands.RDcoordinateY_meters_double)  # gives the tilerow and tilecolumn for the WMTS webrequest
pixelWidth = CodeBlock { 256; }
WMTSTileListFromBbox = Custom[GIS2BIM.WMTSTileListFromBbox](TileRow=WMTSZoomLevelTileRow.TileRow, TileColumn=WMTSZoomLevelTileRow.TileColumn, Resolution=WMTSScaleSetNetherlands.Resolutie_m_pixel, PixelWidth=pixelWidth, BboxWidthInMeters=zoomlevel.out1)  # gives list of tilerows and tilecolums
views = Views("Plattegrond Begane Grond")
WMTSLayersNetherlands = Custom[GIS2BIM.WMTSLayersNetherlands]()  # Library with layers for webrequests of WMTS-services in the Netherlands
WMTSGeoservicesLibraryNetherlands = Custom[GIS2BIM.WMTSGeoservicesLibraryNetherlands](TileRows=WMTSTileListFromBbox.TileRows, TileColumns=WMTSTileListFromBbox.TileColumns, Zoomlevel=WMTSScaleSetNetherlands.Zoomlevel, Layer=WMTSLayersNetherlands.opentopo)  # library with webrequests of WMTS-services in the Netherlands
boolean = BoolSelector(true)
TMS_WMTS_WebrequestAndCombineImages = Custom[GIS2BIM.TMS_WMTS_WebrequestAndCombineImages](URLlist=WMTSGeoservicesLibraryNetherlands, UniqueTileNumbersColumnX=WMTSTileListFromBbox.UniqueTileColumns, UniqueTileNumbersRowY=WMTSTileListFromBbox.UniqueTileRows, WMTSorTMS=boolean)  # Webrequest for list of WMTS or TMS/Google webrequests for tiles. Combines them to 1 image.
firstItem = List.FirstItem(TMS_WMTS_WebrequestAndCombineImages.Image)
systemDrawingBitmapToJPG = Custom[GIS2BIM.SystemDrawingBitmapToJPG](SystemDrawingBitmap=firstItem, FileName=zoomlevel.out2)  # frozen; Save an System.Drawing.Bitmap object as a jpg-file
importImageInView = Custom[GIS2BIM.ImportImageInView](ImageWidthMeters=WMTSTileListFromBbox.TotalTileWidthMetrs, View=views, ImagePath=systemDrawingBitmapToJPG, DeltaX=WMTSZoomLevelTileRow.DeltaX, DeltaY=WMTSZoomLevelTileRow.DeltaY)  # Import rasterimage in view
watch_image = WatchImageCore(firstItem)
