# Dynamo custom node GIS2BIM.MergeImages.dyf (Dynamo 1.3.2.2480)
# category: GIS2BIM.Image
# Merges a list of images to 1 image

images = Input()  # List of images to merge/combine
python_script = Python(IN[0]=images)
# ---------- python_script.python (29 lines) ----------
import clr

clr.AddReference("System.Drawing")
from System.Drawing import Image
from System.Drawing import Bitmap
from System.Drawing import Graphics
from System import Drawing
from System.Drawing.Imaging import ImageFormat

Images=IN[0]

width=[]
for i in Images:
	width.append(i.Width)
w=max(width)

height=[]
for i in Images:
	height.append(i.Height)
h=max(width)

img= Bitmap(w,h)
g= Graphics.FromImage(img)

for i in Images:
	g.DrawImage(i,Drawing.Rectangle(0,0,img.Width,img.Height))

#Assign your output to the OUT variable.
OUT = img
# ----------------------------------------
image = Output(python_script)
