# Dynamo custom node GIS2BIM.TMSWebServices.dyf (Dynamo 1.3.1.1736)
# category: GIS2BIM.WMTS/TMS
# Library With TMS Webservices

code_block = CodeBlock { "https://mt1.google.com/vt/lyrs=s"; "&x="; "&y="; "&z="; }
TileX = Input()
TileY = Input()
Zoomlevel = Input(Zoomlevel: double)
string_from_object = FromObject(Zoomlevel)
code_block_2 = CodeBlock { ","; "."; }
split = String.Split(string_from_object, code_block_2.out0, code_block_2.out1)
firstItem = List.FirstItem(split)
python_script = Python(IN[0]=code_block.out0, IN[1]=code_block.out1, IN[2]=TileX, IN[3]=code_block.out2, IN[4]=TileY, IN[5]=code_block.out3, IN[6]=firstItem)
# ---------- python_script.python (25 lines) ----------
import clr
clr.AddReference('ProtoGeometry')
from Autodesk.DesignScript.Geometry import *
#The inputs to this node will be stored as a list in the IN variables.
dataEnteringNode = IN

str1=IN[0]
str2=IN[1]
lst3=IN[2]
str4=IN[3]
lst5=IN[4]
str6=IN[5]
zooml=IN[6]

n=len(lst3)

lst1=[str1]*n
lst2=[str2]*n
lst4=[str4]*n
lst6=[str6]*n
lst7=[zooml]*n

lstout=[a+b+c+d+e+f+g for a,b,c,d,e,f,g in zip(lst1,lst2,lst3,lst4,lst5,lst6,lst7)]

OUT = lstout
# ----------------------------------------
GoogleEarthURLs = Output(python_script)
