# Dynamo custom node GIS2BIM.WMTSRequestAndImport.dyf (Dynamo 1.3.1.1736)
# category: GIS2BIM.DutchGEO
# total node with WMTS webrequest and import of image in view

Zoomlevel = Input()
WMTSScaleSetNetherlands = Custom[GIS2BIM.WMTSScaleSetNetherlands](Zoomlevel=Zoomlevel)  # gives resolution, scaledenominator and number of tiles
Rdx = Input()
Rdy = Input()
WMTSZoomLevelTileRow = Custom[GIS2BIM.WMTSZoomLevelTileRow](Resolution=WMTSScaleSetNetherlands.Resolutie_m_pixel, Rdx=Rdx, Rdy=Rdy)  # gives the tilerow and tilecolumn for the WMTS webrequest
pixelWidth = CodeBlock { 256; }
Boundingboxwidth = Input()
WMTSTileListFromBbox = Custom[GIS2BIM.WMTSTileListFromBbox](TileRow=WMTSZoomLevelTileRow.TileRow, TileColumn=WMTSZoomLevelTileRow.TileColumn, Resolution=WMTSScaleSetNetherlands.Resolutie_m_pixel, PixelWidth=pixelWidth, BboxWidthInMeters=Boundingboxwidth)  # gives list of tilerows and tilecolums
View = Input()
Layer = Input()
WMTSGeoservicesLibraryNetherlands = Custom[GIS2BIM.WMTSGeoservicesLibraryNetherlands](TileRows=WMTSTileListFromBbox.TileRows, TileColumns=WMTSTileListFromBbox.TileColumns, Zoomlevel=WMTSScaleSetNetherlands.Zoomlevel, Layer=Layer)  # library with webrequests of WMTS-services in the Netherlands
boolean = BoolSelector(true)
TMS_WMTS_WebrequestAndCombineImages = Custom[GIS2BIM.TMS_WMTS_WebrequestAndCombineImages](URLlist=WMTSGeoservicesLibraryNetherlands, UniqueTileNumbersColumnX=WMTSTileListFromBbox.UniqueTileColumns, UniqueTileNumbersRowY=WMTSTileListFromBbox.UniqueTileRows, Pixels=pixelWidth, WMTSorTMS=boolean)  # Webrequest for list of WMTS or TMS/Google webrequests for tiles. Combines them to 1 image.
TemppathFileName = Input()
systemDrawingBitmapToJPG = Custom[GIS2BIM.SystemDrawingBitmapToJPG](SystemDrawingBitmap=TMS_WMTS_WebrequestAndCombineImages.Image, FileName=TemppathFileName)  # Save an System.Drawing.Bitmap object as a jpg-file
importImageInView = Custom[GIS2BIM.ImportImageInView](ImageWidthMeters=WMTSTileListFromBbox.TotalTileWidthMetrs, View=View, ImagePath=systemDrawingBitmapToJPG, DeltaX=WMTSZoomLevelTileRow.DeltaX, DeltaY=WMTSZoomLevelTileRow.DeltaY)  # Import rasterimage in view
Image = Output(TMS_WMTS_WebrequestAndCombineImages.Image)
