# Dynamo custom node GIS2BIM.WebrequestWMS.dyf (Dynamo 1.3.1.1736)
# category: GIS2BIM.WMS
# imports the result(image) of a webrequest based on WMS-protocol into a view in Revit

WMSwebrequest = Input(WMSwebrequest: string)  # url for WMS webrequest
Tempfolder = Input(Tempfolder: string="C:/TEMP/")  # windowsfolder to save image
Filename = Input()  # filename

# group: WEBREQUEST FOR FILE
code_block = CodeBlock { ".png"; }
concat = String.Concat(Filename, code_block)
concat_2 = String.Concat(Tempfolder, concat)
python_script = Python(IN[0]=WMSwebrequest, IN[1]=concat_2)
# ---------- python_script.python (10 lines) ----------
import sys
sys.path.append("C:\Program Files (x86)\IronPython 2.7\Lib")
from System.Net import WebClient

url= IN[0]
filoc= IN[1]

WebClient().DownloadFile(url, filoc)

OUT= filoc
# ----------------------------------------
fromPath = FileObject(python_script)  # "File.FromPath"
readFromFile = Image.ReadFromFile(fromPath)
watch_image = Output(readFromFile)

Boundingboxwidth_m = Input()  # "Boundingboxwidth[m]"; width of the bounding box
View = Input()
code_block_2 = CodeBlock { 0; }
importImageInView = Custom[GIS2BIM.ImportImageInView](ImageWidthMeters=Boundingboxwidth_m, View=View, ImagePath=python_script, DeltaX=code_block_2, DeltaY=code_block_2)  # Import rasterimage in view
image_is_imported_in_view = Output(importImageInView)
