# Dynamo custom node GIS2BIM.WebrequestWMS2.dyf (Dynamo 1.3.2.2480)
# category: GIS2BIM.WMS
# a webrequest based on WMS-protocol

WMSwebrequest = Input()  # url for WMS webrequest
python_script = Python(IN[0]=WMSwebrequest)
# ---------- python_script.python (16 lines) ----------
import sys
sys.path.append("C:\Program Files (x86)\IronPython 2.7\Lib")

import clr

clr.AddReference("System.Drawing")
clr.AddReference("System")
from System.Drawing import Image
from System.Net import WebRequest
url= IN[0]

request = WebRequest.Create(url)
response = request.GetResponse()
bitmap = Image.FromStream(response.GetResponseStream())

OUT = bitmap
# ----------------------------------------
Bitmap = Output(python_script)  # "Bitmap:Image"
