# Dynamo custom node GIS2BIM.FilterGMLPointsMetadata.dyf (Dynamo 1.3.3.4111)
# category: GIS2BIM.Geometry
# Filter GML-file based on boundingbox and create points and belonging meta-data

GMLFile = Input()  # path of GML-file
XpathPoints = Input()  # xPathToSearchXML
CoordinateX = Input()
CoordinateY = Input()
Boundingbox = Input()  # width and height of boundingbox
XpathMetadata = Input()  # xPathToSearchXMLMetadata
python_script = Python(IN[0]=GMLFile, IN[1]=XpathPoints, IN[2]=CoordinateX, IN[3]=CoordinateY, IN[4]=Boundingbox, IN[5]=XpathMetadata)
# ---------- python_script.python (84 lines) ----------
import sys
sys.path.append("C:\Program Files (x86)\IronPython 2.7\Lib")

import clr
clr.AddReference('ProtoGeometry')
from Autodesk.DesignScript.Geometry import *

import xml.etree.ElementTree as ET


def checkIfCoordIsInsideBoundingBox(coord, bounding_box):
    min_x = bounding_box[0] - (bounding_box[2] / 2)
    min_y = bounding_box[1] - (bounding_box[2] / 2)
    max_x = bounding_box[0] + (bounding_box[2] / 2)
    max_y = bounding_box[1] + (bounding_box[2] / 2)

    if min_x <= float(coord[0]) <= max_x and min_y <= float(coord[1]) <= max_y:
        return True
    else:
        return False

def mainFunction():
    # Inputs
    file_path = IN[0]
    xpathstr = IN[1]
    # Bounding box definition
    bbx = IN[2]
    bby = IN[3]
    bb_size = IN[4]
    xpathstr2 = IN[5]
    bounding_box = [bbx, bby, bb_size]
    # get data from xml
    tree = ET.parse(file_path)
    root = tree.getroot()
	
    # for loop to get each element in an array
    XMLelements = []
    for elem in root.iter():
        XMLelements.append(elem)

    xpathfound = root.findall(xpathstr)
    xpathfoundlabel = root.findall(xpathstr2)
    # for loop to get all points in an array
    points = []
    for x in xpathfound:
        if x.text:
            try:
                points.append(x.text)
            except:
                points.append("_none_")
        else:
            points.append("_none_")
	
	labels = []
    for i in xpathfoundlabel:
        if i.text:
            try:
                labels.append(i.text)
            except:
                labels.append("_none_")
        else:
            labels.append("_none_")
    
    # for loop to get each point as a list instead of a string
    newPoints = []
    for point in points:
        newPoints.append(point.split(" "))

    # for loop to get x,y coords and filter points inside Bounding Box
    xyPoints = []
    xyLabels = []
    for newPoint, label in zip(newPoints, labels):
    	point_is_inside_bounding_box = False
    	if checkIfCoordIsInsideBoundingBox(newPoint, bounding_box):
    		point_is_inside_bounding_box = True
    		xyPoints.append(newPoint)
    		xyLabels.append(label)
    return xyPoints, xyLabels

# execution of main function in python script
returnvalue = mainFunction()

# put returnValue in OUT
OUT = returnvalue
# ----------------------------------------
code_block = CodeBlock(t4=python_script, t9=CoordinateX, t10=CoordinateY)
# ---------- code_block.designscript (15 lines) ----------
t3 = DSCore.List.FirstItem(t4);
t5 = DSCore.List.FirstItem(t3@-2<1>);
t6 = String.ToNumber(t5);
t7 = DSCore.List.LastItem(t3@-2<1>);
t8 = String.ToNumber(t7);
rdx = t9;
x = t6;
rdy = t10;
y = t8;
t1 = (rdx - x) * 1000;
t2 = (rdy - y) * 1000;
t11 = Math.Round(t1);
t12 = Math.Round(t2);
point1 = Point.ByCoordinates(t11, t12);
t4[1];
# ----------------------------------------
Points = Output(code_block.point1)
Metadata = Output(code_block.out14)
