# Dynamo custom node GIS2BIM.GetRevitSiteLocation.dyf (Dynamo 1.3.3.4111)
# category: GIS2BIM.Revit
# Gets the properties of the current Site Location of the active Revit Project

siteLocation = SiteLocation()
string_from_object = FromObject(siteLocation)
code_block = CodeBlock(t3=string_from_object) { t4 = String.Split(t3, {",", " "}); t4[0]; t4[1]; t4[2]; }
Name = Output(code_block.out1)
Lon = Output(code_block.out3)
Lat = Output(code_block.out2)
Location = Output(siteLocation)
