# Dynamo custom node GIS2BIM.PDOKReverseGeocodingNetherlands.dyf (Dynamo 1.3.3.4111)
# category: GIS2BIM.DutchGEO
# Reverse geocoding using the PDOK-server in the Netherlands.

code_block = CodeBlock { "http://test.geodata.nationaalgeoregister.nl/locatieserver/revgeo?"; "X="; "&Y="; "&type=provincie"; "&distance=0"; }
Rdx = Input(Rdx:string)
Rdy = Input(Rdy:string)
concat = String.Concat(code_block.out0, code_block.out1, Rdx, code_block.out2, Rdy, code_block.out3, code_block.out4)
web_request = WebRequest(concat)
string = StringInput("\"weergavenaam\" : \"Provincie ")
string_2 = StringInput("\",")
split = String.Split(web_request, string, string_2)
code_block_2 = CodeBlock(a=split) { a[2]; }
Provincie = Output(code_block_2)
Latitude = Input(Latitude:string)

# group: WINDGEBIED&PROVINCIE
code_block_3 = CodeBlock { "2"; "1_2"; "2"; "3"; "3"; "3"; "3"; "2"; "3"; "2"; "2"; }
create = List.Create(code_block_3.out0, code_block_3.out1, code_block_3.out2, code_block_3.out3, code_block_3.out4, code_block_3.out5, code_block_3.out6, code_block_3.out7, code_block_3.out8, code_block_3.out9, code_block_3.out10)
code_block_4 = CodeBlock()
# ---------- code_block_4.designscript (11 lines) ----------
"Zuid-Holland";
"Noord-Holland";
"Zeeland";
"Noord-Brabant";
"Limburg";
"Gelderland";
"Utrecht";
"Flevoland";
"Overijssel";
"Friesland";
"Groningen";
# ----------------------------------------
create_2 = List.Create(code_block_4.out0, code_block_4.out1, code_block_4.out2, code_block_4.out3, code_block_4.out4, code_block_4.out5, code_block_4.out6, code_block_4.out7, code_block_4.out8, code_block_4.out9, code_block_4.out10)
indexOf = IndexOf(create_2, code_block_2)
getItemAtIndex = List.GetItemAtIndex(list=create, index=indexOf)
eq = getItemAtIndex == code_block_3.out1
toNumber = String.ToNumber(Latitude)
code_block_5 = CodeBlock { 52.5; }
lt = toNumber < code_block_5
code_block_6 = CodeBlock { 1; 2; }
if_ = If(test=lt, true=code_block_6.out1, false=code_block_6.out0)
if_2 = If(test=eq, true=if_, false=getItemAtIndex)

Windarea = Output(if_2)
