# Dynamo custom node GIS2BIM.DownloadAHN.dyf (Dynamo 1.3.3.4111)
# category: GIS2BIM.DutchGEO
# get the mapnumber(s) of the AHN based on a given boundingbox

UrlwebrequestAHN2 = Input()
web_request = WebRequest(UrlwebrequestAHN2)
code_block = CodeBlock()
# ---------- code_block.designscript (10 lines) ----------
//XPATHSTRINGS
".//{http://ahn2.geonovum.nl}bladnr";
".//{http://ahn2.geonovum.nl}update";
".//{http://ahn2.geonovum.nl}min_datum";
".//{http://ahn2.geonovum.nl}max_datum";
".//{http://ahn2.geonovum.nl}cellsize";
".//{http://ahn2.geonovum.nl}lo_x";
".//{http://ahn2.geonovum.nl}lo_y";
".//{http://ahn2.geonovum.nl}datum";
".//{http://ahn2.geonovum.nl}geom_valid";
# ----------------------------------------
create = List.Create(code_block.out0, code_block.out1, code_block.out2, code_block.out3, code_block.out4, code_block.out5, code_block.out6, code_block.out7, code_block.out8)
XMLXPath = Custom[GIS2BIM.XMLXPath](XMLString=web_request, XPathStrings=create)  # Run an XPathquery on an xml-string
code_block_2 = CodeBlock { 0; }
getItemAtIndex = List.GetItemAtIndex(list=XMLXPath, index=code_block_2)
Mapnumber = Output(getItemAtIndex)  # "Mapnumber: string"
code_block_3 = CodeBlock()
# ---------- code_block_3.designscript (3 lines) ----------
"http://geodata.nationaalgeoregister.nl/ahn2/extract/ahn2_gefilterd/u";
"http://geodata.nationaalgeoregister.nl/ahn2/extract/ahn2_uitgefilterd/u";
"https://geodata.nationaalgeoregister.nl/ahn3/extract/ahn3_laz/C_";
# ----------------------------------------
code_block_4 = CodeBlock { ".laz.zip"; ".LAZ"; }
concat = String.Concat(code_block_3.out0, arg2=code_block_4.out0)  # unwired: arg1
map = List.Map(list=getItemAtIndex, f_x=concat)
Downloadlink_AHN2_gefilterd = Output(map)  # "Downloadlink_AHN2_gefilterd: string"
concat_2 = String.Concat(code_block_3.out1, arg2=code_block_4.out0)  # unwired: arg1
map_2 = List.Map(list=getItemAtIndex, f_x=concat_2)
Downloadlink_AHN2_uitgefilterd = Output(map_2)  # "Downloadlink_AHN2_uitgefilterd: string"
toUpper = String.ToUpper(getItemAtIndex)
concat_3 = String.Concat(code_block_3.out2, arg2=code_block_4.out1)  # unwired: arg1
map_3 = List.Map(list=toUpper, f_x=concat_3)
downloadlink_AHN3 = Output(map_3)  # "downloadlink_AHN3: string"
AHN2_Metadata_Values = Output(XMLXPath)
AHN2_Metadata_Xquery = Output(create)
UrlwebrequestAHN3 = Input(UrlwebrequestAHN3:string="optional")
web_request_2 = WebRequest(UrlwebrequestAHN3)
code_block_5 = CodeBlock()
# ---------- code_block_5.designscript (6 lines) ----------
//XPATHSTRINGS
".//{http://ahn3.geonovum.nl}bladnr";
".//{http://ahn3.geonovum.nl}cellsize";
".//{http://ahn3.geonovum.nl}lo_x";
".//{http://ahn3.geonovum.nl}lo_y";
".//{http://ahn3.geonovum.nl}has_data";
# ----------------------------------------
create_2 = List.Create(code_block_5.out0, code_block_5.out1, code_block_5.out2, code_block_5.out3, code_block_5.out4)
XMLXPath_2 = Custom[GIS2BIM.XMLXPath](XMLString=web_request_2, XPathStrings=create_2)
AHN3_Metadata_Values = Output(XMLXPath_2)
AHN3_Metadata_Xquery = Output(create_2)
