# Dynamo custom node GIS2BIM.WebrequestWMS2.dyf (Dynamo 2.1.0.7500)
# category: GIS2BIM.WMS
# a webrequest based on WMS-protocol

WMSwebrequest = Input(WMSwebrequest: var[]..[])  # url for WMS webrequest
python_script = Python(IN[0]=WMSwebrequest)
# ---------- python_script.python (17 lines) ----------
import sys
sys.path.append("C:\Program Files (x86)\IronPython 2.7\Lib")

import clr

clr.AddReference("System.Drawing")
clr.AddReference("System")
from System.Drawing import Image
from System.Net import WebRequest
url= IN[0]


request = WebRequest.Create(url)
response = request.GetResponse()
bitmap = Image.FromStream(response.GetResponseStream())

OUT = bitmap
# ----------------------------------------
Bitmap = Output(python_script)  # "Bitmap:Image"
