# Dynamo graph BAG 3D.dyn (Dynamo 2.1.0.7500)

# group: OF GEBRUIK DE REVIT SITE LOCATION
code_block = CodeBlock { "4326"; "28992"; }
getRevitSiteLocation = Custom[GIS2BIM.GetRevitSiteLocation]()  # Gets the properties of the current Site Location of the active Revit Project
transformCRS_epsg = Custom[GIS2BIM.TransformCRS_epsg](sourceCRS=code_block.out0, targetCRS=code_block.out1, xCoordinate=getRevitSiteLocation.Lon, yCoordinate=getRevitSiteLocation.Lat)  # Uses the API of http://epsg.io to transform Coordinate Reference Systems

# group: GEOCODING
code_block_2 = CodeBlock { "Dordrecht"; "grotekerksbuurt"; "20"; }
getLocationdataNetherlands = Custom[GIS2BIM.GetLocationdataNetherlands](City=code_block_2.out0, Streetname=code_block_2.out1, Housenumber=code_block_2.out2)  # Gives locationdata based on an adress in the Netherlands

code_block_3 = CodeBlock(RDX=getLocationdataNetherlands.RDcoordinateX_meters_double, RDY=getLocationdataNetherlands.RDcoordinateY_meters_double) { RDX; RDY; }
width_boundingbox = CodeBlock { 400; }

# group: BOUNDINGBOX EN CONSTRUEER WEBREQUEST
createBoundingBox = Custom[GIS2BIM.CreateBoundingBox](CoordinateX=code_block_3.RDX, CoordinateY=code_block_3.RDY, BoxWidth=width_boundingbox, BoxHeight=width_boundingbox)  # create boundingboxstring for webrequests based on coördinates and dimensions
geoservicesLibraryNetherlands = Custom[GIS2BIM.GeoservicesLibraryNetherlands](BoundingBox_var=createBoundingBox.Boxstring)  # Library with multiple webadresses which can be used for WFS and WMS webrequests

# group: WEBREQUEST & QUERY GML
web_request = WebRequest(url=geoservicesLibraryNetherlands.3D_BAG_TU_Delft_OGC_WFS)
string = StringInput(".//{3dbag}identificatie")  # graph input
string_2 = StringInput(".//{3dbag}bouwjaar")  # graph input
string_3 = StringInput(".//{http://www.opengis.net/gml}posList")  # graph input
string_4 = StringInput(".//{3dbag}ground-0.00")  # graph input
string_5 = StringInput(".//{3dbag}ground-0.50")  # graph input
string_6 = StringInput(".//{3dbag}roof-0.00")  # graph input
string_7 = StringInput(".//{3dbag}roof-0.50")  # graph input
string_8 = StringInput(".//{3dbag}roof-0.99")  # graph input
create = List.Create(item0=string, item1=string_2, item2=string_3, item3=string_4, item4=string_5, item5=string_6, item6=string_7, item7=string_8)
XMLXPath = Custom[GIS2BIM.XMLXPath](XMLString=web_request, XPathStrings=create)  # Run an XPathquery on an xml-string

peil_tov_nap_m = CodeBlock { 2.0; }

# group: CONVERT GML TO POINTS
code_block_4 = CodeBlock(a=XMLXPath) { polygons=a[2]; bottom=a[4]; top=a[7]; }
code_block_5 = CodeBlock(rdx=code_block_3.RDX, rdy=code_block_3.RDY, peil_NAP=peil_tov_nap_m) { rdx; rdy; peil_NAP; }
code_block_6 = CodeBlock(t8=code_block_4.polygons, rdx=code_block_5.rdx, rdy=code_block_5.rdy, zbottom=code_block_4.bottom, peil_NAP=code_block_5.peil_NAP, ztop=code_block_4.top)
# ---------- code_block_6.designscript (9 lines) ----------
t7 = String.Split(t8, [" "]);
t9 = DSCore.List.DropEveryNthItem(t7@-2<1>, 3, 0);
rdxlist = DSCore.String.ToNumber(DSCore.List.DropEveryNthItem(t9@-2<1>, 2, 0));
rdylist = DSCore.String.ToNumber(DSCore.List.DropEveryNthItem(t9@-2<1>, 2, 1));
xlocal= DSCore.Math.Round(1000*(rdxlist-rdx));
ylocal= DSCore.Math.Round(1000*(rdylist-rdy));
zlocalbottom=1000*(DSCore.String.ToNumber(zbottom)-peil_NAP);
zlocaltop=1000*(DSCore.String.ToNumber(ztop)-peil_NAP);
thickness=zlocaltop-zlocalbottom;
# ----------------------------------------

# group: CREATE SOLID GEOMETRY
byCoordinates = Point.ByCoordinates(x=code_block_6.xlocal, y=code_block_6.ylocal, z=code_block_6.zlocalbottom)
byPoints = PolyCurve.ByPoints(points=byCoordinates)
byPatch = Surface.ByPatch(closedCurve=byPoints)
boolean = BoolSelector(false)  # graph input
thicken = Surface.Thicken(surface=byPatch, thickness=code_block_6.thickness, both_sides=boolean)

# group: familytemplate
file_path = Filename("..\..\..\..\..\..\..\..\..\..\..\ProgramData\Autodesk\RVT 2020\Family Templates\English\Conceptual Mass\Metric Mass.rft")  # graph input

code_block_7 = CodeBlock { "Form"; }

# group: UNIQUE FAMILY FOR EVERY BUILDING
code_block_8 = CodeBlock(a=XMLXPath) { a[0]; }
code_block_9 = CodeBlock { "NLRS_90_MA_BAG_"; ".rfa"; }
concat = String.Concat(string0=code_block_9.out0, string2=code_block_9.out1)  # unwired: string1
map = List.Map(list=code_block_8, f_x=concat)
categories = Categories("OST_Mass")  # graph input
byGeometry = Custom[Springs.FamilyInstance.ByGeometry](geometry=thicken, familyTemplatePath=file_path, familyName=map, category=categories, subcategoryName=code_block_7)  # frozen; You must provide a valid family template path that will be used for all input geometry objects. The project units(and not the templates) will be used to determine the size of the output geometry. The provided category will be used only if the family template supports it. If not, the default template category will be used instead. Likewise, the family material(provided as a string) will be set only if a material with that name exists in the template. If not, the default material will be used instead ("By Category"). For void cuts, the material settings will be ignored. The Subcategory name is an optional input. If you'd like to skip assigning a Subcategory to any new instance, simply use null. The node expects a unique family name for each geometry object. The rest of the input lists will be processed as if the node lacing is set to longest.

# group: BOUWJAAR INSTELLEN
code_block_10 = CodeBlock { "Comments"; }
code_block_11 = CodeBlock(a=XMLXPath) { bouwjaar=a[1]; }
setParameterByName = Element.SetParameterByName(element=byGeometry.instance, parameterName=code_block_10, value=code_block_11)
code_block_12 = CodeBlock { "-"; }
split = String.Split(str=code_block_11, separator0=code_block_12)
firstItem = List.FirstItem(list=split@L2)

watch = Watch(web_request)
sendTo = Custom[Clipboard.SendTo](str=geoservicesLibraryNetherlands.3D_BAG_TU_Delft_OGC_WFS)  # Copies a string to the clipboard.
isNull = Object.IsNull(obj=thicken)
filterByBoolMask = List.FilterByBoolMask(list=thicken, mask=isNull)

# group: ONE FAMILY FOR ALL BUILDINGS
byUnion = Solid.ByUnion(solids=filterByBoolMask.out)
code_block_13 = CodeBlock { "NLRS_90_MA_BAG_omgeving.rfa"; }
byGeometry_2 = Custom[Springs.FamilyInstance.ByGeometry](geometry=byUnion, familyTemplatePath=file_path, familyName=code_block_13, category=categories, subcategoryName=code_block_7)
