# Dynamo custom node GIS2BIM.AHN3toPoints.dyf (Dynamo 1.3.4.6666)
# category: GIS2BIM.DutchGEO
# Load AHN3 via Geotiff WCS. Transform to local coordinates

Rdx = Input()
Rdy = Input()
code_block = CodeBlock()
# ---------- code_block.designscript (11 lines) ----------
"https://geodata.nationaalgeoregister.nl/ahn3/wcs?";
"SERVICE=WCS&VERSION=1.0.0";
"&REQUEST=GetCoverage";
"&FORMAT=GEOTIFF_FLOAT32";
"&COVERAGE=";
"&BBOX=";
"99198.4917734710033983,485588.33618855383247137,106915.96004800940863788,494366.81641667388612404";
"&CRS=EPSG:28992";
"&RESPONSE_CRS=EPSG:28992";
"&WIDTH=";
"&HEIGHT=";
# ----------------------------------------
Layer = Input(Layer: string="ahn3_05m_dtm")
BoundinxboxWidth = Input()
createBoundingBox = Custom[GIS2BIM.CreateBoundingBox](CoordinateX=Rdx, CoordinateY=Rdy, BoxWidth=BoundinxboxWidth, BoxHeight=BoundinxboxWidth)  # create boundingboxstring for webrequests based on coördinates and dimensions
ResolutionGeotiff = Input(ResolutionGeotiff: string="150")
concat = String.Concat(code_block.out0, code_block.out1, code_block.out2, code_block.out3, code_block.out4, Layer, code_block.out5, createBoundingBox.Boxstring, code_block.out7, code_block.out8, code_block.out9, ResolutionGeotiff, code_block.out10, ResolutionGeotiff)
FilepathName = Input(FilepathName: string)
python_script = Python(IN[0]=concat, IN[1]=FilepathName)
# ---------- python_script.python (10 lines) ----------
import sys
sys.path.append("C:\Program Files (x86)\IronPython 2.7\Lib")
from System.Net import WebClient

url= IN[0]
filoc= IN[1]

WebClient().DownloadFile(url, filoc)

OUT= filoc
# ----------------------------------------
read = GeoTiffReader.Read(python_script)
WaterlevelHeight = Input(WaterlevelHeight: double=-3)
python_script_2 = Python(IN[0]=Rdx, IN[1]=Rdy, IN[2]=read, IN[3]=WaterlevelHeight)
# ---------- python_script_2.python (31 lines) ----------
import clr
clr.AddReference('ProtoGeometry')
from Autodesk.DesignScript.Geometry import *
#The inputs to this node will be stored as a list in the IN variables.
dataEnteringNode = IN

#Assign your output to the OUT variable.

rdx= IN[0]
rdy = IN[1]
GeotiffValues = IN[2]
Waterbottom = IN[3]

x = []
y = []
z = []

for i in GeotiffValues:
		x.append(int((i[1]-rdx)*1000))
		y.append(int((i[0]-rdy)*1000))
		if int(i[2]) is 0:
			z.append(Waterbottom*1000)
		else:
			z.append(int(i[2]*1000))

Points = []

for i,j,h in zip(x,y,z):
	Points.append(Point.ByCoordinates(i,j,h))
	
OUT = Points
# ----------------------------------------
Points = Output(python_script_2)
