# Dynamo custom node GIS2BIM.GetRevitSiteLocation.dyf (Dynamo 1.3.3.4111)
# category: GIS2BIM.Revit
# Gets the properties of the current Site Location of the active Revit Project

siteLocation = SiteLocation()
string_from_object = FromObject(siteLocation)
code_block = CodeBlock { "Name:"; "Lat"; }
split = String.Split(string_from_object, code_block.out0, code_block.out1)
code_block_2 = CodeBlock(a=split) { a[0]; }
Name = Output(code_block_2)
longitude = DynamoUnits.Location.Longitude(siteLocation)
string_from_object_2 = FromObject(longitude)
Lon = Output(string_from_object_2)
latitude = DynamoUnits.Location.Latitude(siteLocation)
string_from_object_3 = FromObject(latitude)
Lat = Output(string_from_object_3)
Location = Output(siteLocation)
