# Dynamo custom node GIS2BIM.OSM3DBuilding.dyf (Dynamo 1.3.4.6666)
# category: GIS2BIM.OSM
# Filter OSM-data and look for buildings with 'height' parameter and create 3D solid

extrudeAsSolid = Curve.ExtrudeAsSolid()  # unwired: arg0
OSMBuildingpoints = Input()
OSMBuildingKeys = Input()
string_from_object = FromObject(OSMBuildingKeys)
code_block = CodeBlock { "m"; }

# group: GET HEIGHT OF BUILDINGS
code_block_2 = CodeBlock { "height:"; }
contains = String.Contains(str=string_from_object, searchFor=code_block_2)
filterByBoolMask = List.FilterByBoolMask(list=string_from_object, mask=contains)
isEmpty = List.IsEmpty()  # unwired: arg0
map = List.Map(list=filterByBoolMask.in, f_x=isEmpty)
code_block_3 = CodeBlock { 0; }
eq = map == code_block_3
flatten = Flatten(filterByBoolMask.in)
split = String.Split(flatten, code_block_2, code_block)
flatten_2 = Flatten(split)
toNumber = String.ToNumber(flatten_2)
code_block_4 = CodeBlock(height=toNumber) { height*1000; }

filterByBoolMask_2 = List.FilterByBoolMask(list=OSMBuildingpoints, mask=eq)
byPoints = PolyCurve.ByPoints(points=filterByBoolMask_2.in)
flatten_3 = Flatten(byPoints)
extrudeAsSolid_2 = Curve.ExtrudeAsSolid(curve=flatten_3, distance=code_block_4)
Solids = Output(extrudeAsSolid_2)
