# Dynamo custom node GIS2BIM.WMTSZoomLevelTileRow.dyf (Dynamo 1.3.4.6666)
# category: GIS2BIM.WMTS/TMS
# gives the tilerow and tilecolumn for the WMTS webrequest

XCorner = Input(XCorner: double=-285401.92)
YCorner = Input(YCorner: double=903402.0)
Rdx = Input()
Rdy = Input()
PixelWidth = Input(PixelWidth: int=256)
Resolution = Input(Resolution: double)
code_block = CodeBlock(XrdCorner=XCorner, YrdCorner=YCorner, RDx=Rdx, RDy=Rdy, PixelWidth=PixelWidth, MetersPerPixel=Resolution)
# ---------- code_block.designscript (12 lines) ----------
XrdCorner;
YrdCorner;
//www.geonovum.nl/uploads/documents/nederlandse_richtlijn_tiling_-_versie_1.1.pdf
dx=RDx-XrdCorner;
dy=YrdCorner-RDy;
tileSize=PixelWidth*MetersPerPixel;
column=Math.Floor(dx/tileSize);
row=Math.Floor(dy/tileSize);
centerXrd=XrdCorner+(column+0.5)*tileSize;
centerYrd=YrdCorner-(row+0.5)*tileSize;
shiftXmm=Math.Round(centerXrd-RDx,2)*1000;
shiftymm=Math.Round(centerYrd-RDy,2)*1000;
# ----------------------------------------
string_from_object = FromObject(code_block.row)
TileRow = Output(string_from_object)
string_from_object_2 = FromObject(code_block.column)
TileColumn = Output(string_from_object_2)
DeltaXmm = Output(code_block.shiftXmm)
DeltaYmm = Output(code_block.shiftymm)
