# Dynamo custom node GIS2BIM.SetSharedCoordinate.dyf (Dynamo 1.3.1.1736)
# category: GIS2BIM.Coordinates
# Set shared coordinate/project basepoint

categories = Categories("ProjectBasePoint")
all_elements_of_category = ElementsOfCategory(categories)
string = StringInput("E/W")
MeterToMM = Input(MeterToMM : bool=true)
code_block = CodeBlock { 1; 1000; }
if_ = If(test=MeterToMM, true=code_block.out1, false=code_block.out0)
X = Input(X: double)
mul = if_ * X
setParameterByName = Element.SetParameterByName(element=all_elements_of_category, parameterName=string, value=mul)
Xresult = Output(setParameterByName)
string_2 = StringInput("N/S")
Y = Input(Y: double)
mul_2 = if_ * Y
setParameterByName_2 = Element.SetParameterByName(element=all_elements_of_category, parameterName=string_2, value=mul_2)
Yresult = Output(setParameterByName_2)
string_3 = StringInput("Elev")
Z = Input(Z: double=0)
mul_3 = if_ * Z
setParameterByName_3 = Element.SetParameterByName(element=all_elements_of_category, parameterName=string_3, value=mul_3)
Zresult = Output(setParameterByName_3)
