# Dynamo graph BGT.dyn (Dynamo 1.3.1.1736)

# note: It will take quite some time to run this node. It can take 10 minutes. When you run parts of it it will be quicker. Open the file: GIStoBIM1.rvt from the package-folder to use the standard filled regions and linetypes.
code_block = CodeBlock { "Dordrecht"; "lange geldersekade"; "1"; }
getLocationdataNetherlands = Custom[GIS2BIM.GetLocationdataNetherlands](City=code_block.out0, Streetname=code_block.out1, Housenumber=code_block.out2)  # Gives locationdata based on an adress in the Netherlands
getMortonCodeCoordinate = Custom[GIS2BIM.GetMortonCodeCoordinate](X=getLocationdataNetherlands.RDcoordinate_X_meters, Y=getLocationdataNetherlands.RDcoordinate_Y_meters)  # Get mortoncode given 2 coordinates and tiledimension
TEMPfolder = StringInput("C:\TEMP")
downloadBGTdata = Custom[GIS2BIM.DownloadBGTdata](Mortoncode=getMortonCodeCoordinate, Directory=TEMPfolder)  # Download BGT-data(dutch GIS-information)
unzipFile = Custom[GIS2BIM.UnzipFile](FilePathZipFile=downloadBGTdata.Location, DirectoryToExtractTo=downloadBGTdata.Directory)  # Unzip zip-file
width = CodeBlock { 200; }
views = Views()

# group: 2D SETTINGS
# note: Panden;
# 0 bgt_overigbouwwerk;
# Groen;
# 1 bgt_begroeidterreindeel;
# Lijnen(aparte lagen);
# 2 bgt_functioneelgebied;
# 3 bgt_gebouwinstallatie;
# 4 bgt_kunstwerkdeel;
# 5 bgt_onbegroeidterreindeel;
# 6 bgt_ondersteunendwegdeel;
# 7 bgt_overigescheiding;
# 8 bgt_scheiding;
# 9 bgt_spoor;
# 10 bgt_tunneldeel;
# Wegen bruggen en kunstwerken;
# 11 bgt_kunstwerkdeel;
# 12 bgt_overbruggingsdeel;
# 13 bgt_wegdeel;
# Water;
# 14 bgt_ondersteunendwaterdeel;
# 15 bgt_waterdeel;
# Labels;
# 16 bgt_openbareruimtelabel;
# Puntobject;
# 17 bgt_vegetatieobject;
tree = FamilyTypes("90_DI_boom:90_DI_boom")
PANDEN = FilledRegionTypes("FP_DP_90_pand")
GROEN1 = FilledRegionTypes("FP_DP_90_groen1")
GROEN2 = FilledRegionTypes("FP_DP_90_groen2")
WEG = FilledRegionTypes("FP_DP_90_weg")
weg_ondergeschikt = FilledRegionTypes("FP_DP_90_weg2")
WATER = FilledRegionTypes("FP_DP_90_water")
line_styles = CodeBlock()
# ---------- line_styles.designscript (9 lines) ----------
"bgt_functioneelgebied";
"bgt_gebouwinstallatie";
"bgt_kunstwerkdeel";
"bgt_onbegroeidterreindeel";
"bgt_ondersteunendwegdeel";
"bgt_overigescheiding";
"bgt_scheiding";
"bgt_spoor";
"bgt_tunneldeel";
# ----------------------------------------

# note: UNFREEZE THIS NODE AFTER THE DOWNLOAD IS COMPLETE
BGT2D = Custom[GIS2BIM.BGT2D](Directory=downloadBGTdata.Directory, RDx=getLocationdataNetherlands.RDcoordinate_X_meters, RDy=getLocationdataNetherlands.RDcoordinate_Y_meters, BoundingboxWidth=width, View=views, DetailcomponentTree=tree, FilledRegionPand=PANDEN, FilledRegionGreen1=GROEN1, FilledRegionGreen2=GROEN2, FilledRegionRoad=WEG, FilledRegionRoad2=weg_ondergeschikt, FilledRegionWater=WATER, LineStyleBGT_functioneelgebied=line_styles.out0, LineStyleBGT_gebouwinstallatie=line_styles.out1, LineStyleBGT_kunstwerkdeel=line_styles.out2, LineStyleBGT_onbegroeidterreindeel=line_styles.out3, LineStyleBGT_ondersteunendwegdeel=line_styles.out4, LineStyleBGT_overigescheiding=line_styles.out5, LineStyleBGT_scheiding=line_styles.out6, LineStyleBGT_spoor=line_styles.out7, LineStyleBGT_tunneldeel=line_styles.out8)  # frozen; Create 2D BGT siteplan from set of GML-files
