# Dynamo graph GEFCPTmport.dyn (Dynamo 1.3.1.1736)

code_block = CodeBlock { Point.ByCoordinates(0,0,0); 5000; }
byCenterPointRadius = Circle.ByCenterPointRadius(centerPoint=code_block.out0, radius=code_block.out1)
file_path = Filename("..\..\..\Users\Maarten\Documents\GitHub\GIS2BIM\supportfiles\ExampleFiles\GEF1.GEF")
readGEFCPT = Custom[GIS2BIM.ReadGEFCPT](file=file_path)  # read the content of a GEF-file an order it into unique soillayers and depths
file_path_2 = Filename("..\nodes\0.2\support\Metric Site.rft")
GEFCPTTo3DSoilLayers = Custom[GIS2BIM.GEFCPTTo3DSoilLayers](closedPolyCurve=byCenterPointRadius, startDepthUniqueSoilLayers=readGEFCPT.startDepthUniqueSoilLayers, materialnameUniqueSoilLayers=readGEFCPT.nameUniqueSoilLayers, familyTemplateSite=file_path_2)  # creates 3D site families for each unique soillayer
