# Dynamo graph LocationResearch.dyn (Dynamo 1.3.1.1736)

code_block = CodeBlock { "Dordrecht"; "lange geldersekade"; "1"; }
getLocationdataNetherlands = Custom[GIS2BIM.GetLocationdataNetherlands](City=code_block.out0, Streetname=code_block.out1, Housenumber=code_block.out2)  # Gives locationdata based on an adress in the Netherlands
zoomlevel = CodeBlock { 14; 250; "C:/TEMP/WMTS/"; }
WMTSLayersNetherlands = Custom[GIS2BIM.WMTSLayersNetherlands]()  # Library with layers for webrequests of WMTS-services in the Netherlands
byName = DraftingView.ByName(WMTSLayersNetherlands.2016_ortho25IR)
WMTSRequestAndImport = Custom[GIS2BIM.WMTSRequestAndImport](Rdx=getLocationdataNetherlands.RDcoordinate_X_meters, Rdy=getLocationdataNetherlands.RDcoordinate_Y_meters, Zoomlevel=zoomlevel.out0, Boundingboxwidth=zoomlevel.out1, TemppathFiles=zoomlevel.out2, View=byName, Layer=WMTSLayersNetherlands.2016_ortho25IR)  # total node with WMTS webrequest and import of image in view
watch_image = WatchImageCore(WMTSRequestAndImport)
byName_2 = DraftingView.ByName(WMTSLayersNetherlands.bgtstandaard)
WMTSRequestAndImport_2 = Custom[GIS2BIM.WMTSRequestAndImport](Rdx=getLocationdataNetherlands.RDcoordinate_X_meters, Rdy=getLocationdataNetherlands.RDcoordinate_Y_meters, Zoomlevel=zoomlevel.out0, Boundingboxwidth=zoomlevel.out1, TemppathFiles=zoomlevel.out2, View=byName_2, Layer=WMTSLayersNetherlands.bgtstandaard)
watch_image_2 = WatchImageCore(WMTSRequestAndImport_2)
byName_3 = DraftingView.ByName(WMTSLayersNetherlands.natura2000)
WMTSRequestAndImport_3 = Custom[GIS2BIM.WMTSRequestAndImport](Rdx=getLocationdataNetherlands.RDcoordinate_X_meters, Rdy=getLocationdataNetherlands.RDcoordinate_Y_meters, Zoomlevel=zoomlevel.out0, Boundingboxwidth=zoomlevel.out1, TemppathFiles=zoomlevel.out2, View=byName_3, Layer=WMTSLayersNetherlands.natura2000)
watch_image_3 = WatchImageCore(WMTSRequestAndImport_3)
byName_4 = DraftingView.ByName(WMTSLayersNetherlands.kadastralekaartv3)
WMTSRequestAndImport_4 = Custom[GIS2BIM.WMTSRequestAndImport](Rdx=getLocationdataNetherlands.RDcoordinate_X_meters, Rdy=getLocationdataNetherlands.RDcoordinate_Y_meters, Zoomlevel=zoomlevel.out0, Boundingboxwidth=zoomlevel.out1, TemppathFiles=zoomlevel.out2, View=byName_4, Layer=WMTSLayersNetherlands.kadastralekaartv3)
watch_image_4 = WatchImageCore(WMTSRequestAndImport_4)
byName_5 = DraftingView.ByName(WMTSLayersNetherlands.nok2011)
WMTSRequestAndImport_5 = Custom[GIS2BIM.WMTSRequestAndImport](Rdx=getLocationdataNetherlands.RDcoordinate_X_meters, Rdy=getLocationdataNetherlands.RDcoordinate_Y_meters, Zoomlevel=zoomlevel.out0, Boundingboxwidth=zoomlevel.out1, TemppathFiles=zoomlevel.out2, View=byName_5, Layer=WMTSLayersNetherlands.nok2011)
watch_image_5 = WatchImageCore(WMTSRequestAndImport_5)
byName_6 = DraftingView.ByName(WMTSLayersNetherlands.ahn2_05m_non)
WMTSRequestAndImport_6 = Custom[GIS2BIM.WMTSRequestAndImport](Rdx=getLocationdataNetherlands.RDcoordinate_X_meters, Rdy=getLocationdataNetherlands.RDcoordinate_Y_meters, Zoomlevel=zoomlevel.out0, Boundingboxwidth=zoomlevel.out1, TemppathFiles=zoomlevel.out2, View=byName_6, Layer=WMTSLayersNetherlands.ahn2_05m_non)
watch_image_6 = WatchImageCore(WMTSRequestAndImport_6)
byName_7 = DraftingView.ByName(WMTSLayersNetherlands.aan)
WMTSRequestAndImport_7 = Custom[GIS2BIM.WMTSRequestAndImport](Rdx=getLocationdataNetherlands.RDcoordinate_X_meters, Rdy=getLocationdataNetherlands.RDcoordinate_Y_meters, Zoomlevel=zoomlevel.out0, Boundingboxwidth=zoomlevel.out1, TemppathFiles=zoomlevel.out2, View=byName_7, Layer=WMTSLayersNetherlands.aan)
watch_image_7 = WatchImageCore(WMTSRequestAndImport_7)
byName_8 = DraftingView.ByName(WMTSLayersNetherlands.bag)
WMTSRequestAndImport_8 = Custom[GIS2BIM.WMTSRequestAndImport](Rdx=getLocationdataNetherlands.RDcoordinate_X_meters, Rdy=getLocationdataNetherlands.RDcoordinate_Y_meters, Zoomlevel=zoomlevel.out0, Boundingboxwidth=zoomlevel.out1, TemppathFiles=zoomlevel.out2, View=byName_8, Layer=WMTSLayersNetherlands.bag)
watch_image_8 = WatchImageCore(WMTSRequestAndImport_8)
byName_9 = DraftingView.ByName(WMTSLayersNetherlands.brtachtergrondkaart)
WMTSRequestAndImport_9 = Custom[GIS2BIM.WMTSRequestAndImport](Rdx=getLocationdataNetherlands.RDcoordinate_X_meters, Rdy=getLocationdataNetherlands.RDcoordinate_Y_meters, Zoomlevel=zoomlevel.out0, Boundingboxwidth=zoomlevel.out1, TemppathFiles=zoomlevel.out2, View=byName_9, Layer=WMTSLayersNetherlands.brtachtergrondkaart)
watch_image_9 = WatchImageCore(WMTSRequestAndImport_9)
code_block_2 = CodeBlock { 14; 3000; }
byName_10 = DraftingView.ByName(WMTSLayersNetherlands.top500raster)
WMTSRequestAndImport_10 = Custom[GIS2BIM.WMTSRequestAndImport](Rdx=getLocationdataNetherlands.RDcoordinate_X_meters, Rdy=getLocationdataNetherlands.RDcoordinate_Y_meters, Zoomlevel=code_block_2.out0, Boundingboxwidth=code_block_2.out1, TemppathFiles=zoomlevel.out2, View=byName_10, Layer=WMTSLayersNetherlands.top500raster)
watch_image_10 = WatchImageCore(WMTSRequestAndImport_10)
code_block_3 = CodeBlock { 14; 15000; }
byName_11 = DraftingView.ByName(WMTSLayersNetherlands.top1000raster)
WMTSRequestAndImport_11 = Custom[GIS2BIM.WMTSRequestAndImport](Rdx=getLocationdataNetherlands.RDcoordinate_X_meters, Rdy=getLocationdataNetherlands.RDcoordinate_Y_meters, Zoomlevel=code_block_3.out0, Boundingboxwidth=code_block_3.out1, TemppathFiles=zoomlevel.out2, View=byName_11, Layer=WMTSLayersNetherlands.top1000raster)
watch_image_11 = WatchImageCore(WMTSRequestAndImport_11)
code_block_4 = CodeBlock { 500; }
createBoundingBox = Custom[GIS2BIM.CreateBoundingBox](CoordinateX=getLocationdataNetherlands.RDcoordinate_X_meters, CoordinateY=getLocationdataNetherlands.RDcoordinate_Y_meters, BoxWidth=code_block_4, BoxHeight=code_block_4)  # create boundingboxstring for webrequests based on coördinates and dimensions
geoservicesLibraryNetherlands = Custom[GIS2BIM.GeoservicesLibraryNetherlands](BoundingBox=createBoundingBox)  # Library with multiple webadresses which can be used for WFS and WMS webrequests
code_block_5 = CodeBlock { "Ruimtelijke Plannen"; }
byName_12 = DraftingView.ByName(code_block_5)
code_block_6 = CodeBlock { "C:/TEMP/"; }
webrequestWMS = Custom[GIS2BIM.WebrequestWMS](WMSwebrequest=geoservicesLibraryNetherlands.12_ruimtelijkeplannen_WMS, Boundingboxwidth=code_block_4, View=byName_12, Tempfolder=code_block_6, Filename=code_block_5)  # imports the result(image) of a webrequest based on WMS-protocol into a view in Revit
watch_image_12 = WatchImageCore(webrequestWMS)
code_block_7 = CodeBlock()
# ---------- code_block_7.designscript (9 lines) ----------
"http://services.rce.geovoorziening.nl/rce/wms?";
"REQUEST=GetMap&SERVICE=WMS";
"&VERSION=1.3.0";
"&WIDTH=2000";
"&HEIGHT=2000";
"&LAYERS=rce:NationalListedMonuments";
"&FORMAT=image/png";
"&BBOX=";
"&CRS=urn:ogc:def:crs:EPSG::28992";
# ----------------------------------------
concat = String.Concat(code_block_7.out0, code_block_7.out1, code_block_7.out2, code_block_7.out3, code_block_7.out4, code_block_7.out5, code_block_7.out6, code_block_7.out7, createBoundingBox, code_block_7.out8)
code_block_8 = CodeBlock { "Rijksmonumenten"; }
byName_13 = DraftingView.ByName(code_block_8)
webrequestWMS_2 = Custom[GIS2BIM.WebrequestWMS](WMSwebrequest=concat, Boundingboxwidth=code_block_4, View=byName_13, Tempfolder=code_block_6, Filename=code_block_8)
watch_image_13 = WatchImageCore(webrequestWMS_2)
code_block_9 = CodeBlock()
# ---------- code_block_9.designscript (9 lines) ----------
"http://services.rce.geovoorziening.nl/rce/wms?";
"REQUEST=GetMap&SERVICE=WMS";
"&VERSION=1.3.0";
"&WIDTH=2000";
"&HEIGHT=2000";
"&LAYERS=rce:Townscapes";
"&FORMAT=image/png";
"&BBOX=";
"&CRS=urn:ogc:def:crs:EPSG::28992";
# ----------------------------------------
concat_2 = String.Concat(code_block_9.out0, code_block_9.out1, code_block_9.out2, code_block_9.out3, code_block_9.out4, code_block_9.out5, code_block_9.out6, code_block_9.out7, createBoundingBox, code_block_9.out8)
code_block_10 = CodeBlock { "Beschermd Stads Dorpsgezicht"; }
byName_14 = DraftingView.ByName(code_block_10)
webrequestWMS_3 = Custom[GIS2BIM.WebrequestWMS](WMSwebrequest=concat_2, Boundingboxwidth=code_block_4, View=byName_14, Tempfolder=code_block_6, Filename=code_block_10)
watch_image_14 = WatchImageCore(webrequestWMS_3)
code_block_11 = CodeBlock()
# ---------- code_block_11.designscript (9 lines) ----------
"https://geodata.nationaalgeoregister.nl/indgebfunderingsproblematiek/wms?";
"REQUEST=GetMap&SERVICE=WMS";
"&VERSION=1.3.0";
"&WIDTH=2000";
"&HEIGHT=2000";
"&LAYERS=indgebfunderingsproblematiek";
"&FORMAT=image/png";
"&BBOX=";
"&CRS=urn:ogc:def:crs:EPSG::28992";
# ----------------------------------------
concat_3 = String.Concat(code_block_11.out0, code_block_11.out1, code_block_11.out2, code_block_11.out3, code_block_11.out4, code_block_11.out5, code_block_11.out6, code_block_11.out7, createBoundingBox, code_block_11.out8)
code_block_12 = CodeBlock { "Indicatieve aandachtsgebieden funderingsproblematiek "; }
byName_15 = DraftingView.ByName(code_block_12)
webrequestWMS_4 = Custom[GIS2BIM.WebrequestWMS](WMSwebrequest=concat_3, Boundingboxwidth=code_block_4, View=byName_15, Tempfolder=code_block_6, Filename=code_block_12)
watch_image_15 = WatchImageCore(webrequestWMS_4)
code_block_13 = CodeBlock { "Luchtfoto2016"; }
byName_16 = DraftingView.ByName(code_block_13)
webrequestWMS_5 = Custom[GIS2BIM.WebrequestWMS](WMSwebrequest=geoservicesLibraryNetherlands.5_luchtfoto_2016_WMS, Boundingboxwidth=code_block_4, View=byName_16, Tempfolder=code_block_6, Filename=code_block_13)
watch_image_16 = WatchImageCore(webrequestWMS_5)
code_block_14 = CodeBlock { "bodemkaart50000"; }
byName_17 = DraftingView.ByName(code_block_14)
WMTSRequestAndImport_12 = Custom[GIS2BIM.WMTSRequestAndImport](Rdx=getLocationdataNetherlands.RDcoordinate_X_meters, Rdy=getLocationdataNetherlands.RDcoordinate_Y_meters, Zoomlevel=zoomlevel.out0, Boundingboxwidth=zoomlevel.out1, TemppathFiles=zoomlevel.out2, View=byName_17, Layer=code_block_14)
watch_image_17 = WatchImageCore(WMTSRequestAndImport_12)
code_block_15 = CodeBlock { "geomorfologischekaart50000"; }
byName_18 = DraftingView.ByName(code_block_15)
WMTSRequestAndImport_13 = Custom[GIS2BIM.WMTSRequestAndImport](Rdx=getLocationdataNetherlands.RDcoordinate_X_meters, Rdy=getLocationdataNetherlands.RDcoordinate_Y_meters, Zoomlevel=zoomlevel.out0, Boundingboxwidth=zoomlevel.out1, TemppathFiles=zoomlevel.out2, View=byName_18, Layer=code_block_15)
watch_image_18 = WatchImageCore(WMTSRequestAndImport_13)
