# Dynamo custom node GIS2BIM.DownloadOSM.dyf (Dynamo 1.3.1.1736)
# category: GIS2BIM.WebrequestActions
# Download OSM data within a boundingbox

Directory = Input()
Directory_2 = Output(Directory)  # "Directory"
code_block = CodeBlock { "https://overpass-api.de/api/map?bbox="; ","; }
West = Input()
python_script = Python(IN[0]=West)
# ---------- python_script.python (21 lines) ----------
#Copyright(c) 2016, Dimitar Venkov
# @5devene, dimitar.ven@gmail.com

import clr

def tolist(obj1):
	if hasattr(obj1,"__iter__"): return obj1
	else: return [obj1]

def output1(l1):
	if len(l1) == 1: return l1[0]
	else: return l1

num1 = tolist(IN[0])
out1 = []
for i in xrange(len(num1)):
	s1 = str(num1[i])
	if s1[-2:] == ".0": out1.append(s1[:-2])
	else: out1.append(s1)

OUT = output1(out1)
# ----------------------------------------
South = Input()
python_script_2 = Python(IN[0]=South)
# ---------- python_script_2.python (22 lines) ----------
#Copyright(c) 2016, Dimitar Venkov
# @5devene, dimitar.ven@gmail.com

import clr

def tolist(obj1):
	if hasattr(obj1,"__iter__"): return obj1
	else: return [obj1]

def output1(l1):
	if len(l1) == 1: return l1[0]
	else: return l1

num1 = tolist(IN[0])
out1 = []

for i in xrange(len(num1)):
	s1 = str(num1[i])
	if s1[-2:] == ".0": out1.append(s1[:-2])
	else: out1.append(s1)

OUT = output1(out1)
# ----------------------------------------
East = Input()
python_script_3 = Python(IN[0]=East)  # same code as python_script
North = Input()
python_script_4 = Python(IN[0]=North)  # same code as python_script
concat = String.Concat(code_block.out0, python_script, code_block.out1, python_script_2, code_block.out1, python_script_3, code_block.out1, python_script_4)
string = StringInput("/")
code_block_2 = CodeBlock { "map"; }
code_block_3 = CodeBlock { ".osm"; }
concat_2 = String.Concat(Directory, string, code_block_2, code_block_3)
python_script_5 = Python(IN[0]=concat, IN[1]=concat_2)
# ---------- python_script_5.python (10 lines) ----------
import sys
sys.path.append("C:\Program Files (x86)\IronPython 2.7\Lib")
from System.Net import WebClient

url= IN[0]
filoc= IN[1]

WebClient().DownloadFile(url, filoc)

OUT= filoc
# ----------------------------------------
Location = Output(python_script_5)
DownloadlinkOSM = Output(concat)
