# Dynamo graph Set Locationdata.dyn (Dynamo 1.3.1.1736)

string = StringInput("Get RD-coordinates from Address")
string_2 = StringInput("OK")
code_block = CodeBlock { "Place"; }
categories = Categories("ProjectInformation")
all_elements_of_category = ElementsOfCategory(categories)
code_block_2 = CodeBlock { "project_plaats"; }
getParameterValueByName = Element.GetParameterValueByName(element=all_elements_of_category, parameterName=code_block_2)
firstItem = List.FirstItem(getParameterValueByName)
ui_textbox_data = Custom[UI.TextBox Data](InputName=code_block, DefaultText=firstItem)  # Create Data for TextBox input in UI.MultipleInputForm ++ . Check out www.data-shapes.net for more informations
code_block_3 = CodeBlock { "Street"; }
code_block_4 = CodeBlock { "project_straatnaam"; }
getParameterValueByName_2 = Element.GetParameterValueByName(element=all_elements_of_category, parameterName=code_block_4)
firstItem_2 = List.FirstItem(getParameterValueByName_2)
ui_textbox_data_2 = Custom[UI.TextBox Data](InputName=code_block_3, DefaultText=firstItem_2)
code_block_5 = CodeBlock { "HouseNumber"; }
code_block_6 = CodeBlock { "project_huisnummer"; }
getParameterValueByName_3 = Element.GetParameterValueByName(element=all_elements_of_category, parameterName=code_block_6)
firstItem_3 = List.FirstItem(getParameterValueByName_3)
ui_textbox_data_3 = Custom[UI.TextBox Data](InputName=code_block_5, DefaultText=firstItem_3)
create = List.Create(ui_textbox_data, ui_textbox_data_2, ui_textbox_data_3)
boolean = BoolSelector(true)
code_block_7 = CodeBlock { 250; }
ui_multipleinputform = Custom[UI.MultipleInputForm ++](Description_optional=string, ButtonText_optional=string_2, Inputs=create, Toggle=boolean, Width_optional=code_block_7)  # Create a form with multiple inputs. see www.data-shapes.net for tutorials and infos!
code_block_8 = CodeBlock { 0; 1; 2; }
getItemAtIndex = List.GetItemAtIndex(list=ui_multipleinputform.User_Inputs, index=code_block_8.out0)
getItemAtIndex_2 = List.GetItemAtIndex(list=ui_multipleinputform.User_Inputs, index=code_block_8.out1)
getItemAtIndex_3 = List.GetItemAtIndex(list=ui_multipleinputform.User_Inputs, index=code_block_8.out2)
getLocationdataNetherlands = Custom[GIS2BIM.GetLocationdataNetherlands](City=getItemAtIndex, Streetname=getItemAtIndex_2, Housenumber=getItemAtIndex_3)  # Gives locationdata based on an adress in the Netherlands
setSharedCoordinate = Custom[GIS2BIM.SetSharedCoordinate](X=getLocationdataNetherlands.RDcoordinate_X_meters, Y=getLocationdataNetherlands.RDcoordinate_Y_meters)  # Set shared coordinate/project basepoint
categories_2 = Categories("ProjectInformation")
all_elements_of_category_2 = ElementsOfCategory(categories_2)
code_block_9 = CodeBlock { "kadastraal_nummer"; "kadastrale_sectie"; }
setParameterByName = Element.SetParameterByName(element=all_elements_of_category_2, parameterName=code_block_9.out0, value=getLocationdataNetherlands.Perceel_kadaster)
setParameterByName_2 = Element.SetParameterByName(element=all_elements_of_category_2, parameterName=code_block_9.out1, value=getLocationdataNetherlands.Sectie_kadaster)
categories_3 = Categories("ProjectInformation")
all_elements_of_category_3 = ElementsOfCategory(categories_3)
code_block_10 = CodeBlock { "project_plaats"; }
setParameterByName_3 = Element.SetParameterByName(element=all_elements_of_category_3, parameterName=code_block_10, value=getItemAtIndex)
code_block_11 = CodeBlock { "project_straatnaam"; }
setParameterByName_4 = Element.SetParameterByName(element=all_elements_of_category_3, parameterName=code_block_11, value=getItemAtIndex_2)
code_block_12 = CodeBlock { "project_huisnummer"; }
setParameterByName_5 = Element.SetParameterByName(element=all_elements_of_category_3, parameterName=code_block_12, value=getItemAtIndex_3)
