# Dynamo graph WMTS.dyn (Dynamo 1.3.1.1736)

code_block = CodeBlock { "Hellevoetsluis"; "kanaalweg westzijde"; "45"; }
getLocationdataNetherlands = Custom[GIS2BIM.GetLocationdataNetherlands](City=code_block.out0, Streetname=code_block.out1, Housenumber=code_block.out2)  # Gives locationdata based on an adress in the Netherlands
zoomlevel = CodeBlock { 14; 200; "C:/TEMP/WMTS/"; }
views = Views("BGT Copy 1 Copy 1")
WMTSLayersNetherlands = Custom[GIS2BIM.WMTSLayersNetherlands]()  # Library with layers for webrequests of WMTS-services in the Netherlands
WMTSRequestAndImport = Custom[GIS2BIM.WMTSRequestAndImport](Rdx=getLocationdataNetherlands.RDcoordinate_X_meters, Rdy=getLocationdataNetherlands.RDcoordinate_Y_meters, Zoomlevel=zoomlevel.out0, Boundingboxwidth=zoomlevel.out1, TemppathFiles=zoomlevel.out2, View=views, Layer=WMTSLayersNetherlands.2016_ortho25IR)  # total node with WMTS webrequest and import of image in view
watch_image = WatchImageCore(WMTSRequestAndImport)
