# Dynamo custom node GIS2BIM.DownloadAHN.dyf (Dynamo 1.3.2.2480)
# category: GIS2BIM.DutchGEO
# get the mapnumber(s) of the AHN based on a given boundingbox

Urlwebrequest = Input()
web_request = WebRequest(Urlwebrequest)
code_block = CodeBlock()
# ---------- code_block.designscript (2 lines) ----------
//XPATHSTRING
".//{http://ahn2.geonovum.nl}bladnr";
# ----------------------------------------

# group: PYTHON FROM BAKERY
python_script = Python(IN[0]=web_request, IN[1]=code_block)
# ---------- python_script.python (53 lines) ----------
import clr
import sys
clr.AddReference('ProtoGeometry')
from Autodesk.DesignScript.Geometry import *
sys.path.append("C:\Program Files (x86)\IronPython 2.7\Lib")
#from xml.parsers.expat import expat -- can't find this
import xml.etree.ElementTree as ET
#The inputs to this node will be stored as a list in the IN variables.
xml = IN[0]
xpathstr = IN[1]

root = ET.fromstring(xml)

xpathfound = root.findall(xpathstr)
#xparentstr = xpathstr + "/.."
#xparentfound = root.findall(xpathstr+"/..")
xtags, xtext, xcountattrib, xattrib, xattvals, xcountiter, xitertags, xitervals, xparents = [], [], [], [], [], [], [], [], []
for x in xpathfound:
	xtags.append(x.tag)
	if x.text:
		try:
			xtext.append(x.text)
		except:
			xtext.append("_none_")
	else:
		xtext.append("_none_")
	if x.keys():
		xcountattrib.append(len(x.items()))
		for name, value in x.items():
			xattrib.append(name)
			xattvals.append(value)
#PARENT CODE BELOW IS TOO SLOW
#			try:
#				xparents.append(root.find(xpathstr + "/" + name + "/.."))
#			except:
#				xparents.append("no parent found")
	else:
		xcountattrib.append(1)
		xattrib.append("_none_")
		xattvals.append("_none_")

#THIS METHOD NOT GREAT
#	if x.iter():
#		xcountiter.append(len(x.iter()))
#		for name, value in x.iter():
#			xitertags.append(name)
#			xitervals.append(value)
#for y in xparentfound:
#	xparents.append(y.tag)

OUT = root, str(root), xpathfound, xtags, xtext, xcountattrib, xattrib, xattvals
#, xparents 
#, xparentfound#, xparents#, xcountiter, xitertags, xitervals
# ----------------------------------------

code_block_2 = CodeBlock { 4; }
getItemAtIndex = List.GetItemAtIndex(list=python_script, index=code_block_2)
Mapnumber = Output(getItemAtIndex)  # "Mapnumber: string"
code_block_3 = CodeBlock()
# ---------- code_block_3.designscript (3 lines) ----------
"http://geodata.nationaalgeoregister.nl/ahn2/extract/ahn2_gefilterd/u";
"http://geodata.nationaalgeoregister.nl/ahn2/extract/ahn2_uitgefilterd/u";
"https://geodata.nationaalgeoregister.nl/ahn3/extract/ahn3_laz/C_";
# ----------------------------------------
code_block_4 = CodeBlock { ".laz.zip"; ".LAZ"; }
concat = String.Concat(code_block_3.out0, arg2=code_block_4.out0)  # unwired: arg1
map = List.Map(list=getItemAtIndex, f_x=concat)
Downloadlink_AHN2_gefilterd = Output(map)  # "Downloadlink_AHN2_gefilterd: string"
concat_2 = String.Concat(code_block_3.out1, arg2=code_block_4.out0)  # unwired: arg1
map_2 = List.Map(list=getItemAtIndex, f_x=concat_2)
Downloadlink_AHN2_uitgefilterd = Output(map_2)  # "Downloadlink_AHN2_uitgefilterd: string"
toUpper = String.ToUpper(getItemAtIndex)
concat_3 = String.Concat(code_block_3.out2, arg2=code_block_4.out1)  # unwired: arg1
map_3 = List.Map(list=toUpper, f_x=concat_3)
downloadlink_AHN3 = Output(map_3)  # "downloadlink_AHN3: string"
