# Dynamo custom node GIS2BIM.TransformCRS_epsg.dyf (Dynamo 1.3.2.2480)
# category: GIS2BIM.Coordinates
# Uses the API of http://epsg.io to transform Coordinate Reference Systems

code_block = CodeBlock()
# ---------- code_block.designscript (10 lines) ----------
"http://epsg.io/trans?";
"&s_srs=";
4326;
"&t_srs=";
3760;
"&x=";
-157.8619911;
"&y=";
21.3049475;
"&format=json&trans=1&callback=jsonpFunction";
# ----------------------------------------
sourceCRS = Input(sourceCRS: string="4326")  # EPSG_code of the source Coordinate Reference System
targetCRS = Input(targetCRS: string)  # EPSG_code of the target Coordinate Reference System
xCoordinate = Input(xCoordinate: string)  # X-coordinate of the source Coordinate Reference System
yCoordinate = Input(yCoordinate: string)  # Y-coordinate of the source Coordinate Reference System
concat = String.Concat(code_block.out0, code_block.out1, sourceCRS, code_block.out3, targetCRS, code_block.out5, xCoordinate, code_block.out7, yCoordinate, code_block.out9)
web_request = WebRequest(concat)
string = StringInput("\"")
split = String.Split(web_request, string)
code_block_2 = CodeBlock { 3; 7; }
getItemAtIndex = List.GetItemAtIndex(list=split, index=code_block_2.out1)
toNumber = String.ToNumber(getItemAtIndex)
Xtransformed = Output(toNumber)
getItemAtIndex_2 = List.GetItemAtIndex(list=split, index=code_block_2.out0)
toNumber_2 = String.ToNumber(getItemAtIndex_2)
Ytransformed = Output(toNumber_2)
URL = Output(concat)
