# Dynamo custom node GIS2BIM.ArcGIS_REST_API_QUERY.dyf (Dynamo 1.3.1.1736)
# category: GIS2BIM.ARCGIS
# Create query to connect to arcGIS webservers

WebserverAddress = Input()
code_block = CodeBlock()
# ---------- code_block.designscript (30 lines) ----------
"query?";
"where=";
"&text=";
"&objectIds=";
"&time=";
"&geometry=";
"%2C";

"&geometryType=esriGeometryEnvelope";
"&inSR=";
"&spatialRel=esriSpatialRelIntersects";
"&relationParam=";
"&outFields=*";
"&returnGeometry=true";
"&returnTrueCurves=false";
"&maxAllowableOffset=";
"&geometryPrecision=";
"&outSR=";
"&returnIdsOnly=false";
"&returnCountOnly=false";
"&orderByFields=";
"&groupByFieldsForStatistics=";
"&outStatistics=";
"&returnZ=false";
"&returnM=false";
"&gdbVersion=";
"&returnDistinctValues=false";
"&resultOffset=";
"&resultRecordCount=";
"&f=json";
# ----------------------------------------
Boundingbox = Input()
CRS = Input()
concat = String.Concat(WebserverAddress, code_block.out0, code_block.out1, code_block.out2, code_block.out3, code_block.out4, code_block.out5, Boundingbox, code_block.out7, code_block.out8, CRS, code_block.out9, code_block.out10, code_block.out11, code_block.out12, code_block.out13, code_block.out14, code_block.out15, code_block.out16, code_block.out17, code_block.out18, code_block.out19, code_block.out20, code_block.out21, code_block.out22, code_block.out23, code_block.out24, code_block.out25, code_block.out26, code_block.out27, code_block.out28)
WebrequestLink = Output(concat)
