# Dynamo custom node GIS2BIM.CreatePointFromGML.dyf (Dynamo 1.3.2.2480)
# category: GIS2BIM.Geometry
# Create Points from space seperated GML

UnitsConversionFactor = Input(UnitsConversionFactor: double=1000)  # Conversionfactor Units
XML = Input()
XPATHSTRING = Input(XPATHSTRING: string=".//{http://www.opengis.net/gml/3.2}pos")
python_script = Python(IN[0]=XML, IN[1]=XPATHSTRING)
# ---------- python_script.python (53 lines) ----------
import clr
import sys
clr.AddReference('ProtoGeometry')
from Autodesk.DesignScript.Geometry import *
sys.path.append("C:\Program Files (x86)\IronPython 2.7\Lib")
#from xml.parsers.expat import expat -- can't find this
import xml.etree.ElementTree as ET
#The inputs to this node will be stored as a list in the IN variables.
xml = IN[0]
xpathstr = IN[1]

root = ET.fromstring(xml)

xpathfound = root.findall(xpathstr)
#xparentstr = xpathstr + "/.."
#xparentfound = root.findall(xpathstr+"/..")
xtags, xtext, xcountattrib, xattrib, xattvals, xcountiter, xitertags, xitervals, xparents = [], [], [], [], [], [], [], [], []
for x in xpathfound:
	xtags.append(x.tag)
	if x.text:
		try:
			xtext.append(x.text)
		except:
			xtext.append("_none_")
	else:
		xtext.append("_none_")
	if x.keys():
		xcountattrib.append(len(x.items()))
		for name, value in x.items():
			xattrib.append(name)
			xattvals.append(value)
#PARENT CODE BELOW IS TOO SLOW
#			try:
#				xparents.append(root.find(xpathstr + "/" + name + "/.."))
#			except:
#				xparents.append("no parent found")
	else:
		xcountattrib.append(1)
		xattrib.append("_none_")
		xattvals.append("_none_")

#THIS METHOD NOT GREAT
#	if x.iter():
#		xcountiter.append(len(x.iter()))
#		for name, value in x.iter():
#			xitertags.append(name)
#			xitervals.append(value)
#for y in xparentfound:
#	xparents.append(y.tag)

OUT = root, str(root), xpathfound, xtags, xtext, xcountattrib, xattrib, xattvals
#, xparents 
#, xparentfound#, xparents#, xcountiter, xitertags, xitervals
# ----------------------------------------
code_block = CodeBlock { 4; }
getItemAtIndex = List.GetItemAtIndex(list=python_script, index=code_block)
flatten = Flatten(getItemAtIndex)
code_block_2 = CodeBlock { " "; }
split = String.Split(flatten, code_block_2)
toNumber = String.ToNumber(split)
code_block_3 = CodeBlock { 1; 2; 0; }
X = List.TakeEveryNthItem(arg1=code_block_3.out1, arg2=code_block_3.out0)  # unwired: arg0
map = List.Map(list=toNumber, f_x=X)
ModX = Input()
x_convert_to_local_axis = map - ModX
mul = UnitsConversionFactor * x_convert_to_local_axis
Y = List.TakeEveryNthItem(arg1=code_block_3.out1, arg2=code_block_3.out2)  # unwired: arg0
map_2 = List.Map(list=toNumber, f_x=Y)
ModY = Input()
y_convert_to_local_axis = map_2 - ModY
mul_2 = UnitsConversionFactor * y_convert_to_local_axis
code_block_4 = CodeBlock { 0; }
byCoordinates = Point.ByCoordinates(x=mul, y=mul_2, z=code_block_4)
flatten_2 = Flatten(byCoordinates)
Point = Output(flatten_2)
