# Dynamo custom node GIS2BIM.DoubleToString.dyf (Dynamo 1.3.1.1736)
# category: GIS2BIM.Coordinates
# Converts a double to a string

CoordinateDouble = Input(CoordinateDouble: double)
string_from_object = FromObject(CoordinateDouble)
code_block = CodeBlock { ","; "."; }
replace = String.Replace(str=string_from_object, searchFor=code_block.out0, replaceWith=code_block.out1)
CoordinateString = Output(replace)  # "CoordinateString: String"
