# Dynamo custom node GIS2BIM.GeoservicesLibraryNetherlands.dyf (Dynamo 1.3.1.1736)
# category: GIS2BIM.Geoservices.Europe
# Library with multiple webadresses which can be used for WFS and WMS webrequests

link_kadaster = CodeBlock()
# ---------- link_kadaster.designscript (5 lines) ----------
"http://geodata.nationaalgeoregister.nl/";
"kadastralekaartv3/wfs?";
"&request=GetFeature";
"&typeName=kadastralekaartv3:kadastralegrens";
"&bbox=";
# ----------------------------------------
BoundingBox = Input()
concat = String.Concat(link_kadaster.out0, link_kadaster.out1, link_kadaster.out2, link_kadaster.out3, link_kadaster.out4, BoundingBox)
n1_kadastrale_grenzen_WFS = Output(concat)  # "1 kadastrale grenzen(WFS)"
code_block = CodeBlock()
# ---------- code_block.designscript (6 lines) ----------
"http://afnemers.ruimtelijkeplannen.nl/afnemers/services?";
"&service=WFS";
"&version=1.1.0";
"&request=GetFeature";
"&typeName=app:Bouwvlak";
"&bbox=";
# ----------------------------------------
concat_2 = String.Concat(code_block.out0, code_block.out1, code_block.out2, code_block.out3, code_block.out4, code_block.out5, BoundingBox)
n2_ruimtelijke_plannen_WFS = Output(concat_2)  # "2 ruimtelijke plannen(WFS)"
code_block_2 = CodeBlock()
# ---------- code_block_2.designscript (5 lines) ----------
"http://geodata.nationaalgeoregister.nl/bag/wfs?";
"service=wfs&version=2.0.0&";
"request=GetFeature&typeName=";
"bag:verblijfsobject&";
"bbox=";
# ----------------------------------------
concat_3 = String.Concat(code_block_2.out0, code_block_2.out1, code_block_2.out2, code_block_2.out3, code_block_2.out4, BoundingBox)
n3_bag_verblijfsobject_WFS = Output(concat_3)  # "3 bag verblijfsobject(WFS)"
code_block_3 = CodeBlock()
# ---------- code_block_3.designscript (5 lines) ----------
"http://geodata.nationaalgeoregister.nl/bag/wfs?";
"service=wfs&version=2.0.0&";
"request=GetFeature&typeName=";
"bag:pand&";
"bbox=";
# ----------------------------------------
concat_4 = String.Concat(code_block_3.out0, code_block_3.out1, code_block_3.out2, code_block_3.out3, code_block_3.out4, BoundingBox)
n4_bag_pand_WFS = Output(concat_4)  # "4 bag pand(WFS)"
link_kadaster_2 = CodeBlock()
# ---------- link_kadaster_2.designscript (11 lines) ----------
"http://geodata.nationaalgeoregister.nl/";
"luchtfoto/rgb/wms?";
"&request=GetMap";
"&VERSION=1.3.0";
"&STYLES=default";
"&layers=2016_ortho25";
"&bbox=";
"&width=3000";
"&height=3000";
"&format=image/png";
"&crs=EPSG:28992";
# ----------------------------------------
concat_5 = String.Concat(link_kadaster_2.out0, link_kadaster_2.out1, link_kadaster_2.out2, link_kadaster_2.out3, link_kadaster_2.out4, link_kadaster_2.out5, link_kadaster_2.out6, BoundingBox, link_kadaster_2.out7, link_kadaster_2.out8, link_kadaster_2.out9, link_kadaster_2.out10)
n5_luchtfoto_2016_WMS = Output(concat_5)  # "5 luchtfoto 2016(WMS)"
link_kadaster_3 = CodeBlock()
# ---------- link_kadaster_3.designscript (11 lines) ----------
"http://geodata.nationaalgeoregister.nl/";
"cbsvierkanten100mv2/wms?";
"&request=GetMap";
"&VERSION=1.3.0";
"&STYLES=cbsvierkanten100mv2:cbsvierkanten100m_woz_waarde_woning";
"&layers=vierkant100m2011";
"&bbox=";
"&width=2000";
"&height=2000";
"&format=image/png";
"&crs=EPSG:28992";
# ----------------------------------------
concat_6 = String.Concat(link_kadaster_3.out0, link_kadaster_3.out1, link_kadaster_3.out2, link_kadaster_3.out3, link_kadaster_3.out4, link_kadaster_3.out5, link_kadaster_3.out6, BoundingBox, link_kadaster_3.out7, link_kadaster_3.out8, link_kadaster_3.out9, link_kadaster_3.out10)
n6_CBS_WOZ_2011_100m_WMS = Output(concat_6)  # "6 CBS-WOZ 2011 100m(WMS)"
code_block_4 = CodeBlock { "http://geodata.nationaalgeoregister.nl/cbsvierkanten100mv2/ows?service=WMS&request=GetLegendGraphic&format=image%2Fpng&width=20&height=20&layer=vierkant100m2011&style=cbsvierkanten100m_woz_waarde_woning"; }
n6_legenda = Output(code_block_4)  # "6 legenda"
link_kadaster_4 = CodeBlock()
# ---------- link_kadaster_4.designscript (5 lines) ----------
"http://geodata.nationaalgeoregister.nl/";
"kadastralekaartv3/wfs?";
"&request=GetFeature";
"&typeName=kadastralekaartv3:annotatie";
"&bbox=";
# ----------------------------------------
concat_7 = String.Concat(link_kadaster_4.out0, link_kadaster_4.out1, link_kadaster_4.out2, link_kadaster_4.out3, link_kadaster_4.out4, BoundingBox)
n7_kadastrale_annotatie = Output(concat_7)  # "7 kadastrale annotatie"
link_kadaster_5 = CodeBlock()
# ---------- link_kadaster_5.designscript (5 lines) ----------
"http://geodata.nationaalgeoregister.nl/";
"kadastralekaartv3/wfs?";
"&request=GetFeature";
"&typeName=kadastralekaartv3:perceel";
"&bbox=";
# ----------------------------------------
concat_8 = String.Concat(link_kadaster_5.out0, link_kadaster_5.out1, link_kadaster_5.out2, link_kadaster_5.out3, link_kadaster_5.out4, BoundingBox)
n8_kadastrale_perceel = Output(concat_8)  # "8 kadastrale perceel"
link_kadaster_6 = CodeBlock()
# ---------- link_kadaster_6.designscript (6 lines) ----------
"http://services.rce.geovoorziening.nl/rce/wfs?";
"SERVICE=wfs";
"&VERSION=2.0.0";
"&request=GetFeature";
"&typeName=rce:NationalListedMonuments";
"&bbox=";
# ----------------------------------------
concat_9 = String.Concat(link_kadaster_6.out0, link_kadaster_6.out1, link_kadaster_6.out2, link_kadaster_6.out3, link_kadaster_6.out4, link_kadaster_6.out5, BoundingBox)
n9_rijksmonumenten = Output(concat_9)  # "9 rijksmonumenten"
link_kadaster_7 = CodeBlock()
# ---------- link_kadaster_7.designscript (11 lines) ----------
"http://geodata.nationaalgeoregister.nl/";
"plu/wms?";
"&request=GetMap";
"&VERSION=1.3.0";
"&STYLES=Bouwvlak";
"&layers=Bouwvlak";
"&bbox=";
"&width=2000";
"&height=2000";
"&format=image/png";
"&crs=EPSG:28992";
# ----------------------------------------
concat_10 = String.Concat(link_kadaster_7.out0, link_kadaster_7.out1, link_kadaster_7.out2, link_kadaster_7.out3, link_kadaster_7.out4, link_kadaster_7.out5, link_kadaster_7.out6, BoundingBox, link_kadaster_7.out7, link_kadaster_7.out8, link_kadaster_7.out9, link_kadaster_7.out10)
n10_bestemmingsplan_bouwvlak_WMS = Output(concat_10)  # "10 bestemmingsplan bouwvlak(WMS)"
code_block_5 = CodeBlock { "http://geodata.nationaalgeoregister.nl/ahn2/wfs?"; "&request=GetFeature&typeName="; "ahn2_bladindex&"; "bbox="; }
concat_11 = String.Concat(code_block_5.out0, code_block_5.out1, code_block_5.out2, code_block_5.out3, BoundingBox)
n11_AHN2_webrequest_bladindex = Output(concat_11)  # "11 AHN2 webrequest bladindex"
code_block_6 = CodeBlock()
# ---------- code_block_6.designscript (12 lines) ----------
"http://afnemers.ruimtelijkeplannen.nl/afnemers2012/services?";
"REQUEST=GetMap&SERVICE=WMS";
"&VERSION=1.3.0";
"&WIDTH=2000";
"&HEIGHT=2000";
"&LAYERS=BP:Bestemmingsplangebied,BP:Enkelbestemming,BP:Dubbelbestemming,BP:Functieaanduiding,BP:Figuur,BP:Gebiedsaanduiding,BP:Gebiedsaanduiding_overzicht,BP:Wijzigingsplangebied,BP:Bouwaanduiding,BP:Bouwvlak,BP:Inpassingsplangebied,BP:Lettertekenaanduiding,BP:Maatvoering,BP:Rijksbestemmingsplangebied,BP:Uitwerkingsplangebied";
"&STYLES=";
"&TRANSPARENT=TRUE";
"&FORMAT=image/png";
"&BBOX=";
"&CRS=urn:ogc:def:crs:EPSG::28992";
"&STYLES=default";
# ----------------------------------------
concat_12 = String.Concat(code_block_6.out0, code_block_6.out1, code_block_6.out2, code_block_6.out3, code_block_6.out4, code_block_6.out5, code_block_6.out6, code_block_6.out7, code_block_6.out8, code_block_6.out9, BoundingBox, code_block_6.out10, code_block_6.out11)
n12_ruimtelijkeplannen_WMS = Output(concat_12)  # "12 ruimtelijkeplannen(WMS)"
code_block_7 = CodeBlock()
# ---------- code_block_7.designscript (1 lines) ----------
https://geodata.nationaalgeoregister.nl/luchtfoto/infrarood/wms?request=GetCapabilities
# ----------------------------------------
