# Dynamo custom node GIS2BIM.GetSharedCoordinate.dyf (Dynamo 1.3.2.2480)
# category: GIS2BIM.Coordinates
# Get the current shared coordinate

categories = Categories("ProjectBasePoint")
all_elements_of_category = ElementsOfCategory(categories)
code_block = CodeBlock { {"E/W","N/S","Elev","Angle to True North"}; }
getParameterValueByName = Element.GetParameterValueByName(element=all_elements_of_category, parameterName=code_block, lacing=Longest)
code_block_2 = CodeBlock { -1; }
dropItems = List.DropItems(list=getParameterValueByName, amount=code_block_2)
scale = Input(scale: double=1000)  # GIS units are usually in meters
code_block_3 = CodeBlock(list=dropItems, scale=scale) { Flatten(list/scale); }
code_block_4 = CodeBlock(x=code_block_3) { x[0]; x[1]; x[2]; }
E_W = Output(code_block_4.out0)  # "E/W"
N_S = Output(code_block_4.out1)  # "N/S"
Elev = Output(code_block_4.out2)
lastItem = List.LastItem(getParameterValueByName)
Angle_to_True_North = Output(lastItem)
