# Dynamo custom node GIS2BIM.KadasterHouseNumbers.dyf (Dynamo 1.3.2.2480)
# category: GIS2BIM.DutchGEO
# Draw propertylines and place streetnames and housenumbers from the dutch kadaster

View = Input(View: Revit.View)
UrlWebrequestKadasterAnnotation = Input()
web_request = WebRequest(UrlWebrequestKadasterAnnotation)
DeltaX = Input()  # X-value of transformation of points and polygons
DeltaY = Input()  # Y-value of transformation of points and polygons
code_block = CodeBlock { 1000; }
createPointFromGML = Custom[GIS2BIM.CreatePointFromGML](XML=web_request, ModX=DeltaX, ModY=DeltaY, UnitsConversionFactor=code_block)  # Create Points from space seperated GML

# group: GET DATA FROM XML FOR HOUSENUMBER AND STREETNAME
string = StringInput(".//{http://kadastralekaartv3.geonovum.nl}classificatiecode")
python_script = Python(IN[0]=web_request, IN[1]=string)
# ---------- python_script.python (53 lines) ----------
import clr
import sys
clr.AddReference('ProtoGeometry')
from Autodesk.DesignScript.Geometry import *
sys.path.append("C:\Program Files (x86)\IronPython 2.7\Lib")
#from xml.parsers.expat import expat -- can't find this
import xml.etree.ElementTree as ET
#The inputs to this node will be stored as a list in the IN variables.
xml = IN[0]
xpathstr = IN[1]

root = ET.fromstring(xml)

xpathfound = root.findall(xpathstr)
#xparentstr = xpathstr + "/.."
#xparentfound = root.findall(xpathstr+"/..")
xtags, xtext, xcountattrib, xattrib, xattvals, xcountiter, xitertags, xitervals, xparents = [], [], [], [], [], [], [], [], []
for x in xpathfound:
	xtags.append(x.tag)
	if x.text:
		try:
			xtext.append(x.text)
		except:
			xtext.append("_none_")
	else:
		xtext.append("_none_")
	if x.keys():
		xcountattrib.append(len(x.items()))
		for name, value in x.items():
			xattrib.append(name)
			xattvals.append(value)
#PARENT CODE BELOW IS TOO SLOW
#			try:
#				xparents.append(root.find(xpathstr + "/" + name + "/.."))
#			except:
#				xparents.append("no parent found")
	else:
		xcountattrib.append(1)
		xattrib.append("_none_")
		xattvals.append("_none_")

#THIS METHOD NOT GREAT
#	if x.iter():
#		xcountiter.append(len(x.iter()))
#		for name, value in x.iter():
#			xitertags.append(name)
#			xitervals.append(value)
#for y in xparentfound:
#	xparents.append(y.tag)

OUT = root, str(root), xpathfound, xtags, xtext, xcountattrib, xattrib, xattvals
#, xparents 
#, xparentfound#, xparents#, xcountiter, xitertags, xitervals
# ----------------------------------------
code_block_2 = CodeBlock { 4; }
getItemAtIndex = List.GetItemAtIndex(list=python_script, index=code_block_2)
flatten = Flatten(getItemAtIndex)
string_2 = StringInput(".//{http://kadastralekaartv3.geonovum.nl}tekst")
python_script_2 = Python(IN[0]=web_request, IN[1]=string_2)  # same code as python_script
code_block_3 = CodeBlock { 4; }
getItemAtIndex_2 = List.GetItemAtIndex(list=python_script_2, index=code_block_3)
flatten_2 = Flatten(getItemAtIndex_2)
string_3 = StringInput(".//{http://kadastralekaartv3.geonovum.nl}rotatiehoek")
python_script_3 = Python(IN[0]=web_request, IN[1]=string_3)  # same code as python_script
code_block_4 = CodeBlock { 4; }
getItemAtIndex_3 = List.GetItemAtIndex(list=python_script_3, index=code_block_4)
flatten_3 = Flatten(getItemAtIndex_3)

TextTypeHousenumber = Input()
byName = TextNoteType.ByName(TextTypeHousenumber)

# group: PLACE TEXTNOTE FOR HOUSENUMBER
string_4 = StringInput("Z02")
eq = string_4 == flatten
filterByBoolMask = List.FilterByBoolMask(list=flatten_2, mask=eq)
flatten_4 = Flatten(filterByBoolMask.in)
string_5 = StringInput("Center")

TextTypeStreetname = Input()
byName_2 = TextNoteType.ByName(TextTypeStreetname)

# group: PLACE TEXTNOTE FOR STREETNAME
filterByBoolMask_2 = List.FilterByBoolMask(list=createPointFromGML, mask=eq)
filterByBoolMask_3 = List.FilterByBoolMask(list=flatten_3, mask=eq)
flatten_5 = Flatten(filterByBoolMask_2.out)
flatten_6 = Flatten(filterByBoolMask.out)
boolean = BoolSelector(true)
changeCase = String.ChangeCase(flatten_6, boolean)
string_6 = StringInput("Center")
flatten_7 = Flatten(filterByBoolMask_3.out)
toNumber = String.ToNumber(flatten_7)
byLocation = TextNote.ByLocation(view=View, location=flatten_5, text=changeCase, alignment=string_6, type=byName_2, rotation=toNumber)

# group (continued): PLACE TEXTNOTE FOR HOUSENUMBER
flatten_8 = Flatten(filterByBoolMask_2.in)
flatten_9 = Flatten(filterByBoolMask_3.in)
toNumber_2 = String.ToNumber(flatten_9)
byLocation_2 = TextNote.ByLocation(view=View, location=flatten_8, text=flatten_4, alignment=string_5, type=byName, rotation=toNumber_2)
