# Dynamo custom node GIS2BIM.OpenBrowser.dyf (Dynamo 1.3.1.1736)
# category: GIS2BIM.Helpers
# Opens a new window in your default browser with the given url.

toggle = Input(toggle: bool=true)
url = Input(url: string)
code_block = CodeBlock(x=url) { Flatten({x}); }
code_block_2 = CodeBlock(x=code_block) { x[0]; }
python_script_open_webbrowser_at = Python(IN[0]=toggle, IN[1]=code_block_2)  # "Python Script Open webbrowser at url"
# ---------- python_script_open_webbrowser_at.python (12 lines) ----------
import sys
sys.path.append("C:\Program Files (x86)\IronPython 2.7\Lib")
import webbrowser

run=IN[0]
url=IN[1]

if run==1:
	webbrowser.open_new(url)
	
	
OUT = run, url
# ----------------------------------------
code_block_3 = CodeBlock(out=python_script_open_webbrowser_at) { out[0]; out[1]; }
run = Output(code_block_3.out0)
url_2 = Output(code_block_3.out1)  # "url"
