# Dynamo custom node GIS2BIM.TMSBoundingboxFromTileNumber.dyf (Dynamo 1.3.1.1736)
# category: GIS2BIM.WMTS/TMS
# Calculate Lat/Lon boundaries from a TileNumber in TMS(Tile Map Service)

TileX = Input(TileX: double)
TileY = Input(TileY: double)
Zoomlevel = Input(Zoomlevel: double)
python_script = Python(IN[0]=TileX, IN[1]=TileY, IN[2]=Zoomlevel)
# ---------- python_script.python (18 lines) ----------
import sys
sys.path.append("C:\Program Files (x86)\IronPython 2.7\Lib")
import math

xtile = IN[0]
ytile = IN[1]
zoom = IN[2]

n = 2.0 ** zoom
W_deg = xtile / n * 360.0 - 180.0
N_rad = math.atan(math.sinh(math.pi * (1 - 2 * ytile / n)))
N_deg = math.degrees(N_rad)

E_deg = (xtile+1) / n * 360.0 - 180.0
S_rad = math.atan(math.sinh(math.pi * (1 - 2 * (ytile+1) / n)))
S_deg = math.degrees(S_rad)

OUT = N_deg,E_deg,S_deg,W_deg
# ----------------------------------------
code_block = CodeBlock(a=python_script) { a[0]; a[1]; a[2]; a[3]; }
West = Output(code_block.out3)
East = Output(code_block.out1)
North = Output(code_block.out0)
South = Output(code_block.out2)
