# Dynamo custom node GIS2BIM.TMS_WMTS_WebrequestAndCombineImages.dyf (Dynamo 1.3.1.1736)
# category: GIS2BIM.WMTS/TMS
# Webrequest for list of WMTS or TMS/Google webrequests for tiles. Combines them to 1 image.

URLlist = Input()
python_script = Python(IN[0]=URLlist)
# ---------- python_script.python (19 lines) ----------
import clr
clr.AddReference("System.Drawing")
clr.AddReference("System")
from System.Drawing import Image
from System.Drawing import Bitmap
from System.Drawing import Graphics
from System.Drawing.Imaging import ImageFormat
from System.Net import WebRequest
urls= IN[0]

bitmaps = []
for i in urls:
	request = WebRequest.Create(i)
	request.Accept = "text/html"
	request.UserAgent = "Mozilla/5.0"
	response = request.GetResponse()
	bitmaps.append(Image.FromStream(response.GetResponseStream()))

OUT = bitmaps
# ----------------------------------------
UniqueTileNumbersColumnX = Input()
code_block = CodeBlock(TileColumn=UniqueTileNumbersColumnX) { TileColumn; }
ReverseYaxis = Input(ReverseYaxis: bool=false)
UniqueTileNumbersRowY = Input()
code_block_2 = CodeBlock(TileRow=UniqueTileNumbersRowY) { TileRow; }
reverse = List.Reverse(code_block_2)
if_ = If(test=ReverseYaxis, true=reverse, false=code_block_2)
Pixels = Input(Pixels: double=256)
python_script_2 = Python(IN[0]=python_script, IN[1]=code_block, IN[2]=if_, IN[3]=Pixels)
# ---------- python_script_2.python (70 lines) ----------
import sys

sys.path.append("C:\Program Files (x86)\IronPython 2.7\Lib")
from math import *
import itertools
from itertools import islice

import clr

clr.AddReference("System.Drawing")
from System.Drawing import Image
from System.Drawing import Bitmap
from System.Drawing import Graphics
from System.Drawing.Imaging import ImageFormat
from System.IO import Path
from os import listdir

# The inputs to this node will be stored as a list in the IN variables.
bitmaps=IN[0]
x=IN[1]
y=IN[2]
pixels=IN[3]

TotalWidth= len(x)*pixels
TotalHeight= len(y)*pixels

# create image object for the new image
img = Bitmap(TotalWidth,TotalHeight)
g= Graphics.FromImage(img)

LPx=[]
n=0
for i in x:
	LPx.append(n*pixels)
	n=n+1

LPy=[]
n=0
for i in y:
	LPy.append(n*pixels)
	n=n+1

LPx2=[]
n=len(LPy)
for i in LPx:
	LPx2.append([i]*n)

LPx3=[]
for sublist in LPx2:
    for item in sublist:
        LPx3.append(item)

LPy2=[]
#n=len(LPy)
for i in LPx:
	LPy2.append(LPy)

LPy3=[]
for sublist in LPy2:
    for item in sublist:
        LPy3.append(item)
        
LPy4=reversed(LPy3)

for i,j,k in zip(bitmaps,LPx3,LPy4):
	g.DrawImage(i,j,k)

#h= Bitmap(512,512,g)

OUT = img
# ----------------------------------------
Image = Output(python_script_2)
TileImages = Output(python_script)
