# Dynamo custom node GIS2BIM.WebrequestWMTS.dyf (Dynamo 1.3.1.1736)
# category: GIS2BIM.WMTS/TMS

WMTSWebrequestslinks = Input(WMTSWebrequestslinks: string)
code_block = CodeBlock { ""; }
join = String.Join(code_block)  # unwired: arg1, arg2
UniqueTileRows = Input()
code_block_2 = CodeBlock(TileRow=UniqueTileRows) { TileRow; }
python_script = Python(IN[0]=code_block_2)
# ---------- python_script.python (21 lines) ----------
#Copyright(c) 2016, Dimitar Venkov
# @5devene, dimitar.ven@gmail.com

import clr

def tolist(obj1):
	if hasattr(obj1,"__iter__"): return obj1
	else: return [obj1]

def output1(l1):
	if len(l1) == 1: return l1[0]
	else: return l1

num1 = tolist(IN[0])
out1 = []
for i in xrange(len(num1)):
	s1 = str(num1[i])
	if s1[-2:] == ".0": out1.append(s1[:-2])
	else: out1.append(s1)

OUT = output1(out1)
# ----------------------------------------
concat = String.Concat()  # unwired: arg0, arg1, arg2
map = List.Map(list=python_script, f_x=concat)
UniqueTileColumns = Input()
code_block_3 = CodeBlock(TileColumn=UniqueTileColumns) { TileColumn; }
python_script_2 = Python(IN[0]=code_block_3)  # same code as python_script
concat_2 = String.Concat()  # unwired: arg0, arg1, arg2, arg3, arg4, arg5
map_2 = List.Map(list=python_script_2, f_x=concat_2)
combine = List.Combine(join, map, map_2)
python_script_3 = Python(IN[0]=WMTSWebrequestslinks, IN[1]=combine)
# ---------- python_script_3.python (11 lines) ----------
import sys
sys.path.append("C:\Program Files (x86)\IronPython 2.7\Lib")
from urllib import urlretrieve

urls= IN[0]
tempfiles= IN[1]

for url, tempfile in zip(urls, tempfiles):
    urlretrieve(url, tempfile)

OUT= tempfiles
# ----------------------------------------

# group: WAIT UNTIL ALL FILES ARE DOWNLOADED
python_script_4 = Python(IN[0]=python_script_3)
# ---------- python_script_4.python (20 lines) ----------
import sys

sys.path.append("C:\Program Files (x86)\IronPython 2.7\Lib")

import clr

clr.AddReference("mscorlib")
from System.IO import File

# The inputs to this node will be stored as a list in the IN variables.
FileLocations = IN[0]

x=0

Bools = []
for FileLocation in FileLocations:
	Bools.append(File.Exists(FileLocation))
	x= x+1

OUT = Bools
# ----------------------------------------
countTrue = CountTrue(python_script_4)
count = Count(python_script_4)
eq = countTrue == count
code_block_4 = CodeBlock { "waiting..."; }
if_ = If(test=eq, true=python_script_3, false=code_block_4)

TileFiles = Output(if_)
Layer = Output()  # unwired: arg0
