# Dynamo custom node GIS2BIM.ImportImageInView.dyf (Dynamo 1.3.3.4111)
# category: GIS2BIM.Image
# Import rasterimage in view

ImagePath = Input()
DeltaX = Input(DeltaX: double=0)  # mm
DeltaY = Input(DeltaY: double=0)  # mm
View = Input()
ImageWidthMeters = Input(ImageWidthMeters: double)
code_block = CodeBlock(ImagePath=ImagePath, deltax=DeltaX, deltay=DeltaY, view=View, ImageWidth=ImageWidthMeters) { ImagePath; deltax; deltay; view; ImageWidth; }
code_block_2 = CodeBlock(x=code_block.deltax, y=code_block.deltay) { x/304.8; y/304.8; }
code_block_3 = CodeBlock { 0; }
byCoordinates = Point.ByCoordinates(x=code_block_2.out0, y=code_block_2.out1, z=code_block_3)

# group: IMPORT IMAGE IN VIEW(PYTHONSCRIPT FROM DYNAMOFORUM, BY KONRAD S SOBON)
string = StringInput("/")
string_2 = StringInput("\")
replace = String.Replace(str=code_block.ImagePath, searchFor=string, replaceWith=string_2)
python_script = Python()
# ---------- python_script.python (19 lines) ----------
import clr
clr.AddReference('ProtoGeometry')
from Autodesk.DesignScript.Geometry import *
#The inputs to this node will be stored as a list in the IN variables.

clr.AddReference("RevitServices")
import RevitServices
from RevitServices.Persistence import DocumentManager
from RevitServices.Transactions import TransactionManager

clr.AddReference("RevitAPI")
import Autodesk 
from Autodesk.Revit.DB import * 
import System

dataEnteringNode = IN

#Assign your output to the OUT variable.
OUT = System.Enum.GetValues(BoxPlacement)
# ----------------------------------------
code_block_4 = CodeBlock(IN=python_script) { IN[0]; }
code_block_5 = CodeBlock { 200; }
python_script_2 = Python(IN[0]=code_block_4, IN[1]=byCoordinates, IN[2]=code_block_5)
# ---------- python_script_2.python (37 lines) ----------
# Created by Konrad K Sobon
import clr
clr.AddReference('ProtoGeometry')
from Autodesk.DesignScript.Geometry import *
#The inputs to this node will be stored as a list in the IN variables.

clr.AddReference("RevitAPI")
import Autodesk 
from Autodesk.Revit.DB import * 

dataEnteringNode = IN

placement = IN[0]
refPt = IN[1]
res = IN[2]

iio= ImageImportOptions()

def toRvtPoint(point):
	x = point.X
	y = point.Y
	z = point.Z
	return XYZ(x,y,z)
	
message = None
if placement != None:
	iio.Placement = placement
if refPt !=None:
	iio.RefPoint = toRvtPoint(refPt)
else: 
	message = "Please specify placement point."
if res !=None:
	iio.Resolution = res
else:
	iio.Resolution = 72
	
OUT = iio
# ----------------------------------------
boolean = BoolSelector(true)
import_image = Python(IN[0]=replace, IN[1]=python_script_2, IN[2]=code_block.view, IN[3]=boolean, IN[4]=code_block.ImageWidth)
# ---------- import_image.python (56 lines) ----------
#From Konrad K Sobon
#

import clr
clr.AddReference("ProtoGeometry")
from Autodesk.DesignScript.Geometry import *

# Import Element wrapper extension methods
clr.AddReference("RevitNodes")
import Revit
clr.ImportExtensions(Revit.Elements)

# Import geometry conversion extension methods
clr.ImportExtensions(Revit.GeometryConversion)

# Import DocumentManager and TransactionManager
clr.AddReference("RevitServices")
import RevitServices
from RevitServices.Persistence import DocumentManager
from RevitServices.Transactions import TransactionManager

doc = DocumentManager.Instance.CurrentDBDocument
uiapp = DocumentManager.Instance.CurrentUIApplication
app = uiapp.Application

#Import RevitAPI
clr.AddReference("RevitAPI")
import Autodesk
from Autodesk.Revit.DB import *

#inputs
dataEnteringNode = IN

filePath = IN[0]
iio = IN[1]
view = UnwrapElement(IN[2])
RunIt = IN[3]
ImageWidth = IN[4]

if RunIt:
	# Start Transaction
	doc = DocumentManager.Instance.CurrentDBDocument
	TransactionManager.Instance.EnsureInTransaction(doc)

	newElement = clr.StrongBox[Element]()
	elementOut = doc.Import(file = filePath, options = iio, view = view, element = newElement)
	
	#End Transaction
	TransactionManager.Instance.TransactionTaskDone()
	message = filePath
	ImageWidth = ImageWidth * 1000
	time = 30
else: 
	message = "Nee"

OUT = message,time,ImageWidth
# ----------------------------------------

code_block_6 = CodeBlock { 1; }
getItemAtIndex = List.GetItemAtIndex(list=import_image, index=code_block_6)
python_script_3 = Python(IN[0]=import_image, IN[1]=getItemAtIndex)
# ---------- python_script_3.python (14 lines) ----------
import clr
clr.AddReference('ProtoGeometry')
from Autodesk.DesignScript.Geometry import *
#The inputs to this node will be stored as a list in the IN variable.
import time

dataEnteringNode = IN
data = IN[0]
sec = IN[1]

time.sleep(sec)

#Assign your output to the OUT variable
OUT = data
# ----------------------------------------
firstItem = List.FirstItem(python_script_3)
lastItem = List.LastItem(python_script_3)

# group: SET IMAGE WIDTH
string_3 = StringInput("\")
split = String.Split(firstItem, string_3)
lastItem_2 = List.LastItem(split)
setImageWidth = Custom[GIS2BIM.SetImageWidth](Imagename=lastItem_2, Imagewidth=lastItem)  # set width of imported raster image
