# Dynamo custom node GIS2BIM.TMSGetTileNumbersFromBboxLATLON.dyf (Dynamo 1.3.1.1736)
# category: GIS2BIM.WMTS/TMS
# Get the Tilenumbers in X and Y in the TMS Webprotocol based on a given Boundingbox in LAT/LON

North = Input()
East = Input()
Zoomlevel = Input()

# group: TOP RIGHT
TMSTileNumberFromCoordinate = Custom[GIS2BIM.TMSTileNumberFromCoordinate](Latitude=North, Longitude=East, Zoomlevel=Zoomlevel)  # Calculate TMS(Tile Map Service) Number from a lat/lon coördinate
TMSBoundingboxFromTileNumber = Custom[GIS2BIM.TMSBoundingboxFromTileNumber](TileX=TMSTileNumberFromCoordinate.dblXTile, TileY=TMSTileNumberFromCoordinate.dblYTile, Zoomlevel=Zoomlevel)  # Calculate Lat/Lon boundaries from a TileNumber in TMS(Tile Map Service)

South = Input()
West = Input()

# group: LEFT BOTTOM
TMSTileNumberFromCoordinate_2 = Custom[GIS2BIM.TMSTileNumberFromCoordinate](Latitude=South, Longitude=West, Zoomlevel=Zoomlevel)
TMSBoundingboxFromTileNumber_2 = Custom[GIS2BIM.TMSBoundingboxFromTileNumber](TileX=TMSTileNumberFromCoordinate_2.dblXTile, TileY=TMSTileNumberFromCoordinate_2.dblYTile, Zoomlevel=Zoomlevel)

code_block = CodeBlock(x2=TMSTileNumberFromCoordinate.dblXTile, x1=TMSTileNumberFromCoordinate_2.dblXTile, y2=TMSTileNumberFromCoordinate_2.dblYTile, y1=TMSTileNumberFromCoordinate.dblYTile) { deltax=x2-x1; deltay=y2-y1; listx=x1..x2..#deltax+1; listy=y2..y1..#deltay+1; }
python_script = Python(IN[0]=code_block.listx, IN[1]=code_block.listy)
# ---------- python_script.python (30 lines) ----------
import clr
clr.AddReference('ProtoGeometry')
from Autodesk.DesignScript.Geometry import *
#The inputs to this node will be stored as a list in the IN variables.
dataEnteringNode = IN

x=IN[0]
y=IN[1]

n = len(y)
xl1=[]
for i in x:
	xl1.append([i]*n)

xl2=[]
for sublist in xl1:
    for item in sublist:
        xl2.append(item)
        
yl1=[]
for i in x:
	yl1.append(y)

yl2=[]
for sublist in yl1:
    for item in sublist:
        yl2.append(item)

#Assign your output to the OUT variable.
OUT = xl2,yl2
# ----------------------------------------
code_block_2 = CodeBlock(out=python_script) { out[0]; out[1]; }
string_from_object = FromObject(code_block_2.out0)
TileX = Output(string_from_object)
string_from_object_2 = FromObject(code_block_2.out1)
TileY = Output(string_from_object_2)
watch = Watch(code_block.listx)
TileXUnique = Output(watch)
watch_2 = Watch(code_block.listy)
TileYUnique = Output(watch_2)

# group: Width
distanceBetweenCoordinatesWGS84 = Custom[GIS2BIM.DistanceBetweenCoordinatesWGS84](Latitude1=TMSBoundingboxFromTileNumber_2.South, Longitude1=TMSBoundingboxFromTileNumber.East, Latitude2=TMSBoundingboxFromTileNumber_2.South, Longitude2=TMSBoundingboxFromTileNumber_2.West)  # Calculate the distance between 2 lat/lon coördinates in meters

WidthM = Output(distanceBetweenCoordinatesWGS84)
BoundingboxWidth = Input()

# group: DIFF LEFT WIDTH(CALCULATED, TILES)
distanceBetweenCoordinatesWGS84_2 = Custom[GIS2BIM.DistanceBetweenCoordinatesWGS84](Latitude1=South, Longitude1=West, Latitude2=South, Longitude2=TMSBoundingboxFromTileNumber_2.West)

# group: HEIGHT OF TILES
distanceBetweenCoordinatesWGS84_3 = Custom[GIS2BIM.DistanceBetweenCoordinatesWGS84](Latitude1=TMSBoundingboxFromTileNumber_2.South, Longitude1=TMSBoundingboxFromTileNumber_2.West, Latitude2=TMSBoundingboxFromTileNumber.North, Longitude2=TMSBoundingboxFromTileNumber_2.West)

# group: DIFF BOTTOM HEIGHT(CALCULATED, TILES)
distanceBetweenCoordinatesWGS84_4 = Custom[GIS2BIM.DistanceBetweenCoordinatesWGS84](Latitude1=TMSBoundingboxFromTileNumber_2.South, Longitude1=TMSBoundingboxFromTileNumber_2.East, Latitude2=South, Longitude2=TMSBoundingboxFromTileNumber_2.East)

code_block_3 = CodeBlock(widthTiles=distanceBetweenCoordinatesWGS84, WidthDesired=BoundingboxWidth, dxleft=distanceBetweenCoordinatesWGS84_2, heightTiles=distanceBetweenCoordinatesWGS84_3, dybottom=distanceBetweenCoordinatesWGS84_4)
# ---------- code_block_3.designscript (6 lines) ----------
deltawidth=widthTiles-WidthDesired;
a=deltawidth/2;
dximportimageMM=1000*((a-dxleft));
deltaheight=heightTiles-WidthDesired;
b=deltaheight/2;
dyimportimageMM=1000*((b-dybottom));
# ----------------------------------------
DeltaXmm = Output(code_block_3.dximportimageMM)
DeltaYmm = Output(code_block_3.dyimportimageMM)
HeightM = Output(distanceBetweenCoordinatesWGS84_3)
