# Dynamo custom node GIS2BIM.BGTGeometry.dyf (Dynamo 1.3.3.4111)
# category: GIS2BIM.DutchGEO
# Returns BGT-curves and metadata(Dutch GEO)

Directorypath = Input()  # Directory with BGTfiles
code_block = CodeBlock { ".gml"; }

# group: GML INPUT
bgt_lagen = CodeBlock()
# ---------- bgt_lagen.designscript (17 lines) ----------
"bgt_begroeidterreindeel";
"bgt_functioneelgebied";
"bgt_gebouwinstallatie";
"bgt_kunstwerkdeel";
"bgt_onbegroeidterreindeel";
"bgt_ondersteunendwaterdeel";
"bgt_ondersteunendwegdeel";
"bgt_ongeclassifiseerdobject";
"bgt_overbruggingsdeel";
"bgt_overigbouwwerk";
"bgt_overigescheiding";
"bgt_pand.gml";
"bgt_scheiding";
"bgt_spoor";
"bgt_tunneldeel";
"bgt_waterdeel";
"bgt_wegdeel";
# ----------------------------------------
create = List.Create(bgt_lagen.out0, bgt_lagen.out1, bgt_lagen.out2, bgt_lagen.out3, bgt_lagen.out4, bgt_lagen.out5, bgt_lagen.out6, bgt_lagen.out7, bgt_lagen.out8, bgt_lagen.out9, bgt_lagen.out10, bgt_lagen.out11, bgt_lagen.out12, bgt_lagen.out13, bgt_lagen.out14, bgt_lagen.out15, bgt_lagen.out16)
string = StringInput("/")
concat = String.Concat(Directorypath, string, arg3=code_block)  # unwired: arg2
map = List.Map(list=create, f_x=concat)

RDx = Input()  # RD-coordinate in meters
RDy = Input()  # RD-coordinate in meters
BoundingboxWidth = Input()  # Boundingboxwidth and height in meters

# group: CREATE BOUNDINGBOX AND FILTER GML
string_2 = StringInput(".//{http://www.opengis.net/gml}posList")
filterGML = Custom[GIS2BIM.FilterGML](xPATH=string_2, CoordinateX=RDx, CoordinateY=RDy, Boundingbox=BoundingboxWidth)  # filter GML-file based on boundingbox; unwired: GMLFile
map_2 = List.Map(list=map, f_x=filterGML.Polycurves)

Curves_BGT = Output(map_2)
Curvenames_BGT = Output(create)

# group: Puntvormige elementen
bgt_lagen_2 = CodeBlock()
# ---------- bgt_lagen_2.designscript (11 lines) ----------
"bgt_bak";
"bgt_bord";
"bgt_kast";
"bgt_mast";
"bgt_paal";
"bgt_put";
"bgt_sensor";
"bgt_straatmeubilair";
"bgt_vegetatieobject";
"bgt_waterinrichtingselement";
"bgt_wegrichtingselement";
# ----------------------------------------
create_2 = List.Create(bgt_lagen_2.out0, bgt_lagen_2.out1, bgt_lagen_2.out2, bgt_lagen_2.out3, bgt_lagen_2.out4, bgt_lagen_2.out5, bgt_lagen_2.out6, bgt_lagen_2.out7, bgt_lagen_2.out8, bgt_lagen_2.out9, bgt_lagen_2.out10)
code_block_2 = CodeBlock { "/"; }
code_block_3 = CodeBlock { ".gml"; }
concat_2 = String.Concat(Directorypath, code_block_2, arg3=code_block_3)  # unwired: arg2
map_3 = List.Map(list=create_2, f_x=concat_2)

string_3 = StringInput(".//{http://www.opengis.net/gml}pos")
string_4 = StringInput(".//{http://www.geostandaarden.nl/imgeo/2.1}plus-type")
filterGMLPointsMetadata = Custom[GIS2BIM.FilterGMLPointsMetadata](XpathPoints=string_3, XpathMetadata=string_4, CoordinateX=RDx, CoordinateY=RDy, Boundingbox=BoundingboxWidth)  # Filter GML-file based on boundingbox and create points and belonging meta-data; unwired: GMLFile
map_4 = List.Map(list=map_3, f_x=filterGMLPointsMetadata.Points)
Points_BGT = Output(map_4)
Points_Names_BGT = Output(create_2)
map_5 = List.Map(list=map_3, f_x=filterGMLPointsMetadata.Metadata)
Metadata_BGT = Output(map_5)

# group: Labels
code_block_4 = CodeBlock { "bgt_openbareruimtelabel"; }
concat_3 = String.Concat(Directorypath, code_block_2, code_block_4, code_block_3)

string_5 = StringInput(".//{http://www.opengis.net/gml}pos")
string_6 = StringInput(".//{http://www.geostandaarden.nl/imgeo/2.1}tekst")
string_7 = StringInput(".//{http://www.geostandaarden.nl/imgeo/2.1}hoek")
python_script = Python(IN[0]=concat_3, IN[1]=string_5, IN[2]=RDx, IN[3]=RDy, IN[4]=BoundingboxWidth, IN[5]=string_6, IN[6]=string_7)
# ---------- python_script.python (98 lines) ----------
import sys
sys.path.append("C:\Program Files (x86)\IronPython 2.7\Lib")

import clr
clr.AddReference('ProtoGeometry')
from Autodesk.DesignScript.Geometry import *

import xml.etree.ElementTree as ET


def checkIfCoordIsInsideBoundingBox(coord, bounding_box):
    min_x = bounding_box[0] - (bounding_box[2] / 2)
    min_y = bounding_box[1] - (bounding_box[2] / 2)
    max_x = bounding_box[0] + (bounding_box[2] / 2)
    max_y = bounding_box[1] + (bounding_box[2] / 2)

    if min_x <= float(coord[0]) <= max_x and min_y <= float(coord[1]) <= max_y:
        return True
    else:
        return False

def mainFunction():
    # Inputs
    file_path = IN[0]
    xpathstr = IN[1]
    # Bounding box definition
    bbx = IN[2]
    bby = IN[3]
    bb_size = IN[4]
    xpathstr2 = IN[5]
    xpathstr3 = IN[6]
    bounding_box = [bbx, bby, bb_size]
    # get data from xml
    tree = ET.parse(file_path)
    root = tree.getroot()
	
    # for loop to get each element in an array
    XMLelements = []
    for elem in root.iter():
        XMLelements.append(elem)

    xpathfound = root.findall(xpathstr)
    xpathfoundlabel = root.findall(xpathstr2)
    xpathfoundrotation = root.findall(xpathstr3)
    # for loop to get all points in an array
    points = []
    for x in xpathfound:
        if x.text:
            try:
                points.append(x.text)
            except:
                points.append("_none_")
        else:
            points.append("_none_")
	
	labels = []
    for i in xpathfoundlabel:
        if i.text:
            try:
                labels.append(i.text)
            except:
                labels.append("_none_")
        else:
            labels.append("_none_")
        
    rotations = []
    for i in xpathfoundrotation:
        if i.text:
            try:
                rotations.append(i.text)
            except:
                rotations.append("_none_")
        else:
            rotations.append("_none_")
    
    # for loop to get each point as a list instead of a string
    newPoints = []
    for point in points:
        newPoints.append(point.split(" "))

    # for loop to get x,y coords and filter points inside Bounding Box
    xyPoints = []
    xyLabels = []
    xyRotations = []
    for newPoint, label, rotation in zip(newPoints, labels, rotations):
    	point_is_inside_bounding_box = False
    	if checkIfCoordIsInsideBoundingBox(newPoint, bounding_box):
    		point_is_inside_bounding_box = True
    		xyPoints.append(newPoint)
    		xyLabels.append(label)
    		xyRotations.append(rotation)
    return xyPoints, xyLabels, xyRotations

# execution of main function in python script
returnvalue = mainFunction()

# put returnValue in OUT
OUT = returnvalue
# ----------------------------------------
code_block_5 = CodeBlock(t4=python_script, t9=RDx, t10=RDy)
# ---------- code_block_5.designscript (16 lines) ----------
t3 = DSCore.List.FirstItem(t4);
t5 = DSCore.List.FirstItem(t3@-2<1>);
t6 = String.ToNumber(t5);
t7 = DSCore.List.LastItem(t3@-2<1>);
t8 = String.ToNumber(t7);
rdx = t9;
x = t6;
rdy = t10;
y = t8;
t1 = (rdx - x) * 1000;
t2 = (rdy - y) * 1000;
t11 = Math.Round(t1);
t12 = Math.Round(t2);
point1 = Point.ByCoordinates(t11, t12);
t4[1];
t4[2];
# ----------------------------------------
Points_openbareruimtelabel = Output(code_block_5.point1)
Text_openbareruimtelabel = Output(code_block_5.out14)
Rotation_openbareruimtelabel = Output(code_block_5.out15)
