# Dynamo custom node GIS2BIM.SloveniaGeoservicesLibrary.dyf (Dynamo 1.3.3.4111)
# category: GIS2BIM.Geoservices.Europe
# Geoservices in Slovenia

code_block = CodeBlock()
# ---------- code_block.designscript (11 lines) ----------
"https://prostor4.gov.si/";
"ows2-elf-m/elf_cp/ows?service=wms";
"&request=GetMap";
"&VERSION=1.3.0";
"&STYLES=CP.CadastralParcel.ELFCadastre";
"&layers=CP.CadastralParcel";
"&bbox=";
"&width=3000";
"&height=3000";
"&format=image/png";
"&crs=EPSG:3912";
# ----------------------------------------
Boundingboxstring_EPSG_3912 = Input(Boundingboxstring(EPSG 3912): string)
concat = String.Concat(code_block.out0, code_block.out1, code_block.out2, code_block.out3, code_block.out4, code_block.out5, code_block.out6, Boundingboxstring_EPSG_3912, code_block.out7, code_block.out8, code_block.out9, code_block.out10)
Cadastral_Parcel_OGC_WMS = Output(concat)  # "Cadastral Parcel(OGC WMS)"
code_block_2 = CodeBlock()
# ---------- code_block_2.designscript (11 lines) ----------
"https://prostor4.gov.si/";
"ows2-elf-m/elf_bu/ows?service=wms";
"&request=GetMap";
"&VERSION=1.3.0";
"&STYLES=BU.Building.ELFCadastre";
"&layers=BU.Building";
"&bbox=";
"&width=3000";
"&height=3000";
"&format=image/png";
"&crs=EPSG:3912";
# ----------------------------------------
concat_2 = String.Concat(code_block_2.out0, code_block_2.out1, code_block_2.out2, code_block_2.out3, code_block_2.out4, code_block_2.out5, code_block_2.out6, Boundingboxstring_EPSG_3912, code_block_2.out7, code_block_2.out8, code_block_2.out9, code_block_2.out10)
Cadastral_Buildings_OGC_WMS = Output(concat_2)  # "Cadastral Buildings(OGC WMS)"
link_kadaster = CodeBlock()
# ---------- link_kadaster.designscript (5 lines) ----------
"https://prostor4.gov.si/ows2-elf/cp/wfs?";
"service=wfs";
"&request=GetFeature";
"&typeName=cp:CadastralParcel";
"&bbox=";
# ----------------------------------------
concat_3 = String.Concat(link_kadaster.out0, link_kadaster.out1, link_kadaster.out2, link_kadaster.out3, link_kadaster.out4, Boundingboxstring_EPSG_3912)
Cadastral_Parcels_OGC_WFS = Output(concat_3)  # "Cadastral Parcels(OGC WFS)"
