# Dynamo custom node GIS2BIM.GeoservicesLibraryNetherlands.dyf (Dynamo 2.1.0.7500)
# category: GIS2BIM.Geoservices.Europe
# Library with multiple webadresses which can be used for WFS and WMS webrequests

link_kadaster = CodeBlock()
# ---------- link_kadaster.designscript (5 lines) ----------
"http://geodata.nationaalgeoregister.nl/";
"kadastralekaartv3/wfs?";
"&request=GetFeature";
"&typeName=kadastralekaartv3:kadastralegrens";
"&bbox=";
# ----------------------------------------
BoundingBox = Input(BoundingBox: var[]..[])
concat = String.Concat(string0=link_kadaster.out0, string1=link_kadaster.out1, string2=link_kadaster.out2, string3=link_kadaster.out3, string4=link_kadaster.out4, string5=BoundingBox)
n1_kadastrale_grenzen_OGC_WFS = Output(concat)  # "1 kadastrale grenzen(OGC WFS)"
code_block = CodeBlock()
# ---------- code_block.designscript (6 lines) ----------
"http://afnemers.ruimtelijkeplannen.nl/afnemers/services?";
"&service=WFS";
"&version=1.1.0";
"&request=GetFeature";
"&typeName=app:Bouwvlak";
"&bbox=";
# ----------------------------------------
concat_2 = String.Concat(string0=code_block.out0, string1=code_block.out1, string2=code_block.out2, string3=code_block.out3, string4=code_block.out4, string5=code_block.out5, string6=BoundingBox)
n2_ruimtelijke_plannen_OGC_WFS = Output(concat_2)  # "2 ruimtelijke plannen(OGC WFS)"
code_block_2 = CodeBlock()
# ---------- code_block_2.designscript (5 lines) ----------
"http://geodata.nationaalgeoregister.nl/bag/wfs?";
"service=wfs&version=2.0.0&";
"request=GetFeature&typeName=";
"bag:verblijfsobject&";
"bbox=";
# ----------------------------------------
concat_3 = String.Concat(string0=code_block_2.out0, string1=code_block_2.out1, string2=code_block_2.out2, string3=code_block_2.out3, string4=code_block_2.out4, string5=BoundingBox)
n3_bag_verblijfsobject_OGC_WFS = Output(concat_3)  # "3 bag verblijfsobject(OGC WFS)"
code_block_3 = CodeBlock()
# ---------- code_block_3.designscript (5 lines) ----------
"http://geodata.nationaalgeoregister.nl/bag/wfs?";
"service=wfs&version=2.0.0&";
"request=GetFeature&typeName=";
"bag:pand&";
"bbox=";
# ----------------------------------------
concat_4 = String.Concat(string0=code_block_3.out0, string1=code_block_3.out1, string2=code_block_3.out2, string3=code_block_3.out3, string4=code_block_3.out4, string5=BoundingBox)
n4_bag_pand_OGC_WFS = Output(concat_4)  # "4 bag pand(OGC WFS)"
link_kadaster_2 = CodeBlock()
# ---------- link_kadaster_2.designscript (11 lines) ----------
"http://geodata.nationaalgeoregister.nl/";
"luchtfoto/rgb/wms?";
"&request=GetMap";
"&VERSION=1.3.0";
"&STYLES=default";
"&layers=2016_ortho25";
"&bbox=";
"&width=3000";
"&height=3000";
"&format=image/png";
"&crs=EPSG:28992";
# ----------------------------------------
concat_5 = String.Concat(string0=link_kadaster_2.out0, string1=link_kadaster_2.out1, string2=link_kadaster_2.out2, string3=link_kadaster_2.out3, string4=link_kadaster_2.out4, string5=link_kadaster_2.out5, string6=link_kadaster_2.out6, string7=BoundingBox, string8=link_kadaster_2.out7, string9=link_kadaster_2.out8, string10=link_kadaster_2.out9, string11=link_kadaster_2.out10)
n5_luchtfoto_2016_OGC_WMS = Output(concat_5)  # "5 luchtfoto 2016(OGC WMS)"
link_kadaster_3 = CodeBlock()
# ---------- link_kadaster_3.designscript (11 lines) ----------
"http://geodata.nationaalgeoregister.nl/";
"cbsvierkanten100mv2/wms?";
"&request=GetMap";
"&VERSION=1.3.0";
"&STYLES=cbsvierkanten100mv2:cbsvierkanten100m_woz_waarde_woning";
"&layers=vierkant100m2011";
"&bbox=";
"&width=2000";
"&height=2000";
"&format=image/png";
"&crs=EPSG:28992";
# ----------------------------------------
concat_6 = String.Concat(string0=link_kadaster_3.out0, string1=link_kadaster_3.out1, string2=link_kadaster_3.out2, string3=link_kadaster_3.out3, string4=link_kadaster_3.out4, string5=link_kadaster_3.out5, string6=link_kadaster_3.out6, string7=BoundingBox, string8=link_kadaster_3.out7, string9=link_kadaster_3.out8, string10=link_kadaster_3.out9, string11=link_kadaster_3.out10)
n6_CBS_WOZ_2011_100m_OGC_WMS = Output(concat_6)  # "6 CBS-WOZ 2011 100m(OGC WMS)"
code_block_4 = CodeBlock { "http://geodata.nationaalgeoregister.nl/cbsvierkanten100mv2/ows?service=WMS&request=GetLegendGraphic&format=image%2Fpng&width=20&height=20&layer=vierkant100m2011&style=cbsvierkanten100m_woz_waarde_woning"; }
n6_legenda = Output(code_block_4)  # "6 legenda"
link_kadaster_4 = CodeBlock()
# ---------- link_kadaster_4.designscript (5 lines) ----------
"http://geodata.nationaalgeoregister.nl/";
"kadastralekaartv3/wfs?";
"&request=GetFeature";
"&typeName=kadastralekaartv3:annotatie";
"&bbox=";
# ----------------------------------------
concat_7 = String.Concat(string0=link_kadaster_4.out0, string1=link_kadaster_4.out1, string2=link_kadaster_4.out2, string3=link_kadaster_4.out3, string4=link_kadaster_4.out4, string5=BoundingBox)
n7_kadastrale_annotatie_OGC_WFS = Output(concat_7)  # "7 kadastrale annotatie(OGC WFS)"
link_kadaster_5 = CodeBlock()
# ---------- link_kadaster_5.designscript (5 lines) ----------
"http://geodata.nationaalgeoregister.nl/";
"kadastralekaartv3/wfs?";
"&request=GetFeature";
"&typeName=kadastralekaartv3:perceel";
"&bbox=";
# ----------------------------------------
concat_8 = String.Concat(string0=link_kadaster_5.out0, string1=link_kadaster_5.out1, string2=link_kadaster_5.out2, string3=link_kadaster_5.out3, string4=link_kadaster_5.out4, string5=BoundingBox)
n8_kadastrale_perceel_OGC_WFS = Output(concat_8)  # "8 kadastrale perceel(OGC WFS)"
link_kadaster_6 = CodeBlock()
# ---------- link_kadaster_6.designscript (6 lines) ----------
"http://services.rce.geovoorziening.nl/rce/wfs?";
"SERVICE=wfs";
"&VERSION=2.0.0";
"&request=GetFeature";
"&typeName=rce:NationalListedMonuments";
"&bbox=";
# ----------------------------------------
concat_9 = String.Concat(string0=link_kadaster_6.out0, string1=link_kadaster_6.out1, string2=link_kadaster_6.out2, string3=link_kadaster_6.out3, string4=link_kadaster_6.out4, string5=link_kadaster_6.out5, string6=BoundingBox)
n9_rijksmonumenten_OGC_WFS = Output(concat_9)  # "9 rijksmonumenten(OGC WFS)"
link_kadaster_7 = CodeBlock()
# ---------- link_kadaster_7.designscript (11 lines) ----------
"http://geodata.nationaalgeoregister.nl/";
"plu/wms?";
"&request=GetMap";
"&VERSION=1.3.0";
"&STYLES=Bouwvlak";
"&layers=Bouwvlak";
"&bbox=";
"&width=2000";
"&height=2000";
"&format=image/png";
"&crs=EPSG:28992";
# ----------------------------------------
concat_10 = String.Concat(string0=link_kadaster_7.out0, string1=link_kadaster_7.out1, string2=link_kadaster_7.out2, string3=link_kadaster_7.out3, string4=link_kadaster_7.out4, string5=link_kadaster_7.out5, string6=link_kadaster_7.out6, string7=BoundingBox, string8=link_kadaster_7.out7, string9=link_kadaster_7.out8, string10=link_kadaster_7.out9, string11=link_kadaster_7.out10)
n10_bestemmingsplan_bouwvlak_OGC_WMS = Output(concat_10)  # "10 bestemmingsplan bouwvlak(OGC WMS)"
code_block_5 = CodeBlock { "http://geodata.nationaalgeoregister.nl/ahn2/wfs?"; "&request=GetFeature&typeName="; "ahn2_bladindex&"; "bbox="; }
concat_11 = String.Concat(string0=code_block_5.out0, string1=code_block_5.out1, string2=code_block_5.out2, string3=code_block_5.out3, string4=BoundingBox)
n11_AHN2_webrequest_bladindex_OGC_WFS = Output(concat_11)  # "11 AHN2 webrequest bladindex(OGC WFS)"
code_block_6 = CodeBlock()
# ---------- code_block_6.designscript (12 lines) ----------
"http://afnemers.ruimtelijkeplannen.nl/afnemers2012/services?";
"REQUEST=GetMap&SERVICE=WMS";
"&VERSION=1.3.0";
"&WIDTH=2000";
"&HEIGHT=2000";
"&LAYERS=BP:Bestemmingsplangebied,BP:Enkelbestemming,BP:Dubbelbestemming,BP:Functieaanduiding,BP:Figuur,BP:Gebiedsaanduiding,BP:Gebiedsaanduiding_overzicht,BP:Wijzigingsplangebied,BP:Bouwaanduiding,BP:Bouwvlak,BP:Inpassingsplangebied,BP:Lettertekenaanduiding,BP:Maatvoering,BP:Rijksbestemmingsplangebied,BP:Uitwerkingsplangebied";
"&STYLES=";
"&TRANSPARENT=TRUE";
"&FORMAT=image/png";
"&BBOX=";
"&CRS=urn:ogc:def:crs:EPSG::28992";
"&STYLES=default";
# ----------------------------------------
concat_12 = String.Concat(string0=code_block_6.out0, string1=code_block_6.out1, string2=code_block_6.out2, string3=code_block_6.out3, string4=code_block_6.out4, string5=code_block_6.out5, string6=code_block_6.out6, string7=code_block_6.out7, string8=code_block_6.out8, string9=code_block_6.out9, string10=BoundingBox, string11=code_block_6.out10, string12=code_block_6.out11)
n12_ruimtelijkeplannen_OGC_WMS = Output(concat_12)  # "12 ruimtelijkeplannen(OGC WMS)"
code_block_7 = CodeBlock()
# ---------- code_block_7.designscript (1 lines) ----------
https://geodata.nationaalgeoregister.nl/luchtfoto/infrarood/wms?request=GetCapabilities
# ----------------------------------------
link_kadaster_8 = CodeBlock()
# ---------- link_kadaster_8.designscript (10 lines) ----------
"https://opengeodata.zeeland.nl/geoserver/";
"zeeland/wms?";
"&request=GetMap";
"&VERSION=1.3.0";
"&layers=georok_dkkprc1850sdvvlk";
"&bbox=";
"&width=2000";
"&height=2000";
"&format=image/png";
"&crs=EPSG:28992";
# ----------------------------------------
concat_13 = String.Concat(string0=link_kadaster_8.out0, string1=link_kadaster_8.out1, string2=link_kadaster_8.out2, string3=link_kadaster_8.out3, string4=link_kadaster_8.out4, string5=link_kadaster_8.out5, string6=BoundingBox, string7=link_kadaster_8.out6, string8=link_kadaster_8.out7, string9=link_kadaster_8.out8, string10=link_kadaster_8.out9)
Zeeland_Schouwen_Duiveland_Kadastrale_Pe = Output(concat_13)  # "Zeeland Schouwen Duiveland Kadastrale Percelen 1832(OGC:WMS)"
code_block_8 = CodeBlock { "&layers=georok_dkkgbw1850vlk"; }
concat_14 = String.Concat(string0=link_kadaster_8.out0, string1=link_kadaster_8.out1, string2=link_kadaster_8.out2, string3=link_kadaster_8.out3, string4=code_block_8, string5=link_kadaster_8.out5, string6=BoundingBox, string7=link_kadaster_8.out6, string8=link_kadaster_8.out7, string9=link_kadaster_8.out8, string10=link_kadaster_8.out9)
Zeeland_Bebouwing_Kadaster_1832_OGC = Output(concat_14)  # "Zeeland Bebouwing Kadaster 1832(OGC:WMS)"
link_kadaster_9 = CodeBlock()
# ---------- link_kadaster_9.designscript (11 lines) ----------
"http://geodata.nationaalgeoregister.nl/";
"luchtfoto/rgb/wms?";
"&request=GetMap";
"&VERSION=1.3.0";
"&STYLES=default";
"&layers=2017_ortho25";
"&bbox=";
"&width=3000";
"&height=3000";
"&format=image/png";
"&crs=EPSG:28992";
# ----------------------------------------
concat_15 = String.Concat(string0=link_kadaster_9.out0, string1=link_kadaster_9.out1, string2=link_kadaster_9.out2, string3=link_kadaster_9.out3, string4=link_kadaster_9.out4, string5=link_kadaster_9.out5, string6=link_kadaster_9.out6, string7=BoundingBox, string8=link_kadaster_9.out7, string9=link_kadaster_9.out8, string10=link_kadaster_9.out9, string11=link_kadaster_9.out10)
Luchtfoto_2017_OGC_WMS = Output(concat_15)  # "Luchtfoto 2017(OGC WMS)"
code_block_9 = CodeBlock { "http://geodata.nationaalgeoregister.nl/ahn3/wfs?"; "&request=GetFeature&typeName="; "ahn3_bladindex&"; "bbox="; }
concat_16 = String.Concat(string0=code_block_9.out0, string1=code_block_9.out1, string2=code_block_9.out2, string3=code_block_9.out3, string4=BoundingBox)
AHN3_webrequest_bladindex_OGC_WFS = Output(concat_16)  # "AHN3 webrequest bladindex(OGC WFS)"
link_kadaster_10 = CodeBlock()
# ---------- link_kadaster_10.designscript (6 lines) ----------
"http://3dbag.bk.tudelft.nl/";
"data/wfs?";
"&request=GetFeature";
"&typeName=BAG3D:pand3d";
"&outputFormat=GML3";
"&bbox=";
# ----------------------------------------
concat_17 = String.Concat(string0=link_kadaster_10.out0, string1=link_kadaster_10.out1, string2=link_kadaster_10.out2, string3=link_kadaster_10.out3, string4=link_kadaster_10.out4, string5=link_kadaster_10.out5, string6=BoundingBox)
n3D_BAG_TU_Delft_OGC = Output(concat_17)  # "3D BAG TU Delft(OGC:WFS)"
link_kadaster_11 = CodeBlock()
# ---------- link_kadaster_11.designscript (11 lines) ----------
"http://geodata.nationaalgeoregister.nl/";
"luchtfoto/rgb/wms?";
"&request=GetMap";
"&VERSION=1.3.0";
"&STYLES=default";
"&layers=2018_ortho25";
"&bbox=";
"&width=3000";
"&height=3000";
"&format=image/png";
"&crs=EPSG:28992";
# ----------------------------------------
concat_18 = String.Concat(string0=link_kadaster_11.out0, string1=link_kadaster_11.out1, string2=link_kadaster_11.out2, string3=link_kadaster_11.out3, string4=link_kadaster_11.out4, string5=link_kadaster_11.out5, string6=link_kadaster_11.out6, string7=BoundingBox, string8=link_kadaster_11.out7, string9=link_kadaster_11.out8, string10=link_kadaster_11.out9, string11=link_kadaster_11.out10)
luchtfoto_2018_OGC_WMS = Output(concat_18)  # "luchtfoto 2018(OGC WMS)"
code_block_10 = CodeBlock()
# ---------- code_block_10.designscript (11 lines) ----------
"http://geodata.rivm.nl/";
"geoserver/alo/wms??";
"&request=GetMap";
"&VERSION=1.3.0";
"&STYLES=rivm_20180205_g_geluidkaart_lden_alle_bronnen";
"&layers=rivm_20180205_g_geluidkaart_lden_wegverkeer";
"&bbox=";
"&width=2000";
"&height=2000";
"&format=image/png";
"&crs=EPSG:28992";
# ----------------------------------------
concat_19 = String.Concat(string0=code_block_10.out0, string1=code_block_10.out1, string2=code_block_10.out2, string3=code_block_10.out3, string4=code_block_10.out4, string5=code_block_10.out5, string6=code_block_10.out6, string7=BoundingBox, string8=code_block_10.out7, string9=code_block_10.out8, string10=code_block_10.out9, string11=code_block_10.out10)
geluidskaart_alle_bronnen_OGC_WMS = Output(concat_19)  # "geluidskaart alle bronnen(OGC WMS)"
