# Dynamo graph Open Streetmap 3D.dyn (Dynamo 2.1.0.7500)

byPoints = PolyCurve.ByPoints()  # unwired: points
flatten = List.Flatten(list=byPoints)
string_from_object = FromObject()  # unwired: obj
code_block = CodeBlock { "m"; }

# group: GET HEIGHT OF BUILDINGS
code_block_2 = CodeBlock { "height:"; }
contains = String.Contains(str=string_from_object, searchFor=code_block_2)
filterByBoolMask = List.FilterByBoolMask(list=string_from_object, mask=contains)
flatten_2 = List.Flatten(list=filterByBoolMask.in)
split = String.Split(str=flatten_2, separator0=code_block_2, separator1=code_block)
flatten_3 = List.Flatten(list=split)
toNumber = String.ToNumber(str=flatten_3)
code_block_3 = CodeBlock(height=toNumber) { height*1000; }
isEmpty = List.IsEmpty()  # unwired: list
map = List.Map(list=filterByBoolMask.in, f_x=isEmpty)
code_block_4 = CodeBlock { 0; }
eq = map == code_block_4

extrudeAsSolid = Curve.ExtrudeAsSolid(curve=flatten, distance=code_block_3)
code_block_5 = CodeBlock(Solids=extrudeAsSolid) { Solids; }
filterByBoolMask_2 = List.FilterByBoolMask(mask=eq)  # unwired: list
code_block_6 = CodeBlock { "grotekerksplein"; "1"; "dordrecht"; "the netherlands"; }
code_block_7 = CodeBlock { "Crichton Street"; "11"; "Edinburgh"; "united kingdom"; }
code_block_8 = CodeBlock { "aerialway"; }
code_block_9 = CodeBlock { "E 16th Street"; "28"; "new-york"; "united states"; }
geocodingNomatimAPI = Custom[GIS2BIM.GeocodingNomatimAPI](Streetname=code_block_9.out0, Housenumber=code_block_9.out1, Place=code_block_9.out2, Country=code_block_9.out3)  # gets WGS-84 coordinate from address with Open Streets Maps API
code_block_10 = CodeBlock { 200; }
createBoundingBoxLATLONG = Custom[GIS2BIM.CreateBoundingBoxLATLONG](Lat=geocodingNomatimAPI.latitude, Long=geocodingNomatimAPI.longitude, WidthMeters=code_block_10)  # create boundingbox with from lat/long coordinate in degrees
code_block_11 = CodeBlock { "C:/TEMP"; }
downloadOSM = Custom[GIS2BIM.DownloadOSM](West=createBoundingBoxLATLONG.West, East=createBoundingBoxLATLONG.East, North=createBoundingBoxLATLONG.North, South=createBoundingBoxLATLONG.South, Directory=code_block_11)  # Download OSM data within a boundingbox
location = Elk.OSM.Location(filePath=downloadOSM.Location)
code_block_12 = CodeBlock { "C:/TEMP/map.osm"; }
features = Elk.OSM.Features()
code_block_13 = CodeBlock(F=features) { F[5]; }
code_block_14 = CodeBlock { 0; }
subFeatures = Elk.OSM.SubFeatures(feature=code_block_13, subIndexes=code_block_14)
flatten_4 = List.Flatten(list=subFeatures.all)
OSMData = Elk.OSM.OSMData(OSM=location.OSM, File=code_block_12, featureType=code_block_13, subTypes=flatten_4)
OSM3DBuilding = Custom[GIS2BIM.OSM3DBuilding](OSMBuildingpoints=OSMData.Points, OSMBuildingKeys=OSMData.Keys)  # Filter OSM-data and look for buildings with 'height' parameter and create 3D solid
byUnion = Solid.ByUnion(solids=OSM3DBuilding)
code_block_15 = CodeBlock { "C:/ProgramData/Autodesk/RVT 2020/Family Templates/English/Metric Generic Model.rft"; }
code_block_16 = CodeBlock { "50"; }
categories = Categories("OST_GenericModel")
ꟿ_familyinstance_bygeometry = Custom[ꟿ FamilyInstance.ByGeometry](geometry=byUnion, familyTemplatePath=code_block_15, familyName=code_block_16, category=categories)  # You must provide a valid family template path that will be used for all input geometry objects. The project units(and not the templates) will be used to determine the size of the output geometry. The provided category will be used only if the family template supports it. If not, the default template category will be used instead. Likewise, the family material(provided as a string) will be set only if a material with that name exists in the template. If not, the default material will be used instead ("By Category"). For void cuts, the material settings will be ignored. The Subcategory name is an optional input. If you'd like to skip assigning a Subcategory to any new instance, simply use null. The node expects a unique family name for each geometry object. The rest of the input lists will be processed as if the node lacing is set to longest.
