# Dynamo custom node GIS2BIM.CropImage.dyf (Dynamo 1.3.4.6666)
# category: GIS2BIM.Image
# Crop an image

image = Input()  # System.Drawing.Bitmap
SourceWidthM = Input()  # Width of Source Image in Meters
SourceHeightM = Input()  # Height of Source Image in Meters
dxM = Input()  # DeltaXImage in Meters
dyM = Input()  # DeltaYImage in Meters
NewWidthM = Input()  # Desired Width in Meters
NewHeightM = Input()  # Desired Height in Meters
python_script = Python(IN[0]=image, IN[1]=SourceWidthM, IN[2]=SourceHeightM, IN[3]=dxM, IN[4]=dyM, IN[5]=NewWidthM, IN[6]=NewHeightM)
# ---------- python_script.python (41 lines) ----------
import clr

clr.AddReference("System.Drawing")
from System.Drawing import Image
from System.Drawing import Bitmap
from System.Drawing import Graphics
from System import Drawing
from System.Drawing.Imaging import ImageFormat

ImageSource=IN[0]
WidthTiles = IN[1]
HeightTiles= IN[2]
dxM=IN[3]
dyM=IN[4]
WidthDesired=IN[5]
HeightDesired=IN[6]

deltawidth=WidthTiles-WidthDesired
deltaheight=HeightTiles-HeightDesired

a=deltawidth/2
b=deltaheight/2
dx1=dxM
dy1=dyM
dx=-dx1+a
dy=-dy1+b

ImageWidthNew=(WidthDesired/WidthTiles)*ImageSource.Width
ImageHeightNew=(HeightDesired/HeightTiles)*ImageSource.Height
dxImage=(dx/WidthTiles)*ImageSource.Width
dyImage=(dy/HeightTiles)*ImageSource.Height

cropRect=Drawing.Rectangle(dxImage,dyImage,ImageWidthNew,ImageHeightNew)

img= Bitmap(ImageWidthNew,ImageHeightNew)
g= Graphics.FromImage(img)

g.DrawImage(ImageSource,Drawing.Rectangle(0,0,img.Width,img.Height),cropRect,Drawing.GraphicsUnit.Pixel)

#Assign your output to the OUT variable.
OUT = img
# ----------------------------------------
CroppedImage = Output(python_script)  # "CroppedImage:Image"
