# Dynamo custom node GIS2BIM.WMTSTileListFromBbox.dyf (Dynamo 1.3.4.6666)
# category: GIS2BIM.WMTS/TMS
# gives list of tilerows and tilecolums

PixelWidth = Input(PixelWidth:double)
Resolution = Input(Resolution: double)
BboxWidthInMeters = Input(BboxWidthInMeters:double)
TileColumn = Input(TileColumn:string)
toNumber = String.ToNumber(TileColumn)
TileRow = Input(TileRow:string)
toNumber_2 = String.ToNumber(TileRow)
code_block = CodeBlock(PixelWidth, Resolution, BboxWidthInMeters, toNumber, toNumber_2)
# ---------- code_block.designscript (13 lines) ----------
tileSize=PixelWidth*MetersPerPixel;
nTiles=Math.Ceiling(bbox/tileSize);
n=Math.Ceiling(nTiles/2)*2;
//rond nTiles af naar groter even getal, zodat het straks door 2 deelbaar is;
i=n+1;
//aantal tegels;
uniqueTileColumns=(TileColumn-(n/2))..(TileColumn+(n/2))..#i;
uniqueTileRows=(TileRow-(n/2))..(TileRow+(n/2))..#i;
tileColumns=Flatten(DSCore.List.OfRepeatedItem(uniqueTileColumns,i));
tileRows=Flatten(DSCore.List.OfRepeatedItem(uniqueTileRows<1L>,i));
nt=i;
totalWidth=tileSize;
totalTileWidth=totalWidth*i;
# ----------------------------------------
NumberOfTiles = Output(code_block.nt)
TileRows = Output(code_block.tileRows)
TileColumns = Output(code_block.tileColumns)
UniqueTileColumns = Output(code_block.uniqueTileColumns)
UniqueTileRows = Output(code_block.uniqueTileRows)
TileWidthMetrs = Output(code_block.totalWidth)
TotalTileWidthMetrs = Output(code_block.totalTileWidth)
