# Dynamo graph GoogleEarthStaticMapsLowResolution.dyn (Dynamo 1.3.1.1736)

getRevitSiteLocation = Custom[GIS2BIM.GetRevitSiteLocation]()  # Gets the properties of the current Site Location of the active Revit Project
googleStaticMapsAPI = Custom[GIS2BIM.GoogleStaticMapsAPI](Longitude=getRevitSiteLocation.Lon, Latitude=getRevitSiteLocation.Lat)  # Use the Google Static Maps API to download map or aerialphoto
webrequestWMS2 = Custom[GIS2BIM.WebrequestWMS2](WMSwebrequest=googleStaticMapsAPI.URL_Google_Hybrid)  # a webrequest based on WMS-protocol
watch_image = WatchImageCore(webrequestWMS2)
