# Dynamo graph SpainCadastre.dyn (Dynamo 1.3.2.2480)

epsg_codes_coordinate_reference = CodeBlock { "4326"; "25830"; }  # "EPSG-codes Coordinate Reference System"
code_block = CodeBlock { "Carrer Mina"; "2"; "Barcelona"; "Spain"; }
geoCodingGoogleAPI = Custom[GIS2BIM.GeoCodingGoogleAPI](Streetname=code_block.out0, Housenumber=code_block.out1, Place=code_block.out2, Country=code_block.out3)  # gets coordinate from adress with google API
transformCRS_epsg = Custom[GIS2BIM.TransformCRS_epsg](sourceCRS=epsg_codes_coordinate_reference.out0, targetCRS=epsg_codes_coordinate_reference.out1, xCoordinate=geoCodingGoogleAPI.Longitude, yCoordinate=geoCodingGoogleAPI.Latitude)  # Uses the API of http://epsg.io to transform Coordinate Reference Systems
width_of_boundingbox = CodeBlock { 200; }
createBoundingBox = Custom[GIS2BIM.CreateBoundingBox](CoordinateX=transformCRS_epsg.Xtransformed, CoordinateY=transformCRS_epsg.Ytransformed, BoxWidth=width_of_boundingbox, BoxHeight=width_of_boundingbox)  # create boundingboxstring for webrequests based on coördinates and dimensions
spainGeoservicesLibrary = Custom[GIS2BIM.SpainGeoservicesLibrary](Boundingbox=createBoundingBox.Boxstring)  # Geoserviceslibrary of Spain
web_request = WebRequest(spainGeoservicesLibrary)
code_block_2 = CodeBlock { "cp:label"; }
# note: LUNCHBOX PACKAGE
# GetXMLNode
getXMLNode = Lists.DataSets.GetXMLNode(web_request, code_block_2)
code_block_3 = CodeBlock { Application.Document.Current.ActiveView; }
code_block_4 = CodeBlock { ".//{http://www.opengis.net/gml/3.2}pos"; }
createPointFromGML = Custom[GIS2BIM.CreatePointFromGML](XML=web_request, XPATHSTRING=code_block_4, ModX=transformCRS_epsg.Xtransformed, ModY=transformCRS_epsg.Ytransformed)  # Create Points from space seperated GML
code_block_5 = CodeBlock { "cp:nationalCadastralReference"; }
getXMLNode_2 = Lists.DataSets.GetXMLNode(web_request, code_block_5)
code_block_6 = CodeBlock { "Center"; }
textType = CodeBlock { "2.5 mm"; }
byName = TextNoteType.ByName(textType)
byLocation = TextNote.ByLocation(view=code_block_3, location=createPointFromGML, text=getXMLNode_2, alignment=code_block_6, type=byName)
createPointsPolygonFromGMLxy = Custom[GIS2BIM.CreatePointsPolygonFromGMLxy](XML=web_request, DeltaX=transformCRS_epsg.Xtransformed, DeltaY=transformCRS_epsg.Ytransformed)  # Create point and polygons from a GML-file
lineStyle = CodeBlock { "Hidden Lines"; }
createDetailLinesFromPolygons = Custom[GIS2BIM.CreateDetailLinesFromPolygons](View=code_block_3, PolyCurves=createPointsPolygonFromGMLxy.PolyCurves, Linestyle=lineStyle)  # Create detaillines from polygons in a view
searchCRS = Custom[GIS2BIM.SearchCRS](EPSG_Code=epsg_codes_coordinate_reference.out1)  # Search for a Coordinate Reference System
geoservicesLibraryNetherlands = Custom[GIS2BIM.GeoservicesLibraryNetherlands]()  # Library with multiple webadresses which can be used for WFS and WMS webrequests; unwired: BoundingBox
