# Dynamo graph Coordinate Reference System(CRS) Transform Example.dyn (Dynamo 1.3.3.4111)

code_block = CodeBlock { "montee aux poulains"; "2"; "Mont Saint-Michel"; "France"; }
geocodingNomatimAPI = Custom[GIS2BIM.GeocodingNomatimAPI](Streetname=code_block.out0, Housenumber=code_block.out1, Place=code_block.out2, Country=code_block.out3)  # gets WGS-84 coordinate from address with Open Streets Maps API
code_block_2 = CodeBlock()
# ---------- code_block_2.designscript (3 lines) ----------
"2154";
//This is the most common CRS for France
//Have a look at All CRS-systems to look for your CRS-system
# ----------------------------------------
searchCRS = Custom[GIS2BIM.SearchCRS](EPSG_Code=code_block_2)  # Search for a Coordinate Reference System
code_block_3 = CodeBlock()
# ---------- code_block_3.designscript (2 lines) ----------
"4326";
//This is the standard WGS-84 Coordinate Reference System
# ----------------------------------------
code_block_4 = CodeBlock { "logis sainte catherine"; "2"; "Mont Saint-Michel"; "France"; }
geoCodingGoogleAPI = Custom[GIS2BIM.GeoCodingGoogleAPI](Streetname=code_block_4.out0, Housenumber=code_block_4.out1, Place=code_block_4.out2, Country=code_block_4.out3)  # gets coordinate from adress with google API
transformCRS_epsg = Custom[GIS2BIM.TransformCRS_epsg](sourceCRS=code_block_3, targetCRS=code_block_2, xCoordinate=geoCodingGoogleAPI.Latitude, yCoordinate=geoCodingGoogleAPI.Longitude)  # Uses the API of http://epsg.io to transform Coordinate Reference Systems
