# Dynamo graph Toposurface Set Rendermaterial.dyn (Dynamo 1.3.3.4111)

code_block = CodeBlock { "a_gen"; }
byName = Material.ByName(code_block)
temp_filepath_image = CodeBlock { "C:/TEMP/map24.jpg"; }
code_block_2 = CodeBlock { 300; }
code_block_3 = CodeBlock(x=code_block_2) { 0; x*1000; }
boolean = BoolSelector(false)
code_block_4 = CodeBlock { 0; }
setMaterialAppearanceTextureGeneric = Custom[GIS2BIM.SetMaterialAppearanceTextureGeneric](Material=byName, TextureFilelocation=temp_filepath_image, TextureOffsetX=code_block_3.out0, TextureOffsetY=code_block_3.out0, TextureSizeXMM=code_block_3.out1, TextureSizeYMM=code_block_3.out1, LockScale=boolean, Angle=code_block_4)  # Change the values of the texture of the appearanceasset of a Revit Material of the type 'generic'
