# Dynamo custom node GIS2BIM_AHN3toPoints.dyf (Dynamo 2.2.1.5175)
# category: GIS2BIM.DutchGEO
# Load AHN3 via Geotiff WCS. Transform to local coordinates

RdX = Input(RdX: double)
RdY = Input(RdY: double)
code_block = CodeBlock()
# ---------- code_block.designscript (11 lines) ----------
"https://geodata.nationaalgeoregister.nl/ahn3/wcs?";
"SERVICE=WCS&VERSION=1.0.0";
"&REQUEST=GetCoverage";
"&FORMAT=GEOTIFF_FLOAT32";
"&COVERAGE=";
"&BBOX=";
"99198.4917734710033983,485588.33618855383247137,106915.96004800940863788,494366.81641667388612404";
"&CRS=EPSG:28992";
"&RESPONSE_CRS=EPSG:28992";
"&WIDTH=";
"&HEIGHT=";
# ----------------------------------------
Layer = Input(Layer: string)
BoundinxboxWidth = Input(BoundinxboxWidth: double)
GIS2BIM_CreateBoundingBox = Custom[GIS2BIM_CreateBoundingBox](CoordinateX=RdX, CoordinateY=RdY, BoxWidth=BoundinxboxWidth, BoxHeight=BoundinxboxWidth)  # create boundingboxstring for webrequests based on coördinates and dimensions
ResolutionGeotiff = Input(ResolutionGeotiff: string = "150")
concat = String.Concat(string0=code_block.out0, string1=code_block.out1, string2=code_block.out2, string3=code_block.out3, string4=code_block.out4, string5=Layer, string6=code_block.out5, string7=GIS2BIM_CreateBoundingBox.Boxstring, string8=code_block.out7, string9=code_block.out8, string10=code_block.out9, string11=ResolutionGeotiff, string12=code_block.out10, string13=ResolutionGeotiff)
FilepathName = Input(FilepathName: string)
python_script = Python(IN[0]=concat, IN[1]=FilepathName)
# ---------- python_script.python (10 lines) ----------
import sys
sys.path.append("C:\Program Files (x86)\IronPython 2.7\Lib")
from System.Net import WebClient

url= IN[0]
filoc= IN[1]

WebClient().DownloadFile(url, filoc)

OUT= filoc
# ----------------------------------------
GEOTiffReader = Helpers.GEOTiffReader(filePath=python_script)
WaterlevelHeight = Input(WaterlevelHeight: double = -3)
python_script_2 = Python(IN[0]=RdX, IN[1]=RdY, IN[2]=GEOTiffReader, IN[3]=WaterlevelHeight)
# ---------- python_script_2.python (41 lines) ----------
import clr
clr.AddReference('ProtoGeometry')
from Autodesk.DesignScript.Geometry import *
#The inputs to this node will be stored as a list in the IN variables.
dataEnteringNode = IN

#Assign your output to the OUT variable.

rdx= IN[0]
rdy = IN[1]
GeotiffValues = IN[2]
Waterbottom = IN[3]

x1 = []
y1 = []
z1 = []
x2 = []
y2 = []
z2 = []

for i in GeotiffValues:
		if int(i["elevation"]) > 1000:
			z1.append(Waterbottom*1000)
			x1.append(int((i["longitude"]-rdx)*1000))
			y1.append(int((i["latitude"]-rdy)*1000))
		else:
			x2.append(int((i["longitude"]-rdx)*1000))
			y2.append(int((i["latitude"]-rdy)*1000))
			z2.append(int(i["elevation"]*1000))

PointsNoElevationData = []
PointsSurface = []

for i,j,h in zip(x1,y1,z1):
	PointsNoElevationData.append(Point.ByCoordinates(i,j,h))

for i,j,h in zip(x2,y2,z2):
	PointsSurface.append(Point.ByCoordinates(i,j,h))

AllPoints = PointsNoElevationData + PointsSurface
OUT = AllPoints,PointsNoElevationData,PointsSurface
# ----------------------------------------
code_block_2 = CodeBlock(a=python_script_2) { a[0]; a[1]; a[2]; }
Points = Output(code_block_2.out0)
URLWebrequest = Output(concat)  # "URLWebrequest: string"
PointsSurface = Output(code_block_2.out2)
PointsNoElevationData = Output(code_block_2.out1)
