# Dynamo custom node GIS2BIM_Aerius.dyf "GIS2BIM_Aerius_PolyGon" (Dynamo 2.12.1.8246)
# category: GIS2BIM.DutchGEO.Aerius
# Create Aerius PolyGon String

code_block = CodeBlock { "POLYGON(("; "))"; }
code_block_2 = CodeBlock { " "; }
join = String.Join(separator=code_block_2)  # unwired: string0, string1
dx = Input(dx: var[]..[])
curves = Input(curves: var[]..[])
startPoint = Curve.StartPoint(curve=curves)
firstItem = List.FirstItem(list=startPoint)
addItemToEnd = List.AddItemToEnd(item=firstItem, list=startPoint)
X = Point.X(point=addItemToEnd)
round = Math.Round(number=X)
code_block_3 = CodeBlock { 1000; }
div = round / code_block_3
add = dx + div
code_block_4 = CodeBlock { 2; }
round_2 = Math.Round(number=add, digits=code_block_4)
string_from_object = FromObject(object=round_2)
code_block_5 = CodeBlock { ","; "."; }
replace = String.Replace(string=string_from_object, searchFor=code_block_5.out0, replaceWith=code_block_5.out1)
dy = Input(dy: var[]..[])
Y = Point.Y(point=addItemToEnd)
round_3 = Math.Round(number=Y)
div_2 = round_3 / code_block_3
add_2 = dy + div_2
round_4 = Math.Round(number=add_2, digits=code_block_4)
string_from_object_2 = FromObject(object=round_4)
code_block_6 = CodeBlock { ","; "."; }
replace_2 = String.Replace(string=string_from_object_2, searchFor=code_block_6.out0, replaceWith=code_block_6.out1)
combine = List.Combine(combineFunction=join, list0=replace, list1=replace_2)
code_block_7 = CodeBlock { "0000"; ""; }
replace_3 = String.Replace(string=combine, searchFor=code_block_7.out0, replaceWith=code_block_7.out1)
code_block_8 = CodeBlock { ","; }
concat = String.Concat(string1=code_block_8)  # unwired: string0
map = List.Map(list=replace_3, function=concat)
concat_2 = String.Concat(string0=map)
code_block_9 = CodeBlock { -1; -1; }
remove = String.Remove(string=concat_2, startIndex=code_block_9.out0, count=code_block_9.out1)
firstItem_2 = List.FirstItem(list=remove)
concat_3 = String.Concat(string0=code_block.out0, string1=firstItem_2, string2=code_block.out1)
PolygonString = Output(concat_3)
