# Dynamo custom node GIS2BIM_ArcGISJSONtoPolygons.dyf (Dynamo 1.3.1.1736)
# category: GIS2BIM.Geometry
# Convert a JSON-file from a ARCGIS-server to points and polygons

JSONConvertedToLists = Input()
python_script = Python(IN[0]=JSONConvertedToLists)
# ---------- python_script.python (15 lines) ----------
import sys
sys.path.append("C:\Program Files (x86)\IronPython 2.7\Lib")

lst = IN[0]

lst2 = lst[5]

lst3 = []

lst3.append(i[1] for i in lst2)



#Assign your output to the OUT variable.
OUT = lst3
# ----------------------------------------
code_block = CodeBlock { 3; }
flatten = List.Flatten(list=python_script, amt=code_block)
python_script_2 = Python(IN[0]=flatten)
# ---------- python_script_2.python (16 lines) ----------
import sys
sys.path.append("C:\Program Files (x86)\IronPython 2.7\Lib")

lst = IN[0]

X = []

for i in lst:
	X.append(item[0] for item in i)

Y = []

for i in lst:
	Y.append(item[1] for item in i)
	
OUT = X,Y
# ----------------------------------------
firstItem = List.FirstItem(python_script_2)
X = Input()
Unitsconversion = Input(Unitsconversion: double=304.8006096)
code_block_2 = CodeBlock(x1=firstItem, x2=X, factor=Unitsconversion) { (x1-x2)*factor; }
round = Math.Round(code_block_2)
lastItem = List.LastItem(python_script_2)
Y = Input()
code_block_3 = CodeBlock(y1=lastItem, y2=Y, factor=Unitsconversion) { (y1-y2)*factor; }
round_2 = Math.Round(code_block_3)
byCoordinates = Point.ByCoordinates(x=round, y=round_2)
pruneDuplicates = Point.PruneDuplicates(points=byCoordinates)
Points = Output(pruneDuplicates)
boolean = BoolSelector(true)
byPoints = PolyCurve.ByPoints(points=pruneDuplicates, connectLastToFirst=boolean)
Polycurves = Output(byPoints)
