# Dynamo custom node GIS2BIM_ArcGIS_REST_API_QUERY.dyf (Dynamo 2.1.0.7500)
# category: GIS2BIM.ARCGIS
# Create query to connect to arcGIS webservers

WebserverAddress = Input(WebserverAddress: var[]..[])
code_block = CodeBlock()
# ---------- code_block.designscript (30 lines) ----------
"query?";
"where=";
"&text=";
"&objectIds=";
"&time=";
"&geometry=";
"%2C";

"&geometryType=esriGeometryEnvelope";
"&inSR=";
"&spatialRel=esriSpatialRelIntersects";
"&relationParam=";
"&outFields=*";
"&returnGeometry=true";
"&returnTrueCurves=false";
"&maxAllowableOffset=";
"&geometryPrecision=";
"&outSR=";
"&returnIdsOnly=false";
"&returnCountOnly=false";
"&orderByFields=";
"&groupByFieldsForStatistics=";
"&outStatistics=";
"&returnZ=false";
"&returnM=false";
"&gdbVersion=";
"&returnDistinctValues=false";
"&resultOffset=";
"&resultRecordCount=";
"&f=json";
# ----------------------------------------
Boundingbox = Input(Boundingbox: var[]..[])
CRS = Input(CRS: var[]..[])
concat = String.Concat(string0=WebserverAddress, string1=code_block.out0, string2=code_block.out1, string3=code_block.out2, string4=code_block.out3, string5=code_block.out4, string6=code_block.out5, string7=Boundingbox, string8=code_block.out7, string9=code_block.out8, string10=CRS, string11=code_block.out9, string12=code_block.out10, string13=code_block.out11, string14=code_block.out12, string15=code_block.out13, string16=code_block.out14, string17=code_block.out15, string18=code_block.out16, string19=code_block.out17, string20=code_block.out18, string21=code_block.out19, string22=code_block.out20, string23=code_block.out21, string24=code_block.out22, string25=code_block.out23, string26=code_block.out24, string27=code_block.out25, string28=code_block.out26, string29=code_block.out27, string30=code_block.out28)
WebrequestLink = Output(concat)
