# Dynamo custom node GIS2BIM_BAG3D.dyf (Dynamo 2.2.1.5175)
# category: GIS2BIM.DutchGEO
# Perform a WFS(Web Feature Service) webrequest based on a boundingbox of RD-coordinates(28992). Retrieve an xml-file. Read the metadata and create 3D-solids. Maximum of 1000 buildings per request.

# group: WEBREQUEST & QUERY GML
string = StringInput(".//{3dbag}identificatie")  # graph input
string_2 = StringInput(".//{3dbag}bouwjaar")  # graph input
string_3 = StringInput(".//{http://www.opengis.net/gml}posList")  # graph input
string_4 = StringInput(".//{3dbag}ground-0.00")  # graph input
string_5 = StringInput(".//{3dbag}ground-0.50")  # graph input
string_6 = StringInput(".//{3dbag}roof-0.00")  # graph input
string_7 = StringInput(".//{3dbag}roof-0.50")  # graph input
string_8 = StringInput(".//{3dbag}roof-0.99")  # graph input
create = List.Create(item0=string, item1=string_2, item2=string_3, item3=string_4, item4=string_5, item5=string_6, item6=string_7, item7=string_8)

BAG_3D_Metadata_Xquery = Output(create)
BAG3DTUDelft_OGCWFS = Input(BAG3DTUDelft_OGCWFS: string)
web_request = WebRequest(url=BAG3DTUDelft_OGCWFS)
RdX = Input(RdX: double)
RdY = Input(RdY: double)
python_script = Python(IN[0]=web_request, IN[1]=create, IN[2]=RdX, IN[3]=RdY)
# ---------- python_script.python (196 lines) ----------
import sys

import clr
clr.AddReference('RevitAPI')
import Autodesk
from Autodesk.Revit.DB import *

clr.AddReference('ProtoGeometry')
from Autodesk.DesignScript.Geometry import *

clr.AddReference('RevitNodes')
import Revit
clr.ImportExtensions(Revit.Elements)
clr.ImportExtensions(Revit.GeometryConversion)

import xml.etree.ElementTree as ET

import itertools	# smart list functons like izip_longest (transpose)
import operator		# for smart sort (itemgetter)

# =====================================================

xml 		= IN[0]
xpathlist 	= IN[1]

root = ET.fromstring(xml)

xpathsfound = []

for i in xpathlist:
	xpathsfound.append(root.findall(i))
	
lstJSON = []
for i in range(len(xpathsfound)):
	xtext = []
	for j in range(len(xpathsfound[0])):
		try: xtext.append(xpathsfound[i][j].text)
		except: xtext.append('0')#"_none")
	lstJSON.append(xtext)

# =====================================================

lstGround = []
for item in lstJSON[3]:	# get the lowest value for the building solids
	lstGround.append(float(item))	# remember the lowest value
intBottom = min(lstGround)*1000
lstGround.Clear()

# =====================================================

rdX 	= IN[2]
rdY		= IN[3]

lstSurface = []

def defSurface(item):
	lstPoints = item.split(' ')
	lstXYZ = []
	lstPointsX = lstPoints[0::3]
	lstPointsY = lstPoints[1::3]
	lstPointsZ = lstPoints[2::3]
	for x,y in zip(lstPointsX, lstPointsY):
		ptX = round(1000*(float(x)-rdX))
		ptY = round(1000*(float(y)-rdY))
		lstXYZ.append(Point.ByCoordinates(ptX,ptY,intBottom))
	return Surface.ByPatch(PolyCurve.ByPoints(lstXYZ, False))

for item in lstJSON[2]:
	lstSurface.append(defSurface(item))

# =====================================================

#lstSurface = IN[0]
#lstJSON 	= IN[1]

lstJSON[2]	= lstSurface	# replace sublist with contour point for surface list

intJSONId 			= 0
intJSONbouwjaar 	= 1
intJSONcontour 		= 2
intJSONground0_0 	= 3
intJSONground0_5 	= 4
intJSONroof0_0 		= 5
intJSONroof0_5 		= 6
intJSONroof0_99 	= 7
intJSONArea		 	= 8	# to be added


lstHeightIndices = [
intJSONground0_0,
intJSONground0_5,
intJSONroof0_0,
intJSONroof0_5,
intJSONroof0_99
]	# list with indices to be checked


#lstJSONground 		= lstHeightIndices[:1]
#lstJSONroof		= lstHeightIndices[1:]

lstJSON = map(list, itertools.izip_longest(*lstJSON)) # // transpose

for item in lstJSON:	# append area needed for the check on heights
	item.append(item[2].Area/(1000*1000))

# sort the list based on multiple criteria
lstJSON = sorted(lstJSON, key=operator.itemgetter(intJSONArea,intJSONbouwjaar))

# [sublist maximum area, minimum height, maximum height, (set of to be checked indices),(set of uniform values), the height index]
lstOptions 		= [
[20,2,6,(lstHeightIndices[3:5]),(lstHeightIndices[1:]),3],
[50,3,16,(lstHeightIndices[3:5]),(lstHeightIndices[1:]),4],
[75,3,16,(lstHeightIndices[3:5]),(lstHeightIndices[1:]),4],
[100,3,20,(lstHeightIndices[3:5]),(lstHeightIndices[1:]),4],
[150,3,30,(lstHeightIndices[3:5]),(lstHeightIndices[1:]),4],
[1000000,3,999,(lstHeightIndices[3:5]),(lstHeightIndices[:1]),4],
]


# > prepare the divided list to be filled
lstGrouped = []
for item in lstOptions:
	lstGrouped.append([])
	c = 0	# reset counter
	for index in lstHeightIndices:	# append sublist based on the JSON
		lstGrouped[-1].append([])
		c = c + 1	# counter


# > divide complete list of buildings by area group
for subBuilding in lstJSON:
	cBld = 0	# reset counter
	for iOpt in lstOptions:	#	area divider list
		if subBuilding[intJSONArea] < iOpt[0]: # check for the right group
			cBldOpt = 0	# reset second counter
			for index in lstHeightIndices:	# every relevant index
				if index in lstOptions[cBld][3]:	# is there a check for the height
					fltTMP = float(subBuilding[index]) - float(subBuilding[intJSONground0_0])
					# the height of the object
					if fltTMP > lstOptions[cBld][1] and fltTMP < lstOptions[cBld][2]:	# check height
						lstGrouped[cBld][cBldOpt].append(float(subBuilding[index]))
					elif fltTMP > lstOptions[cBld][1]:	# then it has to be the maximum height
						fltTMP = lstOptions[cBld][2] - float(subBuilding[intJSONground0_0])
						lstGrouped[cBld][cBldOpt].append(float(subBuilding[index]))
					elif fltTMP < lstOptions[cBld][2]:	# then it has to be the minimum height
						fltTMP = lstOptions[cBld][1] - float(subBuilding[intJSONground0_0])
						lstGrouped[cBld][cBldOpt].append(float(subBuilding[index]))
					#else no value
				else:
					lstGrouped[cBld][cBldOpt].append(float(subBuilding[index]))
				cBldOpt = cBldOpt + 1	# counter
			break
		cBld  = cBld + 1	# counter


# > create a new list with proven values for heights etc
lstProvenHeights = []
cAreaGroup = 0	# reset counter
for iGroup in lstGrouped:	
	lstProvenHeights.append([lstOptions[cAreaGroup][0]])
	cOpt = 0	# reset counter
	for iHeights in iGroup:
		if lstHeightIndices[cOpt] in lstOptions[cAreaGroup][4]:	# is there a check for the average height
			# append the average value
			#lstProvenHeights[-1].append(itertools.repeat(round(sum(iHeights)/len(iHeights),1), len(iGroup[0])))
			lstTMPph = []
			for i in range(len(iGroup[0])):
				lstTMPph.append(round(sum(iHeights)/len(iHeights),1))
			lstProvenHeights[-1].append(lstTMPph)
		else:
			lstProvenHeights[-1].append(iHeights)
		cOpt = cOpt + 1	# counter
	cAreaGroup = cAreaGroup + 1	# counter
#lstGrouped.Clear()


# > create solids
lstSolids = []
cBuilding = 0 # reset counter (surfaces)
cGroup = 0	# reset counter (groups)
for iOpt in lstOptions:
#	if cGroup != 0: 
#		cGroup = cGroup + 1
#		continue
	for iHeight in lstProvenHeights[cGroup][iOpt[5]+1]:	# get the right index for the height
		obSurface = lstJSON[cBuilding][2]	#lstSurface[cSurface]	# get the surface
		cBuilding = cBuilding + 1	# counter
		obSolid = obSurface.Thicken(1000*(iHeight) - intBottom, False)	# give it height
		lstSolids.append(obSolid)
	cGroup = cGroup + 1
obSolidUnion = lstSolids[0].UnionAll(lstSolids)

try:
	OUT = obSolidUnion, lstProvenHeights
except:
	OUT = lstProvenHeights#, lstOptions, lstGrouped
# ----------------------------------------
firstItem = List.FirstItem(list=python_script)
BAG_3DSolidUnion = Output(firstItem)
