# Dynamo custom node GIS2BIM_BGT2D.dyf (Dynamo 2.10.1.3976)
# category: GIS2BIM.DutchGEO
# Create 2D BGT siteplan from set of GML-files
# packages: GIS2BIM for Dynamo 2.x 0.11.19

FilledRegionRoad2 = Input(FilledRegionRoad2: var[]..[])
Directory = Input(Directory: var[]..[])

# group: GML INPUT
bgt_lagen = CodeBlock()
# ---------- bgt_lagen.designscript (18 lines) ----------
"bgt_overigbouwwerk.gml";
"bgt_begroeidterreindeel.gml";
"bgt_functioneelgebied.gml";
"bgt_gebouwinstallatie.gml";
"bgt_kunstwerkdeel.gml";
"bgt_onbegroeidterreindeel.gml";
"bgt_ondersteunendwegdeel.gml";
"bgt_overigescheiding.gml";
"bgt_scheiding.gml";
"bgt_spoor.gml";
"bgt_tunneldeel.gml";
"bgt_kunstwerkdeel.gml";
"bgt_overbruggingsdeel.gml";
"bgt_wegdeel.gml";
"bgt_ondersteunendwaterdeel.gml";
"bgt_waterdeel.gml";
"bgt_openbareruimtelabel.gml";
"bgt_vegetatieobject.gml";
# ----------------------------------------
create = List.Create(item0=bgt_lagen.out0, item1=bgt_lagen.out1, item2=bgt_lagen.out2, item3=bgt_lagen.out3, item4=bgt_lagen.out4, item5=bgt_lagen.out5, item6=bgt_lagen.out6, item7=bgt_lagen.out7, item8=bgt_lagen.out8, item9=bgt_lagen.out9, item10=bgt_lagen.out10, item11=bgt_lagen.out11, item12=bgt_lagen.out12, item13=bgt_lagen.out13, item14=bgt_lagen.out14, item15=bgt_lagen.out15, item16=bgt_lagen.out16, item17=bgt_lagen.out17)
string = StringInput("\")  # graph input
concat = String.Concat(string0=Directory, string1=string)  # unwired: string2
map = List.Map(list=create, f_x=concat)

# group: PLACE TREES
code_block = CodeBlock { 17; }
getItemAtIndex = List.GetItemAtIndex(list=map, index=code_block)
string_2 = StringInput(".//{http://www.opengis.net/gml}pos")  # graph input

RDx = Input(RDx: var[]..[])
RDy = Input(RDy: var[]..[])
BoundingboxWidth = Input(BoundingboxWidth: var[]..[])
GIS2BIM_FilterGML = Custom[GIS2BIM_FilterGML](GMLFile=getItemAtIndex, xPATH=string_2, CoordinateX=RDx, CoordinateY=RDy, Boundingbox=BoundingboxWidth)  # package GIS2BIM for Dynamo 2.x; filter GML-file based on boundingbox

# group (continued): PLACE TREES
flatten = List.Flatten(list=GIS2BIM_FilterGML.Points)

DetailcomponentTree = Input(DetailcomponentTree: var[]..[])
Viewa = Input(Viewa: var[]..[])

# group: clockwork familyinstance by point in view
code_block_2 = CodeBlock(item=flatten) { Flatten([item]); }
python_script = Python(IN[0]=code_block_2, IN[1]=DetailcomponentTree, IN[2]=Viewa)  # IronPython2
# ---------- python_script.python (31 lines) ----------
import clr
clr.AddReference('RevitAPI')
from Autodesk.Revit.DB import *

clr.AddReference("RevitNodes")
import Revit
clr.ImportExtensions(Revit.Elements)
clr.ImportExtensions(Revit.GeometryConversion)

clr.AddReference("RevitServices")
import RevitServices
from RevitServices.Persistence import DocumentManager
from RevitServices.Transactions import TransactionManager

doc = DocumentManager.Instance.CurrentDBDocument
points = UnwrapElement(IN[0])
famtype = UnwrapElement(IN[1])
lvl = UnwrapElement(IN[2])
elementlist = list()
counter = 0

TransactionManager.Instance.EnsureInTransaction(doc)
# make sure familysymbol is active
if famtype.IsActive == False:
	famtype.Activate()
	doc.Regenerate()
for point in points:
	newobj = doc.Create.NewFamilyInstance(point.ToXyz(),famtype,lvl)
	elementlist.append(newobj.ToDSType(False))
TransactionManager.Instance.TransactionTaskDone()
OUT = elementlist
# ----------------------------------------
python_script_2 = Python(IN[0]=flatten, IN[1]=python_script)  # IronPython2
# ---------- python_script_2.python (4 lines) ----------
check = IN[0]
items = IN[1]
if isinstance(check, (list)): OUT = items
else: OUT = items[0]
# ----------------------------------------

Output = Output(python_script_2)  # ""

# group: CREATE BOUNDINGBOX AND FILTER GML
string_3 = StringInput(".//{http://www.opengis.net/gml}posList")  # graph input
GIS2BIM_FilterGML_2 = Custom[GIS2BIM_FilterGML](xPATH=string_3, CoordinateX=RDx, CoordinateY=RDy, Boundingbox=BoundingboxWidth)  # unwired: GMLFile
map_2 = List.Map(list=map, f_x=GIS2BIM_FilterGML_2.Polycurves)

watch = Watch(map_2)
FilledRegionGreen2 = Input(FilledRegionGreen2: var[]..[])
FilledRegionPand = Input(FilledRegionPand: var[]..[])
FilledRegionGreen1 = Input(FilledRegionGreen1: var[]..[])
FilledRegionRoad = Input(FilledRegionRoad: var[]..[])
FilledRegionWater = Input(FilledRegionWater: var[]..[])

# group: CREATE FILLED REGIONS
code_block_3 = CodeBlock { 5; }
getItemAtIndex_2 = List.GetItemAtIndex(list=watch, index=code_block_3)
explode = Geometry.Explode(geometry=getItemAtIndex_2)
byCurves = FilledRegion.ByCurves(view=Viewa, boundary=explode, regionType=FilledRegionGreen2)
code_block_4 = CodeBlock { 0; }
getItemAtIndex_3 = List.GetItemAtIndex(list=watch, index=code_block_4)
explode_2 = Geometry.Explode(geometry=getItemAtIndex_3)
byCurves_2 = FilledRegion.ByCurves(view=Viewa, boundary=explode_2, regionType=FilledRegionPand)
code_block_5 = CodeBlock { 1; }
getItemAtIndex_4 = List.GetItemAtIndex(list=watch, index=code_block_5)
explode_3 = Geometry.Explode(geometry=getItemAtIndex_4)
byCurves_3 = FilledRegion.ByCurves(view=Viewa, boundary=explode_3, regionType=FilledRegionGreen1)
byCurves_4 = FilledRegion.ByCurves(view=Viewa, boundary=explode_3, regionType=FilledRegionGreen2)
code_block_6 = CodeBlock { 11; }
getItemAtIndex_5 = List.GetItemAtIndex(list=watch, index=code_block_6)
explode_4 = Geometry.Explode(geometry=getItemAtIndex_5)
byCurves_5 = FilledRegion.ByCurves(view=Viewa, boundary=explode_4, regionType=FilledRegionRoad)
code_block_7 = CodeBlock { 12; }
getItemAtIndex_6 = List.GetItemAtIndex(list=watch, index=code_block_7)
explode_5 = Geometry.Explode(geometry=getItemAtIndex_6)
byCurves_6 = FilledRegion.ByCurves(view=Viewa, boundary=explode_5, regionType=FilledRegionRoad)
code_block_8 = CodeBlock { 13; }
getItemAtIndex_7 = List.GetItemAtIndex(list=watch, index=code_block_8)
explode_6 = Geometry.Explode(geometry=getItemAtIndex_7)
byCurves_7 = FilledRegion.ByCurves(view=Viewa, boundary=explode_6, regionType=FilledRegionRoad)
code_block_9 = CodeBlock { 14; }
getItemAtIndex_8 = List.GetItemAtIndex(list=watch, index=code_block_9)
explode_7 = Geometry.Explode(geometry=getItemAtIndex_8)
byCurves_8 = FilledRegion.ByCurves(view=Viewa, boundary=explode_7, regionType=FilledRegionWater)
code_block_10 = CodeBlock { 15; }
getItemAtIndex_9 = List.GetItemAtIndex(list=watch, index=code_block_10)
explode_8 = Geometry.Explode(geometry=getItemAtIndex_9)
byCurves_9 = FilledRegion.ByCurves(view=Viewa, boundary=explode_8, regionType=FilledRegionWater)

Output_2 = Output(byCurves)  # ""
Output_3 = Output(byCurves_2)  # ""
Output_4 = Output(byCurves_3)  # ""
Output_5 = Output(byCurves_4)  # ""
Output_6 = Output(byCurves_5)  # ""
Output_7 = Output(byCurves_6)  # ""
Output_8 = Output(byCurves_7)  # ""
Output_9 = Output(byCurves_8)  # ""
Output_10 = Output(byCurves_9)  # ""
LineStyleBGT_functioneelgebied = Input(LineStyleBGT_functioneelgebied: var[]..[])
LineStyleBGT_gebouwinstallatie = Input(LineStyleBGT_gebouwinstallatie: var[]..[])
LineStyleBGT_kunstwerkdeel = Input(LineStyleBGT_kunstwerkdeel: var[]..[])
LineStyleBGT_onbegroeidterreindeel = Input(LineStyleBGT_onbegroeidterreindeel: var[]..[])
LineStyleBGT_ondersteunendwegdeel = Input(LineStyleBGT_ondersteunendwegdeel: var[]..[])
LineStyleBGT_overigescheiding = Input(LineStyleBGT_overigescheiding: var[]..[])
LineStyleBGT_scheiding = Input(LineStyleBGT_scheiding: var[]..[])
LineStyleBGT_spoor = Input(LineStyleBGT_spoor: var[]..[])
LineStyleBGT_tunneldeel = Input(LineStyleBGT_tunneldeel: var[]..[])

# group: CREATE DETAILLINES
code_block_11 = CodeBlock(t3=watch)
# ---------- code_block_11.designscript (9 lines) ----------
DSCore.List.GetItemAtIndex(t3, 2);
DSCore.List.GetItemAtIndex(t3, 3);
DSCore.List.GetItemAtIndex(t3, 4);
DSCore.List.GetItemAtIndex(t3, 5);
DSCore.List.GetItemAtIndex(t3, 6);
DSCore.List.GetItemAtIndex(t3, 7);
DSCore.List.GetItemAtIndex(t3, 8);
DSCore.List.GetItemAtIndex(t3, 9);
DSCore.List.GetItemAtIndex(t3, 10);
# ----------------------------------------
GIS2BIM_CreateDetailLinesFromPolygons = Custom[GIS2BIM_CreateDetailLinesFromPolygons](view=Viewa, PolyCurves=code_block_11.out0, Linestyle=LineStyleBGT_functioneelgebied)  # package GIS2BIM for Dynamo 2.x; Create detaillines from polygons in a view
GIS2BIM_CreateDetailLinesFromPolygons_2 = Custom[GIS2BIM_CreateDetailLinesFromPolygons](view=Viewa, PolyCurves=code_block_11.out1, Linestyle=LineStyleBGT_gebouwinstallatie)
GIS2BIM_CreateDetailLinesFromPolygons_3 = Custom[GIS2BIM_CreateDetailLinesFromPolygons](view=Viewa, PolyCurves=code_block_11.out0, Linestyle=LineStyleBGT_kunstwerkdeel)
GIS2BIM_CreateDetailLinesFromPolygons_4 = Custom[GIS2BIM_CreateDetailLinesFromPolygons](view=Viewa, PolyCurves=code_block_11.out3, Linestyle=LineStyleBGT_onbegroeidterreindeel)
GIS2BIM_CreateDetailLinesFromPolygons_5 = Custom[GIS2BIM_CreateDetailLinesFromPolygons](view=Viewa, PolyCurves=code_block_11.out4, Linestyle=LineStyleBGT_ondersteunendwegdeel)
GIS2BIM_CreateDetailLinesFromPolygons_6 = Custom[GIS2BIM_CreateDetailLinesFromPolygons](view=Viewa, PolyCurves=code_block_11.out5, Linestyle=LineStyleBGT_overigescheiding)
GIS2BIM_CreateDetailLinesFromPolygons_7 = Custom[GIS2BIM_CreateDetailLinesFromPolygons](view=Viewa, PolyCurves=code_block_11.out6, Linestyle=LineStyleBGT_scheiding)
GIS2BIM_CreateDetailLinesFromPolygons_8 = Custom[GIS2BIM_CreateDetailLinesFromPolygons](view=Viewa, PolyCurves=code_block_11.out7, Linestyle=LineStyleBGT_spoor)
GIS2BIM_CreateDetailLinesFromPolygons_9 = Custom[GIS2BIM_CreateDetailLinesFromPolygons](view=Viewa, PolyCurves=code_block_11.out8, Linestyle=LineStyleBGT_tunneldeel)

Output_11 = Output(GIS2BIM_CreateDetailLinesFromPolygons)  # ""
Output_12 = Output(GIS2BIM_CreateDetailLinesFromPolygons_2)  # ""
Output_13 = Output(GIS2BIM_CreateDetailLinesFromPolygons_3)  # ""
Output_14 = Output(GIS2BIM_CreateDetailLinesFromPolygons_4)  # ""
Output_15 = Output(GIS2BIM_CreateDetailLinesFromPolygons_5)  # ""
Output_16 = Output(GIS2BIM_CreateDetailLinesFromPolygons_6)  # ""
Output_17 = Output(GIS2BIM_CreateDetailLinesFromPolygons_7)  # ""
Output_18 = Output(GIS2BIM_CreateDetailLinesFromPolygons_8)  # ""
Output_19 = Output(GIS2BIM_CreateDetailLinesFromPolygons_9)  # ""
