# Dynamo custom node GIS2BIM_BGTDownload.dyf (Dynamo 2.10.1.3976)
# category: GIS2BIM.DutchGEO
# Download BGT
# Dynamoversion > 2.8
# Uses CPython Libraries

code_block = CodeBlock()
# ---------- code_block.designscript (35 lines) ----------
"bak";
"begroeidterreindeel";
"bord";
"buurt";
"functioneelgebied";
"gebouwinstallatie";
"installatie";
"kast";
"kunstwerkdeel";
"mast";
"onbegroeidterreindeel";
"ondersteunendwaterdeel";
"ondersteunendwegdeel";
"ongeclassificeerdobject";
"openbareruimte";
"openbareruimtelabel";
"overbruggingsdeel";
"overigbouwwerk";
"overigescheiding";
"paal";
"pand";
"plaatsbepalingspunt";
"put";
"scheiding";
"sensor";
"spoor";
"stadsdeel";
"straatmeubilair";
"tunneldeel";
"vegetatieobject";
"waterdeel";
"waterinrichtingselement";
"waterschap";
"weginrichtingselement";
"wijk";
# ----------------------------------------

# group: use Requests from GIS2BIM Folder
python_script = Python()  # CPython3
# ---------- python_script.python (13 lines) ----------
from System.Reflection import Assembly
import os

dynamo = Assembly.Load('DynamoCore')
version = str(dynamo.GetName().Version)
versionsplit = version.split(".")
version = versionsplit[0] + "." + versionsplit[1]

basepath = os.getenv('APPDATA')

pathRequests = basepath + "/Dynamo/Dynamo Revit/" + version + "/packages/GIS2BIM for Dynamo 2.x/bin"

OUT = pathRequests
# ----------------------------------------

PolygonString = Input(PolygonString: string)
TimeOutDownload = Input(TimeOutDownload: int = 120)
FilePathZipFile = Input(FilePathZipFile: var[]..[])
FolderExtractedFiles = Input(FolderExtractedFiles: var[]..[])
PathOfCPythonLibraries = Input(PathOfCPythonLibraries: var[]..[])

# group: POST/GET/ CUSTOM BGT DOWNLOAD
code_block_2 = CodeBlock { "https://api.pdok.nl/lv/bgt/download/v1_0/full/custom"; }
code_block_3 = CodeBlock { "https://api.pdok.nl"; }
python_script_2 = Python(IN[0]=PolygonString, IN[1]=code_block_2, IN[2]=code_block_3, IN[3]=TimeOutDownload, IN[4]=FilePathZipFile, IN[5]=FolderExtractedFiles, IN[6]=PathOfCPythonLibraries)  # CPython3
# ---------- python_script_2.python (82 lines) ----------
import sys
import clr
import json
import urllib
import time

polygonString = IN[0] #Define format, polygon, layers
url = IN[1]
url2= IN[2]
timeout = IN[3]
folder = IN[4]
folder2 = IN[5]
pathRequestsLibrary = IN[6]

sys.path.append(pathRequestsLibrary)
import requests
from requests.structures import CaseInsensitiveDict

##Define data 
qryPart1 = '{"featuretypes":['
qryPart2 = '"bak","begroeidterreindeel","bord","buurt","functioneelgebied","gebouwinstallatie","installatie","kast","kunstwerkdeel","mast","onbegroeidterreindeel","ondersteunendwaterdeel","ondersteunendwegdeel","ongeclassificeerdobject","openbareruimte","openbareruimtelabel","overbruggingsdeel","overigbouwwerk","overigescheiding","paal","pand","put","scheiding","sensor","spoor","stadsdeel","straatmeubilair","tunneldeel","vegetatieobject","waterdeel","waterinrichtingselement","waterschap","weginrichtingselement","wijk","wegdeel"'
qryPart3 = '],"format":"gmllight","geofilter":"POLYGON('
qryPart4 = polygonString
qryPart5 = ')"}'

data = qryPart1 +  qryPart2 + qryPart3 + qryPart4 + qryPart5
dataquery = data

headers = CaseInsensitiveDict()
headers["accept"] = "application/json"
headers["Content-Type"] = "application/json"

resp = requests.post(url, headers=headers, data=data)

jsondata = json.loads(resp.text)
data = jsondata["downloadRequestId"]
urlstatus = url + "/" + data + "/status" 
#urlstatus = "https://api.pdok.nl/lv/bgt/download/v1_0/full/custom/cf759cb6-578c-42c2-40fd-0f371b85bb26/status"
# Check URL Status

req = requests.get(urlstatus).text
#req2 = requests.read().decode('utf-8')
progressStatus = int(json.loads(req)['progress'])

timer = 0

while timer < timeout:
    req = requests.get(urlstatus).text
    try:
        req = requests.get(urlstatus).text
        progressStatus = int(json.loads(req)['progress'])
        status = json.loads(req)['status']
    except:
        time.sleep(1)
        req = requests.get(urlstatus).text
        progressStatus = int(json.loads(req)['progress'])
        status = json.loads(req)['status']
    if status == "COMPLETED":
        try:
            downloadURL = url2 + json.loads(req)["_links"]["download"]["href"]
        except:   
            downloadURL = "unable to get downloadlink"        
        message = status
        break
    elif timer > timeout:
        downloadURL = "empty"
        message = "timeout"
        breakW
    else: 
        downloadURL = "pending"
        time.sleep(1)
    timer = timer + 1

#downloadURL = "test"
#message = "test"
req = requests.get(downloadURL, allow_redirects=True)

with open(folder, 'wb') as f:
    f.write(req.content)


OUT = downloadURL, message, urlstatus, folder, folder2, dataquery, urlstatus
# ----------------------------------------

# group: unzip files
code_block_4 = CodeBlock(a=python_script_2) { a[0]; a[1]; a[2]; a[3]; a[4]; a[5]; }
python_script_3 = Python(IN[0]=code_block_4.out3, IN[1]=code_block_4.out4)  # IronPython2
# ---------- python_script_3.python (27 lines) ----------
import clr
import os
clr.AddReference("System.IO.Compression.FileSystem")
from System.IO.Compression import ZipFile
from datetime import datetime

#The inputs to this node will be stored as a list in the IN variables.
dataEnteringNode = IN
tzip = IN[0]
tpath = IN[1]

files = os.listdir(tpath)

filepaths = []
for i in files:
	j = (tpath + "/" + i)
	os.remove(j)

ZipFile.ExtractToDirectory(tzip, tpath)
files = os.listdir(tpath)

filepaths = []
for i in files:
	filepaths.append(tpath + "/" + i)

#Assign your output to the OUT variable.
OUT = tpath, filepaths
# ----------------------------------------
code_block_5 = CodeBlock(a=python_script_3) { a[0]; a[1]; }

Directory = Output(code_block_5.out0)
Files = Output(code_block_5.out1)
