# Dynamo custom node GIS2BIM_BGTGeometry.dyf (Dynamo 2.10.1.3976)
# category: GIS2BIM.DutchGEO
# Returns BGT-curves and metadata(Dutch GEO)

Directorypath = Input(Directorypath: var[]..[])  # Directory with BGTfiles
RdX = Input(RdX: double)  # RD-coordinate in meters
RdY = Input(RdY: double)  # RD-coordinate in meters
BoundingboxWidth = Input(BoundingboxWidth: double)  # Boundingboxwidth and height in meters
code_block = CodeBlock { rdx; rdy; bbox; 1000; }  # unwired: rdx, rdy, bbox

# group: BGT Curves
string = StringInput(".//{http://www.opengis.net/gml}posList")  # graph input
python_script = Python(IN[0]=Directorypath, IN[1]=string, IN[2]=RdX, IN[3]=RdY, IN[4]=BoundingboxWidth, IN[5]=code_block.out3)  # IronPython2
# ---------- python_script.python (114 lines) ----------
import sys
sys.path.append("C:\Program Files (x86)\IronPython 2.7\Lib")

import clr
import re
clr.AddReference('ProtoGeometry')
from Autodesk.DesignScript.Geometry import *

import xml.etree.ElementTree as ET
aDebug = []

directory_path = IN[0]

bgt_curves = ["bgt_begroeidterreindeel",
"bgt_functioneelgebied",
"bgt_gebouwinstallatie",
"bgt_kunstwerkdeel",
"bgt_onbegroeidterreindeel",
"bgt_ondersteunendwaterdeel",
"bgt_ondersteunendwegdeel",
"bgt_ongeclassifiseerdobject",
"bgt_overbruggingsdeel",
"bgt_overigbouwwerk",
"bgt_overigescheiding",
"bgt_pand",
"bgt_scheiding",
"bgt_spoor",
"bgt_tunneldeel",
"bgt_waterdeel",
"bgt_wegdeel"]

file_paths = []
for i in bgt_curves:
	file_paths.append(directory_path + '/' + i + '.gml')

def checkIfCoordIsInsideBoundingBox(coord, min_x, min_y, max_x, max_y):
	if re.match(r'^-?\d+(?:\.\d+)$', coord[0]) is None or re.match(r'^-?\d+(?:\.\d+)$', coord[1]) is None:
		return False
	else:
		if min_x <= float(coord[0]) <= max_x and min_y <= float(coord[1]) <= max_y:
			return True
		else:
		    return False
	
def mainFunction(file_path):
    # Inputs
	
    xpathstr = IN[1]

    # Bounding box definition
    bbx = IN[2]
    bby = IN[3]
    bb_size = IN[4]
    scale = IN[5]
    bounding_box = [bbx, bby, bb_size]
    min_x = bounding_box[0] - (bounding_box[2]/2)#/2
    min_y = bounding_box[1] - (bounding_box[2]/2)
    max_x = bounding_box[0] + (bounding_box[2]/2)
    max_y = bounding_box[1] + (bounding_box[2]/2)

    # get data from xml
    tree = ET.parse(file_path)
    root = tree.getroot()

    # for loop to get each element in an array
    XMLelements = []
    for elem in root.iter():
        XMLelements.append(elem)

    xpathfound = root.findall(xpathstr)

    # for loop to get all polygons in an array
    polygons = []
    for x in xpathfound:
        if x.text:
            try:
                polygons.append(x.text)
            except:
                polygons.append("_none_")
        else:
            polygons.append("_none_")

    # for loop to get each polygon as a list instead of a string
    newPolygons = []
    for polygon in polygons:
        newPolygons.append(polygon.split(" "))

    # for loop to get x,y coords and filter polygons inside Bounding Box
    xyPolygons = []
    for newPolygon in newPolygons:
        polygon_is_inside_bounding_box = False
        x = 0
        xyPolygon = []
        for i in range(0, int(len(newPolygon) / 2)):
            xy_coord = [newPolygon[x], newPolygon[x + 1]]
            xy_coord_trans = [round((float(newPolygon[x])-bbx)*scale), round((float(newPolygon[x + 1])-bby)*scale)]
            xyPolygon.append(xy_coord_trans)
            x += 2
            if checkIfCoordIsInsideBoundingBox(xy_coord, min_x, min_y, max_x, max_y):
                polygon_is_inside_bounding_box = True
        if polygon_is_inside_bounding_box:
            xyPolygons.append(xyPolygon)
    return xyPolygons

# execution of main function in python script
returnValue = []
for i in file_paths:
	try:
		returnValue.append(mainFunction(i))
	except:
		returnValue.append("_none_")
		
# put returnValue in OUT
OUT = returnValue
# ----------------------------------------
code_block_2 = CodeBlock(t2=python_script) { t3 = List.FirstItem(t2@@L2<1>); t1 = [[0]]; t4 = List.LastItem(t2@@L2<1>); }
python_script_2 = Python(IN[0]=code_block_2.t3, IN[1]=code_block_2.t1)  # IronPython2
# ---------- python_script_2.python (8 lines) ----------
items = IN[0]
rep = IN[1]
elementlist = list()
for item in items:
	if item is None: 
		item = rep
	elementlist.append(item)
OUT = elementlist
# ----------------------------------------
python_script_3 = Python(IN[0]=code_block_2.t4, IN[1]=code_block_2.t1)  # IronPython2; same code as python_script_2
code_block_3 = CodeBlock(t1=python_script_2, t2=python_script_3)
# ---------- code_block_3.designscript (5 lines) ----------
point1 = Point.ByCoordinates(t1, t2, 0);
t3 = List.Clean(point1, false);
polyCurve1 = PolyCurve.ByPoints(t3, false);
geometry1 = Geometry.Explode(polyCurve1);
t4 = ["bgt_begroeidterreindeel", "bgt_functioneelgebied", "bgt_gebouwinstallatie", "bgt_kunstwerkdeel", "bgt_onbegroeidterreindeel", "bgt_ondersteunendwaterdeel", "bgt_ondersteunendwegdeel", "bgt_ongeclassifiseerdobject", "bgt_overbruggingsdeel", "bgt_overigbouwwerk", "bgt_overigescheiding", "bgt_pand", "bgt_scheiding", "bgt_spoor", "bgt_tunneldeel", "bgt_waterdeel"];
# ----------------------------------------

Curves_BGT = Output(code_block_3.geometry1)
PolyCurves_BGT = Output(code_block_3.polyCurve1)
Curvenames_BGT = Output(code_block_3.t4)

# group: BGT Points,metadata
string_2 = StringInput(".//{http://www.opengis.net/gml}pos")  # graph input
string_3 = StringInput(".//{http://www.geostandaarden.nl/imgeo/2.1/simple/gml31}plus-type")  # graph input
python_script_4 = Python(IN[0]=Directorypath, IN[1]=string_2, IN[2]=RdX, IN[3]=RdY, IN[4]=BoundingboxWidth, IN[5]=string_3, IN[6]=code_block.out3)  # IronPython2
# ---------- python_script_4.python (108 lines) ----------
import sys
sys.path.append("C:\Program Files (x86)\IronPython 2.7\Lib")

import clr
clr.AddReference('ProtoGeometry')
from Autodesk.DesignScript.Geometry import *

import xml.etree.ElementTree as ET

directory_path = IN[0]

bgt_points = ["bgt_bak",
"bgt_bord",
"bgt_kast",
"bgt_mast",
"bgt_paal",
"bgt_put",
"bgt_sensor",
"bgt_straatmeubilair",
"bgt_vegetatieobject",
"bgt_waterinrichtingselement",
"bgt_wegrichtingselement"]

file_paths = []
for i in bgt_points:
	file_paths.append(directory_path + '/' + i + '.gml')
	
def checkIfCoordIsInsideBoundingBox(coord, bounding_box):
    min_x = bounding_box[0] - (bounding_box[2] / 2)
    min_y = bounding_box[1] - (bounding_box[2] / 2)
    max_x = bounding_box[0] + (bounding_box[2] / 2)
    max_y = bounding_box[1] + (bounding_box[2] / 2)

    if min_x <= float(coord[0]) <= max_x and min_y <= float(coord[1]) <= max_y:
        return True
    else:
        return False

def mainFunction(file_path):
    # Inputs
    xpathstr = IN[1]
    # Bounding box definition
    bbx = IN[2]
    bby = IN[3]
    bb_size = IN[4]
    xpathstr2 = IN[5]
    scale = IN[6]
    bounding_box = [bbx, bby, bb_size]
    # get data from xml
    tree = ET.parse(file_path)
    root = tree.getroot()
	
    # for loop to get each element in an array
    XMLelements = []
    for elem in root.iter():
        XMLelements.append(elem)

    xpathfound = root.findall(xpathstr)
    xpathfoundlabel = root.findall(xpathstr2)
    # for loop to get all points in an array
    points = []
    for x in xpathfound:
        if x.text:
            try:
                points.append(x.text)
            except:
                points.append("_none_")
        else:
            points.append("_none_")
	
	labels = []
    for i in xpathfoundlabel:
        if i.text:
            try:
                labels.append(i.text)
            except:
                labels.append("_none_")
        else:
            labels.append("_none_")
    
    # for loop to get each point as a list instead of a string
    newPoints = []
    newPointsTrans = []
    for point in points:
    	newPointsTrans.append([round((float((point.split(" ")[0]))-bbx)*scale),round((float((point.split(" ")[1]))-bby)*scale)])
        newPoints.append(point.split(" "))

    # for loop to get x,y coords and filter points inside Bounding Box
    xyPoints = []
    xyLabels = []
    for newPoint,newPointTrans, label in zip(newPoints, newPointsTrans, labels):
    	point_is_inside_bounding_box = False
    	if checkIfCoordIsInsideBoundingBox(newPoint, bounding_box):
    		point_is_inside_bounding_box = True
    		xyPoints.append(newPointTrans)
    		xyLabels.append(label)
    return xyPoints, xyLabels

# execution of main function in python script
returnValue = []
for i in file_paths:
	try:
		returnValue.append(mainFunction(i))
	except:
		returnValue.append("_none_")

# put returnValue in OUT
OUT = returnValue, bgt_points
# ----------------------------------------
code_block_4 = CodeBlock(a=python_script_4) { a[0]; a[1]; }
code_block_5 = CodeBlock(t3=code_block_4.out0)
# ---------- code_block_5.designscript (7 lines) ----------
t2 = List.FirstItem(t3@@L2<1>);
t4 = List.FirstItem(t2@@L3<1>);
t5 = List.LastItem(t3@@L2<1>);
t6 = List.FirstItem(t5@@L3<1>);
point1 = Point.ByCoordinates(t4, t6);
t7 = List.LastItem(t5@@L3<1>);
text = t7;
# ----------------------------------------

Points_BGT = Output(code_block_5.point1)
Points_Names_BGT = Output(code_block_4.out1)
Metadata_BGT = Output(code_block_5.text)
string_4 = StringInput(".//{http://www.opengis.net/gml}featureMember")  # graph input

# group: Labels
code_block_6 = CodeBlock { "bgt_openbareruimtelabel"; "/"; ".gml"; }
concat = String.Concat(string0=Directorypath, string1=code_block_6.out1, string2=code_block_6.out0, string3=code_block_6.out2)
string_5 = StringInput(".//{http://www.opengis.net/gml}pos")  # graph input
string_6 = StringInput(".//{http://www.geostandaarden.nl/imgeo/2.1/simple/gml31}openbareRuimteNaam.tekst")  # graph input
string_7 = StringInput(".//{http://www.geostandaarden.nl/imgeo/2.1/simple/gml31}openbareRuimteNaam.positie_1.hoek")  # graph input
python_script_5 = Python(IN[0]=concat, IN[1]=string_4, IN[2]=RdX, IN[3]=RdY, IN[4]=BoundingboxWidth, IN[5]=string_5, IN[6]=string_6, IN[7]=string_7, IN[8]=code_block.out3)  # IronPython2
# ---------- python_script_5.python (110 lines) ----------
import sys
sys.path.append("C:\Program Files (x86)\IronPython 2.7\Lib")

import clr
clr.AddReference('ProtoGeometry')
from Autodesk.DesignScript.Geometry import *

import xml.etree.ElementTree as ET


def checkIfCoordIsInsideBoundingBox(coord, bounding_box):
    min_x = bounding_box[0] - (bounding_box[2] / 2)
    min_y = bounding_box[1] - (bounding_box[2] / 2)
    max_x = bounding_box[0] + (bounding_box[2] / 2)
    max_y = bounding_box[1] + (bounding_box[2] / 2)

    if min_x <= float(coord[0]) <= max_x and min_y <= float(coord[1]) <= max_y:
        return True
    else:
        return False

def mainFunction():
    # Inputs
    file_path = IN[0]
    xpathstr = IN[1]
    # Bounding box definition
    bbx = IN[2]
    bby = IN[3]
    bb_size = IN[4]
    xpathstr2 = IN[5]
    xpathstr3 = IN[6]
    xpathstr4 = IN[7]
    scale = IN[8]
    bounding_box = [bbx, bby, bb_size]
    # get data from xml
    tree = ET.parse(file_path)
    root = tree.getroot()
	
    # for loop to get each element in an array
    XMLelements = []
    for elem in root.iter():
        XMLelements.append(elem)

    xpathfound = root.findall(xpathstr)
    xpathfoundlabel = root.findall(xpathstr3)
    xpathfoundrotation = root.findall(xpathstr4)
    
    xpathpoints = []
    for i in xpathfound:
    	xpathpoints.append(i.findall(xpathstr2))
    	
    points = []
    for y in xpathpoints:
    	subpoints = []
    	for x in y:
        	if x.text:
        	    try:
        	        subpoints.append(x.text)
        	    except:
        	        subpoints.append("_none_")
        	else:
        	    subpoints.append("_none_")
        points.append(subpoints[0])	    
    # for loop to get all points in an array

	labels = []
    for i in xpathfoundlabel:
        if i.text:
            try:
                labels.append(i.text)
            except:
                labels.append("_none_")
        else:
            labels.append("_none_")
        
    rotations = []
    for i in xpathfoundrotation:
        if i.text:
            try:
                rotations.append(i.text)
            except:
                rotations.append("_none_")
        else:
            rotations.append("_none_")
    
    # for loop to get each point as a list instead of a string
    newPoints = []
    newPointsTrans = []
    for point in points:
    	newPointsTrans.append([round((float((point.split(" ")[0]))-bbx)*scale),round((float((point.split(" ")[1]))-bby)*scale)])
        newPoints.append(point.split(" "))

    # for loop to get x,y coords and filter points inside Bounding Box
    xyPoints = []
    xyLabels = []
    xyRotations = []
    for newPoint, newPointTrans, label, rotation in zip(newPoints, newPointsTrans, labels, rotations):
    	point_is_inside_bounding_box = False
    	if checkIfCoordIsInsideBoundingBox(newPoint, bounding_box):
    		point_is_inside_bounding_box = True
    		xyPoints.append(newPointTrans)
    		xyLabels.append(label)
    		xyRotations.append(rotation)
    return xyPoints, xyLabels, xyRotations, points

# execution of main function in python script
returnvalue = mainFunction()

# put returnValue in OUT
OUT = returnvalue
# ----------------------------------------
code_block_7 = CodeBlock(t2=python_script_5)
# ---------- code_block_7.designscript (5 lines) ----------
a = t2;
t1 = Get.ValueAtIndex(a, 0);
t3 = List.FirstItem(t1@L2<1>);
t4 = List.LastItem(t1@L2<1>);
point1 = Point.ByCoordinates(t3, t4);
# ----------------------------------------
code_block_8 = CodeBlock(a=python_script_5) { a[1]; a[2]; }

Points_openbareruimtelabel = Output(code_block_7.point1)
Text_openbareruimtelabel = Output(code_block_8.out0)
Rotation_openbareruimtelabel = Output(code_block_8.out1)
