# Dynamo custom node GIS2BIM_BuildCMDLASZIP.dyf (Dynamo 2.2.1.5175)
# category: GIS2BIM.Pointcloud
# create scriptfile to run laszip

DirectoryPointcloud = Input(DirectoryPointcloud: var[]..[])

# group: create datetimestamp
now = DateTime.Now()
timeOfDay = DateTime.TimeOfDay(dateTime=now)
python_script = Python(IN[0]=timeOfDay)
# ---------- python_script.python (21 lines) ----------
#Copyright(c) 2016, Dimitar Venkov
# @5devene, dimitar.ven@gmail.com

import clr

def tolist(obj1):
	if hasattr(obj1,"__iter__"): return obj1
	else: return [obj1]

def output1(l1):
	if len(l1) == 1: return l1[0]
	else: return l1

num1 = tolist(IN[0])
out1 = []
for i in xrange(len(num1)):
	s1 = str(num1[i])
	if s1[-2:] == ".0": out1.append(s1[:-2])
	else: out1.append(s1)

OUT = output1(out1)
# ----------------------------------------
string = StringInput(":")  # graph input
string_2 = StringInput("")  # graph input
replace = String.Replace(str=python_script, searchFor=string, replaceWith=string_2)
string_3 = StringInput(".")  # graph input
split = String.Split(str=replace, separator0=string_3)
firstItem = List.FirstItem(list=split)

FilePathLASZIP = Input(FilePathLASZIP: var[]..[])
string_4 = StringInput(" -i ")  # graph input
Files = Input(Files: var[]..[])
FilterString = Input(FilterString: var[]..[])
ReduceString = Input(ReduceString: var[]..[])
CropString = Input(CropString: var[]..[])
Translate = Input(Translate: var[]..[])
MergeString = Input(MergeString: var[]..[])
PathFileFormat = Input(PathFileFormat: var[]..[])
code_block = CodeBlock(lasToolExe=FilePathLASZIP, importPointsFile=string_4, path=DirectoryPointcloud, files=Files, filter=FilterString, reduce=ReduceString, crop=CropString, translate=Translate, merge=MergeString, filePath=PathFileFormat) { lasToolExe+importPointsFile+path+files+filter+reduce+crop+translate+merge+filePath; }

# group: build cmd comments and path setting
combinePath = FileSystem.CombinePath(path0=DirectoryPointcloud, path1=firstItem)
commentmarker = StringInput("REM ")  # graph input
code_block_2 = CodeBlock { "GIStoBIM"; }
code_block_3 = CodeBlock(commentMarker=commentmarker, dynName=code_block_2)
# ---------- code_block_3.designscript (20 lines) ----------
[
commentMarker+"Script based on script made by Ekko Nap",
commentMarker+"Batchscript is made with "+dynName,
commentMarker+"The program is running as a backgroundprocess. It can take some timeondproces.",
[],
"@ECHO OFF",
[]
];

//insert path setting and lastools input



[
[],
"@ECHO ON",
[],
commentMarker+"laszip is ready",
commentMarker+"credits laszip from LAStools: https://rapidlasso.com/laszip/ twitter: @LAStools email: info@rapidlasso.com"
];
# ----------------------------------------
string_5 = StringInput("set PATH=%PATH%;")  # graph input
code_block_4 = CodeBlock(s1=string_5, path=DirectoryPointcloud) { s1+path; }
join = List.Join(list0=code_block_3.out0, list1=code_block_4, list2=code_block, list3=code_block_3.out1)
code_block_5 = CodeBlock(multiline_array=join) { "startLAStools.cmd"; multiline_array; }
code_block_6 = CodeBlock(path=combinePath, str=code_block_5.out0) { path+str; }
exportCSV = Data.ExportCSV(filePath=code_block_6, data=code_block_5.multiline_array)

FilePathScriptFile = Output(code_block_6)
CommandsLASZIP = Output(code_block)
