# Dynamo custom node GIS2BIM_CompanySettings.dyf (Dynamo 2.10.1.3976)
# category: GIS2BIM.Settings
# GIS2BIM Company Settings

code_block = CodeBlock()
# ---------- code_block.designscript (35 lines) ----------
//keys
["project_place",
"project_housenumber",
"project_streetname",
"cadastral_number",
"cadastral_parcel",
"logo",
"notification_pass",
"notification_error",
"linestyle_cadastral_parcel",
"linestyle_buildingcontour",
"filledregion_building",
"filledregion_bgt_pand",
"filledregion_bgt_water",
"filledregion_bgt_water_2",
"filledregion_bgt_weg_1",
"filledregion_bgt_weg_2",
"filledregion_bgt_groen_1",
"filledregion_bgt_groen_2",
"familytemplatepath_mass",
"materialname_green_1",
"materialname_green_2",
"materialname_road_1",
"materialname_road_2",
"materialname_building",
"materialname_toposurface",
"materialname_water",
"familytype_tree",
"textstyle_BAG_kadaster_1",
"textstyle_BAG_kadaster_2",
"textstyle_BAG_kadaster_3",
"linestyle_buildingarea",
"tempfolder_name",
"textstyle_BGT",
"bgt_curve_linestyles"];
# ----------------------------------------
code_block_2 = CodeBlock()
# ---------- code_block_2.designscript (17 lines) ----------
["bgt_begroeidterreindeel",
"bgt_functioneelgebied",
"bgt_gebouwinstallatie",
"bgt_kunstwerkdeel",
"bgt_onbegroeidterreindeel",
"bgt_ondersteunendwaterdeel",
"bgt_ondersteunendwegdeel",
"bgt_ongeclassifiseerdobject",
"bgt_overbruggingsdeel",
"bgt_overigbouwwerk",
"bgt_overigescheiding",
"bgt_pand",
"bgt_scheiding",
"bgt_spoor",
"bgt_tunneldeel",
"bgt_waterdeel",
"bgt_wegdeel"];
# ----------------------------------------
code_block_3 = CodeBlock(bgt_curves=code_block_2)
# ---------- code_block_3.designscript (35 lines) ----------
//values
["project_plaats",
"project_huisnummer",
"project_straatnaam",
"kadastraal_nummer",
"kadastrale_sectie",
"C:/TEMP/logo.png",
"Locatiegegevens ophalen gelukt",
"Locatiegegevens ophalen mislukt! Controleer adres en internetverbinding",
"_0.25 mm CENTER",
"pen rood",
"FP_DP_90_pand",
"FP_DP_90_pand",
"FP_DP_90_water",
"FP_DP_90_water_2",
"FP_DP_90_weg",
"FP_DP_90_weg2",
"FP_DP_90_groen1",
"FP_DP_90_groen2",
"C:/ProgramData/Autodesk/RVT 2019/Family Templates/English/Conceptual Mass/Metric Mass.rft",
"materialname_groen_1",
"materialname_groen_2",
"s1_asfalt",
"materialname_weg_2",
"a_mass_bestaande bebouwing_IP",
"a_maaiveld",
"a_water",
"NLRS_90_boom",
"2.5 mm",
"3.5 mm",
"2.5 mm",
"pen 2",
"GIS-files",
"3.5 mm",
bgt_curves];
# ----------------------------------------
byKeysValues = DesignScript.Builtin.Dictionary.ByKeysValues(keys=code_block, values=code_block_3)
SearchSetting = Input(SearchSetting: string = "project_plaats")
valueAtKey = DesignScript.Builtin.Dictionary.ValueAtKey(dictionary=byKeysValues, key=SearchSetting)
Setting = Output(valueAtKey)
AllSetting = Output(byKeysValues)
