# Dynamo custom node GIS2BIM_CreateDetailLinesFromPolygons.dyf (Dynamo 2.2.1.5175)
# category: GIS2BIM.Revit
# Create detaillines from polygons in a view

PolyCurves = Input(PolyCurves: var[]..[])
explode = Geometry.Explode(geometry=PolyCurves)
View = Input(View: var[]..[])

# group: CLOCKWORK DETAILLINE FROM CURVE
code_block = CodeBlock(item=explode) { DSCore.List.Flatten([item]); }
python_script = Python(IN[0]=code_block, IN[1]=View)
# ---------- python_script.python (28 lines) ----------
import clr
clr.AddReference('RevitAPI')
from Autodesk.Revit.DB import *

clr.AddReference("RevitNodes")
import Revit
clr.ImportExtensions(Revit.GeometryConversion)

clr.AddReference("RevitServices")
import RevitServices
from RevitServices.Persistence import DocumentManager
from RevitServices.Transactions import TransactionManager

doc = DocumentManager.Instance.CurrentDBDocument
curves = UnwrapElement(IN[0])
view = UnwrapElement(IN[1])
elementlist = []

TransactionManager.Instance.EnsureInTransaction(doc)
if doc.IsFamilyDocument: 
	doc_create = doc.FamilyCreate
else: 
	doc_create = doc.Create
for curve in curves:
	detcurve = doc_create.NewDetailCurve(view, curve.ToRevitType())
	elementlist.append(detcurve)
TransactionManager.Instance.TransactionTaskDone()
OUT = elementlist
# ----------------------------------------
python_script_2 = Python(IN[0]=explode, IN[1]=python_script)
# ---------- python_script_2.python (4 lines) ----------
check = IN[0]
items = IN[1]
if isinstance(check, (list)): OUT = items
else: OUT = items[0]
# ----------------------------------------

code_block_2 = CodeBlock { "Line Style"; }
element_types = ElementTypes("GraphicsStyle")  # graph input
all_elements_of_type = ElementsOfType(element_type=element_types)
python_script_3 = Python(IN[0]=all_elements_of_type)
# ---------- python_script_3.python (21 lines) ----------
import clr
clr.AddReference('RevitAPI')
from Autodesk.Revit.DB import *

faminsts = IN[0]
elementlist = list()
for item in faminsts:
	try:
		n = UnwrapElement(item).Name
	except:
		# Use a built-in property of (wrapped) Dynamo elements for family symbols instead
		try:
			n = item.Name
		except:
			# maybe it's a parameter name
			try:
				n = item.Definition.Name
			except:
				n = []
	elementlist.append(n)
OUT = elementlist
# ----------------------------------------
Linestyle = Input(Linestyle: var[]..[])
eq = python_script_3 == Linestyle
filterByBoolMask = List.FilterByBoolMask(list=all_elements_of_type, mask=eq)
flatten = List.Flatten(list=filterByBoolMask.in)
firstItem = List.FirstItem(list=flatten)
setParameterByName = Element.SetParameterByName(element=python_script_2, parameterName=code_block_2, value=firstItem)
Detaillines = Output(setParameterByName)
