# Dynamo custom node GIS2BIM_CzechRepublicGeoservicesLibrary.dyf (Dynamo 1.3.1.1736)
# category: GIS2BIM.Geoservices.Europe
# Geoservices in the Czech Republic

code_block = CodeBlock()
# ---------- code_block.designscript (6 lines) ----------
"http://services.cuzk.cz/wfs/inspire-cp-wfs.asp?service=wfs&version=2.0.0";
"&REQUEST=GetFeature";
"&typeName=cp:CadastralParcel";
"&bbox=";

"&typeName=cp:CadastralBoundary";
# ----------------------------------------
Boundingboxstring = Input(Boundingboxstring: string)
concat = String.Concat(code_block.out0, code_block.out1, code_block.out2, code_block.out3, Boundingboxstring)
Cadastral_Parcel_OGC_WFS = Output(concat)  # "Cadastral Parcel(OGC WFS)"
concat_2 = String.Concat(code_block.out0, code_block.out1, code_block.out4, code_block.out3, Boundingboxstring)
Cadastral_Boundary_OGC_WFS = Output(concat_2)  # "Cadastral Boundary(OGC WFS)"
