# Dynamo custom node GIS2BIM_CzechRepublicGeoservicesLibrary_geoportal.dyf (Dynamo 2.12.1.8246)
# category: GIS2BIM.Geoservices.Europe
# Czech_gov_geoportal
# packages: Data-Shapes 2022.2.103

cz = CodeBlock()  # "geoportal.gov.cz"
# ---------- cz.designscript (12 lines) ----------
//string 0:
"https://geoportal.gov.cz/ArcGIS/services/CENIA/";
"/MapServer/WMSServer?";
//server + layer (string 1 en 3:)
//geomorfologie
"cenia_geomorfologie";
// overzichtskaart van Tsjechië
"cenia_prehledka";
//schaduwmap
"cenia_stinovani";
//topo achtergond
"cenia_t_podklad";
# ----------------------------------------
server = Input(server: string)
bbox = Input(bbox: string)

# group: get capabilities and download all layers
code_block = CodeBlock(mainserver=cz.out0, server=server, service=cz.out1, bbox=bbox)
# ---------- code_block.designscript (13 lines) ----------
//string 0
mainserver;
//string 1
server;
mainserver+server+service+"service=WMS&request=GetCapabilities";
//string 3
"&styles=default&Layers=";
//string 2
service+"service=WMS&request=GetMap&version=1.3.0";
//string 4
"&WIDTH=2000&HEIGHT=2000&format=image/png&CRS=EPSG:5514&BBOX="+bbox;
bbox;
service;
# ----------------------------------------
web_request = WebRequest(url=code_block.out2)
code_block_2 = CodeBlock()
# ---------- code_block_2.designscript (4 lines) ----------
namespace="{http://www.opengis.net/wms}";
[".//"+namespace+"Layer/"+namespace+"Name",
".//"+namespace+"Layer/"+namespace+"Abstract"
];
# ----------------------------------------
python_script = Python(IN[0]=web_request, IN[1]=code_block_2.out1)  # IronPython2
# ---------- python_script.python (28 lines) ----------
import clr
clr.AddReference('ProtoGeometry')
from Autodesk.DesignScript.Geometry import *

import sys
sys.path.append("C:\Program Files (x86)\IronPython 2.7\Lib")

import xml.etree.ElementTree as ET
xml = IN[0]
xpathlist = IN[1]

root = ET.fromstring(xml.encode('utf-8'))
debug = []
xpathsfound = []

for i in xpathlist:
	xpathsfound.append(root.findall(i))
	
xpathresult = []

for i in range(len(xpathsfound)):
	xtext = []
	for j in range(len(xpathsfound[0])):
		try: xtext.append(xpathsfound[i][j].text)
		except: xtext.append("_none")
	xpathresult.append(xtext)

OUT = xpathresult
# ----------------------------------------
code_block_3 = CodeBlock(L=python_script) { layer=L[0]; layername=L[1]; }
concat = String.Concat(string0=code_block.mainserver, string1=code_block.server, string2=code_block.out4, string3=code_block.out3, string5=code_block.out5)  # unwired: string4
map = List.Map(list=code_block_3.layer, function=concat)

# group: some other interesting servers
cz_2 = CodeBlock()  # "geoportal.cuzk.cz"
# ---------- cz_2.designscript (10 lines) ----------
//string 0:
"https://geoportal.cuzk.cz/";
"/WMService.aspx?";
//server en layer (string 1 en 3 ):
// ortofoto
"WMS_INSPIRE_ORTOFOTO";
"GR_ORTFOTORGB";
//test
"WMS_SM5V_PUB";
"SM_MASKA";
# ----------------------------------------
# note: future features. niveau hoger uitlezen en dan alle servers in kaart brengen, selector maken
code_block_4 = CodeBlock()
# ---------- code_block_4.designscript (2 lines) ----------
//betaalde sever.....
"https://geoportal.cuzk.cz/WFS_ZBG/WFService.aspx?service=wfs&request=GetFeature&version=2.0.0&format=text/xml&CRS=EPSG:5514&BBOX=-764483,-1034537,-759483,-1029537&TypeNames=gmgml:PrecerpavaciStaniceProduktovodu";
# ----------------------------------------
code_block_5 = CodeBlock { "https://gis.nature.cz/arcgis/services/INSPIRE/InspireProtectedSites/MapServer/WmsServer?service=WMS&request=GetCapabilities"; }

# group: select layer
code_block_6 = CodeBlock { true; "Layer_selector"; "cancel"; }
code_block_7 = CodeBlock { "Layer"; }
watch = Watch(code_block_3.layername)
watch_2 = Watch(code_block_3.layer)
code_block_8 = CodeBlock { false; }
listview_data = Custom[Listview Data](InputName=code_block_7, Keys=watch, Values=watch_2, SortItems_optionnal=code_block_8)  # package Data-Shapes; Create data for ListView input in UI.MultiInputForm ++ . Check out www.data-shapes.net for more infos.
multipleinputform = Custom[MultipleInputForm ++](Description_optional=code_block_6.out1, Logo_optional=code_block_6.out1, Inputs=listview_data, Toggle=code_block_6.out0, CancelButtonText_optional=code_block_6.out2)  # package Data-Shapes; Create a form with multiple inputs. see www.data-shapes.net for tutorials and infos!
code_block_9 = CodeBlock(L=multipleinputform.User_Inputs) { String.ToNumber(L[0][0]); }

# group: download 1 layers
code_block_10 = CodeBlock(mainserver=code_block.mainserver, server=code_block.server, service=code_block.service, bbox=code_block.bbox)
# ---------- code_block_10.designscript (11 lines) ----------
//string 0
mainserver;
//string 1
server;
mainserver+server+service+"service=WMS&request=GetCapabilities";
//string 3
"&styles=default&Layers=";
//string 2
service+"service=WMS&request=GetMap&version=1.3.0";
//string 4
"&WIDTH=2000&HEIGHT=2000&format=image/png&CRS=EPSG:5514&BBOX="+bbox;
# ----------------------------------------
getItemAtIndex = List.GetItemAtIndex(list=code_block_3.layer, index=code_block_9)
concat_2 = String.Concat(string0=code_block_10.mainserver, string1=code_block_10.server, string2=code_block_10.out4, string3=code_block_10.out3, string4=getItemAtIndex, string5=code_block_10.out5)

url = Output(concat_2)  # "url: string"
layername = Output(code_block_3.layername)  # "layername: string"
layernumber = Output(code_block_9)  # "layernumber: int"
server_2 = Output(code_block_10.server)  # "server: string"
