# Dynamo custom node GIS2BIM_DoubleToString.dyf (Dynamo 2.1.0.7500)
# category: GIS2BIM.Coordinates
# Converts a double to a string

CoordinateDouble = Input(CoordinateDouble: double)
string_from_object = FromObject(obj=CoordinateDouble)
code_block = CodeBlock { ","; "."; }
replace = String.Replace(str=string_from_object, searchFor=code_block.out0, replaceWith=code_block.out1)
CoordinateString = Output(replace)  # "CoordinateString: String"
