# Dynamo custom node GIS2BIM_DownloadLASZIP.dyf "GIS2BIM.DownloadLASZIP" (Dynamo 2.2.1.5175)
# category: GIS2BIM.Pointcloud
# download and unzip laszip

Directory = Input(Directory: var[]..[])
code_block = CodeBlock { "/laszip.zip"; "/laszip.exe"; }
concat = String.Concat(string0=Directory, string1=code_block.out1)
Laszip = Output(concat)
concat_2 = String.Concat(string0=Directory, string1=code_block.out0)
Pathzipfile = Output(concat_2)
code_block_2 = CodeBlock { "https://github.com/DutchSailor/GIS2BIM/raw/master/supportfiles/laszip.zip"; }
python_script = Python(IN[0]=code_block_2, IN[1]=concat_2)
# ---------- python_script.python (10 lines) ----------
import sys
sys.path.append("C:\Program Files (x86)\IronPython 2.7\Lib")
from System.Net import WebClient

url= IN[0]
filoc= IN[1]

WebClient().DownloadFile(url, filoc)

OUT= filoc
# ----------------------------------------
GIS2BIM_UnzipFile = Custom[GIS2BIM_UnzipFile](FilePathZipFile=python_script, DirectoryToExtractTo=Directory)  # Unzip zip-file
