# Dynamo custom node GIS2BIM_FilterGML.dyf (Dynamo 2.5.0.7460)
# category: GIS2BIM.Geometry
# filter GML-file based on boundingbox

GMLFile = Input(GMLFile: var[]..[])  # path of GML-file
xPATH = Input(xPATH: var[]..[])  # xPathToSearchXML
CoordinateX = Input(CoordinateX: var[]..[])
CoordinateY = Input(CoordinateY: var[]..[])
Boundingbox = Input(Boundingbox: var[]..[])  # width and height of boundingbox
python_script = Python(IN[0]=GMLFile, IN[1]=xPATH, IN[2]=CoordinateX, IN[3]=CoordinateY, IN[4]=Boundingbox)
# ---------- python_script.python (84 lines) ----------
import sys
sys.path.append("C:\Program Files (x86)\IronPython 2.7\Lib")

import clr
import re
clr.AddReference('ProtoGeometry')
from Autodesk.DesignScript.Geometry import *

import xml.etree.ElementTree as ET
aDebug = []

def checkIfCoordIsInsideBoundingBox(coord, min_x, min_y, max_x, max_y):
	if re.match(r'^-?\d+(?:\.\d+)$', coord[0]) is None or re.match(r'^-?\d+(?:\.\d+)$', coord[1]) is None:
		return False
	else:
		if min_x <= float(coord[0]) <= max_x and min_y <= float(coord[1]) <= max_y:
			return True
		else:
		    return False
	
def mainFunction():
    # Inputs
    file_path = IN[0]
    xpathstr = IN[1]

    # Bounding box definition
    bbx = IN[2]
    bby = IN[3]
    bb_size = IN[4]
    bounding_box = [bbx, bby, bb_size]
    min_x = bounding_box[0] - (bounding_box[2] / 2)
    min_y = bounding_box[1] - (bounding_box[2] / 2)
    max_x = bounding_box[0] + (bounding_box[2] / 2)
    max_y = bounding_box[1] + (bounding_box[2] / 2)

    # get data from xml
    tree = ET.parse(file_path)
    root = tree.getroot()

    # for loop to get each element in an array
    XMLelements = []
    for elem in root.iter():
        XMLelements.append(elem)

    xpathfound = root.findall(xpathstr)

    # for loop to get all polygons in an array
    polygons = []
    for x in xpathfound:
        if x.text:
            try:
                polygons.append(x.text)
            except:
                polygons.append("_none_")
        else:
            polygons.append("_none_")

    # for loop to get each polygon as a list instead of a string
    newPolygons = []
    for polygon in polygons:
        newPolygons.append(polygon.split(" "))

    # for loop to get x,y coords and filter polygons inside Bounding Box
    xyPolygons = []
    for newPolygon in newPolygons:
        polygon_is_inside_bounding_box = False
        x = 0
        xyPolygon = []
        for i in range(0, int(len(newPolygon) / 2)):
            xy_coord = [newPolygon[x], newPolygon[x + 1]]
            xyPolygon.append(xy_coord)
            x += 2
            if checkIfCoordIsInsideBoundingBox(xy_coord, min_x, min_y, max_x, max_y):
                polygon_is_inside_bounding_box = True
        if polygon_is_inside_bounding_box:
            xyPolygons.append(xyPolygon)
    return xyPolygons

# execution of main function in python script
returnvalue = mainFunction()

# put returnValue in OUT
OUT = returnvalue
#OUT = aDebug
# ----------------------------------------
firstItem = List.FirstItem()  # unwired: list
map = List.Map(f_x=firstItem)  # unwired: list
map_2 = List.Map(list=python_script, f_x=map)
toNumber = String.ToNumber(str=map_2)
lastItem = List.LastItem()  # unwired: list
map_3 = List.Map(f_x=lastItem)  # unwired: list
map_4 = List.Map(list=python_script, f_x=map_3)
toNumber_2 = String.ToNumber(str=map_4)
code_block = CodeBlock(x=toNumber, rdx=CoordinateX, y=toNumber_2, rdy=CoordinateY) { (x-rdx)*1000; (y-rdy)*1000; }
code_block_2 = CodeBlock { 0; }
byCoordinates = Point.ByCoordinates(x=code_block.out0, y=code_block.out1, z=code_block_2)
Points = Output(byCoordinates)
Connectpolycurves = Input(Connectpolycurves: bool = false)  # connect polycurves
byPoints = PolyCurve.ByPoints(points=byCoordinates, connectLastToFirst=Connectpolycurves)
Polycurves = Output(byPoints)
