# Dynamo custom node GIS2BIM_GMLCoordinateListToGeometry.dyf (Dynamo 2.10.1.3976)
# category: GIS2BIM.Coordinates
# List of GML Coordinates to Polycurves and Points

UnitsConversion = Input(UnitsConversion: double = 1000)
ListOfcoordinates = Input(ListOfcoordinates: var[]..[])
code_block = CodeBlock { " "; }
split = String.Split(str=ListOfcoordinates, separator0=code_block)
string = StringInput("0")  # graph input
eq = _ == string  # unwired: x
map = List.Map(list=split, f_x=eq)
filterByBoolMask = List.FilterByBoolMask(list=split, mask=map)
toNumber = String.ToNumber(str=filterByBoolMask.out)
code_block_2 = CodeBlock { 1; 2; 0; }
X = List.TakeEveryNthItem(n=code_block_2.out1, offset=code_block_2.out0)  # unwired: list
map_2 = List.Map(list=toNumber, f_x=X)
dX = Input(dX: var[]..[])
dY = Input(dY: var[]..[])
code_block_3 = CodeBlock(dx=dX, dy=dY) { dx; dy; }
x_convert_to_local_axis = map_2 - code_block_3.dx
mul = UnitsConversion * x_convert_to_local_axis
Y = List.TakeEveryNthItem(n=code_block_2.out1, offset=code_block_2.out2)  # unwired: list
map_3 = List.Map(list=toNumber, f_x=Y)
y_convert_to_local_axis = map_3 - code_block_3.dy
mul_2 = UnitsConversion * y_convert_to_local_axis
code_block_4 = CodeBlock { 0; }
byCoordinates = Point.ByCoordinates(x=mul, y=mul_2, z=code_block_4)
pruneDuplicates = Point.PruneDuplicates(points=byCoordinates)
Points = Output(pruneDuplicates)
code_block_5 = CodeBlock { ClosePolygon: bool = false; }
byPoints = PolyCurve.ByPoints(points=pruneDuplicates, connectLastToFirst=code_block_5)
PolyCurves = Output(byPoints)
