# Dynamo custom node GIS2BIM_GMLData.dyf (Dynamo 2.12.1.8246)
# category: GIS2BIM.Geometry

webrequestURL = Input(webrequestURL: string)
XPATHString = Input(XPATHString: string = ".//{http://www.opengis.net/gml/3.2}posList")
dx = Input(dx: double)
dy = Input(dy: double)
scale = Input(scale: int = 1)
units = Input(units: int = 3)
bboxString = Input(bboxString: string)
python_script = Python(IN[0]=webrequestURL, IN[1]=XPATHString, IN[2]=dx, IN[3]=dy, IN[4]=scale, IN[5]=units, IN[6]=bboxString)  # CPython3
# ---------- python_script.python (59 lines) ----------
import xml.etree.ElementTree as ET
import urllib
import urllib.request
from urllib.request import urlopen

def GML_poslistData(tree,xPathString,dx,dy,scale,DecimalNumbers):
#group X and Y Coordinates of polylines
    posLists = tree.findall(xPathString)
    xyPosList = []
    for posList in posLists:
        dataPosList = posList.text
        coordSplit = dataPosList.split()
        try:
            if float(coordSplit[2]) == 0:
                XYZCountDimensions = 3
            else:XYZCountDimensions = 2
        except:
            XYZCountDimensions = 2
        x = 0
        coordSplitXY = []
        for j in range(0, int(len(coordSplit) / XYZCountDimensions)):
            xy_coord = (round((float(coordSplit[x])+dx)*scale,DecimalNumbers), round((float(coordSplit[x+1])+dy)*scale,DecimalNumbers))
            coordSplitXY.append(xy_coord)
            x +=XYZCountDimensions
        xyPosList.append(coordSplitXY)
    return xyPosList

def PointsFromWFS(serverName,boundingBoxString,xPathString,dx,dy,scale,DecimalNumbers):
# group X and Y Coordinates
    myrequesturl = serverName + boundingBoxString
    urlFile = urllib.request.urlopen(myrequesturl)
    tree = ET.parse(urlFile)
    xyPosList = GML_poslistData(tree,xPathString,dx,dy,scale,DecimalNumbers)
    return xyPosList

url = IN[0]
bbx = IN[6]
xpath = IN[1]
dx = IN[2]
dy = IN[3]
scale = IN[4]
dec = IN[5]

 
xypostlist = PointsFromWFS(url,bbx,xpath,dx,dy,scale,dec)

xposlist = []
yposlist = []

for i in xypostlist:
    xposlistnest = []
    yposlistnest = []
    for j in i:
        xposlistnest.append(j[0])
        yposlistnest.append(j[1])
    xposlist.append(xposlistnest)
    yposlist.append(yposlistnest)

OUT = xypostlist,xposlist,yposlist
# ----------------------------------------
raw = Output(python_script)
code_block = CodeBlock(a=python_script) { a[1]; a[2]; }
byCoordinates = Point.ByCoordinates(x=code_block.out0, y=code_block.out1)
points = Output(byCoordinates)
byPoints = PolyCurve.ByPoints(points=byCoordinates)
polyCurves = Output(byPoints)
