# Dynamo custom node GIS2BIM_GeocodingNominatimAPI.dyf (Dynamo 2.1.0.7500)
# category: GIS2BIM.Geoservices.WorldWide
# gets WGS-84 coordinate from address with Open Streets Maps API

code_block = CodeBlock { "https://nominatim.openstreetmap.org/search/"; "%20"; "?format=xml&addressdetails=1&limit=1&polygon_svg=1"; }
Streetname = Input(Streetname: string)
Housenumber = Input(Housenumber: string)
Place = Input(Place: string)
Country = Input(Country: string)
concat = String.Concat(string0=code_block.out0, string1=Streetname, string2=code_block.out1, string3=Housenumber, string4=code_block.out1, string5=Place, string6=code_block.out1, string7=Country, string8=code_block.out2)
python_script = Python(IN[0]=concat)
# ---------- python_script.python (20 lines) ----------
import clr
clr.AddReference("System.Drawing")
clr.AddReference("System")
from System.Net import WebRequest
from System.IO import StreamReader
from System.Text import Encoding

url= IN[0]

request = WebRequest.Create(url)
request.Accept = "text/html"
request.UserAgent = "Mozilla/5.0"
response = request.GetResponse()

stream = response.GetResponseStream();

reader = StreamReader(stream, Encoding.UTF8)
ResponseString = reader.ReadToEnd();

OUT = ResponseString
# ----------------------------------------
code_block_2 = CodeBlock(t5=python_script)
# ---------- code_block_2.designscript (9 lines) ----------
t4 = String.Split(t5, [" lat='"]);
t6 = DSCore.List.LastItem(t4);
t7 = String.Split(t6, ["' lon="]);
t8 = DSCore.List.LastItem(t7);
t9 = String.Split(t8, ["' display_name"]);
t10 = DSCore.List.FirstItem(t9);
t11 = DSCore.List.LastItem(String.Split(t10,["'"]));
t12 = String.Split(t5, ["postcode"]);
t13 = String.Split(t12[1], [">", "</"]);
# ----------------------------------------
firstItem = List.FirstItem(list=code_block_2.t7)
toNumber = String.ToNumber(str=firstItem)
Latitude = Output(toNumber)  # "Latitude: double"
firstItem_2 = List.FirstItem(list=code_block_2.t11)
toNumber_2 = String.ToNumber(str=firstItem_2)
Longitude = Output(toNumber_2)  # "Longitude: double"
firstItem_3 = List.FirstItem(list=code_block_2.t13)
PostalCode = Output(firstItem_3)  # "PostalCode: string"
xml = Output(python_script)  # "xml:string"
Link_Webrequest = Output(concat)
