# Dynamo custom node GIS2BIM_GeoservicesDatabase.dyf (Dynamo 2.12.1.8246)
# category: GIS2BIM.Geoservices
# Returns a actual list of WFS/WMS/WCS services and requests from the Github-repository of GIS2BIM.

code_block = CodeBlock { "https://raw.githubusercontent.com/DutchSailor/GIS2BIM/master/GIS2BIM_Data.json"; }
web_request = WebRequest(url=code_block)
parseJSON = Data.ParseJSON(json=web_request)
values = DesignScript.Builtin.Dictionary.Values(dictionary=parseJSON)
firstItem = List.FirstItem(list=values)
keys = DesignScript.Builtin.Dictionary.Keys(dictionary=firstItem)
valueAtKey = DesignScript.Builtin.Dictionary.ValueAtKey(dictionary=firstItem, key=keys)
GeoservicesList = Output(valueAtKey)
