# Dynamo custom node GIS2BIM_GetLocationdataNetherlands.dyf (Dynamo 2.3.0.5885)
# category: GIS2BIM.DutchGEO
# Gives locationdata based on an adress in the Netherlands

City = Input(City: string)  # name of the city in the Netherlands
Streetname = Input(Streetname: string)  # streetname
Housenumber = Input(Housenumber: string)  # housenumber
code_block = CodeBlock(city=City, street=Streetname, number=Housenumber)
# ---------- code_block.designscript (6 lines) ----------
"http://geodata.nationaalgeoregister.nl/locatieserver/v3/free?wt=json&rows=1&q="+
city+
" and "+
street+
" and "+
number;
# ----------------------------------------
web_request = WebRequest(url=code_block)
string = StringInput("centroide_rd\":\"POINT(")  # graph input
split = String.Split(str=web_request, separator0=string)
code_block_2 = CodeBlock(x=split) { x[1]; " "; ")"; }
split_2 = String.Split(str=code_block_2.out0, separator0=code_block_2.out1, separator1=code_block_2.out2)
code_block_3 = CodeBlock(x=split_2) { [x[0], x[1]]; }
toNumber = String.ToNumber(str=code_block_3)
round = Math.Round(number=toNumber)
code_block_4 = CodeBlock(x=round) { RDx=x[0]; RDY=x[1]; }
RDcoordinateXmeters = Output(code_block_4.RDx)  # "RDcoordinateXmeters:double"
RDcoordinateYmeters = Output(code_block_4.RDY)  # "RDcoordinateYmeters:double"
string_2 = StringInput("\"postcode\":\"")  # graph input
split_3 = String.Split(str=web_request, separator0=string_2)
code_block_5 = CodeBlock(x=split_3) { x[1]; }
string_3 = StringInput("\",")  # graph input
split_4 = String.Split(str=code_block_5, separator0=string_3)
code_block_6 = CodeBlock(x=split_4) { postcode=x[0]; }
Postalcode = Output(code_block_6)  # "Postalcode:string"
string_4 = StringInput("\"gekoppeld_perceel\":[\"")  # graph input
split_5 = String.Split(str=web_request, separator0=string_4)
code_block_7 = CodeBlock(x=split_5) { x[1]; "-"; }
string_5 = StringInput("\"],")  # graph input
split_6 = String.Split(str=code_block_7.out0, separator0=code_block_7.out1, separator1=string_5)
code_block_8 = CodeBlock(x=split_6) { kadastraleGemeenteCode=x[0]; kadastraleSectie=x[1]; kadastralePerceel=x[2]; }
SectieKadaster = Output(code_block_8.kadastraleSectie)  # "SectieKadaster:string"
PerceelKadaster = Output(code_block_8.kadastralePerceel)  # "PerceelKadaster:string"
string_6 = StringInput("centroide_ll\":\"POINT(")  # graph input
split_7 = String.Split(str=web_request, separator0=string_6)
code_block_9 = CodeBlock(x=split_7) { x[1]; " "; ")"; }
split_8 = String.Split(str=code_block_9.out0, separator0=code_block_9.out1, separator1=code_block_9.out2)
code_block_10 = CodeBlock(x=split_8) { lon=x[0]; lat=x[1]; }
Longitude = Output(code_block_10.lon)  # "Longitude:string"
Latitude = Output(code_block_10.lat)  # "Latitude:string"
code_block_11 = CodeBlock(URLWebrequest=code_block) { URLWebrequest; }
URLWebrequest = Output(code_block_11)
GemeenteCodeKadaster = Output(code_block_8.kadastraleGemeenteCode)  # "GemeenteCodeKadaster:string"

# group: WINDGEBIED&PROVINCIE
string_7 = StringInput("\"provincienaam\":\"")  # graph input
split_9 = String.Split(str=web_request, separator0=string_7)
code_block_12 = CodeBlock(a=split_9) { a[1]; }
string_8 = StringInput("\",")  # graph input
split_10 = String.Split(str=code_block_12, separator0=string_8)
code_block_13 = CodeBlock(a=split_10) { a[0]; }
code_block_14 = CodeBlock { "2"; "1_2"; "2"; "3"; "3"; "3"; "3"; "2"; "3"; "2"; "2"; }
create = List.Create(item0=code_block_14.out0, item1=code_block_14.out1, item2=code_block_14.out2, item3=code_block_14.out3, item4=code_block_14.out4, item5=code_block_14.out5, item6=code_block_14.out6, item7=code_block_14.out7, item8=code_block_14.out8, item9=code_block_14.out9, item10=code_block_14.out10)
code_block_15 = CodeBlock()
# ---------- code_block_15.designscript (11 lines) ----------
"Zuid-Holland";
"Noord-Holland";
"Zeeland";
"Noord-Brabant";
"Limburg";
"Gelderland";
"Utrecht";
"Flevoland";
"Overijssel";
"Friesland";
"Groningen";
# ----------------------------------------
create_2 = List.Create(item0=code_block_15.out0, item1=code_block_15.out1, item2=code_block_15.out2, item3=code_block_15.out3, item4=code_block_15.out4, item5=code_block_15.out5, item6=code_block_15.out6, item7=code_block_15.out7, item8=code_block_15.out8, item9=code_block_15.out9, item10=code_block_15.out10)
indexOf = List.IndexOf(list=create_2, element=code_block_13)
getItemAtIndex = List.GetItemAtIndex(list=create, index=indexOf)
eq = getItemAtIndex == code_block_14.out1
toNumber_2 = String.ToNumber(str=code_block_10.lat)
code_block_16 = CodeBlock { 52.5; }
lt = toNumber_2 < code_block_16
code_block_17 = CodeBlock { 1; 2; }
if_ = If(test=lt, true=code_block_17.out1, false=code_block_17.out0)
if_2 = If(test=eq, true=if_, false=getItemAtIndex)

Provincie = Output(code_block_13)  # "Provincie:string"
Windgebied = Output(if_2)  # "Windgebied:double"
python_script = Python(IN[0]=web_request)
# ---------- python_script.python (32 lines) ----------
import sys
sys.path.append("C:\Program Files (x86)\IronPython 2.7\Lib")
import xml.etree.ElementTree as ET

jsonFile = IN[0]

jsonList = jsonFile.split(",")

a1 = [i for i, s in enumerate(jsonList) if 'centroide_rd' in s]
a2 = jsonList[a1[0]].split(":")[1].replace('"', '')

b1 = [i for i, s in enumerate(jsonList) if 'postcode' in s]
b2 = jsonList[b1[0]].split(":")[1].replace('"', '')

c1 = [i for i, s in enumerate(jsonList) if 'gekoppeld_perceel' in s]
c2 = jsonList[c1[0]].split(":")[1].replace('"', '')

d1 = [i for i, s in enumerate(jsonList) if 'centroide_ll' in s]
d2 = jsonList[d1[0]].split(":")[1].replace('"', '')

e1 = [i for i, s in enumerate(jsonList) if 'gemeentecode' in s]
e2 = jsonList[e1[0]].split(":")[1].replace('"', '')

f1 = [i for i, s in enumerate(jsonList) if 'provincienaam' in s]
f2 = jsonList[f1[0]].split(":")[1].replace('"', '')

g1 = [i for i, s in enumerate(jsonList) if 'waterschapsnaam' in s]
g2 = jsonList[g1[0]].split(":")[1].replace('"', '')

lst = {a2,b2,c2,d2,e2,f2,g2}

OUT = lst
# ----------------------------------------
string_9 = StringInput("\"waterschapsnaam\":\"")  # graph input
split_11 = String.Split(str=web_request, separator0=string_9)
code_block_18 = CodeBlock(x=split_11) { x[1]; }
string_10 = StringInput("\",")  # graph input
split_12 = String.Split(str=code_block_18, separator0=string_10)
code_block_19 = CodeBlock(x=split_12) { waterschap=x[0]; }
Waterschap = Output(code_block_19)  # "Waterschap:string"
