# Dynamo custom node GIS2BIM_GetRevitSiteLocation.dyf (Dynamo 2.12.1.8246)
# category: GIS2BIM.Revit
# Gets the properties of the current Site Location of the active Revit Project

siteLocation = SiteLocation()  # graph input
string_from_object = FromObject(obj=siteLocation)
code_block = CodeBlock { "Name:"; "Lat"; }
split = String.Split(string=string_from_object, separator0=code_block.out0, separator1=code_block.out1)
code_block_2 = CodeBlock(a=split) { a[0]; }
Name = Output(code_block_2)
longitude = DynamoUnits.Location.Longitude(location=siteLocation)
string_from_object_2 = FromObject(obj=longitude)
code_block_3 = CodeBlock { ","; "."; }
replace = String.Replace(string=string_from_object_2, searchFor=code_block_3.out0, replaceWith=code_block_3.out1)
Lon = Output(replace)
latitude = DynamoUnits.Location.Latitude(location=siteLocation)
string_from_object_3 = FromObject(obj=latitude)
code_block_4 = CodeBlock { ","; "."; }
replace_2 = String.Replace(string=string_from_object_3, searchFor=code_block_4.out0, replaceWith=code_block_4.out1)
Lat = Output(replace_2)
Location = Output(siteLocation)
