# Dynamo custom node GIS2BIM_GoogleEarth.dyf (Dynamo 2.10.1.3976)
# category: GIS2BIM.Geoservices.WorldWide
# Download Google Earth
# packages: GIS2BIM for Dynamo 2.x 0.11.20

Latitude = Input(Latitude: var[]..[])
Longitude = Input(Longitude: var[]..[])
WidthBoundingBox = Input(WidthBoundingBox: var[]..[])
GIS2BIM_CreateBoundingBoxLATLONG = Custom[GIS2BIM_CreateBoundingBoxLATLONG](Latitude=Latitude, Longitude=Longitude, WidthMeters=WidthBoundingBox)  # package GIS2BIM for Dynamo 2.x; create boundingbox with from lat/long coordinate in degrees
Zoomlevel = Input(Zoomlevel: int = 18)
GIS2BIM_TMSGetTileNumbersFromBboxLATLON = Custom[GIS2BIM_TMSGetTileNumbersFromBboxLATLON](West=GIS2BIM_CreateBoundingBoxLATLONG.West, East=GIS2BIM_CreateBoundingBoxLATLONG.East, North=GIS2BIM_CreateBoundingBoxLATLONG.North, South=GIS2BIM_CreateBoundingBoxLATLONG.South, Zoomlevel=Zoomlevel, BoundingboxWidth=WidthBoundingBox)  # package GIS2BIM for Dynamo 2.x; Get the Tilenumbers in X and Y in the TMS Webprotocol based on a given Boundingbox in LAT/LON
GIS2BIM_TMSWebServices = Custom[GIS2BIM_TMSWebServices](TileX=GIS2BIM_TMSGetTileNumbersFromBboxLATLON.TileX, TileY=GIS2BIM_TMSGetTileNumbersFromBboxLATLON.TileY, Zoomlevel=Zoomlevel)  # package GIS2BIM for Dynamo 2.x; Library With TMS Webservices
boolean = BoolSelector(false)  # graph input
GIS2BIM_TMS_WMTS_WebrequestAndCombineIma = Custom[GIS2BIM_TMS_WMTS_WebrequestAndCombineImages](URLlist=GIS2BIM_TMSWebServices.URL_Google_Earth_Satellite, UniqueTileNumbersColumnX=GIS2BIM_TMSGetTileNumbersFromBboxLATLON.TileXUnique, UniqueTileNumbersRowY=GIS2BIM_TMSGetTileNumbersFromBboxLATLON.TileYUnique, WMTSorTMS=boolean)  # package GIS2BIM for Dynamo 2.x; Webrequest for list of WMTS or TMS/Google webrequests for tiles. Combines them to 1 image.
code_block = CodeBlock(dx=GIS2BIM_TMSGetTileNumbersFromBboxLATLON.DeltaXmm, dy=GIS2BIM_TMSGetTileNumbersFromBboxLATLON.DeltaYmm) { dx/1000; -dy/1000; }
GIS2BIM_CropImage = Custom[GIS2BIM_CropImage](image=GIS2BIM_TMS_WMTS_WebrequestAndCombineIma.Image, SourceWidthM=GIS2BIM_TMSGetTileNumbersFromBboxLATLON.WidthM, SourceHeightM=GIS2BIM_TMSGetTileNumbersFromBboxLATLON.HeightM, dxM=code_block.out0, dyM=code_block.out1, NewWidthM=WidthBoundingBox, NewHeightM=WidthBoundingBox)  # package GIS2BIM for Dynamo 2.x; Crop an image
Image = Output(GIS2BIM_CropImage)
