# Dynamo custom node GIS2BIM_ImageMakeTransparant.dyf (Dynamo 2.12.1.8246)
# category: GIS2BIM.Image
# Makes a System.Drawing.Bitmap transparant

Bitmap = Input(Bitmap: var[]..[])
python_script = Python(IN[0]=Bitmap)  # IronPython2
# ---------- python_script.python (16 lines) ----------
import sys
sys.path.append("C:\Program Files (x86)\IronPython 2.7\Lib")

import clr

clr.AddReference("System.Drawing")
clr.AddReference("System")
from System.Drawing import Image
from System.Drawing import Bitmap
from System.Drawing import Graphics
img= IN[0]

bmp2 = Bitmap(img)
bmp2.MakeTransparent()

OUT = bmp2
# ----------------------------------------
Bitmap_2 = Output(python_script)  # "Bitmap"
