# Dynamo custom node GIS2BIM_ImageRotateFlip.dyf (Dynamo 2.2.1.5175)
# category: GIS2BIM.Image
# Rotate and/or flip a bitmap/image

image = Input(image: var[]..[])
FlipX = Input(FlipX: bool)
FlipY = Input(FlipY: bool)
RotationFlip = Input(RotationFlip: int)  # Allowed values are 0, 90, 180, 270
python_script = Python(IN[0]=image, IN[1]=FlipX, IN[2]=FlipY, IN[3]=RotationFlip)
# ---------- python_script.python (67 lines) ----------
import sys
sys.path.append("C:\Program Files (x86)\IronPython 2.7\Lib")

import clr
clr.AddReference("System.Drawing")

from System.Drawing import Bitmap
from System.Drawing import RotateFlipType

bmp= IN[0]
FlipX = IN[1]
FlipY = IN[2]
Rotate = IN[3]

if Rotate==180 and FlipX==0 and FlipY==0:
	bmp.RotateFlip(RotateFlipType.Rotate180FlipNone)
	message = "Rotate180FlipNone"
elif Rotate==180 and FlipX==1 and FlipY==0:
	bmp.RotateFlip(RotateFlipType.Rotate180FlipX)
	message = "Rotate180FlipX"
elif Rotate==180 and FlipX==1 and FlipY==1:
	bmp.RotateFlip(RotateFlipType.Rotate180FlipXY)
	message = "Rotate180FlipXY"
elif Rotate==180 and FlipX==0 and FlipY==1:
	bmp.RotateFlip(RotateFlipType.Rotate180FlipY)
	message = "Rotate180FlipY"
elif Rotate==270 and FlipX==0 and FlipY==0:
	bmp.RotateFlip(RotateFlipType.Rotate270FlipNone)
	message = "Rotate270FlipNone"
elif Rotate==270 and FlipX==1 and FlipY==0:
	bmp.RotateFlip(RotateFlipType.Rotate270FlipX)
	message = "Rotate270FlipX"
elif Rotate==270 and FlipX==1 and FlipY==1:
	bmp.RotateFlip(RotateFlipType.Rotate270FlipXY)
	message = "Rotate270FlipXY"
elif Rotate==270 and FlipX==0 and FlipY==1:
	bmp.RotateFlip(RotateFlipType.Rotate270FlipY)
	message = "Rotate270FlipY"
elif Rotate==90 and FlipX==0 and FlipY==0:
	bmp.RotateFlip(RotateFlipType.Rotate90FlipNone)
	message = "Rotate90FlipNone"
elif Rotate==90 and FlipX==1 and FlipY==0:
	bmp.RotateFlip(RotateFlipType.Rotate90FlipX)
	message = "Rotate90FlipX"
elif Rotate==90 and FlipX==1 and FlipY==1:
	bmp.RotateFlip(RotateFlipType.Rotate90FlipXY)
	message = "Rotate90FlipXY"
elif Rotate==90 and FlipX==0 and FlipY==1:
	bmp.RotateFlip(RotateFlipType.Rotate90FlipY)
	message = "Rotate90FlipY"
elif Rotate==0 and FlipX==0 and FlipY==0:
	bmp.RotateFlip(RotateFlipType.RotateNoneFlipNone)
	message = "RotateNoneFlipNone"
elif Rotate==0 and FlipX==1 and FlipY==0:
	bmp.RotateFlip(RotateFlipType.RotateNoneFlipX)
	message = "RotateNoneFlipX"
elif Rotate==0 and FlipX==1 and FlipY==1:
	bmp.RotateFlip(RotateFlipType.RotateNoneFlipXY)
	message = "RotateNonelipXY"
elif Rotate==0 and FlipX==0 and FlipY==1:
	bmp.RotateFlip(RotateFlipType.RotateNoneFlipY)
	message = "RotateNoneFlipY"
else:
	bmp.RotateFlip(RotateFlipType.RotateNoneFlipNone)
	message = "RotateFlipType not found"

OUT = bmp, message
# ----------------------------------------
code_block = CodeBlock(out=python_script) { out[0]; out[1]; }
image_2 = Output(code_block.out0)  # "image"
Message = Output(code_block.out1)
