# Dynamo custom node GIS2BIM_KLICGetFeatures.dyf (Dynamo 2.12.1.8246)
# category: GIS2BIM.Geometry
# Get all features from KLIC files

filepaths = Input(filepaths: string[])
getfeatures_from_klic = Python(IN[0]=filepaths)  # CPython3
# ---------- getfeatures_from_klic.python (40 lines) ----------
# Load the Python Standard and DesignScript Libraries
import sys
import clr
clr.AddReference('ProtoGeometry')
from Autodesk.DesignScript.Geometry import *

# Load the Python libs
import json
from pathlib import Path
import time

# The inputs to this node will be stored as a list in the IN variables.
dataEnteringNode = IN

files = IN[0]

OUTfeature = []
OUTfeatureUnique  = []

#color output and time tests
start = time.time()
for JsonFileToOpen in files:
    f = open(JsonFileToOpen)
    data = json.load(f)
    for feature in data['features']:    
        #look for the type lines not points
        geometryType = feature['geometry']['type']
        polycurves = []
        if geometryType == "LineString":
            #get some properties
            properties = "KLIC_" + feature['properties']['featureType']
            print(properties)
            OUTfeature.append(properties)
            if properties not in OUTfeatureUnique:
                OUTfeatureUnique.append(properties)     
        
end = time.time()
print('Execution time:', end - start, 'seconds')

OUT = OUTfeature, OUTfeatureUnique
# ----------------------------------------
code_block = CodeBlock(L=getfeatures_from_klic) { L[0]; L[1]; }
n01_all_features = Output(code_block.out0)  # "01 all_features"
n02_unique_features = Output(code_block.out1)  # "02 unique_features"
