# Dynamo custom node GIS2BIM_KLICToCurves.dyf (Dynamo 2.12.1.8246)
# category: GIS2BIM.Geometry
# Reads the KLIC json files and filters the lines

filepaths = Input(filepaths: string)
RDX = Input(RDX: double)
RDY = Input(RDY: double)
python_script = Python(IN[0]=filepaths, IN[1]=RDX, IN[2]=RDY)  # CPython3
# ---------- python_script.python (61 lines) ----------
# Load the Python Standard and DesignScript Libraries
import sys
import clr
clr.AddReference('ProtoGeometry')
from Autodesk.DesignScript.Geometry import *

# Load the Python libs
import json
from pathlib import Path
import time

# The inputs to this node will be stored as a list in the IN variables.
dataEnteringNode = IN

JsonFileToOpen= IN[0]
RDX = int(IN[1])*1000
RDY = int(IN[2])*1000
z=-600

#color output and time tests
start = time.time()

f = open(JsonFileToOpen)
data = json.load(f)

OUTfeature = []
OUTfeatureUnique = []
OUTgeometry = []
OUTLineTypes = []

for feature in data['features']:    
    #look for the type lines not points
    geometryType = feature['geometry']['type']
    polycurves = []
    if geometryType == "LineString":
        #get some properties and translates the geometry
        properties = feature['properties']['featureType']
        OUTfeature.append(properties)
        OUTLineTypes.append("KLIC_" + properties)
        if properties not in OUTfeatureUnique:
            OUTfeatureUnique.append(properties)
        coordinateslist = feature['geometry']['coordinates']
        pointsperlinesegment = []
        for coordinate in coordinateslist:
            x=int(coordinate[0]*1000)
            xfrombasepoint = x-RDX
            y=int(coordinate[1]*1000)
            yfrombasepoint = y-RDY
            #print('x:' + str(x) + ' - rdx:' + str(RDX) + ' = ' + str(xfrombasepoint))
            #print('y:' + str(y) + ' - rdy:' + str(RDY) + ' = ' + str(yfrombasepoint))
            point = Point.ByCoordinates(xfrombasepoint, yfrombasepoint, z)
            pointsperlinesegment.append(point)
            #polycurves.append(PolyCurve.ByPoints(point,False))
        polycurve = PolyCurve.ByPoints(pointsperlinesegment,False)
        curves = PolyCurve.Curves(polycurve)
        OUTgeometry.append(curves)
         
end = time.time()
print('Execution time:', end - start, 'seconds')

OUT =  OUTgeometry, OUTfeature, OUTLineTypes, OUTfeatureUnique
# ----------------------------------------
code_block = CodeBlock(L=python_script) { L[0]; L[1]; L[2]; L[3]; }
n1_curves = Output(code_block.out0)  # "1 curves"
n2_features = Output(code_block.out1)  # "2 features"
n3_LineTypeNames = Output(code_block.out2)  # "3 LineTypeNames"
n4_Unique_features = Output(code_block.out3)  # "4 Unique_features"
