# Dynamo custom node GIS2BIM_KadasterPercelen.dyf (Dynamo 2.3.0.5885)
# category: GIS2BIM.DutchGEO
# Draw propertylines and place streetnames and housenumbers from the dutch kadaster

view = Input(view: var[]..[])
UrlWebrequestKadasterPerceel = Input(UrlWebrequestKadasterPerceel: var[]..[])
string = StringInput(".//{http://kadastralekaartv4.geonovum.nl}perceelnummerPlaatscoordinaatX")  # graph input
code_block = CodeBlock { 4; }
DeltaX = Input(DeltaX: var[]..[])  # X-value of transformation of points and polygons
string_2 = StringInput(".//{http://kadastralekaartv4.geonovum.nl}perceelnummerVerschuivingDeltaX")  # graph input
code_block_2 = CodeBlock { 4; }
string_3 = StringInput(".//{http://kadastralekaartv4.geonovum.nl}perceelnummerPlaatscoordinaatY")  # graph input
code_block_3 = CodeBlock { 4; }
DeltaY = Input(DeltaY: var[]..[])  # Y-value of transformation of points and polygons
string_4 = StringInput(".//{http://kadastralekaartv4.geonovum.nl}perceelnummerVerschuivingDeltaY")  # graph input
code_block_4 = CodeBlock { 4; }
string_5 = StringInput(".//{http://kadastralekaartv4.geonovum.nl}perceelnummer")  # graph input
code_block_5 = CodeBlock { 4; }
TextTypePerceel = Input(TextTypePerceel: var[]..[])

# group: PLACE TEXTNOTE FOR KADASTRAAL PERCEEL
web_request = WebRequest(url=UrlWebrequestKadasterPerceel)
string_6 = StringInput("Center")  # graph input
byName = TextNoteType.ByName(name=TextTypePerceel)

python_script = Python(IN[0]=web_request, IN[1]=string)
# ---------- python_script.python (53 lines) ----------
import clr
import sys
clr.AddReference('ProtoGeometry')
from Autodesk.DesignScript.Geometry import *
sys.path.append("C:\Program Files (x86)\IronPython 2.7\Lib")
#from xml.parsers.expat import expat -- can't find this
import xml.etree.ElementTree as ET
#The inputs to this node will be stored as a list in the IN variables.
xml = IN[0]
xpathstr = IN[1]

root = ET.fromstring(xml)

xpathfound = root.findall(xpathstr)
#xparentstr = xpathstr + "/.."
#xparentfound = root.findall(xpathstr+"/..")
xtags, xtext, xcountattrib, xattrib, xattvals, xcountiter, xitertags, xitervals, xparents = [], [], [], [], [], [], [], [], []
for x in xpathfound:
	xtags.append(x.tag)
	if x.text:
		try:
			xtext.append(x.text)
		except:
			xtext.append("_none_")
	else:
		xtext.append("_none_")
	if x.keys():
		xcountattrib.append(len(x.items()))
		for name, value in x.items():
			xattrib.append(name)
			xattvals.append(value)
#PARENT CODE BELOW IS TOO SLOW
#			try:
#				xparents.append(root.find(xpathstr + "/" + name + "/.."))
#			except:
#				xparents.append("no parent found")
	else:
		xcountattrib.append(1)
		xattrib.append("_none_")
		xattvals.append("_none_")

#THIS METHOD NOT GREAT
#	if x.iter():
#		xcountiter.append(len(x.iter()))
#		for name, value in x.iter():
#			xitertags.append(name)
#			xitervals.append(value)
#for y in xparentfound:
#	xparents.append(y.tag)

OUT = root, str(root), xpathfound, xtags, xtext, xcountattrib, xattrib, xattvals
#, xparents 
#, xparentfound#, xparents#, xcountiter, xitertags, xitervals
# ----------------------------------------
getItemAtIndex = List.GetItemAtIndex(list=python_script, index=code_block)

# group (continued): PLACE TEXTNOTE FOR KADASTRAAL PERCEEL
flatten = List.Flatten(list=getItemAtIndex)
toNumber = String.ToNumber(str=flatten)

python_script_2 = Python(IN[0]=web_request, IN[1]=string_2)  # same code as python_script
getItemAtIndex_2 = List.GetItemAtIndex(list=python_script_2, index=code_block_2)
flatten_2 = List.Flatten(list=getItemAtIndex_2)
toNumber_2 = String.ToNumber(str=flatten_2)
python_script_3 = Python(IN[0]=web_request, IN[1]=string_3)  # same code as python_script
getItemAtIndex_3 = List.GetItemAtIndex(list=python_script_3, index=code_block_3)

# group (continued): PLACE TEXTNOTE FOR KADASTRAAL PERCEEL
flatten_3 = List.Flatten(list=getItemAtIndex_3)
toNumber_3 = String.ToNumber(str=flatten_3)

python_script_4 = Python(IN[0]=web_request, IN[1]=string_4)  # same code as python_script
getItemAtIndex_4 = List.GetItemAtIndex(list=python_script_4, index=code_block_4)
flatten_4 = List.Flatten(list=getItemAtIndex_4)
toNumber_4 = String.ToNumber(str=flatten_4)
code_block_6 = CodeBlock(x=toNumber, dx=DeltaX, ddx=toNumber_2, y=toNumber_3, dy=DeltaY, ddy=toNumber_4) { (x-dx+ddx)*1000; (y-dy+ddy)*1000; }
byCoordinates = Point.ByCoordinates(x=code_block_6.out0, y=code_block_6.out1)
python_script_5 = Python(IN[0]=web_request, IN[1]=string_5)  # same code as python_script
getItemAtIndex_5 = List.GetItemAtIndex(list=python_script_5, index=code_block_5)

# group (continued): PLACE TEXTNOTE FOR KADASTRAAL PERCEEL
flatten_5 = List.Flatten(list=getItemAtIndex_5)

string_7 = StringInput(".//{http://kadastralekaartv4.geonovum.nl}perceelnummerRotatie")  # graph input
python_script_6 = Python(IN[0]=web_request, IN[1]=string_7)  # same code as python_script
code_block_7 = CodeBlock { 4; }
getItemAtIndex_6 = List.GetItemAtIndex(list=python_script_6, index=code_block_7)

# group (continued): PLACE TEXTNOTE FOR KADASTRAAL PERCEEL
flatten_6 = List.Flatten(list=getItemAtIndex_6)
flatten_7 = List.Flatten(list=flatten_6)
toNumber_5 = String.ToNumber(str=flatten_7)
byLocation = TextNote.ByLocation(view=view, location=byCoordinates, text=flatten_5, alignment=string_6, type=byName, rotation=toNumber_5)
