# Dynamo custom node GIS2BIM_LocationAnalysisNetherlands.dyf (Dynamo 1.3.4.6666)
# category: GIS2BIM.DutchGEO
# Location Analysis of a location in The Netherlands

Rdx = Input()
Rdy = Input()
WidthSmallBoundingbox = Input(WidthSmallBoundingbox: double=150)
WidthMediumBoundingbox = Input(WidthMediumBoundingbox: double=10000)
WidthMediumBoundingbox_2 = Input(WidthMediumBoundingbox: double=75000)

# group: 5 WEB MAP TILE SERVICES
code_block = CodeBlock { 14; 8; 4; }
code_block_2 = CodeBlock(s=code_block.out0, m=code_block.out1, l=code_block.out2) { s; m; l; s; s; s; m; m; m; }
create = List.Create(code_block_2.out0, code_block_2.out1, code_block_2.out2, code_block_2.out3, code_block_2.out4, code_block_2.out5, code_block_2.out6, code_block_2.out7, code_block_2.out8)
code_block_3 = CodeBlock(s=WidthSmallBoundingbox, m=WidthMediumBoundingbox, l=WidthMediumBoundingbox_2) { s; m; l; s; s; s; m; m; m; s; }
create_2 = List.Create(code_block_3.out0, code_block_3.out1, code_block_3.out2, code_block_3.out3, code_block_3.out4, code_block_3.out5, code_block_3.out6, code_block_3.out7, code_block_3.out8)
code_block_4 = CodeBlock()
# ---------- code_block_4.designscript (9 lines) ----------
"opentopo";
"opentopo";
"opentopo";
"bgtstandaard";
"kadastralekaartv3";
"ahn3_05m_dsm";
"geomorfologischekaart50000";
"bodemkaart50000";
"natura2000";
# ----------------------------------------
create_3 = List.Create(code_block_4.out0, code_block_4.out1, code_block_4.out2, code_block_4.out3, code_block_4.out4, code_block_4.out5, code_block_4.out6, code_block_4.out7, code_block_4.out8)

python_script = Python(IN[0]=create, IN[1]=Rdx, IN[2]=Rdy, IN[3]=create_2, IN[4]=create_3)
# ---------- python_script.python (210 lines) ----------
import clr
clr.AddReference('ProtoGeometry')
clr.AddReference("System.Drawing")
clr.AddReference("System")
from System import Drawing
from System.Drawing import Image
from System.Drawing import Bitmap
from System.Drawing import Graphics
from System.Drawing.Imaging import ImageFormat
from System.Net import WebRequest
from System.IO import Path
#from os import listdir
import sys
sys.path.append("C:\Program Files (x86)\IronPython 2.7\Lib")

from Autodesk.DesignScript.Geometry import *
#The inputs to this node will be stored as a list in the IN variables.

import math
from math import *
import itertools
from itertools import islice

dataEnteringNode = IN

Zoomlevels = IN[0]
Rdx = IN[1]
Rdy = IN[2]
BoundingboxWidths = IN[3]
Layers = IN[4]

Zoomleveldata = {0:3440.640,
1:1720.320,
2:860.160,
3:430.080,
4:215.040,
5:107.520,
6:53.720,
7:26.880,
8:13.440,
9:6.720,
10:3.360,
11:1.680,
12:0.840,
13:0.420,
14:0.210,
15:0.105,
16:0.0575}

PixelWidth =256
Xcorner=-285401.92
Ycorner=903402.0

Resolutions = []
for i in Zoomlevels:
	Resolutions.append(Zoomleveldata[i])

TileColumns = []
TileRows = []
DeltaX = []
DeltaY= []

for i in Resolutions:
	a = PixelWidth*i
	#TileColumns.append(Rdx-Xcorner)
	#TileRows.append(a)
	TileY = (Ycorner-Rdy)/a
	TileX = (Rdx-Xcorner)/a
	TileYRound = int(TileY)
	TileXRound = int(TileX)
	TilePercentageY = TileX-TileXRound
	TilePercentageX = TileY-TileYRound
	DeltaYM = TilePercentageY*PixelWidth*i
	DeltaXM = TilePercentageX*PixelWidth*i
	
	TileRows.append(TileYRound)
	TileColumns.append(TileXRound)
	DeltaY.append(DeltaYM)
	DeltaX.append(DeltaXM)

UniqueTileColumns = []
UniqueTileRows = []
TileColumns2 = []
TileRows2 = []

for i,j,k,l in zip(TileColumns, TileRows, BoundingboxWidths, Resolutions):
	TileWidth=PixelWidth*l
	c = math.ceil(k/TileWidth)
	b = math.ceil(c/2)*2
	UniqueTileColumns.append(range(int((i-b/2)), 1+int(i+b/2)))
	UniqueTileRows.append(range((int(j-b/2)), 1+int(j+b/2)))


for i in UniqueTileColumns:
	#de list:
	a = []
	
	counter = len(i)
	
	for j in i: #elke unieke tile
		a.append(i)
	flatA= []
	
	for sublist in a:
		for item in sublist:
			flatA.append(item)
	TileColumns2.append(flatA)
	
	counter=0

for i in UniqueTileRows:
	#de list:
	a = []
	
	counter = len(i)
	for j in i: #elke unieke tile
		a.append([int(j)]*counter)
	flatA= []
	
	for sublist in a:
		for item in sublist:
			flatA.append(item)
	TileRows2.append(flatA)
	
	counter=0

TotalTileWidth = []

for i, j in zip(Resolutions,UniqueTileColumns):
	a = len(j)*PixelWidth*i
	TotalTileWidth.append(a)

string1 = "http://geodata.nationaalgeoregister.nl/tiles/service/wmts?&request=GetTile&VERSION=1.0.0&LAYER="
string3 = "&STYLE=default&TILEMATRIXSET=EPSG:28992&TILEMATRIX=EPSG:28992:"
string34 = "&TILEROW="
string5 = "&TILECOL="
string7 = "&FORMAT=image/png8";

urlList = []

for i,j,k,z in zip(TileColumns2,TileRows2,Layers,Zoomlevels):
	a = []
	for l,m in zip(i,j):
		b = string1 + str(k) + string3 + str(z) + string34 + str(m) + string5 + str(l) + string7
		a.append(b)
	urlList.append(a)

bitmaps2 = []


for i in urlList:
	bitmaps = []
	for j in i:
		request = WebRequest.Create(j)
		request.Accept = "text/html"
		request.UserAgent = "Mozilla/5.0"
		response = request.GetResponse()
		bitmaps.append(Image.FromStream(response.GetResponseStream()))
	bitmaps2.append(bitmaps)

combinedBitmaps = []
for a,b,c in zip(bitmaps2,UniqueTileColumns,UniqueTileRows):
	TotalWidth = len(b)*PixelWidth
	TotalHeight = len(c)*PixelWidth
	img = Bitmap(TotalWidth,TotalHeight)
	g = Graphics.FromImage(img)
	LPx = []
	n = 0
	for l in j:
		LPx.append(n*PixelWidth)
		n=n+1
	
	LPy = []
	n = 0
	for i in c:
		LPy.append(n*PixelWidth)
		n=n+1

	LPx2=[]
	n=len(LPy)
	for i in LPx:
		LPx2.append([i]*n)

	LPx3=[]
	for sublist in LPx2:
		for item in sublist:
			LPx3.append(item)

	LPy2=[]
	for i in LPx:
		LPy2.append(LPy)

	LPy3=[]
	for sublist in LPy2:
		for item in sublist:
			LPy3.append(item)
        
	LPy4=reversed(LPy3)

	for m,n,o in zip(a,LPy3,LPx3):
		g.DrawImage(m,n,o)
	combinedBitmaps.append(img)

	#else:
	#	for i,j,k in zip(bitmaps,LPx3,LPy4):
	#		g.DrawImage(i,j,k)
	
combinedBitmaps
#Assign your output to the OUT variable.
OUT = combinedBitmaps
# ----------------------------------------

# group (continued): 5 WEB MAP TILE SERVICES
code_block_5 = CodeBlock(a=python_script) { a[0]; a[1]; a[2]; a[3]; a[4]; a[5]; a[6]; a[7]; a[8]; }

WMTS_Opentopo_Small = Output(code_block_5.out0)
WMTS_Opentopo_Medium = Output(code_block_5.out1)
WMTS_Opentopo_Large = Output(code_block_5.out2)
WMTS_BGT_Small = Output(code_block_5.out3)
WMTS_Kadaster_Small = Output(code_block_5.out4)
WMTS_AHN3_Small = Output(code_block_5.out5)
WMTS_geomorfologischekaart50000 = Output(code_block_5.out6)
WMTS_bodemkaart50000 = Output(code_block_5.out7)
WMTS_natura2000 = Output(code_block_5.out8)

# group: 4 Web Map Service
code_block_6 = CodeBlock { bs=150; bm=10000; bl=75000; ratio=1; hs=bs*ratio; hm=bm*ratio; hl=bl*ratio; }
createBoundingBox = Custom[GIS2BIM.CreateBoundingBox](CoordinateX=Rdx, CoordinateY=Rdy, BoxWidth=WidthMediumBoundingbox, BoxHeight=code_block_6.hm)  # create boundingboxstring for webrequests based on coördinates and dimensions
geoservicesLibraryNetherlands = Custom[GIS2BIM.GeoservicesLibraryNetherlands](BoundingBox=createBoundingBox.Boxstring)  # Library with multiple webadresses which can be used for WFS and WMS webrequests
createBoundingBox_2 = Custom[GIS2BIM.CreateBoundingBox](CoordinateX=Rdx, CoordinateY=Rdy, BoxWidth=WidthMediumBoundingbox_2, BoxHeight=code_block_6.hl)
geoservicesLibraryNetherlands_2 = Custom[GIS2BIM.GeoservicesLibraryNetherlands](BoundingBox=createBoundingBox_2.Boxstring)
createBoundingBox_3 = Custom[GIS2BIM.CreateBoundingBox](CoordinateX=Rdx, CoordinateY=Rdy, BoxWidth=WidthSmallBoundingbox, BoxHeight=code_block_6.hs)
geoservicesLibraryNetherlands_3 = Custom[GIS2BIM.GeoservicesLibraryNetherlands](BoundingBox=createBoundingBox_3.Boxstring)
create_4 = List.Create(geoservicesLibraryNetherlands.luchtfoto_2018_OGC_WMS, geoservicesLibraryNetherlands_2.luchtfoto_2018_OGC_WMS, geoservicesLibraryNetherlands_3.5_luchtfoto_2016_OGC_WMS, geoservicesLibraryNetherlands_3.Luchtfoto_2017_OGC_WMS, geoservicesLibraryNetherlands_3.luchtfoto_2018_OGC_WMS, geoservicesLibraryNetherlands.Geluidscontouren_alle_bronnen_OGC_WMS, geoservicesLibraryNetherlands_3.10_bestemmingsplan_bouwvlak_OGC_WMS, geoservicesLibraryNetherlands_3.12_ruimtelijkeplannen_OGC_WMS, geoservicesLibraryNetherlands_3.6_CBS_WOZ_2011_100m_OGC_WMS, geoservicesLibraryNetherlands_3.6_legenda)
python_script_2 = Python(IN[0]=create_4)
# ---------- python_script_2.python (20 lines) ----------
import sys
sys.path.append("C:\Program Files (x86)\IronPython 2.7\Lib")

import clr

clr.AddReference("System.Drawing")
clr.AddReference("System")
from System.Drawing import Image
from System.Net import WebRequest

urls= IN[0]

bitmaps = []

for i in urls:
	request = WebRequest.Create(i)
	response = request.GetResponse()
	bitmaps.append(Image.FromStream(response.GetResponseStream()))

OUT = bitmaps
# ----------------------------------------

# group: 4 Web Map Service(WMS)
code_block_7 = CodeBlock(a=python_script_2) { a[0]; a[1]; a[2]; a[3]; a[4]; a[5]; a[6]; a[7]; a[8]; a[9]; }

WMS_Medium_Luchtfoto_2018 = Output(code_block_7.out0)
WMS_Large_Luchtfoto_2018 = Output(code_block_7.out1)
WMS_Small_Luchtfoto_2016 = Output(code_block_7.out2)
WMS_Small_Luchtfoto_2017 = Output(code_block_7.out3)
WMS_Small_Luchtfoto_2018 = Output(code_block_7.out4)
WMS_Geluidskaart_alle_bronnen = Output(code_block_7.out5)
WMS_Bestemmingsplan_bouwvlak = Output(code_block_7.out6)
WMS_Bestemmingsplankaart = Output(code_block_7.out7)
WMS_CBS_WOZ_waarde_2011 = Output(code_block_7.out8)  # "WMS CBS WOZ-waarde 2011"
WMS_CBS_WOZ_waarde_2011_Legenda = Output(code_block_7.out9)  # "WMS CBS WOZ-waarde 2011 Legenda"
