# Dynamo custom node GIS2BIM_NetherlandsGeoservicesLibrary.dyf (Dynamo 2.12.1.8246)
# category: GIS2BIM.Geoservices.Europe
# Library with multiple webadresses which can be used for WFS and WMS webrequests
# packages: GIS2BIM for Dynamo 2.x 0.11.25

link_kadaster = CodeBlock()
# ---------- link_kadaster.designscript (5 lines) ----------
"http://geodata.nationaalgeoregister.nl/";
"kadastralekaart/wfs/v4_0?service=WFS&version=2.0.0";
"&request=GetFeature";
"&typeName=kadastralegrens";
"&bbox=";
# ----------------------------------------
BoundingBoxEPSG28992 = Input(BoundingBoxEPSG28992: var[]..[])
concat = String.Concat(string0=link_kadaster.out0, string1=link_kadaster.out1, string2=link_kadaster.out2, string3=link_kadaster.out3, string4=link_kadaster.out4, string5=BoundingBoxEPSG28992)
n1_kadastrale_grenzen_OGC_WFS = Output(concat)  # "1 kadastrale grenzen(OGC WFS)"
code_block = CodeBlock()
# ---------- code_block.designscript (6 lines) ----------
"http://afnemers.ruimtelijkeplannen.nl/afnemers/services?";
"&service=WFS";
"&version=1.1.0";
"&request=GetFeature";
"&typeName=app:Bouwvlak";
"&bbox=";
# ----------------------------------------
concat_2 = String.Concat(string0=code_block.out0, string1=code_block.out1, string2=code_block.out2, string3=code_block.out3, string4=code_block.out4, string5=code_block.out5, string6=BoundingBoxEPSG28992)
n2_ruimtelijke_plannen_OGC_WFS = Output(concat_2)  # "2 ruimtelijke plannen(OGC WFS)"
code_block_2 = CodeBlock()
# ---------- code_block_2.designscript (5 lines) ----------
"https://service.pdok.nl/lv/bag/wfs/v2_0?";
"service=wfs&version=2.0.0&";
"request=GetFeature&typeName=";
"bag:verblijfsobject&";
"bbox=";
# ----------------------------------------
concat_3 = String.Concat(string0=code_block_2.out0, string1=code_block_2.out1, string2=code_block_2.out2, string3=code_block_2.out3, string4=code_block_2.out4, string5=BoundingBoxEPSG28992)
n3_bag_verblijfsobject_OGC_WFS = Output(concat_3)  # "3 bag verblijfsobject(OGC WFS)"
code_block_3 = CodeBlock()
# ---------- code_block_3.designscript (5 lines) ----------
"https://service.pdok.nl/lv/bag/wfs/v2_0?";
"service=wfs&version=2.0.0";
"&request=GetFeature&typeName=";
"bag:pand";
"&bbox=";
# ----------------------------------------
concat_4 = String.Concat(string0=code_block_3.out0, string1=code_block_3.out1, string2=code_block_3.out2, string3=code_block_3.out3, string4=code_block_3.out4, string5=BoundingBoxEPSG28992)
n4_bag_pand_OGC_WFS = Output(concat_4)  # "4 bag pand(OGC WFS)"
link_kadaster_2 = CodeBlock()
# ---------- link_kadaster_2.designscript (11 lines) ----------
"https://service.pdok.nl/";
"hwh/luchtfotorgb/wms/v1_0?";
"&request=GetMap";
"&VERSION=1.3.0";
"&STYLES=";
"&layers=2016_ortho25";
"&bbox=";
"&width=3000";
"&height=3000";
"&format=image/png";
"&crs=EPSG:28992";
# ----------------------------------------
code_block_4 = CodeBlock(t3=BoundingBoxEPSG28992)
# ---------- code_block_4.designscript (7 lines) ----------
t2 = DSCore.String.Split(t3, [","]);
t4 = DSCore.String.ToNumber(t2);
a = t4;
b = a[2] - a[0];
h = a[3] - a[1];
bpix = 3000;
hpix = (bpix * h) / b;
# ----------------------------------------
string_from_object = FromObject(obj=code_block_4.hpix)
code_block_5 = CodeBlock(t5=string_from_object) { a = DSCore.String.Split(t5, [".",","]); t6 = DSCore.String.Concat(["&height=", a[0]]); }
concat_5 = String.Concat(string0=link_kadaster_2.out0, string1=link_kadaster_2.out1, string2=link_kadaster_2.out2, string3=link_kadaster_2.out3, string4=link_kadaster_2.out4, string5=link_kadaster_2.out5, string6=link_kadaster_2.out6, string7=BoundingBoxEPSG28992, string8=link_kadaster_2.out7, string9=code_block_5.t6, string10=link_kadaster_2.out9, string11=link_kadaster_2.out10)
n5_luchtfoto_2016_OGC_WMS = Output(concat_5)  # "5 luchtfoto 2016(OGC WMS)"
link_kadaster_3 = CodeBlock()
# ---------- link_kadaster_3.designscript (11 lines) ----------
"http://geodata.nationaalgeoregister.nl/";
"cbsvierkanten100mv2/wms?";
"&request=GetMap";
"&VERSION=1.3.0";
"&STYLES=cbsvierkanten100mv2:cbsvierkanten100m_woz_waarde_woning";
"&layers=vierkant100m2011";
"&bbox=";
"&width=3000";
"&height=2000";
"&format=image/png";
"&crs=EPSG:28992";
# ----------------------------------------
concat_6 = String.Concat(string0=link_kadaster_3.out0, string1=link_kadaster_3.out1, string2=link_kadaster_3.out2, string3=link_kadaster_3.out3, string4=link_kadaster_3.out4, string5=link_kadaster_3.out5, string6=link_kadaster_3.out6, string7=BoundingBoxEPSG28992, string8=link_kadaster_3.out7, string9=code_block_5.t6, string10=link_kadaster_3.out9, string11=link_kadaster_3.out10)
n6_CBS_WOZ_2011_100m_OGC_WMS = Output(concat_6)  # "6 CBS-WOZ 2011 100m(OGC WMS)"
code_block_6 = CodeBlock { "http://geodata.nationaalgeoregister.nl/cbsvierkanten100mv2/ows?service=WMS&request=GetLegendGraphic&format=image%2Fpng&width=20&height=20&layer=vierkant100m2011&style=cbsvierkanten100m_woz_waarde_woning"; }
n6_legenda = Output(code_block_6)  # "6 legenda"
link_kadaster_4 = CodeBlock()
# ---------- link_kadaster_4.designscript (5 lines) ----------
"http://geodata.nationaalgeoregister.nl/";
"kadastralekaart/wfs/v4_0?service=WFS&version=2.0.0";
"&request=GetFeature";
"&typeName=kadastralekaartv4:nummeraanduidingreeks";
"&bbox=";
# ----------------------------------------
concat_7 = String.Concat(string0=link_kadaster_4.out0, string1=link_kadaster_4.out1, string2=link_kadaster_4.out2, string3=link_kadaster_4.out3, string4=link_kadaster_4.out4, string5=BoundingBoxEPSG28992)
link_kadaster_5 = CodeBlock()
# ---------- link_kadaster_5.designscript (5 lines) ----------
"http://geodata.nationaalgeoregister.nl/";
"kadastralekaart/wfs/v4_0?service=WFS&version=2.0.0";
"&request=GetFeature";
"&typeName=kadastralekaartv4:openbareruimtenaam";
"&bbox=";
# ----------------------------------------
concat_8 = String.Concat(string0=link_kadaster_5.out0, string1=link_kadaster_5.out1, string2=link_kadaster_5.out2, string3=link_kadaster_5.out3, string4=link_kadaster_5.out4, string5=BoundingBoxEPSG28992)
list_create = List.Create(item0=concat_7, item1=concat_8)
n7_kadastrale_annotatie_OGC_WFS = Output(list_create)  # "7 kadastrale annotatie(OGC WFS)"
link_kadaster_6 = CodeBlock()
# ---------- link_kadaster_6.designscript (5 lines) ----------
"http://geodata.nationaalgeoregister.nl/";
"kadastralekaart/wfs/v4_0?service=WFS&version=2.0.0";
"&request=GetFeature";
"&typeName=perceel";
"&bbox=";
# ----------------------------------------
concat_9 = String.Concat(string0=link_kadaster_6.out0, string1=link_kadaster_6.out1, string2=link_kadaster_6.out2, string3=link_kadaster_6.out3, string4=link_kadaster_6.out4, string5=BoundingBoxEPSG28992)
n8_kadastrale_perceel_OGC_WFS = Output(concat_9)  # "8 kadastrale perceel(OGC WFS)"
link_kadaster_7 = CodeBlock()
# ---------- link_kadaster_7.designscript (6 lines) ----------
"http://services.rce.geovoorziening.nl/rce/wfs?";
"SERVICE=wfs";
"&VERSION=2.0.0";
"&request=GetFeature";
"&typeName=rce:NationalListedMonuments";
"&bbox=";
# ----------------------------------------
concat_10 = String.Concat(string0=link_kadaster_7.out0, string1=link_kadaster_7.out1, string2=link_kadaster_7.out2, string3=link_kadaster_7.out3, string4=link_kadaster_7.out4, string5=link_kadaster_7.out5, string6=BoundingBoxEPSG28992)
n9_rijksmonumenten_OGC_WFS = Output(concat_10)  # "9 rijksmonumenten(OGC WFS)"
link_kadaster_8 = CodeBlock()
# ---------- link_kadaster_8.designscript (11 lines) ----------
"http://geodata.nationaalgeoregister.nl/";
"plu/wms?";
"&request=GetMap";
"&VERSION=1.3.0";
"&STYLES=Bouwvlak";
"&layers=Bouwvlak";
"&bbox=";
"&width=3000";
"&height=3000";
"&format=image/png";
"&crs=EPSG:28992";
# ----------------------------------------
concat_11 = String.Concat(string0=link_kadaster_8.out0, string1=link_kadaster_8.out1, string2=link_kadaster_8.out2, string3=link_kadaster_8.out3, string4=link_kadaster_8.out4, string5=link_kadaster_8.out5, string6=link_kadaster_8.out6, string7=BoundingBoxEPSG28992, string8=link_kadaster_8.out7, string9=code_block_5.t6, string10=link_kadaster_8.out9, string11=link_kadaster_8.out10)
n10_bestemmingsplan_bouwvlak_OGC_WMS = Output(concat_11)  # "10 bestemmingsplan bouwvlak(OGC WMS)"
code_block_7 = CodeBlock { "http://geodata.nationaalgeoregister.nl/ahn2/wfs?"; "&request=GetFeature&typeName="; "ahn2_bladindex&"; "bbox="; }
concat_12 = String.Concat(string0=code_block_7.out0, string1=code_block_7.out1, string2=code_block_7.out2, string3=code_block_7.out3, string4=BoundingBoxEPSG28992)
n11_AHN2_webrequest_bladindex_OGC_WFS = Output(concat_12)  # "11 AHN2 webrequest bladindex(OGC WFS)"
code_block_8 = CodeBlock()
# ---------- code_block_8.designscript (11 lines) ----------
"http://afnemers.ruimtelijkeplannen.nl/afnemers2012/services?";
"REQUEST=GetMap&SERVICE=WMS";
"&VERSION=1.3.0";
"&WIDTH=3000";
"&HEIGHT=3000";
"&LAYERS=BP:Bestemmingsplangebied,BP:Enkelbestemming,BP:Dubbelbestemming,BP:Functieaanduiding,BP:Figuur,BP:Gebiedsaanduiding,BP:Wijzigingsplangebied,BP:Bouwaanduiding,BP:Bouwvlak,BP:Inpassingsplangebied,BP:Lettertekenaanduiding,BP:Maatvoering,BP:Rijksbestemmingsplangebied,BP:Uitwerkingsplangebied";
"&STYLES=default,default,default,default,default,default,default,default,default,default,default,default,default,default";
"&TRANSPARENT=TRUE";
"&FORMAT=image/png";
"&BBOX=";
"&CRS=urn:ogc:def:crs:EPSG::28992";
# ----------------------------------------
concat_13 = String.Concat(string0=code_block_8.out0, string1=code_block_8.out1, string2=code_block_8.out2, string3=code_block_8.out3, string4=code_block_5.t6, string5=code_block_8.out5, string6=code_block_8.out6, string7=code_block_8.out7, string8=code_block_8.out8, string9=code_block_8.out9, string10=BoundingBoxEPSG28992, string11=code_block_8.out10)
n12_ruimtelijkeplannen_OGC_WMS = Output(concat_13)  # "12 ruimtelijkeplannen(OGC WMS)"
link_kadaster_9 = CodeBlock()
# ---------- link_kadaster_9.designscript (10 lines) ----------
"https://opengeodata.zeeland.nl/geoserver/";
"zeeland/wms?";
"&request=GetMap";
"&VERSION=1.3.0";
"&layers=georok_dkkprc1850sdvvlk";
"&bbox=";
"&width=3000";
"&height=3000";
"&format=image/png";
"&crs=EPSG:28992";
# ----------------------------------------
concat_14 = String.Concat(string0=link_kadaster_9.out0, string1=link_kadaster_9.out1, string2=link_kadaster_9.out2, string3=link_kadaster_9.out3, string4=link_kadaster_9.out4, string5=link_kadaster_9.out5, string6=BoundingBoxEPSG28992, string7=link_kadaster_9.out6, string8=code_block_5.t6, string9=link_kadaster_9.out8, string10=link_kadaster_9.out9)
Zeeland_Schouwen_Duiveland_Kadastrale_Pe = Output(concat_14)  # "Zeeland Schouwen Duiveland Kadastrale Percelen 1832(OGC:WMS)"
code_block_9 = CodeBlock { "&layers=georok_dkkgbw1850vlk"; }
concat_15 = String.Concat(string0=link_kadaster_9.out0, string1=link_kadaster_9.out1, string2=link_kadaster_9.out2, string3=link_kadaster_9.out3, string4=code_block_9, string5=link_kadaster_9.out5, string6=BoundingBoxEPSG28992, string7=link_kadaster_9.out6, string8=code_block_5.t6, string9=link_kadaster_9.out8, string10=link_kadaster_9.out9)
Zeeland_Bebouwing_Kadaster_1832_OGC = Output(concat_15)  # "Zeeland Bebouwing Kadaster 1832(OGC:WMS)"
link_kadaster_10 = CodeBlock()
# ---------- link_kadaster_10.designscript (11 lines) ----------
"https://service.pdok.nl/";
"hwh/luchtfotorgb/wms/v1_0?";
"&request=GetMap";
"&VERSION=1.3.0";
"&STYLES=";
"&layers=2017_ortho25";
"&bbox=";
"&width=3000";
"&height=3000";
"&format=image/png";
"&crs=EPSG:28992";
# ----------------------------------------
concat_16 = String.Concat(string0=link_kadaster_10.out0, string1=link_kadaster_10.out1, string2=link_kadaster_10.out2, string3=link_kadaster_10.out3, string4=link_kadaster_10.out4, string5=link_kadaster_10.out5, string6=link_kadaster_10.out6, string7=BoundingBoxEPSG28992, string8=link_kadaster_10.out7, string9=code_block_5.t6, string10=link_kadaster_10.out9, string11=link_kadaster_10.out10)
Luchtfoto_2017_OGC_WMS = Output(concat_16)  # "Luchtfoto 2017(OGC WMS)"
code_block_10 = CodeBlock { "http://geodata.nationaalgeoregister.nl/ahn3/wfs?"; "&request=GetFeature&typeName="; "ahn3_bladindex&"; "bbox="; }
concat_17 = String.Concat(string0=code_block_10.out0, string1=code_block_10.out1, string2=code_block_10.out2, string3=code_block_10.out3, string4=BoundingBoxEPSG28992)
AHN3_webrequest_bladindex_OGC_WFS = Output(concat_17)  # "AHN3 webrequest bladindex(OGC WFS)"
link_kadaster_11 = CodeBlock()
# ---------- link_kadaster_11.designscript (6 lines) ----------
"http://3dbag.bk.tudelft.nl/";
"data/wfs?";
"&request=GetFeature";
"&typeName=BAG3D:pand3d";
"&outputFormat=GML3";
"&bbox=";
# ----------------------------------------
concat_18 = String.Concat(string0=link_kadaster_11.out0, string1=link_kadaster_11.out1, string2=link_kadaster_11.out2, string3=link_kadaster_11.out3, string4=link_kadaster_11.out4, string5=link_kadaster_11.out5, string6=BoundingBoxEPSG28992)
n3D_BAG_TU_Delft_OGC = Output(concat_18)  # "3D BAG TU Delft(OGC:WFS)"
link_kadaster_12 = CodeBlock()
# ---------- link_kadaster_12.designscript (11 lines) ----------
"https://service.pdok.nl/";
"hwh/luchtfotorgb/wms/v1_0?";
"&request=GetMap";
"&VERSION=1.3.0";
"&STYLES=";
"&layers=2018_ortho25";
"&bbox=";
"&width=3000";
"&height=3000";
"&format=image/png";
"&crs=EPSG:28992";
# ----------------------------------------
concat_19 = String.Concat(string0=link_kadaster_12.out0, string1=link_kadaster_12.out1, string2=link_kadaster_12.out2, string3=link_kadaster_12.out3, string4=link_kadaster_12.out4, string5=link_kadaster_12.out5, string6=link_kadaster_12.out6, string7=BoundingBoxEPSG28992, string8=link_kadaster_12.out7, string9=code_block_5.t6, string10=link_kadaster_12.out9, string11=link_kadaster_12.out10)
luchtfoto_2018_OGC_WMS = Output(concat_19)  # "luchtfoto 2018(OGC WMS)"
link_kadaster_13 = CodeBlock()
# ---------- link_kadaster_13.designscript (11 lines) ----------
"http://geodata.rivm.nl/";
"geoserver/alo/wms??";
"&request=GetMap";
"&VERSION=1.3.0";
"&STYLES=rivm_20180205_g_geluidkaart_lden_alle_bronnen";
"&layers=rivm_20180205_g_geluidkaart_lden_wegverkeer";
"&bbox=";
"&width=3000";
"&height=3000";
"&format=image/png";
"&crs=EPSG:28992";
# ----------------------------------------
concat_20 = String.Concat(string0=link_kadaster_13.out0, string1=link_kadaster_13.out1, string2=link_kadaster_13.out2, string3=link_kadaster_13.out3, string4=link_kadaster_13.out4, string5=link_kadaster_13.out5, string6=link_kadaster_13.out6, string7=BoundingBoxEPSG28992, string8=link_kadaster_13.out7, string9=code_block_5.t6, string10=link_kadaster_13.out9, string11=link_kadaster_13.out10)
Geluidscontouren_alle_bronnen_OGC_WMS = Output(concat_20)  # "Geluidscontouren alle bronnen(OGC WMS)"
code_block_11 = CodeBlock()
# ---------- code_block_11.designscript (11 lines) ----------
"https://geodata.nationaalgeoregister.nl/top10nlv2/wms?";
"&REQUEST=GetMap";
"&VERSION=1.3.0";
"&WIDTH=3000";
"&HEIGHT=3000";
"&LAYERS=top10nlv2";
"&STYLES=";
"&TRANSPARENT=TRUE";
"&FORMAT=image/png";
"&BBOX=";
"&CRS=urn:ogc:def:crs:EPSG::28992";
# ----------------------------------------
concat_21 = String.Concat(string0=code_block_11.out0, string1=code_block_11.out1, string2=code_block_11.out2, string3=code_block_11.out3, string4=code_block_11.out4, string5=code_block_11.out5, string6=code_block_11.out6, string7=code_block_11.out7, string8=code_block_11.out8, string9=code_block_11.out9, string10=BoundingBoxEPSG28992, string11=code_block_11.out10)
TOP10NL_OGC_WMS = Output(concat_21)  # "TOP10NL(OGC WMS)"
code_block_12 = CodeBlock()
# ---------- code_block_12.designscript (11 lines) ----------
"https://geodata.nationaalgeoregister.nl/top10nlv2/wms?";
"&REQUEST=GetMap";
"&VERSION=1.3.0";
"&WIDTH=3000";
"&HEIGHT=3000";
"&LAYERS=waterdeelvlak";
"&STYLES=";
"&TRANSPARENT=TRUE";
"&FORMAT=image/svg";
"&BBOX=";
"&CRS=urn:ogc:def:crs:EPSG::28992";
# ----------------------------------------
code_block_13 = CodeBlock { "&LAYERS=wegdeelvlak"; }
concat_22 = String.Concat(string0=code_block_12.out0, string1=code_block_12.out1, string2=code_block_12.out2, string3=code_block_12.out3, string4=code_block_12.out4, string5=code_block_13, string6=code_block_12.out6, string7=code_block_12.out7, string8=code_block_12.out8, string9=code_block_12.out9, string10=BoundingBoxEPSG28992, string11=code_block_12.out10)
TOP10NL_wegdeelvlak_OGC_WMS_SVG = Output(concat_22)  # "TOP10NL_wegdeelvlak(OGC WMS SVG)"
concat_23 = String.Concat(string0=code_block_12.out0, string1=code_block_12.out1, string2=code_block_12.out2, string3=code_block_12.out3, string4=code_block_12.out4, string5=code_block_12.out5, string6=code_block_12.out6, string7=code_block_12.out7, string8=code_block_12.out8, string9=code_block_12.out9, string10=BoundingBoxEPSG28992, string11=code_block_12.out10)
TOP10NL_waterdeelvlak_OGC_WMS_SVG = Output(concat_23)  # "TOP10NL_waterdeelvlak(OGC WMS SVG)"
code_block_14 = CodeBlock()
# ---------- code_block_14.designscript (11 lines) ----------
"https://geodata.nationaalgeoregister.nl/ahn3/wms?";
"wmtver=WMS&VERSION=1.0.0";
"&REQUEST=GetMap";
"&FORMAT=image/png";
"&LAYERS=";
"&BBOX=";
"99198.4917734710033983,485588.33618855383247137,106915.96004800940863788,494366.81641667388612404";
"&SRS=EPSG:28992";
"&WIDTH=3000";
"&HEIGHT=3000";
"&STYLES=ahn3:ahn3_05m_detail";
# ----------------------------------------
code_block_15 = CodeBlock { "ahn3_05m_dsm"; }
concat_24 = String.Concat(string0=code_block_14.out0, string1=code_block_14.out1, string2=code_block_14.out2, string3=code_block_14.out3, string4=code_block_14.out4, string5=code_block_15, string6=code_block_14.out5, string7=BoundingBoxEPSG28992, string8=code_block_14.out7, string9=code_block_14.out8, string10=code_block_14.out9, string11=code_block_14.out10)
AHN3_OGC_WMS = Output(concat_24)  # "AHN3(OGC WMS)"
link_kadaster_14 = CodeBlock()
# ---------- link_kadaster_14.designscript (11 lines) ----------
"https://service.pdok.nl/";
"hwh/luchtfotorgb/wms/v1_0?";
"&request=GetMap";
"&VERSION=1.3.0";
"&STYLES=";
"&layers=2019_ortho25";
"&bbox=";
"&width=3000";
"&height=3000";
"&format=image/png";
"&crs=EPSG:28992";
# ----------------------------------------
concat_25 = String.Concat(string0=link_kadaster_14.out0, string1=link_kadaster_14.out1, string2=link_kadaster_14.out2, string3=link_kadaster_14.out3, string4=link_kadaster_14.out4, string5=link_kadaster_14.out5, string6=link_kadaster_14.out6, string7=BoundingBoxEPSG28992, string8=link_kadaster_14.out7, string9=code_block_5.t6, string10=link_kadaster_14.out9, string11=link_kadaster_14.out10)
luchtfoto_2019_OGC_WMS = Output(concat_25)  # "luchtfoto 2019(OGC WMS)"
link_kadaster_15 = CodeBlock { "https://data.3dbag.nl/api/BAG3D_v2/"; "wfs?"; "&request=GetFeature"; "&typeName=BAG3D_v2:bag_tiles_3k"; "&bbox="; }
concat_26 = String.Concat(string0=link_kadaster_15.out0, string1=link_kadaster_15.out1, string2=link_kadaster_15.out2, string3=link_kadaster_15.out3, string4=link_kadaster_15.out4, string5=BoundingBoxEPSG28992)
BAG3D_V2_OGC_WFS = Output(concat_26)  # "BAG3D V2(OGC WFS)"
link_kadaster_16 = CodeBlock()
# ---------- link_kadaster_16.designscript (11 lines) ----------
"https://service.pdok.nl/";
"hwh/luchtfotorgb/wms/v1_0?";
"&request=GetMap";
"&VERSION=1.3.0";
"&STYLES=";
"&layers=2020_ortho25";
"&bbox=";
"&width=3000";
"&height=3000";
"&format=image/png";
"&crs=EPSG:28992";
# ----------------------------------------
concat_27 = String.Concat(string0=link_kadaster_16.out0, string1=link_kadaster_16.out1, string2=link_kadaster_16.out2, string3=link_kadaster_16.out3, string4=link_kadaster_16.out4, string5=link_kadaster_16.out5, string6=link_kadaster_16.out6, string7=BoundingBoxEPSG28992, string8=link_kadaster_16.out7, string9=code_block_5.t6, string10=link_kadaster_16.out9, string11=link_kadaster_16.out10)
luchtfoto_2020_OGC_WMS = Output(concat_27)  # "luchtfoto 2020(OGC WMS)"
code_block_16 = CodeBlock { "NL_PDOK_Luchtfoto_actueel_28992"; "serverrequestprefix"; }
GIS2BIM_GetWebServerData = Custom[GIS2BIM_GetWebServerData](title=code_block_16.out0, parameter=code_block_16.out1)  # package GIS2BIM for Dynamo 2.x; Get webserverdata from github repository of GIS2BIM(up to date list of GIS-servers & requests)
concat_28 = String.Concat(string0=GIS2BIM_GetWebServerData, string1=BoundingBoxEPSG28992)
luchtfoto_actueel_OGC_WMS = Output(concat_28)  # "luchtfoto actueel(OGC WMS)"
