# Dynamo custom node GIS2BIM_NetherlandsGeoservicesLibrary_RIVM.dyf (Dynamo 2.12.1.8246)
# category: GIS2BIM.Geoservices.Europe
# download RIVM wms images
# packages: Data-Shapes 2022.2.103

mainserver = Input(mainserver: string)
server = Input(server: string)
code_block = CodeBlock(mainserver=mainserver, server=server) { service = "/wms?request=GetCapabilities"; url=mainserver+server+service; }
web_request = WebRequest(url=code_block.url)
python_script = Python(IN[0]=web_request)  # IronPython2
# ---------- python_script.python (33 lines) ----------
import clr
clr.AddReference('ProtoGeometry')
from Autodesk.DesignScript.Geometry import *
import sys
sys.path.append("C:\Program Files (x86)\IronPython 2.7\Lib")
import xml.etree.ElementTree as ET

xml = IN[0]
root = ET.fromstring(xml.encode('utf-8'))
debug = []
ns="{http://www.opengis.net/wms}"
OUTlayers = []
OUTstyles = []

#for child in root[1][3]:
#	sChildText=child.text
#	sChildTag=child.tag
#	sChildAttrib=child.attrib
	#debug.append(sChildAttrib)

for child in root.findall(".//"+ns+"Layer[@queryable]"):
	aLayer=[]
	for subchild in child.findall ("./"+ns+"Name"):
		aLayer.append(subchild.text)
		OUTlayers.append(subchild.text)
		aStyles=[]
		for subchild in child.findall("./"+ns+"Style/"+ns+"Name"):
			aStyles.append(subchild.text)
		aLayer.append(aStyles)
		OUTstyles.append(aStyles)
	#debug.append(aLayer)
	
OUT = OUTlayers, OUTstyles
# ----------------------------------------
code_block_2 = CodeBlock(l=python_script) { "Select 1 layerst"; layers=l[0]; indexes= 0..List.Count(l[0])..1; styles=l[1]; }
listview_data = Custom[Listview Data](InputName=code_block_2.out0, Keys=code_block_2.layers, Values=code_block_2.indexes)  # package Data-Shapes; Create data for ListView input in UI.MultiInputForm ++ . Check out www.data-shapes.net for more infos.
code_block_3 = CodeBlock { true; "Cancel"; 600; 600; }
multipleinputform = Custom[MultipleInputForm ++](Inputs=listview_data, Toggle=code_block_3.out0, CancelButtonText_optional=code_block_3.out1, MaxHeight_optional=code_block_3.out3, Width_optional=code_block_3.out2)  # package Data-Shapes; Create a form with multiple inputs. see www.data-shapes.net for tutorials and infos!
code_block_4 = CodeBlock(l=multipleinputform.User_Inputs) { l[0][0]; }
getItemAtIndex = List.GetItemAtIndex(list=code_block_2.layers, index=code_block_4)
getItemAtIndex_2 = List.GetItemAtIndex(index=code_block_4)  # unwired: list
code_block_5 = CodeBlock(L=getItemAtIndex_2) { "Select Styles"; List.Count(L[0])>1; }
listview_data_2 = Custom[Listview Data](InputName=code_block_5.out0, Keys=getItemAtIndex_2, Values=getItemAtIndex_2)
code_block_6 = CodeBlock(wasrun=multipleinputform.Was_Run, cancelled=multipleinputform.Was_Cancelled) { wasrun == true && cancelled==false; }
code_block_7 = CodeBlock { "cancel"; 600; }
multipleinputform_2 = Custom[MultipleInputForm ++](Inputs=listview_data_2, Toggle=code_block_6, CancelButtonText_optional=code_block_7.out0, Width_optional=code_block_7.out1)
code_block_8 = CodeBlock(style=multipleinputform_2.User_Inputs) { style[0][0]; }
bbox = Input(bbox: string)
code_block_9 = CodeBlock(mainserver=mainserver, server=server, layers=getItemAtIndex, styles=code_block_8, bbox=bbox)
# ---------- code_block_9.designscript (5 lines) ----------
service = "/wms?request=GetMap&VERSION=1.3.0";
parameters = "&width=3000&height=3000&format=image/png&crs=EPSG:28992";
mainserver+server+service+
"&layers="+layers+"&STYLES="+styles+
parameters+"&bbox="+bbox;
# ----------------------------------------
url = Output(code_block_9.out2)  # "url: string"
code_block_10 = CodeBlock { ":"; }
split = String.Split(string=code_block_8, separator0=code_block_10)
code_block_11 = CodeBlock(l=split) { l[1]; }
style = Output(code_block_11)  # "style: string"
layer = Output(getItemAtIndex)  # "layer: string"
