# Dynamo custom node GIS2BIM_PTStoPoints.dyf (Dynamo 1.3.3.4111)
# category: GIS2BIM.Pointcloud
# convert a pts-file(ascii) to dynamo points

PTSFile = Input()
readText = File.ReadText(PTSFile)
NumberOfColumns = Input(NumberOfColumns: int=4)  # Number of Columns in PTS file First 3 columns will be used for xyz
python_script = Python(IN[0]=readText, IN[1]=NumberOfColumns)
# ---------- python_script.python (26 lines) ----------
import clr
# Import RevitNodes

clr.AddReference("RevitNodes")
import Revit
import sys
sys.path.append("C:\Program Files (x86)\IronPython 2.7\Lib")

import itertools

clr.AddReference('ProtoGeometry')
from Autodesk.DesignScript.Geometry import *

input = IN[0]
no = IN[1]

pointlist = input.split()

def grouper(n, it):
    "grouper(3, 'ABCDEFG') --> ABC DEF G"
    it = iter(it)
    return iter(lambda: list(itertools.islice(it, n)), [])

pointlist = list(grouper(no, pointlist))

OUT = pointlist
# ----------------------------------------
code_block = CodeBlock(t2=python_script)
# ---------- code_block.designscript (5 lines) ----------
t1 = DSCore.List.Transpose(t2);
t5 = 1000*String.ToNumber(DSCore.List.GetItemAtIndex(t1, 0));
t6 = 1000*String.ToNumber(DSCore.List.GetItemAtIndex(t1, 1));
t7 = 1000*String.ToNumber(DSCore.List.GetItemAtIndex(t1, 2));
points = Point.ByCoordinates(t5,t6,t7);
# ----------------------------------------
Points = Output(code_block.points)
code_block_2 = CodeBlock { 3; }
minimumItem = List.MinimumItem(code_block.t7)
Min_Height = Output(minimumItem)
maximumItem = List.MaximumItem(code_block.t7)
Max_Height = Output(maximumItem)
