# Dynamo custom node GIS2BIM_ReadGEFCPT.dyf (Dynamo 2.2.1.5175)
# category: GIS2BIM.SubSoil
# read the content of a GEF-file an order it into unique soillayers and depths

soilLayer1FrictionRatio = Input(soilLayer1FrictionRatio: double = 0.2)
file = Input(file: var[]..[])
readText = FileSystem.ReadText(file=file)
code_block = CodeBlock(t8=readText)
# ---------- code_block.designscript (10 lines) ----------
t7 = " ";
t3 = t8;
t1 = "#EOH=";
t2 = String.Split(t3, [t1]);
t4 = DSCore.List.LastItem(t2);
t5 = "
";
t6 = String.Split(t4, [t5]);
t9 = String.Split(t6, [t7]);
t10 = DSCore.List.Transpose(t9);
# ----------------------------------------
depthColumn = Input(depthColumn: int = 0)
getItemAtIndex = List.GetItemAtIndex(list=code_block.t10, index=depthColumn)
depthINmm = Python(IN[0]=getItemAtIndex)
# ---------- depthINmm.python (14 lines) ----------
import clr
clr.AddReference('ProtoGeometry')
from Autodesk.DesignScript.Geometry import *
#The inputs to this node will be stored as a list in the IN variables.
dataEnteringNode = IN

Depths = IN[0]

A= []
for Depth in Depths:
	A.append(-1000*float(Depth))

#Assign your output to the OUT variable.
OUT = A
# ----------------------------------------
frictionRatioColumn = Input(frictionRatioColumn: int = 6)
getItemAtIndex_2 = List.GetItemAtIndex(list=code_block.t10, index=frictionRatioColumn)
frictionRatio = Python(IN[0]=getItemAtIndex_2)
# ---------- frictionRatio.python (14 lines) ----------
import clr
clr.AddReference('ProtoGeometry')
from Autodesk.DesignScript.Geometry import *
#The inputs to this node will be stored as a list in the IN variables.
dataEnteringNode = IN

Depths = IN[0]

A= []
for Depth in Depths:
	A.append(float(Depth))

#Assign your output to the OUT variable.
OUT = A
# ----------------------------------------
soilLayer3FrictionRatio = Input(soilLayer3FrictionRatio: double = 5)
lt = frictionRatio < soilLayer3FrictionRatio
soilLayer3FrictionRatio_2 = Input(soilLayer3FrictionRatio: double = 2.5)
gt = frictionRatio > soilLayer3FrictionRatio_2
lt_2 = frictionRatio < soilLayer3FrictionRatio
eq = gt == lt_2
soilLayer3Name = Input(soilLayer3Name: string = "SoilClay")
soilLayer2FrictionRatio = Input(soilLayer2FrictionRatio: double = 1)
gt_2 = frictionRatio > soilLayer2FrictionRatio
lt_3 = frictionRatio < soilLayer3FrictionRatio_2
eq_2 = gt_2 == lt_3
soilLayer2Name = Input(soilLayer2Name: string = "SoilSilt")
lt_4 = frictionRatio < soilLayer2FrictionRatio
pressureColumn = Input(pressureColumn: int = 1)
getItemAtIndex_3 = List.GetItemAtIndex(list=code_block.t10, index=pressureColumn)
pressureMPA = Python(IN[0]=getItemAtIndex_3)  # same code as frictionRatio
code_block_2 = CodeBlock { 3; 10; }
lt_5 = pressureMPA < code_block_2.out0
soilLayer1Name0_3MPA = Input(soilLayer1Name0_3MPA: string = "SoilSand1")
gt_3 = pressureMPA > code_block_2.out0
lt_6 = pressureMPA < code_block_2.out1
eq_3 = gt_3 == lt_6
soilLayer1Name3_10MPA = Input(soilLayer1Name3_10MPA: string = "SoilSand2")
gt_4 = pressureMPA > code_block_2.out0
soilLayer1Name10_xMPA = Input(soilLayer1Name10_xMPA: string = "SoilSand3")
string = StringInput("")  # graph input
sandLayers3 = If(test=gt_4, true=soilLayer1Name10_xMPA, false=string)
sandLayers2 = If(test=eq_3, true=soilLayer1Name3_10MPA, false=sandLayers3)
sandLayers1 = If(test=lt_5, true=soilLayer1Name0_3MPA, false=sandLayers2)
string_2 = StringInput("")  # graph input
sandLayers = If(test=lt_4, true=sandLayers1, false=string_2)
siltLayers = If(test=eq_2, true=soilLayer2Name, false=sandLayers)
clayLayers = If(test=eq, true=soilLayer3Name, false=siltLayers)
soilLayer4Name = Input(soilLayer4Name: string = "SoilPeat")
peatLayers = If(test=lt, true=clayLayers, false=soilLayer4Name)
python_script = Python(IN[0]=peatLayers)
# ---------- python_script.python (26 lines) ----------
import sys
sys.path.append("C:\Program Files (x86)\IronPython 2.7\Lib")

from itertools import groupby

a= IN[0]

# number of same soillayers
b= [len(list(group)) for key, group in groupby(a)]

# index in list of a new soillayer

c= []
count = 0
for i in b:
    count = count + 1
    c.append(sum(b[:count-1]))

# name of each new soillayer
d= []
count = 0
for i in c:
    d.append(a.__getitem__(c.__getitem__(count)))
    count = count + 1
#Assign your output to the OUT variable.
OUT = b,c,d
# ----------------------------------------
code_block_3 = CodeBlock { 1; }
getItemAtIndex_4 = List.GetItemAtIndex(list=python_script, index=code_block_3)
startDepthSoilLayers = List.GetItemAtIndex(list=depthINmm, index=getItemAtIndex_4)
startDepthUniqueSoilLayers = Output(startDepthSoilLayers)
code_block_4 = CodeBlock { 2; }
soillayerName = List.GetItemAtIndex(list=python_script, index=code_block_4)
nameUniqueSoilLayers = Output(soillayerName)
depthFromGEF = Output(depthINmm)
pressureFromGEF = Output(pressureMPA)
frictionRatioFromGEF = Output(frictionRatio)
