# Dynamo custom node GIS2BIM_SVGToCurves.dyf (Dynamo 2.2.1.5175)
# category: GIS2BIM.Geometry
# Beta version of converting SVG to Curves

code_block = CodeBlock()
# ---------- code_block.designscript (60 lines) ----------
"
import clr
clr.AddReference('ProtoGeometry')
from Autodesk.DesignScript.Geometry import *

import sys
pyt_path = 'C:/Program Files (x86)/IronPython 2.7/Lib'
sys.path.append(pyt_path)

strSVG = IN[0]
bPix = IN[1]
hPix = IN[2]
widthM = IN[3]
heightM = IN[4]

def readSVG(svgString):
	strSplit = svgString.split('d=')
	del strSplit[0]
	del strSplit[0]
	del strSplit[0]
	del strSplit[0]
	del strSplit[0]

	strPolygon = []
	strPolygonX = []
	strPolygonY = []
	strPolygon2 = []
	ratioX=float(widthM)/float(bPix)
	ratioY=float(heightM)/float(hPix)

	for i in strSplit:
		j = i.split('fill')[0]
		k = j[2:]
		l = k.replace('L','')
		m = l[:-3]
		n = m.split('ZM')
		strPolygon.append(n)

	for sublist in strPolygon:
   		for item in sublist:
   			strPolygon2.append(item)

	for i in strPolygon2:
		o = i.split(' ')
		p = list(filter(None, o))
		q = p[0::2]
		r = p[1::2]
		xCoord = (int(1000*(float(s)*ratioX-0.5*widthM)) for s in q)
		yCoord = (int(-1000*(float(t)*ratioY-0.5*heightM)) for t in r)
		strPolygonX.append(xCoord)
		strPolygonY.append(yCoord)

	return strPolygonX,strPolygonY,

SVGpts = readSVG(strSVG)

OUT = SVGpts

";
//SVGsplit.split('Z')
# ----------------------------------------
SVGString = Input(SVGString: var[]..[])
WidthPixels = Input(WidthPixels: double = 3000)
HeightPixels = Input(HeightPixels: double = 3000)
Width = Input(Width: double)
Height = Input(Height: double)
python_script_from_string = PythonStringNode(script=code_block, IN[0]=SVGString, IN[1]=WidthPixels, IN[2]=HeightPixels, IN[3]=Width, IN[4]=Height)
code_block_2 = CodeBlock(t3=python_script_from_string, widthM=Width, heightM=Height)
# ---------- code_block_2.designscript (21 lines) ----------
a = t3;
point1 = Point.ByCoordinates(a[0], a[1]);
//Create big surface
widthM;
heightM;
b = widthM + 50;
h = heightM + 50;
bmax = (b * 1000) / 2;
bmin = -1 * bmax;
hmax = (h * 1000) / 2;
hmin = -1 * hmax;
p1 = Point.ByCoordinates(bmin, hmin);
p2 = Point.ByCoordinates(bmax, hmin);
p3 = Point.ByCoordinates(bmax, hmax);
p4 = Point.ByCoordinates(bmin, hmax);
t1 = [p1, p2, p3, p4];
surface1 = Surface.ByPerimeterPoints(t1);

polyCurve1 = PolyCurve.ByPoints(point1, false);
surface2 = polyCurve1.Extrude(1000);
geometry1 = surface1.Split(surface2);
# ----------------------------------------
Unstructured_Curves = Output(code_block_2.point1)
code_block_3 = CodeBlock(t2=code_block_2.geometry1)
# ---------- code_block_3.designscript (4 lines) ----------
t1 = List.LastItem(t2@-2<1>);
t3 = DSCore.Object.IsNull(t1);
t4 = List.FilterByBoolMask(t1, t3);
t6 = Dictionary.ValueAtKey(t4, "out");
# ----------------------------------------
Faces = Output(code_block_3.t6)
perimeterCurves = Surface.PerimeterCurves(surface=code_block_3.t6)
Structured_Curves = Output(perimeterCurves)
byJoinedSurfaces = PolySurface.ByJoinedSurfaces(surfaces=code_block_3.t6)
PolySurface = Output(byJoinedSurfaces)
perimeterCurves_2 = Surface.PerimeterCurves(surface=byJoinedSurfaces)
PolySurfaceBoundary = Output(perimeterCurves_2)
