# Dynamo custom node GIS2BIM_ScotlandGeoservicesLibrary.dyf (Dynamo 2.2.1.5175)
# category: GIS2BIM.Geoservices.Europe
# Webservices in Scotland

link_kadaster = CodeBlock()
# ---------- link_kadaster.designscript (12 lines) ----------
"https://cagmap.snh.gov.uk/arcgis/services/";
"snh_habitats_and_species/MapServer/WMSServer?";
"&request=GetMap";
"&VERSION=1.3.0";
"&STYLES=default";
"&layers=1";
"&bbox=";
"&width=3000";
"&height=3000";
"&format=image/png";
"&crs=EPSG:27700";
//Scottish Natural Heritage Habitats and Species
# ----------------------------------------
BoundingBoxEPSG27700 = Input(BoundingBoxEPSG27700: DSCore.String)
concat = String.Concat(string0=link_kadaster.out0, string1=link_kadaster.out1, string2=link_kadaster.out2, string3=link_kadaster.out3, string4=link_kadaster.out4, string5=link_kadaster.out5, string6=link_kadaster.out6, string7=BoundingBoxEPSG27700, string8=link_kadaster.out7, string9=link_kadaster.out8, string10=link_kadaster.out9, string11=link_kadaster.out10)
Scottish_Natural_Heritage_Habitats_and_S = Output(concat)  # "Scottish Natural Heritage Habitats and Species(WMS)"
link_kadaster_2 = CodeBlock()
# ---------- link_kadaster_2.designscript (12 lines) ----------
"http://ros.datafeed.locationcentre.co.uk/";
"geoserver/wms?";
"&request=GetMap";
"&VERSION=1.3.0";
"&STYLES=CP.CadastralParcel";
"&layers=CP.CadastralParcel";
"&bbox=";
"&width=2000";
"&height=2000";
"&format=image/png";
"&crs=EPSG:27700";
//ELF Cadastral Parcel
# ----------------------------------------
concat_2 = String.Concat(string0=link_kadaster_2.out0, string1=link_kadaster_2.out1, string2=link_kadaster_2.out2, string3=link_kadaster_2.out3, string4=link_kadaster_2.out4, string5=link_kadaster_2.out5, string6=link_kadaster_2.out6, string7=BoundingBoxEPSG27700, string8=link_kadaster_2.out7, string9=link_kadaster_2.out8, string10=link_kadaster_2.out9, string11=link_kadaster_2.out10)
ELF_Cadastral_Parcel_WMS = Output(concat_2)  # "ELF Cadastral Parcel(WMS)"
link_kadaster_3 = CodeBlock()
# ---------- link_kadaster_3.designscript (12 lines) ----------
"https://ons-inspire.esriuk.com/arcgis/services/Electoral_Boundaries/";
"European_Electoral_Regions_December_2016_Boundaries/MapServer/WMSServer?&service=WMS";
"&request=GetMap";
"&VERSION=1.3.0";
"&STYLES=default";
"&layers=1";
"&bbox=";
"&width=2000";
"&height=2000";
"&format=image/png";
"&crs=EPSG:27700";
//Boundaries electoral regions december 2016 European Elections
# ----------------------------------------
concat_3 = String.Concat(string0=link_kadaster_3.out0, string1=link_kadaster_3.out1, string2=link_kadaster_3.out2, string3=link_kadaster_3.out3, string4=link_kadaster_3.out4, string5=link_kadaster_3.out5, string6=link_kadaster_3.out6, string7=BoundingBoxEPSG27700, string8=link_kadaster_3.out7, string9=link_kadaster_3.out8, string10=link_kadaster_3.out9, string11=link_kadaster_3.out10)
Boundaries_electoral_regions_december_20 = Output(concat_3)  # "Boundaries electoral regions december 2016 European Elections(WMS)"
