# Dynamo custom node GIS2BIM_SetImageWidth.dyf (Dynamo 2.2.1.5175)
# category: GIS2BIM.Image
# set width of imported raster image

categories = Categories("OST_RasterImages")  # graph input
all_elements_of_category = ElementsOfCategory(Category=categories)
name = Element.Name(element=all_elements_of_category)
Imagename = Input(Imagename: var[]..[])  # name of the rasterimage in revit
eq = name == Imagename
filterByBoolMask = List.FilterByBoolMask(list=all_elements_of_category, mask=eq)
flatten = List.Flatten(list=filterByBoolMask.in)
code_block = CodeBlock { "Width"; }
Imagewidth = Input(Imagewidth: var[]..[])  # desired width of the image
setParameterByName = Element.SetParameterByName(element=flatten, parameterName=code_block, value=Imagewidth)
