# Dynamo custom node GIS2BIM_SetMaterialAppearanceTextureGeneric.dyf (Dynamo 1.3.3.4111)
# category: GIS2BIM.Revit
# Change the values of the texture of the appearanceasset of a Revit Material of the type 'generic'

Material = Input()  # "Material_"
TextureFilelocation = Input()  # String of TextureFileLocation
TextureOffsetX = Input()
TextureOffsetY = Input()
TextureSizeXMM = Input()
TextureSizeYMM = Input()
LockScale = Input()
RotationAngle = Input()
python_script = Python(IN[0]=Material, IN[1]=TextureFilelocation, IN[2]=TextureOffsetX, IN[3]=TextureOffsetY, IN[4]=TextureSizeXMM, IN[5]=TextureSizeYMM, IN[6]=LockScale, IN[7]=RotationAngle)
# ---------- python_script.python (73 lines) ----------
import clr
clr.AddReference("RevitNodes")
import Revit
clr.ImportExtensions(Revit.Elements)
clr.AddReference("RevitAPI")
import Autodesk
from Autodesk.Revit.DB import *
from Autodesk.Revit.DB.Visual import *

clr.AddReference("RevitServices")
import RevitServices
from RevitServices.Persistence import DocumentManager
from RevitServices.Transactions import TransactionManager

doc = DocumentManager.Instance.CurrentDBDocument

import sys

pyt_path = 'C:\Program Files (x86)\IronPython 2.7\Lib'
sys.path.append(pyt_path)

mat1= IN[0]
var1 = IN[1]
offsetX1 = IN[2]
offsetY1 = IN[3]
scaleX1 = IN[4]
scaleY1 = IN[5]
lockScale = IN[6]
angle = IN[7]

offsetX = offsetX1/25.4
offsetY = offsetY1/25.4
scaleX = scaleX1/25.4
scaleY = scaleY1/25.4

mat = UnwrapElement(mat1)
doc = DocumentManager.Instance.CurrentDBDocument

AppearanceAsset = doc.GetElement(mat.AppearanceAssetId)
RenderingAsset = AppearanceAsset.GetRenderingAsset()
AppearanceAssetid =AppearanceAsset.Id

TransactionManager.Instance.EnsureInTransaction(doc)

editScope = AppearanceAssetEditScope(doc)
AssetEditable = editScope.Start(AppearanceAssetid)

BitMapLocation = AssetEditable[UnifiedBitmap.UnifiedbitmapBitmap] #AssetProperty String Object
BitMapLocation.Value = var1

BitmapOffsetX = AssetEditable[UnifiedBitmap.TextureRealWorldOffsetX]
BitmapOffsetX.Value = offsetX

BitmapOffsetY = AssetEditable[UnifiedBitmap.TextureRealWorldOffsetY]
BitmapOffsetY.Value = offsetY

BitmapscaleX = AssetEditable[UnifiedBitmap.TextureRealWorldScaleX]
BitmapscaleX.Value = scaleX

BitmapScaleY = AssetEditable[UnifiedBitmap.TextureRealWorldScaleY]
BitmapScaleY.Value = scaleY

Scalelock = AssetEditable[UnifiedBitmap.TextureScaleLock]
Scalelock.Value = lockScale

TextureWAngle = AssetEditable[UnifiedBitmap.TextureWAngle]
TextureWAngle.Value = angle

editScope.Commit(IFailuresPreprocessor)

TransactionManager.Instance.TransactionTaskDone()

OUT = mat1
# ----------------------------------------
Output = Output(python_script)  # ""
