# Dynamo custom node GIS2BIM_SetSharedCoordinate.dyf (Dynamo 2.12.1.8246)
# category: GIS2BIM.Coordinates
# Set shared coordinate/project basepoint

categories = Categories("OST_ProjectBasePoint")  # graph input
all_elements_of_category = ElementsOfCategory(Category=categories)
code_block = CodeBlock { ["E/W","N/S","Elev","Angle to True North"]; }
x = Input(x: double)  # E/W
y = Input(y: double)  # N/S
z = Input(z: double = 0)  # Elev
create = List.Create(item0=x, item1=y, item2=z)
scale = Input(scale: double = 1000)  # GIS units are usually in meters
code_block_2 = CodeBlock(list=create, scale=scale) { list*scale; }
angle = Input(angle: double = 0)  # Angle to True North
join = List.Join(list0=code_block_2, list1=angle)
setParameterByName = Element.SetParameterByName(element=all_elements_of_category, parameterName=code_block, value=join, lacing=Longest)
uniqueItems = List.UniqueItems(list=setParameterByName)
Element = Output(uniqueItems)
getParameterValueByName = Element.GetParameterValueByName(element=setParameterByName, parameterName=code_block, lacing=Longest)
code_block_3 = CodeBlock(x=getParameterValueByName) { x[0]; x[1]; x[2]; x[3]; }
EastWest = Output(code_block_3.out0)  # "EastWest: double"
NorthSouth = Output(code_block_3.out1)  # "NorthSouth: double"
Elevation = Output(code_block_3.out2)
Angle_to_True_North = Output(code_block_3.out3)
