# Dynamo custom node GIS2BIM_SloveniaGeoservicesLibrary.dyf (Dynamo 2.2.1.5175)
# category: GIS2BIM.Geoservices.Europe
# Geoservices in Slovenia

code_block = CodeBlock()
# ---------- code_block.designscript (11 lines) ----------
"https://prostor4.gov.si/";
"ows2-elf-m/elf_cp/ows?service=wms";
"&request=GetMap";
"&VERSION=1.3.0";
"&STYLES=CP.CadastralParcel.ELFCadastre";
"&layers=CP.CadastralParcel";
"&bbox=";
"&width=3000";
"&height=3000";
"&format=image/png";
"&crs=EPSG:3912";
# ----------------------------------------
BoundingBoxEPSG3912 = Input(BoundingBoxEPSG3912: string)
concat = String.Concat(string0=code_block.out0, string1=code_block.out1, string2=code_block.out2, string3=code_block.out3, string4=code_block.out4, string5=code_block.out5, string6=code_block.out6, string7=BoundingBoxEPSG3912, string8=code_block.out7, string9=code_block.out8, string10=code_block.out9, string11=code_block.out10)
Cadastral_Parcel_OGC_WMS = Output(concat)  # "Cadastral Parcel(OGC WMS)"
code_block_2 = CodeBlock()
# ---------- code_block_2.designscript (11 lines) ----------
"https://prostor4.gov.si/";
"ows2-elf-m/elf_bu/ows?service=wms";
"&request=GetMap";
"&VERSION=1.3.0";
"&STYLES=BU.Building.ELFCadastre";
"&layers=BU.Building";
"&bbox=";
"&width=3000";
"&height=3000";
"&format=image/png";
"&crs=EPSG:3912";
# ----------------------------------------
concat_2 = String.Concat(string0=code_block_2.out0, string1=code_block_2.out1, string2=code_block_2.out2, string3=code_block_2.out3, string4=code_block_2.out4, string5=code_block_2.out5, string6=code_block_2.out6, string7=BoundingBoxEPSG3912, string8=code_block_2.out7, string9=code_block_2.out8, string10=code_block_2.out9, string11=code_block_2.out10)
Cadastral_Buildings_OGC_WMS = Output(concat_2)  # "Cadastral Buildings(OGC WMS)"
link_kadaster = CodeBlock()
# ---------- link_kadaster.designscript (5 lines) ----------
"https://prostor4.gov.si/ows2-elf/cp/wfs?";
"service=wfs";
"&request=GetFeature";
"&typeName=cp:CadastralParcel";
"&bbox=";
# ----------------------------------------
concat_3 = String.Concat(string0=link_kadaster.out0, string1=link_kadaster.out1, string2=link_kadaster.out2, string3=link_kadaster.out3, string4=link_kadaster.out4, string5=BoundingBoxEPSG3912)
Cadastral_Parcels_OGC_WFS = Output(concat_3)  # "Cadastral Parcels(OGC WFS)"
