# Dynamo custom node GIS2BIM_SouthAfricaGeoservicesLibrary.dyf (Dynamo 1.3.1.1736)
# category: GIS2BIM.Geoservices.Africa
# Geoservices in South-Africa

code_block = CodeBlock { "http://webgis.esri-southafrica.com/arcgis/rest/services/GISCOE/South_Africa_Cadastre/MapServer/2/"; }
South_Africa_Parcels = Output(code_block)
code_block_2 = CodeBlock { "http://webgis.esri-southafrica.com/arcgis/rest/services/GISCOE/South_Africa_Cadastre/MapServer/1/"; }
South_Africa_Erven = Output(code_block_2)
