# Dynamo custom node GIS2BIM_SpainGeoservicesLibrary.dyf (Dynamo 1.3.1.1736)
# category: GIS2BIM.Geoservices.Europe
# Geoserviceslibrary of Spain

code_block = CodeBlock()
# ---------- code_block.designscript (5 lines) ----------
"http://ovc.catastro.meh.es/INSPIRE/wfsCP.aspx?service=wfs";
"&request=getfeature";
"&Typenames=cp.cadastralparcel";
"&SRSname=EPSG::25830";
"&bbox=";
# ----------------------------------------
BoundingboxString = Input()  # Input From Boundingboxnode from GIS2BIM
concat = String.Concat(code_block.out0, code_block.out1, code_block.out2, code_block.out3, code_block.out4, BoundingboxString)
Cadastre_Parcels_OGC_WFS = Output(concat)  # "Cadastre Parcels(OGC WFS)"
