# Dynamo custom node GIS2BIM_Subregions.dyf (Dynamo 2.2.1.5175)
# category: GIS2BIM.Revit
# Create a subregion on a topography

Curves = Input(Curves: var[]..[])
TopographyHost = Input(TopographyHost: var[]..[])
python_script = Python(IN[0]=Curves, IN[1]=TopographyHost)
# ---------- python_script.python (52 lines) ----------
import clr

clr.AddReference('RevitAPI')
from Autodesk.Revit.DB import *
from Autodesk.Revit.DB.Architecture import *
import System.Collections.Generic
from System.Collections.Generic import List

clr.AddReference('RevitNodes')
import Revit
clr.ImportExtensions(Revit.GeometryConversion)

clr.AddReference('RevitServices')
from RevitServices.Transactions import TransactionManager
from RevitServices.Persistence import DocumentManager

doc = DocumentManager.Instance.CurrentDBDocument

# Get input variables
subregions = IN[0]
host = UnwrapElement(IN[1])

# Init variables
curveLoops = []
createdSubRegions = []
error = []

TransactionManager.Instance.EnsureInTransaction(doc)

# Get groups of curves (exploded polycurves!) and creates per group a SubRegion
for i in subregions:
	# Init CurveLoop for every curve group
	x = CurveLoop()
	
	# Iterate the seperate curves -> convert type to Revit Type -> add to CurveLoop
	for j in i:
		x.Append(j.ToRevitType())
	curveLoops.append(x)
	
	# Add layer to list
	y = [x]
	yI = List[CurveLoop](y)
	
	if SiteSubRegion.IsValidBoundary(yI):
		# Create SubRegion out of the CurveLoop group and add its to 'createdSubregions'
		newSubRegion = SiteSubRegion.Create(doc, yI, host.Id)
		createdSubRegions.append(newSubRegion)
	
TransactionManager.Instance.TransactionTaskDone()

# Output
OUT = createdSubRegions
# ----------------------------------------
Subregions = Output(python_script)
