# Dynamo custom node GIS2BIM_SuggestLocationdata.dyf (Dynamo 2.2.1.5175)
# category: GIS2BIM.DutchGEO
# Suggests the adress in the Netherlands that best matches the given search terms.
# https://github.com/PDOK/locatieserver/wiki/API-Locatieserver

code_block = CodeBlock { "adres onbekend"; }
string = StringInput("http://geodata.nationaalgeoregister.nl/locatieserver/v3/suggest?q=")  # graph input
code_block_2 = CodeBlock { " and "; }
SearchTerm = Input(SearchTerm: var[]..[])
flatten = List.Flatten(list=SearchTerm)
string_from_object = FromObject(obj=flatten)
length = String.Length(str=string_from_object)
code_block_3 = CodeBlock(x=length) { x>0; }
filterByBoolMask = List.FilterByBoolMask(list=string_from_object, mask=code_block_3)
join = String.Join(separator=code_block_2, string0=filterByBoolMask.in)
code_block_4 = CodeBlock(PDOKgeosearchstring=string, zoektermen=join) { PDOKgeosearchstring+zoektermen; }
web_request = WebRequest(url=code_block_4)
string_2 = StringInput("\"maxScore\":")  # graph input
string_3 = StringInput(",\"docs\":")  # graph input
string_4 = StringInput(",\"highlighting\":{")  # graph input
split = String.Split(str=web_request, separator0=string_2, separator1=string_3, separator2=string_4)
code_block_5 = CodeBlock(x=split) { list=x[0]; maxScore=list[1]; adresses=list[2]; }
string_5 = StringInput("type\":\"")  # graph input
string_6 = StringInput("weergavenaam\":\"")  # graph input
string_7 = StringInput("\",\"")  # graph input
string_8 = StringInput("score\":")  # graph input
string_9 = StringInput("}")  # graph input
split_2 = String.Split(str=code_block_5.adresses, separator0=string_5, separator1=string_6, separator2=string_7, separator3=string_8, separator4=string_9)
code_block_6 = CodeBlock { 5; 3; 5; 2; }
takeEveryNthItem = List.TakeEveryNthItem(list=split_2, n=code_block_6.out0, offset=code_block_6.out1)
takeEveryNthItem_2 = List.TakeEveryNthItem(list=split_2, n=code_block_6.out0, offset=code_block_6.out3)
code_block_7 = CodeBlock(x=takeEveryNthItem_2) { x=="adres"; }
filterByBoolMask_2 = List.FilterByBoolMask(list=takeEveryNthItem, mask=code_block_7)
code_block_8 = CodeBlock { " "; ","; }
split_3 = String.Split(str=filterByBoolMask_2.in, separator0=code_block_8.out0, separator1=code_block_8.out1)
code_block_9 = CodeBlock(onbekend=code_block, adres=split_3) { s=onbekend; [adres, [[s,s,s,s]]]; }
toNumber = String.ToNumber(str=code_block_5.maxScore)
code_block_10 = CodeBlock(x=toNumber) { max=x; a=x>0; b=x==0; [a,b]; }
filterByBoolMask_3 = List.FilterByBoolMask(list=code_block_9.out1, mask=code_block_10.out3)
code_block_11 = CodeBlock(s=filterByBoolMask_3.in) { x=s[0]; }
code_block_12 = CodeBlock(x=code_block_11) { List.GetItemAtIndex(x<1>, 0); List.GetItemAtIndex(x<1>, 1); List.GetItemAtIndex(x<1>, 2); List.GetItemAtIndex(x<1>, 3); }
plaatsnaam = Output(code_block_12.out3)
postcode = Output(code_block_12.out2)
straatnaam = Output(code_block_12.out0)
huisnummer = Output(code_block_12.out1)
code_block_13 = CodeBlock(adres=filterByBoolMask_2.in, onbekend=code_block) { [adres,[onbekend]]; }
filterByBoolMask_4 = List.FilterByBoolMask(list=code_block_13, mask=code_block_10.out3)
code_block_14 = CodeBlock(s=filterByBoolMask_4.in) { x=s[0]; }
adres = Output(code_block_14)
takeEveryNthItem_3 = List.TakeEveryNthItem(list=split_2, n=code_block_6.out0, offset=code_block_6.out2)
filterByBoolMask_5 = List.FilterByBoolMask(list=takeEveryNthItem_3, mask=code_block_7)
toNumber_2 = String.ToNumber(str=filterByBoolMask_5.in)
code_block_15 = CodeBlock(x=toNumber_2, max=code_block_10.max) { Math.Round(x/max*100); }
string_from_object_2 = FromObject(obj=code_block_15)
code_block_16 = CodeBlock { "."; ","; }
split_4 = String.Split(str=string_from_object_2, separator0=code_block_16.out0, separator1=code_block_16.out1)
code_block_17 = CodeBlock(x=split_4)
# ---------- code_block_17.designscript (2 lines) ----------
[List.GetItemAtIndex(x<1>, 0)+"%",
["0%"]];
# ----------------------------------------
filterByBoolMask_6 = List.FilterByBoolMask(list=code_block_17, mask=code_block_10.out3)
code_block_18 = CodeBlock(s=filterByBoolMask_6.in) { x=s[0]; }
score = Output(code_block_18)
