# Dynamo custom node GIS2BIM_TMSGetTileNumbersFromBboxLATLON.dyf (Dynamo 2.2.1.5175)
# category: GIS2BIM.WMTS/TMS
# Get the Tilenumbers in X and Y in the TMS Webprotocol based on a given Boundingbox in LAT/LON

North = Input(North: var[]..[])
East = Input(East: var[]..[])
Zoomlevel = Input(Zoomlevel: var[]..[])

# group: TOP RIGHT
GIS2BIM_TMSTileNumberFromCoordinate = Custom[GIS2BIM_TMSTileNumberFromCoordinate](Latitude=North, Longitude=East, Zoomlevel=Zoomlevel)  # Calculate TMS(Tile Map Service) Number from a lat/lon coördinate

South = Input(South: var[]..[])
West = Input(West: var[]..[])

# group: LEFT BOTTOM
GIS2BIM_TMSTileNumberFromCoordinate_2 = Custom[GIS2BIM_TMSTileNumberFromCoordinate](Latitude=South, Longitude=West, Zoomlevel=Zoomlevel)
GIS2BIM_TMSBoundingboxFromTileNumber = Custom[GIS2BIM_TMSBoundingboxFromTileNumber](TileX=GIS2BIM_TMSTileNumberFromCoordinate_2.dblXTile, TileY=GIS2BIM_TMSTileNumberFromCoordinate_2.dblYTile, Zoomlevel=Zoomlevel)  # Calculate Lat/Lon boundaries from a TileNumber in TMS(Tile Map Service)

code_block = CodeBlock(x2=GIS2BIM_TMSTileNumberFromCoordinate.dblXTile, x1=GIS2BIM_TMSTileNumberFromCoordinate_2.dblXTile, y2=GIS2BIM_TMSTileNumberFromCoordinate_2.dblYTile, y1=GIS2BIM_TMSTileNumberFromCoordinate.dblYTile) { deltax=x2-x1; deltay=y2-y1; listx=x1..x2..#deltax+1; listy=y2..y1..#deltay+1; }
python_script = Python(IN[0]=code_block.listx, IN[1]=code_block.listy)
# ---------- python_script.python (30 lines) ----------
import clr
clr.AddReference('ProtoGeometry')
from Autodesk.DesignScript.Geometry import *
#The inputs to this node will be stored as a list in the IN variables.
dataEnteringNode = IN

x=IN[0]
y=IN[1]

n = len(y)
xl1=[]
for i in x:
	xl1.append([i]*n)

xl2=[]
for sublist in xl1:
    for item in sublist:
        xl2.append(item)
        
yl1=[]
for i in x:
	yl1.append(y)

yl2=[]
for sublist in yl1:
    for item in sublist:
        yl2.append(item)

#Assign your output to the OUT variable.
OUT = xl2,yl2
# ----------------------------------------
code_block_2 = CodeBlock(out=python_script) { out[0]; out[1]; }
string_from_object = FromObject(obj=code_block_2.out0)
TileX = Output(string_from_object)
string_from_object_2 = FromObject(obj=code_block_2.out1)
TileY = Output(string_from_object_2)
watch = Watch(code_block.listx)
TileXUnique = Output(watch)
watch_2 = Watch(code_block.listy)
TileYUnique = Output(watch_2)
GIS2BIM_TMSBoundingboxFromTileNumber_2 = Custom[GIS2BIM_TMSBoundingboxFromTileNumber](TileX=GIS2BIM_TMSTileNumberFromCoordinate.dblXTile, TileY=GIS2BIM_TMSTileNumberFromCoordinate.dblYTile, Zoomlevel=Zoomlevel)

# group: Width
GIS2BIM_DistanceBetweenCoordinatesWGS84 = Custom[GIS2BIM_DistanceBetweenCoordinatesWGS84](Latitude1=GIS2BIM_TMSBoundingboxFromTileNumber.South, Longitude1=GIS2BIM_TMSBoundingboxFromTileNumber_2.East, Latitude2=GIS2BIM_TMSBoundingboxFromTileNumber.South, Longitude2=GIS2BIM_TMSBoundingboxFromTileNumber.West)  # Calculate the distance between 2 lat/lon coördinates in meters

WidthM = Output(GIS2BIM_DistanceBetweenCoordinatesWGS84)
BoundingboxWidth = Input(BoundingboxWidth: var[]..[])

# group: DIFF LEFT WIDTH(CALCULATED, TILES)
GIS2BIM_DistanceBetweenCoordinatesWGS84_2 = Custom[GIS2BIM_DistanceBetweenCoordinatesWGS84](Latitude1=South, Longitude1=West, Latitude2=South, Longitude2=GIS2BIM_TMSBoundingboxFromTileNumber.West)

# group: HEIGHT OF TILES
GIS2BIM_DistanceBetweenCoordinatesWGS84_3 = Custom[GIS2BIM_DistanceBetweenCoordinatesWGS84](Latitude1=GIS2BIM_TMSBoundingboxFromTileNumber.South, Longitude1=GIS2BIM_TMSBoundingboxFromTileNumber.West, Latitude2=GIS2BIM_TMSBoundingboxFromTileNumber_2.North, Longitude2=GIS2BIM_TMSBoundingboxFromTileNumber.West)

# group: DIFF BOTTOM HEIGHT(CALCULATED, TILES)
GIS2BIM_DistanceBetweenCoordinatesWGS84_4 = Custom[GIS2BIM_DistanceBetweenCoordinatesWGS84](Latitude1=GIS2BIM_TMSBoundingboxFromTileNumber.South, Longitude1=GIS2BIM_TMSBoundingboxFromTileNumber.East, Latitude2=South, Longitude2=GIS2BIM_TMSBoundingboxFromTileNumber.East)

code_block_3 = CodeBlock(widthTiles=GIS2BIM_DistanceBetweenCoordinatesWGS84, WidthDesired=BoundingboxWidth, dxleft=GIS2BIM_DistanceBetweenCoordinatesWGS84_2, heightTiles=GIS2BIM_DistanceBetweenCoordinatesWGS84_3, dybottom=GIS2BIM_DistanceBetweenCoordinatesWGS84_4)
# ---------- code_block_3.designscript (6 lines) ----------
deltawidth=widthTiles-WidthDesired;
a=deltawidth/2;
dximportimageMM=1000*((a-dxleft));
deltaheight=heightTiles-WidthDesired;
b=deltaheight/2;
dyimportimageMM=1000*((b-dybottom));
# ----------------------------------------
DeltaXmm = Output(code_block_3.dximportimageMM)
DeltaYmm = Output(code_block_3.dyimportimageMM)
HeightM = Output(GIS2BIM_DistanceBetweenCoordinatesWGS84_3)
