# Dynamo custom node GIS2BIM_TMSTileNumberFromCoordinate.dyf (Dynamo 1.3.1.1736)
# category: GIS2BIM.WMTS/TMS
# Calculate TMS(Tile Map Service) Number from a lat/lon coördinate

Latitude = Input(Latitude:double)
Longitude = Input(Longitude:double)
Zoomlevel = Input(Zoomlevel:double=19)
python_script = Python(IN[0]=Latitude, IN[1]=Longitude, IN[2]=Zoomlevel)
# ---------- python_script.python (14 lines) ----------
import sys
sys.path.append("C:\Program Files (x86)\IronPython 2.7\Lib")
import math

lat_deg = IN[0]
lon_deg = IN[1]
zoom = IN[2]

lat_rad = math.radians(lat_deg)
n = 2.0 ** zoom
xtile = int((lon_deg + 180.0) / 360.0 * n)
ytile = int((1.0 - math.log(math.tan(lat_rad) + (1 / math.cos(lat_rad))) / math.pi) / 2.0 * n)

OUT = xtile, ytile
# ----------------------------------------
firstItem = List.FirstItem(python_script)
string_from_object = FromObject(firstItem)
strXTile = Output(string_from_object)  # "strXTile: string"
lastItem = List.LastItem(python_script)
string_from_object_2 = FromObject(lastItem)
strYTile = Output(string_from_object_2)  # "strYTile: string"
dblXTile = Output(firstItem)  # "dblXTile: double"
dblYTile = Output(lastItem)  # "dblYTile: double"
