# Dynamo custom node GIS2BIM_TMSWebServices.dyf (Dynamo 1.3.1.1736)
# category: GIS2BIM.WMTS/TMS
# Library With TMS Webservices

code_block = CodeBlock { "https://mt1.google.com/vt/lyrs=s"; "&x="; "&y="; "&z="; }
TileX = Input()
TileY = Input()
Zoomlevel = Input(Zoomlevel: double)
string_from_object = FromObject(Zoomlevel)
code_block_2 = CodeBlock { ","; "."; }
split = String.Split(string_from_object, code_block_2.out0, code_block_2.out1)
firstItem = List.FirstItem(split)
python_script = Python(IN[1]=code_block.out1, IN[2]=TileX, IN[3]=code_block.out2, IN[4]=TileY, IN[5]=code_block.out3, IN[6]=firstItem)  # unwired: IN[0]
# ---------- python_script.python (23 lines) ----------
import clr
clr.AddReference('ProtoGeometry')
from Autodesk.DesignScript.Geometry import *
#The inputs to this node will be stored as a list in the IN variables.
dataEnteringNode = IN

str2=IN[1]
lst3=IN[2]
str4=IN[3]
lst5=IN[4]
str6=IN[5]
zooml=IN[6]

n=len(lst3)

lst2=[str2]*n
lst4=[str4]*n
lst6=[str6]*n
lst7=[zooml]*n

lstout=[a+b+c+d+e+f for a,b,c,d,e,f in zip(lst2,lst3,lst4,lst5,lst6,lst7)]

OUT = lstout
# ----------------------------------------
code_block_3 = CodeBlock()
# ---------- code_block_3.designscript (7 lines) ----------
lst={"https://mt1.google.com/vt/lyrs=h",
"https://mt1.google.com/vt/lyrs=m",
"https://mt1.google.com/vt/lyrs=p",
"https://mt1.google.com/vt/lyrs=r",
"https://mt1.google.com/vt/lyrs=s",
"https://mt1.google.com/vt/lyrs=t",
"https://mt1.google.com/vt/lyrs=y"};
# ----------------------------------------
code_block_4 = CodeBlock(lst=code_block_3) { lst[0]; lst[1]; lst[2]; lst[3]; lst[4]; lst[5]; lst[6]; }
concat = String.Concat(code_block_4.out4)  # unwired: arg1
map = List.Map(list=python_script, f_x=concat)
URL_Google_Earth_Satellite = Output(map)
concat_2 = String.Concat(code_block_4.out0)  # unwired: arg1
map_2 = List.Map(list=python_script, f_x=concat_2)
URL_Google_Roads_Only = Output(map_2)
concat_3 = String.Concat(code_block_4.out1)  # unwired: arg1
map_3 = List.Map(list=python_script, f_x=concat_3)
URL_Google_Standard_Roadmap = Output(map_3)
concat_4 = String.Concat(code_block_4.out2)  # unwired: arg1
map_4 = List.Map(list=python_script, f_x=concat_4)
URL_Google_Terrain = Output(map_4)
concat_5 = String.Concat(code_block_4.out3)  # unwired: arg1
map_5 = List.Map(list=python_script, f_x=concat_5)
URL_Google_Alterned_Roadmap = Output(map_5)
concat_6 = String.Concat(code_block_4.out5)  # unwired: arg1
map_6 = List.Map(list=python_script, f_x=concat_6)
URL_Google_Terrain_Only = Output(map_6)
concat_7 = String.Concat(code_block_4.out6)  # unwired: arg1
map_7 = List.Map(list=python_script, f_x=concat_7)
URL_Google_Hybrid = Output(map_7)
