# Dynamo custom node GIS2BIM_TransformCRS_epsg.dyf (Dynamo 2.10.1.3976)
# category: GIS2BIM.Coordinates
# Uses the API of http://epsg.io to transform Coordinate Reference Systems
# packages: GIS2BIM for Dynamo 2.x 0.11.24

code_block = CodeBlock()
# ---------- code_block.designscript (10 lines) ----------
"http://epsg.io/trans?";
"&s_srs=";
4326;
"&t_srs=";
3760;
"&x=";
-157.8619911;
"&y=";
21.3049475;
"&format=json&trans=1&callback=jsonpFunction";
# ----------------------------------------
SourceCRS = Input(SourceCRS: string = "4326")  # EPSG_code of the source Coordinate Reference System
TargetCRS = Input(TargetCRS: string)  # EPSG_code of the target Coordinate Reference System
xCoordinate = Input(xCoordinate: double)  # X-coordinate of the source Coordinate Reference System
GIS2BIM_DoubleToString = Custom[GIS2BIM_DoubleToString](CoordinateDouble=xCoordinate)  # package GIS2BIM for Dynamo 2.x; Converts a double to a string
yCoordinate = Input(yCoordinate: double)  # Y-coordinate of the source Coordinate Reference System
GIS2BIM_DoubleToString_2 = Custom[GIS2BIM_DoubleToString](CoordinateDouble=yCoordinate)
concat = String.Concat(string0=code_block.out0, string1=code_block.out1, string2=SourceCRS, string3=code_block.out3, string4=TargetCRS, string5=code_block.out5, string6=GIS2BIM_DoubleToString, string7=code_block.out7, string8=GIS2BIM_DoubleToString_2, string9=code_block.out9)
web_request = WebRequest(url=concat)
string = StringInput("\"")  # graph input
split = String.Split(str=web_request, separator0=string)
code_block_2 = CodeBlock { 3; 7; }
getItemAtIndex = List.GetItemAtIndex(list=split, index=code_block_2.out0)
toNumber = String.ToNumber(str=getItemAtIndex)
Xtransformed = Output(toNumber)  # "Xtransformed: double"
getItemAtIndex_2 = List.GetItemAtIndex(list=split, index=code_block_2.out1)
toNumber_2 = String.ToNumber(str=getItemAtIndex_2)
Ytransformed = Output(toNumber_2)  # "Ytransformed: double"
URL = Output(concat)  # "URL: string"
