# Dynamo custom node GIS2BIM_UnzipFile.dyf (Dynamo 2.10.1.3976)
# category: GIS2BIM.Helpers
# Unzip zip-file

FilePathZipFile = Input(FilePathZipFile: var[]..[])
DirectoryToExtractTo = Input(DirectoryToExtractTo: var[]..[])
python_script = Python(IN[0]=FilePathZipFile, IN[1]=DirectoryToExtractTo)  # IronPython2
# ---------- python_script.python (19 lines) ----------
import clr
import os
clr.AddReference("System.IO.Compression.FileSystem")
from System.IO.Compression import ZipFile

#The inputs to this node will be stored as a list in the IN variables.
dataEnteringNode = IN
tzip = IN[0]
tpath = IN[1]

ZipFile.ExtractToDirectory(tzip, tpath)
files = os.listdir(tpath)

filepaths = []
for i in files:
	filepaths.append(tpath + "/" + i)

#Assign your output to the OUT variable.
OUT = tpath, filepaths
# ----------------------------------------
code_block = CodeBlock(a=python_script) { a[0]; a[1]; }
Directory = Output(code_block.out0)
Files = Output(code_block.out1)
