# Dynamo custom node GIS2BIM_WMTSRequestAndImport.dyf (Dynamo 2.5.0.7460)
# category: GIS2BIM.DutchGEO
# total node with WMTS webrequest and import of image in view
# packages: GIS2BIM for Dynamo 2.x 0.11.16

Zoomlevel = Input(Zoomlevel: var[]..[])
WMTSScaleSetNetherlands = Custom[GIS2BIM.WMTSScaleSetNetherlands](Zoomlevel=Zoomlevel)  # package GIS2BIM for Dynamo 2.x; gives resolution, scaledenominator and number of tiles
Rdx = Input(Rdx: var[]..[])
Rdy = Input(Rdy: var[]..[])
WMTSZoomLevelTileRow = Custom[GIS2BIM.WMTSZoomLevelTileRow](Resolution=WMTSScaleSetNetherlands.Resolutie_m_pixel, Rdx=Rdx, Rdy=Rdy)  # package GIS2BIM for Dynamo 2.x; gives the tilerow and tilecolumn for the WMTS webrequest
pixelWidth = CodeBlock { 256; }
Boundingboxwidth = Input(Boundingboxwidth: var[]..[])
WMTSTileListFromBbox = Custom[GIS2BIM.WMTSTileListFromBbox](TileRow=WMTSZoomLevelTileRow.TileRow, TileColumn=WMTSZoomLevelTileRow.TileColumn, Resolution=WMTSScaleSetNetherlands.Resolutie_m_pixel, PixelWidth=pixelWidth, BboxWidthInMeters=Boundingboxwidth)  # package GIS2BIM for Dynamo 2.x; gives list of tilerows and tilecolums
Layer = Input(Layer: var[]..[])
WMTSGeoservicesLibraryNetherlands = Custom[GIS2BIM.WMTSGeoservicesLibraryNetherlands](TileRows=WMTSTileListFromBbox.TileRows, TileColumns=WMTSTileListFromBbox.TileColumns, Zoomlevel=WMTSScaleSetNetherlands.Zoomlevel, Layer=Layer)  # package GIS2BIM for Dynamo 2.x; library with webrequests of WMTS-services in the Netherlands
boolean = BoolSelector(true)  # graph input
TMS_WMTS_WebrequestAndCombineImages = Custom[GIS2BIM.TMS_WMTS_WebrequestAndCombineImages](URLlist=WMTSGeoservicesLibraryNetherlands, UniqueTileNumbersColumnX=WMTSTileListFromBbox.UniqueTileColumns, UniqueTileNumbersRowY=WMTSTileListFromBbox.UniqueTileRows, Pixels=pixelWidth, WMTSorTMS=boolean)  # package GIS2BIM for Dynamo 2.x; Webrequest for list of WMTS or TMS/Google webrequests for tiles. Combines them to 1 image.
Image = Output(TMS_WMTS_WebrequestAndCombineImages.Image)
View1 = Input(View1: var[]..[])
TemppathFileName = Input(TemppathFileName: var[]..[])
GIS2BIM_ImportImageInView = Custom[GIS2BIM_ImportImageInView](ImageWidthMeters=WMTSTileListFromBbox.TileWidthMetrs, view=View1, ImagePath=TemppathFileName, DeltaX=WMTSZoomLevelTileRow.DeltaXmm, DeltaY=WMTSZoomLevelTileRow.DeltaYmm)  # package GIS2BIM for Dynamo 2.x; Import rasterimage in view
writeToFile = Image.WriteToFile(path=TemppathFileName, image=TMS_WMTS_WebrequestAndCombineImages.Image)
