# Dynamo custom node GIS2BIM_WebrequestCredentials.dyf (Dynamo 1.3.3.4111)
# category: GIS2BIM.Helpers
# Webrequest with username and password

url = Input()
username = Input()
password = Input()
python_script = Python(IN[0]=url, IN[1]=username, IN[2]=password)
# ---------- python_script.python (18 lines) ----------
import sys
sys.path.append("C:\Program Files (x86)\IronPython 2.7\Lib")

from System.Net import HttpWebRequest, NetworkCredential
from System.IO import StreamReader


url = IN[0]
user = IN[1]
pword = IN[2]

request = HttpWebRequest.Create(url)
request.Method = "GET"
request.Credentials = NetworkCredential(user,pword)
response = request.GetResponse()

result = StreamReader(response.GetResponseStream()).ReadToEnd()
OUT = result
# ----------------------------------------
result = Output(python_script)
