# Dynamo custom node GIS2BIM_XMLXPath.dyf (Dynamo 1.3.3.4111)
# category: GIS2BIM.Helpers
# Run an XPathquery on an xml-string

XMLString = Input(XMLString: string)
XPathStrings = Input()
python_script = Python(IN[0]=XMLString, IN[1]=XPathStrings)
# ---------- python_script.python (27 lines) ----------
import clr
clr.AddReference('ProtoGeometry')
from Autodesk.DesignScript.Geometry import *

import sys
sys.path.append("C:\Program Files (x86)\IronPython 2.7\Lib")

import xml.etree.ElementTree as ET
xml = IN[0]
xpathlist = IN[1]

root = ET.fromstring(xml)

xpathsfound = []

for i in xpathlist:
	xpathsfound.append(root.findall(i))
	
xpathresult = []
for i in range(len(xpathsfound)):
	xtext = []
	for j in range(len(xpathsfound[0])):
		try: xtext.append(xpathsfound[i][j].text)
		except: xtext.append("_none")
	xpathresult.append(xtext)

OUT = xpathresult
# ----------------------------------------
Result = Output(python_script)
