# Dynamo custom node GIS2BIM.WFSBGTGeometry.dyf (Dynamo 1.3.3.4111)
# category: GIS2BIM.DutchGEO
# Returns BGT-curves and metadata using the beta WFS BGT method.

rdx = Input()
rdy = Input()
boundingbox = Input()
code_block = CodeBlock(rdx=rdx, rdy=rdy, BoundingBoxWidth=boundingbox) { rdx; rdy; BoundingBoxWidth; }
bgt_lagen = CodeBlock()
# ---------- bgt_lagen.designscript (17 lines) ----------
"bgt:begroeidterreindeel";
"bgt:functioneelgebied";
"bgt:gebouwinstallatie";
"bgt:kunstwerkdeel";
"bgt:onbegroeidterreindeel";
"bgt:ondersteunendwaterdeel";
"bgt:ondersteunendwegdeel";
"bgt:ongeclassifiseerdobject";
"bgt:overbruggingsdeel";
"bgt:overigbouwwerk";
"bgt:overigescheiding";
"bgt:pand.gml";
"bgt:scheiding";
"bgt:spoor";
"bgt:tunneldeel";
"bgt:waterdeel";
"bgt:wegdeel";
# ----------------------------------------
create = List.Create(bgt_lagen.out0, bgt_lagen.out1, bgt_lagen.out2, bgt_lagen.out3, bgt_lagen.out4, bgt_lagen.out5, bgt_lagen.out6, bgt_lagen.out7, bgt_lagen.out8, bgt_lagen.out9, bgt_lagen.out10, bgt_lagen.out11, bgt_lagen.out12, bgt_lagen.out13, bgt_lagen.out14, bgt_lagen.out15, bgt_lagen.out16)
code_block_2 = CodeBlock()
# ---------- code_block_2.designscript (2 lines) ----------
"https://geodata.nationaalgeoregister.nl/beta/bgt/wfs?service=wfs&version=2.0.0&request=GetFeature&typeNames=";
"&bbox=";
# ----------------------------------------
createBoundingBox = Custom[GIS2BIM.CreateBoundingBox](CoordinateX=code_block.rdx, CoordinateY=code_block.rdy, BoxWidth=code_block.BoundingBoxWidth, BoxHeight=code_block.BoundingBoxWidth)  # create boundingboxstring for webrequests based on coördinates and dimensions
concat = String.Concat(code_block_2.out0, arg2=code_block_2.out1, arg3=createBoundingBox.Boxstring)  # unwired: arg1
map = List.Map(list=create, f_x=concat)
web_request = WebRequest(map)

# group: XPATH XML
string = StringInput(".//{http://www.opengis.net/gml/3.2}posList")
string_2 = StringInput(".//{http://bgt.wfs.geonovum.nl}bgt-fysiekVoorkomen")
string_3 = StringInput(".//{http://bgt.wfs.geonovum.nl}plus-fysiekvoorkomen")
string_4 = StringInput(".//{http://bgt.wfs.geonovum.nl}bgt-functie")
create_2 = List.Create(string, string_2, string_3, string_4)
XMLXPath = Custom[GIS2BIM.XMLXPath](XPathStrings=create_2)  # Run an XPathquery on an xml-string; unwired: XMLString

map_2 = List.Map(list=web_request, f_x=XMLXPath)
code_block_3 = CodeBlock(code_block.rdx, code_block.rdy, map_2)
# ---------- code_block_3.designscript (18 lines) ----------
rdx = t9;
rdy = t10;
t11 = DSCore.List.FirstItem(t12@-3<1>);
t13 = String.Split(t11, {" "});
t14 = String.ToNumber(t13);
t15 = DSCore.List.TakeEveryNthItem(t14@-2<1>, 2, 1);
t16 = DSCore.List.TakeEveryNthItem(t14@-2<1>, 2, 0);
rdx1 = rdx;
rdxcoordinates = t15;
rdy1 = rdy;
rdycoordinates = t16;
Uconvert = 1000;
LocalCoordinatesX = Uconvert * (rdx1 - rdxcoordinates);
LocalCoordinatesY = Uconvert * (rdy1 - rdycoordinates);
point1 = Point.ByCoordinates(LocalCoordinatesX, LocalCoordinatesY);
point2 = Point.PruneDuplicates(point1<1L>, 0.001);
polyCurve1 = PolyCurve.ByPoints(point2, false);
t3 = Math.Round(5.3, 1);
# ----------------------------------------
code_block_4 = CodeBlock(PolycurvesBGT=code_block_3.polyCurve1) { PolycurvesBGT; }
Polycurves_BGT = Output(code_block_4)
code_block_5 = CodeBlock(CurveNamesBGT=create) { CurveNamesBGT; }
CurveNames_BGT = Output(code_block_5)
code_block_6 = CodeBlock(t4=XMLXPath)
# ---------- code_block_6.designscript (3 lines) ----------
t5 = DSCore.List.GetItemAtIndex(t4@-3<1>, 1);
t6 = DSCore.List.GetItemAtIndex(t4@-3<1>, 2);
t7 = DSCore.List.GetItemAtIndex(t4@-3<1>, 3);
# ----------------------------------------
create_3 = List.Create(code_block_6.t5, code_block_6.t6, code_block_6.t7)
code_block_7 = CodeBlock(MetadataBGT=create_3) { MetadataBGT; }
Metadata_Polycurves = Output(code_block_7)
bgt_lagen_2 = CodeBlock()
# ---------- bgt_lagen_2.designscript (11 lines) ----------
"bgt:bak";
"bgt:bord";
"bgt:kast";
"bgt:mast";
"bgt:paal";
"bgt:put";
"bgt:sensor";
"bgt:straatmeubilair";
"bgt:vegetatieobject";
"bgt:waterinrichtingselement";
"bgt:wegrichtingselement";
# ----------------------------------------
create_4 = List.Create(bgt_lagen_2.out0, bgt_lagen_2.out1, bgt_lagen_2.out2, bgt_lagen_2.out3, bgt_lagen_2.out4, bgt_lagen_2.out5, bgt_lagen_2.out6, bgt_lagen_2.out7, bgt_lagen_2.out8, bgt_lagen_2.out9, bgt_lagen_2.out10)
map_3 = List.Map(list=create_4, f_x=concat)
web_request_2 = WebRequest(map_3)

# group: XPATH XML
string_5 = StringInput(".//{http://www.opengis.net/gml/3.2}pos")
string_6 = StringInput(".//{http://bgt.wfs.geonovum.nl}plus-type")
string_7 = StringInput(".//{http://bgt.wfs.geonovum.nl}bgt-type")
create_5 = List.Create(string_5, string_6, string_7)
XMLXPath_2 = Custom[GIS2BIM.XMLXPath](XPathStrings=create_5)  # unwired: XMLString

map_4 = List.Map(list=web_request_2, f_x=XMLXPath_2)
code_block_8 = CodeBlock(t9=code_block.rdx, t10=code_block.rdy, t12=map_4)
# ---------- code_block_8.designscript (15 lines) ----------
rdx = t9;
rdy = t10;
t11 = DSCore.List.FirstItem(t12@-3<1>);
t13 = String.Split(t11, {" "});
t14 = String.ToNumber(t13);
t15 = DSCore.List.TakeEveryNthItem(t14@-2<1>, 2, 1);
t16 = DSCore.List.TakeEveryNthItem(t14@-2<1>, 2, 0);
rdx1 = rdx;
rdxcoordinates = t15;
rdy1 = rdy;
rdycoordinates = t16;
Uconvert = 1000;
LocalCoordinatesX = Uconvert * (rdx1 - rdxcoordinates);
LocalCoordinatesY = Uconvert * (rdy1 - rdycoordinates);
point1 = Point.ByCoordinates(LocalCoordinatesX, LocalCoordinatesY);
# ----------------------------------------
code_block_9 = CodeBlock(PointsBGT=code_block_8.point1) { PointsBGT; }
Points_BGT = Output(code_block_9)
code_block_10 = CodeBlock { PointNamesBGT; }  # unwired: PointNamesBGT
PointNames_BGT = Output(code_block_10)
code_block_11 = CodeBlock { 1; 2; }
getItemAtIndex = List.GetItemAtIndex(list=map_4@L3, index=code_block_11.out0)
getItemAtIndex_2 = List.GetItemAtIndex(list=map_4@L3, index=code_block_11.out1)
create_6 = List.Create(getItemAtIndex, getItemAtIndex_2)
code_block_12 = CodeBlock(MetadataBGT=create_6) { MetadataBGT; }
Metadata_BGT = Output(code_block_12)
code_block_13 = CodeBlock { "bgt:openbareruimtelabel"; }
create_7 = List.Create(code_block_13)
map_5 = List.Map(list=create_7, f_x=concat)
web_request_3 = WebRequest(map_5)
code_block_14 = CodeBlock(a=web_request_3) { a[0]; }
string_8 = StringInput(".//{http://bgt.wfs.geonovum.nl}hoek")

# group: XPATH XML
string_9 = StringInput(".//{http://www.opengis.net/gml/3.2}pos")
string_10 = StringInput(".//{http://bgt.wfs.geonovum.nl}openbareruimtetype")
string_11 = StringInput(".//{http://bgt.wfs.geonovum.nl}openbareRuimteNaam")
create_8 = List.Create(string_9, string_10, string_11, string_8)
XMLXPath_3 = Custom[GIS2BIM.XMLXPath](XMLString=code_block_14, XPathStrings=create_8)

code_block_15 = CodeBlock(t9=code_block.rdx, t10=code_block.rdy, t12=XMLXPath_3)
# ---------- code_block_15.designscript (15 lines) ----------
rdx = t9;
rdy = t10;
t11 = DSCore.List.FirstItem(t12);
t13 = String.Split(t11, {" "});
t14 = String.ToNumber(t13);
t15 = DSCore.List.TakeEveryNthItem(t14@-2<1>, 2, 1);
t16 = DSCore.List.TakeEveryNthItem(t14@-2<1>, 2, 0);
rdx1 = rdx;
rdxcoordinates = t15;
rdy1 = rdy;
rdycoordinates = t16;
Uconvert = 1000;
LocalCoordinatesX = Uconvert * (rdx1 - rdxcoordinates);
LocalCoordinatesY = Uconvert * (rdy1 - rdycoordinates);
point1 = Point.ByCoordinates(LocalCoordinatesX, LocalCoordinatesY);
# ----------------------------------------
code_block_16 = CodeBlock(PointsOpenbareruimtelabel=code_block_15.point1) { PointsOpenbareruimtelabel; }
Points_Openbareruimtelabel = Output(code_block_16)
code_block_17 = CodeBlock(a=XMLXPath_3) { a[1]; a[2]; a[3]; }
code_block_18 = CodeBlock(RuimteTypeOpenbareruimtelabel=code_block_17.out0) { RuimteTypeOpenbareruimtelabel; }
RuimteType_Openbareruimtelabel = Output(code_block_18)
code_block_19 = CodeBlock(RuimteNaamOpenbareruimtelabel=code_block_17.out1) { RuimteNaamOpenbareruimtelabel; }
RuimteNaam_Openbareruimtelabel = Output(code_block_19)
code_block_20 = CodeBlock(HoekOpenbareruimtelabel=code_block_17.out2) { HoekOpenbareruimtelabel; }
Hoek_Openbareruimtelabel = Output(code_block_20)
