# Dynamo graph GoogleEarthTileMapServiceHighResolution.dyn (Dynamo 1.3.1.1736)

getRevitSiteLocation = Custom[GIS2BIM.GetRevitSiteLocation]()  # Gets the properties of the current Site Location of the active Revit Project
doubleToString = Custom[GIS2BIM.DoubleToString](CoordinateDouble=getRevitSiteLocation.Lat)  # Converts a double to a string
doubleToString_2 = Custom[GIS2BIM.DoubleToString](CoordinateDouble=getRevitSiteLocation.Lon)
desired_width_in_meters = CodeBlock { 300; }
createBoundingBoxLATLONG = Custom[GIS2BIM.CreateBoundingBoxLATLONG](Lat=doubleToString, Long=doubleToString_2, WidthMeters=desired_width_in_meters)  # create boundingbox with from lat/long coordinate in degrees
zoomlevel = CodeBlock { 19; }
TMSGetTileNumbersFromBboxLATLON = Custom[GIS2BIM.TMSGetTileNumbersFromBboxLATLON](West=createBoundingBoxLATLONG.West, East=createBoundingBoxLATLONG.East, North=createBoundingBoxLATLONG.North, South=createBoundingBoxLATLONG.South, Zoomlevel=zoomlevel, BoundingboxWidth=desired_width_in_meters)  # Get the Tilenumbers in X and Y in the TMS Webprotocol based on a given Boundingbox in LAT/LON
current = Document.Current()
activeView = Document.ActiveView(current)
TMSWebServices = Custom[GIS2BIM.TMSWebServices](TileX=TMSGetTileNumbersFromBboxLATLON.TileX, TileY=TMSGetTileNumbersFromBboxLATLON.TileY, Zoomlevel=zoomlevel)  # Library With TMS Webservices
boolean = BoolSelector(false)
TMS_WMTS_WebrequestAndCombineImages = Custom[GIS2BIM.TMS_WMTS_WebrequestAndCombineImages](URLlist=TMSWebServices, UniqueTileNumbersColumnX=TMSGetTileNumbersFromBboxLATLON.TileXUnique, UniqueTileNumbersRowY=TMSGetTileNumbersFromBboxLATLON.TileYUnique, WMTSorTMS=boolean)  # Webrequest for list of WMTS or TMS/Google webrequests for tiles. Combines them to 1 image.
watch_image = WatchImageCore(TMS_WMTS_WebrequestAndCombineImages.Image)
temp_filepath_image = CodeBlock { "C:/TEMP/map24.jpg"; }
systemDrawingBitmapToJPG = Custom[GIS2BIM.SystemDrawingBitmapToJPG](SystemDrawingBitmap=watch_image, FileName=temp_filepath_image)  # frozen; Save an System.Drawing.Bitmap object as a jpg-file
importImageInView = Custom[GIS2BIM.ImportImageInView](ImageWidthMeters=TMSGetTileNumbersFromBboxLATLON.WidthM, View=activeView, ImagePath=systemDrawingBitmapToJPG, DeltaX=TMSGetTileNumbersFromBboxLATLON.DeltaXmm, DeltaY=TMSGetTileNumbersFromBboxLATLON.DeltaYmm)  # Import rasterimage in view
code_block = CodeBlock { "wattstraat"; "17"; "zwijndrecht"; "the netherlands"; }
geoCodingGoogleAPI = Custom[GIS2BIM.GeoCodingGoogleAPI](Streetname=code_block.out0, Housenumber=code_block.out1, Place=code_block.out2, Country=code_block.out3)  # frozen; gets coordinate from adress with google API
setRevitSiteLocation = Custom[GIS2BIM.SetRevitSiteLocation](lat=geoCodingGoogleAPI.Latitude, lon=geoCodingGoogleAPI.Longitude)  # Sets the properties of the current Site Location of the active Revit Project
