# Dynamo graph BGT-Lines.dyn (Dynamo 1.3.2.2480)

code_block = CodeBlock { 105600; 425000; }
getMortonCodeCoordinate = Custom[GIS2BIM.GetMortonCodeCoordinate](X=code_block.out0, Y=code_block.out1)  # Get mortoncode given 2 coordinates and tiledimension
TEMPfolder = StringInput("C:\TEMP")
code_block_2 = CodeBlock { 15892; }
downloadBGTdata = Custom[GIS2BIM.DownloadBGTdata](Mortoncode=code_block_2)  # Download BGT-data(dutch GIS-information); unwired: Directory
unzipFile = Custom[GIS2BIM.UnzipFile](FilePathZipFile=downloadBGTdata.Location, DirectoryToExtractTo=downloadBGTdata.Directory)  # Unzip zip-file
code_block_3 = CodeBlock { Directory; }
code_block_4 = CodeBlock { FilledRegionGreen1; }  # unwired: FilledRegionGreen1
code_block_5 = CodeBlock { FilledRegionGreen2; }  # unwired: FilledRegionGreen2
code_block_6 = CodeBlock { "C:/TEMP/15892"; }

# group: GML INPUT
bgt_lagen = CodeBlock()
# ---------- bgt_lagen.designscript (13 lines) ----------
"bgt_bak.gml";
"bgt_bord.gml";
"bgt_kast.gml";
"bgt_mast.gml";
"bgt_ongeclassificeerdobject.gml";
"bgt_openbareruimtelabel.gml";
"bgt_vegetatieobject.gml";
"bgt_paal.gml";
"bgt_put.gml";
"bgt_sensor.gml";
"bgt_straatmeubilair.gml";
"bgt_waterinrichtingselement.gml";
"bgt_weginrichtingselement.gml";
# ----------------------------------------
create = List.Create(bgt_lagen.out0, bgt_lagen.out1, bgt_lagen.out2, bgt_lagen.out3, bgt_lagen.out4, bgt_lagen.out5, bgt_lagen.out6, bgt_lagen.out7, bgt_lagen.out8, bgt_lagen.out9, bgt_lagen.out10, bgt_lagen.out11, bgt_lagen.out12)
string = StringInput("/")
concat = String.Concat(code_block_6, string)  # unwired: arg2
map = List.Map(list=create, f_x=concat)
bgt_lagen_2 = CodeBlock()
# ---------- bgt_lagen_2.designscript (17 lines) ----------
"bgt_overigbouwwerk.gml";
"bgt_begroeidterreindeel.gml";
"bgt_functioneelgebied.gml";
"bgt_gebouwinstallatie.gml";
"bgt_kunstwerkdeel.gml";
"bgt_onbegroeidterreindeel.gml";
"bgt_ondersteunendwegdeel.gml";
"bgt_overigescheiding.gml";
"bgt_scheiding.gml";
"bgt_spoor.gml";
"bgt_tunneldeel.gml";
"bgt_kunstwerkdeel.gml";
"bgt_overbruggingsdeel.gml";
"bgt_wegdeel.gml";
"bgt_ondersteunendwaterdeel.gml";
"bgt_waterdeel.gml";
"bgt_pand.gml";
# ----------------------------------------
create_2 = List.Create(bgt_lagen_2.out0, bgt_lagen_2.out1, bgt_lagen_2.out2, bgt_lagen_2.out3, bgt_lagen_2.out4, bgt_lagen_2.out5, bgt_lagen_2.out6, bgt_lagen_2.out7, bgt_lagen_2.out8, bgt_lagen_2.out9, bgt_lagen_2.out10, bgt_lagen_2.out11, bgt_lagen_2.out12, bgt_lagen_2.out13, bgt_lagen_2.out14, bgt_lagen_2.out15, bgt_lagen_2.out16)
map_2 = List.Map(list=create_2, f_x=concat)

getSharedCoordinate = Custom[GIS2BIM.GetSharedCoordinate]()  # Get the current shared coordinate
code_block_7 = CodeBlock(RDx=getSharedCoordinate.RdxMeters) { RDx; }
code_block_8 = CodeBlock(RDy=getSharedCoordinate.RdyMeters) { RDy; }
width = CodeBlock { 150; }
code_block_9 = CodeBlock(BoundingboxWidth=width) { BoundingboxWidth; }

# group: CREATE BOUNDINGBOX AND FILTER GML
string_2 = StringInput(".//{http://www.opengis.net/gml}posList")
filterGML = Custom[GIS2BIM.FilterGML](xPATH=string_2, CoordinateX=code_block_7, CoordinateY=code_block_8, Boundingbox=code_block_9)  # filter GML-file based on boundingbox; unwired: GMLFile
map_3 = List.Map(list=map, f_x=filterGML.Points)
map_4 = List.Map(list=map_2, f_x=filterGML.Polycurves)

# group: PLACE TREES
code_block_10 = CodeBlock { 6; }
getItemAtIndex = List.GetItemAtIndex(list=map_3, index=code_block_10)
flatten = Flatten(getItemAtIndex)

# group: 2D SETTINGS
# note: Panden;
# 0 bgt_overigbouwwerk;
# Groen;
# 1 bgt_begroeidterreindeel;
# Lijnen(aparte lagen);
# 2 bgt_functioneelgebied;
# 3 bgt_gebouwinstallatie;
# 4 bgt_kunstwerkdeel;
# 5 bgt_onbegroeidterreindeel;
# 6 bgt_ondersteunendwegdeel;
# 7 bgt_overigescheiding;
# 8 bgt_scheiding;
# 9 bgt_spoor;
# 10 bgt_tunneldeel;
# Wegen bruggen en kunstwerken;
# 11 bgt_kunstwerkdeel;
# 12 bgt_overbruggingsdeel;
# 13 bgt_wegdeel;
# Water;
# 14 bgt_ondersteunendwaterdeel;
# 15 bgt_waterdeel;
# Labels;
# 16 bgt_openbareruimtelabel;
# Puntobject;
# 17 bgt_vegetatieobject;
tree = FamilyTypes("90_DI_boom:90_DI_boom")

code_block_11 = CodeBlock(DetailcomponentTree=tree) { DetailcomponentTree; }
current = Document.Current()
activeView = Document.ActiveView(current)
code_block_12 = CodeBlock(View=activeView) { View; }

# group: clockwork familyinstance by point in view
code_block_13 = CodeBlock(item=flatten) { Flatten({item}); }
python_script = Python(IN[0]=code_block_13, IN[1]=code_block_11, IN[2]=code_block_12)
# ---------- python_script.python (31 lines) ----------
import clr
clr.AddReference('RevitAPI')
from Autodesk.Revit.DB import *

clr.AddReference("RevitNodes")
import Revit
clr.ImportExtensions(Revit.Elements)
clr.ImportExtensions(Revit.GeometryConversion)

clr.AddReference("RevitServices")
import RevitServices
from RevitServices.Persistence import DocumentManager
from RevitServices.Transactions import TransactionManager

doc = DocumentManager.Instance.CurrentDBDocument
points = UnwrapElement(IN[0])
famtype = UnwrapElement(IN[1])
lvl = UnwrapElement(IN[2])
elementlist = list()
counter = 0

TransactionManager.Instance.EnsureInTransaction(doc)
# make sure familysymbol is active
if famtype.IsActive == False:
	famtype.Activate()
	doc.Regenerate()
for point in points:
	newobj = doc.Create.NewFamilyInstance(point.ToXyz(),famtype,lvl)
	elementlist.append(newobj.ToDSType(False))
TransactionManager.Instance.TransactionTaskDone()
OUT = elementlist
# ----------------------------------------
python_script_2 = Python(IN[0]=flatten, IN[1]=python_script)
# ---------- python_script_2.python (4 lines) ----------
check = IN[0]
items = IN[1]
if isinstance(check, (list)): OUT = items
else: OUT = items[0]
# ----------------------------------------

# note: It will take quite some time to run this node. It can take 10 minutes. When you run parts of it it will be quicker. Open the file: GIStoBIM1.rvt from the package-folder to use the standard filled regions and linetypes.
setSharedCoordinate = Custom[GIS2BIM.SetSharedCoordinate](X=code_block.out0, Y=code_block.out1)  # Set shared coordinate/project basepoint
code_block_14 = CodeBlock(View=activeView) { View; }
code_block_15 = CodeBlock(Polycurves=map_4) { Polycurves; }
code_block_16 = CodeBlock { "."; }
split = String.Split(create_2, code_block_16)
firstItem = List.FirstItem()  # unwired: arg0
map_5 = List.Map(list=split, f_x=firstItem)

# group: DETAILLINES
code_block_17 = CodeBlock(t2=code_block_15, t4=map_5) { t3 = DSCore.List.GetItemAtIndex(t2, 0); t5 = DSCore.List.GetItemAtIndex(t4, 0); }
createDetailLinesFromPolygons = Custom[GIS2BIM.CreateDetailLinesFromPolygons](View=code_block_14, PolyCurves=code_block_17.t3, Linestyle=code_block_17.t5)  # Create detaillines from polygons in a view
code_block_18 = CodeBlock(t2=code_block_15, t4=map_5) { t3 = DSCore.List.GetItemAtIndex(t2, 1); t5 = DSCore.List.GetItemAtIndex(t4, 1); }
createDetailLinesFromPolygons_2 = Custom[GIS2BIM.CreateDetailLinesFromPolygons](View=code_block_14, PolyCurves=code_block_18.t3, Linestyle=code_block_18.t5)
code_block_19 = CodeBlock(t2=code_block_15, t4=map_5) { t3 = DSCore.List.GetItemAtIndex(t2, 2); t5 = DSCore.List.GetItemAtIndex(t4, 2); }
createDetailLinesFromPolygons_3 = Custom[GIS2BIM.CreateDetailLinesFromPolygons](View=code_block_14, PolyCurves=code_block_19.t3, Linestyle=code_block_19.t5)
code_block_20 = CodeBlock(t2=code_block_15, t4=map_5) { t3 = DSCore.List.GetItemAtIndex(t2, 3); t5 = DSCore.List.GetItemAtIndex(t4, 3); }
createDetailLinesFromPolygons_4 = Custom[GIS2BIM.CreateDetailLinesFromPolygons](View=code_block_14, PolyCurves=code_block_20.t3, Linestyle=code_block_20.t5)
code_block_21 = CodeBlock(t2=code_block_15, t4=map_5) { t3 = DSCore.List.GetItemAtIndex(t2, 4); t5 = DSCore.List.GetItemAtIndex(t4, 4); }
createDetailLinesFromPolygons_5 = Custom[GIS2BIM.CreateDetailLinesFromPolygons](View=code_block_14, PolyCurves=code_block_21.t3, Linestyle=code_block_21.t5)
code_block_22 = CodeBlock(t2=code_block_15, t4=map_5) { t3 = DSCore.List.GetItemAtIndex(t2, 5); t5 = DSCore.List.GetItemAtIndex(t4, 5); }
createDetailLinesFromPolygons_6 = Custom[GIS2BIM.CreateDetailLinesFromPolygons](View=code_block_14, PolyCurves=code_block_22.t3, Linestyle=code_block_22.t5)
code_block_23 = CodeBlock(t2=code_block_15, t4=map_5) { t3 = DSCore.List.GetItemAtIndex(t2, 6); t5 = DSCore.List.GetItemAtIndex(t4, 6); }
createDetailLinesFromPolygons_7 = Custom[GIS2BIM.CreateDetailLinesFromPolygons](View=code_block_14, PolyCurves=code_block_23.t3, Linestyle=code_block_23.t5)
code_block_24 = CodeBlock(t2=code_block_15, t4=map_5) { t3 = DSCore.List.GetItemAtIndex(t2, 7); t5 = DSCore.List.GetItemAtIndex(t4, 7); }
createDetailLinesFromPolygons_8 = Custom[GIS2BIM.CreateDetailLinesFromPolygons](View=code_block_14, PolyCurves=code_block_24.t3, Linestyle=code_block_24.t5)
code_block_25 = CodeBlock(t2=code_block_15, t4=map_5) { t3 = DSCore.List.GetItemAtIndex(t2, 8); t5 = DSCore.List.GetItemAtIndex(t4, 8); }
createDetailLinesFromPolygons_9 = Custom[GIS2BIM.CreateDetailLinesFromPolygons](View=code_block_14, PolyCurves=code_block_25.t3, Linestyle=code_block_25.t5)
code_block_26 = CodeBlock(t2=code_block_15, t4=map_5) { t3 = DSCore.List.GetItemAtIndex(t2, 9); t5 = DSCore.List.GetItemAtIndex(t4, 9); }
createDetailLinesFromPolygons_10 = Custom[GIS2BIM.CreateDetailLinesFromPolygons](View=code_block_14, PolyCurves=code_block_26.t3, Linestyle=code_block_26.t5)
code_block_27 = CodeBlock(t2=code_block_15, t4=map_5) { t3 = DSCore.List.GetItemAtIndex(t2, 10); t5 = DSCore.List.GetItemAtIndex(t4, 10); }
createDetailLinesFromPolygons_11 = Custom[GIS2BIM.CreateDetailLinesFromPolygons](View=code_block_14, PolyCurves=code_block_27.t3, Linestyle=code_block_27.t5)
code_block_28 = CodeBlock(t2=code_block_15, t4=map_5) { t3 = DSCore.List.GetItemAtIndex(t2, 11); t5 = DSCore.List.GetItemAtIndex(t4, 11); }
createDetailLinesFromPolygons_12 = Custom[GIS2BIM.CreateDetailLinesFromPolygons](View=code_block_14, PolyCurves=code_block_28.t3, Linestyle=code_block_28.t5)
code_block_29 = CodeBlock(t2=code_block_15, t4=map_5) { t3 = DSCore.List.GetItemAtIndex(t2, 12); t5 = DSCore.List.GetItemAtIndex(t4, 12); }
createDetailLinesFromPolygons_13 = Custom[GIS2BIM.CreateDetailLinesFromPolygons](View=code_block_14, PolyCurves=code_block_29.t3, Linestyle=code_block_29.t5)
code_block_30 = CodeBlock(t2=code_block_15, t4=map_5) { t3 = DSCore.List.GetItemAtIndex(t2, 13); t5 = DSCore.List.GetItemAtIndex(t4, 13); }
createDetailLinesFromPolygons_14 = Custom[GIS2BIM.CreateDetailLinesFromPolygons](View=code_block_14, PolyCurves=code_block_30.t3, Linestyle=code_block_30.t5)
code_block_31 = CodeBlock(t2=code_block_15, t4=map_5) { t3 = DSCore.List.GetItemAtIndex(t2, 14); t5 = DSCore.List.GetItemAtIndex(t4, 14); }
createDetailLinesFromPolygons_15 = Custom[GIS2BIM.CreateDetailLinesFromPolygons](View=code_block_14, PolyCurves=code_block_31.t3, Linestyle=code_block_31.t5)
code_block_32 = CodeBlock(t2=code_block_15, t4=map_5) { t3 = DSCore.List.GetItemAtIndex(t2, 15); t5 = DSCore.List.GetItemAtIndex(t4, 15); }
createDetailLinesFromPolygons_16 = Custom[GIS2BIM.CreateDetailLinesFromPolygons](View=code_block_14, PolyCurves=code_block_32.t3, Linestyle=code_block_32.t5)
code_block_33 = CodeBlock(t2=code_block_15, t4=map_5) { t3 = DSCore.List.GetItemAtIndex(t2, 16); t5 = DSCore.List.GetItemAtIndex(t4, 16); }
createDetailLinesFromPolygons_17 = Custom[GIS2BIM.CreateDetailLinesFromPolygons](View=code_block_14, PolyCurves=code_block_33.t3, Linestyle=code_block_33.t5)

# group: FILLED REGION PAND
code_block_34 = CodeBlock(t2=code_block_15) { t3 = DSCore.List.GetItemAtIndex(t2, 16); }
explode = Geometry.Explode(code_block_34)
select_filled_region_type = FilledRegionTypes("FP_DP_90_pand")
byCurves = FilledRegion.ByCurves(code_block_14, explode, select_filled_region_type)

# group: OPENBARE RUIMTE LABELS
code_block_35 = CodeBlock { 5; }
getItemAtIndex_2 = List.GetItemAtIndex(list=map_3, index=code_block_35)
flatten_2 = Flatten(getItemAtIndex_2)
string_3 = StringInput(".//{http://www.opengis.net/gml}POS")

getItemAtIndex_3 = List.GetItemAtIndex(list=map, index=code_block_35)

# group (continued): OPENBARE RUIMTE LABELS
filterGML_2 = Custom[GIS2BIM.FilterGML](GMLFile=getItemAtIndex_3, xPATH=string_3, CoordinateX=code_block_7, CoordinateY=code_block_8, Boundingbox=code_block_9)

createPointFromGML = Custom[GIS2BIM.CreatePointFromGML]()  # Create Points from space seperated GML; unwired: XML, ModX, ModY
