# Dynamo graph Bestemmingsplan.dyn (Dynamo 1.3.1.1736)

# group: INPUT
code_block = CodeBlock { "Dordrecht"; "lange geldersekade"; "2"; }
boundingboxwidth_m = CodeBlock { 250; }
views = Views("Level 1")
code_block_2 = CodeBlock { "C:/TEMP/"; }
nameArialPhoto = CodeBlock { "bouwvlakbestemmingsplan"; }

# group: GET GEOSERVICES
getLocationdataNetherlands = Custom[GIS2BIM.GetLocationdataNetherlands](City=code_block.out0, Streetname=code_block.out1, Housenumber=code_block.out2)  # Gives locationdata based on an adress in the Netherlands
createBoundingBox = Custom[GIS2BIM.CreateBoundingBox](CoordinateX=getLocationdataNetherlands.RDcoordinate_X_meters, CoordinateY=getLocationdataNetherlands.RDcoordinate_Y_meters, BoxWidth=boundingboxwidth_m, BoxHeight=boundingboxwidth_m)  # create boundingboxstring for webrequests based on coördinates and dimensions
geoservicesLibraryNetherlands = Custom[GIS2BIM.GeoservicesLibraryNetherlands](BoundingBox=createBoundingBox)  # Library with multiple webadresses which can be used for WFS and WMS webrequests

# group: BESTEMMINGSPLAN
webrequestWMS = Custom[GIS2BIM.WebrequestWMS](WMSwebrequest=geoservicesLibraryNetherlands.10_bestemmingsplan_bouwvlak_WMS, Boundingboxwidth=boundingboxwidth_m, View=views, Tempfolder=code_block_2, Filename=nameArialPhoto)  # imports the result(image) of a webrequest based on WMS-protocol into a view in Revit
watch_image = WatchImageCore(webrequestWMS)

setSharedCoordinate = Custom[GIS2BIM.SetSharedCoordinate](X=getLocationdataNetherlands.RDcoordinate_X_meters, Y=getLocationdataNetherlands.RDcoordinate_Y_meters)  # Set shared coordinate/project basepoint
sendTo = Custom[Clipboard.SendTo](str=geoservicesLibraryNetherlands.10_bestemmingsplan_bouwvlak_WMS)  # Copies a string to the clipboard.
