# Dynamo graph Czech Republic Cadastre.dyn (Dynamo 1.3.1.1736)

code_block = CodeBlock { "5514"; }
searchCRS = Custom[GIS2BIM.SearchCRS](EPSG_Code=code_block)  # Search for a Coordinate Reference System
code_block_2 = CodeBlock { Application.Document.Current.ActiveView; }
code_block_3 = CodeBlock { "4326"; }
code_block_4 = CodeBlock { "14.42"; "50.087"; }
transformCRS_epsg = Custom[GIS2BIM.TransformCRS_epsg](sourceCRS=code_block_3, targetCRS=code_block, xCoordinate=code_block_4.out0, yCoordinate=code_block_4.out1)  # Uses the API of http://epsg.io to transform Coordinate Reference Systems
boundingboxWidth = CodeBlock { 200; }
createBoundingBox = Custom[GIS2BIM.CreateBoundingBox](CoordinateX=transformCRS_epsg.Xtransformed, CoordinateY=transformCRS_epsg.Ytransformed, BoxWidth=boundingboxWidth, BoxHeight=boundingboxWidth)  # create boundingboxstring for webrequests based on coördinates and dimensions
czechRepublicGeoservicesLibrary = Custom[GIS2BIM.CzechRepublicGeoservicesLibrary](Boundingboxstring=createBoundingBox.Boxstring)  # Geoservices in the Czech Republic
code_block_5 = CodeBlock { "Thin Lines"; "Hidden Lines"; }

# group: CADASTRE PARCELS
web_request = WebRequest(czechRepublicGeoservicesLibrary.Cadastral_Parcel_OGC_WFS)
createPointsPolygonFromGMLxy = Custom[GIS2BIM.CreatePointsPolygonFromGMLxy](XML=web_request, DeltaX=transformCRS_epsg.Xtransformed, DeltaY=transformCRS_epsg.Ytransformed)  # Create point and polygons from a GML-file
createDetailLinesFromPolygons = Custom[GIS2BIM.CreateDetailLinesFromPolygons](View=code_block_2, PolyCurves=createPointsPolygonFromGMLxy.PolyCurves, Linestyle=code_block_5.out1)  # frozen; Create detaillines from polygons in a view

# group: BUILDING OUTLINES
web_request_2 = WebRequest()  # unwired: arg0
createPointsPolygonFromGMLxy_2 = Custom[GIS2BIM.CreatePointsPolygonFromGMLxy](XML=web_request_2, DeltaX=transformCRS_epsg.Xtransformed, DeltaY=transformCRS_epsg.Ytransformed)
createDetailLinesFromPolygons_2 = Custom[GIS2BIM.CreateDetailLinesFromPolygons](View=code_block_2, PolyCurves=createPointsPolygonFromGMLxy_2.PolyCurves, Linestyle=code_block_5.out0)  # frozen

code_block_6 = CodeBlock { "Center"; }

# group: HOUSENUMBER
web_request_3 = WebRequest()  # unwired: arg0
createPointFromGML = Custom[GIS2BIM.CreatePointFromGML](XML=web_request_3, ModX=transformCRS_epsg.Xtransformed, ModY=transformCRS_epsg.Ytransformed)  # Create Points from space seperated GML
code_block_7 = CodeBlock { "GRB:HUISNR"; }
getXMLNode = Lists.DataSets.GetXMLNode(web_request_3, code_block_7)
flatten = Flatten(getXMLNode)
string_from_object = FromObject(flatten)
byLocation = TextNote.ByLocation(view=code_block_2, location=createPointFromGML, text=string_from_object, alignment=code_block_6)

openBrowser = Custom[GIS2BIM.OpenBrowser]()  # Opens a new window in your default browser with the given url.; unwired: url
code_block_8 = CodeBlock { "Via benedetto Bompiani"; "1"; "Rome"; "Italy"; }
geoCodingGoogleAPI = Custom[GIS2BIM.GeoCodingGoogleAPI](Streetname=code_block_8.out0, Housenumber=code_block_8.out1, Place=code_block_8.out2, Country=code_block_8.out3)  # gets coordinate from adress with google API
