# Dynamo graph NetherlandsCadastre.dyn (Dynamo 1.3.1.1736)

# group: INPUT
boundingboxwidth_m = CodeBlock { 250; }
code_block = CodeBlock { "Dordrecht"; "werf van schouten"; "501"; }
views = Views("Plattegrond Begane Grond")
code_block_2 = CodeBlock { "2.5 mm"; "3.5 mm"; "2.5 mm zwart"; }
lineStyleKadaster = CodeBlock { "kadastrale_grens"; }
lineStyleBAGPand = StringInput("pen rood")

getLocationdataNetherlands = Custom[GIS2BIM.GetLocationdataNetherlands](City=code_block.out0, Streetname=code_block.out1, Housenumber=code_block.out2)  # Gives locationdata based on an adress in the Netherlands
code_block_3 = CodeBlock { 250; }
createBoundingBox = Custom[GIS2BIM.CreateBoundingBox](CoordinateX=getLocationdataNetherlands.RDcoordinateX_meters_double, CoordinateY=getLocationdataNetherlands.RDcoordinateY_meters_double, BoxWidth=code_block_3, BoxHeight=code_block_3)  # create boundingboxstring for webrequests based on coördinates and dimensions
geoservicesLibraryNetherlands = Custom[GIS2BIM.GeoservicesLibraryNetherlands](BoundingBox=createBoundingBox.Boxstring)  # Library with multiple webadresses which can be used for WFS and WMS webrequests

# group: KADASTER ANNOTATION
kadasterPercelen = Custom[GIS2BIM.KadasterPercelen](DeltaX=getLocationdataNetherlands.RDcoordinateX_meters_double, DeltaY=getLocationdataNetherlands.RDcoordinateY_meters_double, View=views, TextTypePerceel=code_block_2.out0, UrlWebrequestKadasterPerceel=geoservicesLibraryNetherlands.8_kadastrale_perceel)  # Draw propertylines and place streetnames and housenumbers from the dutch kadaster
kadasterHouseNumbers = Custom[GIS2BIM.KadasterHouseNumbers](UrlWebrequestKadasterAnnotation=geoservicesLibraryNetherlands.7_kadastrale_annotatie, DeltaX=getLocationdataNetherlands.RDcoordinateX_meters_double, DeltaY=getLocationdataNetherlands.RDcoordinateY_meters_double, View=views, TextTypeHousenumber=code_block_2.out0, TextTypeStreetname=code_block_2.out1)  # Draw propertylines and place streetnames and housenumbers from the dutch kadaster

string = StringInput(".//{http://www.opengis.net/gml/3.2}posList")
boolean = BoolSelector(true)
code_block_4 = CodeBlock { 1000; }

# group: KADASTRALE PERCELEN(GRENZEN)
web_request = WebRequest(geoservicesLibraryNetherlands.1_kadastrale_grenzen_WFS)
createPointsPolygonFromGMLxy = Custom[GIS2BIM.CreatePointsPolygonFromGMLxy](XML=web_request, XPATHSTRING=string, DeltaX=getLocationdataNetherlands.RDcoordinateX_meters_double, DeltaY=getLocationdataNetherlands.RDcoordinateY_meters_double, Connectpolygon=boolean, UnitsConversionFactor=code_block_4)  # Create point and polygons from a GML-file
createDetailLinesFromPolygons = Custom[GIS2BIM.CreateDetailLinesFromPolygons](View=views, PolyCurves=createPointsPolygonFromGMLxy.PolyCurves, Linestyle=lineStyleKadaster)  # Create detaillines from polygons in a view

filledregiontypebag_pand = FilledRegionTypes("FP_DP_90_pand")

# group: BAG: pand
web_request_2 = WebRequest(geoservicesLibraryNetherlands.4_bag_pand_WFS)
boolean_2 = BoolSelector(true)
createPointsPolygonFromGMLxyz = Custom[GIS2BIM.CreatePointsPolygonFromGMLxyz](XML=web_request_2, XPATHSTRING=string, DeltaX=getLocationdataNetherlands.RDcoordinateX_meters_double, DeltaY=getLocationdataNetherlands.RDcoordinateY_meters_double, Connectpolygon=boolean_2)  # Create points and polygons from a xml/gml-file with x,y and z value
createDetailLinesFromPolygons_2 = Custom[GIS2BIM.CreateDetailLinesFromPolygons](View=views, PolyCurves=createPointsPolygonFromGMLxyz.PolyCurves, Linestyle=lineStyleBAGPand)
explode = Geometry.Explode(createPointsPolygonFromGMLxyz.PolyCurves)
byCurves = FilledRegion.ByCurves(views, explode, filledregiontypebag_pand)

setSharedCoordinate = Custom[GIS2BIM.SetSharedCoordinate](x=getLocationdataNetherlands.RDcoordinateX_meters_double, y=getLocationdataNetherlands.RDcoordinateY_meters_double)  # Set shared coordinate/project basepoint
sendTo = Custom[Clipboard.SendTo](str=geoservicesLibraryNetherlands.4_bag_pand_WFS)  # Copies a string to the clipboard.
