# Dynamo graph Slovenia Cadastre.dyn (Dynamo 1.3.3.4111)

code_block = CodeBlock { "3912"; }
searchCRS = Custom[GIS2BIM.SearchCRS](EPSG_Code=code_block)  # Search for a Coordinate Reference System
watch = Watch(searchCRS.Name_CRS)
code_block_2 = CodeBlock { "4326"; }
code_block_3 = CodeBlock { "Dunajska cesta"; "18"; "ljubljana"; "slovenia"; }
geoCodingGoogleAPI = Custom[GIS2BIM.GeoCodingGoogleAPI](Streetname=code_block_3.out0, Housenumber=code_block_3.out1, Place=code_block_3.out2, Country=code_block_3.out3)  # gets coordinate from adress with google API
transformCRS_epsg = Custom[GIS2BIM.TransformCRS_epsg](sourceCRS=code_block_2, targetCRS=code_block, xCoordinate=geoCodingGoogleAPI.Longitude, yCoordinate=geoCodingGoogleAPI.Latitude)  # Uses the API of http://epsg.io to transform Coordinate Reference Systems
code_block_4 = CodeBlock { 500; }
createBoundingBox = Custom[GIS2BIM.CreateBoundingBox](CoordinateX=transformCRS_epsg.Xtransformed, CoordinateY=transformCRS_epsg.Ytransformed, BoxWidth=code_block_4, BoxHeight=code_block_4)  # create boundingboxstring for webrequests based on coördinates and dimensions
sloveniaGeoservicesLibrary = Custom[GIS2BIM.SloveniaGeoservicesLibrary](Boundingboxstring_EPSG_3912=createBoundingBox.Boxstring)  # Geoservices in Slovenia
webrequestWMS2 = Custom[GIS2BIM.WebrequestWMS2](WMSwebrequest=sloveniaGeoservicesLibrary.Cadastral_Parcel_OGC_WMS)  # a webrequest based on WMS-protocol
watch_image = WatchImageCore(webrequestWMS2)
