# Dynamo graph SpainCadastre.dyn (Dynamo 1.3.2.2480)

epsg_codes_coordinate_reference = CodeBlock { "4326"; "25830"; }  # "EPSG-codes Coordinate Reference System"

# group: INPUT
code_block = CodeBlock { "Carrer Mina"; "2"; "Barcelona"; "Spain"; }
width_of_boundingbox = CodeBlock { 200; }
view = CodeBlock { Application.Document.Current.ActiveView; }
textType = CodeBlock { "2.5 mm"; }
lineStyle = CodeBlock { "Hidden Lines"; }

geoCodingGoogleAPI = Custom[GIS2BIM.GeoCodingGoogleAPI](Streetname=code_block.out0, Housenumber=code_block.out1, Place=code_block.out2, Country=code_block.out3)  # gets coordinate from adress with google API
transformCRS_epsg = Custom[GIS2BIM.TransformCRS_epsg](sourceCRS=epsg_codes_coordinate_reference.out0, targetCRS=epsg_codes_coordinate_reference.out1, xCoordinate=geoCodingGoogleAPI.Longitude, yCoordinate=geoCodingGoogleAPI.Latitude)  # Uses the API of http://epsg.io to transform Coordinate Reference Systems
createBoundingBox = Custom[GIS2BIM.CreateBoundingBox](CoordinateX=transformCRS_epsg.Xtransformed, CoordinateY=transformCRS_epsg.Ytransformed, BoxWidth=width_of_boundingbox, BoxHeight=width_of_boundingbox)  # create boundingboxstring for webrequests based on coördinates and dimensions
spainGeoservicesLibrary = Custom[GIS2BIM.SpainGeoservicesLibrary](Boundingbox=createBoundingBox.Boxstring)  # Geoserviceslibrary of Spain
web_request = WebRequest(spainGeoservicesLibrary)

# group: NATIONAL CADASTRAL REFERENCE TEXT LABEL
code_block_2 = CodeBlock { "cp:label"; }
# note: LUNCHBOX PACKAGE
# GetXMLNode
getXMLNode = Lists.DataSets.GetXMLNode(web_request, code_block_2)
code_block_3 = CodeBlock { ".//{http://www.opengis.net/gml/3.2}pos"; }
createPointFromGML = Custom[GIS2BIM.CreatePointFromGML](XML=web_request, XPATHSTRING=code_block_3, ModX=transformCRS_epsg.Xtransformed, ModY=transformCRS_epsg.Ytransformed)  # Create Points from space seperated GML
code_block_4 = CodeBlock { "cp:nationalCadastralReference"; }
getXMLNode_2 = Lists.DataSets.GetXMLNode(web_request, code_block_4)
code_block_5 = CodeBlock { "Center"; }
byName = TextNoteType.ByName(textType)
byLocation = TextNote.ByLocation(view=view, location=createPointFromGML, text=getXMLNode_2, alignment=code_block_5, type=byName)

# group: PARCELS CURVES TO DETAILLINES
createPointsPolygonFromGMLxy = Custom[GIS2BIM.CreatePointsPolygonFromGMLxy](XML=web_request, DeltaX=transformCRS_epsg.Xtransformed, DeltaY=transformCRS_epsg.Ytransformed)  # Create point and polygons from a GML-file
createDetailLinesFromPolygons = Custom[GIS2BIM.CreateDetailLinesFromPolygons](View=view, PolyCurves=createPointsPolygonFromGMLxy.PolyCurves, Linestyle=lineStyle)  # Create detaillines from polygons in a view

searchCRS = Custom[GIS2BIM.SearchCRS](EPSG_Code=epsg_codes_coordinate_reference.out1)  # Search for a Coordinate Reference System
