# Dynamo graph Dutch Aerialphoto 2016.dyn (Dynamo 1.3.3.4111)

code_block = CodeBlock { 1000; }
getSharedCoordinate = Custom[GIS2BIM.GetSharedCoordinate](scale=code_block)  # Get the current shared coordinate

# group: INPUT
boundingboxwidth_m = CodeBlock { 500; }
code_block_2 = CodeBlock { "C:/TEMP/"; }
nameArialPhoto = CodeBlock { "PDOK_aerialphoto2017"; }

createBoundingBox = Custom[GIS2BIM.CreateBoundingBox](CoordinateX=getSharedCoordinate.E_W, CoordinateY=getSharedCoordinate.N_S, BoxWidth=boundingboxwidth_m, BoxHeight=boundingboxwidth_m)  # create boundingboxstring for webrequests based on coördinates and dimensions
geoservicesLibraryNetherlands = Custom[GIS2BIM.GeoservicesLibraryNetherlands](BoundingBox=createBoundingBox.Boxstring)  # Library with multiple webadresses which can be used for WFS and WMS webrequests
current = Document.Current()
activeView = Document.ActiveView(current)
code_block_3 = CodeBlock { "rdx"; "rdy"; "bbox"; }
string_from_object = FromObject(getSharedCoordinate.E_W)
string_from_object_2 = FromObject(getSharedCoordinate.N_S)
string_from_object_3 = FromObject(boundingboxwidth_m)
concat = String.Concat(nameArialPhoto, code_block_3.out0, string_from_object, code_block_3.out1, string_from_object_2, code_block_3.out2, string_from_object_3)

# group: GET AERIAL PHOTO
webrequestWMS = Custom[GIS2BIM.WebrequestWMS](WMSwebrequest=geoservicesLibraryNetherlands.Luchtfoto_2017_OGC_WMS, Boundingboxwidth=boundingboxwidth_m, View=activeView, Tempfolder=code_block_2, Filename=concat)  # imports the result(image) of a webrequest based on WMS-protocol into a view in Revit
watch_image = WatchImageCore(webrequestWMS.watch_image)
