# Dynamo graph Kadaster BAG.dyn (Dynamo 1.3.1.1736)

code_block = CodeBlock { 1000; }
getSharedCoordinate = Custom[GIS2BIM.GetSharedCoordinate](scale=code_block)  # Get the current shared coordinate
current = Document.Current()
activeView = Document.ActiveView(current)

# group: INPUT
code_block_2 = CodeBlock { "2.5 mm"; "3.5 mm"; "2.5 mm zwart"; }
boundingboxwidth_m = CodeBlock { 250; }
lineStyleKadaster = CodeBlock { "kadastrale_grens"; }
lineStyleBAGPand = StringInput("pen rood")

createBoundingBox = Custom[GIS2BIM.CreateBoundingBox](CoordinateX=getSharedCoordinate.E_W, CoordinateY=getSharedCoordinate.N_S, BoxWidth=boundingboxwidth_m, BoxHeight=boundingboxwidth_m)  # create boundingboxstring for webrequests based on coördinates and dimensions
geoservicesLibraryNetherlands = Custom[GIS2BIM.GeoservicesLibraryNetherlands](BoundingBox=createBoundingBox.Boxstring)  # Library with multiple webadresses which can be used for WFS and WMS webrequests

# group: KADASTER ANNOTATION
kadasterPercelen = Custom[GIS2BIM.KadasterPercelen](DeltaX=getSharedCoordinate.E_W, DeltaY=getSharedCoordinate.N_S, View=activeView, TextTypePerceel=code_block_2.out0, UrlWebrequestKadasterPerceel=geoservicesLibraryNetherlands.8_kadastrale_perceel)  # Draw propertylines and place streetnames and housenumbers from the dutch kadaster
kadasterHouseNumbers = Custom[GIS2BIM.KadasterHouseNumbers](UrlWebrequestKadasterAnnotation=geoservicesLibraryNetherlands.7_kadastrale_annotatie, DeltaX=getSharedCoordinate.E_W, DeltaY=getSharedCoordinate.N_S, View=activeView, TextTypeHousenumber=code_block_2.out0, TextTypeStreetname=code_block_2.out1)  # Draw propertylines and place streetnames and housenumbers from the dutch kadaster

string = StringInput(".//{http://www.opengis.net/gml/3.2}posList")
boolean = BoolSelector(false)
code_block_3 = CodeBlock { 1000; }

# group: KADASTRALE PERCELEN(GRENZEN)
web_request = WebRequest(geoservicesLibraryNetherlands.1_kadastrale_grenzen_WFS)
createPointsPolygonFromGMLxy = Custom[GIS2BIM.CreatePointsPolygonFromGMLxy](XML=web_request, XPATHSTRING=string, DeltaX=getSharedCoordinate.E_W, DeltaY=getSharedCoordinate.N_S, Connectpolygon=boolean, UnitsConversionFactor=code_block_3)  # Create point and polygons from a GML-file
createDetailLinesFromPolygons = Custom[GIS2BIM.CreateDetailLinesFromPolygons](View=activeView, PolyCurves=createPointsPolygonFromGMLxy.PolyCurves, Linestyle=lineStyleKadaster)  # Create detaillines from polygons in a view

filledregiontypebag_pand = FilledRegionTypes("FP_DP_90_pand")

# group: BAG: pand
web_request_2 = WebRequest(geoservicesLibraryNetherlands.4_bag_pand_WFS)
boolean_2 = BoolSelector(true)
createPointsPolygonFromGMLxyz = Custom[GIS2BIM.CreatePointsPolygonFromGMLxyz](XML=web_request_2, XPATHSTRING=string, DeltaX=getSharedCoordinate.E_W, DeltaY=getSharedCoordinate.N_S, Connectpolygon=boolean_2)  # Create points and polygons from a xml/gml-file with x,y and z value
createDetailLinesFromPolygons_2 = Custom[GIS2BIM.CreateDetailLinesFromPolygons](View=activeView, PolyCurves=createPointsPolygonFromGMLxyz.PolyCurves, Linestyle=lineStyleBAGPand)
explode = Geometry.Explode(createPointsPolygonFromGMLxyz.PolyCurves)
byCurves = FilledRegion.ByCurves(activeView, explode, filledregiontypebag_pand)
