# Dynamo graph Kadaster1832 Nederland.dyn (Dynamo 1.3.2.2480)

# group: INPUT
code_block = CodeBlock { "Dordrecht"; "werf van schouten"; "501"; }
boundingboxwidth_m = CodeBlock { 50; }

getLocationdataNetherlands = Custom[GIS2BIM.GetLocationdataNetherlands](City=code_block.out0, Streetname=code_block.out1, Housenumber=code_block.out2)  # Gives locationdata based on an adress in the Netherlands
createBoundingBox = Custom[GIS2BIM.CreateBoundingBox](CoordinateX=getLocationdataNetherlands.RDcoordinateX_meters_double, CoordinateY=getLocationdataNetherlands.RDcoordinateY_meters_double, BoxWidth=boundingboxwidth_m, BoxHeight=boundingboxwidth_m)  # create boundingboxstring for webrequests based on coördinates and dimensions

# group: WEBREQUEST RIJKSDIENST VOOR CULTUREEL ERGOED ZOEKT GRENZEN VAN DE MINUUTPLANNEN
code_block_2 = CodeBlock()
# ---------- code_block_2.designscript (6 lines) ----------
"http://services.rce.geovoorziening.nl/misc/wfs?";
"&service=WFS";
"&version=2.0.0";
"&request=GetFeature";
"&typeName=misc:Minuutplanbegrenzingen";
"&bbox=";
# ----------------------------------------
concat = String.Concat(code_block_2.out0, code_block_2.out1, code_block_2.out2, code_block_2.out3, code_block_2.out4, code_block_2.out5, createBoundingBox.Boxstring)

web_request = WebRequest(concat)

# group: MINUUTGRENZEN
createPointsPolygonFromGMLxyz = Custom[GIS2BIM.CreatePointsPolygonFromGMLxyz](XML=web_request, DeltaX=getLocationdataNetherlands.RDcoordinateX_meters_double, DeltaY=getLocationdataNetherlands.RDcoordinateY_meters_double)  # Create points and polygons from a xml/gml-file with x,y and z value

# group: WEBREQUEST EN RESULTAAT UITLEZEN
code_block_3 = CodeBlock { a={"misc:GEMEENTE","misc:SECTIE","misc:BLAD","misc:URL"}; }
getXMLNode = Lists.DataSets.GetXMLNode(web_request, code_block_3)
code_block_4 = CodeBlock(a=getXMLNode) { a[3]; }
watch = Watch(code_block_4)

openBrowser = Custom[GIS2BIM.OpenBrowser](url=watch)  # Opens a new window in your default browser with the given url.
