# Dynamo graph Ruimtelijke Plannen.dyn (Dynamo 1.3.1.1736)

getSharedCoordinate = Custom[GIS2BIM.GetSharedCoordinate]()  # Get the current shared coordinate

# group: INPUT
boundingboxwidth_m = CodeBlock { 250; }
code_block = CodeBlock { "C:/TEMP/"; }
nameArialPhoto = CodeBlock { "ruimtelijkeplannen"; }

createBoundingBox = Custom[GIS2BIM.CreateBoundingBox](CoordinateX=getSharedCoordinate.RdxMeters, CoordinateY=getSharedCoordinate.RdyMeters, BoxWidth=boundingboxwidth_m, BoxHeight=boundingboxwidth_m)  # create boundingboxstring for webrequests based on coördinates and dimensions
geoservicesLibraryNetherlands = Custom[GIS2BIM.GeoservicesLibraryNetherlands](BoundingBox=createBoundingBox)  # Library with multiple webadresses which can be used for WFS and WMS webrequests
current = Document.Current()
activeView = Document.ActiveView(current)
code_block_2 = CodeBlock { "rdx"; "rdy"; "bbox"; }
string_from_object = FromObject(getSharedCoordinate.RdxMeters)
string_from_object_2 = FromObject(getSharedCoordinate.RdyMeters)
string_from_object_3 = FromObject(boundingboxwidth_m)
concat = String.Concat(nameArialPhoto, code_block_2.out0, string_from_object, code_block_2.out1, string_from_object_2, code_block_2.out2, string_from_object_3)

# group: GET AERIAL PHOTO
webrequestWMS = Custom[GIS2BIM.WebrequestWMS](WMSwebrequest=geoservicesLibraryNetherlands.12_ruimtelijkeplannen_WMS, Boundingboxwidth=boundingboxwidth_m, View=activeView, Tempfolder=code_block, Filename=concat)  # imports the result(image) of a webrequest based on WMS-protocol into a view in Revit
watch_image = WatchImageCore(webrequestWMS)
