# Dynamo graph Set Locationdata.dyn (Dynamo 1.3.1.1736)

code_block = CodeBlock { "Strijen"; "Simon Stevinstraat"; "6"; }
getLocationdataNetherlands = Custom[GIS2BIM.GetLocationdataNetherlands](City=code_block.out0, Streetname=code_block.out1, Housenumber=code_block.out2)  # Gives locationdata based on an adress in the Netherlands
code_block_2 = CodeBlock { 0; }
setSharedCoordinate = Custom[GIS2BIM.SetSharedCoordinate](x=getLocationdataNetherlands.RDcoordinateX_meters_double, y=getLocationdataNetherlands.RDcoordinateY_meters_double, angle=code_block_2)  # Set shared coordinate/project basepoint
string = StringInput("Get RD-coordinates from Address")
string_2 = StringInput("OK")
code_block_3 = CodeBlock { "Place"; }
categories = Categories("ProjectInformation")
all_elements_of_category = ElementsOfCategory(categories)
code_block_4 = CodeBlock { "project_plaats"; }
getParameterValueByName = Element.GetParameterValueByName(element=all_elements_of_category, parameterName=code_block_4)
firstItem = List.FirstItem(getParameterValueByName)
ui_textbox_data = Custom[UI.TextBox Data](InputName=code_block_3, DefaultText=firstItem)  # Create Data for TextBox input in UI.MultipleInputForm ++ . Check out www.data-shapes.net for more informations
code_block_5 = CodeBlock { "Street"; }
code_block_6 = CodeBlock { "project_straatnaam"; }
getParameterValueByName_2 = Element.GetParameterValueByName(element=all_elements_of_category, parameterName=code_block_6)
firstItem_2 = List.FirstItem(getParameterValueByName_2)
ui_textbox_data_2 = Custom[UI.TextBox Data](InputName=code_block_5, DefaultText=firstItem_2)
code_block_7 = CodeBlock { "HouseNumber"; }
code_block_8 = CodeBlock { "project_huisnummer"; }
getParameterValueByName_3 = Element.GetParameterValueByName(element=all_elements_of_category, parameterName=code_block_8)
firstItem_3 = List.FirstItem(getParameterValueByName_3)
ui_textbox_data_3 = Custom[UI.TextBox Data](InputName=code_block_7, DefaultText=firstItem_3)
create = List.Create(ui_textbox_data, ui_textbox_data_2, ui_textbox_data_3)
boolean = BoolSelector(true)
code_block_9 = CodeBlock { 250; }
ui_multipleinputform = Custom[UI.MultipleInputForm ++](Description_optional=string, ButtonText_optional=string_2, Inputs=create, Toggle=boolean, Width_optional=code_block_9)  # Create a form with multiple inputs. see www.data-shapes.net for tutorials and infos!
code_block_10 = CodeBlock { 0; 1; 2; }
categories_2 = Categories("ProjectInformation")
all_elements_of_category_2 = ElementsOfCategory(categories_2)
code_block_11 = CodeBlock { "kadastraal_nummer"; "kadastrale_sectie"; }
setParameterByName = Element.SetParameterByName(element=all_elements_of_category_2, parameterName=code_block_11.out0, value=getLocationdataNetherlands.PerceelKadaster)
setParameterByName_2 = Element.SetParameterByName(element=all_elements_of_category_2, parameterName=code_block_11.out1, value=getLocationdataNetherlands.SectieKadaster)
categories_3 = Categories("ProjectInformation")
all_elements_of_category_3 = ElementsOfCategory(categories_3)
code_block_12 = CodeBlock { "project_plaats"; }
setParameterByName_3 = Element.SetParameterByName(element=all_elements_of_category_3, parameterName=code_block_12)  # unwired: value
code_block_13 = CodeBlock { "project_straatnaam"; }
setParameterByName_4 = Element.SetParameterByName(element=all_elements_of_category_3, parameterName=code_block_13)  # unwired: value
code_block_14 = CodeBlock { "project_huisnummer"; }
setParameterByName_5 = Element.SetParameterByName(element=all_elements_of_category_3, parameterName=code_block_14)  # unwired: value
