# Dynamo graph Import and Reduce Mesh to Directshape.dyn (Dynamo 1.3.3.4111)

file_path = Filename("\\NAS-BE-94-5F\3bm\50_projecten\1_3BM_cooperatie\918_Schelp_2.0_Egmond_aan_Zee\918_40_terrein\918_mesh_oct_10.obj")
importFile = Autodesk.Dynamo.MeshToolkit.Mesh.ImportFile(file_path)
code_block = CodeBlock { 50000; }
reduce = Autodesk.Dynamo.MeshToolkit.Mesh.Reduce(importFile, code_block)
code_block_2 = CodeBlock { 1000; }
scale = Autodesk.Dynamo.MeshToolkit.Mesh.Scale(reduce, code_block_2)
toolkitMeshToMesh = Custom[Springs.ToolkitMeshToMesh](tkMesh=scale)  # Attempts to convert a toolkit mesh to a Dynamo mesh. You obviously need to have the appropriate version of the mesh toolkit package downloaded first.
categories = Categories("GenericModel")
code_block_3 = CodeBlock { "a_gen"; }
byName = Material.ByName(code_block_3)
code_block_4 = CodeBlock { "terrein"; }
byMesh = DirectShape.ByMesh(toolkitMeshToMesh, categories, byName, code_block_4)
