# Dynamo graph RevitLocationTransformCoordinate.dyn (Dynamo 1.3.2.2480)

code_block = CodeBlock { "4326"; }
code_block_2 = CodeBlock { "28992"; }
siteLocation = SiteLocation()
longitude = DynamoUnits.Location.Longitude(siteLocation)
string_from_object = FromObject(longitude)
code_block_3 = CodeBlock(t3=string_from_object) { t4 = String.Replace(t3, ",", "."); }
latitude = DynamoUnits.Location.Latitude(siteLocation)
string_from_object_2 = FromObject(latitude)
code_block_4 = CodeBlock(t3=string_from_object_2) { t4 = String.Replace(t3, ",", "."); }
transformCRS_epsg = Custom[GIS2BIM.TransformCRS_epsg](sourceCRS=code_block, targetCRS=code_block_2, xCoordinate=code_block_3, yCoordinate=code_block_4)  # Uses the API of http://epsg.io to transform Coordinate Reference Systems
code_block_5 = CodeBlock { 500; }
createBoundingBox = Custom[GIS2BIM.CreateBoundingBox](CoordinateX=transformCRS_epsg.Xtransformed, CoordinateY=transformCRS_epsg.Ytransformed, BoxWidth=code_block_5, BoxHeight=code_block_5)  # create boundingboxstring for webrequests based on coördinates and dimensions
setSharedCoordinate = Custom[GIS2BIM.SetSharedCoordinate]()  # Set shared coordinate/project basepoint; unwired: X, Y
searchCRS = Custom[GIS2BIM.SearchCRS](EPSG_Code=code_block)  # Search for a Coordinate Reference System
