# Dynamo graph TMS Example Google .dyn (Dynamo 1.3.3.4111)

code_block = CodeBlock { "wattstraat"; "17"; "zwijndrecht"; "the netherlands"; }
geoCodingGoogleAPI = Custom[GIS2BIM.GeoCodingGoogleAPI](Streetname=code_block.out0, Housenumber=code_block.out1, Place=code_block.out2, Country=code_block.out3)  # gets coordinate from adress with google API
desired_width_in_meters = CodeBlock { 300; }
createBoundingBoxLATLONG = Custom[GIS2BIM.CreateBoundingBoxLATLONG](Lat=geoCodingGoogleAPI.Latitude, Long=geoCodingGoogleAPI.Longitude, WidthMeters=desired_width_in_meters)  # create boundingbox with from lat/long coordinate in degrees
zoomlevel = CodeBlock { 18; }
TMSGetTileNumbersFromBboxLATLON = Custom[GIS2BIM.TMSGetTileNumbersFromBboxLATLON](West=createBoundingBoxLATLONG.West, East=createBoundingBoxLATLONG.East, North=createBoundingBoxLATLONG.North, South=createBoundingBoxLATLONG.South, Zoomlevel=zoomlevel, BoundingboxWidth=desired_width_in_meters)  # Get the Tilenumbers in X and Y in the TMS Webprotocol based on a given Boundingbox in LAT/LON
TMSWebServices = Custom[GIS2BIM.TMSWebServices](TileX=TMSGetTileNumbersFromBboxLATLON.TileX, TileY=TMSGetTileNumbersFromBboxLATLON.TileY, Zoomlevel=zoomlevel)  # Library With TMS Webservices
boolean = BoolSelector(false)
TMS_WMTS_WebrequestAndCombineImages = Custom[GIS2BIM.TMS_WMTS_WebrequestAndCombineImages](URLlist=TMSWebServices.URL_Google_Earth_Satellite, UniqueTileNumbersColumnX=TMSGetTileNumbersFromBboxLATLON.TileXUnique, UniqueTileNumbersRowY=TMSGetTileNumbersFromBboxLATLON.TileYUnique, WMTSorTMS=boolean)  # Webrequest for list of WMTS or TMS/Google webrequests for tiles. Combines them to 1 image.
watch_image = WatchImageCore(TMS_WMTS_WebrequestAndCombineImages.Image)
current = Document.Current()
activeView = Document.ActiveView(current)
code_block_2 = CodeBlock(dx=TMSGetTileNumbersFromBboxLATLON.DeltaXmm, dy=TMSGetTileNumbersFromBboxLATLON.DeltaYmm) { dx/1000; dy/1000; }
cropImage = Custom[GIS2BIM.CropImage](image=TMS_WMTS_WebrequestAndCombineImages.Image, SourceWidthM=TMSGetTileNumbersFromBboxLATLON.WidthM, SourceHeightM=TMSGetTileNumbersFromBboxLATLON.HeightM, dxM=code_block_2.out0, dyM=code_block_2.out1, NewWidthM=desired_width_in_meters, NewHeightM=desired_width_in_meters)  # Crop an image

# group: SET MATERIAL
temp_filepath_image = CodeBlock { "C:/TEMP/map24.png"; }
code_block_3 = CodeBlock { "a_gen"; }
byName = Material.ByName(code_block_3)
code_block_4 = CodeBlock(x=desired_width_in_meters) { 0; x*1000; }
boolean_2 = BoolSelector(false)
code_block_5 = CodeBlock { 0; }
setMaterialAppearanceTextureGeneric = Custom[GIS2BIM.SetMaterialAppearanceTextureGeneric](Material=byName, TextureFilelocation=temp_filepath_image, TextureOffsetX=code_block_4.out0, TextureOffsetY=code_block_4.out0, TextureSizeXMM=code_block_4.out1, TextureSizeYMM=code_block_4.out1, LockScale=boolean_2, RotationAngle=code_block_5)  # Change the values of the texture of the appearanceasset of a Revit Material of the type 'generic'

systemDrawingBitmapToJPG = Custom[GIS2BIM.SystemDrawingBitmapToJPG](SystemDrawingBitmap=cropImage, FileName=temp_filepath_image)  # Save an System.Drawing.Bitmap object as a jpg-file
importImageInView = Custom[GIS2BIM.ImportImageInView](ImageWidthMeters=desired_width_in_meters, View=activeView, ImagePath=systemDrawingBitmapToJPG)  # Import rasterimage in view
setRevitSiteLocation = Custom[GIS2BIM.SetRevitSiteLocation](lat=geoCodingGoogleAPI.Latitude, lon=geoCodingGoogleAPI.Longitude)  # Sets the properties of the current Site Location of the active Revit Project
getRevitSiteLocation = Custom[GIS2BIM.GetRevitSiteLocation]()  # Gets the properties of the current Site Location of the active Revit Project
doubleToString = Custom[GIS2BIM.DoubleToString](CoordinateDouble=getRevitSiteLocation.Lon)  # Converts a double to a string
doubleToString_2 = Custom[GIS2BIM.DoubleToString](CoordinateDouble=getRevitSiteLocation.Lat)
watch_image_2 = WatchImageCore(cropImage)
boolean_3 = BoolSelector(true)
python_script = Python(IN[0]=boolean_3)
# ---------- python_script.python (27 lines) ----------
#©2017 Ekko Nap, ekko@groosman.com
#licensed under MIT

import clr
clr.AddReference("RevitServices")
import RevitServices
from RevitServices.Persistence import DocumentManager
from RevitServices.Transactions import TransactionManager
import math

doc = DocumentManager.Instance.CurrentDBDocument

projectLocation = doc.ActiveProjectLocation
siteLocation = projectLocation.SiteLocation

#SiteLocation = projectLocation.GetSiteLocation(); // 2018
#from https://github.com/jeremytammik/the_building_coder_samples/blob/master/BuildingCoder/BuildingCoder/CmdUnrotateNorth.cs
#untested

bool = IN[0]

if bool==1:
	latitude=siteLocation.Latitude
	longitude=siteLocation.Longitude
	name=siteLocation.PlaceName

OUT = latitude*180/math.pi, longitude*180/math.pi, name
# ----------------------------------------
