# Dynamo graph WFSKadsterBAG.dyn (Dynamo 1.3.1.1736)

geoservicesLibraryNetherlands = Custom[GIS2BIM.GeoservicesLibraryNetherlands]()  # Library with multiple webadresses which can be used for WFS and WMS webrequests; unwired: BoundingBox

# group: INPUT
code_block = CodeBlock { "Hellevoetsluis"; "kanaalweg westzijde"; "45"; }
views = Views("BGT Copy 1")
code_block_2 = CodeBlock { "2.5 mm"; "3.5 mm"; "2.5 mm zwart"; }
lineStyleKadaster = CodeBlock { "kadastrale_grens"; }
lineStyleBAGPand = StringInput("pen rood")
boundingboxwidth_m = CodeBlock { 250; }
code_block_3 = CodeBlock { "C:/TEMP/"; }
nameArialPhoto = CodeBlock { "luchtfoto14"; }

getLocationdataNetherlands = Custom[GIS2BIM.GetLocationdataNetherlands](City=code_block.out0, Streetname=code_block.out1, Housenumber=code_block.out2)  # Gives locationdata based on an adress in the Netherlands
code_block_4 = CodeBlock { 250; }
createBoundingBox = Custom[GIS2BIM.CreateBoundingBox](CoordinateX=getLocationdataNetherlands.RDcoordinate_X_meters, CoordinateY=getLocationdataNetherlands.RDcoordinate_Y_meters, BoxWidth=code_block_4, BoxHeight=code_block_4)  # create boundingboxstring for webrequests based on coördinates and dimensions
geoservicesLibraryNetherlands_2 = Custom[GIS2BIM.GeoservicesLibraryNetherlands](BoundingBox=createBoundingBox)

# group: KADASTER ANNOTATION
kadasterPercelen = Custom[GIS2BIM.KadasterPercelen](DeltaX=getLocationdataNetherlands.RDcoordinate_X_meters, DeltaY=getLocationdataNetherlands.RDcoordinate_Y_meters, View=views, TextTypePerceel=code_block_2.out2, UrlWebrequestKadasterPerceel=geoservicesLibraryNetherlands_2.8_kadastrale_perceel)  # Draw propertylines and place streetnames and housenumbers from the dutch kadaster
kadasterHouseNumbers = Custom[GIS2BIM.KadasterHouseNumbers](UrlWebrequestKadasterAnnotation=geoservicesLibraryNetherlands_2.7_kadastrale_annotatie, DeltaX=getLocationdataNetherlands.RDcoordinate_X_meters, DeltaY=getLocationdataNetherlands.RDcoordinate_Y_meters, View=views, TextTypeHousenumber=code_block_2.out0, TextTypeStreetname=code_block_2.out1)

boolean = BoolSelector(false)

# group: KADASTRALE PERCELEN(GRENZEN)
web_request = WebRequest(geoservicesLibraryNetherlands_2.1_kadastrale_grenzen_WFS)
code_block_5 = CodeBlock { "gml:posList"; }
createPointsPolygonFromGMLxy = Custom[GIS2BIM.CreatePointsPolygonFromGMLxy](XML=web_request, Xmltagname=code_block_5, DeltaX=getLocationdataNetherlands.RDcoordinate_X_meters, DeltaY=getLocationdataNetherlands.RDcoordinate_Y_meters, Connectpolygon=boolean)  # Create point and polygons from a GML-file
createDetailLinesFromPolygons = Custom[GIS2BIM.CreateDetailLinesFromPolygons](View=views, PolyCurves=createPointsPolygonFromGMLxy.PolyCurves, Linestyle=lineStyleKadaster)  # Create detaillines from polygons in a view

# group: GET AERIAL PHOTO
webrequestWMS = Custom[GIS2BIM.WebrequestWMS](WMSwebrequest=geoservicesLibraryNetherlands_2.5_luchtfoto_2016_WMS, Boundingboxwidth=boundingboxwidth_m, View=views, Tempfolder=code_block_3, Filename=nameArialPhoto)  # imports the result(image) of a webrequest based on WMS-protocol into a view in Revit
watch_image = WatchImageCore(webrequestWMS)

filledregiontypebag_pand = FilledRegionTypes("FP_DP_90_pand")

# group: BAG: pand
web_request_2 = WebRequest(geoservicesLibraryNetherlands_2.4_bag_pand_WFS)
code_block_6 = CodeBlock { "gml:posList"; }
boolean_2 = BoolSelector(true)
createPointsPolygonFromGMLxyz = Custom[GIS2BIM.CreatePointsPolygonFromGMLxyz](XML=web_request_2, Xmltagname=code_block_6, DeltaX=getLocationdataNetherlands.RDcoordinate_X_meters, DeltaY=getLocationdataNetherlands.RDcoordinate_Y_meters, Connectpolygon=boolean_2)  # Create points and polygons from a xml/gml-file with x,y and z value
createDetailLinesFromPolygons_2 = Custom[GIS2BIM.CreateDetailLinesFromPolygons](View=views, PolyCurves=createPointsPolygonFromGMLxyz.PolyCurves, Linestyle=lineStyleBAGPand)
explode = Geometry.Explode(createPointsPolygonFromGMLxyz.PolyCurves)
byCurves = FilledRegion.ByCurves(views, explode, filledregiontypebag_pand)

setSharedCoordinate = Custom[GIS2BIM.SetSharedCoordinate](X=getLocationdataNetherlands.RDcoordinate_X_meters, Y=getLocationdataNetherlands.RDcoordinate_Y_meters)  # Set shared coordinate/project basepoint
sendTo = Custom[Clipboard.SendTo](str=geoservicesLibraryNetherlands_2.4_bag_pand_WFS)  # Copies a string to the clipboard.
