# Dynamo graph WMS Example Belgium Aerial.dyn (Dynamo 1.3.2.2480)

code_block = CodeBlock { "31370"; }
searchCRS = Custom[GIS2BIM.SearchCRS](EPSG_Code=code_block)  # Search for a Coordinate Reference System
boundingboxWidth = CodeBlock { 200; }
code_block_2 = CodeBlock { "4326"; }
code_block_3 = CodeBlock { "Grootkanonplein"; "2"; "Gent"; "Belgium"; }
geoCodingGoogleAPI = Custom[GIS2BIM.GeoCodingGoogleAPI](Streetname=code_block_3.out0, Housenumber=code_block_3.out1, Place=code_block_3.out2, Country=code_block_3.out3)  # gets coordinate from adress with google API
transformCRS_epsg = Custom[GIS2BIM.TransformCRS_epsg](sourceCRS=code_block_2, targetCRS=code_block, xCoordinate=geoCodingGoogleAPI.Longitude, yCoordinate=geoCodingGoogleAPI.Latitude)  # Uses the API of http://epsg.io to transform Coordinate Reference Systems
createBoundingBox = Custom[GIS2BIM.CreateBoundingBox](CoordinateX=transformCRS_epsg.Xtransformed, CoordinateY=transformCRS_epsg.Ytransformed, BoxWidth=boundingboxWidth, BoxHeight=boundingboxWidth)  # create boundingboxstring for webrequests based on coördinates and dimensions
belgiumGeoservicesLibrary = Custom[GIS2BIM.BelgiumGeoservicesLibrary](BoundingboxString=createBoundingBox.Boxstring)  # Geoserviceslibrary in Belgium
webrequestWMS2 = Custom[GIS2BIM.WebrequestWMS2](WMSwebrequest=belgiumGeoservicesLibrary.AerialPhoto_OGWRGB13_15VL_WMS_IMAGE)  # a webrequest based on WMS-protocol
watch_image = WatchImageCore(webrequestWMS2)

# group: OPTIONAL IMPORT IMAGE IN ACTIVEVIEW
current = Document.Current()
activeView = Document.ActiveView(current)
code_block_4 = CodeBlock { "C:/TEMP/aerialphoto.png"; }  # frozen
code_block_5 = CodeBlock { 0; 0; }
importImageInView = Custom[GIS2BIM.ImportImageInView](ImageWidthMeters=boundingboxWidth, View=activeView, ImagePath=code_block_4, Deltax=code_block_5.out0, Deltay=code_block_5.out1)  # Import rasterimage in view
writeToFile = Image.WriteToFile(code_block_4, watch_image)
