# Dynamo graph AllNodes.dyn (Dynamo 1.3.1.1736)

setSharedCoordinate = Custom[GIS2BIM.SetSharedCoordinate]()  # Set shared coordinate/project basepoint; unwired: X, Y
downloadAHN = Custom[GIStoBIM.DownloadAHN]()  # get the mapnumber(s) of the AHN based on a given boundingbox; unwired: Urlwebrequest
BGT2D = Custom[GIStoBIM.BGT2D]()  # Create 2D BGT siteplan from set of GML-files; unwired: Directory, RDx, RDy, BoundingboxWidth, View, DetailcomponentTree, FilledRegionPand, FilledRegionGreen1, FilledRegionGreen2, FilledRegionRoad, FilledRegionRoad2, FilledRegionWater, LineStyleBGT_functioneelgebied, LineStyleBGT_gebouwinstallatie, LineStyleBGT_kunstwerkdeel, LineStyleBGT_onbegroeidterreindeel, LineStyleBGT_ondersteunendwegdeel, LineStyleBGT_overigescheiding, LineStyleBGT_scheiding, LineStyleBGT_spoor, LineStyleBGT_tunneldeel
downloadBGTdata = Custom[GIS2BIM.DownloadBGTdata]()  # "GIStoBIM.DownloadBGTdata"; Download BGT-data(dutch GIS-information); unwired: Mortoncode, Directory
geoservicesLibraryNetherlands = Custom[GIStoBIM.GeoservicesLibraryNetherlands]()  # Library with multiple webadresses which can be used for WFS and WMS webrequests; unwired: BoundingBox
getLocationdataNetherlands = Custom[GIStoBIM.GetLocationdataNetherlands]()  # Gives locationdata based on an adress in the Netherlands; unwired: City, Streetname, Housenumber
kadasterHouseNumbers = Custom[GIStoBIM.KadasterHouseNumbers]()  # Draw propertylines and place streetnames and housenumbers from the dutch kadaster; unwired: UrlWebrequestKadasterAnnotation, DeltaX, DeltaY, View, TextTypeHousenumber, TextTypeStreetname
kadasterPercelen = Custom[GIStoBIM.KadasterPercelen]()  # Draw propertylines and place streetnames and housenumbers from the dutch kadaster; unwired: DeltaX, DeltaY, View, TextTypePerceel, UrlWebrequestKadasterPerceel
WMTSGeoservicesLibraryNetherlands = Custom[GIStoBIM.WMTSGeoservicesLibraryNetherlands]()  # library with webrequests of WMTS-services in the Netherlands; unwired: TileRow, TileColumn, Zoomlevel, Layer
WMTSLayersNetherlands = Custom[GIStoBIM.WMTSLayersNetherlands]()  # Library with layers for webrequests of WMTS-services in the Netherlands
WMTSRequestAndImport = Custom[GIStoBIM.WMTSRequestAndImport]()  # total node with WMTS webrequest and import of image in view; unwired: Rdx, Rdy, Zoomlevel, Boundingboxwidth, TemppathFiles, View, Layer
WMTSScaleSetNetherlands = Custom[GIStoBIM.WMTSScaleSetNetherlands]()  # gives resolution, scaledenominator and number of tiles
createDetailLinesFromPolygons = Custom[GIStoBIM.CreateDetailLinesFromPolygons]()  # Create detaillines from polygons in a view; unwired: View, PolyCurves, Linestyle
createPointFromGML = Custom[GIStoBIM.CreatePointFromGML]()  # Create Points from space seperated GML; unwired: XML, ModX, ModY
createPointsPolygonFromGMLxy = Custom[GIStoBIM.CreatePointsPolygonFromGMLxy]()  # Create point and polygons from a GML-file; unwired: XML, Xmltagname, DeltaX, DeltaY
createPointsPolygonFromGMLxyz = Custom[GIStoBIM.CreatePointsPolygonFromGMLxyz]()  # Create points and polygons from a xml/gml-file with x,y and z value; unwired: XML, Xmltagname, DeltaX, DeltaY
filterGML = Custom[GIStoBIM.FilterGML]()  # filter GML-file based on boundingbox; unwired: GMLFile, xPATH, CoordinateX, CoordinateY, Boundingbox
buildCMDLASZIP = Custom[GIStoBIM.BuildCMDLASZIP]()  # create scriptfile to run laszip; unwired: FilePathLASZIP, DirectoryPointcloud, Files, Filter, Reduce, Crop, Merge, PathFileFormat, Translate
downloadLASZIP = Custom[GIStoBIM.DownloadLASZIP]()  # download and unzip laszip; unwired: Directory
LASZIPCommands = Custom[GIStoBIM.LASZIPCommands]()  # commandline options for LASZIP; unwired: X, Y, BoundingboxwidthMeters, Targetdirectory, Filename, ClassificationToKeep, KeepEveryNthPoint, LAZFile, TranslateX, TranslateY
PTStoPoints = Custom[GIStoBIM.PTStoPoints]()  # convert a pts-file(ascii) to dynamo points; unwired: PTSFile
combineImages = Custom[GIStoBIM.CombineImages]()  # combine images from wmts webrequest; unwired: ImageList, TileRows, TileColumns, NumberOfPixels, Layer
createBoundingBox = Custom[GIStoBIM.CreateBoundingBox]()  # create boundingboxstring for webrequests based on coördinates and dimensions; unwired: CoordinateX, CoordinateY, BoxWidth, BoxHeight
createBoundingBoxLATLONG = Custom[GIStoBIM.CreateBoundingBoxLATLONG]()  # create boundingbox with from lat/long coordinate in degrees; unwired: Lat, Long, WidthMeters
downloadOSM = Custom[GIS2BIM.DownloadOSM]()  # "GIStoBIM.DownloadOSM"; Download OSM data within a boundingbox; unwired: West, East, North, South, Directory
geoCodingGoogleAPI = Custom[GIStoBIM.GeoCodingGoogleAPI]()  # gets coordinate from adress with google API; unwired: Streetname, Housenumber, Place, Country
getMortonCodeCoordinate = Custom[GIStoBIM.GetMortonCodeCoordinate]()  # Get mortoncode(bitshifting) given 2 coordinates and tiledimension; unwired: X, Y
importImageInView = Custom[GIStoBIM.ImportImageInView]()  # Import rasterimage in view; unwired: ImageWidthMeters, View, ImagePath, Deltax, Deltay
setImageWidth = Custom[GIStoBIM.SetImageWidth]()  # set width of imported raster image; unwired: Imagename, Imagewidth
unzipFile = Custom[GIStoBIM.UnzipFile]()  # Unzip zip-file; unwired: FilePathZipFile, DirectoryToExtractTo
webrequestWMS = Custom[GIStoBIM.WebrequestWMS]()  # imports the result(image) of a webrequest based on WMS-protocol into a view in Revit; unwired: WMSwebrequest, Boundingboxwidth, View, Filename
webrequestWMTS = Custom[GIStoBIM.WebrequestWMTS]()  # unwired: WMTSWebrequest, Temppath, TileRow, TileColumn, Layer, Zoomlevel
WMTSTileListFromBbox = Custom[GIStoBIM.WMTSTileListFromBbox]()  # gives list of tilerows and tilecolums; unwired: TileRow, TileColumn, Resolution, PixelWidth, Bbox
WMTSZoomLevelTileRow = Custom[GIStoBIM.WMTSZoomLevelTileRow]()  # gives the tilerow and tilecolumn for the WMTS webrequest; unwired: Resolution, Rdx, Rdy
geoservicesLibraryNetherlands_2 = Custom[GIStoBIM.GeoservicesLibraryNetherlands]()  # unwired: BoundingBox
code_block = CodeBlock { "dordrecht"; "werf van schouten"; "501"; }
getLocationdataNetherlands_2 = Custom[GIStoBIM.GetLocationdataNetherlands](City=code_block.out0, Streetname=code_block.out1, Housenumber=code_block.out2)
code_block_2 = CodeBlock { 250; }
createBoundingBox_2 = Custom[GIStoBIM.CreateBoundingBox](CoordinateX=getLocationdataNetherlands_2.RDcoordinate_X_meters, CoordinateY=getLocationdataNetherlands_2.RDcoordinate_Y_meters, BoxWidth=code_block_2, BoxHeight=code_block_2)
sendTo = Custom[Clipboard.SendTo](str=getLocationdataNetherlands_2.URLWebrequest)  # Copies a string to the clipboard.
setSharedCoordinate_2 = Custom[GIS2BIM.SetSharedCoordinate]()  # unwired: X, Y
downloadBGTdata_2 = Custom[GIStoBIM.DownloadBGTdata]()  # Download BGT-data(dutch GIS-information); unwired: Mortoncode, Directory
getMortonCodeCoordinate_2 = Custom[GIStoBIM.GetMortonCodeCoordinate](X=getLocationdataNetherlands_2.RDcoordinate_X_meters, Y=getLocationdataNetherlands_2.RDcoordinate_Y_meters)
