# Dynamo graph Bestemmingsplan.dyn (Dynamo 1.3.1.1736)

# group: INPUT
code_block = CodeBlock { "Dordrecht"; "lange geldersekade"; "2"; }
boundingboxwidth_m = CodeBlock { 250; }
views = Views("Level 1")
code_block_2 = CodeBlock { "C:/TEMP/"; }
nameArialPhoto = CodeBlock { "bouwvlakbestemmingsplan"; }
code_block_3 = CodeBlock { "2.5 mm"; "3.5 mm"; "2.5 mm zwart"; }

# group: GET GEOSERVICES
getLocationdataNetherlands = Custom[GIStoBIM.GetLocationdataNetherlands](city=code_block.out0, streetname=code_block.out1, housenumber=code_block.out2)  # Gives locationdata based on an adress in the Netherlands
createBoundingBox = Custom[GIStoBIM.CreateBoundingBox](coordinateX=getLocationdataNetherlands.RDcoordinate_X_meters, coordinateY=getLocationdataNetherlands.RDcoordinate_Y_meters, boxWidth=boundingboxwidth_m, boxHeight=boundingboxwidth_m)  # create boundingboxstring for webrequests based on coördinates and dimensions
geoservicesLibraryNetherlands = Custom[GIStoBIM.GeoservicesLibraryNetherlands](BoundingBox=createBoundingBox)  # Library with multiple webadresses which can be used for WFS and WMS webrequests

# group: BESTEMMINGSPLAN
webrequestWMS = Custom[GIStoBIM.WebrequestWMS](WMSwebrequest=geoservicesLibraryNetherlands.10_bestemmingsplan_bouwvlak_WMS, boundingboxwidth=boundingboxwidth_m, view=views, tempfolder=code_block_2, filename=nameArialPhoto)  # imports the result(image) of a webrequest based on WMS-protocol into a view in Revit
watch_image = WatchImageCore(webrequestWMS)

code_block_4 = CodeBlock { "papendrecht"; "westeind"; "85"; }
setSharedCoordinate = Custom[GIStoBIM.SetSharedCoordinate](X=getLocationdataNetherlands.RDcoordinate_X_meters, Y=getLocationdataNetherlands.RDcoordinate_Y_meters)  # Set shared coordinate/project basepoint
sendTo = Custom[Clipboard.SendTo](str=geoservicesLibraryNetherlands.10_bestemmingsplan_bouwvlak_WMS)  # Copies a string to the clipboard.
