# Dynamo graph Example.dyn (Dynamo 1.3.1.1736)

code_block = CodeBlock { "Dordrecht"; "Lange Geldersekade"; "1"; }
getLocationdataNetherlands = Custom[GIStoBIM.GetLocationdataNetherlands](city=code_block.out0, streetname=code_block.out1, housenumber=code_block.out2)  # Gives locationdata based on an adress in the Netherlands
setSharedCoordinate = Custom[GIStoBIM.SetSharedCoordinate](X=getLocationdataNetherlands.RDcoordinate_X_meters, Y=getLocationdataNetherlands.RDcoordinate_Y_meters)  # Set shared coordinate/project basepoint
web_request = WebRequest()  # unwired: arg0
code_block_2 = CodeBlock { "gml:posList"; }
boolean = BoolSelector(false)
createPointsPolygonFromGMLxy = Custom[GIStoBIM.CreatePointsPolygonFromGMLxy](xml=web_request, xmltagname=code_block_2, deltaX=getLocationdataNetherlands.RDcoordinate_X_meters, deltaY=getLocationdataNetherlands.RDcoordinate_Y_meters, connectpolygon=boolean)  # Create point and polygons from a GML-file
views = Views("Situation")
code_block_3 = CodeBlock { 200; }
createBoundingBox = Custom[GIStoBIM.CreateBoundingBox](coordinateX=getLocationdataNetherlands.RDcoordinate_X_meters, coordinateY=getLocationdataNetherlands.RDcoordinate_Y_meters, boxWidth=code_block_3, boxHeight=code_block_3)  # create boundingboxstring for webrequests based on coördinates and dimensions
geoservicesLibraryNetherlands = Custom[GIStoBIM.GeoservicesLibraryNetherlands](BoundingBox=createBoundingBox)  # Library with multiple webadresses which can be used for WFS and WMS webrequests
web_request_2 = WebRequest(geoservicesLibraryNetherlands.4_bag_pand_WFS)
code_block_4 = CodeBlock { "gml:posList"; }
boolean_2 = BoolSelector(true)
createPointsPolygonFromGMLxyz = Custom[GIStoBIM.CreatePointsPolygonFromGMLxyz](xml=web_request_2, xmltagname=code_block_4, deltaX=getLocationdataNetherlands.RDcoordinate_X_meters, deltaY=getLocationdataNetherlands.RDcoordinate_Y_meters, connectpolygon=boolean_2)  # Create points and polygons from a xml/gml-file with x,y and z value
string = StringInput("pen groen")
createDetailLinesFromPolygons = Custom[GIStoBIM.CreateDetailLinesFromPolygons](view=views, polyCurves=createPointsPolygonFromGMLxyz.PolyCurves, linestyle=string)  # Create detaillines from polygons in a view
code_block_5 = CodeBlock { "C:/TEMP/"; }
code_block_6 = CodeBlock { "luchtfoto"; }
webrequestWMS = Custom[GIStoBIM.WebrequestWMS](WMSwebrequest=geoservicesLibraryNetherlands.5_luchtfoto_2016_WMS, boundingboxwidth=code_block_3, view=views, tempfolder=code_block_5, filename=code_block_6)  # imports the result(image) of a webrequest based on WMS-protocol into a view in Revit
watch_image = WatchImageCore(webrequestWMS)
