# Dynamo graph GIS2x_2.10 Natura2000.dyn (Dynamo 2.12.1.8246)
# packages: GIS2BIM for Dynamo 2.x 0.11.25, Clockwork for Dynamo 2.x 2.3.0, GIS2BIM for Dynamo 2.x 0.12.0

afmeting_boundingbox_in_meters = IntegerSlider(20000, range=100..20000 step 1)  # "Afmeting boundingbox in meters(breedte, hoogte)"; graph input
code_block = CodeBlock(bboxWidth=afmeting_boundingbox_in_meters) { scale = 1000; width = bboxWidth/1000; }

# group: Bepaal actieve view & bestandsnaam
current = Document.Current()
activeView = Document.ActiveView(document=current)
filePath = Document.FilePath(document=current)
code_block_2 = CodeBlock { ".rvt"; "kadaster.jpg"; }
replace = String.Replace(string=filePath, searchFor=code_block_2.out0, replaceWith=code_block_2.out1)

code_block_3 = CodeBlock { "NL_PDOK_Luchtfoto_actueel_28992"; "serverrequestprefix"; }
GIS2BIM_GetWebServerData = Custom[GIS2BIM_GetWebServerData](title=code_block_3.out0)  # package GIS2BIM for Dynamo 2.x; Get webserverdata from github repository of GIS2BIM(up to date list of GIS-servers & requests)
code_block_4 = CodeBlock { "28992"; }
GIS2BIM_GetRevitSiteLocation = Custom[GIS2BIM_GetRevitSiteLocation]()  # package GIS2BIM for Dynamo 2.x; Gets the properties of the current Site Location of the active Revit Project
toNumber = String.ToNumber(string=GIS2BIM_GetRevitSiteLocation.Lon)
toNumber_2 = String.ToNumber(string=GIS2BIM_GetRevitSiteLocation.Lat)
GIS2BIM_TransformCRS_epsg = Custom[GIS2BIM_TransformCRS_epsg](TargetCRS=code_block_4, xCoordinate=toNumber, yCoordinate=toNumber_2)  # package GIS2BIM for Dynamo 2.x; Uses the API of http://epsg.io to transform Coordinate Reference Systems
GIS2BIM_CreateBoundingBox = Custom[GIS2BIM_CreateBoundingBox](CoordinateX=GIS2BIM_TransformCRS_epsg.Xtransformed, CoordinateY=GIS2BIM_TransformCRS_epsg.Ytransformed, BoxWidth=afmeting_boundingbox_in_meters, BoxHeight=afmeting_boundingbox_in_meters)  # package GIS2BIM for Dynamo 2.x; create boundingboxstring for webrequests based on coördinates and dimensions
concat = String.Concat(string0=GIS2BIM_GetWebServerData, string1=GIS2BIM_CreateBoundingBox.Boxstring)
GIS2BIM_WebrequestWMS = Custom[GIS2BIM_WebrequestWMS](WMSwebrequest=concat)  # package GIS2BIM for Dynamo 2.x; a webrequest based on WMS-protocol
watch_image = WatchImageCore(image=GIS2BIM_WebrequestWMS)
code_block_5 = CodeBlock { "NL_PDOK_natura2000_28992"; "serverrequestprefix"; }
GIS2BIM_GetWebServerData_2 = Custom[GIS2BIM_GetWebServerData](title=code_block_5.out0)
concat_2 = String.Concat(string0=GIS2BIM_GetWebServerData_2, string1=GIS2BIM_CreateBoundingBox.Boxstring)
GIS2BIM_WebrequestWMS_2 = Custom[GIS2BIM_WebrequestWMS](WMSwebrequest=concat_2)
GIS2BIM_ImageMakeTransparant = Custom[GIS2BIM_ImageMakeTransparant](Bitmap=GIS2BIM_WebrequestWMS_2)  # package GIS2BIM for Dynamo 2.x; Makes a System.Drawing.Bitmap transparant
watch_image_2 = WatchImageCore(image=GIS2BIM_ImageMakeTransparant)
list_create = List.Create(item0=watch_image, item1=watch_image_2)
GIS2BIM_MergeImages = Custom[GIS2BIM_MergeImages](images=list_create)  # package GIS2BIM for Dynamo 2.x; Merges a list of images to 1 image
writeToFile = Image.WriteToFile(path=replace, image=GIS2BIM_MergeImages)

# group: Afbeelding inladen
passthrough = Custom[Passthrough](passThrough=replace, waitFor=writeToFile)  # package Clockwork for Dynamo 2.x; Forces a sequential order of execution. The node wired into the output of the Passthrough node will be executed *after* the node wired into the waitFor input (e.g. important for some Revit operations). The value of the passThrough input will be passed on to the node wired into the output port of the Passthrough node.
GIS2BIM_ImportImageInView = Custom[GIS2BIM_ImportImageInView](ImageWidthMeters=code_block.width, view=activeView, ImagePath=passthrough)  # package GIS2BIM for Dynamo 2.x; Import rasterimage in view

byCoordinates = Point.ByCoordinates()
code_block_6 = CodeBlock { "NL_PDOK_natura2000_Contour_28992"; "serverrequestprefix"; }
GIS2BIM_GetWebServerData_3 = Custom[GIS2BIM_GetWebServerData](title=code_block_6.out0, parameter=code_block_6.out1)
code_block_7 = CodeBlock()
# ---------- code_block_7.designscript (2 lines) ----------
//XPATHSTRING
XPATHSTRING: string=".//{http://www.opengis.net/gml/3.2}posList";
# ----------------------------------------
code_block_8 = CodeBlock(rdx=GIS2BIM_TransformCRS_epsg.Xtransformed, rdy=GIS2BIM_TransformCRS_epsg.Ytransformed) { -rdx; -rdy; }
GIS2BIM_GMLData = Custom[GIS2BIM_GMLData](webrequestURL=GIS2BIM_GetWebServerData_3, XPATHString=code_block_7, dx=code_block_8.out0, dy=code_block_8.out1, bboxString=GIS2BIM_CreateBoundingBox.Boxstring)  # package GIS2BIM for Dynamo 2.x
byPatch = Surface.ByPatch(closedCurve=GIS2BIM_GMLData.polyCurves)
closestPointTo = Geometry.ClosestPointTo(geometry=byPatch, other=byCoordinates)
byStartPointEndPoint = Line.ByStartPointEndPoint(startPoint=byCoordinates, endPoint=closestPointTo)
length = Curve.Length(curve=byStartPointEndPoint)
minimumItem = List.MinimumItem(list=length)
byCenterPointRadius = Circle.ByCenterPointRadius(centerPoint=byCoordinates, radius=minimumItem)
code_block_9 = CodeBlock { "_0.50mm"; }
GIS2BIM_CreateDetailLinesFromPolygons = Custom[GIS2BIM_CreateDetailLinesFromPolygons](view=activeView, PolyCurves=byCenterPointRadius, Linestyle=code_block_9)  # package GIS2BIM for Dynamo 2.x; Create detaillines from polygons in a view
watch_image_3 = WatchImageCore(image=GIS2BIM_MergeImages)
