# Dynamo graph gdal.dyn (Dynamo 1.3.3.4651)

boolean = BoolSelector(true)
python_script = Python(IN[0]=boolean)
# ---------- python_script.python (34 lines) ----------
import clr
clr.AddReference('gdal_csharp')

from OSGeo.GDAL import Gdal
from System import Environment
from System.IO import Path

#The inputs to this node will be stored as a list in the IN variables.
dataEnteringNode = IN

gdalPath = "D:\\Workspace\\Git\\3bm\\gdal\\GDAL.NET.Core.2.3.1\\gdal"
nativePath = gdalPath + "\\x64"

path = Environment.GetEnvironmentVariable("PATH")
path = nativePath + ";" + Path.Combine(nativePath, "plugins") + ";" + path
Environment.SetEnvironmentVariable("PATH", path)

gdalData = Path.Combine(gdalPath, "data")
Environment.SetEnvironmentVariable("GDAL_DATA", gdalData)
Gdal.SetConfigOption("GDAL_DATA", gdalData)

driverPath = Path.Combine(nativePath, "plugins");
Environment.SetEnvironmentVariable("GDAL_DRIVER_PATH", driverPath)
Gdal.SetConfigOption("GDAL_DRIVER_PATH", driverPath)

Environment.SetEnvironmentVariable("GEOTIFF_CSV", gdalData)
Gdal.SetConfigOption("GEOTIFF_CSV", gdalData)

projSharePath = Path.Combine(gdalPath, "share")
Environment.SetEnvironmentVariable("PROJ_LIB", projSharePath)
Gdal.SetConfigOption("PROJ_LIB", projSharePath)

#Assign your output to the OUT variable.
OUT = Gdal.VersionInfo("")
# ----------------------------------------
watch = Watch(python_script)
