# Dynamo graph GEF_file.dyn (Dynamo 1.3.1.1736)

# group: INPUT
fractionRatioSand = DoubleInput(0.2)
string = StringInput("90_zand")
file_path = Filename("..\..\..\Users\Maarten\Documents\GitHub\GIS2BIM\supportfiles\ExampleFiles\GEF1.GEF")
fractionRatioPeat = DoubleInput(5)
fractionRatioClay = DoubleInput(2.5)
string_2 = StringInput("SoilClay")
fractionRatioSilt = DoubleInput(1)
string_3 = StringInput("SoilSilt")
string_4 = StringInput("SoilPeat")

code_block = CodeBlock { Point.ByCoordinates(0,0,0); 5000; }
byCenterPointRadius = Circle.ByCenterPointRadius(centerPoint=code_block.out0, radius=code_block.out1)
byPatch = Surface.ByPatch(byCenterPointRadius)
readText = File.ReadText(file_path)
code_block_2 = CodeBlock(t8=readText)
# ---------- code_block_2.designscript (10 lines) ----------
t7 = " ";
t3 = t8;
t1 = "#EOH=";
t2 = String.Split(t3, {t1});
t4 = DSCore.List.LastItem(t2);
t5 = "
";
t6 = String.Split(t4, {t5});
t9 = String.Split(t6, {t7});
t10 = DSCore.List.Transpose(t9);
# ----------------------------------------
depth_column = CodeBlock { 0; }
getItemAtIndex = List.GetItemAtIndex(list=code_block_2.t10, index=depth_column)
depthINmm = Python(IN[0]=getItemAtIndex)
# ---------- depthINmm.python (14 lines) ----------
import clr
clr.AddReference('ProtoGeometry')
from Autodesk.DesignScript.Geometry import *
#The inputs to this node will be stored as a list in the IN variables.
dataEnteringNode = IN

Depths = IN[0]

A= []
for Depth in Depths:
	A.append(-1000*float(Depth))

#Assign your output to the OUT variable.
OUT = A
# ----------------------------------------
frictionratio_column = CodeBlock { 6; }
getItemAtIndex_2 = List.GetItemAtIndex(list=code_block_2.t10, index=frictionratio_column)
frictionRatio = Python(IN[0]=getItemAtIndex_2)
# ---------- frictionRatio.python (14 lines) ----------
import clr
clr.AddReference('ProtoGeometry')
from Autodesk.DesignScript.Geometry import *
#The inputs to this node will be stored as a list in the IN variables.
dataEnteringNode = IN

Depths = IN[0]

A= []
for Depth in Depths:
	A.append(float(Depth))

#Assign your output to the OUT variable.
OUT = A
# ----------------------------------------
lt = frictionRatio < fractionRatioPeat
gt = frictionRatio > fractionRatioClay
lt_2 = frictionRatio < fractionRatioPeat
eq = gt == lt_2
gt_2 = frictionRatio > fractionRatioSilt
lt_3 = frictionRatio < fractionRatioClay
eq_2 = gt_2 == lt_3
lt_4 = frictionRatio < fractionRatioSilt
pressure_column = CodeBlock { 1; }
getItemAtIndex_3 = List.GetItemAtIndex(list=code_block_2.t10, index=pressure_column)
pressureMPA = Python(IN[0]=getItemAtIndex_3)  # same code as frictionRatio
code_block_3 = CodeBlock { 3; 10; }
lt_5 = pressureMPA < code_block_3.out0
sand0to3MPA = StringInput("SoilSand1")
gt_3 = pressureMPA > code_block_3.out0
lt_6 = pressureMPA < code_block_3.out1
eq_3 = gt_3 == lt_6
sand3_10mpa = StringInput("SoilSand2")
gt_4 = pressureMPA > code_block_3.out0
sand10_MPA = StringInput("SoilSand3")
string_5 = StringInput("")
sandLayers3 = If(test=gt_4, true=sand10_MPA, false=string_5)
sandLayers2 = If(test=eq_3, true=sand3_10mpa, false=sandLayers3)
sandLayers1 = If(test=lt_5, true=sand0to3MPA, false=sandLayers2)
string_6 = StringInput("")
sandLayers = If(test=lt_4, true=sandLayers1, false=string_6)
siltLayers = If(test=eq_2, true=string_3, false=sandLayers)
clayLayers = If(test=eq, true=string_2, false=siltLayers)
peatLayers = If(test=lt, true=clayLayers, false=string_4)
python_script = Python(IN[0]=peatLayers)
# ---------- python_script.python (26 lines) ----------
import sys
sys.path.append("C:\Program Files (x86)\IronPython 2.7\Lib")

from itertools import groupby

a= IN[0]

# number of same soillayers
b= [len(list(group)) for key, group in groupby(a)]

# index in list of a new soillayer

c= []
count = 0
for i in b:
    count = count + 1
    c.append(sum(b[:count-1]))

# name of each new soillayer
d= []
count = 0
for i in c:
    d.append(a.__getitem__(c.__getitem__(count)))
    count = count + 1
#Assign your output to the OUT variable.
OUT = b,c,d
# ----------------------------------------
code_block_4 = CodeBlock { 1; }
getItemAtIndex_4 = List.GetItemAtIndex(list=python_script, index=code_block_4)
code_block_5 = CodeBlock { 0; }
code_block_6 = CodeBlock { 0; }
file_path_2 = Filename("..\..\..\..\..\..\ProgramData\Autodesk\RVT 2018\Family Templates\English\Metric Site.rft")
code_block_7 = CodeBlock { ".rfa"; }
concat = String.Concat(arg2=code_block_7)  # unwired: arg0, arg1
code_block_8 = CodeBlock { 2; }

# group: OUTPUT
startDepthSoilLayers = List.GetItemAtIndex(list=depthINmm, index=getItemAtIndex_4)
soillayerName = List.GetItemAtIndex(list=python_script, index=code_block_8)

translate = Geometry.Translate(geometry=byPatch, zTranslation=startDepthSoilLayers)
removeItemAtIndex = List.RemoveItemAtIndex(list=startDepthSoilLayers, indices=code_block_5)
sub = removeItemAtIndex - startDepthSoilLayers
thicken = Surface.Thicken(surface=translate, thickness=sub, both_sides=code_block_6)
code_block_9 = CodeBlock { 0; }
removeItemAtIndex_2 = List.RemoveItemAtIndex(list=soillayerName, indices=code_block_9)
prefix = CodeBlock { "90_SI_soillayer_"; "_depth="; }
concat_2 = String.Concat(prefix.out0, arg2=prefix.out1)  # unwired: arg1
map = List.Map(list=removeItemAtIndex_2, f_x=concat_2)
code_block_10 = CodeBlock { 0; }
removeItemAtIndex_3 = List.RemoveItemAtIndex(list=startDepthSoilLayers, indices=code_block_10)

# group: Spring.ToString
python_script_2 = Python(IN[0]=removeItemAtIndex_3)
# ---------- python_script_2.python (21 lines) ----------
#Copyright(c) 2016, Dimitar Venkov
# @5devene, dimitar.ven@gmail.com

import clr

def tolist(obj1):
	if hasattr(obj1,"__iter__"): return obj1
	else: return [obj1]

def output1(l1):
	if len(l1) == 1: return l1[0]
	else: return l1

num1 = tolist(IN[0])
out1 = []
for i in xrange(len(num1)):
	s1 = str(num1[i])
	if s1[-2:] == ".0": out1.append(s1[:-2])
	else: out1.append(s1)

OUT = output1(out1)
# ----------------------------------------

combine = List.Combine(concat, map, python_script_2)
categories = Categories("Site")
byGeometry = Custom[Springs.FamilyInstance.ByGeometry](geometry=thicken, familyTemplatePath=file_path_2, familyName=combine, category=categories)  # You must provide a valid family template path that will be used for all input geometry objects. The project units(and not the templates) will be used to determine the size of the output geometry. The provided category will be used only if the family template supports it. If not, the default template category will be used instead. Likewise, the family material(provided as a string) will be set only if a material with that name exists in the template. If not, the default material will be used instead ("By Category"). For void cuts, the material settings will be ignored. The Subcategory name is an optional input. If you'd like to skip assigning a Subcategory to any new instance, simply use null. The node expects a unique family name for each geometry object. The rest of the input lists will be processed as if the node lacing is set to longest.
