# Dynamo graph PTStoTopography.dyn (Dynamo 1.3.1.1736)

PTStoPoints = Custom[GIStoBIM.PTStoPoints]()  # convert a pts-file(ascii) to dynamo points; unwired: PTSFile
file_path = Filename("D:\GEO\AHN2\AHNtest4.pts")
PTStoPoints_2 = Custom[GIStoBIM.PTStoPoints](PTSFile=file_path)
byPoints = Topography.ByPoints(PTStoPoints_2)
