# Dynamo graph Pointcloud.dyn (Dynamo 1.3.1.1736)

# group: DOWNLOAD LASZIP
code_block = CodeBlock { "D:/GEO/AHN2"; }
downloadLASZIP = Custom[GIStoBIM.DownloadLASZIP](directory=code_block)  # download and unzip laszip
string = StringInput("/")
string_2 = StringInput("\")
replace = String.Replace(str=code_block, searchFor=string, replaceWith=string_2)

code_block_2 = CodeBlock { "papendrecht"; "westeind"; "85"; }
getLocationdataNetherlands = Custom[GIStoBIM.GetLocationdataNetherlands](city=code_block_2.out0, streetname=code_block_2.out1, housenumber=code_block_2.out2)  # Gives locationdata based on an adress in the Netherlands
code_block_3 = CodeBlock { 200; }
code_block_4 = CodeBlock { "D:/GEO/AHN2"; }
code_block_5 = CodeBlock { "AHNtest4"; }
code_block_6 = CodeBlock { 6; }
code_block_7 = CodeBlock { 10; }
code_block_8 = CodeBlock { "D:/GEO/AHN2/C_38CZ2.LAZ"; }
code_block_9 = CodeBlock { -1; }
mul = getLocationdataNetherlands.RDcoordinate_X_meters * code_block_9
code_block_10 = CodeBlock { -1; }
mul_2 = getLocationdataNetherlands.RDcoordinate_Y_meters * code_block_10
LASZIPCommands = Custom[GIStoBIM.LASZIPCommands](x=getLocationdataNetherlands.RDcoordinate_X_meters, y=getLocationdataNetherlands.RDcoordinate_Y_meters, boundingboxwidthMeters=code_block_3, Targetdirectory=code_block_4, Filename=code_block_5, ClassificationToKeep=code_block_6, KeepEveryNthPoint=code_block_7, LAZFile=code_block_8, TransposeX=mul, TransposeY=mul_2)  # commandline options for LASZIP
buildCMDLASZIP = Custom[GIStoBIM.BuildCMDLASZIP](FilePathLASZIP=downloadLASZIP.laszip, DirectoryPointcloud=replace, Files=LASZIPCommands.LASZIPCommand_AllLAZfiles, Filter=LASZIPCommands.LASZIPCommand_FilterClassification, Reduce=LASZIPCommands.LASZIPCommand_ReducePointCLoudSize, Crop=LASZIPCommands.LASZIPCommand_Cropoptions, Merge=LASZIPCommands.LASZIPCommand_MergeLAZfiles, PathFileFormat=LASZIPCommands.LASZIPCommand_PTSfileformat, Translate=LASZIPCommands.LASZIPCommand_Translate)  # create scriptfile to run laszip
watch = Watch(buildCMDLASZIP.CommandsLASZIP)
code_block_11 = CodeBlock { ""; }
PTStoPoints = Custom[GIStoBIM.PTStoPoints]()  # convert a pts-file(ascii) to dynamo points; unwired: PTSFile

# group: DOWNLOAD AHN
string_3 = StringInput("""import sys
sys.path.append("C:\Program Files (x86)\IronPython 2.7\Lib")
import webbrowser

links = IN[0]

for link in links:
 webbrowser.open(link)
 
OUT = links""")
createBoundingBox = Custom[GIStoBIM.CreateBoundingBox](coordinateX=getLocationdataNetherlands.RDcoordinate_X_meters, coordinateY=getLocationdataNetherlands.RDcoordinate_Y_meters, boxWidth=code_block_3, boxHeight=code_block_3)  # create boundingboxstring for webrequests based on coördinates and dimensions
geoservicesLibraryNetherlands = Custom[GIStoBIM.GeoservicesLibraryNetherlands](BoundingBox=createBoundingBox)  # Library with multiple webadresses which can be used for WFS and WMS webrequests
downloadAHN = Custom[GIStoBIM.DownloadAHN](urlwebrequest=geoservicesLibraryNetherlands.11_AHN2_webrequest_bladindex)  # get the mapnumber(s) of the AHN based on a given boundingbox
open_downloadlink = PythonStringNode(script=string_3, IN[0]=downloadAHN.downloadlink_AHN3)
