# Dynamo graph 3DFier.dyn (Dynamo 1.3.1.1736)

code_block = CodeBlock { "Gouda"; "markt"; "1"; }

# group: INPUT
boundingboxwidth_m = CodeBlock { 500; }

# group: GET GEOSERVICES
getLocationdataNetherlands = Custom[GIS2BIM.GetLocationdataNetherlands](City=code_block.out0, Streetname=code_block.out1, Housenumber=code_block.out2)  # Gives locationdata based on an adress in the Netherlands
createBoundingBox = Custom[GIS2BIM.CreateBoundingBox](CoordinateX=getLocationdataNetherlands.RDcoordinate_X_meters, CoordinateY=getLocationdataNetherlands.RDcoordinate_Y_meters, BoxWidth=boundingboxwidth_m, BoxHeight=boundingboxwidth_m)  # create boundingboxstring for webrequests based on coördinates and dimensions
geoservicesLibraryNetherlands = Custom[GIS2BIM.GeoservicesLibraryNetherlands](BoundingBox=createBoundingBox)  # Library with multiple webadresses which can be used for WFS and WMS webrequests

# group: DOWNLOAD BGT
getMortonCodeCoordinate = Custom[GIS2BIM.GetMortonCodeCoordinate](X=getLocationdataNetherlands.RDcoordinate_X_meters, Y=getLocationdataNetherlands.RDcoordinate_Y_meters)  # Get mortoncode(bitshifting) given 2 coordinates and tiledimension
code_block_2 = CodeBlock { "C:/TEMP"; }
downloadBGTdata = Custom[GIS2BIM.DownloadBGTdata](Mortoncode=getMortonCodeCoordinate, Directory=code_block_2)  # Download BGT-data(dutch GIS-information)
unzipFile = Custom[GIS2BIM.UnzipFile](FilePathZipFile=downloadBGTdata.Location, DirectoryToExtractTo=downloadBGTdata.Directory)  # Unzip zip-file

folder = CodeBlock { "D:/GEO/AHN2"; }

# group: DOWNLOAD LASZIP
downloadLASZIP = Custom[GIS2BIM.DownloadLASZIP](Directory=folder)  # download and unzip laszip
string = StringInput("/")
string_2 = StringInput("\")
replace = String.Replace(str=folder, searchFor=string, replaceWith=string_2)

newFileName = CodeBlock { "AHNtest4"; }
classificationToKeep = CodeBlock { 6; }
keepEveryNthPoint = CodeBlock { 10; }
pathLAZFile = CodeBlock { "D:/GEO/AHN2/C_38CZ2.LAZ"; }
use_this_as_input_if_you_do_not = CodeBlock { ""; }  # "USE THIS AS INPUT IF YOU DO NOT WANT TO USE CERTAIN EDITS"

# group: BUILD CMD
code_block_3 = CodeBlock { -1; }
mul = getLocationdataNetherlands.RDcoordinate_X_meters * code_block_3
code_block_4 = CodeBlock { -1; }
mul_2 = getLocationdataNetherlands.RDcoordinate_Y_meters * code_block_4
LASZIPCommands = Custom[GIS2BIM.LASZIPCommands](X=getLocationdataNetherlands.RDcoordinate_X_meters, Y=getLocationdataNetherlands.RDcoordinate_Y_meters, BoundingboxwidthMeters=boundingboxwidth_m, Targetdirectory=folder, Filename=newFileName, ClassificationToKeep=classificationToKeep, KeepEveryNthPoint=keepEveryNthPoint, LAZFile=pathLAZFile, TranslateX=mul, TranslateY=mul_2)  # commandline options for LASZIP
buildCMDLASZIP = Custom[GIS2BIM.BuildCMDLASZIP](FilePathLASZIP=downloadLASZIP.Laszip, DirectoryPointcloud=replace, Files=LASZIPCommands.LASZIPCommand_AllLAZfiles, Filter=LASZIPCommands.LASZIPCommand_FilterClassification, Reduce=LASZIPCommands.LASZIPCommand_ReducePointCLoudSize, Crop=LASZIPCommands.LASZIPCommand_Cropoptions, Merge=use_this_as_input_if_you_do_not, PathFileFormat=LASZIPCommands.LASZIPCommand_PTSfileformat, Translate=LASZIPCommands.LASZIPCommand_Translate)  # create scriptfile to run laszip

# note: Run the script
watch = Watch(buildCMDLASZIP.CommandsLASZIP)
# note: Unfreeze this node to convert the pts-file to dynamo points
PTStoPoints = Custom[GIS2BIM.PTStoPoints](PTSFile=LASZIPCommands.FilePathPTS)  # frozen; convert a pts-file(ascii) to dynamo points
byPoints = Topography.ByPoints(PTStoPoints)  # frozen

# group: DOWNLOAD AHN
string_3 = StringInput("""import sys
sys.path.append("C:\Program Files (x86)\IronPython 2.7\Lib")
import webbrowser

links = IN[0]

for link in links:
 webbrowser.open(link)
 
OUT = links""")
createBoundingBox_2 = Custom[GIS2BIM.CreateBoundingBox](CoordinateX=getLocationdataNetherlands.RDcoordinate_X_meters, CoordinateY=getLocationdataNetherlands.RDcoordinate_Y_meters, BoxWidth=boundingboxwidth_m, BoxHeight=boundingboxwidth_m)
geoservicesLibraryNetherlands_2 = Custom[GIS2BIM.GeoservicesLibraryNetherlands](BoundingBox=createBoundingBox_2)
downloadAHN = Custom[GIS2BIM.DownloadAHN](Urlwebrequest=geoservicesLibraryNetherlands_2.11_AHN2_webrequest_bladindex)  # get the mapnumber(s) of the AHN based on a given boundingbox
open_downloadlink = PythonStringNode(script=string_3, IN[0]=downloadAHN.downloadlink_AHN3)

boundingboxWidthInMeters = CodeBlock { 200; }
