# Dynamo graph 3Dfier2.dyn (Dynamo 1.3.1.1736)

folder = CodeBlock { "C:/TEMP/3dfier/ahn3"; }

# group: DOWNLOAD LASZIP
downloadLASZIP = Custom[GIS2BIM.DownloadLASZIP](Directory=folder)  # download and unzip laszip
string = StringInput("/")
string_2 = StringInput("\")
replace = String.Replace(str=folder, searchFor=string, replaceWith=string_2)

boundingboxWidthInMeters = CodeBlock { 250; }
newFileName = CodeBlock { "AHNtest4"; }
classificationToKeep = CodeBlock { 6; }
keepEveryNthPoint = CodeBlock { 10; }
pathLAZFile = CodeBlock { "C:/TEMP/C_31CZ2.LAZ"; }
use_this_as_input_if_you_do_not = CodeBlock { ""; }  # "USE THIS AS INPUT IF YOU DO NOT WANT TO USE CERTAIN EDITS"

# group: BUILD CMD
code_block = CodeBlock { -1; }
mul = _ * code_block  # unwired: arg0
code_block_2 = CodeBlock { -1; }
mul_2 = _ * code_block_2  # unwired: arg0
LASZIPCommands = Custom[GIS2BIM.LASZIPCommands](BoundingboxwidthMeters=boundingboxWidthInMeters, Targetdirectory=folder, Filename=newFileName, ClassificationToKeep=classificationToKeep, KeepEveryNthPoint=keepEveryNthPoint, LAZFile=pathLAZFile, TranslateX=mul, TranslateY=mul_2)  # commandline options for LASZIP; unwired: X, Y
buildCMDLASZIP = Custom[GIS2BIM.BuildCMDLASZIP](FilePathLASZIP=downloadLASZIP.Laszip, DirectoryPointcloud=replace, Files=LASZIPCommands.LASZIPCommand_AllLAZfiles, Filter=use_this_as_input_if_you_do_not, Reduce=use_this_as_input_if_you_do_not, Crop=LASZIPCommands.LASZIPCommand_Cropoptions, Merge=use_this_as_input_if_you_do_not, PathFileFormat=LASZIPCommands.LASZIPCommand_LASfileformat, Translate=use_this_as_input_if_you_do_not)  # create scriptfile to run laszip

watch = Watch(buildCMDLASZIP.CommandsLASZIP)
code_block_3 = CodeBlock { "boskoop"; "warmoeskade"; "2"; }
getLocationdataNetherlands = Custom[GIS2BIM.GetLocationdataNetherlands](City=code_block_3.out0, Streetname=code_block_3.out1, Housenumber=code_block_3.out2)  # Gives locationdata based on an adress in the Netherlands

# group: DOWNLOAD AHN
string_3 = StringInput("""import sys
sys.path.append("C:\Program Files (x86)\IronPython 2.7\Lib")
import webbrowser

links = IN[0]

for link in links:
 webbrowser.open(link)
 
OUT = links""")
createBoundingBox = Custom[GIS2BIM.CreateBoundingBox](CoordinateX=getLocationdataNetherlands.RDcoordinate_X_meters, CoordinateY=getLocationdataNetherlands.RDcoordinate_Y_meters, BoxWidth=boundingboxWidthInMeters, BoxHeight=boundingboxWidthInMeters)  # create boundingboxstring for webrequests based on coördinates and dimensions
geoservicesLibraryNetherlands = Custom[GIS2BIM.GeoservicesLibraryNetherlands](BoundingBox=createBoundingBox)  # Library with multiple webadresses which can be used for WFS and WMS webrequests
downloadAHN = Custom[GIS2BIM.DownloadAHN](Urlwebrequest=geoservicesLibraryNetherlands.11_AHN2_webrequest_bladindex)  # get the mapnumber(s) of the AHN based on a given boundingbox
open_downloadlink = PythonStringNode(script=string_3, IN[0]=downloadAHN.downloadlink_AHN3)
