# Dynamo graph 3dfier.dyn (Dynamo 1.3.1.1736)

downloadBGTdata = Custom[GIS2BIM.DownloadBGTdata]()  # Download BGT-data(dutch GIS-information); unwired: Mortoncode, Directory
code_block = CodeBlock()  # frozen
# ---------- code_block.designscript (52 lines) ----------
SCHERM 1
CONTROLESCHERM OF ALLES GEINSTALLEERD IS.
 1.1 GIS2BIM
 1.2 CGAL
 1.3 GCAL
 1.4 3DFIER
 1.5 LIBLAS
 1.6 GRASS
//control met de mogelijkheid om te downloaden en te installeren

SCHERM 2
DATA DOWNLOADEN
2.1 CHECKBOX 1: ADD ADDRESS
 INVOERSCHERM 1
 INVOERSCHERM 2
 INVOERSCHERM 3

2.2 VOER RD-COORDINAAT IN

// 2.2b UITKOMST VAN 2.1 EN/OF 2.2: RD-COORDINAAT X EN Y

2.3 boundingboxafmeting
 limiteer op 1000 meter

// SCHERM MET open streetmaps met boundingbox zichtbaar en rd-coordinaten
//die gelijk ook in te vullen zijn.

// 2.3a maak boundingbox

2.4 selecteer windowsmap waar data inkomt
Map
MAP/BGT
MAP/AHN
MAP/3DFIER
maak mappenstructuur aan in deze map

2.4 selecteer of download BGT link(s)--> commandrun met voortgangscherm
//met browse knop
//2.4b crop de bgt en voeg samen tot nieuwe gml-bestanden
//convert to sqlite

2.5 download AHN;
// als 2.4
//
//

2.6 selecteer bestandslocatie 3dfier;

2.7 3dfier options:
-building height_roof percentile-90(;
);
-building height_floor: percentile-10;
# ----------------------------------------
adress = BoolSelector(true)
# note: 3d fier
code_block_2 = CodeBlock { "boskoop"; "warmoeskade"; "2"; }
getLocationdataNetherlands = Custom[GIS2BIM.GetLocationdataNetherlands](City=code_block_2.out0, Streetname=code_block_2.out1, Housenumber=code_block_2.out2)  # Gives locationdata based on an adress in the Netherlands
rdx = CodeBlock { 300; }
rdy = CodeBlock { 600; }
python_script = Python(IN[0]=adress, IN[1]=getLocationdataNetherlands.RDcoordinate_X_meters, IN[2]=getLocationdataNetherlands.RDcoordinate_Y_meters, IN[3]=rdx, IN[4]=rdy)
# ---------- python_script.python (21 lines) ----------
import clr
clr.AddReference('ProtoGeometry')
from Autodesk.DesignScript.Geometry import *
#The inputs to this node will be stored as a list in the IN variables.
dataEnteringNode = IN

test = IN[0]
X1 = IN[1]
Y1 = IN[2]
X2 = IN[3]
Y2 = IN[4]

if test:
	X = X1
	Y = Y1
else:
	X = X2
	Y = Y2

#Assign your output to the OUT variable.
OUT = X, Y
# ----------------------------------------
code_block_3 = CodeBlock(T=python_script) { T[0]; T[1]; }
width_of_cityblock = CodeBlock { 300; }
createBoundingBox = Custom[GIS2BIM.CreateBoundingBox](CoordinateX=code_block_3.out0, CoordinateY=code_block_3.out1, BoxWidth=width_of_cityblock, BoxHeight=width_of_cityblock)  # create boundingboxstring for webrequests based on coördinates and dimensions
geoservicesLibraryNetherlands = Custom[GIS2BIM.GeoservicesLibraryNetherlands](BoundingBox=createBoundingBox)  # Library with multiple webadresses which can be used for WFS and WMS webrequests
downloadAHN = Custom[GIS2BIM.DownloadAHN](Urlwebrequest=geoservicesLibraryNetherlands.11_AHN2_webrequest_bladindex)  # get the mapnumber(s) of the AHN based on a given boundingbox
code_block_4 = CodeBlock(X=code_block_3.out0)
# ---------- code_block_4.designscript (2 lines) ----------
//X-coordinate
X: double;
# ----------------------------------------
code_block_5 = CodeBlock(BoundingboxWidth=width_of_cityblock) { BoundingboxWidth; }
code_block_6 = CodeBlock(Y=code_block_3.out1)
# ---------- code_block_6.designscript (2 lines) ----------
//Y-coordinate
Y: double;
# ----------------------------------------
code_block_7 = CodeBlock(BoundingboxHeight=width_of_cityblock) { BoundingboxHeight; }
code_block_8 = CodeBlock(X=code_block_4, bboxwidth=code_block_5, Y=code_block_6, bboxheight=code_block_7) { Xleft= X-bboxwidth/2; Xright= X+bboxwidth/2; Ybottom= Y-bboxheight/2; Ytop= Y+bboxheight/2; }
create = List.Create(code_block_8.Xleft, code_block_8.Xright)
create_2 = List.Create(code_block_8.Ybottom, code_block_8.Ytop)
code_block_9 = CodeBlock()
# ---------- code_block_9.designscript (2 lines) ----------
//Modification of X-coordinate
ModX: double=-100000;
# ----------------------------------------
code_block_10 = CodeBlock()
# ---------- code_block_10.designscript (2 lines) ----------
//Modification of Y-coordinate
ModY: double=200000;
# ----------------------------------------
code_block_11 = CodeBlock { TileDimension: double=2000; }
python_script_2 = Python(IN[0]=create, IN[1]=create_2, IN[2]=code_block_9, IN[3]=code_block_10, IN[4]=code_block_11)
# ---------- python_script_2.python (38 lines) ----------
import clr
clr.AddReference('ProtoGeometry')
from Autodesk.DesignScript.Geometry import *
import sys
sys.path.append("C:\Program Files (x86)\IronPython 2.7\Lib")

import math

#The inputs to this node will be stored as a list in the IN variables.
dataEnteringNode = IN
X = IN[0]
Y = IN[1]
Xmod=IN[2]
Ymod=IN[3]
TILE=IN[4]

x = []
for i in X:
	x.append(bin(int(math.floor(((i - Xmod)/TILE)))))
for i in x:
	x.append(str(i[2:]))

y = []
for i in Y:
	y.append(bin(int(math.floor(((i - Ymod)/TILE)))))
for i in y:
	y.append(str(i[2:]))
	
res = []
for g,h in x,y:
	res.append = "".join(i + j for i, j in zip(g, h))
	
#z=(res)

#z = int(z, 2)

#Assign your output to the OUT variable.
OUT = res
# ----------------------------------------
python_script_3 = Python(IN[0]=code_block_8.Xright, IN[1]=code_block_8.Ytop, IN[2]=code_block_9, IN[3]=code_block_10, IN[4]=code_block_11)
# ---------- python_script_3.python (29 lines) ----------
import clr
clr.AddReference('ProtoGeometry')
from Autodesk.DesignScript.Geometry import *
import sys
sys.path.append("C:\Program Files (x86)\IronPython 2.7\Lib")

import math

#The inputs to this node will be stored as a list in the IN variables.
dataEnteringNode = IN
X = IN[0]
Y = IN[1]
Xmod=IN[2]
Ymod=IN[3]
TILE=IN[4]

x = bin(int(math.floor(((X - Xmod)/TILE))))
y = bin(int(math.floor(((Y - Ymod)/TILE))))

x = str(x[2:])
y = str(y[2:])

res = "".join(i + j for i, j in zip(y, x))
z=(res)

z = int(z, 2)

#Assign your output to the OUT variable.
OUT = z
# ----------------------------------------
python_script_4 = Python(IN[0]=create, IN[1]=create_2, IN[2]=code_block_9, IN[3]=code_block_10, IN[4]=code_block_11)
# ---------- python_script_4.python (36 lines) ----------
import clr
clr.AddReference('ProtoGeometry')
from Autodesk.DesignScript.Geometry import *
import sys
sys.path.append("C:\Program Files (x86)\IronPython 2.7\Lib")

import math

#The inputs to this node will be stored as a list in the IN variables.
dataEnteringNode = IN
X = IN[0]
Y = IN[1]
Xmod=IN[2]
Ymod=IN[3]
TILE=IN[4]

x = []
for i in X:
	x.append(bin(int(math.floor(((i - Xmod)/TILE)))))
	x.append(str(i[2:]))

y = []
for i in Y:
	y.append(bin(int(math.floor(((i - Ymod)/TILE)))))
	y.append(str(i[2:]))
	
res = []
for g,h in x,y:
	res.append("".join(i + j for i, j in zip(g, h)))
	
#z=(res)

#z = int(z, 2)

#Assign your output to the OUT variable.
OUT = res
# ----------------------------------------
getMortonCodeCoordinate = Custom[GIS2BIM.GetMortonCodeCoordinate]()  # Get mortoncode(bitshifting) given 2 coordinates and tiledimension; unwired: X, Y
