# Dynamo graph AHN3 WMS.dyn (Dynamo 1.3.3.4111)

webrequestWMS2 = Custom[GIS2BIM.WebrequestWMS2]()  # a webrequest based on WMS-protocol; unwired: WMSwebrequest
watch_image = WatchImageCore(webrequestWMS2)
file_path = Filename("No file selected.")
file_path_2 = Filename("..\..\..\..\..\..\..\TEMP\BGTTEST\2\Geotiff.tif")
createTopo = Elk.Topography.CreateTopo(file_path_2)  # unwired: arg1
code_block = CodeBlock { "roelofarendsveen"; "de lasso-zuid"; "22"; }
getLocationdataNetherlands = Custom[GIS2BIM.GetLocationdataNetherlands](City=code_block.out0, Streetname=code_block.out1, Housenumber=code_block.out2)  # Gives locationdata based on an adress in the Netherlands
code_block_2 = CodeBlock { 250; }
createBoundingBoxLATLONG = Custom[GIS2BIM.CreateBoundingBoxLATLONG](Lat=getLocationdataNetherlands.Latitude, Long=getLocationdataNetherlands.Longitude, WidthMeters=code_block_2)  # create boundingbox with from lat/long coordinate in degrees
constructLocation = Elk.Topography.ConstructLocation(createBoundingBoxLATLONG.West, createBoundingBoxLATLONG.East, createBoundingBoxLATLONG.South, createBoundingBoxLATLONG.North)
writeToFile = Image.WriteToFile()  # unwired: arg0, arg1
link_kadaster = CodeBlock()
# ---------- link_kadaster.designscript (11 lines) ----------
"http://geodata.nationaalgeoregister.nl/";
"ahn3/wms?";
"&request=GetMap";
"&VERSION=1.3.0";
"&STYLES=default";
"&layers=ahn3_05m_dsm";
"&bbox=";
"&width=3000";
"&height=3000";
"&format=image/GeoTIFF";
"&crs=EPSG:28992";
# ----------------------------------------
code_block_3 = CodeBlock { 250; }
createBoundingBox = Custom[GIS2BIM.CreateBoundingBox](CoordinateX=getLocationdataNetherlands.RDcoordinateX_meters_double, CoordinateY=getLocationdataNetherlands.RDcoordinateY_meters_double, BoxWidth=code_block_3, BoxHeight=code_block_3)  # create boundingboxstring for webrequests based on coördinates and dimensions
concat = String.Concat(link_kadaster.out0, link_kadaster.out1, link_kadaster.out2, link_kadaster.out3, link_kadaster.out4, link_kadaster.out5, link_kadaster.out6, createBoundingBox.Boxstring, link_kadaster.out7, link_kadaster.out8, link_kadaster.out9, link_kadaster.out10)
openBrowser = Custom[GIS2BIM.OpenBrowser](url=concat)  # Opens a new window in your default browser with the given url.
