# Dynamo graph AHN3.dyn (Dynamo 1.3.3.4111)

downloadAHN = Custom[GIS2BIM.DownloadAHN]()  # get the mapnumber(s) of the AHN based on a given boundingbox; unwired: Urlwebrequest
openBrowser = Custom[GIS2BIM.OpenBrowser]()  # Opens a new window in your default browser with the given url.; unwired: url
code_block = CodeBlock { "boskoop"; "warmoeskade"; "2"; }
getLocationdataNetherlands = Custom[GIS2BIM.GetLocationdataNetherlands](City=code_block.out0, Streetname=code_block.out1, Housenumber=code_block.out2)  # Gives locationdata based on an adress in the Netherlands
web_request = WebRequest(getLocationdataNetherlands.URLWebrequest)
string = StringInput("\"identificatie\":\"")
split = String.Split(web_request, string)
code_block_2 = CodeBlock(x=split) { x[1]; }
string_2 = StringInput("\",")
split_2 = String.Split(code_block_2, string_2)
code_block_3 = CodeBlock(x=split_2) { identificatie=x[0]; }
string_3 = StringInput("\"id\":\"")
split_3 = String.Split(web_request, string_3)
code_block_4 = CodeBlock(x=split_3) { x[1]; }
string_4 = StringInput("\",")
split_4 = String.Split(code_block_4, string_4)
code_block_5 = CodeBlock(x=split_4) { id=x[0]; }
code_block_6 = CodeBlock()
# ---------- code_block_6.designscript (5 lines) ----------
"http://geodata.nationaalgeoregister.nl/ahn2/wfs?";
"&request=GetFeature";
"&typeName=ahn2_bladindex";
"&outputformat=JSON";
"&bbox=";
# ----------------------------------------
code_block_7 = CodeBlock { 400; }
createBoundingBox = Custom[GIS2BIM.CreateBoundingBox](CoordinateX=getLocationdataNetherlands.RDcoordinateX_meters_double, CoordinateY=getLocationdataNetherlands.RDcoordinateY_meters_double, BoxWidth=code_block_7, BoxHeight=code_block_7)  # create boundingboxstring for webrequests based on coördinates and dimensions
code_block_8 = CodeBlock(bbox=createBoundingBox.Boxstring) { bbox; }
concat = String.Concat(code_block_6.out0, code_block_6.out1, code_block_6.out2, code_block_6.out3, code_block_6.out4, code_block_8)
web_request_2 = WebRequest(concat)
string_5 = StringInput("\"id\":\"")
string_6 = StringInput("\",")
code_block_9 = CodeBlock(result=web_request_2, mindatum=string_5, t7=string_6) { t = String.Split(result, {mindatum}); t6 = String.Split(t[1], {t7}); min_datum = t6[0]; }
string_7 = StringInput("\"min_datum\":\"")
string_8 = StringInput("\",")
code_block_10 = CodeBlock(result=web_request_2, mindatum=string_7, t7=string_8) { t = String.Split(result, {mindatum}); t6 = String.Split(t[1], {t7}); min_datum = t6[0]; }
string_9 = StringInput("\"max_datum\":\"")
string_10 = StringInput("\",")
code_block_11 = CodeBlock(result=web_request_2, mindatum=string_9, t7=string_10) { t = String.Split(result, {mindatum}); t6 = String.Split(t[1], {t7}); min_datum = t6[0]; }
string_11 = StringInput("\"bladnr\":\"")
string_12 = StringInput("\",")
code_block_12 = CodeBlock(result=web_request_2, mindatum=string_11, t7=string_12)
# ---------- code_block_12.designscript (4 lines) ----------
t = String.Split(result, {mindatum});
t = String.Split(result, {mindatum});
t6 = String.Split(t[1], {t7});
min_datum = t6[0];
# ----------------------------------------
string_13 = StringInput("\"cellsize\":\"")
string_14 = StringInput("\",")
code_block_13 = CodeBlock(result=web_request_2, mindatum=string_13, t7=string_14)  # same code as code_block_12
string_15 = StringInput("\"datum\":\"")
string_16 = StringInput("\",")
code_block_14 = CodeBlock(result=web_request_2, mindatum=string_15, t7=string_16)  # same code as code_block_12
string_17 = StringInput("\"lo_x\":\"")
string_18 = StringInput("\",")
code_block_15 = CodeBlock(result=web_request_2, mindatum=string_17, t7=string_18)  # same code as code_block_12
string_19 = StringInput("\"lo_y\":\"")
string_20 = StringInput("\",")
code_block_16 = CodeBlock(result=web_request_2, mindatum=string_19, t7=string_20)  # same code as code_block_12
code_block_17 = CodeBlock(id=code_block_9.min_datum, min_datum=code_block_10.min_datum, max_datum=code_block_11.min_datum, bladnr=code_block_12.out2, cellsize=code_block_13.out2, datum=code_block_14.out2, lo_x=code_block_15.out2, lo_y=code_block_16.out2) { id; min_datum; max_datum; bladnr; cellsize; datum; lo_x; lo_y; }
code_block_18 = CodeBlock()
# ---------- code_block_18.designscript (5 lines) ----------
"http://geodata.nationaalgeoregister.nl/ahn3/wfs?";
"&request=GetFeature";
"&typeName=ahn3_bladindex";
"&outputformat=JSON";
"&bbox=";
# ----------------------------------------
concat_2 = String.Concat(code_block_18.out0, code_block_18.out1, code_block_18.out2, code_block_18.out3, code_block_18.out4, code_block_8)
web_request_3 = WebRequest(concat_2)
code_block_19 = CodeBlock(result=web_request_3) { t = String.Split(result, {mindatum}); t6 = String.Split(t[1], {t7}); min_datum = t6[0]; }  # unwired: mindatum, t7
code_block_20 = CodeBlock(result=web_request_3)  # unwired: mindatum, t7; same code as code_block_12
code_block_21 = CodeBlock(result=web_request_3)  # unwired: mindatum, t7; same code as code_block_12
code_block_22 = CodeBlock(result=web_request_3)  # unwired: mindatum, t7; same code as code_block_12
code_block_23 = CodeBlock(result=web_request_3)  # unwired: mindatum, t7; same code as code_block_12
code_block_24 = CodeBlock(id=code_block_19.min_datum, bladnr=code_block_20.out2, cellsize=code_block_21.out2, lo_x=code_block_22.out2, lo_y=code_block_23.out2) { id; bladnr; cellsize; lo_x; lo_y; }
code_block_25 = CodeBlock { "bbox="; }
split_5 = String.Split(arg1=code_block_25)  # unwired: arg0
geoservicesLibraryNetherlands = Custom[GIS2BIM.GeoservicesLibraryNetherlands](BoundingBox=createBoundingBox.Boxstring)  # Library with multiple webadresses which can be used for WFS and WMS webrequests
web_request_4 = WebRequest(geoservicesLibraryNetherlands.AHN3_webrequest_bladindex_OGC_WFS)
code_block_26 = CodeBlock(url=geoservicesLibraryNetherlands.AHN3_webrequest_bladindex_OGC_WFS) { url; }
code_block_27 = CodeBlock { "/"; }
split_6 = String.Split(code_block_26, code_block_27)
code_block_28 = CodeBlock(a=split_6) { a[2]; }
code_block_29 = CodeBlock()
# ---------- code_block_29.designscript (10 lines) ----------
//XPATHSTRING
".//{http://ahn2.geonovum.nl}bladnr";
".//{http://ahn2.geonovum.nl}cellsize";
".//{http://ahn2.geonovum.nl}lo_x";
".//{http://ahn2.geonovum.nl}lo_y";
".//{http://www.opengis.net/gml/3.2}id";
".//{http://ahn2.geonovum.nl}min_datum";
".//{http://ahn2.geonovum.nl}max_datum";
".//{http://ahn2.geonovum.nl}datum";
".//datum()";
# ----------------------------------------
create = List.Create(code_block_29.out0, code_block_29.out1, code_block_29.out2, code_block_29.out3, code_block_29.out4, code_block_29.out5, code_block_29.out6, code_block_29.out7, code_block_29.out8)
code_block_30 = CodeBlock()
# ---------- code_block_30.designscript (7 lines) ----------
//XPATHSTRING
".//{http://ahn3.geonovum.nl}bladnr";
".//{http://ahn3.geonovum.nl}cellsize";
".//{http://ahn3.geonovum.nl}lo_x";
".//{http://ahn3.geonovum.nl}lo_y";
".//{http://ahn3.geonovum.nl}has_data";
".//{http://www.opengis.net/gml/3.2}ahn3_bladindex";
# ----------------------------------------
create_2 = List.Create(code_block_30.out0, code_block_30.out1, code_block_30.out2, code_block_30.out3, code_block_30.out4, code_block_30.out5)

# group: PYTHON FROM BAKERY
python_script = Python(IN[0]=web_request_4, IN[1]=code_block_28, IN[2]=create, IN[3]=create_2)
# ---------- python_script.python (39 lines) ----------
import clr
import sys
clr.AddReference('ProtoGeometry')
from Autodesk.DesignScript.Geometry import *
sys.path.append("C:\Program Files (x86)\IronPython 2.7\Lib")
#from xml.parsers.expat import expat -- can't find this
import xml.etree.ElementTree as ET
#The inputs to this node will be stored as a list in the IN variables.
xml = IN[0]
ahnNo = IN[1]
xpathstrAHN2 = IN[2]
xpathstrAHN3 = IN[3]

if ahnNo is "ahn2":
	ahnlst = xpathstrAHN2
else:
	ahnlst = xpathstrAHN3	

root = ET.fromstring(xml)

xpathfound = []
for i in ahnlst:
	xpathfound.append(root.findall(i))

xtags = []
xtext = []

for x in xpathfound:
	for i in x:
		xtags.append(i.tag)
		if i.text:
			try:
				xtext.append(i.text)
			except:
				xtext.append("_none_")
		else:
			xtext.append("_none_")
		
OUT = xtext
# ----------------------------------------

code_block_31 = CodeBlock { 0; }
getItemAtIndex = List.GetItemAtIndex(list=python_script, index=code_block_31)
string_21 = StringInput("\"cellsize\":\"")
string_22 = StringInput("\",")
string_23 = StringInput("\"datum\":\"")
string_24 = StringInput("\",")
string_25 = StringInput("\"lo_x\":\"")
code_block_32 = CodeBlock(P=python_script) { bladindex= P[0]; size= P[1]; lo_x= P[2]; lo_y= P[3]; datam_min= P[4]; datum_max= P[5]; datum= P[6]; }
openBrowser_2 = Custom[GIS2BIM.OpenBrowser](url=geoservicesLibraryNetherlands.AHN3_webrequest_bladindex_OGC_WFS)
get_xml_children_texts_and_tags = Custom[Get XML Children Texts and Tags from XML Elements]()  # unwired: xml_elements
string_26 = StringInput("ahn3:lo_x")
getXMLNode = Lists.DataSets.GetXMLNode(web_request_4, string_26)
importImageInView = Custom[GIS2BIM.ImportImageInView]()  # Import rasterimage in view; unwired: ImageWidthMeters, View, ImagePath
downloadAHN_2 = Custom[GIS2BIM.DownloadAHN]()  # unwired: Urlwebrequest
python_script_2 = Python()  # unwired: IN[0], IN[1]
# ---------- python_script_2.python (22 lines) ----------
import clr
clr.AddReference('ProtoGeometry')
from Autodesk.DesignScript.Geometry import *
#The inputs to this node will be stored as a list in the IN variables.
import sys

sys.path.append("C:\Program Files (x86)\IronPython 2.7\Lib")

import xml.etree.ElementTree as ET
xml = IN[0]
xpath = IN[1]

root = ET.fromstring(xml)

xpathfound = root.findall(xpath)

xpathfoundtext = []
for i in xpathfound:
	xpathfoundtext.append(i.text)


OUT = xpathfoundtext
# ----------------------------------------
XMLXPath = Custom[GIS2BIM.XMLXPath]()  # Run an XPathquery on an xml-string; unwired: XMLString, XPathStrings
map = List.Map(f_x=XMLXPath)  # unwired: list
python_script_3 = Python(IN[0]=web_request_4, IN[1]=create_2)
# ---------- python_script_3.python (25 lines) ----------
import clr
clr.AddReference('ProtoGeometry')
from Autodesk.DesignScript.Geometry import *
#The inputs to this node will be stored as a list in the IN variables.
import sys

sys.path.append("C:\Program Files (x86)\IronPython 2.7\Lib")

import xml.etree.ElementTree as ET
xml = IN[0]
xpathlist = IN[1]

root = ET.fromstring(xml)

xpathfounds = []

for i in xpathlist:
	xpathfounds.append(root.findall(i))
	
xpathfoundtext = []
for i in xpathfounds:
	for j in i:
		xpathfoundtext.append(j.text)

OUT = xpathfoundtext
# ----------------------------------------
