# Dynamo graph AHN_CloudCompareImportMesh.dyn (Dynamo 1.3.3.4111)

file_path = Filename("\\NAS-BE-94-5F\3bm\50_projecten\1_3BM_cooperatie\918_Schelp_2.0_Egmond_aan_Zee\918_40_terrein\918_mesh_oct_10.obj")
importFile = Autodesk.Dynamo.MeshToolkit.Mesh.ImportFile(file_path)
code_block = CodeBlock { 250000; }
reduce = Autodesk.Dynamo.MeshToolkit.Mesh.Reduce(importFile, code_block)
code_block_2 = CodeBlock { 1000; }
scale = Autodesk.Dynamo.MeshToolkit.Mesh.Scale(reduce, code_block_2)
firstItem = List.FirstItem(scale)
select_model_element = DSModelElementSelection()  # 1 picked in the model
geometry = Element.Geometry(select_model_element)
code_block_3 = CodeBlock { 0; }
byGeometry = Autodesk.Dynamo.MeshToolkit.Mesh.ByGeometry(geometry, code_block_3)
firstItem_2 = List.FirstItem(byGeometry)
booleanDifference = Autodesk.Dynamo.MeshToolkit.Mesh.BooleanDifference(firstItem, firstItem_2)
toolkitMeshToMesh = Custom[Springs.ToolkitMeshToMesh](tkMesh=booleanDifference)  # Attempts to convert a toolkit mesh to a Dynamo mesh. You obviously need to have the appropriate version of the mesh toolkit package downloaded first.
categories = Categories("GenericModel")
code_block_4 = CodeBlock { "a_gen"; }
byName = Material.ByName(code_block_4)
code_block_5 = CodeBlock { "terrein"; }
byMesh = DirectShape.ByMesh(toolkitMeshToMesh, categories, byName, code_block_5)
code_block_6 = CodeBlock { a=50000; b= Point.ByCoordinates(-a,a,-1000); c= Point.ByCoordinates(a,a,-1000); d= Point.ByCoordinates(-a,a,5000); }
byThreePoints = Plane.ByThreePoints(code_block_6.b, code_block_6.c, code_block_6.d)
intersect = Autodesk.Dynamo.MeshToolkit.Mesh.Intersect(scale, byThreePoints)  # frozen
curves = PolyCurve.Curves(intersect)
flatten = Flatten(curves)
byCurve = ModelCurve.ByCurve(flatten)
code_block_7 = CodeBlock { 300000; }
planeCut = Autodesk.Dynamo.MeshToolkit.Mesh.PlaneCut()  # unwired: arg0, arg1
