# Dynamo graph ArcGISAPI.dyn (Dynamo 1.3.2.2480)

deserialise = DynaWeb.Helpers.Deserialise()  # unwired: arg0
views = Views()
code_block = CodeBlock { "_0.18"; }
createDetailLinesFromPolygons = Custom[GIS2BIM.CreateDetailLinesFromPolygons](View=views, Linestyle=code_block)  # Create detaillines from polygons in a view; unwired: PolyCurves
gis2bim = Custom[GIS2BIM.CoordinateReferenceSystemsLibrary(CRS)]()  # Library
code_block_2 = CodeBlock { "ualenastreet"; "101"; "honolulu"; "hawai"; }
geoCodingGoogleAPI = Custom[GIS2BIM.GeoCodingGoogleAPI](Streetname=code_block_2.out0, Housenumber=code_block_2.out1, Place=code_block_2.out2, Country=code_block_2.out3)  # gets coordinate from adress with google API
transformCRS_epsg = Custom[GIS2BIM.TransformCRS_epsg](sourceCRS=gis2bim.WGS84, targetCRS=gis2bim.NAD83_HARN_Hawai_zone_3_ftUS, x_coordinate=geoCodingGoogleAPI.Longitude, y_coordinate=geoCodingGoogleAPI.Latitude)  # Uses the API of http://epsg.io to transform Coordinate Reference Systems
arcGISJSONtoPolygons = Custom[GIS2BIM.ArcGISJSONtoPolygons](X=transformCRS_epsg.Xtransformed, Y=transformCRS_epsg.Ytransformed)  # Convert a JSON-file from a ARCGIS-server to points and polygons; unwired: JSONConvertedToLists
hawaiGeoservicesLibrary = Custom[GIS2BIM.HawaiGeoservicesLibrary]()  # Library with multiple webadresses which can be used for WFS and WMS webrequests
code_block_3 = CodeBlock(WebserverAddress=hawaiGeoservicesLibrary.Hawai_Cadastral_Address) { WebserverAddress; }
code_block_4 = CodeBlock()
# ---------- code_block_4.designscript (30 lines) ----------
"query?";
"where=";
"&text=";
"&objectIds=";
"&time=";
"&geometry=";
"%2C";

"&geometryType=esriGeometryEnvelope";
"&inSR=3760";
"&spatialRel=esriSpatialRelIntersects";
"&relationParam=";
"&outFields=*";
"&returnGeometry=true";
"&returnTrueCurves=false";
"&maxAllowableOffset=";
"&geometryPrecision=";
"&outSR=";
"&returnIdsOnly=false";
"&returnCountOnly=false";
"&orderByFields=";
"&groupByFieldsForStatistics=";
"&outStatistics=";
"&returnZ=false";
"&returnM=false";
"&gdbVersion=";
"&returnDistinctValues=false";
"&resultOffset=";
"&resultRecordCount=";
"&f=json";
# ----------------------------------------
boundingbox_width_and_height_in = CodeBlock { 2000; }  # "Boundingbox width and height(In surveyFeet)"
createBoundingBox = Custom[GIS2BIM.CreateBoundingBox](CoordinateX=transformCRS_epsg.Xtransformed, CoordinateY=transformCRS_epsg.Ytransformed, BoxWidth=boundingbox_width_and_height_in, BoxHeight=boundingbox_width_and_height_in)  # create boundingboxstring for webrequests based on coördinates and dimensions
concat = String.Concat(code_block_3, code_block_4.out0, code_block_4.out1, code_block_4.out2, code_block_4.out3, code_block_4.out4, code_block_4.out5, createBoundingBox.Boxstring2, code_block_4.out7, code_block_4.out8, code_block_4.out9, code_block_4.out10, code_block_4.out11, code_block_4.out12, code_block_4.out13, code_block_4.out14, code_block_4.out15, code_block_4.out16, code_block_4.out17, code_block_4.out18, code_block_4.out19, code_block_4.out20, code_block_4.out21, code_block_4.out22, code_block_4.out23, code_block_4.out24, code_block_4.out25, code_block_4.out26, code_block_4.out27, code_block_4.out28)
code_block_5 = CodeBlock(WebrequestLink=concat) { WebrequestLink; }
web_request = WebRequest()  # unwired: arg0

# group: Input
string = StringInput("https://jsonplaceholder.typicode.com")
# note: The "users/1" endpoint is REST convention for
# - GET me the resource
# - that is part of USERS
# - and has ID=1
# Each REST API will obviously have its own specs, but this is the general approach taken by REST services.
string_2 = StringInput("users/1")
string_3 = StringInput("todos")
string_4 = StringInput("https://jsonplaceholder.typicode.com/users")
# note: TIP : change the resource for the client-based request to see the results update without having to mess with URLs.
# The REST API service used in these examples supports the following endpoints :
# /posts : 100 items
# /comments : 500 items
# /albums : 100 items
# /photos : 5000 items
# /todos : 200 items
# /users : 10 items
# This also affects the deserialisation at the end, so watch out for the consequences there.
# Also play with the resource ID to retrieve specific elements.
string_5 = StringInput("comments")
string_6 = StringInput("posts")
string_7 = StringInput("posts/3")
string_8 = StringInput("photos")
string_9 = StringInput("albums")

# group: Build WebClient
byUrl = DynaWeb.WebClient.ByUrl(string)

# group: Build WebRequest for use with client
byEndpoint = DynaWeb.WebRequest.ByEndpoint(string_2)

# group: Execute request on WebClient
execute = DynaWeb.WebClient.Execute(byUrl, byEndpoint)

# group: Response
# note: In this example, we're retrieving
# a single "user" from the API.
content = DynaWeb.WebResponse.Content(execute)
watch = Watch(content)

# group: Rebase the JSON on a specific node.
string_10 = StringInput("$.address")
selectJsonRoot = DynaWeb.Helpers.SelectJsonRoot(watch, string_10)
watch_2 = Watch(selectJsonRoot)
# note: What this does is effectively ignore anything that came before the "address" node, as well as anything that comes after and is not a direct child of this node.
# Tip: this field is dynamic, so no need to chain multiple SelectJsonRoot nodes, you can simply chain the objects using the dot notation :
# ex : $root.object.child1.child2
string_11 = StringInput("$.address.geo.lat")
selectJsonRoot_2 = DynaWeb.Helpers.SelectJsonRoot(watch, string_11)
watch_3 = Watch(selectJsonRoot_2)

# group: Deserialise address
deserialiseAsDictionary = DynaWeb.Helpers.DeserialiseAsDictionary(watch_2)
watch_values = Watch(deserialiseAsDictionary.out1)
watch_properties = Watch(deserialiseAsDictionary.out0)

# group: Deserialise JSON to dictionary
# note: Use DeserialiseAsDictionary with workflows where both property name and value are required.
# A good example is deserialising the address, where both the label ("street", "city" etc) and the value ("Kulas Light" etc) would be useful when saving to Excel or generally using in formatted outputs.
# As you can notice from the example, this node is not recursive, so it will not deserialise child objects or JSON arrays. Use the Deserialise node above for that.
deserialiseAsDictionary_2 = DynaWeb.Helpers.DeserialiseAsDictionary(watch)
watch_values_2 = Watch(deserialiseAsDictionary_2.out1)
# note: Values can continue to be deserialised, such as the address in this example.
code_block_6 = CodeBlock(json=watch_values_2) { json[4]; }
# note: Or you could use the Deserialise node to get all the values in one go instead of requiring multiple dictionary nodes, keeping the list structure.
deserialise_2 = DynaWeb.Helpers.Deserialise(code_block_6)
watch_values_3 = Watch(deserialise_2)
watch_properties_2 = Watch(deserialiseAsDictionary_2.out0)
deserialiseAsDictionary_3 = DynaWeb.Helpers.DeserialiseAsDictionary(code_block_6)
# note: And then deserialising the lat/long further.
code_block_7 = CodeBlock(json=deserialiseAsDictionary_3.out1) { json[4]; }
deserialiseAsDictionary_4 = DynaWeb.Helpers.DeserialiseAsDictionary(code_block_7)

# group: time it took to execute the request
time = DynaWeb.WebResponse.Time(execute)

# group: Debug : the URL the client calls
# note: The WebClient.BuildUri node takes the base URL supplied to the client and the resource supplied to the WeRequest and combines them into the final URL that will be Executed.
# This node is useful as preview and checking mechanisms.
buildUri = DynaWeb.WebClient.BuildUri(byUrl, byEndpoint)
watch_4 = Watch(buildUri)

# group: alternative way to build WebRequest
# note: The 2 nodes below achieve the same result as the WebRequest.ByEndpoint node above.
byUrl_2 = DynaWeb.WebRequest.ByUrl(string)
setResource = DynaWeb.WebRequest.SetResource(byUrl_2, string_3)

# group: Build & Execute simple request
byUrl_3 = DynaWeb.WebRequest.ByUrl(string_4)
execute_2 = DynaWeb.WebRequest.Execute(byUrl_3)

# group: time it took to execute the request
# note: Tip : if the time reports 0, try reconnecting the WebRequest node to the input of this node and the value should update.
time_2 = DynaWeb.WebResponse.Time(execute_2)

# group: Response
content_2 = DynaWeb.WebResponse.Content(execute_2)
watch_5 = Watch(content_2)

# group: Deserialise
# note: The Deserialise method is recursive, so it affects all levels of the JSON string, making it much more effective than deserialising to dictionary as below.
# In this example, we're deserialising a JSON array of "users" and all their properties in one go.
# However, you only ever get the values using this method, whereas certain workflows might also require the name of properties, not just the values.
# To get both, use the DeserialiseAsDictionary method below.
deserialise_3 = DynaWeb.Helpers.Deserialise(watch_5)
watch_values_4 = Watch(deserialise_3)

string_12 = StringInput("users")
arcGIS_REST_API_QUERY = Custom[GIS2BIM.ArcGIS_REST_API_QUERY](WebserverAddress=hawaiGeoservicesLibrary.Hawai_Cadastral_Tax_Parcel, Boundingbox=createBoundingBox.Boxstring2, CRS=gis2bim.NAD83_HARN_Hawai_zone_3_ftUS)  # Create query to connect to arcGIS webservers
web_request_2 = WebRequest(arcGIS_REST_API_QUERY)

# group: Deserialise JSON to dictionary
deserialiseAsDictionary_5 = DynaWeb.Helpers.DeserialiseAsDictionary(web_request_2)
watch_properties_3 = Watch(deserialiseAsDictionary_5.out0)
# note: Use DeserialiseAsDictionary with workflows where both property name and value are required.
# A good example is deserialising the address, where both the label ("street", "city" etc) and the value ("Kulas Light" etc) would be useful when saving to Excel or generally using in formatted outputs.
# As you can notice from the example, this node is not recursive, so it will not deserialise child objects or JSON arrays. Use the Deserialise node above for that.
watch_values_5 = Watch(deserialiseAsDictionary_5.out1)
code_block_8 = CodeBlock(json=watch_values_5) { json[5]; }
# note: Values can continue to be deserialised, such as the address in this example.
deserialise_4 = DynaWeb.Helpers.Deserialise(code_block_8)
# note: Or you could use the Deserialise node to get all the values in one go instead of requiring multiple dictionary nodes, keeping the list structure.
watch_values_6 = Watch(deserialise_4)
deserialiseAsDictionary_6 = DynaWeb.Helpers.DeserialiseAsDictionary(code_block_8)
# note: And then deserialising the lat/long further.
code_block_9 = CodeBlock(json=deserialiseAsDictionary_6.out1) { json[4]; }
deserialiseAsDictionary_7 = DynaWeb.Helpers.DeserialiseAsDictionary(code_block_9)

code_block_10 = CodeBlock { "$..wkid"; "$..latestWkid"; "$...TAXPIN"; }
create = List.Create(code_block_10.out0, code_block_10.out1, code_block_10.out2)

# group: Rebase the JSON on a specific node.
selectJsonRoot_3 = DynaWeb.Helpers.SelectJsonRoot(web_request_2, create)
watch_6 = Watch(selectJsonRoot_3)

southAfricaGeoservicesLibrary = Custom[GIS2BIM.SouthAfricaGeoservicesLibrary]()  # Geoservices in South-Africa
code_block_11 = CodeBlock {  }
code_block_12 = CodeBlock { 2; }
getItemAtIndex = List.GetItemAtIndex(list=selectJsonRoot_3, index=code_block_12)
python_script = Python(IN[0]=web_request_2)
# ---------- python_script.python (12 lines) ----------
import clr
clr.AddReference("Newtonsoft.Json")

from Newtonsoft.Json import JsonSerializer
from Newtonsoft.Json import JsonConvert

jsonstring = IN[0]

XNode = JsonConvert.DeserializeXmlNode(jsonstring, "spatialReference")

#Assign your output to the OUT variable.
OUT = XNode
# ----------------------------------------
python_script_2 = Python()  # unwired: IN[0]; same code as python_script
