# Dynamo graph BAG 3D-2.dyn (Dynamo 1.3.3.4111)

code_block = CodeBlock { "Gouda"; "Wijdstraat"; "17"; }
getLocationdataNetherlands = Custom[GIS2BIM.GetLocationdataNetherlands](City=code_block.out0, Streetname=code_block.out1, Housenumber=code_block.out2)  # Gives locationdata based on an adress in the Netherlands
code_block_2 = CodeBlock { 400; }
createBoundingBox = Custom[GIS2BIM.CreateBoundingBox](CoordinateX=getLocationdataNetherlands.RDcoordinateX_meters_double, CoordinateY=getLocationdataNetherlands.RDcoordinateY_meters_double, BoxWidth=code_block_2, BoxHeight=code_block_2)  # create boundingboxstring for webrequests based on coördinates and dimensions
geoservicesLibraryNetherlands = Custom[GIS2BIM.GeoservicesLibraryNetherlands](BoundingBox=createBoundingBox.Boxstring)  # Library with multiple webadresses which can be used for WFS and WMS webrequests
web_request = WebRequest(geoservicesLibraryNetherlands.3D_BAG_TU_Delft_OGC_WFS)
string = StringInput(".//{3dbag}identificatie")
string_2 = StringInput(".//{3dbag}bouwjaar")
string_3 = StringInput(".//{http://www.opengis.net/gml}posList")
string_4 = StringInput(".//{3dbag}ground-0.00")
string_5 = StringInput(".//{3dbag}ground-0.50")
string_6 = StringInput(".//{3dbag}roof-0.00")
string_7 = StringInput(".//{3dbag}roof-0.50")
string_8 = StringInput(".//{3dbag}roof-0.99")
create = List.Create(string, string_2, string_3, string_4, string_5, string_6, string_7, string_8)
XMLXPath = Custom[GIS2BIM.XMLXPath](XMLString=web_request, XPathStrings=create)  # Run an XPathquery on an xml-string
code_block_3 = CodeBlock(a=XMLXPath) { polygons=a[2]; bottom=a[4]; top=a[7]; }
code_block_4 = CodeBlock(rdx=getLocationdataNetherlands.RDcoordinateX_meters_double, rdy=getLocationdataNetherlands.RDcoordinateY_meters_double) { rdx; rdy; peil_NAP=2.05; }
code_block_5 = CodeBlock(t8=code_block_3.polygons, rdx=code_block_4.rdx, rdy=code_block_4.rdy, zbottom=code_block_3.bottom, peil_NAP=code_block_4.peil_NAP, ztop=code_block_3.top)
# ---------- code_block_5.designscript (9 lines) ----------
t7 = String.Split(t8, {" "});
t9 = DSCore.List.DropEveryNthItem(t7@-2<1>, 3, 0);
rdxlist = DSCore.String.ToNumber(DSCore.List.DropEveryNthItem(t9@-2<1>, 2, 0));
rdylist = DSCore.String.ToNumber(DSCore.List.DropEveryNthItem(t9@-2<1>, 2, 1));
xlocal= DSCore.Math.Round(1000*(rdxlist-rdx));
ylocal= DSCore.Math.Round(1000*(rdylist-rdy));
zlocalbottom=1000*(DSCore.String.ToNumber(zbottom)-peil_NAP);
zlocaltop=1000*(DSCore.String.ToNumber(ztop)-peil_NAP);
thickness=zlocaltop-zlocalbottom;
# ----------------------------------------
byCoordinates = Point.ByCoordinates(x=code_block_5.xlocal, y=code_block_5.ylocal, z=code_block_5.zlocalbottom)
byPoints = PolyCurve.ByPoints(points=byCoordinates)
byPatch = Surface.ByPatch(byPoints)
boolean = BoolSelector(false)
thicken = Surface.Thicken(surface=byPatch, thickness=code_block_5.thickness, both_sides=boolean)
sendTo = Custom[Clipboard.SendTo](str=geoservicesLibraryNetherlands.3D_BAG_TU_Delft_OGC_WFS)  # Copies a string to the clipboard.
