# Dynamo graph BAG bug.dyn (Dynamo 1.3.3.4111)

importImageInView = Custom[GIS2BIM.ImportImageInView]()  # Import rasterimage in view; unwired: ImageWidthMeters, View, ImagePath
createPointsPolygonFromGMLxy = Custom[GIS2BIM.CreatePointsPolygonFromGMLxy]()  # Create point and polygons from a GML-file; unwired: XML, DeltaX, DeltaY
code_block = CodeBlock { "lekkerkerk"; "korte achterweg"; "11"; }
getLocationdataNetherlands = Custom[GIS2BIM.GetLocationdataNetherlands](City=code_block.out0, Streetname=code_block.out1, Housenumber=code_block.out2)  # Gives locationdata based on an adress in the Netherlands
code_block_2 = CodeBlock { 200; }
createBoundingBox = Custom[GIS2BIM.CreateBoundingBox](CoordinateX=getLocationdataNetherlands.RDcoordinateX_meters_double, CoordinateY=getLocationdataNetherlands.RDcoordinateY_meters_double, BoxWidth=code_block_2, BoxHeight=code_block_2)  # create boundingboxstring for webrequests based on coördinates and dimensions
geoservicesLibraryNetherlands = Custom[GIS2BIM.GeoservicesLibraryNetherlands](BoundingBox=createBoundingBox.Boxstring)  # Library with multiple webadresses which can be used for WFS and WMS webrequests
web_request = WebRequest(geoservicesLibraryNetherlands.4_bag_pand_OGC_WFS)
code_block_3 = CodeBlock()
# ---------- code_block_3.designscript (9 lines) ----------
//xpath
".//{http://bag.geonovum.nl}identificatie";
".//{http://bag.geonovum.nl}bouwjaar";
".//{http://bag.geonovum.nl}status";
".//{http://bag.geonovum.nl}gebruiksdoel";
".//{http://bag.geonovum.nl}oppervlakte_min";
".//{http://bag.geonovum.nl}oppervlakte_max";
".//{http://bag.geonovum.nl}aantal_verblijfsobjecten";
".//{http://bag.geonovum.nl}geometrie";
# ----------------------------------------
create = List.Create(code_block_3.out0, code_block_3.out1, code_block_3.out2, code_block_3.out3, code_block_3.out4, code_block_3.out5, code_block_3.out6)
XMLXPath = Custom[GIS2BIM.XMLXPath](XMLString=web_request, XPathStrings=create)  # Run an XPathquery on an xml-string
web_request_2 = WebRequest(geoservicesLibraryNetherlands.3_bag_verblijfsobject_OGC_WFS)
code_block_4 = CodeBlock()
# ---------- code_block_4.designscript (13 lines) ----------
//xpath
".//{http://bag.geonovum.nl}identificatie";
".//{http://bag.geonovum.nl}oppervlakte";
".//{http://bag.geonovum.nl}status";
".//{http://bag.geonovum.nl}gebruiksdoel";
".//{http://bag.geonovum.nl}openbare_ruimte";
".//{http://bag.geonovum.nl}huisnummer";
".//{http://bag.geonovum.nl}postcode";
".//{http://bag.geonovum.nl}woonplaats";
".//{http://bag.geonovum.nl}bouwjaar";
".//{http://bag.geonovum.nl}pandidentificatie";
".//{http://bag.geonovum.nl}pandstatus";
".//{http://bag.geonovum.nl}geometrie";
# ----------------------------------------
create_2 = List.Create(code_block_4.out0, code_block_4.out1, code_block_4.out2, code_block_4.out3, code_block_4.out4, code_block_4.out5, code_block_4.out6, code_block_4.out7, code_block_4.out8, code_block_4.out9, code_block_4.out10, code_block_4.out11)
XMLXPath_2 = Custom[GIS2BIM.XMLXPath](XMLString=web_request_2, XPathStrings=create_2)
python_script = Python()  # unwired: IN[0]; starter script, not edited (OUT = 0)
python_script_2 = Python(IN[0]=web_request)  # unwired: IN[1]
# ---------- python_script_2.python (53 lines) ----------
import clr
import sys
clr.AddReference('ProtoGeometry')
from Autodesk.DesignScript.Geometry import *
sys.path.append("C:\Program Files (x86)\IronPython 2.7\Lib")
#from xml.parsers.expat import expat -- can't find this
import xml.etree.ElementTree as ET
#The inputs to this node will be stored as a list in the IN variables.
xml = IN[0]
xpathstr = IN[1]

root = ET.fromstring(xml)

xpathfound = root.findall(xpathstr)
#xparentstr = xpathstr + "/.."
#xparentfound = root.findall(xpathstr+"/..")
xtags, xtext, xcountattrib, xattrib, xattvals, xcountiter, xitertags, xitervals, xparents = [], [], [], [], [], [], [], [], []
for x in xpathfound:
	xtags.append(x.tag)
	if x.text:
		try:
			xtext.append(x.text)
		except:
			xtext.append("_none_")
	else:
		xtext.append("_none_")
	if x.keys():
		xcountattrib.append(len(x.items()))
		for name, value in x.items():
			xattrib.append(name)
			xattvals.append(value)
#PARENT CODE BELOW IS TOO SLOW
#			try:
#				xparents.append(root.find(xpathstr + "/" + name + "/.."))
#			except:
#				xparents.append("no parent found")
	else:
		xcountattrib.append(1)
		xattrib.append("_none_")
		xattvals.append("_none_")

#THIS METHOD NOT GREAT
#	if x.iter():
#		xcountiter.append(len(x.iter()))
#		for name, value in x.iter():
#			xitertags.append(name)
#			xitervals.append(value)
#for y in xparentfound:
#	xparents.append(y.tag)

OUT = root, str(root), xpathfound, xtags, xtext, xcountattrib, xattrib, xattvals
#, xparents 
#, xparentfound#, xparents#, xcountiter, xitertags, xitervals
# ----------------------------------------
code_block_5 = CodeBlock(a=python_script_2) { a[2]; }
split_xml_and_return_lists = Custom[Split XML and Return Lists](file_string=code_block_5)  # unwired: tagName
get_elementtree_object_from_xml = Custom[Get ElementTree object from XML File Path]()  # this may break with utf8; unwired: xml_File_Path
iterate_through_xml_elementtree = Custom[Iterate through XML ElementTree]()  # unwired: ElementTree
createDetailLinesFromPolygons = Custom[GIS2BIM.CreateDetailLinesFromPolygons]()  # Create detaillines from polygons in a view; unwired: View, PolyCurves, Linestyle
code_block_6 = CodeBlock()
# ---------- code_block_6.designscript (5 lines) ----------
//xpath
".//{http://bag.geonovum.nl}geometrie";
".//{http://bag.geonovum.nl}pandgeometrie";
".//{http://www.opengis.net/gml/3.2}surfaceMember";
".//{http://www.opengis.net/gml/3.2}poslist";
# ----------------------------------------
create_3 = List.Create(code_block_6.out0)
python_script_3 = Python(IN[0]=web_request, IN[1]=create_3)  # frozen
# ---------- python_script_3.python (27 lines) ----------
import clr
clr.AddReference('ProtoGeometry')
from Autodesk.DesignScript.Geometry import *

import sys
sys.path.append("C:\Program Files (x86)\IronPython 2.7\Lib")

import xml.etree.ElementTree as ET
xml = IN[0]
xpathlist = IN[1]

root = ET.fromstring(xml)

xpathsfound = []

for i in xpathlist:
	xpathsfound.append(root.findall(i))
	
xpathresult = []
for i in range(len(xpathsfound)):
	xtext = []
	for j in range(len(xpathsfound[0])):
		try: xtext.append(xpathsfound[i][j].text)
		except: xtext.append("_none")
	xpathresult.append(xtext)

OUT = xpathresult
# ----------------------------------------
code_block_7 = CodeBlock()
# ---------- code_block_7.designscript (4 lines) ----------
//NOT WORKING
".//{http://bag.geonovum.nl}geometrie//{http://www.opengis.net/gml/3.2}poslist";
".//{http://bag.geonovum.nl}geometrie//poslist";
"//{http://bag.geonovum.nl}geometrie//{http://www.opengis.net/gml/3.2}poslist";
# ----------------------------------------
python_script_4 = Python(IN[0]=web_request, IN[1]=code_block_6.out0)  # same code as python_script_2
code_block_8 = CodeBlock(A=python_script_4) { A[2]; A[0]; }
xpath_expression_find_for = Custom[XPATH Expression Find for Element Tree](ElementTree=code_block_8.out1)  # unwired: XPATH
iterate_through_xml_elementtree_2 = Custom[Iterate through XML ElementTree]()  # unwired: ElementTree
python_script_5 = Python(IN[0]=code_block_8.out0)
# ---------- python_script_5.python (30 lines) ----------
import clr
import sys
clr.AddReference('ProtoGeometry')
from Autodesk.DesignScript.Geometry import *
sys.path.append("C:\Program Files (x86)\IronPython 2.7\Lib")
#from xml.parsers.expat import expat -- can't find this
import xml.etree.ElementTree as ET
#The inputs to this node will be stored as a list in the IN variables.
xmElems = IN[0]

#xmParsed = xmTree.parse(xmlFile)
#root = xmTree.getroot()
itertaglist, iterattriblist, attribnames, attribvals, itertexts = [], [], [], [], []
for elem in xmElems:
	itertaglist.append(elem.tag)
	if elem.keys():
		iterattriblist.append(len(elem.items()))
		for name, value in elem.items():
			attribnames.append(name)
			attribvals.append(value)
	else:
		iterattriblist.append(0)
		attribnames.append("no name")
		attribvals.append("no values")
	try:
		itertexts.append(elem.text)
	except:
		itertexts.append("no texts")

OUT = itertaglist, itertexts, iterattriblist, attribnames, attribvals
# ----------------------------------------
python_script_6 = Python(IN[0]=code_block_8.out0, IN[1]=code_block_6.out3)
# ---------- python_script_6.python (25 lines) ----------
import clr
clr.AddReference('ProtoGeometry')
from Autodesk.DesignScript.Geometry import *

import sys
sys.path.append("C:\Program Files (x86)\IronPython 2.7\Lib")

import xml.etree.ElementTree as ET
roots = IN[0]
xpath = IN[1]

xpathsfound = []

for i in root:
	xpathsfound.append(i.findall(xpath))
	
xpathresult = []
for i in range(len(xpathsfound)):
	xtext = []
	for j in range(len(xpathsfound[0])):
		try: xtext.append(xpathsfound[i][j].text)
		except: xtext.append("_none")
	xpathresult.append(xtext)

OUT = xpathsfound
# ----------------------------------------
