# Dynamo graph BGT New 2.dyn (Dynamo 2.10.1.3976)
# packages: GIS2BIM for Dynamo 2.x 0.11.19, DynaWeb 1.0.3

code_block = CodeBlock { "28992"; }
GIS2BIM_GetRevitSiteLocation = Custom[GIS2BIM_GetRevitSiteLocation]()  # package GIS2BIM for Dynamo 2.x; Gets the properties of the current Site Location of the active Revit Project
toNumber = String.ToNumber(str=GIS2BIM_GetRevitSiteLocation.Lon)
toNumber_2 = String.ToNumber(str=GIS2BIM_GetRevitSiteLocation.Lat)
GIS2BIM_TransformCRS_epsg = Custom[GIS2BIM_TransformCRS_epsg](TargetCRS=code_block, xCoordinate=toNumber, yCoordinate=toNumber_2)  # package GIS2BIM for Dynamo 2.x; Uses the API of http://epsg.io to transform Coordinate Reference Systems
code_block_2 = CodeBlock { 400; }
GIS2BIM_CreateBoundingBox = Custom[GIS2BIM_CreateBoundingBox](CoordinateX=GIS2BIM_TransformCRS_epsg.Xtransformed, CoordinateY=GIS2BIM_TransformCRS_epsg.Ytransformed, BoxWidth=code_block_2, BoxHeight=code_block_2)  # package GIS2BIM for Dynamo 2.x; create boundingboxstring for webrequests based on coördinates and dimensions
code_block_3 = CodeBlock { "https://api.pdok.nl/lv/bgt/download/v1_0/full/custom"; }
byUrl = DynaWeb.WebRequest.ByUrl(url=code_block_3)
code_block_4 = CodeBlock { "POST"; }
setMethod = DynaWeb.WebRequest.SetMethod(webRequest=byUrl, method=code_block_4, lacing=Shortest)
code_block_5 = CodeBlock { "accept"; "application/json"; "Content-type"; "application/json"; }
addHeader = DynaWeb.WebRequest.AddHeader(webRequest=setMethod, name=code_block_5.out0, value=code_block_5.out1)
code_block_6 = CodeBlock { "data"; "RequestBody"; }
string = StringInput("{\"featuretypes\":[\"waterdeel\"],\"format\":\"gmllight\",\"geofilter\":\"POLYGON((213089 593892, 217076 593892, 217076 597981, 213089 597981, 213089 593892))\"}")
addParameter = DynaWeb.WebRequest.AddParameter(webRequest=addHeader, name=code_block_6.out0, value=string, parameterType=code_block_6.out1)
string_2 = StringInput("application/json")
addHeader_2 = DynaWeb.WebRequest.AddHeader(webRequest=addParameter, name=code_block_5.out2, value=string_2)
execute = DynaWeb.WebRequest.Execute(request=addHeader_2)
content = DynaWeb.WebResponse.Content(webResponse=execute)
GIS2BIM_BGTGeometry = Custom[GIS2BIM_BGTGeometry]()  # package GIS2BIM for Dynamo 2.x; Returns BGT-curves and metadata(Dutch GEO); unwired: Directorypath, RdX, RdY, BoundingboxWidth
code_block_7 = CodeBlock { Text openbareruimtelabel; }
code_block_8 = CodeBlock { Rotation openbareruimtelabel; }
code_block_9 = CodeBlock()  # unwired: Directorypath
# ---------- code_block_9.designscript (2 lines) ----------
/*Directory with BGTfiles */
Directorypath: var[]..[];
# ----------------------------------------

# group: Puntvormige elementen
code_block_10 = CodeBlock { "/"; }
code_block_11 = CodeBlock { ".gml"; }
bgt_lagen = CodeBlock()
# ---------- bgt_lagen.designscript (11 lines) ----------
"bgt_bak";
"bgt_bord";
"bgt_kast";
"bgt_mast";
"bgt_paal";
"bgt_put";
"bgt_sensor";
"bgt_straatmeubilair";
"bgt_vegetatieobject";
"bgt_waterinrichtingselement";
"bgt_wegrichtingselement";
# ----------------------------------------
create = List.Create(item0=bgt_lagen.out0, item1=bgt_lagen.out1, item2=bgt_lagen.out2, item3=bgt_lagen.out3, item4=bgt_lagen.out4, item5=bgt_lagen.out5, item6=bgt_lagen.out6, item7=bgt_lagen.out7, item8=bgt_lagen.out8, item9=bgt_lagen.out9, item10=bgt_lagen.out10)
concat = String.Concat(string0=code_block_9, string1=code_block_10, string3=code_block_11)  # unwired: string2
map = List.Map(list=create, function=concat)

# group: Labels
code_block_12 = CodeBlock { "bgt_openbareruimtelabel"; }
concat_2 = String.Concat(string0=code_block_9, string1=code_block_10, string2=code_block_12, string3=code_block_11)

string_3 = StringInput(".//{http://www.opengis.net/gml}pos")  # graph input
code_block_13 = CodeBlock()  # unwired: RdX
# ---------- code_block_13.designscript (2 lines) ----------
/*RD-coordinate in meters*/
RdX: double;
# ----------------------------------------
code_block_14 = CodeBlock()  # unwired: RdY
# ---------- code_block_14.designscript (2 lines) ----------
/*RD-coordinate in meters*/
RdY: double;
# ----------------------------------------
code_block_15 = CodeBlock()  # unwired: BoundingboxWidth
# ---------- code_block_15.designscript (2 lines) ----------
/*Boundingboxwidth and height in meters*/
BoundingboxWidth: double;
# ----------------------------------------
string_4 = StringInput(".//{http://www.geostandaarden.nl/imgeo/2.1}tekst")  # graph input
string_5 = StringInput(".//{http://www.geostandaarden.nl/imgeo/2.1}hoek")  # graph input
python_script = Python(IN[0]=concat_2, IN[1]=string_3, IN[2]=code_block_13, IN[3]=code_block_14, IN[4]=code_block_15, IN[5]=string_4, IN[6]=string_5)  # IronPython2
# ---------- python_script.python (98 lines) ----------
import sys
sys.path.append("C:\Program Files (x86)\IronPython 2.7\Lib")

import clr
clr.AddReference('ProtoGeometry')
from Autodesk.DesignScript.Geometry import *

import xml.etree.ElementTree as ET


def checkIfCoordIsInsideBoundingBox(coord, bounding_box):
    min_x = bounding_box[0] - (bounding_box[2] / 2)
    min_y = bounding_box[1] - (bounding_box[2] / 2)
    max_x = bounding_box[0] + (bounding_box[2] / 2)
    max_y = bounding_box[1] + (bounding_box[2] / 2)

    if min_x <= float(coord[0]) <= max_x and min_y <= float(coord[1]) <= max_y:
        return True
    else:
        return False

def mainFunction():
    # Inputs
    file_path = IN[0]
    xpathstr = IN[1]
    # Bounding box definition
    bbx = IN[2]
    bby = IN[3]
    bb_size = IN[4]
    xpathstr2 = IN[5]
    xpathstr3 = IN[6]
    bounding_box = [bbx, bby, bb_size]
    # get data from xml
    tree = ET.parse(file_path)
    root = tree.getroot()
	
    # for loop to get each element in an array
    XMLelements = []
    for elem in root.iter():
        XMLelements.append(elem)

    xpathfound = root.findall(xpathstr)
    xpathfoundlabel = root.findall(xpathstr2)
    xpathfoundrotation = root.findall(xpathstr3)
    # for loop to get all points in an array
    points = []
    for x in xpathfound:
        if x.text:
            try:
                points.append(x.text)
            except:
                points.append("_none_")
        else:
            points.append("_none_")
	
	labels = []
    for i in xpathfoundlabel:
        if i.text:
            try:
                labels.append(i.text)
            except:
                labels.append("_none_")
        else:
            labels.append("_none_")
        
    rotations = []
    for i in xpathfoundrotation:
        if i.text:
            try:
                rotations.append(i.text)
            except:
                rotations.append("_none_")
        else:
            rotations.append("_none_")
    
    # for loop to get each point as a list instead of a string
    newPoints = []
    for point in points:
        newPoints.append(point.split(" "))

    # for loop to get x,y coords and filter points inside Bounding Box
    xyPoints = []
    xyLabels = []
    xyRotations = []
    for newPoint, label, rotation in zip(newPoints, labels, rotations):
    	point_is_inside_bounding_box = False
    	if checkIfCoordIsInsideBoundingBox(newPoint, bounding_box):
    		point_is_inside_bounding_box = True
    		xyPoints.append(newPoint)
    		xyLabels.append(label)
    		xyRotations.append(rotation)
    return xyPoints, xyLabels, xyRotations

# execution of main function in python script
returnvalue = mainFunction()

# put returnValue in OUT
OUT = returnvalue
# ----------------------------------------
code_block_16 = CodeBlock(t4=python_script, t9=code_block_13, t10=code_block_14)
# ---------- code_block_16.designscript (16 lines) ----------
t3 = DSCore.List.FirstItem(t4);
t5 = DSCore.List.FirstItem(t3@-2<1>);
t6 = String.ToNumber(t5);
t7 = DSCore.List.LastItem(t3@-2<1>);
t8 = String.ToNumber(t7);
rdx = t9;
x = t6;
rdy = t10;
y = t8;
t1 = (rdx - x) * 1000;
t2 = (rdy - y) * 1000;
t11 = Math.Round(t1);
t12 = Math.Round(t2);
point1 = Point.ByCoordinates(t11, t12);
t4[1];
t4[2];
# ----------------------------------------
code_block_17 = CodeBlock { Points openbareruimtelabel; }
code_block_18 = CodeBlock { Metadata BGT; }
string_6 = StringInput(".//{http://www.opengis.net/gml}pos")  # graph input
string_7 = StringInput(".//{http://www.geostandaarden.nl/imgeo/2.1}plus-type")  # graph input
GIS2BIM_FilterGMLPointsMetadata = Custom[GIS2BIM_FilterGMLPointsMetadata](XpathPoints=string_6, XpathMetadata=string_7, CoordinateX=code_block_13, CoordinateY=code_block_14, Boundingbox=code_block_15)  # package GIS2BIM for Dynamo 2.x; Filter GML-file based on boundingbox and create points and belonging meta-data; unwired: GMLFile
map_2 = List.Map(list=map, function=GIS2BIM_FilterGMLPointsMetadata.Metadata)
map_3 = List.Map(list=map, function=GIS2BIM_FilterGMLPointsMetadata.Points)
code_block_19 = CodeBlock { Points BGT; }
code_block_20 = CodeBlock { Points Names BGT; }
code_block_21 = CodeBlock { ".gml"; }

# group: GML INPUT
bgt_lagen_2 = CodeBlock()
# ---------- bgt_lagen_2.designscript (17 lines) ----------
"bgt_begroeidterreindeel";
"bgt_functioneelgebied";
"bgt_gebouwinstallatie";
"bgt_kunstwerkdeel";
"bgt_onbegroeidterreindeel";
"bgt_ondersteunendwaterdeel";
"bgt_ondersteunendwegdeel";
"bgt_ongeclassifiseerdobject";
"bgt_overbruggingsdeel";
"bgt_overigbouwwerk";
"bgt_overigescheiding";
"bgt_pand.gml";
"bgt_scheiding";
"bgt_spoor";
"bgt_tunneldeel";
"bgt_waterdeel";
"bgt_wegdeel";
# ----------------------------------------
create_2 = List.Create(item0=bgt_lagen_2.out0, item1=bgt_lagen_2.out1, item2=bgt_lagen_2.out2, item3=bgt_lagen_2.out3, item4=bgt_lagen_2.out4, item5=bgt_lagen_2.out5, item6=bgt_lagen_2.out6, item7=bgt_lagen_2.out7, item8=bgt_lagen_2.out8, item9=bgt_lagen_2.out9, item10=bgt_lagen_2.out10, item11=bgt_lagen_2.out11, item12=bgt_lagen_2.out12, item13=bgt_lagen_2.out13, item14=bgt_lagen_2.out14, item15=bgt_lagen_2.out15, item16=bgt_lagen_2.out16)
string_8 = StringInput("/")  # graph input
concat_3 = String.Concat(string0=code_block_9, string1=string_8, string3=code_block_21)  # unwired: string2
map_4 = List.Map(list=create_2, function=concat_3)

# group: CREATE BOUNDINGBOX AND FILTER GML
string_9 = StringInput(".//{http://www.opengis.net/gml}posList")  # graph input

GIS2BIM_FilterGML = Custom[GIS2BIM_FilterGML](xPATH=string_9, CoordinateX=code_block_13, CoordinateY=code_block_14, Boundingbox=code_block_15)  # package GIS2BIM for Dynamo 2.x; filter GML-file based on boundingbox; unwired: GMLFile

# group (continued): CREATE BOUNDINGBOX AND FILTER GML
map_5 = List.Map(list=map_4, function=GIS2BIM_FilterGML.Polycurves)

code_block_22 = CodeBlock { Curvenames BGT; }
code_block_23 = CodeBlock { Curves BGT; }
python_script_2 = Python()  # IronPython2
# ---------- python_script_2.python (28 lines) ----------
import clr
clr.AddReference('System.Web.Extensions')
from System.Web.Script.Serialization import JavaScriptSerializer
from System.Net import * 
from System.Net import WebRequestCreator
from System import Convert
from System.Text import Encoding
import urllib # - this needs Python 2.7.7 or later!

url = "https://api.pdok.nl/lv/bgt/download/v1_0/full/custom"
data1 = '{"featuretypes":["waterdeel"],"format":"gmllight","geofilter":"POLYGON((213089 593892, 217076 593892, 217076 597981, 213089 597981, 213089 593892))"}'

ServicePointManager.SecurityProtocol = SecurityProtocolType.Tls; #TLS 1.2

# Create a web client
WebRequest.RegisterPrefix("http://", WebRequestCreator.ClientHttp);
WebRequest.RegisterPrefix("https://", WebRequestCreator.ClientHttp);

client = WebClient()

client.Headers.Clear()
client.Headers["Content-Type"] = "application/json"
client.Headers[HttpRequestHeader.Accept] = "application/json"
client.QueryString.Add("data", data1)

data = client.UploadValues(url, "POST", client.QueryString)

OUT = data
# ----------------------------------------

# group: 1. Input
string_10 = StringInput("https://requestb.in/sso5frss")
# note: I suggest using something like RequestBin to test out the package and web responses.
# https://requestb.in/
# Visit the site to generate a fresh URL, this one will likely be out of date.
# Using such a service will allow you to see how different parts of the request would be received by the server.
# I also recommend using the Postman app (https://www.getpostman.com) to figure out how to interact with a REST API first. Once you have it working in Postman, replicating those settings using DynaWeb will be trivial since the nomenclature is pretty much the same.
string_11 = StringInput("""{
  "name": "Dynamo Bot",
  "username": "dynamoBot",
  "email": "mr.robot@dynamobim.org",
  "address": {
    "street": "17 Broadwick St",
    "city": "London",
    "zipcode": "W1F 0DE"
  },
  "phone": "+44-(0)-207-851-8000",
  "website": "dynamobim.org",
  "company": {
    "name": "Autodesk",
    "catchPhrase": "Open source graphical programming for design",
    "bs": "programmind without code"
  }
}""")

# group: DynaWeb : Build & Execute simple request
# note: The "WebRequest.Execute" node in the DynaWeb Dynamo library simply executes the web request it is given. It expects a valid WebRequest as input.
# note: The "WebRequest.ByURL" node in the DynaWeb Dynamo library builds a web request to the URL provided.
# This node also defaults to building a GET request, but this can be overriden after the request is built using the "WebRequest.SetMethod" node, see the more advanced samples.
byUrl_2 = DynaWeb.WebRequest.ByUrl(url=string_10, lacing=Shortest)

# group: Set HTTP method
# note: The HTTP methods supported by DynaWeb are :
# GET
# POST
# PUT
# DELETE
# HEAD
# OPTIONS
# PATCH
# MERGE
string_12 = StringInput("POST")
setMethod_2 = DynaWeb.WebRequest.SetMethod(webRequest=byUrl_2, method=string_12, lacing=Shortest)

# group: Add headers
# note: HTTP headers allow the client and the server to pass additional information with the request or the response. A request header consists of its case-insensitive name followed by a colon ':', then by its value (without line breaks). Leading white space before the value is ignored.
# Please see this Mozzila foundation page for more info :
# https://developer.mozilla.org/en-US/docs/Web/HTTP/Headers
code_block_24 = CodeBlock { "customHeader"; "DynaHeader"; }
addHeader_3 = DynaWeb.WebRequest.AddHeader(webRequest=setMethod_2, name=code_block_24.out0, value=code_block_24.out1, lacing=Shortest)

# group: Add cookies
# note: The Cookie is added to the request header and can contain a list of key/value pairs.
# Example : name=value; name2=value2;
# Cookies are usually set by the server during a first interaction and the client/requester then uses that cookie to enable the server to identify it in subsequent requests.
# This field is totally optional.
code_block_25 = CodeBlock { "customCookie"; "DynaCookie"; }
addCookie = DynaWeb.WebRequest.AddCookie(webRequest=addHeader_3, name=code_block_25.out0, value=code_block_25.out1, lacing=Shortest)

# group: Adding a parameter to URL
code_block_26 = CodeBlock { "queryParam"; "123"; }
addQueryParameter = DynaWeb.WebRequest.AddQueryParameter(webRequest=addCookie, name=code_block_26.out0, value=code_block_26.out1, lacing=Shortest)

# group: Adding a parameter to the body of the request
string_13 = StringInput("undefined")
watch = Watch(string_11)
string_14 = StringInput("RequestBody")
addParameter_2 = DynaWeb.WebRequest.AddParameter(webRequest=addQueryParameter, name=string_13, value=watch, parameterType=string_14, lacing=Shortest)

# group: Tell the server we're sending JSON data
string_15 = StringInput("Content-Type")
# note: Most REST API services will not only return this header, but also require it.
string_16 = StringInput("application/json")
addHeader_4 = DynaWeb.WebRequest.AddHeader(webRequest=addParameter_2, name=string_15, value=string_16, lacing=Shortest)

# group: Execute the request
execute_2 = DynaWeb.WebRequest.Execute(request=addHeader_4, lacing=Shortest)

# group: Response metadata
cookies = DynaWeb.WebResponse.Cookies(webResponse=execute_2, lacing=Shortest)
watch_2 = Watch(cookies)
statusDescription = DynaWeb.WebResponse.StatusDescription(webResponse=execute_2, lacing=Shortest)
responseUri = DynaWeb.WebResponse.ResponseUri(webResponse=execute_2, lacing=Shortest)
server = DynaWeb.WebResponse.Server(webResponse=execute_2, lacing=Shortest)
headers = DynaWeb.WebResponse.Headers(webResponse=execute_2, lacing=Shortest)
watch_3 = Watch(headers)
statusCode = DynaWeb.WebResponse.StatusCode(webResponse=execute_2, lacing=Shortest)
responseStatus = DynaWeb.WebResponse.ResponseStatus(webResponse=execute_2, lacing=Shortest)
content_2 = DynaWeb.WebResponse.Content(webResponse=execute_2, lacing=Shortest)
watch_4 = Watch(content_2)

# group: Time it took for Request to execute
time = DynaWeb.WebResponse.Time(webResponse=execute_2, lacing=Shortest)

# group: Response
# note: The Execute node from the DynaWeb package returns a WebResponse object. This object contains all the metadata of the response as well as the content itself.
# The WebResponse.Content node returns the actual content returned from the server.
# In this example, the server does not return HTML to us, but a simple ok.
# Please see the following image in the samples folder to get a sense of what the server will be receiving when this request is executed :
# 6 - Complex POST request server-side.PNG
content_3 = DynaWeb.WebResponse.Content(webResponse=execute_2, lacing=Shortest)
watch_5 = Watch(content_3)

string_17 = StringInput("Content-Type")
addParameter_3 = DynaWeb.WebRequest.AddParameter(webRequest=addQueryParameter, name=string_13, value=watch, parameterType=string_14, lacing=Shortest)
requestFormat = DynaWeb.WebRequest.RequestFormat(webRequest=addParameter)
byClientRequestMethod = DynaWeb.Execute.ByClientRequestMethod()  # unwired: webClient, webRequest, method
