# Dynamo graph BGT New.dyn (Dynamo 2.5.0.7460)
# packages: GIS2BIM for Dynamo 2.x 0.11.16, DynaWeb 1.0.3

code_block = CodeBlock { "zwijndrecht"; "wattstraat"; "17"; }
GIS2BIM_GetLocationdataNetherlands = Custom[GIS2BIM_GetLocationdataNetherlands](City=code_block.out0, Streetname=code_block.out1, Housenumber=code_block.out2)  # package GIS2BIM for Dynamo 2.x; Gives locationdata based on an adress in the Netherlands
GIS2BIM_GetMortonCodeCoordinate = Custom[GIS2BIM_GetMortonCodeCoordinate](X=GIS2BIM_GetLocationdataNetherlands.RDcoordinateXmeters, Y=GIS2BIM_GetLocationdataNetherlands.RDcoordinateYmeters)  # package GIS2BIM for Dynamo 2.x; Get mortoncode(bitshifting) given 2 coordinates and tiledimension
code_block_2 = CodeBlock { 400; }
GIS2BIM_CreateBoundingBox = Custom[GIS2BIM_CreateBoundingBox](CoordinateX=GIS2BIM_GetLocationdataNetherlands.RDcoordinateXmeters, CoordinateY=GIS2BIM_GetLocationdataNetherlands.RDcoordinateYmeters, BoxWidth=code_block_2, BoxHeight=code_block_2)  # package GIS2BIM for Dynamo 2.x; create boundingboxstring for webrequests based on coördinates and dimensions
string = StringInput("https://api.pdok.nl/lv/bgt/download/v1_0/full/custom\" -H \"accept: application/json\" -H \"Content-Type: application/json\" -d \"{\\\"featuretypes\\\":[\\\"bak\\\",\\\"gebouwinstallatie\\\",\\\"kunstwerkdeel\\\",\\\"onbegroeidterreindeel\\\"],\\\"format\\\":\\\"citygml\\\",\\\"geofilter\\\":\\\"POLYGON((101891,426775 101891,427175 102291,427175 102291,426775 101891,426775))\\\"}")
web_request = WebRequest(url=string)
code_block_3 = CodeBlock()
# ---------- code_block_3.designscript (1 lines) ----------
https://api.pdok.nl/lv/bgt/download/v1_0/ui/#/Full%20Custom/FullCustomDownload
# ----------------------------------------
POST = DynaWeb.Execute.POST()  # unwired: webRequest, webClient
