# Dynamo graph AHN 2.dyn (Dynamo 1.3.3.4111)

# group: INPUT
directory_laszip = CodeBlock { "C:/TEMP/BGTTEST"; }
filepath_laz_pointcloud = Filename("..\..\..\..\..\..\..\..\TEMP\BGTTEST\C_31AZ1.LAZ")
boundingbox = CodeBlock { 250; }
new_filename = CodeBlock { "BGT_cropped.pts"; }

code_block = CodeBlock { "Roelofarendsveen"; "De Lasso-Zuid"; "22"; }
getLocationdataNetherlands = Custom[GIS2BIM.GetLocationdataNetherlands](City=code_block.out0, Streetname=code_block.out1, Housenumber=code_block.out2)  # Gives locationdata based on an adress in the Netherlands
code_block_2 = CodeBlock { " -keep_every_nth "; }
string = StringInput("10")
concat = String.Concat(code_block_2, string)

# group: CREATE BATCHFILE
code_block_3 = CodeBlock { "/"; "cropped3.bat"; }
concat_2 = String.Concat(directory_laszip, code_block_3.out0, code_block_3.out1)
downloadLASZIP = Custom[GIS2BIM.DownloadLASZIP](Directory=directory_laszip)  # download and unzip laszip
code_block_4 = CodeBlock { " -i "; }
code_block_5 = CodeBlock { "-keep_classification 2 "; ""; " -oparse xyz"; }
string_2 = StringInput("\"")
code_block_6 = CodeBlock { " -translate_x -"; " -translate_y -"; }
code_block_7 = CodeBlock(x=getLocationdataNetherlands.RDcoordinateX_meters_double, y=getLocationdataNetherlands.RDcoordinateY_meters_double, width=boundingbox) { x; y; width; }
toString = Custom[Springs.Number.ToString](num=code_block_7.x)  # Converts the input number(s) to string. You can optionally limit the number of digits.
toString_2 = Custom[Springs.Number.ToString](num=code_block_7.y)
code_block_8 = CodeBlock { " -inside "; " "; }
code_block_9 = CodeBlock(x=code_block_7.x, bbox=code_block_7.width, y=code_block_7.y) { x-0.5*bbox; x+0.5*bbox; y-0.5*bbox; y+0.5*bbox; }
toString_3 = Custom[Springs.Number.ToString](num=code_block_9.out0)
toString_4 = Custom[Springs.Number.ToString](num=code_block_9.out2)
toString_5 = Custom[Springs.Number.ToString](num=code_block_9.out1)
toString_6 = Custom[Springs.Number.ToString](num=code_block_9.out3)
code_block_10 = CodeBlock { " -odir "; " -o "; }
string_3 = StringInput("\"")
concat_3 = String.Concat(downloadLASZIP.Laszip, code_block_4, code_block_5.out1, string_2, filepath_laz_pointcloud, string_2, code_block_6.out0, toString, code_block_6.out1, toString_2, code_block_8.out0, toString_3, code_block_8.out1, toString_4, code_block_8.out1, toString_5, code_block_8.out1, toString_6, code_block_10.out0, string_2, directory_laszip, string_2, code_block_10.out1, string_3, new_filename, string_3, concat)
writeToFile = CSV.WriteToFile(concat_2, concat_3)

createBoundingBox = Custom[GIS2BIM.CreateBoundingBox](CoordinateX=getLocationdataNetherlands.RDcoordinateX_meters_double, CoordinateY=getLocationdataNetherlands.RDcoordinateY_meters_double, BoxWidth=boundingbox, BoxHeight=boundingbox)  # create boundingboxstring for webrequests based on coördinates and dimensions
geoservicesLibraryNetherlands = Custom[GIS2BIM.GeoservicesLibraryNetherlands](BoundingBox=createBoundingBox.Boxstring)  # Library with multiple webadresses which can be used for WFS and WMS webrequests
webrequestWMS2 = Custom[GIS2BIM.WebrequestWMS2](WMSwebrequest=geoservicesLibraryNetherlands.5_luchtfoto_2016_OGC_WMS)  # a webrequest based on WMS-protocol
watch_image = WatchImageCore(webrequestWMS2)
downloadAHN = Custom[GIS2BIM.DownloadAHN](UrlwebrequestAHN2=geoservicesLibraryNetherlands.11_AHN2_webrequest_bladindex_OGC_WFS, UrlwebrequestAHN3=geoservicesLibraryNetherlands.AHN3_webrequest_bladindex_OGC_WFS)  # get the mapnumber(s) of the AHN based on a given boundingbox
openBrowser = Custom[GIS2BIM.OpenBrowser](url=downloadAHN.downloadlink_AHN3)  # frozen; Opens a new window in your default browser with the given url.
code_block_11 = CodeBlock { "roelofarendsveen"; "de lasso-zuid"; "23"; }
create = List.Create(code_block_11.out0, code_block_11.out1, code_block_11.out2)
suggestLocationdata = Custom[GIS2BIM.SuggestLocationdata](search_terms=create)  # Suggests the adress in the Netherlands that best matches the given search terms. https://github.com/PDOK/locatieserver/wiki/API-Locatieserver
LASZIPCommands = Custom[GIS2BIM.LASZIPCommands]()  # commandline options for LASZIP; unwired: X, Y, BoundingboxwidthMeters, Targetdirectory, Filename, ClassificationToKeep, KeepEveryNthPoint, LAZFile, TranslateX, TranslateY
PTStoPoints = Custom[GIS2BIM.PTStoPoints]()  # convert a pts-file(ascii) to dynamo points; unwired: PTSFile
LASZIPCommands_2 = Custom[GIS2BIM.LASZIPCommands]()  # unwired: X, Y, BoundingboxwidthMeters, Targetdirectory, Filename, ClassificationToKeep, KeepEveryNthPoint, LAZFile, TranslateX, TranslateY
PTStoPoints_2 = Custom[GIS2BIM.PTStoPoints]()  # unwired: PTSFile
code_block_12 = CodeBlock { C:/TEMP/BGTTEST/laszip.exe -i "C:\TEMP\BGTTEST\C_31AZ1.LAZ"  -oparse xyz -translate_x -102542 -translate_y -468572 -inside 102417 468447 102667 468697 -odir "C:/TEMP/BGTTEST" -o "BGT_cropped.pts" -keep_every_nth 10; }
