# Dynamo graph AHN Download.dyn (Dynamo 1.3.3.4111)

# group: SETTINGS
directory_laszip = CodeBlock { "C:/TEMP/BGTTEST"; }
filepath_laz_pointcloud = Filename("..\..\..\..\..\..\..\..\TEMP\BGTTEST\C_31AZ1.LAZ")
new_filename = CodeBlock { "BGT_cropped.pts"; }

# group: INPUT
directory_for_temporary_files = Directory("C:\TEMP\BGTTEST\2")
boundingbox = CodeBlock { 250; }

code_block = CodeBlock { "Roelofarendsveen"; "De Lasso-Zuid"; "22"; }
getLocationdataNetherlands = Custom[GIS2BIM.GetLocationdataNetherlands](City=code_block.out0, Streetname=code_block.out1, Housenumber=code_block.out2)  # Gives locationdata based on an adress in the Netherlands
code_block_2 = CodeBlock(x=getLocationdataNetherlands.RDcoordinateX_meters_double, y=getLocationdataNetherlands.RDcoordinateY_meters_double, width=boundingbox) { x; y; width; }
toString = Custom[Springs.Number.ToString](num=code_block_2.x)  # Converts the input number(s) to string. You can optionally limit the number of digits.
toString_2 = Custom[Springs.Number.ToString](num=code_block_2.y)
code_block_3 = CodeBlock(x=code_block_2.x, bbox=code_block_2.width, y=code_block_2.y) { x-0.5*bbox; x+0.5*bbox; y-0.5*bbox; y+0.5*bbox; }
toString_3 = Custom[Springs.Number.ToString](num=code_block_3.out0)
toString_4 = Custom[Springs.Number.ToString](num=code_block_3.out2)
toString_5 = Custom[Springs.Number.ToString](num=code_block_3.out1)
toString_6 = Custom[Springs.Number.ToString](num=code_block_3.out3)
code_block_4 = CodeBlock { " -keep_every_nth "; }
string = StringInput("10")
concat = String.Concat(code_block_4, string)

# group: CREATE BATCHFILE
code_block_5 = CodeBlock { "/"; "cropped3.bat"; }
concat_2 = String.Concat(directory_laszip, code_block_5.out0, code_block_5.out1)
downloadLASZIP = Custom[GIS2BIM.DownloadLASZIP](Directory=directory_for_temporary_files)  # download and unzip laszip
code_block_6 = CodeBlock { " -i "; }
code_block_7 = CodeBlock { "-keep_classification 2 "; ""; " -oparse xyz"; }
string_2 = StringInput("\"")
code_block_8 = CodeBlock { " -translate_x -"; " -translate_y -"; }
code_block_9 = CodeBlock { " -inside "; " "; }
code_block_10 = CodeBlock { " -odir "; " -o "; }
string_3 = StringInput("\"")
concat_3 = String.Concat(downloadLASZIP.Laszip, code_block_6, code_block_7.out1, string_2, filepath_laz_pointcloud, string_2, code_block_8.out0, toString, code_block_8.out1, toString_2, code_block_9.out0, toString_3, code_block_9.out1, toString_4, code_block_9.out1, toString_5, code_block_9.out1, toString_6, code_block_10.out0, string_2, directory_laszip, string_2, code_block_10.out1, string_3, new_filename, string_3, concat)
writeToFile = CSV.WriteToFile(concat_2, concat_3)

createBoundingBox = Custom[GIS2BIM.CreateBoundingBox](CoordinateX=getLocationdataNetherlands.RDcoordinateX_meters_double, CoordinateY=getLocationdataNetherlands.RDcoordinateY_meters_double, BoxWidth=boundingbox, BoxHeight=boundingbox)  # create boundingboxstring for webrequests based on coördinates and dimensions
geoservicesLibraryNetherlands = Custom[GIS2BIM.GeoservicesLibraryNetherlands](BoundingBox=createBoundingBox.Boxstring)  # Library with multiple webadresses which can be used for WFS and WMS webrequests
webrequestWMS2 = Custom[GIS2BIM.WebrequestWMS2](WMSwebrequest=geoservicesLibraryNetherlands.5_luchtfoto_2016_OGC_WMS)  # a webrequest based on WMS-protocol
watch_image = WatchImageCore(webrequestWMS2)
code_block_11 = CodeBlock { "roelofarendsveen"; "de lasso-zuid"; "23"; }
create = List.Create(code_block_11.out0, code_block_11.out1, code_block_11.out2)
suggestLocationdata = Custom[GIS2BIM.SuggestLocationdata](search_terms=create)  # Suggests the adress in the Netherlands that best matches the given search terms. https://github.com/PDOK/locatieserver/wiki/API-Locatieserver
PTStoPoints = Custom[GIS2BIM.PTStoPoints]()  # convert a pts-file(ascii) to dynamo points; unwired: PTSFile
code_block_12 = CodeBlock(directory=directory_for_temporary_files) { directory; }
downloadAHN = Custom[GIS2BIM.DownloadAHN](UrlwebrequestAHN2=geoservicesLibraryNetherlands.11_AHN2_webrequest_bladindex_OGC_WFS, UrlwebrequestAHN3=geoservicesLibraryNetherlands.AHN3_webrequest_bladindex_OGC_WFS)  # get the mapnumber(s) of the AHN based on a given boundingbox

# group: BATCH FILE DOWNLOAD AHN
string_4 = StringInput("\")
code_block_13 = CodeBlock { "/"; "download.bat"; }
concat_4 = String.Concat(code_block_12, string_4, code_block_13.out1)
string_5 = StringInput("powershell -Command \"Invoke-WebRequest ")
firstItem = List.FirstItem(downloadAHN.downloadlink_AHN3)
code_block_14 = CodeBlock { " -OutFile "; mapnumber; }  # unwired: mapnumber
firstItem_2 = List.FirstItem(downloadAHN.Mapnumber)
string_6 = StringInput(".LAZ\"")
concat_5 = String.Concat(string_5, firstItem, code_block_14.out0, firstItem_2, string_6)
writeToFile_2 = CSV.WriteToFile(concat_4, concat_5)

python_script = Python()  # unwired: IN[0]
# ---------- python_script.python (10 lines) ----------
import clr
clr.AddReference('ProtoGeometry')
from Autodesk.DesignScript.Geometry import *

from System.Diagnostics import Process

fileloc = IN[0]

Process.Start(r'C:\TEMP\BGTTEST\2\download.bat')
#Assign your output to the OUT variable.
# ----------------------------------------
writeText = File.WriteText()  # unwired: arg0, arg1
code_block_15 = CodeBlock { C:/TEMP/BGTTEST/laszip.exe -i "C:\TEMP\BGTTEST\C_31AZ1.LAZ"  -oparse xyz -keep_classification 2 -translate_x -102542 -translate_y -468572 -inside 102417 468447 102667 468697 -odir "C:/TEMP/BGTTEST" -o "BGT_cropped_topography.pts" -keep_every_nth 30; }
string_7 = StringInput("\laszip.exe")
code_block_16 = CodeBlock { "-i "; }
concat_6 = String.Concat(code_block_12, string_7, code_block_16)  # unwired: arg3, arg4
