# Dynamo graph BGT API.dyn (Dynamo 2.5.0.7460)
# packages: DynaWeb 1.0.3, GIS2BIM for Dynamo 2.x 0.11.18

POST = DynaWeb.Execute.POST()  # unwired: webRequest, webClient
byUrl = DynaWeb.WebRequest.ByUrl()  # unwired: url
code_block = CodeBlock { "28992"; }
GIS2BIM_GetRevitSiteLocation = Custom[GIS2BIM_GetRevitSiteLocation]()  # package GIS2BIM for Dynamo 2.x; Gets the properties of the current Site Location of the active Revit Project
toNumber = String.ToNumber(str=GIS2BIM_GetRevitSiteLocation.Lon)
toNumber_2 = String.ToNumber(str=GIS2BIM_GetRevitSiteLocation.Lat)
GIS2BIM_TransformCRS_epsg = Custom[GIS2BIM_TransformCRS_epsg](TargetCRS=code_block, xCoordinate=toNumber, yCoordinate=toNumber_2)  # package GIS2BIM for Dynamo 2.x; Uses the API of http://epsg.io to transform Coordinate Reference Systems
code_block_2 = CodeBlock { 500; }
GIS2BIM_CreateBoundingBox = Custom[GIS2BIM_CreateBoundingBox](CoordinateX=GIS2BIM_TransformCRS_epsg.Xtransformed, CoordinateY=GIS2BIM_TransformCRS_epsg.Ytransformed, BoxWidth=code_block_2, BoxHeight=code_block_2)  # package GIS2BIM for Dynamo 2.x; create boundingboxstring for webrequests based on coördinates and dimensions
watch = Watch(GIS2BIM_CreateBoundingBox.PolygonString)
directory_path = Directory("C:\Users\mikev\OneDrive\Bureaublad\TEMP\extract")
GIS2BIM_BGTGeometry = Custom[GIS2BIM_BGTGeometry](Directorypath=directory_path, RdX=GIS2BIM_TransformCRS_epsg.Xtransformed, RdY=GIS2BIM_TransformCRS_epsg.Ytransformed, BoundingboxWidth=code_block_2)  # package GIS2BIM for Dynamo 2.x; Returns BGT-curves and metadata(Dutch GEO)
