# Dynamo graph BGT_ s.dyn (Dynamo 1.3.2.2480)

code_block = CodeBlock()
# ---------- code_block.designscript (6 lines) ----------
"https://geodata.nationaalgeoregister.nl/beta/bgt/wfs";
"?service=wfs&version=2.0.0";
"&request=GetFeature";
"&typeNames=";
"bgt:pand";
"&bbox=";
# ----------------------------------------
code_block_2 = CodeBlock(a=code_block.out0, b=code_block.out1, c=code_block.out2, d=code_block.out3) { a+b+c+d; }
code_block_3 = CodeBlock()
# ---------- code_block_3.designscript (35 lines) ----------
{
"bgt:bak",
"bgt:begroeidterreindeel",
"bgt:bord",
"bgt:buurt",
"bgt:functioneelgebied",
"bgt:gebouwinstallatie",
"bgt:installatie",
"bgt:kast",
"bgt:kunstwerkdeel",
"bgt:mast",
"bgt:nummeraanduiding",
"bgt:onbegroeidterreindeel",
"bgt:ondersteunendwaterdeel",
"bgt:ondersteunendwegdeel",
"bgt:ongeclassificeerdobject",
"bgt:openbareruimtelabel",
"bgt:overbruggingsdeel",
"bgt:overigbouwwerk",
"bgt:overigescheiding",
"bgt:paal",
"bgt:pand",
"bgt:put",
"bgt:scheiding",
"bgt:sensor",
"bgt:spoor",
"bgt:straatmeubilair",
"bgt:tunneldeel",
"bgt:vegetatieobject",
"bgt:waterdeel",
"bgt:waterinrichtingselement",
"bgt:wegdeel",
"bgt:weginrichtingselement",
"bgt:wijk"
};
# ----------------------------------------
boolean = BoolSelector(true)
revit = Custom[RD.PD2R.get.location.revit](toggle=boolean)  # Getting the site location in revit and the RD coordinates
code_block_4 = CodeBlock { 50; }
createBoundingBox = Custom[RD.GIS2BIM.CreateBoundingBox](CoordinateX=revit.RD_x, CoordinateY=revit.RD_y, BoxWidth=code_block_4, BoxHeight=code_block_4)  # create boundingboxstring for webrequests based on coördinates and dimensions
code_block_5 = CodeBlock(a=code_block_2, b=code_block_3, c=code_block.out5, d=createBoundingBox.Boxstring) { a+b+c+d; }
web_request = WebRequest(code_block_5)
string = StringInput(".//{http://www.opengis.net/gml/3.2}posList")
createPointsPolygonFromGMLxyz = Custom[RD.GIS2BIM.CreatePointsPolygonFromGMLxyz](XML=web_request, XPATHSTRING=string, DeltaX=revit.RD_x, DeltaY=revit.RD_y, lacing=Longest)  # Create points and polygons from a xml/gml-file with x,y and z value
isEmpty = List.IsEmpty(createPointsPolygonFromGMLxyz, lacing=Longest)
filterByBoolMask = List.FilterByBoolMask(list=createPointsPolygonFromGMLxyz, mask=isEmpty)
code_block_6 = CodeBlock { true; }
byPoints = PolyCurve.ByPoints(points=filterByBoolMask.out, connectLastToFirst=code_block_6, lacing=Longest)
byPatch = Surface.ByPatch(byPoints, lacing=Longest)
code_block_7 = CodeBlock(x=byPatch) { x[1]; }
categories = Categories("GenericModel")
string_2 = StringInput("Default")
byName = Material.ByName(string_2)
filterByBoolMask_2 = List.FilterByBoolMask(list=code_block_3, mask=isEmpty)
code_block_8 = CodeBlock { 0; 4; }
remove = String.Remove(str=filterByBoolMask_2.out, startIndex=code_block_8.out0, count=code_block_8.out1, lacing=Longest)
code_block_9 = CodeBlock(x=remove) { x[1]; }
byGeometry = DirectShape.ByGeometry(geometry=code_block_7, category=categories, material=byName, name=code_block_9)
fromElements = Custom[RD_Group.FromElements](elements=byGeometry, groupName=remove, lacing=Longest)  # frozen; Creates a group from a list of Revit elements
code_block_10 = CodeBlock()
# ---------- code_block_10.designscript (6 lines) ----------
"bgt:begroeidterreindeel";
"bgt:onbegroeidterreindeel";
"bgt:ondersteunendwegdeel";
"bgt:ongeclassificeerdobject";
"bgt:spoor";
"bgt:tunneldeel";
# ----------------------------------------
wegen = CodeBlock()
# ---------- wegen.designscript (2 lines) ----------
{"bgt:kunstwerkdeel",
"bgt:overbruggingsdeel"};
# ----------------------------------------
code_block_11 = CodeBlock()
# ---------- code_block_11.designscript (2 lines) ----------
{"bgt:ondersteunendwaterdeel",
"bgt:waterdeel"};
# ----------------------------------------
panden = CodeBlock()
# ---------- panden.designscript (2 lines) ----------
{"bgt:overigbouwwerk",
"bgt:pand"};
# ----------------------------------------
code_block_12 = CodeBlock { "bgt:wegdeel"; }
create = List.Create(code_block_10.out0, code_block_10.out1, code_block_10.out2, code_block_10.out3, code_block_10.out4, code_block_10.out5, wegen, code_block_11, panden, code_block_12)
flatten = Flatten(create)
empty_layer = Watch(filterByBoolMask_2.in)
id = Element.Id(byGeometry)  # frozen
code_block_13 = CodeBlock { 646479; }
indexOf = IndexOf(id, code_block_13, lacing=Longest)
getItemAtIndex = List.GetItemAtIndex(list=byGeometry, index=indexOf, lacing=Longest)
getItemAtIndex_2 = List.GetItemAtIndex(list=byPatch, index=indexOf, lacing=Longest)
flatten_2 = Flatten(getItemAtIndex_2)
removeNulls = Lists.Manage.RemoveNulls(flatten_2)
boundingBox = Element.BoundingBox(removeNulls)
watch_3d = Watch3D(getItemAtIndex_2)
code_block_14 = CodeBlock { "test springs"; }
byGeometry_2 = Custom[Springs.DirectShape.ByGeometry](geometry=removeNulls, category=categories, name=code_block_14)  # Convert the input geometry to DirectShape element inside the Revit document. It supports solids or surfaces.It is based on an alternative process that uses a SAT import and can produce smooth surfaces. Each created DS will have a unique type. Make sure that each input geometry has a unique name. You can either feed a single category for all geometries or a unique category for each geometry - the node's lacing is set to longest by default.

# group: scheiding vloeren met (in) en zonder (out) gaten
perimeterCurves = Surface.PerimeterCurves(code_block_7)
# note: Om gaten te detecteren controleren we of de lijnen op elkaar aansluiten. Of het eindpunt van de ene lijn, óp het beginpunt van de volgende lijn ligt. Hierdoor vergelijken we de lijst met Curve.EndPoint van de omtreklijnen met de 1-positie verschoven lijst met Curve.StartPoint
endPoint = Curve.EndPoint(perimeterCurves)
startPoint = Curve.StartPoint(perimeterCurves)
code_block_15 = CodeBlock { -1; }
shiftIndices = List.ShiftIndices(list=startPoint@L2, amount=code_block_15)
# note: Geometry.DoesIntersect:
# leest uit of het eindpunt van de een curve op dezelfde plaats ligt als het startpunt van de volgende curve.
# Als de lijst alleen true bevat is het een gesloten boundary zonder gaten.
# Als ze allemaal false zijn dan zitten er gaten in. De richting van de curves draait om. (WTF!?)
# Als het een combinatie van true en false is dan zit er een rond gat in.
doesIntersect = Geometry.DoesIntersect(geometry=endPoint, other=shiftIndices)
allFalse = AllFalse(doesIntersect@L2)
filterByBoolMask_3 = List.FilterByBoolMask(list=perimeterCurves, mask=allFalse)

# group: vloer met ronde gaten n.t.b.
# note: clockwork
anyFalse = Custom[List.AnyFalse](seq=doesIntersect@L2)  # Returns true if any item in a list of booleans is false.
filterByBoolMask_4 = List.FilterByBoolMask(list=perimeterCurves, mask=anyFalse)

file_path = Filename("..\FL_vloeren_opdelen.dyn")
code_block_16 = CodeBlock { "3.3"; "Start"; "Floors"; "DirectShape"; }
writeLog = Custom[WriteLog](currentScriptFilePath=file_path, currentScriptVersion=code_block_16.out0, errorCode=code_block_16.out2, lastNodeOutput=byGeometry)  # Writes or edits a log file of the given script (input the current dyn file for a meaningful result) at the given directory. Contains Python Form for user feedback, forked from Data-Shapes Make sure user has writing priviliges at this location! Does not update between runs, restart the Dynamo session for a new log entry.
writeLog_2 = Custom[WriteLog](currentScriptFilePath=file_path, currentScriptVersion=code_block_16.out0, errorCode=code_block_16.out1, lastNodeOutput=byPatch)
floor_types = FloorTypes("90_OOA_omgeving")
levels = Levels("00 maaiveld")

# group: Floorboundaries opdelen in losse polycurves: 1 omtrek en 1 per gat.
# note: Om de gaten werkelijk te detecteren controleren we of de lijnen op elkaar aansluiten. Of het eindpunt van de ene lijn, óp het beginpunt van de volgende lijn ligt. Hierdoor vergelijken we de lijst met Curve.EndPoint van de omtreklijnen met de +1-positie verschoven lijst met Curve.StartPoint. Dit omdat de richting is omgedraaid door het gat.
endPoint_2 = Curve.EndPoint(filterByBoolMask_3.in)
startPoint_2 = Curve.StartPoint(filterByBoolMask_3.in)
code_block_17 = CodeBlock { 1; }
shiftIndices_2 = List.ShiftIndices(list=startPoint_2@L2, amount=code_block_17)
doesIntersect_2 = Geometry.DoesIntersect(geometry=endPoint_2, other=shiftIndices_2)
code_block_18 = CodeBlock { -1; }
# note: -1 positie verschuiven is noodzakelijk.
# De eerste 'false' zit waarschijnlijk op positie 0.
# Het gat is positie 1 t/m de volgende false.
shiftIndices_3 = List.ShiftIndices(list=doesIntersect_2@L2, amount=code_block_18)
boolean_2 = BoolSelector(false)
getItemIndices = Custom[List.GetItemIndices](List=shiftIndices_3@L2, Item=boolean_2)  # This node searches the input list for the given string or number.
code_block_19 = CodeBlock(index=getItemIndices)
# ---------- code_block_19.designscript (3 lines) ----------
index+1;
//index 5 is de 6e regel in de lijst.
//Dus choppen op index+1
# ----------------------------------------
code_block_20 = CodeBlock { 1; 0; }
shiftIndices_4 = List.ShiftIndices(list=code_block_19@L2, amount=code_block_20.out0)
replaceItemAtIndex = List.ReplaceItemAtIndex(list=shiftIndices_4@L2, index=code_block_20.out1, item=code_block_20.out1)
sub = code_block_19@L2 - replaceItemAtIndex@L2
chop = List.Chop(list=filterByBoolMask_3.in@L2, lengths=sub@L2)

# group: boundaries opdelen in contour en gaten
# note: surface van de boundaries maken.
# oppervlakte opvragen.
# het grootste oppervlak is de contour.
# Die index opvragen en gebruiken voor de vloer.
# Diezelfde index uit de lijst verwijderen en het restant gebruiken voor de openingen.
byJoinedCurves = PolyCurve.ByJoinedCurves(chop)
byPatch_2 = Surface.ByPatch(byJoinedCurves)
area = Surface.Area(byPatch_2)
maximumItem = List.MaximumItem(area)
# note: Bakery
if_equal_return_index_using = Custom[If Equal Return Index using IndexOf](searchForThese=maximumItem@L1, inThisList=area@L2)
getItemAtIndex_3 = List.GetItemAtIndex(list=byJoinedCurves@L2, index=if_equal_return_index_using@L2)
curves = PolyCurve.Curves(getItemAtIndex_3)
code_block_21 = CodeBlock { 1; }
flatten_3 = List.Flatten(list=curves, amt=code_block_21)
removeItemAtIndex = List.RemoveItemAtIndex(list=byJoinedCurves@L2, indices=if_equal_return_index_using@L2)
curves_2 = PolyCurve.Curves(removeItemAtIndex)

# group: output
byOutlineTypeAndLevel = Floor.ByOutlineTypeAndLevel(outlineCurves=filterByBoolMask_3.out, floorType=floor_types, level=levels)
byOutlineTypeAndLevel_2 = Floor.ByOutlineTypeAndLevel(outlineCurves=flatten_3, floorType=floor_types, level=levels)
byCurves = Custom[Springs.FloorOpening.ByCurves](host=byOutlineTypeAndLevel_2@L1, curves=curves_2)  # Create hosted floor opeinngs through the input floors. The second input is a list of sub-lists of the boundary curves.

join = List.Join(byOutlineTypeAndLevel, byCurves)
writeLog_3 = Custom[WriteLog](currentScriptFilePath=file_path, currentScriptVersion=code_block_16.out0, errorCode=code_block_16.out3, lastNodeOutput=byGeometry)
