# Dynamo graph BGT_WFS_metadata.dyn (Dynamo 1.3.3.4111)

code_block = CodeBlock { "https://geodata.nationaalgeoregister.nl/beta/bgt/wfs?service=wfs&version=2.0.0&request=GetFeature&typeNames=bgt:wegdeel&bbox=89016,469801,89066,469851"; }
web_request = WebRequest(code_block)
string = StringInput(".//{http://www.opengis.net/gml/3.2}posList")
string_2 = StringInput(".//{http://bgt.wfs.geonovum.nl}bgt-functie")
python_script = Python(IN[0]=web_request, IN[1]=string, IN[2]=string_2)
# ---------- python_script.python (68 lines) ----------
import sys
sys.path.append("C:\Program Files (x86)\IronPython 2.7\Lib")

import clr
clr.AddReference('ProtoGeometry')
from Autodesk.DesignScript.Geometry import *

import xml.etree.ElementTree as ET


def mainFunction():
    # Inputs
    xml = IN[0]
    xpathstr = IN[1]
    xpathstr2 = IN[2]
    # get data from xml
    root = ET.fromstring(xml)
    #root = tree.getroot()
	
    # for loop to get each element in an array
    XMLelements = []
    for elem in root.iter():
        XMLelements.append(elem)

    xpathfound = root.findall(xpathstr)
    xpathfoundlabel = root.findall(xpathstr2)
    # for loop to get all points in an array
    polygons = []
    for x in xpathfound:
        if x.text:
            try:
                polygons.append(x.text)
            except:
                polygons.append("_none_")
        else:
            polygons.append("_none_")
            
    # for loop to get each polygon as a list instead of a string
    newPolygons = []
    for polygon in polygons:
        newPolygons.append(polygon.split(" "))

    xyPolygons = []
    for newPolygon in newPolygons:
        x = 0
        xyPolygon = []
        for i in range(0, int(len(newPolygon) / 2)):
            xy_coord = [newPolygon[x], newPolygon[x + 1]]
            xyPolygon.append(xy_coord)
            x += 2
        xyPolygons.append(xyPolygon)
            
	labels = []
    for i in xpathfoundlabel:
        if i.text:
            try:
                labels.append(i.text)
            except:
                labels.append("_none_")
        else:
            labels.append("_none_")
    return xyPolygons, labels

# execution of main function in python script
returnvalue = mainFunction()

# put returnValue in OUT
OUT = returnvalue
# ----------------------------------------
code_block_2 = CodeBlock(a=python_script) { a[0]; }
code_block_3 = CodeBlock { rdx=89016; rdy=469801; }

# group: CURVES
firstItem = List.FirstItem()  # unwired: arg0
map = List.Map(f_x=firstItem)  # unwired: list
map_2 = List.Map(list=code_block_2, f_x=map)
toNumber = String.ToNumber(map_2)
lastItem = List.LastItem()  # unwired: arg0
map_3 = List.Map(f_x=lastItem)  # unwired: list
map_4 = List.Map(list=code_block_2, f_x=map_3)
toNumber_2 = String.ToNumber(map_4)
code_block_4 = CodeBlock(x=toNumber, rdx=code_block_3.rdx, y=toNumber_2, rdy=code_block_3.rdy) { (x-rdx)*1000; (y-rdy)*1000; }
code_block_5 = CodeBlock { 0; }
byCoordinates = Point.ByCoordinates(x=code_block_4.out0, y=code_block_4.out1, z=code_block_5)
byPoints = PolyCurve.ByPoints(points=byCoordinates)

code_block_6 = CodeBlock()
# ---------- code_block_6.designscript (22 lines) ----------
":plus-status_codespace";
":status_codespace";
":inonderzoek_leeg";
":lokaalid";
":plus-fysiekvoorkomen_leeg";
":functie_codespace";
":fysiekvoorkomen_codespace";
":creationdate";
":plus-status_leeg";
":terminationdate_leeg";
":plus-functie_codespace";
":plus-fysiekvoorkomen_codespace";
":optalud";
":relatievehoogteligging";
":status";
":lv-publicatiedatum";
":tijdstipregistratie";
":kruinlijn_leeg";
":plus-functie_leeg";
":bronhouder";
":bgt-functie";
":bgt-fysiekVoorkomen";
# ----------------------------------------
create = List.Create(code_block_6.out0, code_block_6.out1, code_block_6.out2, code_block_6.out3, code_block_6.out4, code_block_6.out5, code_block_6.out6, code_block_6.out7, code_block_6.out8, code_block_6.out9, code_block_6.out10, code_block_6.out11, code_block_6.out12, code_block_6.out13, code_block_6.out14, code_block_6.out15, code_block_6.out16, code_block_6.out17, code_block_6.out18, code_block_6.out19, code_block_6.out20, code_block_6.out21)
string_3 = StringInput(".//{http://bgt.wfs.geonovum.nl}")
concat = String.Concat(string_3)  # unwired: arg1
map_5 = List.Map(list=create, f_x=concat)
python_script_2 = Python(IN[0]=web_request, IN[1]=string, IN[2]=map_5)  # same code as python_script
code_block_7 = CodeBlock(a=python_script) { a[1]; }
openBrowser = Custom[GIS2BIM.OpenBrowser](url=code_block)  # Opens a new window in your default browser with the given url.
BGTGeometry = Custom[GIS2BIM.BGTGeometry]()  # Returns BGT-curves and metadata(Dutch GEO); unwired: Directorypath, RDx, RDy, BoundingboxWidth
openBrowser_2 = Custom[GIS2BIM.OpenBrowser]()  # unwired: url
code_block_8 = CodeBlock { "4326"; "28992"; }
getRevitSiteLocation = Custom[GIS2BIM.GetRevitSiteLocation]()  # Gets the properties of the current Site Location of the active Revit Project
transformCRS_epsg = Custom[GIS2BIM.TransformCRS_epsg](sourceCRS=code_block_8.out0, targetCRS=code_block_8.out1, xCoordinate=getRevitSiteLocation.Lon, yCoordinate=getRevitSiteLocation.Lat)  # Uses the API of http://epsg.io to transform Coordinate Reference Systems
code_block_9 = CodeBlock { 250; }
createBoundingBox = Custom[GIS2BIM.CreateBoundingBox](CoordinateX=transformCRS_epsg.Xtransformed, CoordinateY=transformCRS_epsg.Ytransformed, BoxWidth=code_block_9, BoxHeight=code_block_9)  # create boundingboxstring for webrequests based on coördinates and dimensions
geoservicesLibraryNetherlands = Custom[GIS2BIM.GeoservicesLibraryNetherlands](BoundingBox=createBoundingBox.Boxstring)  # Library with multiple webadresses which can be used for WFS and WMS webrequests
webrequestWMS2 = Custom[GIS2BIM.WebrequestWMS2](WMSwebrequest=geoservicesLibraryNetherlands.Luchtfoto_2017_OGC_WMS)  # a webrequest based on WMS-protocol
watch_image = WatchImageCore(webrequestWMS2)
downloadAHN = Custom[GIS2BIM.DownloadAHN](UrlwebrequestAHN2=geoservicesLibraryNetherlands.11_AHN2_webrequest_bladindex_OGC_WFS, UrlwebrequestAHN3=geoservicesLibraryNetherlands.AHN3_webrequest_bladindex_OGC_WFS)  # get the mapnumber(s) of the AHN based on a given boundingbox
code_block_10 = CodeBlock { "bgt:openbareruimtelabel"; }
create_2 = List.Create(code_block_10)
code_block_11 = CodeBlock()
# ---------- code_block_11.designscript (2 lines) ----------
"https://geodata.nationaalgeoregister.nl/beta/bgt/wfs?service=wfs&version=2.0.0&request=GetFeature&typeNames=";
"&bbox=";
# ----------------------------------------
code_block_12 = CodeBlock(rdx=transformCRS_epsg.Xtransformed, rdy=transformCRS_epsg.Ytransformed, BoundingBoxWidth=code_block_9) { rdx; rdy; BoundingBoxWidth; }
createBoundingBox_2 = Custom[GIS2BIM.CreateBoundingBox](CoordinateX=code_block_12.rdx, CoordinateY=code_block_12.rdy, BoxWidth=code_block_12.BoundingBoxWidth, BoxHeight=code_block_12.BoundingBoxWidth)
concat_2 = String.Concat(code_block_11.out0, arg2=code_block_11.out1, arg3=createBoundingBox_2.Boxstring)  # unwired: arg1
map_6 = List.Map(list=create_2, f_x=concat_2)
openBrowser_3 = Custom[GIS2BIM.OpenBrowser](url=map_6)
web_request_2 = WebRequest(map_6)
code_block_13 = CodeBlock(a=web_request_2) { a[0]; }
string_4 = StringInput(".//{http://bgt.wfs.geonovum.nl}hoek")

# group: XPATH XML
string_5 = StringInput(".//{http://www.opengis.net/gml/3.2}pos")
string_6 = StringInput(".//{http://bgt.wfs.geonovum.nl}openbareruimtetype")
string_7 = StringInput(".//{http://bgt.wfs.geonovum.nl}openbareRuimteNaam")
create_3 = List.Create(string_5, string_6, string_7, string_4)
XMLXPath = Custom[GIS2BIM.XMLXPath](XMLString=code_block_13, XPathStrings=create_3)  # Run an XPathquery on an xml-string

code_block_14 = CodeBlock(t9=code_block_12.rdx, t10=code_block_12.rdy, t12=XMLXPath)
# ---------- code_block_14.designscript (15 lines) ----------
rdx = t9;
rdy = t10;
t11 = DSCore.List.FirstItem(t12);
t13 = String.Split(t11, {" "});
t14 = String.ToNumber(t13);
t15 = DSCore.List.TakeEveryNthItem(t14@-2<1>, 2, 1);
t16 = DSCore.List.TakeEveryNthItem(t14@-2<1>, 2, 0);
rdx1 = rdx;
rdxcoordinates = t15;
rdy1 = rdy;
rdycoordinates = t16;
Uconvert = 1000;
LocalCoordinatesX = Uconvert * (rdx1 - rdxcoordinates);
LocalCoordinatesY = Uconvert * (rdy1 - rdycoordinates);
point1 = Point.ByCoordinates(LocalCoordinatesX, LocalCoordinatesY);
# ----------------------------------------
code_block_15 = CodeBlock(PointsOpenbareruimtelabel=code_block_14.point1) { PointsOpenbareruimtelabel; }
code_block_16 = CodeBlock(a=XMLXPath) { a[1]; a[2]; a[3]; }
code_block_17 = CodeBlock(RuimteTypeOpenbareruimtelabel=code_block_16.out0) { RuimteTypeOpenbareruimtelabel; }
code_block_18 = CodeBlock(HoekOpenbareruimtelabel=code_block_16.out2) { HoekOpenbareruimtelabel; }
code_block_19 = CodeBlock(RuimteNaamOpenbareruimtelabel=code_block_16.out1) { RuimteNaamOpenbareruimtelabel; }
bgt_lagen = CodeBlock()
# ---------- bgt_lagen.designscript (11 lines) ----------
"bgt:bak";
"bgt:bord";
"bgt:kast";
"bgt:mast";
"bgt:paal";
"bgt:put";
"bgt:sensor";
"bgt:straatmeubilair";
"bgt:vegetatieobject";
"bgt:waterinrichtingselement";
"bgt:wegrichtingselement";
# ----------------------------------------
create_4 = List.Create(bgt_lagen.out0, bgt_lagen.out1, bgt_lagen.out2, bgt_lagen.out3, bgt_lagen.out4, bgt_lagen.out5, bgt_lagen.out6, bgt_lagen.out7, bgt_lagen.out8, bgt_lagen.out9, bgt_lagen.out10)
map_7 = List.Map(list=create_4, f_x=concat_2)
web_request_3 = WebRequest(map_7)

# group: XPATH XML
string_8 = StringInput(".//{http://www.opengis.net/gml/3.2}pos")
string_9 = StringInput(".//{http://bgt.wfs.geonovum.nl}plus-type")
string_10 = StringInput(".//{http://bgt.wfs.geonovum.nl}bgt-type")
create_5 = List.Create(string_8, string_9, string_10)
XMLXPath_2 = Custom[GIS2BIM.XMLXPath](XPathStrings=create_5)  # unwired: XMLString

map_8 = List.Map(list=web_request_3, f_x=XMLXPath_2)
code_block_20 = CodeBlock(t9=code_block_12.rdx, t10=code_block_12.rdy, t12=map_8)
# ---------- code_block_20.designscript (15 lines) ----------
rdx = t9;
rdy = t10;
t11 = DSCore.List.FirstItem(t12@-3<1>);
t13 = String.Split(t11, {" "});
t14 = String.ToNumber(t13);
t15 = DSCore.List.TakeEveryNthItem(t14@-2<1>, 2, 1);
t16 = DSCore.List.TakeEveryNthItem(t14@-2<1>, 2, 0);
rdx1 = rdx;
rdxcoordinates = t15;
rdy1 = rdy;
rdycoordinates = t16;
Uconvert = 1000;
LocalCoordinatesX = Uconvert * (rdx1 - rdxcoordinates);
LocalCoordinatesY = Uconvert * (rdy1 - rdycoordinates);
point1 = Point.ByCoordinates(LocalCoordinatesX, LocalCoordinatesY);
# ----------------------------------------
code_block_21 = CodeBlock(PointsBGT=code_block_20.point1) { PointsBGT; }
code_block_22 = CodeBlock(PointsNamesBGT=create_4) { PointsNamesBGT; }
code_block_23 = CodeBlock { 1; 2; }
getItemAtIndex = List.GetItemAtIndex(list=map_8@L3, index=code_block_23.out0)
getItemAtIndex_2 = List.GetItemAtIndex(list=map_8@L3, index=code_block_23.out1)
create_6 = List.Create(getItemAtIndex, getItemAtIndex_2)
code_block_24 = CodeBlock(MetadataBGT=create_6) { MetadataBGT; }
bgt_lagen_2 = CodeBlock()
# ---------- bgt_lagen_2.designscript (17 lines) ----------
"bgt:begroeidterreindeel";
"bgt:functioneelgebied";
"bgt:gebouwinstallatie";
"bgt:kunstwerkdeel";
"bgt:onbegroeidterreindeel";
"bgt:ondersteunendwaterdeel";
"bgt:ondersteunendwegdeel";
"bgt:ongeclassifiseerdobject";
"bgt:overbruggingsdeel";
"bgt:overigbouwwerk";
"bgt:overigescheiding";
"bgt:pand.gml";
"bgt:scheiding";
"bgt:spoor";
"bgt:tunneldeel";
"bgt:waterdeel";
"bgt:wegdeel";
# ----------------------------------------
create_7 = List.Create(bgt_lagen_2.out0, bgt_lagen_2.out1, bgt_lagen_2.out2, bgt_lagen_2.out3, bgt_lagen_2.out4, bgt_lagen_2.out5, bgt_lagen_2.out6, bgt_lagen_2.out7, bgt_lagen_2.out8, bgt_lagen_2.out9, bgt_lagen_2.out10, bgt_lagen_2.out11, bgt_lagen_2.out12, bgt_lagen_2.out13, bgt_lagen_2.out14, bgt_lagen_2.out15, bgt_lagen_2.out16)
map_9 = List.Map(list=create_7, f_x=concat_2)
web_request_4 = WebRequest(map_9)

# group: XPATH XML
string_11 = StringInput(".//{http://www.opengis.net/gml/3.2}posList")
string_12 = StringInput(".//{http://bgt.wfs.geonovum.nl}bgt-fysiekVoorkomen")
string_13 = StringInput(".//{http://bgt.wfs.geonovum.nl}plus-fysiekvoorkomen")
string_14 = StringInput(".//{http://bgt.wfs.geonovum.nl}bgt-functie")
create_8 = List.Create(string_11, string_12, string_13, string_14)
XMLXPath_3 = Custom[GIS2BIM.XMLXPath](XPathStrings=create_8)  # unwired: XMLString

map_10 = List.Map(list=web_request_4, f_x=XMLXPath_3)
code_block_25 = CodeBlock(code_block_12.rdx, code_block_12.rdy, map_10)
# ---------- code_block_25.designscript (18 lines) ----------
rdx = t9;
rdy = t10;
t11 = DSCore.List.FirstItem(t12@-3<1>);
t13 = String.Split(t11, {" "});
t14 = String.ToNumber(t13);
t15 = DSCore.List.TakeEveryNthItem(t14@-2<1>, 2, 1);
t16 = DSCore.List.TakeEveryNthItem(t14@-2<1>, 2, 0);
rdx1 = rdx;
rdxcoordinates = t15;
rdy1 = rdy;
rdycoordinates = t16;
Uconvert = 1000;
LocalCoordinatesX = Uconvert * (rdx1 - rdxcoordinates);
LocalCoordinatesY = Uconvert * (rdy1 - rdycoordinates);
point1 = Point.ByCoordinates(LocalCoordinatesX, LocalCoordinatesY);
point2 = Point.PruneDuplicates(point1<1L>, 0.001);
polyCurve1 = PolyCurve.ByPoints(point2, false);
t3 = Math.Round(5.3, 1);
# ----------------------------------------
code_block_26 = CodeBlock(PolycurvesBGT=code_block_25.polyCurve1) { PolycurvesBGT; }
code_block_27 = CodeBlock(CurveNamesBGT=create_7) { CurveNamesBGT; }
code_block_28 = CodeBlock(t4=XMLXPath_3)
# ---------- code_block_28.designscript (3 lines) ----------
t5 = DSCore.List.GetItemAtIndex(t4@-3<1>, 1);
t6 = DSCore.List.GetItemAtIndex(t4@-3<1>, 2);
t7 = DSCore.List.GetItemAtIndex(t4@-3<1>, 3);
# ----------------------------------------
create_9 = List.Create(code_block_28.t5, code_block_28.t6, code_block_28.t7)
code_block_29 = CodeBlock(MetadataBGT=create_9) { MetadataBGT; }
