# Dynamo graph LASzip_CliStringBuilder.dyn (Dynamo 1.3.0.875)

directory_path_for_laz_download = Directory("C:\TEMP")

# group: input gebruiker
rd_x_coördinaat_linker_onderhoek = CodeBlock { 86500; }  # "RD x-coördinaat linker onderhoek in meters"
rd_y_coördinaat_linker_onderhoek = CodeBlock { 461200; }  # "RD y-coördinaat linker onderhoek in meters"
rd_x_coördinaat_rechter = CodeBlock { 87000; }  # "RD x-coördinaat rechter bovenhoek in meters"
rd_y_coördinaat_rechter = CodeBlock { 461500; }  # "RD y-coördinaat rechter bovenhoek in meters"
filter_op_classificatie = BoolSelector(true)
te_behouden_classificatie = CodeBlock { 6; }
geef_het_pad_op_van_de_map_waar = Directory("M:\2015\2015108_Generaal Winkelmanlaan_Wassenaar\50_Communication\02_Post-in")  # "geef het pad op van de map waar je inkomende bestanden plaatst"
te_behouden_classificaties = CodeBlock()  # "te behouden classificaties (meervoud)"
# ---------- te_behouden_classificaties.designscript (8 lines) ----------
{2,1};
/*
UITLEG
als je tegelijk meerdere classificaties wilt behouden,
schrijf ze dan hierboven tussen de accolades,
gescheiden door een komma,
en stop het resultaat in de 'input classificatie' Node
*/;
# ----------------------------------------

# group: collect input
create = List.Create(rd_x_coördinaat_linker_onderhoek, rd_y_coördinaat_linker_onderhoek, rd_x_coördinaat_rechter, rd_y_coördinaat_rechter)
input_classificatie = Watch(te_behouden_classificatie)
string_from_object = FromObject(input_classificatie)
create_2 = List.Create(filter_op_classificatie, string_from_object)

# group: random integerstring from user input
sum = Math.Sum(create)
code_block = CodeBlock(Filteren=create_2) { Filteren[0]; }
code_block_2 = CodeBlock { 1; 2; }
if_ = If(test=code_block, true=code_block_2.out0, false=code_block_2.out1)
code_block_3 = CodeBlock(Filteren=create_2) { Filteren[1]; }
toNumber = String.ToNumber(code_block_3)
create_3 = List.Create(sum, if_, toNumber)
flatten = Flatten(create_3)
sum_2 = Math.Sum(flatten)
random = Math.Random(sum_2)
code_block_4 = CodeBlock(x=random) { x*1000; }
string_from_object_2 = FromObject(code_block_4)
code_block_5 = CodeBlock { ","; }
split = String.Split(string_from_object_2, code_block_5)
code_block_6 = CodeBlock(str=split) { str[0]; }
code_block_7 = CodeBlock { 3; "0"; }
padLeft = String.PadLeft(code_block_6, code_block_7.out0, code_block_7.out1)

file_path = Filename("LASzip_CliStringBuilder.dyn")

# group: build cmd comments and path setting
commentmarker = StringInput("REM ")
code_block_8 = CodeBlock(commentMarker=commentmarker, dynName=file_path)
# ---------- code_block_8.designscript (23 lines) ----------
{
commentMarker+"info voor gebruiker, vragen sturen naar ekko@groosman.com",
commentMarker+"Batch script gebouwd met "+dynName,
commentMarker+"bedankt voor het gebuiken van dit Batch Script",
commentMarker+"Het programma laszip draait nu als een achtergrondproces.",
commentMarker+"Afhankelijk van hoe groot de pointcloud in het *.laz bestand was,",
commentMarker+"kan het even duren voor het proces klaar is.",
{},
"@ECHO OFF",
{}
};

//insert path setting and lastools input



{
{},
"@ECHO ON",
{},
commentMarker+"laszip is klaar, je uitgepakte, gecropte en gefilterde *.las staat klaar op de locatie die je in Dynamo had opgegeven",
commentMarker+"credits laszip from LAStools: https://rapidlasso.com/laszip/ twitter: @LAStools email: info@rapidlasso.com"
};
# ----------------------------------------
string = StringInput("set PATH=%PATH%;")
code_block_9 = CodeBlock(s1=string, path=directory_path_for_laz_download) { s1+path; }

# group: kopieer laszip.exe naar dezelfde map als de *. laz download
file_path_2 = Filename("F:\Applic\Dynamo\LAStools\laszip.exe")
fromPath = FileObject(file_path_2)  # "File.FromPath"
fileName = FilePath.FileName(file_path_2)
combine = FilePath.Combine(directory_path_for_laz_download, fileName)
code_block_10 = CodeBlock { true; }
copy = File.Copy(fromPath, combine, code_block_10)
isNull = Object.IsNull(copy)
if_2 = If(test=isNull, true=fileName, false=fileName)

string_2 = StringInput(" -i ")
string_3 = StringInput("\*.laz")

# group: filter
code_block_11 = CodeBlock(Filteren=create_2) { Filteren[0]; }
code_block_12 = CodeBlock { " -keep_classification "; }
code_block_13 = CodeBlock(Filteren=create_2) { Filteren[1]; }
join = String.Join(code_block_12, code_block_13)
code_block_14 = CodeBlock(a=code_block_12, b=join) { a+b; }
string_4 = StringInput(" ")
if_3 = If(test=code_block_11, true=code_block_14, false=string_4)

# group: crop
string_5 = StringInput(" -inside")
code_block_15 = CodeBlock(cropBox=create) { cropBox; }
crop_string = CodeBlock(x=string_5, cropBox=code_block_15) { x+" "+cropBox[0]+" "+cropBox[1]+" "+cropBox[2]+" "+cropBox[3]; }
code_block_16 = CodeBlock(cropBox=code_block_15) { a=cropBox[0]; b=cropBox[2]; a-b; }
code_block_17 = CodeBlock(cropBox=code_block_15) { a=cropBox[1]; b=cropBox[3]; a-b; }
code_block_18 = CodeBlock(x=code_block_16.out2, y=code_block_17.out2) { x+" x "+y; }
afmetingen_pointcloud_in_meters = Watch(code_block_18)

string_6 = StringInput(" -merged")

# group: file name addition
code_block_19 = CodeBlock()
# ---------- code_block_19.designscript (5 lines) ----------
{
{1, "overig"},
{2, "maaiveld"},
{6, "bebouwing"}
};
# ----------------------------------------
lastItem = List.LastItem(code_block_19, lacing=Longest)
firstItem = List.FirstItem(code_block_19, lacing=Longest)
containsItem = List.ContainsItem(list=input_classificatie, item=firstItem, lacing=CrossProduct)
code_block_20 = CodeBlock { true; }
allIndicesOf = List.AllIndicesOf(list=containsItem, item=code_block_20, lacing=Longest)
getItemAtIndex = List.GetItemAtIndex(list=lastItem, index=allIndicesOf)
code_block_21 = CodeBlock(x=getItemAtIndex) { "_"+x; }
string_from_array = FromArray(code_block_21)
string_7 = StringInput("{")
string_8 = StringInput("")
replace = String.Replace(str=string_from_array, searchFor=string_7, replaceWith=string_8)
string_9 = StringInput("}")
replace_2 = String.Replace(str=replace, searchFor=string_9, replaceWith=string_8)
string_10 = StringInput(",")
replace_3 = String.Replace(str=replace_2, searchFor=string_10, replaceWith=string_8)

# group: target directory and file name
code_block_22 = CodeBlock(Filteren=create_2) { Filteren[0]; }
string_11 = StringInput("\"")
code_block_23 = CodeBlock(map=geef_het_pad_op_van_de_map_waar) { map; }
string_12 = StringInput("AHN")
combine_2 = FilePath.Combine(code_block_23, string_12)
string_13 = StringInput("\")
string_14 = StringInput("_")
split_2 = String.Split(code_block_23, string_13, string_14)
code_block_24 = CodeBlock(str=split_2) { str[2]; }
code_block_25 = CodeBlock(Filteren=create_2) { Filteren[1]; }

# group: output extra folder
fromPath_2 = DirectoryObject(combine_2)  # "Directory.FromPath"

# group (continued): target directory and file name
code_block_26 = CodeBlock(stringmark=string_11, path=fromPath_2, projectnr=code_block_24, classX=replace_3) { " -odir "+stringmark+path+stringmark+" -o "+stringmark+projectnr+"_pointcloud"+classX+".las"+stringmark; }
code_block_27 = CodeBlock(stringmark=string_11, path=fromPath_2, projectnr=code_block_24) { " -odir "+stringmark+path+stringmark+" -o "+stringmark+projectnr+"_pointcloud.las"+stringmark; }
if_4 = If(test=code_block_22, true=code_block_26, false=code_block_27)

code_block_28 = CodeBlock(lasToolExe=if_2, importPointsFile=string_2, path=directory_path_for_laz_download, files=string_3, filter=if_3, crop=crop_string, merge=string_6, filePath=if_4) { lasToolExe+importPointsFile+path+files+filter+crop+merge+filePath; }

# group: batch file output to C:\temp
combine_3 = FilePath.Combine(directory_path_for_laz_download, padLeft)
join_2 = List.Join(code_block_8.out0, code_block_9, code_block_28, code_block_8.out1)
code_block_29 = CodeBlock(multiline_array=join_2) { "startLAStools.cmd"; multiline_array; }
code_block_30 = CodeBlock(path=combine_3, str=code_block_29.out0) { path+str; }
writeToFile = CSV.WriteToFile(code_block_30, code_block_29.multiline_array)

# group: Revit Ouput, indien externe coördinaten ontbreken, zet die dan op RD-stelsel, nulpunt is hart AHN Pointcloud
categories = Categories("ProjectBasePoint")
all_elements_of_category = ElementsOfCategory(categories)
code_block_31 = CodeBlock { {"E/W","N/S", "Elev", "Angle to True North"}; }
code_block_32 = CodeBlock { -1; }
dropItems = List.DropItems(list=code_block_31, amount=code_block_32)
getParameterValueByName = Element.GetParameterValueByName(element=all_elements_of_category, parameterName=code_block_31, lacing=Longest)
abs = Math.Abs(getParameterValueByName)
code_block_33 = CodeBlock { tolerance=0.0001; }
code_block_34 = CodeBlock(x=abs, t=code_block_33) { x>t; }
allTrue = AllTrue(code_block_34)
code_block_35 = CodeBlock(cropBox=create) { cropBox; }
code_block_36 = CodeBlock(cropBox=code_block_35) { a=cropBox[0]; b=cropBox[2]; (a+b)/2; }
code_block_37 = CodeBlock(cropBox=code_block_35) { a=cropBox[1]; b=cropBox[3]; (a+b)/2; }
code_block_38 = CodeBlock { 0; }
create_4 = List.Create(code_block_36.out2, code_block_37.out2, code_block_38)
convert_meter_to_millimeter = CodeBlock(valueInMeters=create_4) { valueInMeters * 1000; }
dropItems_2 = List.DropItems(list=getParameterValueByName, amount=code_block_32)
if_5 = If(test=allTrue, true=convert_meter_to_millimeter, false=dropItems_2)
setParameterByName = Element.SetParameterByName(element=all_elements_of_category, parameterName=dropItems, value=if_5, lacing=Longest)

code_block_39 = CodeBlock()
# ---------- code_block_39.designscript (60 lines) ----------
/*
workflow:

haal de pointcloud(s) op bij AHN
http://pdokviewer.pdok.nl/ - vul adres in, zoek links in het menu 'Lagen' de
ahn3 (nog niet landelijk dekkend) of de ahn2 bladindex. Noteer meteen de RD
coördinaten (links onder de kaart, lopen mee met je muis) van de linkeronderhoek
en de rechterbovenhoek van het gebied dat je interesseert.
Daar kunnen we de enorme puntenwolk die je downloadt meteen op afsnijden.

ahn3 kun je downloaden van https://www.pdok.nl/nl/ahn3-downloads,
dit bestand bevat een classificatie
1: overig (vaak auto's of bomen),
2: maaiveld,
6: bebouwing
?: water (is meestal al uit de data weggelaten)
?: kunstwerk (bruggen, viaducten) of
(? = aan te vullen waar content wordt aangetroffen)


ahn2 kun je downloaden van
http://geodata.nationaalgeoregister.nl/ahn2/atom/ahn2_gefilterd.xml
(maaiveld) en
http://geodata.nationaalgeoregister.nl/ahn2/atom/ahn2_uitgefilterd.xml
(alles wat geen maaiveld is)

sla de download op in de map C:\temp en laat de naam ongewijzigd

als het gebied dat je interesseert op meer dan 1 kaartblad valt,
download je ook de andere bladen en zet je ze in dezelfde map

geef het pad op van de map waar je inkomende bestanden plaatst (op moment van
schrijven is dat voor nieuwe projecten M:\<jaar>\<project>\10_Incoming

run dit script. het maakt:
- een map AHN bij je inkomende bestanden-map
- een cmd file in de map C:\temp

open de Opdrachtprompt (type "Opdrachtprompt" in bij Windows Start,
of kijk op C:\Windows\system32\cmd.exe)

sleep de meest recente cmd-file die dit script in je C:\temp map zet
naar het Opdrachtprompt venster en druk op Enter. de cmd file doet dan dit:
- LAStools (open source programma) aansturen om de gedownloade bestanden te
- combineren,
- croppen
- filteren op classificatie (alleen beschikbvarr voor AHN3)
- opslaan als *.las bestand voor bewerking in Revit
NB: dit proces loopt in de achtergrond, en kan even duren!

Link daarna de verkregen pointcloud in Revit. Dat vergt twee stappen, omdat
*.las bestanden eerst worden omgezet naar Autodesks formaat voor pointclouds.
Volg de suggestie van Revit om een index file te maken.
Revit geeft de voortgang van dat proces netjes aan. Zodra dat klaar is start
je het 'link pointcloud' commando opnieuw, en link je de *.rcp of *.rcs -file.
NB: zet bij de tweede run de 'Positioning'optie op Auto-By Shared Coordinates

bewaar de *.las file voor andere bewerkingen met LAStools

*/;
# ----------------------------------------
