# Dynamo graph BGT donut oplossing.dyn (Dynamo 2.10.0.3455)

# group: DONUT EXAMPLE
XY = Plane.XY()
code_block = CodeBlock { 500; }
byWidthLength = Rectangle.ByWidthLength(plane=XY, width=code_block, length=code_block)
code_block_2 = CodeBlock { 100; }
offset = Curve.Offset(curve=byWidthLength, distance=code_block_2)
byPatch = Surface.ByPatch(closedCurve=offset)
byPatch_2 = Surface.ByPatch(closedCurve=byWidthLength)
code_block_3 = CodeBlock { 0.5; }
pointAtParameter = Surface.PointAtParameter(surface=byPatch_2, u=code_block_3, v=code_block_3)
trim = Geometry.Trim(geometry=byPatch, other=byPatch_2, pick=pointAtParameter)

code_block_4 = CodeBlock()
# ---------- code_block_4.designscript (12 lines) ----------
// GML Structure
bgt-layer
	gml:Polygon
	gml:Polygon;
		gml:exterior;
			gml:posList
				x
				y
		gml:interior;
			gml:posList;
				x
				y;
# ----------------------------------------
string = StringInput("C:\Users\mikev\OneDrive\Bureaublad\TEMP\GIS-files\BGT")
code_block_5 = CodeBlock(Directorypath=string)
# ---------- code_block_5.designscript (2 lines) ----------
/*Directory with BGTfiles */
Directorypath: var[]..[];
# ----------------------------------------
string_2 = StringInput(".//{http://www.opengis.net/gml}exterior")  # graph input
string_3 = StringInput(".//{http://www.opengis.net/gml}interior")  # graph input
string_4 = StringInput(".//{http://www.opengis.net/gml}posList")  # graph input
code_block_6 = CodeBlock { 108119; 454497; }
code_block_7 = CodeBlock(RdX=code_block_6.out0)
# ---------- code_block_7.designscript (2 lines) ----------
/*RD-coordinate in meters*/
RdX: double;
# ----------------------------------------
code_block_8 = CodeBlock(RdY=code_block_6.out1)
# ---------- code_block_8.designscript (2 lines) ----------
/*RD-coordinate in meters*/
RdY: double;
# ----------------------------------------
afmeting_boundingbox_in_meters = IntegerSlider(250, range=100..1500 step 1)  # "Afmeting boundingbox in meters(breedte, hoogte)"; graph input
code_block_9 = CodeBlock(BoundingboxWidth=afmeting_boundingbox_in_meters)
# ---------- code_block_9.designscript (2 lines) ----------
/*Boundingboxwidth and height in meters*/
BoundingboxWidth: double;
# ----------------------------------------
code_block_10 = CodeBlock { 1000; }

# group: BGT Curves
string_5 = StringInput(".//{http://www.opengis.net/gml}Polygon")  # graph input
python_script = Python(IN[0]=code_block_5, IN[1]=string_5, IN[2]=string_2, IN[3]=string_3, IN[4]=string_4, IN[5]=code_block_7, IN[6]=code_block_8, IN[7]=code_block_9, IN[8]=code_block_10)  # IronPython2
# ---------- python_script.python (155 lines) ----------
import sys
sys.path.append("C:\Program Files (x86)\IronPython 2.7\Lib")

import clr
import re
clr.AddReference('ProtoGeometry')
clr.AddReference('DSCoreNodes')

from Autodesk.DesignScript.Geometry import *
from DSCore import *

import xml.etree.ElementTree as ET

directory_path = IN[0]

bgt_curves = ["bgt_begroeidterreindeel",
"bgt_functioneelgebied",
"bgt_gebouwinstallatie",
"bgt_kunstwerkdeel",
"bgt_onbegroeidterreindeel",
"bgt_ondersteunendwaterdeel",
"bgt_ondersteunendwegdeel",
"bgt_ongeclassifiseerdobject",
"bgt_overbruggingsdeel",
"bgt_overigbouwwerk",
"bgt_overigescheiding",
"bgt_pand",
"bgt_scheiding",
"bgt_spoor",
"bgt_tunneldeel",
"bgt_waterdeel",
"bgt_wegdeel"]

file_paths = []
for i in bgt_curves:
	file_paths.append(directory_path + '/' + i + '.gml')

def checkIfCoordIsInsideBoundingBox(coord, min_x, min_y, max_x, max_y):
	if re.match(r'^-?\d+(?:\.\d+)$', coord[0]) is None or re.match(r'^-?\d+(?:\.\d+)$', coord[1]) is None:
		return False
	else:
		if min_x <= float(coord[0]) <= max_x and min_y <= float(coord[1]) <= max_y:
			return True
		else:
		    return False
	
def mainFunction(file_path):
    # Inputs
	
    xpathstrPolygon = IN[1]
    xpathstrExterior = IN[2]
    xpathstrInterior = IN[3]
    xpathstrposList = IN[4]

    # Bounding box definition
    bbx = IN[5]
    bby = IN[6]
    bb_size = IN[7]
    scale = IN[8]
    bounding_box = [bbx, bby, bb_size]
    min_x = bounding_box[0] - (bounding_box[2]) # / 2
    min_y = bounding_box[1] - (bounding_box[2])
    max_x = bounding_box[0] + (bounding_box[2])
    max_y = bounding_box[1] + (bounding_box[2])

    # get data from xml
    tree = ET.parse(file_path)
    root = tree.getroot()

    # for loop to get each element in an array
    XMLelements = []
    for elem in root.iter():
        XMLelements.append(elem)

    gmlPolygons = root.findall(xpathstrPolygon)

    # for loop to get all gmlPolygons in an array
    Polygons = []

    for gmlPolygon in gmlPolygons:
     	gmlIntExt = []
     	gmlExterior = gmlPolygon.findall(xpathstrExterior)
     	PosListExterior = []
     	for i in gmlExterior:
     		PosListExterior.append(i.findall(xpathstrposList))
     		posListText = []
     		for j in PosListExterior:
     			for k in j:
     				polygon_is_inside_bounding_box = False
     				coordsx = k.text.split(" ")[0::2]
     				coordsy = k.text.split(" ")[1::2]
     				coord = []
     				for i,j in zip(coordsx,coordsy):
     					xy_coord = [i,j]
     					try:
     						xcoord = round((float(i)-bbx)*scale)
     						ycoord = round((float(j)-bby)*scale)
     					except: 
     						xcoord = 0
     						ycoord = 0
     					xy_coord_trans = [xcoord,ycoord]
     					if checkIfCoordIsInsideBoundingBox(xy_coord, min_x, min_y, max_x, max_y):
     						polygon_is_inside_bounding_box = True
     					coord.append(xy_coord_trans)
     				#	ycoord = round((float(newPolygon[x + 1])-bby)*scale)
           			#	xy_coord_trans = [xcoord,ycoord]
     				if polygon_is_inside_bounding_box:
     					posListText.append(coord)
     	gmlIntExt.append(posListText)
     	gmlInterior = gmlPolygon.findall(xpathstrInterior)     	
     	PosListInterior = []
     	posListText = []
     	xy_coord_trans = []
     	for i in gmlInterior:
     		PosListInterior.append(i.findall(xpathstrposList))
     		posListText = []
     		for j in PosListInterior:
     			for k in j:
     				polygon_is_inside_bounding_box = False
     				coordsx = k.text.split(" ")[0::2]
     				coordsy = k.text.split(" ")[1::2]
     				coord = []
     				for i,j in zip(coordsx,coordsy):
     					xy_coord = [i,j]
     					try:
     						xcoord = round((float(i)-bbx)*scale)
     						ycoord = round((float(j)-bby)*scale)
     					except: 
     						xcoord = 0
     						ycoord = 0
     					xy_coord_trans = [xcoord,ycoord]
     					if checkIfCoordIsInsideBoundingBox(xy_coord, min_x, min_y, max_x, max_y):
     						polygon_is_inside_bounding_box = True
     					coord.append(xy_coord_trans)
     				#	ycoord = round((float(newPolygon[x + 1])-bby)*scale)
           			#	xy_coord_trans = [xcoord,ycoord]
     				if polygon_is_inside_bounding_box:
     					posListText.append(coord)
     	gmlIntExt.append(posListText)
     	Polygons.append(gmlIntExt)
    return Polygons
    

returnValue = mainFunction(file_paths[0])
# execution of main function in python script
#returnValue = []

#for i in file_paths:
#	try:
#		returnValue.append(mainFunction(i))
#	except:
#		returnValue.append("_none_")
		
# put returnValue in OUT
OUT = returnValue
# ----------------------------------------
code_block_11 = CodeBlock(t2=python_script) { t3 = List.FirstItem(t2@@L2<1>); t1 = [[0]]; t4 = List.LastItem(t2@@L2<1>); }  # frozen
python_script_2 = Python(IN[0]=code_block_11.t3, IN[1]=code_block_11.t1)  # IronPython2
# ---------- python_script_2.python (8 lines) ----------
items = IN[0]
rep = IN[1]
elementlist = list()
for item in items:
	if item is None: 
		item = rep
	elementlist.append(item)
OUT = elementlist
# ----------------------------------------
python_script_3 = Python(IN[0]=code_block_11.t4, IN[1]=code_block_11.t1)  # IronPython2; same code as python_script_2
code_block_12 = CodeBlock(t1=python_script_2, t2=python_script_3)
# ---------- code_block_12.designscript (5 lines) ----------
point1 = Point.ByCoordinates(t1, t2, 0);
t3 = List.Clean(point1, false);
polyCurve1 = PolyCurve.ByPoints(t3, false);
geometry1 = Geometry.Explode(polyCurve1);
t4 = ["bgt_begroeidterreindeel", "bgt_functioneelgebied", "bgt_gebouwinstallatie", "bgt_kunstwerkdeel", "bgt_onbegroeidterreindeel", "bgt_ondersteunendwaterdeel", "bgt_ondersteunendwegdeel", "bgt_ongeclassifiseerdobject", "bgt_overbruggingsdeel", "bgt_overigbouwwerk", "bgt_overigescheiding", "bgt_pand", "bgt_scheiding", "bgt_spoor", "bgt_tunneldeel", "bgt_waterdeel", "bgt_wegdeel"];
# ----------------------------------------

code_block_13 = CodeBlock(a=code_block_12.point1) { a[0]; }
pruneDuplicates = Point.PruneDuplicates()  # unwired: points
byPerimeterPoints = Surface.ByPerimeterPoints(points=pruneDuplicates)
boolean = BoolSelector(false)
clean = List.Clean(list=byPerimeterPoints, preserveIndices=boolean)

# group: BOUNDINGBOX IN DYNAMO
code_block_14 = CodeBlock(a=afmeting_boundingbox_in_meters) { a*1000; }
byWidthLength_2 = Rectangle.ByWidthLength(width=code_block_14, length=code_block_14)

split = Geometry.Split(geometry=clean, other=byWidthLength_2)
code_block_15 = CodeBlock { 0.5; }
pointAtParameter_2 = Surface.PointAtParameter(surface=split, u=code_block_15, v=code_block_15)
containmentTest = Polygon.ContainmentTest(polygon=byWidthLength_2, point=pointAtParameter_2)
filterByBoolMask = List.FilterByBoolMask(list=split, mask=containmentTest)
watch = Watch(filterByBoolMask.in)
flatten = List.Flatten(list=watch)
perimeterCurves = Surface.PerimeterCurves(surface=flatten)
code_block_16 = CodeBlock { 0.5; }
pointAtParameter_3 = Surface.PointAtParameter(u=code_block_16, v=code_block_16)  # unwired: surface
trim_2 = Geometry.Trim()  # unwired: geometry, other, pick
subtractFrom = Surface.SubtractFrom()  # unwired: surface, trimmingEntity
code_block_17 = CodeBlock()
# ---------- code_block_17.designscript (16 lines) ----------
"
#Load the Python Standard and DesignScript Libraries
import sys
import clr
clr.AddReference('ProtoGeometry')
clr.AddReference('DSCoreNodes')
from DSCore import *
from Autodesk.DesignScript.Geometry import *

pointdata = IN[0]

lst = List.Clean(pointdata,0)
pnt = Point.ByCoordinates(0,0,0)

OUT = lst
";
# ----------------------------------------
python_script_from_string = PythonStringNode(script=code_block_17, IN[0]=python_script)  # IronPython2
firstItem = List.FirstItem(list=python_script_from_string@@L2)
lastItem = List.LastItem(list=python_script_from_string@@L2)
byCoordinates = Point.ByCoordinates(x=firstItem, y=lastItem)
code_block_18 = CodeBlock { 0; 1; }

# group: exterior Ring
getItemAtIndex = List.GetItemAtIndex(list=byCoordinates@@L4, index=code_block_18.out0)

# group: interior Ring
getItemAtIndex_2 = List.GetItemAtIndex(list=byCoordinates@@L4, index=code_block_18.out1)

isNull = Object.IsNull(object=getItemAtIndex_2)
filterByBoolMask_2 = List.FilterByBoolMask(list=getItemAtIndex, mask=isNull)
code_block_19 = CodeBlock { 0.0; }
pruneDuplicates_2 = Point.PruneDuplicates(points=filterByBoolMask_2.out, tolerance=code_block_19)
byPerimeterPoints_2 = Surface.ByPerimeterPoints(points=pruneDuplicates_2)
filterByBoolMask_3 = List.FilterByBoolMask(list=getItemAtIndex_2, mask=isNull)
code_block_20 = CodeBlock { 0.0; }
pruneDuplicates_3 = Point.PruneDuplicates(points=filterByBoolMask_3.out, tolerance=code_block_20)
byPerimeterPoints_3 = Surface.ByPerimeterPoints(points=pruneDuplicates_3)
difference = Surface.Difference(surface=byPerimeterPoints_2, others=byPerimeterPoints_3)
byPerimeterPoints_4 = Surface.ByPerimeterPoints(points=filterByBoolMask_2.in)
firstItem_2 = List.FirstItem(list=filterByBoolMask_2.in)
flatten_2 = List.Flatten(list=firstItem_2)
byPoints = PolyCurve.ByPoints(points=flatten_2)
