# Dynamo graph BGT-Lines2.dyn (Dynamo 1.3.3.4111)

TEMPfolder = StringInput("C:\TEMP")
code_block = CodeBlock { 106436; 425689; }
# note: It will take quite some time to run this node. It can take 10 minutes. When you run parts of it it will be quicker. Open the file: GIStoBIM1.rvt from the package-folder to use the standard filled regions and linetypes.
getMortonCodeCoordinate = Custom[GIS2BIM.GetMortonCodeCoordinate](X=code_block.out0, Y=code_block.out1)  # Get mortoncode given 2 coordinates and tiledimension
string = StringInput("C:\TEMP")
downloadBGTdata = Custom[GIS2BIM.DownloadBGTdata](Mortoncode=getMortonCodeCoordinate, Directory=string)  # frozen; Download BGT-data(dutch GIS-information)
unzipFile = Custom[GIS2BIM.UnzipFile](FilePathZipFile=downloadBGTdata.Location, DirectoryToExtractTo=downloadBGTdata.Directory)  # Unzip zip-file

# group: 2D SETTINGS
# note: Panden;
# 0 bgt_overigbouwwerk;
# Groen;
# 1 bgt_begroeidterreindeel;
# Lijnen(aparte lagen);
# 2 bgt_functioneelgebied;
# 3 bgt_gebouwinstallatie;
# 4 bgt_kunstwerkdeel;
# 5 bgt_onbegroeidterreindeel;
# 6 bgt_ondersteunendwegdeel;
# 7 bgt_overigescheiding;
# 8 bgt_scheiding;
# 9 bgt_spoor;
# 10 bgt_tunneldeel;
# Wegen bruggen en kunstwerken;
# 11 bgt_kunstwerkdeel;
# 12 bgt_overbruggingsdeel;
# 13 bgt_wegdeel;
# Water;
# 14 bgt_ondersteunendwaterdeel;
# 15 bgt_waterdeel;
# Labels;
# 16 bgt_openbareruimtelabel;
# Puntobject;
# 17 bgt_vegetatieobject;
tree = FamilyTypes("90_DI_boom:90_DI_boom")
line_styles = CodeBlock()
# ---------- line_styles.designscript (9 lines) ----------
"bgt_functioneelgebied";
"bgt_gebouwinstallatie";
"bgt_kunstwerkdeel";
"bgt_onbegroeidterreindeel";
"bgt_ondersteunendwegdeel";
"bgt_overigescheiding";
"bgt_scheiding";
"bgt_spoor";
"bgt_tunneldeel";
# ----------------------------------------

code_block_2 = CodeBlock { Directory; }
code_block_3 = CodeBlock(RDx=code_block.out0) { RDx; }
code_block_4 = CodeBlock(RDy=code_block.out1) { RDy; }
width = CodeBlock { 250; }
code_block_5 = CodeBlock(BoundingboxWidth=width) { BoundingboxWidth; }

# group: PLACE TREES
code_block_6 = CodeBlock { 17; }
getItemAtIndex = List.GetItemAtIndex(index=code_block_6)  # unwired: list
string_2 = StringInput(".//{http://www.opengis.net/gml}pos")
filterGML = Custom[GIS2BIM.FilterGML](GMLFile=getItemAtIndex, xPATH=string_2, CoordinateX=code_block_3, CoordinateY=code_block_4, Boundingbox=code_block_5)  # filter GML-file based on boundingbox
flatten = Flatten(filterGML.Points)

activeView = Custom[Springs.Doc.ActiveView]()  # Selects the current document's active view. Supports more view types than the built-in option. Will be depreciated once the bult in node works with all plan types.
code_block_7 = CodeBlock(View=activeView) { View; }

# group: clockwork familyinstance by point in view
code_block_8 = CodeBlock(item=flatten) { Flatten({item}); }
python_script = Python(IN[0]=code_block_8, IN[2]=code_block_7)  # unwired: IN[1]
# ---------- python_script.python (31 lines) ----------
import clr
clr.AddReference('RevitAPI')
from Autodesk.Revit.DB import *

clr.AddReference("RevitNodes")
import Revit
clr.ImportExtensions(Revit.Elements)
clr.ImportExtensions(Revit.GeometryConversion)

clr.AddReference("RevitServices")
import RevitServices
from RevitServices.Persistence import DocumentManager
from RevitServices.Transactions import TransactionManager

doc = DocumentManager.Instance.CurrentDBDocument
points = UnwrapElement(IN[0])
famtype = UnwrapElement(IN[1])
lvl = UnwrapElement(IN[2])
elementlist = list()
counter = 0

TransactionManager.Instance.EnsureInTransaction(doc)
# make sure familysymbol is active
if famtype.IsActive == False:
	famtype.Activate()
	doc.Regenerate()
for point in points:
	newobj = doc.Create.NewFamilyInstance(point.ToXyz(),famtype,lvl)
	elementlist.append(newobj.ToDSType(False))
TransactionManager.Instance.TransactionTaskDone()
OUT = elementlist
# ----------------------------------------
python_script_2 = Python(IN[0]=flatten, IN[1]=python_script)
# ---------- python_script_2.python (4 lines) ----------
check = IN[0]
items = IN[1]
if isinstance(check, (list)): OUT = items
else: OUT = items[0]
# ----------------------------------------

code_block_9 = CodeBlock(x=python_script_2) { x; }
count = List.Count()  # unwired: arg0
map = List.Map(f_x=count)  # frozen; unwired: list
code_block_10 = CodeBlock { "."; }
split = String.Split(arg1=code_block_10)  # unwired: arg0
firstItem = List.FirstItem()  # unwired: arg0
map_2 = List.Map(list=split, f_x=firstItem)
python_script_3 = Python(IN[0]=map, IN[1]=map_2)
# ---------- python_script_3.python (22 lines) ----------
import clr
clr.AddReference('ProtoGeometry')
from Autodesk.DesignScript.Geometry import *
#The inputs to this node will be stored as a list in the IN variables.
dataEnteringNode = IN

a = IN[0]
b = IN[1]

d = []
for i in a:
    if i is None:
        d.append(0)
    else:
    	d.append(i)

c = []

for j,k in zip(d,b):
    c.append([k]*j)

OUT = c
# ----------------------------------------
code_block_11 = CodeBlock(View=activeView) { View; }
code_block_12 = CodeBlock { ".gml"; }
code_block_13 = CodeBlock { "C:/TEMP/15893"; }

# group: Puntvormige elementen
code_block_14 = CodeBlock { "/"; }
code_block_15 = CodeBlock { ".gml"; }
bgt_lagen = CodeBlock()
# ---------- bgt_lagen.designscript (11 lines) ----------
"bgt_bak";
"bgt_bord";
"bgt_kast";
"bgt_mast";
"bgt_paal";
"bgt_put";
"bgt_sensor";
"bgt_straatmeubilair";
"bgt_vegetatieobject";
"bgt_waterinrichtingselement";
"bgt_wegrichtingselement";
# ----------------------------------------
create = List.Create(bgt_lagen.out0, bgt_lagen.out1, bgt_lagen.out2, bgt_lagen.out3, bgt_lagen.out4, bgt_lagen.out5, bgt_lagen.out6, bgt_lagen.out7, bgt_lagen.out8, bgt_lagen.out9, bgt_lagen.out10)
concat = String.Concat(code_block_13, code_block_14, arg3=code_block_15)  # unwired: arg2
map_3 = List.Map(list=create, f_x=concat)

# group: Labels
code_block_16 = CodeBlock { "bgt_openbareruimtelabel"; }
concat_2 = String.Concat(code_block_13, code_block_14, code_block_16, code_block_15)

string_3 = StringInput(".//{http://www.opengis.net/gml}Point")
python_script_4 = Python(IN[0]=concat_2, IN[1]=string_3, IN[2]=code_block_3, IN[3]=code_block_4, IN[4]=code_block_5)
# ---------- python_script_4.python (81 lines) ----------
import sys
sys.path.append("C:\Program Files (x86)\IronPython 2.7\Lib")

import clr
clr.AddReference('ProtoGeometry')
from Autodesk.DesignScript.Geometry import *

import xml.etree.ElementTree as ET


def checkIfCoordIsInsideBoundingBox(coord, bounding_box):
    min_x = bounding_box[0] - (bounding_box[2] / 2)
    min_y = bounding_box[1] - (bounding_box[2] / 2)
    max_x = bounding_box[0] + (bounding_box[2] / 2)
    max_y = bounding_box[1] + (bounding_box[2] / 2)

    if min_x <= float(coord[0]) <= max_x and min_y <= float(coord[1]) <= max_y:
        return True
    else:
        return False


def mainFunction():
    # Inputs
    file_path = IN[0]
    xpathstr = IN[1]

    # Bounding box definition
    bbx = IN[2]
    bby = IN[3]
    bb_size = IN[4]
    bounding_box = [bbx, bby, bb_size]

    # get data from xml
    tree = ET.parse(file_path)
    root = tree.getroot()

    # for loop to get each element in an array
    XMLelements = []
    for elem in root.iter():
        XMLelements.append(elem)

    xpathfound = root.findall(xpathstr)

    # for loop to get all polygons in an array
    polygons = []
    for x in xpathfound:
        if x.text:
            try:
                polygons.append(x.text)
            except:
                polygons.append("_none_")
        else:
            polygons.append("_none_")

    # for loop to get each polygon as a list instead of a string
    newPolygons = []
    for polygon in polygons:
        newPolygons.append(polygon.split(" "))

    # for loop to get x,y coords and filter polygons inside Bounding Box
    xyPolygons = []
    for newPolygon in newPolygons:
        polygon_is_inside_bounding_box = False
        x = 0
        xyPolygon = []
        for i in range(0, int(len(newPolygon) / 2)):
            xy_coord = [newPolygon[x], newPolygon[x + 1]]
            xyPolygon.append(xy_coord)
            x += 2
            if checkIfCoordIsInsideBoundingBox(xy_coord, bounding_box):
                polygon_is_inside_bounding_box = True
        if polygon_is_inside_bounding_box:
            xyPolygons.append(xyPolygon)
    return xyPolygons

# execution of main function in python script
returnvalue = mainFunction()

# put returnValue in OUT
OUT = returnvalue
# ----------------------------------------
string_4 = StringInput(".//{http://www.opengis.net/gml}pos")
python_script_5 = Python(IN[0]=concat_2, IN[1]=string_4, IN[2]=code_block_3, IN[3]=code_block_4, IN[4]=code_block_5)
# ---------- python_script_5.python (63 lines) ----------
import sys
sys.path.append("C:\Program Files (x86)\IronPython 2.7\Lib")

import clr
clr.AddReference('ProtoGeometry')
from Autodesk.DesignScript.Geometry import *

import xml.etree.ElementTree as ET


def checkIfCoordIsInsideBoundingBox(coord, bounding_box):
    min_x = bounding_box[0] - (bounding_box[2] / 2)
    min_y = bounding_box[1] - (bounding_box[2] / 2)
    max_x = bounding_box[0] + (bounding_box[2] / 2)
    max_y = bounding_box[1] + (bounding_box[2] / 2)

    if min_x <= float(coord[0]) <= max_x and min_y <= float(coord[1]) <= max_y:
        return True
    else:
        return False


def mainFunction():
    # Inputs
    file_path = IN[0]
    xpathstr = IN[1]

    # Bounding box definition
    bbx = IN[2]
    bby = IN[3]
    bb_size = IN[4]
    bounding_box = [bbx, bby, bb_size]

    # get data from xml
    tree = ET.parse(file_path)
    root = tree.getroot()

    # for loop to get each element in an array
    XMLelements = []
    for elem in root.iter():
        XMLelements.append(elem)

    xpathfound = root.findall(xpathstr)

    # for loop to get all polygons in an array
    polygons = []
    for x in xpathfound:
        if x.text:
            try:
                polygons.append(x.text)
            except:
                polygons.append("_none_")
        else:
            polygons.append("_none_")


    return xpathfound

# execution of main function in python script
returnvalue = mainFunction()

# put returnValue in OUT
OUT = returnvalue
# ----------------------------------------
readText = File.ReadText(concat_2)
string_5 = StringInput("imgeo:tekst")
string_6 = StringInput("imgeo:hoek")
python_script_6 = Python(IN[0]=concat_2, IN[1]=string_4, IN[2]=code_block_3)
# ---------- python_script_6.python (19 lines) ----------
import sys
sys.path.append("C:\Program Files (x86)\IronPython 2.7\Lib")

import clr
clr.AddReference('ProtoGeometry')
from Autodesk.DesignScript.Geometry import *

import xml.etree.ElementTree as ET

file_path = IN[0]
xpathstr = IN[1]

tree = ET.parse(file_path)
root = tree.getroot()

xpathfound = root.findall(xpathstr)

# put returnValue in OUT
OUT = xpathfound
# ----------------------------------------
code_block_17 = CodeBlock { "Dordrecht"; "werf van schouten"; "501"; }
getLocationdataNetherlands = Custom[GIS2BIM.GetLocationdataNetherlands](City=code_block_17.out0, Streetname=code_block_17.out1, Housenumber=code_block_17.out2)  # Gives locationdata based on an adress in the Netherlands
BGTGeometry = Custom[GIS2BIM.BGTGeometry](Directory=code_block_13, RDx=code_block_3, RDy=code_block_4, BoundingboxWidth=code_block_5)  # Returns BGT-curves and metadata(Dutch GEO)
filterGML_2 = Custom[GIS2BIM.FilterGML]()  # unwired: GMLFile, xPATH, CoordinateX, CoordinateY, Boundingbox
string_7 = StringInput(".//{http://www.opengis.net/gml}posList")
firstItem_2 = List.FirstItem()  # unwired: arg0
map_4 = List.Map(f_x=firstItem_2)  # unwired: list
map_5 = List.Map(f_x=map_4)  # unwired: list
toNumber = String.ToNumber(map_5)
lastItem = List.LastItem()  # unwired: arg0
map_6 = List.Map(f_x=lastItem)  # unwired: list
map_7 = List.Map(f_x=map_6)  # unwired: list
toNumber_2 = String.ToNumber(map_7)
code_block_18 = CodeBlock(x=toNumber, y=toNumber_2) { (x-rdx)*1000; (y-rdy)*1000; }  # unwired: rdx, rdy
code_block_19 = CodeBlock { 0; }
byCoordinates = Point.ByCoordinates(x=code_block_18.out0, y=code_block_18.out1, z=code_block_19)
code_block_20 = CodeBlock(a=map_3) { a[0]; }
string_8 = StringInput(".//{http://www.opengis.net/gml}pos")
string_9 = StringInput(".//{http://www.geostandaarden.nl/imgeo/2.1}plus-type")
python_script_7 = Python(IN[0]=code_block_20, IN[1]=string_8, IN[2]=code_block_3, IN[3]=code_block_4, IN[4]=code_block_5, IN[5]=string_9)
# ---------- python_script_7.python (84 lines) ----------
import sys
sys.path.append("C:\Program Files (x86)\IronPython 2.7\Lib")

import clr
clr.AddReference('ProtoGeometry')
from Autodesk.DesignScript.Geometry import *

import xml.etree.ElementTree as ET


def checkIfCoordIsInsideBoundingBox(coord, bounding_box):
    min_x = bounding_box[0] - (bounding_box[2] / 2)
    min_y = bounding_box[1] - (bounding_box[2] / 2)
    max_x = bounding_box[0] + (bounding_box[2] / 2)
    max_y = bounding_box[1] + (bounding_box[2] / 2)

    if min_x <= float(coord[0]) <= max_x and min_y <= float(coord[1]) <= max_y:
        return True
    else:
        return False

def mainFunction():
    # Inputs
    file_path = IN[0]
    xpathstr = IN[1]
    # Bounding box definition
    bbx = IN[2]
    bby = IN[3]
    bb_size = IN[4]
    xpathstr2 = IN[5]
    bounding_box = [bbx, bby, bb_size]
    # get data from xml
    tree = ET.parse(file_path)
    root = tree.getroot()
	
    # for loop to get each element in an array
    XMLelements = []
    for elem in root.iter():
        XMLelements.append(elem)

    xpathfound = root.findall(xpathstr)
    xpathfoundlabel = root.findall(xpathstr2)
    # for loop to get all points in an array
    points = []
    for x in xpathfound:
        if x.text:
            try:
                points.append(x.text)
            except:
                points.append("_none_")
        else:
            points.append("_none_")
	
	labels = []
    for i in xpathfoundlabel:
        if i.text:
            try:
                labels.append(i.text)
            except:
                labels.append("_none_")
        else:
            labels.append("_none_")
    
    # for loop to get each point as a list instead of a string
    newPoints = []
    for point in points:
        newPoints.append(point.split(" "))

    # for loop to get x,y coords and filter points inside Bounding Box
    xyPoints = []
    xyLabels = []
    for newPoint, label in zip(newPoints, labels):
    	point_is_inside_bounding_box = False
    	if checkIfCoordIsInsideBoundingBox(newPoint, bounding_box):
    		point_is_inside_bounding_box = True
    		xyPoints.append(newPoint)
    		xyLabels.append(label)
    return xyPoints, xyLabels

# execution of main function in python script
returnvalue = mainFunction()

# put returnValue in OUT
OUT = returnvalue
# ----------------------------------------
code_block_21 = CodeBlock(t4=python_script_7, t9=code_block_3, t10=code_block_4)
# ---------- code_block_21.designscript (14 lines) ----------
t3 = DSCore.List.FirstItem(t4);
t5 = DSCore.List.FirstItem(t3@-2<1>);
t6 = String.ToNumber(t5);
t7 = DSCore.List.LastItem(t3@-2<1>);
t8 = String.ToNumber(t7);
rdx = t9;
x = t6;
rdy = t10;
y = t8;
t1 = (rdx - x) * 1000;
t2 = (rdy - y) * 1000;
t11 = Math.Round(t1);
t12 = Math.Round(t2);
point1 = Point.ByCoordinates(t11, t12);
# ----------------------------------------
