# Dynamo graph BGT_WFS BETA.dyn (Dynamo 2.0.2.6826)

code_block = CodeBlock { "4326"; "28992"; }
getRevitSiteLocation = Custom[GIS2BIM.GetRevitSiteLocation]()  # Gets the properties of the current Site Location of the active Revit Project
transformCRS_epsg = Custom[GIS2BIM.TransformCRS_epsg](sourceCRS=code_block.out0, targetCRS=code_block.out1, xCoordinate=getRevitSiteLocation.Lon, yCoordinate=getRevitSiteLocation.Lat)  # Uses the API of http://epsg.io to transform Coordinate Reference Systems
code_block_2 = CodeBlock { "roelofarendsveen"; "de lasso-zuid"; "22"; }
getLocationdataNetherlands = Custom[GIS2BIM.GetLocationdataNetherlands](City=code_block_2.out0, Streetname=code_block_2.out1, Housenumber=code_block_2.out2)  # Gives locationdata based on an adress in the Netherlands
code_block_3 = CodeBlock { 250; }
createBoundingBox = Custom[GIS2BIM.CreateBoundingBox](CoordinateX=getLocationdataNetherlands.RDcoordinateX_meters_double, CoordinateY=getLocationdataNetherlands.RDcoordinateY_meters_double, BoxWidth=code_block_3, BoxHeight=code_block_3)  # create boundingboxstring for webrequests based on coördinates and dimensions
geoservicesLibraryNetherlands = Custom[GIS2BIM.GeoservicesLibraryNetherlands](BoundingBox=createBoundingBox.Boxstring)  # Library with multiple webadresses which can be used for WFS and WMS webrequests
webrequestWMS2 = Custom[GIS2BIM.WebrequestWMS2](WMSwebrequest=geoservicesLibraryNetherlands.Luchtfoto_2017_OGC_WMS)  # a webrequest based on WMS-protocol
watch_image = WatchImageCore(image=webrequestWMS2)
downloadAHN = Custom[GIS2BIM.DownloadAHN](UrlwebrequestAHN2=geoservicesLibraryNetherlands.11_AHN2_webrequest_bladindex_OGC_WFS, UrlwebrequestAHN3=geoservicesLibraryNetherlands.AHN3_webrequest_bladindex_OGC_WFS)  # get the mapnumber(s) of the AHN based on a given boundingbox
code_block_4 = CodeBlock(rdx=getLocationdataNetherlands.RDcoordinateX_meters_double, rdy=getLocationdataNetherlands.RDcoordinateY_meters_double, BoundingBoxWidth=code_block_3) { rdx; rdy; BoundingBoxWidth; }
WFSBGTGeometry = Custom[GIS2BIM.WFSBGTGeometry](rdx=code_block_4.rdx, rdy=code_block_4.rdy, boundingbox=code_block_4.BoundingBoxWidth)  # frozen; Returns BGT-curves and metadata using the beta WFS BGT method.
file_path = Filename("..\..\..\..\..\..\..\..\TEMP\BGTTEST\BGT_cropped_buildings.bat")  # graph input
web_request = WebRequest(url=geoservicesLibraryNetherlands.4_bag_pand_OGC_WFS)
code_block_5 = CodeBlock(rdx=getLocationdataNetherlands.RDcoordinateX_meters_double, rdy=getLocationdataNetherlands.RDcoordinateY_meters_double) { rdx; rdy; }
createPointsPolygonFromGMLxy = Custom[GIS2BIM.CreatePointsPolygonFromGMLxy](XML=web_request, DeltaX=code_block_5.rdx, DeltaY=code_block_5.rdy)  # Create point and polygons from a GML-file
file_path_2 = Filename("..\..\..\..\..\..\..\..\TEMP\BGTTEST\BGT_cropped_buildings.pts")  # graph input
PTStoPoints = Custom[GIS2BIM.PTStoPoints](PTSFile=file_path_2)  # convert a pts-file(ascii) to dynamo points; unwired: NumberOfColumns
translate = Geometry.Translate(geometry=createPointsPolygonFromGMLxy.PolyCurves, zTranslation=PTStoPoints.Min_Height)
byPatch = Surface.ByPatch(closedCurve=translate)
code_block_6 = CodeBlock(maxheight=PTStoPoints.Max_Height, minheight=PTStoPoints.Min_Height) { maxheight-minheight; }
thicken = Surface.Thicken(surface=byPatch, thickness=code_block_6)
code_block_7 = CodeBlock { 4; }
takeEveryNthItem = List.TakeEveryNthItem(list=PTStoPoints.Points, n=code_block_7)
byPoints = Topography.ByPoints(points=takeEveryNthItem)
mesh = Topography.Mesh(topography=byPoints)
toPolySurface = Custom[Springs.Mesh.ToPolySurface](mesh=mesh)  # Converts a Dynamo mesh to a polysurface. Uses multithreading - optimized for 4 cores.; unwired: mergeAll
split = Geometry.Split(geometry=thicken, other=toPolySurface)
firstItem = List.FirstItem(list=split@L2)
thicken_2 = Surface.Thicken()  # unwired: surface
byGeometry = Custom[Springs.FamilyInstance.ByGeometry]()  # You must provide a valid family template path that will be used for all input geometry objects. The project units(and not the templates) will be used to determine the size of the output geometry. The provided category will be used only if the family template supports it. If not, the default template category will be used instead. Likewise, the family material(provided as a string) will be set only if a material with that name exists in the template. If not, the default material will be used instead ("By Category"). For void cuts, the material settings will be ignored. The Subcategory name is an optional input. If you'd like to skip assigning a Subcategory to any new instance, simply use null. The node expects a unique family name for each geometry object. The rest of the input lists will be processed as if the node lacing is set to longest.; unwired: geometry, familyTemplatePath, familyName
code_block_8 = CodeBlock { 1; }
getItemAtIndex = List.GetItemAtIndex(list=split@L2, index=code_block_8)
categories = Categories(index=230)  # graph input
byGeometry_2 = DirectShape.ByGeometry(geometry=getItemAtIndex, category=categories)
