# Dynamo graph BRO.dyn (Dynamo 1.3.1.1736)

code_block = CodeBlock()
# ---------- code_block.designscript (1 lines) ----------
https://geodata.nationaalgeoregister.nl/brogeotechnischsondeeronderzoek/wfs?request=GetCapabilities
# ----------------------------------------
code_block_2 = CodeBlock()
# ---------- code_block_2.designscript (6 lines) ----------
"https://geodata.nationaalgeoregister.nl/brogeotechnischsondeeronderzoek/wfs?";
"&REQUEST=GetFeature";
"&version=2.0.0";
"&typeName=brogeotechnischsondeeronderzoek:brogeotechnischsondeeronderzoek";
"&crs=EPSG:28992";
"&bbox=";
# ----------------------------------------
code_block_3 = CodeBlock { "zwijndrecht"; "wattstraat"; "17"; }
getLocationdataNetherlands = Custom[GIS2BIM.GetLocationdataNetherlands](City=code_block_3.out0, Streetname=code_block_3.out1, Housenumber=code_block_3.out2)  # Gives locationdata based on an adress in the Netherlands
code_block_4 = CodeBlock { 50000; }
createBoundingBox = Custom[GIS2BIM.CreateBoundingBox](CoordinateX=getLocationdataNetherlands.RDcoordinateX_meters_double, CoordinateY=getLocationdataNetherlands.RDcoordinateY_meters_double, BoxWidth=code_block_4, BoxHeight=code_block_4)  # create boundingboxstring for webrequests based on coördinates and dimensions
concat = String.Concat(code_block_2.out0, code_block_2.out1, code_block_2.out2, code_block_2.out3, code_block_2.out4, code_block_2.out5, createBoundingBox.Boxstring)
openBrowser = Custom[GIS2BIM.OpenBrowser](url=concat)  # Opens a new window in your default browser with the given url.
code_block_5 = CodeBlock()
# ---------- code_block_5.designscript (1 lines) ----------
https://geodata.nationaalgeoregister.nl/brogeotechnischsondeeronderzoek/wms?&request=GetCapabilities&service=WMS
# ----------------------------------------
geoservicesLibraryNetherlands = Custom[GIS2BIM.GeoservicesLibraryNetherlands](BoundingBox=createBoundingBox.Boxstring)  # Library with multiple webadresses which can be used for WFS and WMS webrequests
