# Dynamo graph BRO2.dyn (Dynamo 1.3.3.4111)

geoservicesLibraryNetherlands = Custom[GIS2BIM.GeoservicesLibraryNetherlands]()  # Library with multiple webadresses which can be used for WFS and WMS webrequests; unwired: BoundingBox
code_block = CodeBlock()
# ---------- code_block.designscript (8 lines) ----------
"http://geodata.nationaalgeoregister.nl/";
"brocpt/wfs?";
"&request=GetFeature";
"&VERSION=1.3.0";
"&typeName=brocpt:cpt";
"&bbox=";
"&format=json";
"&setCRS=urn:ogc:def:crs:EPSG::28992";
# ----------------------------------------
code_block_2 = CodeBlock { "Dordrecht"; "werf van schouten"; "501"; }
getLocationdataNetherlands = Custom[GIS2BIM.GetLocationdataNetherlands](City=code_block_2.out0, Streetname=code_block_2.out1, Housenumber=code_block_2.out2)  # Gives locationdata based on an adress in the Netherlands
code_block_3 = CodeBlock { 1000; }
createBoundingBox = Custom[GIS2BIM.CreateBoundingBox](CoordinateX=getLocationdataNetherlands.RDcoordinateX_meters_double, CoordinateY=getLocationdataNetherlands.RDcoordinateY_meters_double, BoxWidth=code_block_3, BoxHeight=code_block_3)  # create boundingboxstring for webrequests based on coördinates and dimensions
concat = String.Concat(code_block.out0, code_block.out1, code_block.out2, code_block.out3, code_block.out4, code_block.out5, createBoundingBox.Boxstring, code_block.out6, code_block.out7)
link_kadaster = CodeBlock()
# ---------- link_kadaster.designscript (11 lines) ----------
"http://geodata.nationaalgeoregister.nl/";
"brocpt/wms?";
"&request=GetMap";
"&VERSION=1.3.0";
"&STYLES=brocpt:bro_cpt";
"&layers=cpt";
"&bbox=";
"&width=2000";
"&height=2000";
"&format=image/png";
"&crs=EPSG:28992";
# ----------------------------------------
concat_2 = String.Concat(link_kadaster.out0, link_kadaster.out1, link_kadaster.out2, link_kadaster.out3, link_kadaster.out4, link_kadaster.out5, link_kadaster.out6, createBoundingBox.Boxstring, link_kadaster.out7, link_kadaster.out8, link_kadaster.out9, link_kadaster.out10)
openBrowser = Custom[GIS2BIM.OpenBrowser](url=concat_2)  # Opens a new window in your default browser with the given url.
link_kadaster_2 = CodeBlock()
# ---------- link_kadaster_2.designscript (6 lines) ----------
"http://services.rce.geovoorziening.nl/rce/wfs?";
"SERVICE=wfs";
"&VERSION=2.0.0";
"&request=GetFeature";
"&typeName=rce:NationalListedMonuments";
"&bbox=";
# ----------------------------------------
code_block_4 = CodeBlock { "28992"; "4258"; }
doubleToString = Custom[GIS2BIM.DoubleToString](CoordinateDouble=getLocationdataNetherlands.RDcoordinateX_meters_double)  # Converts a double to a string
doubleToString_2 = Custom[GIS2BIM.DoubleToString](CoordinateDouble=getLocationdataNetherlands.RDcoordinateY_meters_double)
transformCRS_epsg = Custom[GIS2BIM.TransformCRS_epsg](sourceCRS=code_block_4.out0, targetCRS=code_block_4.out1, xCoordinate=doubleToString, yCoordinate=doubleToString_2)  # Uses the API of http://epsg.io to transform Coordinate Reference Systems
code_block_5 = CodeBlock()
# ---------- code_block_5.designscript (6 lines) ----------
"http://geodata.nationaalgeoregister.nl/";
"brogmw/wfs?";
"&request=GetFeature";
"&VERSION=1.1.0";
"&typeName=brogmw:gmw";
"&bbox=";
# ----------------------------------------
concat_3 = String.Concat(code_block_5.out0, code_block_5.out1, code_block_5.out2, code_block_5.out3, code_block_5.out4, code_block_5.out5, createBoundingBox.Boxstring)
