# Dynamo graph CPython From IronPython.dyn (Dynamo 2.0.2.6826)

python_script_from_string = PythonStringNode()  # unwired: script, IN[0]
code_block = CodeBlock { "Python File as input"; }
python_script = Python(IN[0]=code_block)
# ---------- python_script.python (22 lines) ----------
import sys       
#ADD LIBRARIES OF IRON PYTHON 
sys.path.append(r'C:\Program Files (x86)\IronPython 2.7\Lib') 
 
#IMPORT SUBPROCESS TO RUN THE .PY AND RECEIVE OUTPUT DATA  
import subprocess 
from subprocess import Popen, PIPE 
 
#LINE TO SEND TO COMMAND PROMPT 
cmd = IN[0] 
 
#ADD LIST OF .PY FILE OUTPUTS 
out = [] 
 
#OPEN SUBPROCESS PIPE 
process = subprocess.Popen( cmd, stdout=subprocess.PIPE, stderr=subprocess.PIPE) 
for line in process.stdout: 
    out.append(line) 
process.wait() 

process.returncode 
OUT= out 
# ----------------------------------------
