# Dynamo graph DynaWeb Dynamo 1.3 - 4 - REST API example.dyn (Dynamo 1.3.2.2480)

# group: Input
string = StringInput("https://jsonplaceholder.typicode.com")
# note: The "users/1" endpoint is REST convention for
# - GET me the resource
# - that is part of USERS
# - and has ID=1
# Each REST API will obviously have its own specs, but this is the general approach taken by REST services.
string_2 = StringInput("users/1")
string_3 = StringInput("posts")
# note: TIP : change the resource for the client-based request to see the results update without having to mess with URLs.
# The REST API service used in these examples supports the following endpoints :
# /posts : 100 items
# /comments : 500 items
# /albums : 100 items
# /photos : 5000 items
# /todos : 200 items
# /users : 10 items
# This also affects the deserialisation at the end, so watch out for the consequences there.
# Also play with the resource ID to retrieve specific elements.
string_4 = StringInput("comments")
string_5 = StringInput("posts/3")
string_6 = StringInput("https://jsonplaceholder.typicode.com/users")
string_7 = StringInput("todos")
string_8 = StringInput("albums")
string_9 = StringInput("photos")

# group: Build WebClient
byUrl = DynaWeb.WebClient.ByUrl(string)

# group: Build WebRequest for use with client
byEndpoint = DynaWeb.WebRequest.ByEndpoint(string_2)

# group: Debug : the URL the client calls
# note: The WebClient.BuildUri node takes the base URL supplied to the client and the resource supplied to the WeRequest and combines them into the final URL that will be Executed.
# This node is useful as preview and checking mechanisms.
buildUri = DynaWeb.WebClient.BuildUri(byUrl, byEndpoint)
watch = Watch(buildUri)

# group: Execute request on WebClient
execute = DynaWeb.WebClient.Execute(byUrl, byEndpoint)

# group: Response
# note: In this example, we're retrieving
# a single "user" from the API.
content = DynaWeb.WebResponse.Content(execute)
watch_2 = Watch(content)

# group: Deserialise JSON to dictionary
# note: Use DeserialiseAsDictionary with workflows where both property name and value are required.
# A good example is deserialising the address, where both the label ("street", "city" etc) and the value ("Kulas Light" etc) would be useful when saving to Excel or generally using in formatted outputs.
# As you can notice from the example, this node is not recursive, so it will not deserialise child objects or JSON arrays. Use the Deserialise node above for that.
deserialiseAsDictionary = DynaWeb.Helpers.DeserialiseAsDictionary(watch_2)
watch_properties = Watch(deserialiseAsDictionary.out0)
watch_values = Watch(deserialiseAsDictionary.out1)
# note: Values can continue to be deserialised, such as the address in this example.
code_block = CodeBlock(json=watch_values) { json[4]; }
deserialiseAsDictionary_2 = DynaWeb.Helpers.DeserialiseAsDictionary(code_block)
# note: And then deserialising the lat/long further.
code_block_2 = CodeBlock(json=deserialiseAsDictionary_2.out1) { json[4]; }
deserialiseAsDictionary_3 = DynaWeb.Helpers.DeserialiseAsDictionary(code_block_2)
# note: Or you could use the Deserialise node to get all the values in one go instead of requiring multiple dictionary nodes, keeping the list structure.
deserialise = DynaWeb.Helpers.Deserialise(code_block)
watch_values_2 = Watch(deserialise)

string_10 = StringInput("users")

# group: Rebase the JSON on a specific node.
string_11 = StringInput("$.address")
selectJsonRoot = DynaWeb.Helpers.SelectJsonRoot(watch_2, string_11)
watch_3 = Watch(selectJsonRoot)
# note: What this does is effectively ignore anything that came before the "address" node, as well as anything that comes after and is not a direct child of this node.
# Tip: this field is dynamic, so no need to chain multiple SelectJsonRoot nodes, you can simply chain the objects using the dot notation :
# ex : $root.object.child1.child2
string_12 = StringInput("$.address.geo.lat")
selectJsonRoot_2 = DynaWeb.Helpers.SelectJsonRoot(watch_2, string_12)
watch_4 = Watch(selectJsonRoot_2)

# group: Deserialise address
deserialiseAsDictionary_4 = DynaWeb.Helpers.DeserialiseAsDictionary(watch_3)
watch_values_3 = Watch(deserialiseAsDictionary_4.out1)
watch_properties_2 = Watch(deserialiseAsDictionary_4.out0)

# group: Build & Execute simple request
byUrl_2 = DynaWeb.WebRequest.ByUrl(string_6)
execute_2 = DynaWeb.WebRequest.Execute(byUrl_2)

# group: Response
content_2 = DynaWeb.WebResponse.Content(execute_2)
watch_5 = Watch(content_2)

# group: Deserialise
# note: The Deserialise method is recursive, so it affects all levels of the JSON string, making it much more effective than deserialising to dictionary as below.
# In this example, we're deserialising a JSON array of "users" and all their properties in one go.
# However, you only ever get the values using this method, whereas certain workflows might also require the name of properties, not just the values.
# To get both, use the DeserialiseAsDictionary method below.
deserialise_2 = DynaWeb.Helpers.Deserialise(watch_5)
watch_values_4 = Watch(deserialise_2)

# group: alternative way to build WebRequest
# note: The 2 nodes below achieve the same result as the WebRequest.ByEndpoint node above.
byUrl_3 = DynaWeb.WebRequest.ByUrl(string)
setResource = DynaWeb.WebRequest.SetResource(byUrl_3, string_7)

# group: time it took to execute the request
# note: Tip : if the time reports 0, try reconnecting the WebRequest node to the input of this node and the value should update.
time = DynaWeb.WebResponse.Time(execute_2)

# group: time it took to execute the request
time_2 = DynaWeb.WebResponse.Time(execute)
