# Dynamo graph GIS2BIM_rivm.dyn (Dynamo 2.12.1.8246)
# packages: GIS2BIM for Dynamo 2.x 0.11.24, spring nodes 210.1.1

# group: Control
code_block = CodeBlock { mainserver = "https://data.rivm.nl/geo/"; server = "alo"; server2 = "dank"; }
GIS2BIM_GetSharedCoordinate = Custom[GIS2BIM_GetSharedCoordinate]()  # package GIS2BIM for Dynamo 2.x; Get the current shared coordinate
code_block_2 = CodeBlock { 5000; }
GIS2BIM_CreateBoundingBox = Custom[GIS2BIM_CreateBoundingBox](CoordinateX=GIS2BIM_GetSharedCoordinate.EastWest, CoordinateY=GIS2BIM_GetSharedCoordinate.NorthSouth, BoxWidth=code_block_2, BoxHeight=code_block_2)  # package GIS2BIM for Dynamo 2.x; create boundingboxstring for webrequests based on coördinates and dimensions

GIS2BIM_NetherlandsGeoservicesLibrary_RI = Custom[GIS2BIM_NetherlandsGeoservicesLibrary_RIVM](server=code_block.server, mainserver=code_block.mainserver, bbox=GIS2BIM_CreateBoundingBox.Boxstring)  # package GIS2BIM for Dynamo 2.x; download RIVM wms images

# group: Control
ꟿ_document_centralpath = Custom[ꟿ Document.CentralPath]()  # package spring nodes; If the document is workshared, the node returns the path to the central document as a string. Otherwise a null value will be returned.
directoryName = FileSystem.DirectoryName(path=ꟿ_document_centralpath)
string = StringInput("\GISDATA\")
code_block_3 = CodeBlock(path=directoryName, dir=string, name=GIS2BIM_NetherlandsGeoservicesLibrary_RI.style) { path+dir+name+".png"; }

# group: Control
GIS2BIM_WebrequestWMS = Custom[GIS2BIM_WebrequestWMS](WMSwebrequest=GIS2BIM_NetherlandsGeoservicesLibrary_RI.url)  # package GIS2BIM for Dynamo 2.x; a webrequest based on WMS-protocol
code_block_4 = CodeBlock { "c:/temp/test.png"; }
current = Document.Current()
activeView = Document.ActiveView(document=current)
GIS2BIM_ImageToFile = Custom[GIS2BIM_ImageToFile](ImageObject=GIS2BIM_WebrequestWMS, FileNamePath=code_block_3)  # package GIS2BIM for Dynamo 2.x; Write Image to file
GIS2BIM_ImportImageInView = Custom[GIS2BIM_ImportImageInView](ImageWidthMeters=code_block_2, view=activeView, ImagePath=GIS2BIM_ImageToFile)  # package GIS2BIM for Dynamo 2.x; Import rasterimage in view

watch_image = WatchImageCore(image=GIS2BIM_WebrequestWMS)
