# Dynamo graph LibTiff.net.dyn (Dynamo 1.3.4.6666)

code_block = CodeBlock { "C:/TEMP/test9.tiff"; }
code_block_2 = CodeBlock { "C:/TEMP/AHN/m5_65az2.tif"; }
code_block_3 = CodeBlock { "r"; }
open = BitMiracle.LibTiff.Classic.Tiff.Open(code_block_2, code_block_3)
code_block_4 = CodeBlock { 1; }
getTagListEntry = BitMiracle.LibTiff.Classic.Tiff.GetTagListEntry(open, code_block_4)
getField = BitMiracle.LibTiff.Classic.Tiff.GetField(open, getTagListEntry)
getTagListCount = BitMiracle.LibTiff.Classic.Tiff.GetTagListCount(open)
readDirectory = BitMiracle.LibTiff.Classic.Tiff.ReadDirectory(open)
tileSize = BitMiracle.LibTiff.Classic.Tiff.TileSize(open)
getMode = BitMiracle.LibTiff.Classic.Tiff.GetMode(open)
getStream = BitMiracle.LibTiff.Classic.Tiff.GetStream(open)
readBufferSetup = BitMiracle.LibTiff.Classic.Tiff.ReadBufferSetup()  # unwired: arg0, arg1, arg2
readScanline = BitMiracle.LibTiff.Classic.Tiff.ReadScanline(open)  # unwired: arg1, arg2
GEOTIFF_MODELPIXELSCALETAG = BitMiracle.LibTiff.Classic.TiffTag.GEOTIFF_MODELPIXELSCALETAG()
GEOTIFF_MODELTIEPOINTTAG = BitMiracle.LibTiff.Classic.TiffTag.GEOTIFF_MODELTIEPOINTTAG()
tiffTagMethods = BitMiracle.LibTiff.Classic.TiffTagMethods.TiffTagMethods()
GEOTIFF_MODELTRANSFORMATIONTAG = BitMiracle.LibTiff.Classic.TiffTag.GEOTIFF_MODELTRANSFORMATIONTAG()
getField_2 = BitMiracle.LibTiff.Classic.TiffTagMethods.GetField(tiffTagMethods, open, GEOTIFF_MODELTRANSFORMATIONTAG)
code_block_5 = CodeBlock { 1; 2; }
readScanline_2 = BitMiracle.LibTiff.Classic.Tiff.ReadScanline(open, code_block_5.out0, code_block_5.out1)
code_block_6 = CodeBlock { "boskoop"; "warmoeskade"; "2"; }
getLocationdataNetherlands = Custom[GIS2BIM.GetLocationdataNetherlands](City=code_block_6.out0, Streetname=code_block_6.out1, Housenumber=code_block_6.out2)  # Gives locationdata based on an adress in the Netherlands
code_block_7 = CodeBlock { 500; }
createBoundingBox = Custom[GIS2BIM.CreateBoundingBox](CoordinateX=getLocationdataNetherlands.RDcoordinateX_meters_double, CoordinateY=getLocationdataNetherlands.RDcoordinateY_meters_double, BoxWidth=code_block_7, BoxHeight=code_block_7)  # create boundingboxstring for webrequests based on coördinates and dimensions
code_block_8 = CodeBlock { "C:/TEMP/test4.tif"; }
numberOfStrips = BitMiracle.LibTiff.Classic.Tiff.NumberOfStrips(open)
stripSize = BitMiracle.LibTiff.Classic.Tiff.StripSize(open)
tileRowSize = BitMiracle.LibTiff.Classic.Tiff.TileRowSize(open)
IMAGEWIDTH = BitMiracle.LibTiff.Classic.TiffTag.IMAGEWIDTH()
getField_3 = BitMiracle.LibTiff.Classic.Tiff.GetField(open, IMAGEWIDTH)
IMAGELENGTH = BitMiracle.LibTiff.Classic.TiffTag.IMAGELENGTH()
getField_4 = BitMiracle.LibTiff.Classic.Tiff.GetField(open, IMAGELENGTH)
GEOTIFF_MODELPIXELSCALETAG_2 = BitMiracle.LibTiff.Classic.TiffTag.GEOTIFF_MODELPIXELSCALETAG()
getField_5 = BitMiracle.LibTiff.Classic.Tiff.GetField(open, GEOTIFF_MODELPIXELSCALETAG_2)
pixels = Image.Pixels()  # unwired: image, xSamples, ySamples
GEOTIFF_MODELTIEPOINTTAG_2 = BitMiracle.LibTiff.Classic.TiffTag.GEOTIFF_MODELTIEPOINTTAG()
getField_6 = BitMiracle.LibTiff.Classic.Tiff.GetField(open, GEOTIFF_MODELTIEPOINTTAG_2)
code_block_9 = CodeBlock(a=getField_6) { a[1]; }
python_script = Python(IN[0]=code_block_9)
# ---------- python_script.python (19 lines) ----------
import clr
clr.AddReference('ProtoGeometry')
clr.AddReference('System.Text.Encoding')
clr.AddReference('System.Runtime.Extensions')

from System.Text import Encoding
from System import BitConverter

from Autodesk.DesignScript.Geometry import *
#The inputs to this node will be stored as a list in the IN variables.
dataEnteringNode = IN

str= IN[0]

a = BitConverter.GetBytes(str)

#b = BitConverter.ToDouble(a,0)
#Assign your output to the OUT variable.
OUT = a
# ----------------------------------------
code_block_10 = CodeBlock()
# ---------- code_block_10.designscript (10 lines) ----------
"https://geodata.nationaalgeoregister.nl/ahn3/wcs?SERVICE=WCS";
"&VERSION=1.0.0";
"&REQUEST=GetCoverage";
"&FORMAT=image/tiff";
"&COVERAGE=ahn3_05m_dsm";
"&BBOX=";
"99198.4917734710033983,485588.33618855383247137,106915.96004800940863788,494366.81641667388612404";
"&CRS=EPSG:28992";
"&RESPONSE_CRS=EPSG:28992";
"&WIDTH=450&HEIGHT=512";
# ----------------------------------------
concat = String.Concat(code_block_10.out0, code_block_10.out1, code_block_10.out2, code_block_10.out3, code_block_10.out4, code_block_10.out5, code_block_10.out6, code_block_10.out7, code_block_10.out8, code_block_10.out9)
code_block_11 = CodeBlock()
# ---------- code_block_11.designscript (10 lines) ----------
"https://geodata.nationaalgeoregister.nl/ahn2/wcs?SERVICE=WCS";
"&VERSION=2.0.1";
"&REQUEST=GetCoverage";
"&FORMAT=image/tiff";
"&COVERAGE=ahn3_05m_dsm";
"&BBOX=";
"99198.4917734710033983,485588.33618855383247137,106915.96004800940863788,494366.81641667388612404";
"&CRS=EPSG:28992";
"&RESPONSE_CRS=EPSG:28992";
"&WIDTH=450&HEIGHT=512";
# ----------------------------------------
concat_2 = String.Concat(code_block_11.out0, code_block_11.out1, code_block_11.out2, code_block_11.out3, code_block_11.out4, code_block_11.out5, code_block_11.out6, code_block_11.out7, code_block_11.out8, code_block_11.out9)
code_block_12 = CodeBlock()
# ---------- code_block_12.designscript (1 lines) ----------
"https://geodata.nationaalgeoregister.nl/ahn3/wcs?SERVICE=WCS&VERSION=1.0.0&REQUEST=GetCoverage&FORMAT=GEOTIFF_FLOAT32&COVERAGE=ahn3_05m_dsm&BBOX=99198.4917734710033983,485588.33618855383247137,106915.96004800940863788,494366.81641667388612404&CRS=EPSG:28992&RESPONSE_CRS=EPSG:28992&WIDTH=450&HEIGHT=512";
# ----------------------------------------
code_block_13 = CodeBlock { "C:/TEMP/test9.tiff"; }
python_script_2 = Python(IN[0]=code_block_12, IN[1]=code_block_13)
# ---------- python_script_2.python (10 lines) ----------
import sys
sys.path.append("C:\Program Files (x86)\IronPython 2.7\Lib")
from System.Net import WebClient

url= IN[0]
filoc= IN[1]

WebClient().DownloadFile(url, filoc)

OUT= filoc
# ----------------------------------------
python_script_3 = Python(IN[0]=python_script_2)
# ---------- python_script_3.python (24 lines) ----------
import clr
clr.AddReference('gdal_csharp')
clr.AddReference('PresentationCore')
clr.AddReference('System.Drawing')
clr.AddReference('System.IO')

from System.Windows.Media.Imaging import TiffBitmapDecoder
from System.Windows.Media.Imaging import BitmapCreateOptions
from System.Windows.Media.Imaging import BitmapCacheOption
from System.Drawing import Image
from System.IO import *

Imagepath= IN[0]

ImageStreamSource = FileStream(Imagepath, FileMode.Open, FileAccess.Read, FileShare.Read)

Decoder = TiffBitmapDecoder(ImageStreamSource,BitmapCreateOptions.PreservePixelFormat, BitmapCacheOption.Default)

BMP = Decoder.Frames
BMP2 = BMP[0].Metadata
#Decoder.Frames


OUT = BMP, BMP2
# ----------------------------------------
code_block_14 = CodeBlock { "https://geodata.nationaalgeoregister.nl/ahn3/wcs?SERVICE=WCS&VERSION=1.0.0&REQUEST=GetCoverage&FORMAT=image/tiff&COVERAGE=ahn3_5m_dsm&BBOX=99198.4917734710033983,485588.33618855383247137,106915.96004800940863788,494366.81641667388612404&CRS=EPSG:28992&RESPONSE_CRS=EPSG:28992&WIDTH=450&HEIGHT=512"; }
code_block_15 = CodeBlock { "boskoop"; "warmoeskade"; "2"; }
getLocationdataNetherlands_2 = Custom[GIS2BIM.GetLocationdataNetherlands](City=code_block_15.out0, Streetname=code_block_15.out1, Housenumber=code_block_15.out2)
code_block_16 = CodeBlock { 200; 200; }
createBoundingBox_2 = Custom[GIS2BIM.CreateBoundingBox](CoordinateX=getLocationdataNetherlands_2.RDcoordinateX_meters_double, CoordinateY=getLocationdataNetherlands_2.RDcoordinateY_meters_double, BoxWidth=code_block_16.out0, BoxHeight=code_block_16.out0)
geoservicesLibraryNetherlands = Custom[GIS2BIM.GeoservicesLibraryNetherlands](BoundingBox=createBoundingBox_2.Boxstring)  # Library with multiple webadresses which can be used for WFS and WMS webrequests
downloadAHN = Custom[GIS2BIM.DownloadAHN](UrlwebrequestAHN2=geoservicesLibraryNetherlands.11_AHN2_webrequest_bladindex_OGC_WFS, UrlwebrequestAHN3=geoservicesLibraryNetherlands.AHN3_webrequest_bladindex_OGC_WFS)  # get the mapnumber(s) of the AHN based on a given boundingbox
code_block_17 = CodeBlock()
# ---------- code_block_17.designscript (1 lines) ----------
"https://geodata.nationaalgeoregister.nl/ahn2/wcs?service=wcs&version=2.0.1&request=GetCoverage&CoverageId=ahn2_05m_ruw&subsettingcrs=http://www.opengis.net/def/crs/EPSG/0/3857&subset=x(541606.5072,542466.4238)&subset=y(6863335.7088,6864558.7013)&scale=30&format=geotiff_float32&scalesize=x(2000),y(2000)";
# ----------------------------------------
tileSize_2 = BitMiracle.LibTiff.Classic.Tiff.TileSize(open)
code_block_18 = CodeBlock { 0; }
code_block_19 = CodeBlock { 56.25; 56.25; }
readTile = BitMiracle.LibTiff.Classic.Tiff.ReadTile(open, tileSize_2, code_block_18, code_block_19.out0, code_block_19.out1, code_block_18, code_block_18)
BYTE = BitMiracle.LibTiff.Classic.TiffType.BYTE()
code_block_20 = CodeBlock { 255; }
TILEWIDTH = BitMiracle.LibTiff.Classic.TiffTag.TILEWIDTH()
getField_7 = BitMiracle.LibTiff.Classic.Tiff.GetField(open, TILEWIDTH)
code_block_21 = CodeBlock { 7200/128; }
TILELENGTH = BitMiracle.LibTiff.Classic.TiffTag.TILELENGTH()
getField_8 = BitMiracle.LibTiff.Classic.Tiff.GetField(open, TILELENGTH)
code_block_22 = CodeBlock { 0; }
code_block_23 = CodeBlock { 255; }
code_block_24 = CodeBlock { 0; 3; }
readRawTile = BitMiracle.LibTiff.Classic.Tiff.ReadRawTile(open, code_block_22, code_block_23, code_block_24.out0, code_block_24.out1)
code_block_25 = CodeBlock { "https://geodata.nationaalgeoregister.nl/ahn3/wcs?SERVICE=WCS&VERSION=1.0.0&REQUEST=GetCoverage&FORMAT=GEOTIFF_FLOAT32&COVERAGE=ahn3_05m_dsm&BBOX=104709.5,490176.5,104726.5,490200.5&CRS=EPSG:28992&RESPONSE_CRS=EPSG:28992&WIDTH=34&HEIGHT=48"; }
GDT_Float32 = OSGeo.GDAL.DataType.GDT_Float32()
