# Dynamo graph TiffBitmapDecoder GDAL Libtiff.dyn (Dynamo 1.3.4.6666)

boolean = BoolSelector(true)
python_script = Python(IN[0]=boolean)
# ---------- python_script.python (34 lines) ----------
import clr
clr.AddReference('gdal_csharp')

from OSGeo.GDAL import Gdal
from System import Environment
from System.IO import Path

#The inputs to this node will be stored as a list in the IN variables.
dataEnteringNode = IN

gdalPath = "C:\\temp_folder\\new\\GDAL.NET.Core.2.3.1\\gdal"
nativePath = gdalPath + "\\x64"

path = Environment.GetEnvironmentVariable("PATH")
path = nativePath + ";" + Path.Combine(nativePath, "plugins") + ";" + path
Environment.SetEnvironmentVariable("PATH", path)

gdalData = Path.Combine(gdalPath, "data")
Environment.SetEnvironmentVariable("GDAL_DATA", gdalData)
Gdal.SetConfigOption("GDAL_DATA", gdalData)

driverPath = Path.Combine(nativePath, "plugins");
Environment.SetEnvironmentVariable("GDAL_DRIVER_PATH", driverPath)
Gdal.SetConfigOption("GDAL_DRIVER_PATH", driverPath)

Environment.SetEnvironmentVariable("GEOTIFF_CSV", gdalData)
Gdal.SetConfigOption("GEOTIFF_CSV", gdalData)

projSharePath = Path.Combine(gdalPath, "share")
Environment.SetEnvironmentVariable("PROJ_LIB", projSharePath)
Gdal.SetConfigOption("PROJ_LIB", projSharePath)

#Assign your output to the OUT variable.
OUT = Gdal.VersionInfo("")
# ----------------------------------------
watch = Watch(python_script)
code_block = CodeBlock { "C:/TEMP/test.tiff"; }
code_block_2 = CodeBlock { "C:/TEMP/test2.geotiff"; }
code_block_3 = CodeBlock { "C:/TEMP/test3.tif"; }
code_block_4 = CodeBlock { "https://geodata.nationaalgeoregister.nl/ahn3/wcs?SERVICE=WCS&VERSION=1.0.0&REQUEST=GetCoverage&FORMAT=image/tiff&COVERAGE=ahn3_5m_dsm&BBOX=99198.4917734710033983,485588.33618855383247137,106915.96004800940863788,494366.81641667388612404&CRS=EPSG:28992&RESPONSE_CRS=EPSG:28992&WIDTH=450&HEIGHT=512"; }
code_block_5 = CodeBlock { "C:/TEMP/test6.tiff"; }
python_script_2 = Python(IN[0]=code_block_4, IN[1]=code_block_5)
# ---------- python_script_2.python (10 lines) ----------
import sys
sys.path.append("C:\Program Files (x86)\IronPython 2.7\Lib")
from System.Net import WebClient

url= IN[0]
filoc= IN[1]

WebClient().DownloadFile(url, filoc)

OUT= filoc
# ----------------------------------------
python_script_3 = Python(IN[0]=python_script_2)
# ---------- python_script_3.python (24 lines) ----------
import clr
clr.AddReference('gdal_csharp')
clr.AddReference('PresentationCore')
clr.AddReference('System.Drawing')
clr.AddReference('System.IO')

from System.Windows.Media.Imaging import TiffBitmapDecoder
from System.Windows.Media.Imaging import BitmapCreateOptions
from System.Windows.Media.Imaging import BitmapCacheOption
from System.Drawing import Image
from System.IO import *

Imagepath= IN[0]

ImageStreamSource = FileStream(Imagepath, FileMode.Open, FileAccess.Read, FileShare.Read)

Decoder = TiffBitmapDecoder(ImageStreamSource,BitmapCreateOptions.PreservePixelFormat, BitmapCacheOption.Default)

BMP = Decoder.Frames
BMP2 = BMP[0].Metadata
#Decoder.Frames


OUT = BMP, BMP2
# ----------------------------------------
code_block_6 = CodeBlock { "C:/TEMP/cea.tif"; }
GA_ReadOnly = OSGeo.GDAL.Access.GA_ReadOnly()
open = OSGeo.GDAL.Gdal.Open(code_block_6, GA_ReadOnly)
code_block_7 = CodeBlock { "boskoop"; "warmoeskade"; "2"; }
getLocationdataNetherlands = Custom[GIS2BIM.GetLocationdataNetherlands](City=code_block_7.out0, Streetname=code_block_7.out1, Housenumber=code_block_7.out2)  # Gives locationdata based on an adress in the Netherlands
code_block_8 = CodeBlock { 200; 200; }
createBoundingBox = Custom[GIS2BIM.CreateBoundingBox](CoordinateX=getLocationdataNetherlands.RDcoordinateX_meters_double, CoordinateY=getLocationdataNetherlands.RDcoordinateY_meters_double, BoxWidth=code_block_8.out0, BoxHeight=code_block_8.out0)  # create boundingboxstring for webrequests based on coördinates and dimensions
geoservicesLibraryNetherlands = Custom[GIS2BIM.GeoservicesLibraryNetherlands](BoundingBox=createBoundingBox.Boxstring)  # Library with multiple webadresses which can be used for WFS and WMS webrequests
downloadAHN = Custom[GIS2BIM.DownloadAHN](UrlwebrequestAHN2=geoservicesLibraryNetherlands.11_AHN2_webrequest_bladindex_OGC_WFS, UrlwebrequestAHN3=geoservicesLibraryNetherlands.AHN3_webrequest_bladindex_OGC_WFS)  # get the mapnumber(s) of the AHN based on a given boundingbox
code_block_9 = CodeBlock()
# ---------- code_block_9.designscript (10 lines) ----------
"https://geodata.nationaalgeoregister.nl/ahn3/wcs?SERVICE=WCS";
"&VERSION=1.0.0";
"&REQUEST=GetCoverage";
"&FORMAT=image/tiff";
"&COVERAGE=ahn3_05m_dsm";
"&BBOX=";
"99198.4917734710033983,485588.33618855383247137,106915.96004800940863788,494366.81641667388612404";
"&CRS=EPSG:28992";
"&RESPONSE_CRS=EPSG:28992";
"&WIDTH=450&HEIGHT=512";
# ----------------------------------------
concat = String.Concat(code_block_9.out0, code_block_9.out1, code_block_9.out2, code_block_9.out3, code_block_9.out4, code_block_9.out5, code_block_9.out6, code_block_9.out7, code_block_9.out8, code_block_9.out9)
code_block_10 = CodeBlock()  # same code as code_block_9
concat_2 = String.Concat(code_block_10.out0, code_block_10.out1, code_block_10.out2, code_block_10.out3, code_block_10.out4, code_block_10.out5, code_block_10.out6, code_block_10.out7, code_block_10.out8, code_block_10.out9)
