# Dynamo graph gdal.dyn (Dynamo 2.1.0.7500)

transformGeolocations = OSGeo.GDAL.Transformer.TransformGeolocations()  # unwired: transformer, xBand, yBand, zBand, callback, callback_data, options
GDT_Byte = OSGeo.GDAL.DataType.GDT_Byte()
driver = OSGeo.GDAL.Driver.Driver()  # unwired: cPtr, cMemoryOwn, parent
create = OSGeo.GDAL.Driver.Create(driver=driver)  # unwired: utf8_path, xsize, ysize, bands, eType, options
GCPPixel = OSGeo.GDAL.GCP.GCPPixel()  # unwired: gCP
getCPtrAndSetReference = OSGeo.GDAL.GCP.getCPtrAndSetReference()  # unwired: obj, parent
code_block = CodeBlock { "C:/TEMP/cea.tif"; }
GA_ReadOnly = OSGeo.GDAL.Access.GA_ReadOnly()
open = OSGeo.GDAL.Gdal.Open(utf8_path=code_block, eAccess=GA_ReadOnly)
link_kadaster = CodeBlock()
# ---------- link_kadaster.designscript (11 lines) ----------
"http://geodata.nationaalgeoregister.nl/";
"ahn3/wms?";
"&request=GetMap";
"&VERSION=1.3.0";
"&STYLES=default";
"&bbox=";
"&width=3000";
"&height=3000";
"&format=image/GeoTIFF";
"&crs=EPSG:28992";
"&layers=ahn3_05m_dsm";
# ----------------------------------------
code_block_2 = CodeBlock { "Gouda"; "gouderaksedijk"; "58"; }
getLocationdataNetherlands = Custom[GIS2BIM.GetLocationdataNetherlands](City=code_block_2.out0, Streetname=code_block_2.out1, Housenumber=code_block_2.out2)  # Gives locationdata based on an adress in the Netherlands
code_block_3 = CodeBlock { 300; }
createBoundingBox = Custom[GIS2BIM.CreateBoundingBox](CoordinateX=getLocationdataNetherlands.RDcoordinateX_meters_double, CoordinateY=getLocationdataNetherlands.RDcoordinateY_meters_double, BoxWidth=code_block_3, BoxHeight=code_block_3)  # create boundingboxstring for webrequests based on coördinates and dimensions
concat = String.Concat(string0=link_kadaster.out0, string1=link_kadaster.out1, string2=link_kadaster.out2, string3=link_kadaster.out3, string4=link_kadaster.out4, string5=link_kadaster.out5, string6=createBoundingBox.Boxstring, string7=link_kadaster.out6, string8=link_kadaster.out7, string9=link_kadaster.out8, string10=link_kadaster.out9, string11=link_kadaster.out10)
webrequestWMS2 = Custom[GIS2BIM.WebrequestWMS2](WMSwebrequest=concat)  # a webrequest based on WMS-protocol
watch_image = WatchImageCore(image=webrequestWMS2)
systemDrawingBitmapToJPG = Custom[GIS2BIM.SystemDrawingBitmapToJPG](SystemDrawingBitmap=webrequestWMS2)  # frozen; Save an System.Drawing.Bitmap object as a jpg-file; unwired: FileName
getProjection = OSGeo.GDAL.Dataset.GetProjection()  # unwired: dataset
boolean = BoolSelector(true)
GOA2GetAccessToken = OSGeo.GDAL.Gdal.GOA2GetAccessToken()  # unwired: pszRefreshToken, pszScope
code_block_4 = CodeBlock { "C:/TEMP/cea.tif"; }
