# Dynamo graph ImportImageInView Version 2.dyn (Dynamo 1.3.3.4111)

firstItem = List.FirstItem()  # unwired: arg0
lastItem = List.LastItem()  # unwired: arg0

# group: SET IMAGE WIDTH
string = StringInput("\")
split = String.Split(firstItem, string)
lastItem_2 = List.LastItem(split)
setImageWidth = Custom[GIS2BIM.SetImageWidth](Imagename=lastItem_2, Imagewidth=lastItem)  # set width of imported raster image

code_block = CodeBlock { 200; }
current = Document.Current()
activeView = Document.ActiveView(current)
code_block_2 = CodeBlock { "C:/TEMP/test2.jpg"; }
code_block_3 = CodeBlock { 0; }
resolution = CodeBlock { 100; }
boolean = BoolSelector(true)
python_script = Python(IN[0]=code_block, IN[1]=activeView, IN[2]=code_block_2, IN[3]=code_block_3, IN[4]=code_block_3, IN[5]=resolution, IN[6]=boolean)
# ---------- python_script.python (88 lines) ----------
# Main part used from Konrad K Sobon

import clr
clr.AddReference('ProtoGeometry')
from Autodesk.DesignScript.Geometry import *
#The inputs to this node will be stored as a list in the IN variables.

clr.AddReference("RevitServices")
import RevitServices
from RevitServices.Persistence import DocumentManager
from RevitServices.Transactions import TransactionManager

clr.AddReference("RevitAPI")
import Autodesk 
from Autodesk.Revit.DB import * 
import System

# Import Element wrapper extension methods
clr.AddReference("RevitNodes")
import Revit
clr.ImportExtensions(Revit.Elements)

# Import geometry conversion extension methods
clr.ImportExtensions(Revit.GeometryConversion)

# Import DocumentManager and TransactionManager
clr.AddReference("RevitServices")
import RevitServices
from RevitServices.Persistence import DocumentManager
from RevitServices.Transactions import TransactionManager

doc = DocumentManager.Instance.CurrentDBDocument
uiapp = DocumentManager.Instance.CurrentUIApplication
app = uiapp.Application

dataEnteringNode = IN

ImageWidthM=IN[0]
view=UnwrapElement(IN[1])
filePath=IN[2]
deltax=IN[3]
deltay=IN[4]
res = IN[5]
RunIt = IN[6]

ImagePixels = 3000

res = 10000/((ImageWidthM*1000)/((25.4*ImagePixels)/100))
placement=System.Enum.GetValues(BoxPlacement)[0]

x = deltax/304.8
y = deltay/304.8
refPt = XYZ(x,y,0)

#Set Image Import Options

iio= ImageImportOptions()
	
message = None
if placement != None:
	iio.Placement = placement
if refPt !=None:
	iio.RefPoint = refPt
else: 
	message = "Please specify placement point."
if res !=None:
	iio.Resolution = res
else:
	iio.Resolution = 72
	

if RunIt:
	# Start Transaction
	doc = DocumentManager.Instance.CurrentDBDocument
	TransactionManager.Instance.EnsureInTransaction(doc)

	newElement = clr.StrongBox[Element]()
	elementOut = doc.Import(file = filePath, options = iio, view = view, element = newElement)
	
	#End Transaction
	TransactionManager.Instance.TransactionTaskDone()
	message = "Succes"
else: 
	message = "Set Runit to true"

newElement = UnwrapElement(newElement)

OUT = iio,message, Element, res
# ----------------------------------------
code_block_4 = CodeBlock { "Dordrecht"; "werf van schouten"; "503"; }
getLocationdataNetherlands = Custom[GIS2BIM.GetLocationdataNetherlands](City=code_block_4.out0, Streetname=code_block_4.out1, Housenumber=code_block_4.out2)  # Gives locationdata based on an adress in the Netherlands
createBoundingBox = Custom[GIS2BIM.CreateBoundingBox](CoordinateX=getLocationdataNetherlands.RDcoordinateX_meters_double, CoordinateY=getLocationdataNetherlands.RDcoordinateY_meters_double, BoxWidth=code_block, BoxHeight=code_block)  # create boundingboxstring for webrequests based on coördinates and dimensions
geoservicesLibraryNetherlands = Custom[GIS2BIM.GeoservicesLibraryNetherlands](BoundingBox=createBoundingBox.Boxstring)  # Library with multiple webadresses which can be used for WFS and WMS webrequests
webrequestWMS2 = Custom[GIS2BIM.WebrequestWMS2](WMSwebrequest=geoservicesLibraryNetherlands.Luchtfoto_2017_OGC_WMS)  # a webrequest based on WMS-protocol
watch_image = WatchImageCore(webrequestWMS2)
code_block_5 = CodeBlock { "C:/TEMP/test2.jpg"; }
systemDrawingBitmapToJPG = Custom[GIS2BIM.SystemDrawingBitmapToJPG](SystemDrawingBitmap=watch_image, FileName=code_block_5)  # Save an System.Drawing.Bitmap object as a jpg-file
importImageInView = Custom[GIS2BIM.ImportImageInView]()  # Import rasterimage in view; unwired: ImageWidthMeters, View, ImagePath
code_block_6 = CodeBlock { (3000*200)/304; }
code_block_7 = CodeBlock { 38100; }
code_block_8 = CodeBlock()
# ---------- code_block_8.designscript (2 lines) ----------
ImagePixels = 2000
res = ((ImageWidthM*1000)/25.4)*(ImagePixels/100);
# ----------------------------------------
code_block_9 = CodeBlock { ((250*1000)/25.4)/(2000/100); }
code_block_10 = CodeBlock()
# ---------- code_block_10.designscript (6 lines) ----------
2000 pixels
200 res
200 meter

wordt 25.4 meter;
200/25.4;
# ----------------------------------------
code_block_11 = CodeBlock()
# ---------- code_block_11.designscript (5 lines) ----------
3000 pixels
200 res
200 meter

wordt 38.1 meter;
# ----------------------------------------
code_block_12 = CodeBlock { 200/25.4; }
code_block_13 = CodeBlock { 200/38.1; }
code_block_14 = CodeBlock { 2000/25.4; }
code_block_15 = CodeBlock()
# ---------- code_block_15.designscript (5 lines) ----------
3000 pixels
100 res
200 meter

wordt 76.2 meter;
# ----------------------------------------
code_block_16 = CodeBlock { 10000/(200000/((25.4*3000)/100)); }
code_block_17 = CodeBlock { 200/76.2; 200*0.381; }
