# Dynamo custom node FilePaths.dyf (Dynamo 2.16.2.5624)
# category: KC
# Gets the filepaths from the model.

path = Python()  # "Doc.Path"; CPython3; unwired: IN[0]
# ---------- path.python (35 lines) ----------
import clr

clr.AddReference('RevitServices')
from RevitServices.Persistence import DocumentManager
doc = DocumentManager.Instance.CurrentDBDocument

from System.IO import Directory
import os

clr.AddReference('RevitAPI')
from Autodesk.Revit.DB import *

KLICfiles  = []
files = []

if doc.IsWorkshared:
	cp = doc.GetWorksharingCentralModelPath()
	fileName= ModelPathUtils.ConvertModelPathToUserVisiblePath(cp)
else:
    fileName = doc.PathName
    
DirName = os.path.dirname(fileName)
GisdataPath = os.path.join(DirName, "GISDATA") 
ImagePath  = os.path.join(GisdataPath, "images")
osmPath  = os.path.join(GisdataPath, "OSM")

for r, d, f in os.walk(DirName):
    for file in f:
    #       files.append(os.path.join(r, file))
        if "ligging" in file:
            print(file)
            KLICfiles.append(os.path.join(r, file))
      
    
OUT = fileName, DirName, GisdataPath, ImagePath, KLICfiles,osmPath
# ----------------------------------------
code_block = CodeBlock(l=path) { l[0]; l[1]; l[2]; l[3]; l[4]; l[5]; }
n01_central_modelpath = Output(code_block.out0)  # "01 (central)modelpath"
n02_central_modeldir = Output(code_block.out1)  # "02 (central)modeldir"
n03_gisdatadir = Output(code_block.out2)  # "03 gisdatadir"
n04_imagedir = Output(code_block.out3)  # "04 imagedir"
n05_KLICfiles = Output(code_block.out4)  # "05 KLICfiles"
n06_OSMfiles = Output(code_block.out5)  # "06 OSMfiles"
