# Dynamo custom node FilledRegion_ByCurves.dyf "ByCurves" (Dynamo 2.12.1.8246)
# category: KC.FilledRegion
# Create a Filled Region using a list of boundary curves.

FilledRegionTypeID = Input(FilledRegionTypeID: int)
ViewID = Input(ViewID: int)
Curvelines = Input(Curvelines: Autodesk.DesignScript.Geometry.Curve)
python_script = Python(IN[0]=FilledRegionTypeID, IN[1]=ViewID, IN[2]=Curvelines)  # IronPython2
# ---------- python_script.python (34 lines) ----------
import clr

clr.AddReference('RevitAPI')
from Autodesk.Revit.DB import *
import System.Collections.Generic
from System.Collections.Generic import List

clr.AddReference('RevitNodes')
import Revit
clr.ImportExtensions(Revit.GeometryConversion)

clr.AddReference('RevitServices')
from RevitServices.Transactions import TransactionManager
from RevitServices.Persistence import DocumentManager

doc = DocumentManager.Instance.CurrentDBDocument

filledType = ElementId(IN[0])
viewId = ElementId(IN[1])
boundaries = IN[2]
boundariesLoop = List[CurveLoop]()

for i in boundaries:
	curves = List[Curve]()
	for x in i:
		curves.Add(x.ToRevitType())
		
	boundariesLoop.Add(CurveLoop.Create(curves))

TransactionManager.Instance.EnsureInTransaction(doc)
filled = FilledRegion.Create(doc, filledType, viewId, boundariesLoop)
TransactionManager.Instance.TransactionTaskDone()

OUT = filled
# ----------------------------------------
filledregions = Output(python_script)
