# Dynamo custom node FilterElements.dyf (Dynamo 2.3.0.5885)
# category: KC
# Filter Elements with by parameter and value.

elementlist = Input(elementlist: var[]..[])
string_from_object = FromObject(obj=elementlist)
parametername = Input(parametername: var[]..[])
filter = Input(filter: var[]..[])
code_block = CodeBlock(aElements=string_from_object, sParameter=parametername, sFilter=filter)
# ---------- code_block.designscript (7 lines) ----------
aParameterlist = Elements.Element.GetParameterValueByName(aElements, sParameter);
aBoolmask = String.Contains(aParameterlist, sFilter, true);
aElementsSorted = List.FilterByBoolMask(aElements, aBoolmask);
aElementsIn = DesignScript.Dictionary.ValueAtKey(aElementsSorted, "in");
aElementsInParameterValues = Elements.Element.GetParameterValueByName(aElementsIn, sParameter);
aElementsOut = DesignScript.Dictionary.ValueAtKey(aElementsSorted, "out");
aElementsOutParameterValues = Elements.Element.GetParameterValueByName(aElementsOut, sParameter);
# ----------------------------------------
In = Output(code_block.aElementsIn)
Out = Output(code_block.aElementsOut)
watch = Watch(code_block.aElementsSorted)
InValues = Output(code_block.aElementsInParameterValues)
OutValues = Output(code_block.aElementsOutParameterValues)
input = Output(string_from_object)
