# Dynamo custom node GIS2BIM.GeoservicesLibraryNetherland.dyf "GIS2BIM.GeoservicesLibraryNetherlands_MLA" (Dynamo 2.16.2.5624)
# category: KC
# GeoservicesLibraryNetherlands_MLA

BoundingBoxEPSG28992 = Input(BoundingBoxEPSG28992: var[]..[])

# group: ruimtelijke plannen
link_kadaster = CodeBlock()
# ---------- link_kadaster.designscript (13 lines) ----------
//https://service.pdok.nl/kadaster/plu/wms/v1_0?request=getcapabilities&service=wms
"https://service.pdok.nl/kadaster/plu/wms/v1_0?request=GetMap&service=wms&version=1.3.0";
"&STYLES=enkelbestemming";
"&layers=enkelbestemming";
"&width=3000&height=3000&format=image/png&crs=EPSG:28992";
"&bbox=";

"&STYLES=dubbelbestemming";
"&layers=dubbelbestemming";

//view
"gis2bim_ruimtelijkeplannen_enkelbestemming";
"gis2bim_ruimtelijkeplannen_dubbelbestemming";
# ----------------------------------------
concat = String.Concat(string0=link_kadaster.out0, string1=link_kadaster.out1, string2=link_kadaster.out2, string3=link_kadaster.out3, string4=link_kadaster.out4, string5=BoundingBoxEPSG28992)
concat_2 = String.Concat(string0=link_kadaster.out0, string1=link_kadaster.out5, string2=link_kadaster.out6, string3=link_kadaster.out3, string4=link_kadaster.out4, string5=BoundingBoxEPSG28992)

list_create = List.Create(item0=concat, item1=concat_2)
n70_bestemmingsplan_enkelbestemming_OGC_W = Output(list_create)  # "70 bestemmingsplan enkelbestemming(OGC WMS)"

# group: Annotation
link_kadaster_2 = CodeBlock(coords=BoundingBoxEPSG28992)
# ---------- link_kadaster_2.designscript (11 lines) ----------
//default links
link = "http://geodata.nationaalgeoregister.nl/";
service = "kadastralekaart/wfs/v4_0?service=WFS&version=2.0.0";
request = "&request=GetFeature";
totallink = link + service +request;
bbox = "&bbox=" + coords;
// totalrequestlink
totallink + "&typeName=kadastralekaartv4:nummeraanduidingreeks" + bbox;
totallink + "&typeName=kadastralekaartv4:openbareruimtenaam" + bbox;
totallink + "&typeName=perceel" + bbox;
totallink + "&typeName=kadastralegrens" + bbox;
# ----------------------------------------

# group: bag pand
code_block = CodeBlock()
# ---------- code_block.designscript (5 lines) ----------
"https://service.pdok.nl/lv/bag/wfs/v2_0?";
"service=wfs&version=2.0.0";
"&request=GetFeature&typeName=";
"bag:pand";
"&bbox=";
# ----------------------------------------
concat_3 = String.Concat(string0=code_block.out0, string1=code_block.out1, string2=code_block.out2, string3=code_block.out3, string4=code_block.out4, string5=BoundingBoxEPSG28992)

list_create_2 = List.Create(item0=link_kadaster_2.out5, item1=link_kadaster_2.out6, item2=link_kadaster_2.out7, item3=link_kadaster_2.out8, item4=concat_3)
n00_kadaster_en_BAG_list_OGC_WFS = Output(list_create_2)  # "00 kadaster en BAG list(OGC WFS)"

# group: Annotation
link_kadaster_3 = CodeBlock { "https://data.3dbag.nl/api/BAG3D/"; "wfs?&request=GetFeature"; "&typeName=BAG3D:Tiles"; "&bbox="; }
concat_4 = String.Concat(string0=link_kadaster_3.out0, string1=link_kadaster_3.out1, string2=link_kadaster_3.out2, string3=link_kadaster_3.out3, string4=BoundingBoxEPSG28992)

n90_BAG3D_tiles_WFS = Output(concat_4)  # "90 BAG3D tiles (WFS)"

# group: 00 luchtfoto
link_kadaster_4 = CodeBlock()
# ---------- link_kadaster_4.designscript (8 lines) ----------
"https://service.pdok.nl/hwh/luchtfotorgb/";
"wmts/v1_0?&request=GetMap&VERSION=1.3.0";
"&STYLES=&layers=Actueel_orthoHR";
"&width=2000&height=2000&format=image/png&crs=EPSG:28992";
"&bbox=";

//view
"gis2bim_luchtfoto";
# ----------------------------------------
concat_5 = String.Concat(string0=link_kadaster_4.out0, string1=link_kadaster_4.out1, string2=link_kadaster_4.out2, string3=link_kadaster_4.out3, string4=link_kadaster_4.out4, string5=BoundingBoxEPSG28992)

# group: 01 dijkbeschermingszones
link_kadaster_5 = CodeBlock()
# ---------- link_kadaster_5.designscript (9 lines) ----------
"https://service.pdok.nl/hwh/keringenimwa/wms/v1_0?service=wms&";
"&request=GetMap&VERSION=1.3.0";
"&STYLES=default";
"&layers=beschermingszone";
"&width=4000&height=4000&format=image/png&crs=EPSG:28992";
"&bbox=";

//view
"gis2bim_dijkbeschermingszone";
# ----------------------------------------
concat_6 = String.Concat(string0=link_kadaster_5.out0, string1=link_kadaster_5.out1, string2=link_kadaster_5.out2, string3=link_kadaster_5.out3, string4=link_kadaster_5.out4, string5=link_kadaster_5.out5, string6=BoundingBoxEPSG28992)

# group: geurhinder openhaarden
link_kadaster_6 = CodeBlock()
# ---------- link_kadaster_6.designscript (16 lines) ----------
"http://data.rivm.nl/";
"geo/alo/wms?";
"&request=GetMap";
"&VERSION=1.3.0";
"&STYLES=rivm_20180905_geurhinder";
"&layers=rivm_20180905_v_geurhinder_open_haarden";
"&bbox=";
"&width=2000";
"&height=2000";
"&format=image/png";
"&crs=EPSG:28992";

//https://data.rivm.nl/geo/alo/wms?request=GetCapabilities

//view
"gis2bim_geurhinder_openhaarden";
# ----------------------------------------
concat_7 = String.Concat(string0=link_kadaster_6.out0, string1=link_kadaster_6.out1, string2=link_kadaster_6.out2, string3=link_kadaster_6.out3, string4=link_kadaster_6.out4, string5=link_kadaster_6.out5, string6=link_kadaster_6.out6, string7=BoundingBoxEPSG28992, string8=link_kadaster_6.out7, string9=link_kadaster_6.out8, string10=link_kadaster_6.out9, string11=link_kadaster_6.out10)

# group: 05 natura 2000
link_kadaster_7 = CodeBlock()
# ---------- link_kadaster_7.designscript (8 lines) ----------
"https://service.pdok.nl/rvo/";
"natura2000/wms/v1_0?request=GetMap&service=wms&VERSION=1.3.0";
"&STYLES=natura2000:lnv_natura2000&layers=natura2000";
"&width=4000&height=4000&format=image/png&crs=EPSG:28992";
"&bbox=";

//view
"gis2bim_natura2000";
# ----------------------------------------
concat_8 = String.Concat(string0=link_kadaster_7.out0, string1=link_kadaster_7.out1, string2=link_kadaster_7.out2, string3=link_kadaster_7.out3, string4=link_kadaster_7.out4, string5=BoundingBoxEPSG28992)

# group: grondwater / waterwin
link_kadaster_8 = CodeBlock()
# ---------- link_kadaster_8.designscript (8 lines) ----------
"https://service.pdok.nl/provincies/grondwaterbeschermingsgebieden/wms/v1_0?request=getmap&service=wms";
"&STYLES=AM.DrinkingWaterProtectionArea";
"&layers=AM.DrinkingWaterProtectionArea.Default";
"&width=2000&height=2000&format=image/png&crs=EPSG:28992";
"&bbox=";

//view
"gis2bim_waterwin";
# ----------------------------------------
concat_9 = String.Concat(string0=link_kadaster_8.out0, string1=link_kadaster_8.out1, string2=link_kadaster_8.out2, string3=link_kadaster_8.out3, string4=link_kadaster_8.out4, string5=BoundingBoxEPSG28992)

# group: luchtvervuiling
# note: RIVM:
# https://data.rivm.nl/geo/alo/wms?request=GetCapabilities
# https://data.rivm.nl/geo/dank/wms?request=GetCapabilities
link_kadaster_9 = CodeBlock()
# ---------- link_kadaster_9.designscript (20 lines) ----------
"https://data.rivm.nl/geo/alo/wms?&request=GetMap&VERSION=1.3.0&bbox=";
"&width=2000&height=2000&format=image/png&crs=EPSG:28992";
//fijnstof pm2,5
"&STYLES=rivm_nsl_20220101_gm_PM252020_Int";
"&LAYERS=rivm_nsl_20220101_gm_PM252020_Int";
//fijnstof pm10
"&STYLES=rivm_nsl_20220101_gm_PM102020_Int";
"&LAYERS=rivm_nsl_20220101_gm_PM102020_Int";
//stikstof
"&STYLES=rivm_nsl_20220101_gm_NO22020_Int";
"&LAYERS=rivm_nsl_20220101_gm_NO22020_Int";
//roet (EC)
"&STYLES=rivm_nsl_20220101_gm_EC2020";
"&LAYERS=rivm_nsl_20220101_gm_EC2020";

//view
"gis2bim_luchtvervuiling_pm25";
"gis2bim_luchtvervuiling_pm10";
"gis2bim_luchtvervuiling_stikstof";
"gis2bim_luchtvervuiling_roet";
# ----------------------------------------
code_block_2 = CodeBlock(bbox=BoundingBoxEPSG28992) { bbox; }
concat_10 = String.Concat(string0=link_kadaster_9.out0, string1=code_block_2, string2=link_kadaster_9.out1, string3=link_kadaster_9.out2, string4=link_kadaster_9.out3)
concat_11 = String.Concat(string0=link_kadaster_9.out0, string1=code_block_2, string2=link_kadaster_9.out1, string3=link_kadaster_9.out4, string4=link_kadaster_9.out5)
concat_12 = String.Concat(string0=link_kadaster_9.out0, string1=code_block_2, string2=link_kadaster_9.out1, string3=link_kadaster_9.out6, string4=link_kadaster_9.out7)
concat_13 = String.Concat(string0=link_kadaster_9.out0, string1=code_block_2, string2=link_kadaster_9.out1, string3=link_kadaster_9.out8, string4=link_kadaster_9.out9)

# group: geluidscontouren
link_kadaster_10 = CodeBlock()
# ---------- link_kadaster_10.designscript (16 lines) ----------
"https://data.rivm.nl/geo/alo/wms?&request=GetMap&VERSION=1.3.0&bbox=";
"&width=2000&height=2000&format=image/png&crs=EPSG:28992";
//fijnstof pm2,5
"&STYLES=rivm_20210201_g_geluidkaart_lden_alle_bronnen_v3";
"&LAYERS=rivm_20210201_g_geluidkaart_lden_alle_bronnen_v3";
//fijnstof pm10
"&STYLES=rivm_20180205_g_geluidkaart_lden_wegverkeer";
"&LAYERS=rivm_20191112_g_geluidkaart_lden_wegverkeer";
//stikstof
"&STYLES=rivm_r94_20170912_lg_spoor2016lden";
"&LAYERS=vw_rivm_r94_20170912_lg_spoor2016lden";

//view
"gis2bim_geluidscontouren_alle_bronnen";
"gis2bim_geluidscontouren_wegverkeer";
"gis2bim_geluidscontouren_spoor";
# ----------------------------------------
# note: RIVM:
# https://data.rivm.nl/geo/alo/wms?request=GetCapabilities
# https://data.rivm.nl/geo/dank/wms?request=GetCapabilities
code_block_3 = CodeBlock(bbox=BoundingBoxEPSG28992) { bbox; }
concat_14 = String.Concat(string0=link_kadaster_10.out0, string1=code_block_3, string2=link_kadaster_10.out1, string3=link_kadaster_10.out2, string4=link_kadaster_10.out3)
concat_15 = String.Concat(string0=link_kadaster_10.out0, string1=code_block_3, string2=link_kadaster_10.out1, string3=link_kadaster_10.out4, string4=link_kadaster_10.out5)
concat_16 = String.Concat(string0=link_kadaster_10.out0, string1=code_block_3, string2=link_kadaster_10.out1, string3=link_kadaster_10.out6, string4=link_kadaster_10.out7)

# group: risicokaarten
link_kadaster_11 = CodeBlock(bbox=BoundingBoxEPSG28992)
# ---------- link_kadaster_11.designscript (37 lines) ----------
"https://servicespub.risicokaart.nl/geoserver/ISOR_RK/wms?service=WMS&request=GetMap&service=WMS&bbox=";
"&width=2000&height=2000&format=image/png&crs=EPSG:28992";
//installaties
"&STYLES=risico_installatie_10-6";
"&LAYERS=risicocontouren";
//inrichting
"&STYLES=risico_inrichting_10-6";
"&LAYERS=risicocontouren";
//transport
"&STYLES=trnsp_ctr_6";
"&LAYERS=risicocontouren";
//transport
"&STYLES=isor_spoor_hogesnelheidslijn";
"&LAYERS=spoor_hogesnelheidslijn";

//view
"gis2bim_risico_pr_contour_ev";
"gis2bim_risico_pr_contour";
"gis2bim_risico_brand";
"gis2bim_risico_explosie";

"https://apps.geodan.nl/public/data/org/gws/IENW7924REVX/rev_public/wms?request=GetMap&service=WMS";
"&STYLES=prcontour";
"&layers=ev_pr10_6";
"&width=1000&height=1000&format=image/png&crs=EPSG:28992&bbox="+bbox;

"&layers=bn_explosieaandachtsgebieden";
"&STYLES=aandachtsgebied";

"&layers=ev_brandaandachtsgebieden";
"&STYLES=aandachtsgebied";

"&layers=bn_pr10_6";
"&STYLES=prcontour";

"&layers=ev_pr10_6";
"&STYLES=prcontour";
# ----------------------------------------
concat_17 = String.Concat(string0=link_kadaster_11.out14, string1=link_kadaster_11.out22, string2=link_kadaster_11.out23, string3=link_kadaster_11.out17)
concat_18 = String.Concat(string0=link_kadaster_11.out14, string1=link_kadaster_11.out24, string2=link_kadaster_11.out25, string3=link_kadaster_11.out17)
concat_19 = String.Concat(string0=link_kadaster_11.out14, string1=link_kadaster_11.out20, string2=link_kadaster_11.out21, string3=link_kadaster_11.out17)
concat_20 = String.Concat(string0=link_kadaster_11.out14, string1=link_kadaster_11.out18, string2=link_kadaster_11.out19, string3=link_kadaster_11.out17)

# group: WOZ
link_kadaster_12 = CodeBlock(bbox=BoundingBoxEPSG28992)
# ---------- link_kadaster_12.designscript (7 lines) ----------
"https://service.pdok.nl/cbs/vierkantstatistieken100m/2021/wms/v1_0?request=GetMap&service=WMS&VERSION=1.3.0";
"&STYLES=cbsvierkant100m_gemiddelde_woz_waarde_woning&layers=vierkant_100m";
"&width=3000&height=2000&format=image/png";
"&crs=EPSG:28992&bbox="+bbox;

//view
"gis2bim_woz";
# ----------------------------------------
concat_21 = String.Concat(string0=link_kadaster_12.out0, string1=link_kadaster_12.out1, string2=link_kadaster_12.out2, string3=link_kadaster_12.out3)

list_create_3 = List.Create(item0=concat_5, item1=concat_6, item2=concat_7, item3=concat_8, item4=concat_9, item5=concat_10, item6=concat_11, item7=concat_12, item8=concat_13, item9=concat_14, item10=concat_15, item11=concat_16, item12=concat_17, item13=concat_18, item14=concat_19, item15=concat_20, item16=concat_21, item17=concat, item18=concat_2)
n03_WMS_request_list = Output(list_create_3)  # "03 WMS_request_list"
list_create_4 = List.Create(item0=link_kadaster_4.out5, item1=link_kadaster_5.out6, item2=link_kadaster_6.out11, item3=link_kadaster_7.out5, item4=link_kadaster_8.out5, item5=link_kadaster_9.out10, item6=link_kadaster_9.out11, item7=link_kadaster_9.out12, item8=link_kadaster_9.out13, item9=link_kadaster_10.out8, item10=link_kadaster_10.out9, item11=link_kadaster_10.out10, item12=link_kadaster_11.out10, item13=link_kadaster_11.out11, item14=link_kadaster_11.out12, item15=link_kadaster_11.out13, item16=link_kadaster_12.out4, item17=link_kadaster.out7, item18=link_kadaster.out8)
n03_WMS_view_list = Output(list_create_4)  # "03 WMS_view_list"
code_block_4 = CodeBlock {  }
