# Dynamo custom node GIS2BIM_BBox.dyf "GetBBoxParameters" (Dynamo 2.0.2.6826)
# category: KC.GIS2BIM
# Returns the BBox Dimensions when set via Global Parameters (bbox or bboxwidth and bboxheight)

code_block = CodeBlock { "bboxwidth"; "Integer"; }
byName = GlobalParameter.ByName(name=code_block.out0, parameterType=code_block.out1)
value = GlobalParameter.Value(globalParameter=byName)
code_block_2 = CodeBlock { "bboxheight"; "Integer"; }
byName_2 = GlobalParameter.ByName(name=code_block_2.out0, parameterType=code_block_2.out1)
value_2 = GlobalParameter.Value(globalParameter=byName_2)
code_block_3 = CodeBlock { "bbox"; "Integer"; }
byName_3 = GlobalParameter.ByName(name=code_block_3.out0, parameterType=code_block_3.out1)
value_3 = GlobalParameter.Value(globalParameter=byName_3)
python_script = Python(IN[0]=value, IN[1]=value_2, IN[2]=value_3)
# ---------- python_script.python (24 lines) ----------
# Enable Python support and load DesignScript library
import clr
clr.AddReference('ProtoGeometry')
from Autodesk.DesignScript.Geometry import *

# The inputs to this node will be stored as a list in the IN variables.
dataEnteringNode = IN

ibboxh = IN[0]
ibboxv = IN[1]
ibbox = IN[2]
aOutput =[]
# Place your code below this line

if ibboxh > 0 and ibboxv > 0:
	ibboxhdef = ibboxh
	ibboxvdef = ibboxv
else:
	ibboxhdef = ibbox
	ibboxvdef = ibbox
aOutput.append(ibboxhdef)
aOutput.append(ibboxvdef)
# Assign your output to the OUT variable.
OUT = aOutput
# ----------------------------------------
code_block_4 = CodeBlock(bbox=python_script) { bbox[0]; }
width = Output(code_block_4)
code_block_5 = CodeBlock(bbox=python_script) { bbox[1]; }
height = Output(code_block_5)
maximumItem = List.MaximumItem(list=python_script)
