# Dynamo custom node GIS2BIM_BGTFilterV2.dyf "BGTFilter" (Dynamo 2.12.1.8246)
# category: KC.GIS2BIM
# BGT / KLIK Filter
# packages: GIS2BIM for Dynamo 2.x 0.11.15, LunchBox for Dynamo 2018.7.6

# group: Input
path = Input(path: string)
polygonorpoint = Input(polygonorpoint: string)
bbx = Input(bbx: double)
connectlasttofirst = Input(connectlasttofirst: bool)

# group: filter recent registrations
readText = FileSystem.ReadText(file=path)
code_block = CodeBlock { "cityObjectMember"; "imgeo:eindRegistratie"; }
getXMLNode = Lists.DataSets.GetXMLNode(XML=readText, TagName=code_block.out0)
contains = String.Contains(string=getXMLNode, searchFor=code_block.out1)
filterByBoolMask = List.FilterByBoolMask(list=getXMLNode, mask=contains)

# group: read xml and filter polygons
code_block_2 = CodeBlock(input=polygonorpoint)
# ---------- code_block_2.designscript (16 lines) ----------
"gml:" + input;
d = [Imperative]
{
if (input == "Polygon")
{
return = "gml:posList";
}
else
{
return "gml:pos";
}
};
" ";
"gml:id";
"gml:exterior";
"gml:interior";
# ----------------------------------------
getXMLNode_2 = Lists.DataSets.GetXMLNode(TagName=code_block_2.out0)  # unwired: XML

getXMLNode_3 = Lists.DataSets.GetXMLNode(XML=filterByBoolMask.out, TagName=code_block_2.out4)

# group (continued): read xml and filter polygons
getXMLNode_4 = Lists.DataSets.GetXMLNode(XML=getXMLNode_3, TagName=code_block_2.out1)
isNull = Object.IsNull(object=getXMLNode_4)
allFalse = List.AllFalse(list=isNull@L2)
filterByBoolMask_2 = List.FilterByBoolMask(list=getXMLNode_4@@L4, mask=allFalse)
split = String.Split(string=filterByBoolMask_2.in, separator0=code_block_2.out2)
flatten = List.Flatten(list=split@L3)

# group: location
GIS2BIM_GetSharedCoordinate = Custom[GIS2BIM_GetSharedCoordinate]()  # package GIS2BIM for Dynamo 2.x; Get the current shared coordinate

# group: filter coords within bbox
code_block_3 = CodeBlock { 2; 1; 0; }
xCoords = List.TakeEveryNthItem(list=flatten@@L2, n=code_block_3.out0, offset=code_block_3.out1)
toNumber = String.ToNumber(string=xCoords)
code_block_4 = CodeBlock(eastwest=GIS2BIM_GetSharedCoordinate.EastWest, bbox=bbx, northsouth=GIS2BIM_GetSharedCoordinate.NorthSouth) { xmin=eastwest-bbox/2; xmax=eastwest+bbox/2; ymin=northsouth-bbox/2; ymax=northsouth+bbox/2; }
yCoords = List.TakeEveryNthItem(list=flatten@@L2, n=code_block_3.out0, offset=code_block_3.out2)
toNumber_2 = String.ToNumber(string=yCoords)
check_coords_within_bbox = CodeBlock(xCoord=toNumber, xmin=code_block_4.xmin, xmax=code_block_4.xmax, yCoord=toNumber_2, ymin=code_block_4.ymin, ymax=code_block_4.ymax) { bool1 = xCoord>xmin && xCoord<xmax && yCoord>ymin && yCoord<ymax; bool2 = List.AllFalse(bool1@L2<1>); }

# group: create coordinates
filterByBoolMask_3 = List.FilterByBoolMask(list=toNumber, mask=check_coords_within_bbox.bool2)
sub = filterByBoolMask_3.out - GIS2BIM_GetSharedCoordinate.EastWest
code_block_5 = CodeBlock { 1000; }
mul = sub * code_block_5
filterByBoolMask_4 = List.FilterByBoolMask(list=toNumber_2, mask=check_coords_within_bbox.bool2)
sub_2 = filterByBoolMask_4.out - GIS2BIM_GetSharedCoordinate.NorthSouth
mul_2 = sub_2 * code_block_5
code_block_6 = CodeBlock(x=filterByBoolMask_3.out, y=filterByBoolMask_4.out) { "x=" + x + ", y="+y; }

# group: create polycurve
code_block_7 = CodeBlock { 0; }
byCoordinates = Point.ByCoordinates(x=mul, y=mul_2, z=code_block_7)
pruneDuplicates = Point.PruneDuplicates(points=byCoordinates, tolerance=code_block_7)
byPoints = PolyCurve.ByPoints(points=pruneDuplicates, connectLastToFirst=connectlasttofirst)

isNull_2 = Object.IsNull(object=byPoints)
filterByBoolMask_5 = List.FilterByBoolMask(list=byCoordinates, mask=isNull_2)
filterByBoolMask_6 = List.FilterByBoolMask(list=byPoints, mask=isNull_2)
filterByBoolMask_7 = List.FilterByBoolMask(list=code_block_6, mask=isNull_2)

# group: Control
code_block_8 = CodeBlock { "imgeo:identificatie"; "imgeo:lokaalID"; }
getXMLNode_5 = Lists.DataSets.GetXMLNode(XML=filterByBoolMask.out, TagName=code_block_8.out0)
getXMLNode_6 = Lists.DataSets.GetXMLNode(XML=getXMLNode_5, TagName=code_block_8.out1)
filterByBoolMask_8 = List.FilterByBoolMask(list=getXMLNode_6@@L4, mask=allFalse)
flatten_2 = List.Flatten(list=filterByBoolMask_8.in)

filterByBoolMask_9 = List.FilterByBoolMask(list=flatten_2, mask=check_coords_within_bbox.bool2)
filterByBoolMask_10 = List.FilterByBoolMask(list=filterByBoolMask_9.out, mask=isNull_2)

# group: output
points = Output(filterByBoolMask_5.out)
polycurves = Output(filterByBoolMask_6.out)
coords = Output(filterByBoolMask_7.out)
ids = Output(filterByBoolMask_10.out)
