# Dynamo custom node GIS2BIM_GeoServicesLibraryNationaalGeoRegister.dyf "GeoservicesLibraryNationaalGeoRegister" (Dynamo 2.3.0.5885)
# category: KC.GIS2BIM
# Wrapper for the Nationaalgeoregister's GeoServices

link_kadaster = CodeBlock()
# ---------- link_kadaster.designscript (11 lines) ----------
"http://geodata.nationaalgeoregister.nl/";
"plu/wms?";
"&request=GetMap";
"&VERSION=1.3.0";
"&STYLES=";
"&layers=";
"&bbox=";
"&width=3000";
"&height=3000";
"&format=image/png";
"&crs=EPSG:28992";
# ----------------------------------------
styles = Input(styles: var[]..[])
layers = Input(layers: var[]..[])
BoundingBoxEPSG28992 = Input(BoundingBoxEPSG28992: var[]..[])
concat = String.Concat(string0=link_kadaster.out0, string1=link_kadaster.out1, string2=link_kadaster.out2, string3=link_kadaster.out3, string4=link_kadaster.out4, string5=styles, string6=link_kadaster.out5, string7=layers, string8=link_kadaster.out6, string9=BoundingBoxEPSG28992, string10=link_kadaster.out7, string11=link_kadaster.out8, string12=link_kadaster.out9, string13=link_kadaster.out10)
webquery = Output(concat)
