# Dynamo custom node GIS2BIM_GermanGeoServicesLibrary.dyf "GermanGeoservicesLibrary" (Dynamo 2.12.1.8246)
# category: KC.GIS2BIM
# Returns URLS to different German Geoservices based on location and bounding box.
# packages: archi-lab.net 2023.213.1523

city = Input(city: var[]..[])
state = Input(state: var[]..[])
bbox = Input(bbox: var[]..[])
ATOMOffsetX = Input(ATOMOffsetX: var[]..[])
ATOMOffsetY = Input(ATOMOffsetY: var[]..[])
py = Python(IN[0]=city, IN[1]=state, IN[2]=bbox, IN[3]=ATOMOffsetX, IN[4]=ATOMOffsetY)  # "GermanGeoServiceLibrary.py"; CPython3
# ---------- py.python (341 lines) ----------
# Load the Python Standard and DesignScript Libraries
import sys
import math
import clr
clr.AddReference('ProtoGeometry')
from Autodesk.DesignScript.Geometry import *

# The inputs to this node will be stored as a list in the IN variables.
city = IN[0]
state = IN[1]
bbox = IN[2]
ATOMOffsetX = IN[3]
ATOMOffsetY = IN[4]

#city = 'Aachen'
#state = 'Nordrhein-Westfalen'
#bbox = '296290,5628196,296590,5628496'
#city = 'Berlin'
#state = 'Berlin'
#bbox = '388593,5818053,388893,5818353'

# Place your code below this line
# print(city)
# print(state)
# print(bbox)

# Constants

WIDTH = 3000    # Resolution width of WMS bbox
HEIGHT = 3000   # Resolution width of WMS bbox

# LAYERS_WFS = ['cadastre', 'cadastreBuildings'] # Placeholder for later filtering of layers. Needed?
# LAYERS_WMS = ['orthophotos', 'topography', 'noiseKI', 'noiseNight', 'noiseDay', 'pollution', 'groundValueReference', 'zoning', 'energySources', 'groundwaterLevel', 'floodingAreas'] # Placeholder for later filtering of layers. Needed?

# Prepared Properties

bboxComponents = bbox.split(',')
bboxOrigin = (bboxComponents[0], bboxComponents[1])
bboxCenter = (str((int(bboxComponents[2]) - int(bboxComponents[0])) / 2 + int(bboxComponents[0])), str((int(bboxComponents[3]) - int(bboxComponents[1])) / 2 + int(bboxComponents[1])))

bboxWidth = float(bboxComponents[2]) - float(bboxComponents[0])
bboxHeight = float(bboxComponents[3]) - float(bboxComponents[1])

def calcMaxImageDim(scale, bboxDim):
    resolution = 90
    inchToCM = 2.54
    return math.floor(bboxDim * 100 / scale / inchToCM * resolution)
    
def floorToEven(number):
    if type(number) == str:
        return floorToEven(int(number))
    if number % 2 == 0:
        return number
    else:
        return number - 1
    
# Part 1 - URL template dictionary (external? combine with EPSG code?)

germanyWideURLs = {
    'properties': {
        'epsg': 3857,
    },
    'WFSURLs': {},  
    'WMSURLs': {
        'basemap': {
            'url': "https://sgx.geodatenzentrum.de/wms_basemapde?service=WMS&VERSION=1.3.0&request=GetMap&format=image%2Fpng&transparent=true&CRS=EPSG%3A{epsg}&STYLES=&bbox={bbox}&width={width}&height={height}&layers=de_basemapde_web_raster_farbe",
            'legend': "https://sgx.geodatenzentrum.de/wms_basemapde?format=image%2Fpng&layer=de_basemapde_web_raster_farbe&sld_version=1.1.0&request=GetLegendGraphic&service=WMS&version=1.1.1&styles="
        },
        'noise': {
            'url': "https://datahub.uba.de/server/services/VeLa/LK/MapServer/WMSServer?service=WMS&VERSION=1.3.0&request=GetMap&format=image%2Fpng&transparent=true&CRS=EPSG%3A{epsg}&STYLES=&bbox={bbox}&width={width}&height={height}&layers=Aggair_Lden_17,Mair_Lden_17,Aggind_Lden_17,Mroad_Lden_17,Aggroad_Lden_17,AggSrail_Lden_17,Mrail_Lden_17,Aggrail_Lden_17",
            'legend': "https://datahub.uba.de/server/services/VeLa/LK/MapServer/WMSServer?request=GetLegendGraphic%26version=1.3.0%26format=image/png%26layer=Aggind_Lden_17" 
        }
    },
    'OtherURLs': {}
}

stateURLs = {
    'Berlin': {
        'properties': {
            'epsg': 25833,
        },
        'WFSURLs': {
            'cadastre': "https://fbinter.stadt-berlin.de/fb/wfs/data/senstadt/s_wfs_alkis?service=WFS&version=2.0.0&request=GetFeature&typenames=s_wfs_alkis&bbox={bbox}",
            'cadastreBuildings': "https://fbinter.stadt-berlin.de/fb/wfs/data/senstadt/s_wfs_alkis_gebaeudeflaechen?service=WFS&version=2.0.0&request=GetFeature&typenames=s_wfs_alkis_gebaeudeflaechen&bbox={bbox}",
            'trees': "https://fbinter.stadt-berlin.de/fb/wfs/data/senstadt/s_wfs_baumbestand?service=WFS&version=2.0.0&request=GetFeature&typenames=fis:s_wfs_baumbestand&bbox={bbox}",
        },
        'WMSURLs': {
            'basemap': {
               'url': "https://fbinter.stadt-berlin.de/fb/wms/senstadt/wmsk_alkis?service=WMS&VERSION=1.3.0&request=GetMap&format=image%2Fpng&transparent=true&CRS=EPSG%3A25833&STYLES=&bbox={bbox}&width={width}&height={height}&layers=wmsk_alkis",
               'legend': "https://fbinter.stadt-berlin.de/fb_daten/legenden/leg_alkis.png"
            },
            'landuse': {
                'url': "https://fbinter.stadt-berlin.de/fb/wms/senstadt/fnp_ak?service=WMS&VERSION=1.3.0&request=GetMap&format=image%2Fpng&transparent=true&CRS=EPSG%3A25833&STYLES=&bbox={bbox}&width={width}&height={height}&layers=0",
                'minScale': 2500,
                'legend': "https://fbinter.stadt-berlin.de/fb_daten/legenden/leg_fnp_ak.png"
            },
            'orthophotos': "https://fbinter.stadt-berlin.de/fb/wms/senstadt/OI_DOP2022rgbi?service=WMS&VERSION=1.3.0&request=GetMap&format=image%2Fpng&transparent=true&CRS=EPSG%3A25833&STYLES=&bbox={bbox}&width={width}&height={height}&layers=OI_DOP2022rgbi",
            'topography': "https://fbinter.stadt-berlin.de/fb/wms/senstadt/k_dgm1?service=WMS&VERSION=1.3.0&request=GetMap&format=image%2Fpng&transparent=true&CRS=EPSG%3A25833&STYLES=&bbox={bbox}&width={width}&height={height}&layers=ATKIS",
            'noise': {
                'url': "https://fbinter.stadt-berlin.de/fb/wms/senstadt/wmsk_07_05_14verkehr_gesDEN2016?service=WMS&VERSION=1.3.0&request=GetMap&format=image%2Fpng&transparent=true&CRS=EPSG%3A25833&STYLES=&bbox={bbox}&width={width}&height={height}&layers=wmsk_07_05_14verkehr_gesDEN2016",
                'legend': "https://fbinter.stadt-berlin.de/fb_daten/legenden/umweltatlas/leg_07_05_14verkehr_gesDEN2012.png",
            },
            'pollution': {
                'url': "https://fbinter.stadt-berlin.de/fb/wms/senstadt/k03_11_1emisskfzverkehr?service=WMS&VERSION=1.3.0&request=GetMap&format=image%2Fpng&transparent=true&CRS=EPSG%3A25833&STYLES=&bbox={bbox}&width={width}&height={height}&layers=k03_11_1emisskfzverkehr",
                'minScale': 600,
                'maxDim': 4050,
                'legend': "https://fbinter.stadt-berlin.de/fb_daten/legenden/umweltatlas/leg_03_11_1emisskfzverkehr2015.png"
            },
            'groundValueReference': "https://fbinter.stadt-berlin.de/fb/wms/senstadt/brw_2022_amtlich?service=WMS&VERSION=1.3.0&request=GetMap&format=image%2Fpng&transparent=true&CRS=EPSG%3A25833&STYLES=&bbox={bbox}&width={width}&height={height}&layers=brw_2022_amtlich",
            # Energy Sources and Groundwaterlevel only for larger bounding boxes or smaller resolutions... -> calculate from 90dpi resolution?
            'energySources': "https://fbinter.stadt-berlin.de/fb/wms/senstadt/energienetze_ea?service=WMS&VERSION=1.3.0&request=GetMap&format=image%2Fpng&transparent=true&CRS=EPSG%3A25833&STYLES=&bbox={bbox}&width={width}&height={height}&layers=energienetze_ea",
            'groundwaterLevel': "https://fbinter.stadt-berlin.de/fb/wms/senstadt/wmsk_02_12gwgleichen?service=WMS&VERSION=1.3.0&request=GetMap&format=image%2Fpng&transparent=true&CRS=EPSG%3A25833&STYLES=&bbox={bbox}&width={width}&height={height}&layers=wmsk_02_12gwgleichen",
            'floodingAreas': {
                'url': "https://fbinter.stadt-berlin.de/fb/wms/senstadt/ueberschwemmung?service=WMS&VERSION=1.3.0&request=GetMap&format=image%2Fpng&transparent=true&CRS=EPSG%3A25833&STYLES=&bbox={bbox}&width={width}&height={height}&layers=ueberschwemmung",
                'minScale': 2500,
                'legend': "https://fbinter.stadt-berlin.de/fb_daten/legenden/umweltatlas/leg_02_21uesg2018.png",
            },
        },
        'OtherURLs': {
            '3dBuildingsATOM': "https://fbinter.stadt-berlin.de/fb/atom/LOD2/LoD2_{x}_{y}.zip".format(x=int(bboxCenter[0][0:3]) + ATOMOffsetX, y=int(bboxCenter[1][0:4]) + ATOMOffsetY),
            'topographyATOM': "https://fbinter.stadt-berlin.de/fb/atom/DGM1/DGM1_{x}_{y}.zip".format(x=floorToEven(int(bboxCenter[0][0:3]) + ATOMOffsetX), y=floorToEven(int(bboxCenter[1][0:4]) + ATOMOffsetY)),
        }
    },
    'Brandenburg': {
        'properties': {
            'epsg': 25833,
        },
        'WFSURLs': {
            'cadastre': "https://inspire.brandenburg.de/services/cp_alkis_wfs?request=GetFeature&service=WFS&version=2.0.0&typenames=cp:CadastralParcel&bbox={bbox}",
            'cadastreBuildings': "https://inspire.brandenburg.de/services/bu_alkis_wfs?request=GetFeature&service=WFS&version=2.0.0&typenames=bu-core2d:Building&bbox={bbox}",
            'cadastreAAA': "https://isk.geobasis-bb.de/ows/alkis_sf_wfs?service=WFS&version=2.0.0&request=GetFeature&bbox={bbox}&typenames=adv:AP_Darstellung,adv:AP_FPO,adv:AP_LPO,adv:AP_LTO,adv:AP_PPO,adv:AP_PTO,adv:AX_AndereFestlegungNachStrassenrecht,adv:AX_AndereFestlegungNachWasserrecht,adv:AX_Aufnahmepunkt,adv:AX_Bahnverkehr,adv:AX_Bahnverkehrsanlage,adv:AX_BauRaumOderBodenordnungsrecht,adv:AX_Baublock,adv:AX_Bauteil,adv:AX_BauwerkImGewaesserbereich,adv:AX_BauwerkImVerkehrsbereich,adv:AX_BauwerkOderAnlageFuerIndustrieUndGewerbe,adv:AX_BauwerkOderAnlageFuerSportFreizeitUndErholung,adv:AX_Bergbaubetrieb,adv:AX_BesondereFlurstuecksgrenze,adv:AX_BesondereGebaeudelinie,adv:AX_BesondererBauwerkspunkt,adv:AX_BesondererGebaeudepunkt,adv:AX_BesondererHoehenpunkt,adv:AX_BesondererTopographischerPunkt,adv:AX_Bewertung,adv:AX_Bodenschaetzung,adv:AX_BoeschungKliff,adv:AX_Boeschungsflaeche,adv:AX_Buchungsblattbezirk,adv:AX_Bundesland,adv:AX_DammWallDeich,adv:AX_Denkmalschutzrecht,adv:AX_Dienststelle,adv:AX_Duene,adv:AX_EinrichtungInOeffentlichenBereichen,adv:AX_EinrichtungenFuerDenSchiffsverkehr,adv:AX_FelsenFelsblockFelsnadel,adv:AX_Firstlinie,adv:AX_FlaecheBesondererFunktionalerPraegung,adv:AX_FlaecheGemischterNutzung,adv:AX_Fliessgewaesser,adv:AX_Flugverkehr,adv:AX_Flugverkehrsanlage,adv:AX_Flurstueck,adv:AX_Forstrecht,adv:AX_Friedhof,adv:AX_Gebaeude,adv:AX_Gebaeudeausgestaltung,adv:AX_Gehoelz,adv:AX_Gelaendekante,adv:AX_Gemarkung,adv:AX_GemarkungsteilFlur,adv:AX_Gemeinde,adv:AX_Gemeindeteil,adv:AX_GeoreferenzierteGebaeudeadresse,adv:AX_Gewaessermerkmal,adv:AX_Gleis,adv:AX_GrablochDerBodenschaetzung,adv:AX_Grenzpunkt,adv:AX_Hafenbecken,adv:AX_Halde,adv:AX_Heide,adv:AX_HeilquelleGasquelle,adv:AX_HistorischesBauwerkOderHistorischeEinrichtung,adv:AX_HistorischesFlurstueck,adv:AX_HistorischesFlurstueckALB,adv:AX_HistorischesFlurstueckOhneRaumbezug,adv:AX_Hoehenlinie,adv:AX_Hoehleneingang,adv:AX_IndustrieUndGewerbeflaeche,adv:AX_KlassifizierungNachStrassenrecht,adv:AX_KlassifizierungNachWasserrecht,adv:AX_KommunalesGebiet,adv:AX_KreisRegion,adv:AX_LagebezeichnungKatalogeintrag,adv:AX_LagebezeichnungMitHausnummer,adv:AX_LagebezeichnungMitPseudonummer,adv:AX_LagebezeichnungOhneHausnummer,adv:AX_Landschaft,adv:AX_Landwirtschaft,adv:AX_Leitung,adv:AX_MarkanterGelaendepunkt,adv:AX_Meer,adv:AX_Moor,adv:AX_MusterLandesmusterUndVergleichsstueck,adv:AX_NaturUmweltOderBodenschutzrecht,adv:AX_Platz,adv:AX_PunktortAG,adv:AX_PunktortAU,adv:AX_PunktortTA,adv:AX_Regierungsbezirk,adv:AX_SchifffahrtslinieFaehrverkehr,adv:AX_Schiffsverkehr,adv:AX_SchutzgebietNachNaturUmweltOderBodenschutzrecht,adv:AX_SchutzgebietNachWasserrecht,adv:AX_Schutzzone,adv:AX_SeilbahnSchwebebahn,adv:AX_Sicherungspunkt,adv:AX_SonstigerVermessungspunkt,adv:AX_SonstigesBauwerkOderSonstigeEinrichtung,adv:AX_SonstigesRecht,adv:AX_SportFreizeitUndErholungsflaeche,adv:AX_StehendesGewaesser,adv:AX_Strassenverkehr,adv:AX_Strassenverkehrsanlage,adv:AX_Sumpf,adv:AX_TagebauGrubeSteinbruch,adv:AX_Tagesabschnitt,adv:AX_TopographischeLinie,adv:AX_Transportanlage,adv:AX_Turm,adv:AX_UnlandVegetationsloseFlaeche,adv:AX_UntergeordnetesGewaesser,adv:AX_Vegetationsmerkmal,adv:AX_Verwaltungsgemeinschaft,adv:AX_VorratsbehaelterSpeicherbauwerk,adv:AX_Wald,adv:AX_Wasserspiegelhoehe,adv:AX_Weg,adv:AX_WegPfadSteig,adv:AX_WirtschaftlicheEinheit,adv:AX_Wohnbauflaeche,adv:AX_Wohnplatz",
            '3dBuilding': "https://isk.geobasis-bb.de/ows/gebaeudelod2_wfs?request=GetFeature&service=WFS&version=2.0.0&typenames=bldg:Building&bbox={bbox}"
        },
        'WMSURLs': {
            'orthophotos': "https://isk.geobasis-bb.de/mapproxy/dop20c/service/wms?service=WMS&VERSION=1.3.0&request=GetMap&format=image%2Fpng&transparent=true&CRS=EPSG%3A25833&STYLES=&bbox={bbox}&width={width}&height={height}&layers=bebb_dop20c",
            'topography': "https://isk.geobasis-bb.de/mapproxy/dtk10farbe/service/wms?service=WMS&VERSION=1.3.0&request=GetMap&format=image%2Fpng&transparent=true&CRS=EPSG%3A25833&STYLES=&bbox={bbox}&width={width}&height={height}&layers=bb_dtk10_farbe",
            'noise': "https://inspire.brandenburg.de/services/hh_laermk_bb2022_wms?service=WMS&VERSION=1.3.0&request=GetMap&format=image%2Fpng&transparent=true&CRS=EPSG%3A25833&STYLES=&bbox={bbox}&width={width}&height={height}&layers=HH.HealthDeterminantMeasure",
            'pollution': "",
            'groundValueReference': "",
            'zoning': "https://inspire.brandenburg.de/services/elu_alkis_wms?service=WMS&VERSION=1.3.0&request=GetMap&format=image%2Fpng&transparent=true&CRS=EPSG%3A25833&STYLES=&bbox={bbox}&width={width}&height={height}&layers=LU.ExistingLandUse",
            'energySources': "",
            'groundwaterLevel': "",
            'floodingAreas': "https://maps.brandenburg.de/services/wms/uesg?service=WMS&VERSION=1.3.0&request=GetMap&format=image%2Fpng&transparent=true&CRS=EPSG%3A25833&STYLES=&bbox={bbox}&width={width}&height={height}&layers=Festgesetzte_Ueberschwemmungsgebiete",
        },
        'OtherURLs': {
            '3dBuildingsATOM': "",
        }
    },
    'Nordrhein-Westfalen': {
        'properties': {
            'epsg': 25832,
        },
        'WFSURLs': {
            'cadastre': "https://www.wfs.nrw.de/geobasis/wfs_nw_alkis_aaa-modell-basiert?SERVICE=WFS&VERSION=2.0.0&REQUEST=GetFeature&bbox={bbox}&typenames=adv:AX_Flurstueck",
            'cadastreBuildings': "https://www.wfs.nrw.de/geobasis/wfs_nw_alkis_aaa-modell-basiert?SERVICE=WFS&VERSION=2.0.0&REQUEST=GetFeature&bbox={bbox}&typenames=adv:AX_Gebaeude",
            'cadastreStreets': "https://www.wfs.nrw.de/geobasis/wfs_nw_alkis_aaa-modell-basiert?SERVICE=WFS&VERSION=2.0.0&REQUEST=GetFeature&bbox={bbox}&typenames=adv:AX_Strassenverkehr",
            '3dBuildingsLoD1': "https://www.wfs.nrw.de/geobasis/wfs_nw_3d-gebaeudemodell_lod1?SERVICE=WFS&VERSION=1.1.0&REQUEST=GetFeature&bbox={bbox}&typename=bldg:Building",
        },
        'WMSURLs': {
            'basemap': {
                'url': "https://www.wms.nrw.de/geobasis/wms_nw_alkis?request=GetMap&service=WMS&version=1.3.0&format=image/png&crs=EPSG:25832&styles=&transparent=true&language=ger&bbox={bbox}&width={width}&height={height}&layers=adv_alkis_tatsaechliche_nutzung",
                'legend': "https://www.wms.nrw.de/aaa-suite/wms-resources/external-graphics/alkis/wms/adv/ALKIS-WMS-Legende_TN_farbe.png",
            },
            'orthophotos': "https://www.wms.nrw.de/geobasis/wms_nw_dop?request=GetMap&service=WMS&version=1.3.0&format=image/png&crs=EPSG:25832&styles=&transparent=true&language=ger&bbox={bbox}&width={width}&height={height}&layers=nw_dop_utm_info%2Cnw_dop_rgb",
            'topography': "https://www.wms.nrw.de/geobasis/wms_nw_dtk10?REQUEST=GetMap&SERVICE=WMS&VERSION=1.3.0&format=image/png&crs=EPSG:25832&styles=&transparent=true&language=ger&bbox={bbox}&width={width}&height={height}&layers=WMS_NW_DTK10",
            'noise': {
                'url': "https://www.wms.nrw.de/umwelt/laerm?REQUEST=GetMap&SERVICE=WMS&VERSION=1.3.0&format=image/png&crs=EPSG:25832&styles=&transparent=true&bbox={bbox}&width={width}&height={height}&layers=laerm",
                'legend': "https://www.wms.nrw.de/umwelt/laerm?service=WMS&version=1.1.1&sld_version=1.1.0&request=GetLegendGraphic&layer=STR_DEN&styles=&format=image%2Fpng",
            },
            'pollution': "",
            'groundValueReference': "https://www.wms.nrw.de/wms/borisplus?SERVICE=WMS&REQUEST=GetMap&version=1.3.0&format=image/png&crs=EPSG:25832&styles=&transparent=true&bbox={bbox}&width={width}&height={height}&layers=0%2C2%2C3%2C5%2C6%2C8%2C9%2C11%2C12%2C14%2C15%2C17%2C18",
            'zoning': "",
            'energySources': "",
            'groundwaterLevel': "",
            'floodingAreas': "https://www.wms.nrw.de/umwelt/uesg?REQUEST=GetMap&SERVICE=WMS&VERSION=1.3.0&format=image/png&crs=EPSG:25832&styles=&transparent=true&bbox={bbox}&width={width}&height={height}&layers=1%2C2%2C3%2C4%2C5%2C6",
        },
        'OtherURLs': {
            '3dBuildingsATOM': "https://www.opengeodata.nrw.de/produkte/geobasis/3dg/lod2_gml/lod2_gml/LoD2_32_{x}_{y}_1_NW.gml".format(x=int(bboxCenter[0][0:3]) + ATOMOffsetX, y=int(bboxCenter[1][0:4])+ ATOMOffsetY),
            'topographyATOM': "https://www.opengeodata.nrw.de/produkte/geobasis/hm/dgm1_xyz/dgm1_xyz/dgm1_32_{x}_{y}_1_nw.xyz.gz".format(x=int(bboxCenter[0][0:3]) + ATOMOffsetX, y=int(bboxCenter[1][0:4]) + ATOMOffsetY),
        }
    },
    'Baden-Württemberg': { # CAUTON - NOT FREE TO USE
        'properties': {
            'epsg': 25832,
            'epsgGK': 31467,
        },
        'WFSURLs': {
            'cadastre': "",
            'cadastreBuildings': "",
        },
        'WMSURLs': {
            'basemap': "",
            'orthophotos': "https://owsproxy.lgl-bw.de/owsproxy/ows/WMS_LGL-BW_ATKIS_DOP_20_C?user=geop_raumord&password=20141009_raum&LAYERS=IMAGES_DOP_20_RGB&TRANSPARENT=false&FORMAT=image%2Fpng&VERSION=1.1.1&SERVICE=WMS&REQUEST=GetMap&STYLES=&SRS=EPSG%3A25832&BBOX={bbox}&WIDTH={width}&HEIGHT={height}",
            'topography': "",
            'pollution': "",
            'groundValueReference': "",
            'landuse': {
                'url': "https://www.geoportal-raumordnung-bw.de/mapserver/wms/nologin/1_fnp?LAYERS=fnp0&TRANSPARENT=TRUE&FORMAT=image%2Fgif&VERSION=1.1.1&SERVICE=WMS&REQUEST=GetMap&STYLES=&SRS=EPSG%3A25832&BBOX={bbox}&WIDTH={width}&HEIGHT={height}",
                'legend': "https://www.geoportal-raumordnung-bw.de/mapserver/wms/nologin/1_fnp?version=1.1.1&service=WMS&request=GetLegendGraphic&layer=fnp0&format=image/png&STYLE=default",
                'minScale': 7500,
            },
            'energySources': "",
            'groundwaterLevel': "",
            'floodingAreas': "",
        },
        'OtherURLs': {
            '3dBuildingsATOM': "",
            'topographyATOM': "",
        }
    },
}

cityURLs = {
    'Heidenheim': {
        'properties': {
            'epsg': 25832
        },
        'WFSURLs': {},
        'WMSURLs': {
            'cadastreWMS': "https://buergerinfo.landkreis-heidenheim.de/cadenza/api/map?SERVICE=WMS&VERSION=1.1.1&REQUEST=GetMap&FORMAT=image/png&TRANSPARENT=true&LAYERS=ALKISWMS~5976&STYLES=default&EXCEPTIONS=application/vnd.ogc.se_blank&SRS=EPSG:25832&width={width}&height={height}&bbox={bbox}",
            'orthophotos': "https://owsproxy.lgl-bw.de/owsproxy/ows/WMS_LGL-BW_ATKIS_DOP_20_C?user=lra_heidenheim02&password=20150504_heidenh02&SERVICE=WMS&VERSION=1.3.0&REQUEST=GetMap&FORMAT=image%2Fpng&TRANSPARENT=true&LAYERS=IMAGES_DOP_20_RGB&STYLES=default&EXCEPTIONS=BLANK&CRS=EPSG%3A25832&WIDTH={width}&HEIGHT={height}&BBOX={bbox}"
        },
        'OtherURLs': {}
    },
    'München': {
        'properties': {
            'epsg': 25832
        },
        'WFSURLs': {},
        'WMSURLs': {
            'cadastre': "https://geoportal.muenchen.de/geoserver/gsm/wms?SERVICE=WMS&VERSION=1.3.0&REQUEST=GetMap&FORMAT=image/png&TRANSPARENT=true&LAYERS=gsm:g_stadtkarte_gesamt&SINGLETILE=false&CRS=EPSG:25832&STYLES=&width={width}&height={height}&bbox={bbox}",
            'orthophotos': "https://geoportal.muenchen.de/geoserver/gsm/wms?SERVICE=WMS&VERSION=1.3.0&REQUEST=GetMap&FORMAT=image/png&TRANSPARENT=true&CACHEID=1217800&LAYERS=gsm:g_luftbild&SINGLETILE=false&CRS=EPSG:25832&STYLES=&width={width}&height={height}&bbox={bbox}",
            'zoning': "https://geoportal.muenchen.de/geoserver/plan/wms?SERVICE=WMS&VERSION=1.3.0&REQUEST=GetMap&FORMAT=image/png&TRANSPARENT=true&LAYERS=plan:g_fnp&SINGLETILE=false&CRS=EPSG:25832&STYLES=&width={width}&height={height}&bbox={bbox}",
            'groundwaterLevel': "https://geoportal.muenchen.de/geoserver/rgu/wms?SERVICE=WMS&VERSION=1.3.0&REQUEST=GetMap&FORMAT=image/png&TRANSPARENT=true&LAYERS=rgu:flab&SINGLETILE=false&CRS=EPSG:25832&STYLES=&width={width}&height={height}&bbox={bbox}",
            'floodingAreas': "https://geoportal.muenchen.de/geoserver/rgu/wms?SERVICE=WMS&VERSION=1.3.0&REQUEST=GetMap&FORMAT=image/png&TRANSPARENT=true&CACHEID=6795953&LAYERS=rgu:festsetzung&SINGLETILE=false&CRS=EPSG:25832&STYLES=&width={width}&height={height}&bbox={bbox}"
        },
        'OtherURLs': {}
    },
    'Stuttgart': {
        'properties': {
            'epsg': 25832
        },
        'WFSURLs': {},
        'WMSURLs': {
            'basemap': {
                'url': "https://geoserver.stuttgart.de/geoserver/ows/?SERVICE=WMS&VERSION=1.3.0&REQUEST=GetMap&format=image/png&crs=EPSG:25832&styles=&transparent=true&bbox={bbox}&width={width}&height={height}&layers=Base:Basemap_EPSG25832",
                'legend': "https://geoserver.stuttgart.de/geoserver/ows?service=WMS&version=1.3.0&request=GetLegendGraphic&format=image%2Fpng&width=20&height=20&layer=Base%3ABasemap_EPSG25832"
            },
            'cadastre': "https://geoserver.stuttgart.de/geoserver/ows/?SERVICE=WMS&VERSION=1.3.0&REQUEST=GetMap&format=image/png&crs=EPSG:25832&styles=&transparent=true&bbox={bbox}&width={width}&height={height}&layers=Base:A62_GK_STRLINIEN_PLUS_EPSG25832,GEOLINE_FLEX:A36_SOLAR_GEB_GRUNDRISSE_EPSG25832,Base:A67_GFM_BAUM_PLUS_EPSG25832,GEOLINE_FLEX:A62_Hoehenlinien_EPSG25832,GEOLINE_FLEX:A62_GK_Flurstuecke_EPSG25832",
            'orthophotos': "https://geoserver.stuttgart.de/geoserver/ows/?SERVICE=WMS&VERSION=1.3.0&REQUEST=GetMap&format=image/png&crs=EPSG:25832&styles=&transparent=true&bbox={bbox}&width={width}&height={height}&layers=Base:A62_Luftbild_2021_EPSG25832",
            'noise': {
                'url': "https://geoserver.stuttgart.de/geoserver/ows/?SERVICE=WMS&VERSION=1.3.0&REQUEST=GetMap&format=image/png&crs=EPSG:25832&styles=&transparent=true&bbox={bbox}&width={width}&height={height}&layers=Base:A62_GK_STRLINIEN_PLUS_EPSG25832,GEOLINE_FLEX:A36_SOLAR_GEB_GRUNDRISSE_EPSG25832,GEOLINE_FLEX:A36_LAERM2017_Strasse_LDEN_Gebaeude_EPSG25832",
                'legend': "https://maps.stuttgart.de/_config/ressources/img/legend/Laermkartierung_24h_2018.png"
            },
            'pollution': {
                'url': "https://geoserver.stuttgart.de/geoserver/ows/?SERVICE=WMS&VERSION=1.3.0&REQUEST=GetMap&format=image/png&crs=EPSG:25832&styles=&transparent=true&bbox={bbox}&width={width}&height={height}&layers=GEOLINE_FLEX:A36_LUFT_POT_LUFTBELASTUNG_STGT_EPSG25832,Base:A62_GK_STRLINIEN_PLUS_EPSG25832,GEOLINE_FLEX:A36_SOLAR_GEB_GRUNDRISSE_EPSG25832",
                'legend': "https://maps.stuttgart.de/_config/ressources/img/legend/Luftbelastung/potentielle_luftbelastung.PNG",
                'minScale': 7500,
            },
            'pollutionPM10': {
                'url': "https://geoserver.stuttgart.de/geoserver/ows/?SERVICE=WMS&VERSION=1.3.0&REQUEST=GetMap&format=image/png&crs=EPSG:25832&styles=&transparent=true&bbox={bbox}&width={width}&height={height}&layers=Base:A62_GK_STRLINIEN_PLUS_EPSG25832,GEOLINE_FLEX:A36_SOLAR_GEB_GRUNDRISSE_EPSG25832,GEOLINE_FLEX:A36_LUFT_IMMISSION_PM10_EPSG25832",
                'legend': "https://maps.stuttgart.de/_config/ressources/img/legend/Luftbelastung/Feinstaub.PNG"
            },
            'pollutionNO2': {
                'url': "https://geoserver.stuttgart.de/geoserver/ows/?SERVICE=WMS&VERSION=1.3.0&REQUEST=GetMap&format=image/png&crs=EPSG:25832&styles=&transparent=true&bbox={bbox}&width={width}&height={height}&layers=Base:A62_GK_STRLINIEN_PLUS_EPSG25832,GEOLINE_FLEX:A36_SOLAR_GEB_GRUNDRISSE_EPSG25832,GEOLINE_FLEX:A36_Stickstoffdioxid_NO2_EPSG25832",
                'legend': "https://maps.stuttgart.de/_config/ressources/img/legend/Luftbelastung/Stickstoffdioxid.PNG"
            },
            'floodingAreas': {
                'url': "https://geoserver.stuttgart.de/geoserver/ows/?SERVICE=WMS&VERSION=1.3.0&REQUEST=GetMap&format=image/png&crs=EPSG:25832&styles=&transparent=true&bbox={bbox}&width={width}&height={height}&layers=Base:A62_GK_STRLINIEN_PLUS_EPSG25832,GEOLINE_FLEX:A36_SOLAR_GEB_GRUNDRISSE_EPSG25832,GEOLINE_FLEX:A36_Ueberschwemmungsgebiete_HQ100_EPSG25832",
                'legend': "https://maps.stuttgart.de/_config/ressources/img/legend/Festgesetzte_Ueberschwemmungsgebiete.png"
            },
        },
        'OtherURLs': {}
    }
}




# Part 2 - Select best URLs for city/state/country/EU and fill templates with bbox (and potentially other parameters)

urlTemplatesWFS = germanyWideURLs['WFSURLs']
urlTemplatesWMS = germanyWideURLs['WMSURLs']
urlsOther = germanyWideURLs['OtherURLs']

epsg = germanyWideURLs['properties']['epsg']

if state in stateURLs:
    urlTemplatesWFS = {**urlTemplatesWFS, **stateURLs[state]['WFSURLs']}
    urlTemplatesWMS = {**urlTemplatesWMS, **stateURLs[state]['WMSURLs']}
    urlsOther = {**urlsOther, **stateURLs[state]['OtherURLs']}
    epsg = stateURLs[state]['properties']['epsg']
if city in cityURLs:
    urlTemplatesWFS = {**urlTemplatesWFS, **cityURLs[city]['WFSURLs']}
    urlTemplatesWMS = {**urlTemplatesWMS, **cityURLs[city]['WMSURLs']} 
    urlsOther = {**urlsOther, **cityURLs[city]['OtherURLs']}
    epsg = cityURLs[city]['properties']['epsg']
else:
    print('Error: No Service URLS available for this location')


# Part 3 - Prepare correct URLs for deault layers (customize layer selection?)

urlsWFS = { key + 'WFS': urlTemplatesWFS[key].format(bbox=bbox) for key in urlTemplatesWFS.keys() }
#urlsWMS = { key + 'WMS': urlTemplatesWMS[key].format(width=WIDTH, height=HEIGHT, bbox=bbox) for key in urlTemplatesWMS.keys() }
urlsWMS = {}
for key in urlTemplatesWMS.keys():
    urlTemplate = urlTemplatesWMS[key]
    outputKey = key + 'WMS'
    if type(urlTemplate) is dict:
        width = WIDTH
        height = HEIGHT
        
        if 'minScale' in urlTemplate:
            scale = urlTemplate['minScale']
            width = calcMaxImageDim(scale, bboxWidth)
            height = calcMaxImageDim(scale, bboxHeight)
            
        if 'maxDim' in urlTemplate:
            maxDim = urlTemplate['maxDim']
            ratio = width / height
            if width > maxDim:
                width = maxDim
                height = math.floor(width / ratio)
            elif height > maxDim:
                height = maxDim
                width = math.floor(height * ratio)
    
        if 'legend' in urlTemplate:
            urlsWMS[outputKey] = [urlTemplatesWMS[key]['url'].format(width=width, height=height, bbox=bbox, epsg=epsg), urlTemplatesWMS[key]['legend']]
        else:
            urlsWMS[outputKey] = urlTemplatesWMS[key]['url'].format(width=width, height=height, bbox=bbox, epsg=epsg)
    else:
        urlsWMS[outputKey] = urlTemplatesWMS[key].format(width=WIDTH, height=HEIGHT, bbox=bbox)


# Combine differnt URL groups to single output

OUT = { **urlsWFS, **urlsWMS, **urlsOther }

# print(OUT)
# ----------------------------------------
URLs = Output(py)
code_block = CodeBlock { "basemapWMS"; }
tryGetValueAtKey = archilab.Core.Dictionaries.TryGetValueAtKey(dictionary=py, key=code_block)
Base_Map_WMS = Output(tryGetValueAtKey)  # "Base Map (WMS)"
code_block_2 = CodeBlock()  # // Future Inputs: Layers
code_block_3 = CodeBlock { "orthophotosWMS"; }
tryGetValueAtKey_2 = archilab.Core.Dictionaries.TryGetValueAtKey(dictionary=py, key=code_block_3)
Orthophotos_WMS = Output(tryGetValueAtKey_2)  # "Orthophotos (WMS)"
code_block_4 = CodeBlock { "noiseWMS"; }
tryGetValueAtKey_3 = archilab.Core.Dictionaries.TryGetValueAtKey(dictionary=py, key=code_block_4)
Noise_WMS = Output(tryGetValueAtKey_3)  # "Noise (WMS)"
code_block_5 = CodeBlock { "pollutionWMS"; }
tryGetValueAtKey_4 = archilab.Core.Dictionaries.TryGetValueAtKey(dictionary=py, key=code_block_5)
Pollution_WMS = Output(tryGetValueAtKey_4)  # "Pollution (WMS)"
code_block_6 = CodeBlock { "topographyWMS"; }
tryGetValueAtKey_5 = archilab.Core.Dictionaries.TryGetValueAtKey(dictionary=py, key=code_block_6)
Topography_WMS = Output(tryGetValueAtKey_5)  # "Topography (WMS)"
code_block_7 = CodeBlock { "cadastreWFS"; }
tryGetValueAtKey_6 = archilab.Core.Dictionaries.TryGetValueAtKey(dictionary=py, key=code_block_7)
Cadastre_WFS = Output(tryGetValueAtKey_6)  # "Cadastre (WFS)"
code_block_8 = CodeBlock { "cadastreBuildingsWFS"; }
tryGetValueAtKey_7 = archilab.Core.Dictionaries.TryGetValueAtKey(dictionary=py, key=code_block_8)
Cadastre_Buildings_WFS = Output(tryGetValueAtKey_7)  # "Cadastre Buildings (WFS)"
code_block_9 = CodeBlock { "3dBuildingsATOM"; }
tryGetValueAtKey_8 = archilab.Core.Dictionaries.TryGetValueAtKey(dictionary=py, key=code_block_9)
n3D_Buildings_ATOM = Output(tryGetValueAtKey_8)  # "3D Buildings (ATOM)"
code_block_10 = CodeBlock { "3dBuildingsLoD1WFS"; }
tryGetValueAtKey_9 = archilab.Core.Dictionaries.TryGetValueAtKey(dictionary=py, key=code_block_10)
n3D_Buildings_LoD1_WFS = Output(tryGetValueAtKey_9)  # "3D Buildings LoD1 (WFS)"
code_block_11 = CodeBlock { "treesWFS"; }
tryGetValueAtKey_10 = archilab.Core.Dictionaries.TryGetValueAtKey(dictionary=py, key=code_block_11)
Trees_WFS = Output(tryGetValueAtKey_10)  # "Trees (WFS)"
code_block_12 = CodeBlock { "topographyATOM"; }
tryGetValueAtKey_11 = archilab.Core.Dictionaries.TryGetValueAtKey(dictionary=py, key=code_block_12)
Topography_1m_ATOM = Output(tryGetValueAtKey_11)  # "Topography 1m (ATOM)"
code_block_13 = CodeBlock { "landuseWMS"; }
tryGetValueAtKey_12 = archilab.Core.Dictionaries.TryGetValueAtKey(dictionary=py, key=code_block_13)
Land_Use_WMS = Output(tryGetValueAtKey_12)  # "Land Use (WMS)"
code_block_14 = CodeBlock { "floodingAreasWMS"; }
tryGetValueAtKey_13 = archilab.Core.Dictionaries.TryGetValueAtKey(dictionary=py, key=code_block_14)
Flooding_Areas_WMS = Output(tryGetValueAtKey_13)  # "Flooding Areas (WMS)"
code_block_15 = CodeBlock { "cadastreWMS"; }
tryGetValueAtKey_14 = archilab.Core.Dictionaries.TryGetValueAtKey(dictionary=py, key=code_block_15)
Cadastre_WMS = Output(tryGetValueAtKey_14)  # "Cadastre (WMS)"
code_block_16 = CodeBlock { "pollutionPM10WMS"; }
tryGetValueAtKey_15 = archilab.Core.Dictionaries.TryGetValueAtKey(dictionary=py, key=code_block_16)
Pollution_PM10_WMS = Output(tryGetValueAtKey_15)  # "Pollution PM10 (WMS)"
code_block_17 = CodeBlock { "pollutionNO2WMS"; }
tryGetValueAtKey_16 = archilab.Core.Dictionaries.TryGetValueAtKey(dictionary=py, key=code_block_17)
Pollution_NO2_WMS = Output(tryGetValueAtKey_16)  # "Pollution NO2 (WMS)"
code_block_18 = CodeBlock { "cadastreStreetsWFS"; }
tryGetValueAtKey_17 = archilab.Core.Dictionaries.TryGetValueAtKey(dictionary=py, key=code_block_18)
Cadastre_Streets_WFS = Output(tryGetValueAtKey_17)  # "Cadastre Streets (WFS)"
