# Dynamo custom node GIS2BIM_GetPointsPolygonFromGMLxy.dyf "GetPointsPolygonFromGMLxy" (Dynamo 2.12.1.8246)
# category: KC.GIS2BIM
# Extracts PolygonPoints from a 2D GML File.

UnitsConversionFactor = Input(UnitsConversionFactor: double = 1000)  # Conversionfactor Units
XML = Input(XML: var[]..[])  # result webrequest
XPATHSTRING = Input(XPATHSTRING: string = ".//{http://www.opengis.net/gml/3.2}posList")  # XPATHSTRING

# group: PYTHON FROM BAKERY
python_script = Python(IN[0]=XML, IN[1]=XPATHSTRING)  # CPython3
# ---------- python_script.python (56 lines) ----------
import clr
import sys
clr.AddReference('ProtoGeometry')
from Autodesk.DesignScript.Geometry import *
sys.path.append("C:\Program Files (x86)\IronPython 2.7\Lib")
#from xml.parsers.expat import expat -- can't find this
import xml.etree.ElementTree as ET
#The inputs to this node will be stored as a list in the IN variables.
xml = IN[0]
xpathstr = IN[1]

if type(xml) == list:
        xml = xml[0]

root = ET.fromstring(xml.encode('utf-8'))

xpathfound = root.findall(xpathstr)
#xparentstr = xpathstr + "/.."
#xparentfound = root.findall(xpathstr+"/..")
xtags, xtext, xcountattrib, xattrib, xattvals, xcountiter, xitertags, xitervals, xparents = [], [], [], [], [], [], [], [], []
for x in xpathfound:
        xtags.append(x.tag)
        if x.text:
                try:
                        xtext.append(x.text)
                except:
                        xtext.append("_none_")
        else:
                xtext.append("_none_")
        if list(x.keys()):
                xcountattrib.append(len(list(x.items())))
                for name, value in list(x.items()):
                        xattrib.append(name)
                        xattvals.append(value)
#PARENT CODE BELOW IS TOO SLOW
#                       try:
#                               xparents.append(root.find(xpathstr + "/" + name + "/.."))
#                       except:
#                               xparents.append("no parent found")
        else:
                xcountattrib.append(1)
                xattrib.append("_none_")
                xattvals.append("_none_")

#THIS METHOD NOT GREAT
#       if x.iter():
#               xcountiter.append(len(x.iter()))
#               for name, value in x.iter():
#                       xitertags.append(name)
#                       xitervals.append(value)
#for y in xparentfound:
#       xparents.append(y.tag)

OUT = root, str(root), xpathfound, xtags, xtext, xcountattrib, xattrib, xattvals
#, xparents 
#, xparentfound#, xparents#, xcountiter, xitertags, xitervals
# ----------------------------------------

code_block = CodeBlock { 4; }
getItemAtIndex = List.GetItemAtIndex(list=python_script, index=code_block)
code_block_2 = CodeBlock { " "; }
split = String.Split(string=getItemAtIndex, separator0=code_block_2)
string = StringInput("0")  # graph input
eq = _ == string  # unwired: x
map = List.Map(list=split, function=eq)
filterByBoolMask = List.FilterByBoolMask(list=split, mask=map)
toNumber = String.ToNumber(string=filterByBoolMask.out)
code_block_3 = CodeBlock { 1; 2; 0; }
X = List.TakeEveryNthItem(n=code_block_3.out1, offset=code_block_3.out0)  # unwired: list
map_2 = List.Map(list=toNumber, function=X)
DeltaX = Input(DeltaX: var[]..[])  # X-value of transformation of points and polygons
x_convert_to_local_axis = map_2 - DeltaX
mul = UnitsConversionFactor * x_convert_to_local_axis
Y = List.TakeEveryNthItem(n=code_block_3.out1, offset=code_block_3.out2)  # unwired: list
map_3 = List.Map(list=toNumber, function=Y)
DeltaY = Input(DeltaY: var[]..[])  # Y-value of transformation of points and polygons
y_convert_to_local_axis = map_3 - DeltaY
mul_2 = UnitsConversionFactor * y_convert_to_local_axis
code_block_4 = CodeBlock { 0; }
byCoordinates = Point.ByCoordinates(x=mul, y=mul_2, z=code_block_4)
pruneDuplicates = Point.PruneDuplicates(points=byCoordinates)
Connectpolygon = Input(Connectpolygon: bool = true)  # Connect polygons from the xml
byPoints = PolyCurve.ByPoints(points=pruneDuplicates, connectLastToFirst=Connectpolygon)
PolyCurves = Output(byPoints)
Points = Output(pruneDuplicates)
