# Dynamo custom node GIS2BIM_KadasterPercelen.dyf "KadasterPercelen" (Dynamo 2.0.2.6826)
# category: KC.GIS2BIM
# Draw propertylines and place streetnames and housenumbers from the dutch kadaster

View_Revit_View = Input(View: Revit.View: var[]..[])
WebrequestKadasterPerceel = Input(WebrequestKadasterPerceel: var[]..[])
DeltaX = Input(DeltaX: var[]..[])  # X-value of transformation of points and polygons
string = StringInput(".//{http://kadastralekaartv3.geonovum.nl}perceelnummer_deltax")  # graph input
python_script = Python(IN[0]=WebrequestKadasterPerceel, IN[1]=string)
# ---------- python_script.python (53 lines) ----------
import clr
import sys
clr.AddReference('ProtoGeometry')
from Autodesk.DesignScript.Geometry import *
sys.path.append("C:\Program Files (x86)\IronPython 2.7\Lib")
#from xml.parsers.expat import expat -- can't find this
import xml.etree.ElementTree as ET
#The inputs to this node will be stored as a list in the IN variables.
xml = IN[0]
xpathstr = IN[1]

root = ET.fromstring(xml)

xpathfound = root.findall(xpathstr)
#xparentstr = xpathstr + "/.."
#xparentfound = root.findall(xpathstr+"/..")
xtags, xtext, xcountattrib, xattrib, xattvals, xcountiter, xitertags, xitervals, xparents = [], [], [], [], [], [], [], [], []
for x in xpathfound:
	xtags.append(x.tag)
	if x.text:
		try:
			xtext.append(x.text)
		except:
			xtext.append("_none_")
	else:
		xtext.append("_none_")
	if x.keys():
		xcountattrib.append(len(x.items()))
		for name, value in x.items():
			xattrib.append(name)
			xattvals.append(value)
#PARENT CODE BELOW IS TOO SLOW
#			try:
#				xparents.append(root.find(xpathstr + "/" + name + "/.."))
#			except:
#				xparents.append("no parent found")
	else:
		xcountattrib.append(1)
		xattrib.append("_none_")
		xattvals.append("_none_")

#THIS METHOD NOT GREAT
#	if x.iter():
#		xcountiter.append(len(x.iter()))
#		for name, value in x.iter():
#			xitertags.append(name)
#			xitervals.append(value)
#for y in xparentfound:
#	xparents.append(y.tag)

OUT = root, str(root), xpathfound, xtags, xtext, xcountattrib, xattrib, xattvals
#, xparents 
#, xparentfound#, xparents#, xcountiter, xitertags, xitervals
# ----------------------------------------
code_block = CodeBlock { 4; }
getItemAtIndex = List.GetItemAtIndex(list=python_script, index=code_block)
DeltaY = Input(DeltaY: var[]..[])  # Y-value of transformation of points and polygons
string_2 = StringInput(".//{http://kadastralekaartv3.geonovum.nl}perceelnummer_deltay")  # graph input
python_script_2 = Python(IN[0]=WebrequestKadasterPerceel, IN[1]=string_2)  # same code as python_script
code_block_2 = CodeBlock { 4; }
getItemAtIndex_2 = List.GetItemAtIndex(list=python_script_2, index=code_block_2)
code_block_3 = CodeBlock { 1000; }
string_3 = StringInput(".//{http://kadastralekaartv3.geonovum.nl}perceelnummer")  # graph input
python_script_3 = Python(IN[0]=WebrequestKadasterPerceel, IN[1]=string_3)  # same code as python_script
code_block_4 = CodeBlock { 4; }
getItemAtIndex_3 = List.GetItemAtIndex(list=python_script_3, index=code_block_4)
TextTypePerceel = Input(TextTypePerceel: var[]..[])
string_4 = StringInput(".//{http://kadastralekaartv3.geonovum.nl}perceelnummer_rotatie")  # graph input
python_script_4 = Python(IN[0]=WebrequestKadasterPerceel, IN[1]=string_4)  # same code as python_script
code_block_5 = CodeBlock { 4; }
getItemAtIndex_4 = List.GetItemAtIndex(list=python_script_4, index=code_block_5)

# group: PLACE TEXTNOTE FOR KADASTRAAL PERCEEL
flatten = List.Flatten(list=getItemAtIndex)
toNumber = String.ToNumber(str=flatten)
add = DeltaX + toNumber
flatten_2 = List.Flatten(list=getItemAtIndex_2)
toNumber_2 = String.ToNumber(str=flatten_2)
add_2 = DeltaY + toNumber_2
createPointFromGML = Custom[GIS2BIM.CreatePointFromGML](XML=WebrequestKadasterPerceel, ModX=add, ModY=add_2, UnitsConversionFactor=code_block_3)  # Create Points from space seperated GML
flatten_3 = List.Flatten(list=getItemAtIndex_3)
string_5 = StringInput("Center")  # graph input
byName = TextNoteType.ByName(name=TextTypePerceel)
flatten_4 = List.Flatten(list=getItemAtIndex_4)
flatten_5 = List.Flatten(list=flatten_4)
toNumber_3 = String.ToNumber(str=flatten_5)
byLocation = TextNote.ByLocation(view=View_Revit_View, location=createPointFromGML, text=flatten_3, alignment=string_5, type=byName, rotation=toNumber_3)
