# Dynamo custom node GIS2BIM_Paging.dyf "GMLRequestPaging" (Dynamo 2.12.1.8246)
# category: KC.GIS2BIM
# Page the response of a GML request
# packages: Clockwork for Dynamo 2.x 2.1.2

query = Input(query: var[]..[])
sendTo = Custom[Clipboard.SendTo](str=query)  # package Clockwork for Dynamo 2.x; Copies a string to the clipboard.
code_block = CodeBlock { "&count=1000&startindex="; }
code_block_2 = CodeBlock { 0..9000..#10; }
code_block_3 = CodeBlock(a=sendTo, b=code_block, c=code_block_2) { a+b+c; }
web_request = WebRequest(url=code_block_3)
string = StringInput("numberReturned=\"0\"")
code_block_4 = CodeBlock { true; }
contains = String.Contains(string=web_request, searchFor=string, ignoreCase=code_block_4)
filterByBoolMask = List.FilterByBoolMask(list=web_request, mask=contains)
xml = Output(filterByBoolMask.out)
urls = Output(code_block_3)
