# Dynamo custom node GIS2BIM_WMTSDownload.dyf "WMTSDownload" (Dynamo 2.12.1.8246)
# category: KC.GIS2BIM
# Download an image from WMTS Server based on a boundingbox, image size and service capabilities.

wmtsServerURLs = Input(wmtsServerURLs: var[]..[])
layers = Input(layers: var[]..[] = null)
tileMatrixSets = Input(tileMatrixSets: var[]..[] = null)

# group: Possible Additional Parameters
code_block = CodeBlock { XYOrder = true; topLeftOrigin = true; }

# group: Extract Data from Capabilities
py = Python(IN[0]=wmtsServerURLs, IN[1]=layers, IN[2]=tileMatrixSets)  # "GetWMTSURLTemplate.py"; CPython3
# ---------- py.python (95 lines) ----------
# Load the Python Standard and DesignScript Libraries
import sys
import clr
clr.AddReference('ProtoGeometry')
from Autodesk.DesignScript.Geometry import *

# sys.path.append("C:\Program Files (x86)\IronPython 2.7\Lib")

import re
import requests
import xmltodict

# The inputs to this node will be stored as a list in the IN variables.
urls = IN[0]
selectedLayers = IN[1]
selectedTileSets = IN[2]

# Helper Functions
def getOnlyFirstOrSelected(collection, selector = None, idPath = None):
    if type(collection) is list:
        # Fallback: Use first layer
        selectedItem = collection[0]
        
        if selector is not None and idPath is not None:
            for index, item in enumerate(collection):
                if item[idPath] == selector:
                    selectedItem = collection[index]
    else:
        selectedItem = collection
    
    return selectedItem

# Function wrapper for automatic lacing
def getLevelsForLayer(baseurl, selectedLayer, selectedTileSet):
    
    # STEP 1: Download Capabilites XML
    url = baseurl + '?request=GetCapabilities&service=wmts' 
    xml = requests.get(url).content
    
    data = xmltodict.parse(xml)
    
    # STEP 2: Parse Capabilities
    availableLayers = data['Capabilities']['Contents']['Layer']
    layerData = getOnlyFirstOrSelected(availableLayers, selectedLayer, 'ows:Identifier')
    
    try:
        templateURL = getOnlyFirstOrSelected(layerData['ResourceURL'])['@template']
    except:
        #templateURL = baseurl + '/' + selectedLayer + '/{TileMatrixSet}/{TileMatrix}/{TileCol}/{TileRow}.png'
        templateURL = baseurl + '?layer=' + selectedLayer + '&style={Style}&tilematrixset={TileMatrixSet}&Service=WMTS&Request=GetTile&Version=1.0.0&Format=image/png&TileMatrix={TileMatrix}&TileCol={TileCol}&TileRow={TileRow}'
    
    try:
        defaultStyle = getOnlyFirstOrSelected(layerData['Style'])['ows:Identifier']
    except:
        defaultStyle = 'default'
        
    tileMatrixSet = getOnlyFirstOrSelected(layerData['TileMatrixSetLink'], selectedTileSet, 'TileMatrixSet')['TileMatrixSet']
    
    # print('URL', templateURL, defaultStyle, tileMatrixSet)
    
    templateURL = re.sub('{Style}', defaultStyle, templateURL)
    templateURL = re.sub('{TileMatrixSet}', tileMatrixSet, templateURL)
    
    # print('URL', templateURL, defaultStyle, tileMatrixSet)
    
    return [templateURL, tileMatrixSet]
    
if type(urls) is list:
    templates = []
    tileMatrices = []
    for index, url in enumerate(urls):
        if selectedLayers is not None: 
            if type(selectedLayers) == list:
                layer = selectedLayers[index]
            else: 
                layer = selectedLayers 
        else:
            layer = None
        if selectedTileSets is not None: 
            if type(selectedTileSets) == list:
                tileSet = selectedTileSets[index]
            else: 
                tileSet = selectedTileSets 
        else:
            tileSet = None
        result = getLevelsForLayer(url, layer, tileSet)
        templates.append(result[0])
        tileMatrices.append(result[1])
    layerTemplates = [templates, tileMatrices]
else:
    print('DATA', urls, selectedLayers, selectedTileSets)
    layerTemplates = getLevelsForLayer(urls, selectedLayers, selectedTileSets)

# STEP 3: Return Zoom Levels
OUT = layerTemplates
# ----------------------------------------
code_block_2 = CodeBlock(result=py) { URLTemplates = result[0]; TileSets = result[1]; }
py_2 = Python(IN[0]=wmtsServerURLs, IN[1]=code_block_2.TileSets, IN[2]=code_block.XYOrder)  # "GetWMTSZoomLevels.py"; CPython3
# ---------- py_2.python (95 lines) ----------
# Load the Python Standard and DesignScript Libraries
import sys
import clr
clr.AddReference('ProtoGeometry')
from Autodesk.DesignScript.Geometry import *

# sys.path.append("C:\Program Files (x86)\IronPython 2.7\Lib")

import requests
import xmltodict

# The inputs to this node will be stored as a list in the IN variables.
urls = IN[0]
tileSets = IN[1]
XYOrder = IN[2]

# Helper Functions
def getOnlyFirstOrSelected(collection, selector = None, idPath = None):
    if type(collection) == list:
        # Fallback: Use first layer
        selectedItem = collection[0]
        
        if selector is not None and idPath is not None:
            for index, item in enumerate(collection):
                if item[idPath] == selector:
                    selectedItem = collection[index]
    else:
        selectedItem = collection
    
    return selectedItem

# Function wrapper for automatic lacing
def getLevelsForLayer(url, tileSet):
    url += '?request=GetCapabilities&service=wmts'
    # STEP 1: Download Capabilites XML
    xml = requests.get(url).content
    
    data = xmltodict.parse(xml)
    
    # STEP 2: Parse Capabilities
    tileMatrices = getOnlyFirstOrSelected(data['Capabilities']['Contents']['TileMatrixSet'], tileSet, 'ows:Identifier')['TileMatrix']
    
    pixelSize = 0.00028 # meter per pixel
    
    # Ordering of the Coordinates depends on the CRS - figure out automatically?
    if XYOrder:
        rowIndex = 1
        columnIndex = 0
    else:
        rowIndex = 0
        columnIndex = 1
    
    zoomLevels = []
    for tileMatrix in tileMatrices:
        
        identifier = tileMatrix['ows:Identifier']
        scaleDenominator = float(tileMatrix['ScaleDenominator'])
        rowOrigin = float(tileMatrix['TopLeftCorner'].split(' ')[rowIndex])
        columnOrigin = float(tileMatrix['TopLeftCorner'].split(' ')[columnIndex])
        tileWidth = int(tileMatrix['TileWidth'])
        tileHeight = int(tileMatrix['TileHeight'])
        matrixWidth = int(tileMatrix['MatrixWidth'])
        matrixHeight = int(tileMatrix['MatrixHeight'])
        
        # calculate additional attributes
        tileResolution = pixelSize * scaleDenominator
        tileContentSize = tileWidth * tileResolution
        
        zoomLevel = {
            'identifier': identifier,
            'scaleDenominator': scaleDenominator,
            'rowOrigin': rowOrigin,
            'columnOrigin': columnOrigin,
            'tileWidth': tileWidth,
            'tileHeight': tileHeight,
            'matrixWidth': matrixWidth,
            'matrixHeight': matrixHeight,
            'resolution': tileResolution,
            'tileContentSize': tileContentSize,
        }
        
        zoomLevels.append(zoomLevel)
        
    return zoomLevels

# Lacing Code
if type(urls) is list:
    layerLevels = []
    for index, url in enumerate(urls):
        layerLevels.append(getLevelsForLayer(url, tileSets[index]))
else:
    layerLevels = getLevelsForLayer(urls, tileSets)

# STEP 3: Return Zoom Levels
OUT = layerLevels
# ----------------------------------------

bboxSize = Input(bboxSize: var[]..[])
targetSizeOnSheet = Input(targetSizeOnSheet: var[]..[] = 100)
py_3 = Python(IN[0]=bboxSize, IN[1]=targetSizeOnSheet)  # "SheetResolution.py"; CPython3
# ---------- py_3.python (19 lines) ----------
# Load the Python Standard and DesignScript Libraries
import sys
import clr
clr.AddReference('ProtoGeometry')
from Autodesk.DesignScript.Geometry import *

# The inputs to this node will be stored as a list in the IN variables.
bboxDiameter = IN[0]
sizeOnSheet = IN[1]

MM_IN_INCH = 25.4
TARGET_PRINT_RESOLUTION = 300 # dpi

pixelsPerImage = TARGET_PRINT_RESOLUTION * sizeOnSheet / MM_IN_INCH

metersPerPixel = bboxDiameter / pixelsPerImage

# Assign your output to the OUT variable.
OUT = metersPerPixel
# ----------------------------------------

# group: Select ZoomLevel
code_block_3 = CodeBlock(zoomLevels=py_2, targetResolution=py_3) { zoomLevels; targetResolution; }
py_4 = Python(IN[0]=code_block_3.zoomLevels, IN[1]=code_block_3.targetResolution)  # "selectZoomLevel.py"; CPython3
# ---------- py_4.python (29 lines) ----------
# Load the Python Standard and DesignScript Libraries
import sys
import clr
clr.AddReference('ProtoGeometry')
from Autodesk.DesignScript.Geometry import *

# The inputs to this node will be stored as a list in the IN variables.
zoomLevelsPerLayer = IN[0]
targetResolution = IN[1] # m/pixel ~ 1.6 = 3000px for 500m

def pickZoomLevel(zoomLevels):
    selectedZoomLevel = zoomLevels[-1]
    for zoomLevel in zoomLevels:
        resolution = zoomLevel['resolution']
        if resolution < targetResolution:
            selectedZoomLevel = zoomLevel
            break;

    return selectedZoomLevel

if type(zoomLevelsPerLayer[0]) == list:
    selectedLevels = []
    for layer in zoomLevelsPerLayer:
        selectedLevels.append(pickZoomLevel(layer))
else:
    selectedLevels = pickZoomLevel(zoomLevelsPerLayer)

# Assign your output to the OUT variable.
OUT = selectedLevels
# ----------------------------------------

xCoordinate = Input(xCoordinate: var[]..[])
yCoordinate = Input(yCoordinate: var[]..[])

# group: Prepare Tile URLs
code_block_4 = CodeBlock(urlTemplates=code_block_2.URLTemplates, zoomLevels=py_4, RDx=xCoordinate, RDy=yCoordinate, bboxDiameter=bboxSize) { urlTemplates; zoomLevels; RDx; RDy; bboxDiameter; }
py_5 = Python(IN[0]=code_block_4.urlTemplates, IN[1]=code_block_4.zoomLevels, IN[2]=code_block_4.RDx, IN[3]=code_block_4.RDy, IN[4]=code_block_4.bboxDiameter)  # "CreateTileURLs.py"; CPython3
# ---------- py_5.python (77 lines) ----------
# Load the Python Standard and DesignScript Libraries
import sys
import clr
clr.AddReference('ProtoGeometry')
from Autodesk.DesignScript.Geometry import *

import math

# The inputs to this node will be stored as a list in the IN variables.
urlTemplates = IN[0]
zoomLevels = IN[1]
X = int(IN[2])
Y = int(IN[3])
bboxRadius = float(IN[4]) / 2


def getURLsForLayerAndLevel(urlTemplate, zoomLevel):
    
    # Calculate BBox Extends
    bboxTop = Y + bboxRadius
    bboxBottom = Y - bboxRadius
    bboxLeft = X - bboxRadius
    bboxRight = X + bboxRadius
    
    # Calculate Tile Coordinates
    rowBase = zoomLevel['rowOrigin']
    colBase = zoomLevel['columnOrigin']
    tileContentSize = zoomLevel['tileContentSize']
    tileMatrix = zoomLevel['identifier']
    tilePixelSize = zoomLevel['tileWidth']
    
    tileRowMinParam = (rowBase - bboxTop) / tileContentSize
    tileColumnMinParam = (bboxLeft - colBase) / tileContentSize
    tileRowMaxParam = (rowBase - bboxBottom) / tileContentSize
    tileColumnMaxParam = (bboxRight - colBase) / tileContentSize
    
    
    
    tileRowMin = math.floor(tileRowMinParam)
    tileColumnMin = math.floor(tileColumnMinParam)
    tileRowMax = math.floor(tileRowMaxParam)
    tileColumnMax = math.floor(tileColumnMaxParam)
    
    rowTileNumbers = range(tileRowMin, tileRowMax + 1)
    colTileNumbers = range(tileColumnMin, tileColumnMax + 1)
    
    print('VALUES', rowBase, bboxTop, bboxBottom, tileRowMin, tileRowMax, tileColumnMin, tileColumnMax, tileContentSize, zoomLevel['resolution'], zoomLevel['scaleDenominator'], zoomLevel['matrixWidth'])
    
    # Prepare URLs
    urls = []
    for row in rowTileNumbers:
        for column in colTileNumbers:
            urls.append(urlTemplate.format(TileMatrix = tileMatrix, TileRow = row, TileCol = column))
    
    # Get Cropping Information in pixels
    topDiff = (tileRowMinParam - tileRowMin) * tilePixelSize
    leftDiff = (tileColumnMinParam - tileColumnMin) * tilePixelSize
    bottomDiff = (1 - (tileRowMaxParam - tileRowMax)) * tilePixelSize
    rightDiff = (1 - (tileColumnMaxParam - tileColumnMax)) * tilePixelSize
    
    cropDiffs = [topDiff, leftDiff, bottomDiff, rightDiff]

    return [len(rowTileNumbers), len(colTileNumbers), tilePixelSize, cropDiffs, urls]


if type(urlTemplates) is list:
    urlLists = []
    for index, template in enumerate(urlTemplates):
        urlLists.append(getURLsForLayerAndLevel(template, zoomLevels[index]))
else:
    urlLists = getURLsForLayerAndLevel(urlTemplates, zoomLevels)


# Return URL(s)
OUT = urlLists

# print('TILE COORDINATES', tileRowMin, tileRowMax, tileColumnMin, tileColumnMax, tileMatrix)
# ----------------------------------------

# group: Download and Combine
py_6 = Python(IN[0]=py_5)  # "DownloadAndCombineWMTSTiles.py"; CPython3
# ---------- py_6.python (73 lines) ----------
import sys
sys.path.append("C:\Program Files (x86)\IronPython 2.7\Lib")

import clr
clr.AddReference("System.Drawing")
clr.AddReference("System")
from System.Drawing import Image
from System.Drawing import Image
from System.Drawing import Bitmap
from System.Drawing import Graphics
from System.Net import WebRequest

# The inputs to this node will be stored as a list in the IN variables.
urlResults = IN[0]

def downloadWMTSTiles(urls):
    bitmaps = []
    for i in urls:
    	request = WebRequest.Create(i)
    	request.Accept = "text/html"
    	request.UserAgent = "Mozilla/5.0"
    	response = request.GetResponse()
    	bitmaps.append(Image.FromStream(response.GetResponseStream()))
    
    return bitmaps

def combineTiles(tiles, rowCount, colCount, pixels, cropDiffs):
    topDiff, leftDiff, bottomDiff, rightDiff = cropDiffs

    totalHeight = rowCount * pixels - topDiff - bottomDiff
    totalWidth = colCount * pixels - leftDiff - rightDiff
    
    # create image object for the new image
    combinedImage = Bitmap(totalWidth, totalHeight)
    combinedImageGraphics = Graphics.FromImage(combinedImage)
    
    rowPositions = []
    colPositions = []
    
    for i in range(rowCount):
        for j in range(colCount):
            rowPositions.append(i * pixels - topDiff) # Move "out" of image to crop
            colPositions.append(j * pixels - leftDiff)
    
    # print('DEBUG', len(bitmaps), rowCount, colCount, rowPositions, colPositions, totalHeight, totalWidth)
    
    for image, x, y in zip(tiles, colPositions, rowPositions):
    	combinedImageGraphics.DrawImage(image, x, y, pixels, pixels)
    
    return combinedImage


if type(urlResults[0]) is list:
    images = []
    for urlResult in urlResults:
        rowCount = urlResult[0]
        columnCount = urlResult[1]
        pixels = urlResult[2]
        cropDiffs = urlResult[3]
        urls = urlResult[4]
        tiles = downloadWMTSTiles(urls)
        images.append(combineTiles(tiles, rowCount, columnCount, pixels, cropDiffs))
else:
    rowCount = urlResults[0]
    columnCount = urlResults[1]
    pixels = urlResults[2]
    cropDiffs = urlResults[3]
    urls = urlResults[4]
    tiles = downloadWMTSTiles(urls)
    images = combineTiles(tiles, rowCount, columnCount, pixels, cropDiffs)

# Assign your output to the OUT variable.
OUT = images
# ----------------------------------------

TileImages = Output(py_6)
TileURLs = Output(py_5)
