# Dynamo custom node RemoveImages.dyf (Dynamo 2.12.1.8246)
# category: KC
# Takes a list of image names and removes them (including duplicates and their type) from Revit.
# packages: archi-lab.net 2023.213.1523

categories = Categories("OST_RasterImages")
byCategory = archilab.Revit.Selection.Select.ByCategory(category=categories)
Images = Input(Images: var[]..[])
name = Element.Name(element=byCategory)
py = Python(IN[0]=Images, IN[1]=name)  # "ListContainsList.py"; CPython3
# ---------- py.python (24 lines) ----------
# Load the Python Standard and DesignScript Libraries
import sys
import clr
clr.AddReference('ProtoGeometry')
from Autodesk.DesignScript.Geometry import *

# The inputs to this node will be stored as a list in the IN variables.
toCheckIn = IN[0]
toCheck = IN[1]

# Place your code below this line

resultBoolList = []

for item in toCheck:
    result = False
    for testItem in toCheckIn:
        if testItem and item.startswith(testItem):
            result = True
    resultBoolList.append(result)


# Assign your output to the OUT variable.
OUT = resultBoolList
# ----------------------------------------
filterByBoolMask = List.FilterByBoolMask(list=byCategory, mask=py)
type = archilab.Revit.Elements.Elements.Type(element=filterByBoolMask.in)
delete = Element.Delete(element=type)
Success = Output(delete)
