# Dynamo custom node View_SelectByName.dyf "SelectByName" (Dynamo 2.13.1.3887)
# category: KC.View
# Select a view by its name

view_type = ViewTypesUi(index=9)
getByType = archilab.Revit.Views.Views.GetByType(viewType=view_type)
view_type_2 = ViewTypesUi(index=18)
getByType_2 = archilab.Revit.Views.Views.GetByType(viewType=view_type_2)
view_type_3 = ViewTypesUi(index=19)
getByType_3 = archilab.Revit.Views.Views.GetByType(viewType=view_type_3)
view_type_4 = ViewTypesUi(index=7)
getByType_4 = archilab.Revit.Views.Views.GetByType(viewType=view_type_4)
view_type_5 = ViewTypesUi(index=21)
getByType_5 = archilab.Revit.Views.Views.GetByType(viewType=view_type_5)
view_type_6 = ViewTypesUi(index=11)
getByType_6 = archilab.Revit.Views.Views.GetByType(viewType=view_type_6)
list_create = List.Create(item0=getByType, item1=getByType_2, item2=getByType_3, item3=getByType_4, item4=getByType_5, item5=getByType_6)
flatten = List.Flatten(list=list_create)
watch = Watch(flatten)
name = Element.Name(element=flatten)
Viewname = Input(Viewname: var[]..[])
code_block = CodeBlock { true; }
contains = String.Contains(searchFor=Viewname, ignoreCase=code_block)  # unwired: string
map = List.Map(list=name, f_x=contains)
watch_2 = Watch(map)
code_block_2 = CodeBlock { true; }
firstIndexOf = List.FirstIndexOf(list=watch_2, item=code_block_2)
watch_3 = Watch(firstIndexOf)
getItemAtIndex = List.GetItemAtIndex(list=watch, index=watch_3)
view = Output(getItemAtIndex)
code_block_3 = CodeBlock(a=getItemAtIndex) { a[0]; }
code_block_4 = CodeBlock {  }
