# Dynamo graph GIS2BIM_KLIK_V1.dyn "MLA_GIS2BIM_KLIK_V1" (Dynamo 2.12.1.8246)
# packages: GIS2BIM for Dynamo 2.x 0.11.24

filePaths = Custom[FilePaths]()  # Gets the filepaths from the model.
# note: tested with:
# - revit 2022.1
# - dynamo 2.12.1
# python (default) dependencies:
# -json
# -Path
# -time
# input = list of klicfiles generated with the klicviewer
GIS2BIM_GetSharedCoordinate = Custom[GIS2BIM_GetSharedCoordinate]()  # package GIS2BIM for Dynamo 2.x; Get the current shared coordinate
KLICToCurves = Custom[KLICToCurves](filepaths=filePaths.05_KLICfiles, RDX=GIS2BIM_GetSharedCoordinate.EastWest, RDY=GIS2BIM_GetSharedCoordinate.NorthSouth)  # Reads the KLIC json files and filters the lines
byCurve = ModelCurve.ByCurve(curve=KLICToCurves.1_curves)
code_block = CodeBlock { "Line Style"; }
getAll = Custom[GetAll]()  # Gets all Graphic Styles in the project.
byName = Custom[ByName](LineTypeName=KLICToCurves.3_LineTypeNames, LineTypeNamesInProject=getAll.01_Names, GraphicstylesInProject=getAll.02_Graphicstyles)  # Get a Graphic Style by name
setParameterByName = Element.SetParameterByName(element=byCurve@@L2, parameterName=code_block, value=byName@L1)
