# Dynamo custom node GraphicStyle_ByName.dyf "ByName" (Dynamo 2.12.1.8246)
# category: MLA+.GraphicStyle
# Get a Graphic Style by name

LineTypeName = Input(LineTypeName: string[])
LineTypeNamesInProject = Input(LineTypeNamesInProject: string[])
GraphicstylesInProject = Input(GraphicstylesInProject: Revit.Elements.Element[])
getgraphicstyles = Python(IN[0]=LineTypeName, IN[1]=LineTypeNamesInProject, IN[2]=GraphicstylesInProject)  # CPython3
# ---------- getgraphicstyles.python (39 lines) ----------
import clr
clr.AddReference('RevitAPI')
import Autodesk
from Autodesk.Revit.DB import *

clr.AddReference('RevitNodes')
import Revit
clr.ImportExtensions(Revit.Elements)

clr.AddReference('RevitServices')
import RevitServices
from RevitServices.Persistence import DocumentManager

# The inputs to this node will be stored as a list in the IN variables.
dataEnteringNode = IN

KLICfeaturetypes= IN[0]
Linestylenames = IN[1]
graphicstyles = IN[2]

#get current document and graphic category of graphicstyles
doc = DocumentManager.Instance.CurrentDBDocument
cat = Category.GetCategory(doc, BuiltInCategory.OST_Lines)
gs = cat.GetGraphicsStyle(GraphicsStyleType.Projection)
gscat = gs.GraphicsStyleCategory.SubCategories

OUTgraphicstyles = []

for featuretype in KLICfeaturetypes:
    print(featuretype)
    try:
        i = Linestylenames.index(featuretype)
        print(i)
        OUTgraphicstyles.append(graphicstyles[i])
    except:
        print("linestyle not found in project")
        OUTgraphicstyles.append(graphicstyles[1])

OUT = OUTgraphicstyles
# ----------------------------------------
n01_graphicstyle = Output(getgraphicstyles)  # "01 graphicstyle"
