# Dynamo custom node GraphicStyle_GetAll.dyf "GetAll" (Dynamo 2.12.1.8246)
# category: MLA+.GraphicStyle
# Gets all Graphic Styles in the project.

python_script = Python()  # CPython3; unwired: IN[0]
# ---------- python_script.python (37 lines) ----------
import clr
clr.AddReference('RevitAPI')
import Autodesk
from Autodesk.Revit.DB import *

clr.AddReference('RevitNodes')
import Revit
clr.ImportExtensions(Revit.Elements)

clr.AddReference('RevitServices')
import RevitServices
from RevitServices.Persistence import DocumentManager
# The inputs to this node will be stored as a list in the IN variables.
dataEnteringNode = IN

doc = DocumentManager.Instance.CurrentDBDocument
cat = Category.GetCategory(doc, BuiltInCategory.OST_Lines)
gs = cat.GetGraphicsStyle(GraphicsStyleType.Projection)
gscat = gs.GraphicsStyleCategory.SubCategories

Linestylenames = []
Linestyles = []
Linegraphicstylepatternids = []

#get all linestyles in document  
for i in gscat:
    #get all linestylenames
    Linestylename = i.Name
    Linestylenames.append(Linestylename)
    #get all grahicstyle of all linestyles
    Linegraphicstyle = i.GetGraphicsStyle(GraphicsStyleType.Projection)
    Linestyles.append(Linegraphicstyle)
    #get all pattern id`s of graphicstyles
    Linegraphicstylepatternid = i.GetLinePatternId(GraphicsStyleType.Projection)
    Linegraphicstylepatternids.append(Linegraphicstylepatternid)
    
OUT = Linestylenames, Linestyles, Linegraphicstylepatternids
# ----------------------------------------
code_block = CodeBlock(l=python_script) { l[0]; l[1]; l[2]; }
n01_Names = Output(code_block.out0)  # "01 Names"
n02_Graphicstyles = Output(code_block.out1)  # "02 Graphicstyles"
n03_GraphicStylesPatternIds = Output(code_block.out2)  # "03 GraphicStylesPatternIds"
