# Dynamo custom node LineStyle_Create.dyf "Create" (Dynamo 2.12.1.8246)
# category: MLA+.LineStyle
# Create a new line style

name = Input(name: string)
graphicstyle = Input(graphicstyle: Revit.Elements.LinePatternElement)
weight = Input(weight: int = 2)
RGB = Input(RGB: int[] = [255, 255, 255])
python_script_get_or_create = Python(IN[0]=name, IN[1]=graphicstyle, IN[2]=weight, IN[3]=RGB)  # "Python Script get or create graphicstyles"; CPython3
# ---------- python_script_get_or_create.python (50 lines) ----------
import clr
clr.AddReference('RevitAPI')
import Autodesk
from Autodesk.Revit.DB import *

clr.AddReference('RevitNodes')
import Revit
clr.ImportExtensions(Revit.Elements)

clr.AddReference('RevitServices')
import RevitServices
from RevitServices.Persistence import DocumentManager
from RevitServices.Transactions import TransactionManager

import random

# The inputs to this node will be stored as a list in the IN variables.
dataEnteringNode = IN

NewLineStyleName = IN[0]
graphicstylepatternid = [1]
weight = IN[2]
color = IN[3]

#get current document and graphic category of graphicstyles
doc = DocumentManager.Instance.CurrentDBDocument
cat = Category.GetCategory(doc, BuiltInCategory.OST_Lines)
gs = cat.GetGraphicsStyle(GraphicsStyleType.Projection)
gscat = gs.GraphicsStyleCategory.SubCategories

#create new linstyle
def createnewlinestyle(name, weight, linePatternElemId, color):
    TransactionManager.Instance.EnsureInTransaction(doc)
    newLineStyleSubCat = doc.Settings.Categories.NewSubcategory(cat, name)
    newLineStyleSubCat.SetLineWeight(weight,GraphicsStyleType.Projection)
    newLineStyleSubCat.LineColor = color
    newLineStyleSubCat.SetLinePatternId(linePatternElem, GraphicsStyleType.Projection)
    TransactionManager.Instance.TransactionTaskDone()
    return(newLineStyleSubCat.GetGraphicsStyle(GraphicsStyleType.Projection))

try:
    color = Autodesk.Revit.DB.Color(color[0],color[1],color[2])
    linestyle = createnewlinestyle(NewLineStyleName, weight, graphicstylepatternid, color)
    print("linestyle created: " + linestyle + " with color: ", color[0], "_", color[1], "_",color[2])
except:
    linestyle = NewLineStyleName
    print("linestyle: " + linestyle + " bestaat al")
  
            
OUT = linestyle
# ----------------------------------------
n01_LineStyleName = Output(python_script_get_or_create)  # "01 LineStyleName"
