# Dynamo graph Mesh.dyn (Dynamo 1.3.1.1736)

code_block = CodeBlock()
# ---------- code_block.designscript (6 lines) ----------
Point.ByCoordinates(0,0,0);
Point.ByCoordinates(1000,0,0);
Point.ByCoordinates(1000,1000,0);
Point.ByCoordinates(1000,1000,1000);
Point.ByCoordinates(1000,0,1000);
Point.ByCoordinates(0,1000,1000);
# ----------------------------------------
create = List.Create(code_block.out0, code_block.out1, code_block.out2, code_block.out3, code_block.out4, code_block.out5)
code_block_2 = CodeBlock { 0; 1; 2; 3; 4; 5; }
byIndices = IndexGroup.ByIndices(code_block_2.out0, code_block_2.out1, code_block_2.out2)
byIndices_2 = IndexGroup.ByIndices(code_block_2.out3, code_block_2.out4, code_block_2.out5)
byIndices_3 = IndexGroup.ByIndices(code_block_2.out0, code_block_2.out2, code_block_2.out5)
create_2 = List.Create(byIndices, byIndices_2, byIndices_3)
byPointsFaceIndices = Mesh.ByPointsFaceIndices(create, create_2)
