# Dynamo custom node GIS2BIM.PointListPolygonAreaAndDirection.dyf (Dynamo 1.3.0.875)
# category: GIS2BIM.Geometry
# Determines the area of a polygon constructed from a list of points, and if the direction of the points in the list is clockwise.
# https://en.wikipedia.org/wiki/Shoelace_formula

pointList = Input()
code_block = CodeBlock { 1; }
shiftIndices = List.ShiftIndices(list=pointList, amount=code_block, lacing=Longest)
X = Point.X(shiftIndices)
X_2 = Point.X(pointList)
Y = Point.Y(shiftIndices)
Y_2 = Point.Y(pointList)
code_block_2 = CodeBlock(x2=X, x1=X_2, y2=Y, y1=Y_2) { A2=(x2-x1)*(y2+y1)/2; }
sum = Math.Sum(code_block_2)
code_block_3 = CodeBlock(x=sum) { x>0; x; -x; }
clockwise = Output(code_block_3.out0)
if_ = If(test=code_block_3.out0, true=code_block_3.x, false=code_block_3.out2)
Area = Output(if_)
