# Dynamo custom node GIS2BIM.convertRD&WGS84 (1).dyf "GIS2BIM.convertRD&WGS84" (Dynamo 1.3.0.875)
# category: GIS2BIM.DutchGEO
# Converts coördinates between Rijksdriehoeksstelsel and WGS84 and vice-versa, as long as the result is within tolerance.

coordinates = Input(coordinates: double[][])
flatten = Flatten(coordinates)
code_block = CodeBlock(x=flatten) { x[0]; }
string_from_object = FromObject(code_block)
code_block_2 = CodeBlock { ","; "."; "°"; }
split = String.Split(string_from_object, code_block_2.out0, code_block_2.out1, code_block_2.out2)
firstItem = List.FirstItem(split@@L2)
length = String.Length(firstItem)
code_block_3 = CodeBlock(x=length) { x>3; }
code_block_4 = CodeBlock(x=code_block_3) { x[0]; }
toggle = Input(toggle: bool=true)
convertBetweenRijksdriehoeksstelselAndWG = Python(IN[0]=flatten, IN[1]=code_block_4, IN[2]=toggle)  # "ConvertBetweenRijksdriehoeksstelselAndWGS84"
# ---------- convertBetweenRijksdriehoeksstelselAndWG.python (90 lines) ----------
#https://thomasv.nl/2014/03/rd-naar-gps/
#nog te verifieren tegen
#https://www.kadaster.nl/transformatie-van-coordinaten
#http://www.gpscoordinaten.nl/converteer-rd-coordinaten.php

#nog om te zetten naar code die input accepteert en output geeft naar Dynamo ipv print naar scherm.


# Formules voor benadering zijn gebaseerd op http://www.dekoepel.nl/pdf/Transformatieformules.pdf
# Bovenstaande link werkt helaas niet meer, daar Stiching de Koepel opgeheven is. Backup link: http://media.thomasv.nl/2015/07/Transformatieformules.pdf

class RDWGSConverter:

    X0      = 155000
    Y0      = 463000
    phi0    = 52.15517440
    lam0    = 5.38720621

    def fromRdToWgs( self, coords ):

        Kp = [0,2,0,2,0,2,1,4,2,4,1]
        Kq = [1,0,2,1,3,2,0,0,3,1,1]
        Kpq = [3235.65389,-32.58297,-0.24750,-0.84978,-0.06550,-0.01709,-0.00738,0.00530,-0.00039,0.00033,-0.00012]

        Lp = [1,1,1,3,1,3,0,3,1,0,2,5]
        Lq = [0,1,2,0,3,1,1,2,4,2,0,0]
        Lpq = [5260.52916,105.94684,2.45656,-0.81885,0.05594,-0.05607,0.01199,-0.00256,0.00128,0.00022,-0.00022,0.00026]

        dX = 1E-5 * ( coords[0] - self.X0 )
        dY = 1E-5 * ( coords[1] - self.Y0 )
        
        phi = 0
        lam = 0

        for k in range(len(Kpq)):
            phi = phi + ( Kpq[k] * dX**Kp[k] * dY**Kq[k] )
        phi = self.phi0 + phi / 3600

        for l in range(len(Lpq)):
            lam = lam + ( Lpq[l] * dX**Lp[l] * dY**Lq[l] )
        lam = self.lam0 + lam / 3600

        return [phi,lam]

    def fromWgsToRd( self, coords ):
        
        Rp = [0,1,2,0,1,3,1,0,2]
        Rq = [1,1,1,3,0,1,3,2,3]
        Rpq = [190094.945,-11832.228,-114.221,-32.391,-0.705,-2.340,-0.608,-0.008,0.148]

        Sp = [1,0,2,1,3,0,2,1,0,1]
        Sq = [0,2,0,2,0,1,2,1,4,4]
        Spq = [309056.544,3638.893,73.077,-157.984,59.788,0.433,-6.439,-0.032,0.092,-0.054]

        dPhi = 0.36 * ( coords[0] - self.phi0 )
        dLam = 0.36 * ( coords[1] - self.lam0 )

        X = 0
        Y = 0

        for r in range( len( Rpq ) ):
            X = X + ( Rpq[r] * dPhi**Rp[r] * dLam**Rq[r] ) 
        X = self.X0 + X

        for s in range( len( Spq ) ):
            Y = Y + ( Spq[s] * dPhi**Sp[s] * dLam**Sq[s] )
        Y = self.Y0 + Y

        return [X,Y]

coordXY=IN[0]
RDyn=IN[1]
conv = []
control=[]
namespace = RDWGSConverter()

if RDyn == True:
    conv = namespace.fromRdToWgs( coordXY )
    control = namespace.fromWgsToRd( conv )
    controlvalues = namespace.fromRdToWgs( control )

else:
    conv = namespace.fromWgsToRd( coordXY )
    control = namespace.fromRdToWgs( conv )
    controlvalues = namespace.fromWgsToRd( control )

dev=[a - b for a, b in zip(conv, controlvalues)]

#Assign your output to the OUT variable.
OUT = (conv, control, dev)
# ----------------------------------------
tolerance = Input(tolerance: double=1)
code_block_5 = CodeBlock(x=convertBetweenRijksdriehoeksstelselAndWG, t=tolerance)
# ---------- code_block_5.designscript (4 lines) ----------
exceedsTolerance=Math.Abs(x[2])*1000>t;
inrange=exceedsTolerance[0]==false&&exceedsTolerance[1]==false;
x[0];
"out of range";
# ----------------------------------------
if_ = If(test=code_block_5.inrange, true=code_block_5.out2, false=code_block_5.out3)
uniqueItems = List.UniqueItems(if_)
result = Output(uniqueItems)
