# Dynamo graph topo.dyn (Dynamo 1.3.0.875)

file_path = Filename("M:\2017\2017056_Mitros Terwijde_Leidse Rijn\10_Incoming\AHN\2017056_pointcloud_maaiveld_thinadaptive5.txt")
getSharedCoordinate = Custom[GIS2BIM.GetSharedCoordinate]()  # Get the current shared coordinate
code_block = CodeBlock { z=0; scale=1000; }
filepath_for_delimited_txt = Python(IN[0]=file_path, IN[1]=getSharedCoordinate.RdxMeters, IN[2]=getSharedCoordinate.RdyMeters, IN[3]=code_block.z, IN[4]=code_block.scale)  # "FilePath for delimited .txt containing coordinates to set of XYZ integers"
# ---------- filepath_for_delimited_txt.python (41 lines) ----------
#©2017 Ekko Nap, ekko@groosman.com
#licensed under MIT

import clr
# Import RevitNodes

clr.AddReference("RevitNodes")
import Revit
import sys
sys.path.append("C:\Program Files (x86)\IronPython 2.7\Lib")

import itertools

clr.AddReference('ProtoGeometry')
from Autodesk.DesignScript.Geometry import *

input = IN[0]
deltaX = IN[1]
deltaY = IN[2]
deltaZ = IN[3]
scale = IN[4]

file=open(input)
linelist=file.readlines()


pointlist=[]
for i in linelist:
	strings=i.split()
	X=int(scale*(float(strings[0])-deltaX))
	Y=int(scale*(float(strings[1])-deltaY))
	Z=int(scale*(float(strings[2])-deltaZ))
	points=(X,Y,Z)
	pointlist.append(points)

#removeduplicates
pointlist_clean = set(map(tuple,pointlist))
#pointlist_clean is a tuple, a sequence of immutable Python objects
#https://www.tutorialspoint.com/python/python_tuples.htm

OUT = pointlist_clean
# ----------------------------------------

# group: the hard way
code_block_2 = CodeBlock { 0; 1; 2; }  # frozen
getItemAtIndex = List.GetItemAtIndex(list=filepath_for_delimited_txt, index=code_block_2.out0, lacing=Longest)
getItemAtIndex_2 = List.GetItemAtIndex(list=filepath_for_delimited_txt, index=code_block_2.out1, lacing=Longest)
getItemAtIndex_3 = List.GetItemAtIndex(list=filepath_for_delimited_txt, index=code_block_2.out2, lacing=Longest)
byCoordinates = Point.ByCoordinates(x=getItemAtIndex, y=getItemAtIndex_2, z=getItemAtIndex_3)
byPoints = Topography.ByPoints(byCoordinates)

code_block_3 = CodeBlock { convertInputToFeet=true; scale=1; }
byNumber = Python(IN[0]=filepath_for_delimited_txt, IN[1]=code_block_3.convertInputToFeet, IN[2]=code_block_3.scale)  # "Topography.ByNumber"
# ---------- byNumber.python (43 lines) ----------
#©2017 Ekko Nap, ekko@groosman.com
#licensed under MIT

import clr
clr.AddReference('RevitAPI')
from Autodesk.Revit.DB import *
import Autodesk
from Autodesk.Revit.DB import Architecture
from Autodesk.Revit.DB.Architecture import *

clr.AddReference("RevitNodes")
import Revit
clr.ImportExtensions(Revit.Elements)

clr.AddReference("RevitServices")
import RevitServices
from RevitServices.Persistence import DocumentManager
from RevitServices.Transactions import TransactionManager

doc = DocumentManager.Instance.CurrentDBDocument

coordlist = IN[0]
convertToFeet=IN[1]
scale=IN[2]



if convertToFeet == 1 :
	scalefactor = 304.8/scale
else:
	scalefactor = 1/scale

XYZlist=[]
for list in coordlist:
	xyz=XYZ(list[0]/scalefactor,list[1]/scalefactor,list[2]/scalefactor)
	XYZlist.append(xyz)

TransactionManager.Instance.EnsureInTransaction(doc)

newtopo = TopographySurface.Create(doc,XYZlist)

TransactionManager.Instance.TransactionTaskDone()
OUT = newtopo
# ----------------------------------------
