# Dynamo graph NomatimWebrequest.dyn (Dynamo 1.3.1.1736)

code_block = CodeBlock()
# ---------- code_block.designscript (2 lines) ----------
"https://nominatim.openstreetmap.org/search?"
"q=";
# ----------------------------------------
code_block_2 = CodeBlock()
# ---------- code_block_2.designscript (2 lines) ----------
"https://nominatim.openstreetmap.org/search?q="501+werf van schouten+dordrecht+netherlands&format=xml&polygon=1&addressdetails=0;
"+";
# ----------------------------------------
openBrowser = Custom[GIS2BIM.OpenBrowser]()  # Opens a new window in your default browser with the given url.; unwired: url
TMS_WMTS_WebrequestAndCombineImages = Custom[GIS2BIM.TMS_WMTS_WebrequestAndCombineImages]()  # Webrequest for list of WMTS or TMS/Google webrequests for tiles. Combines them to 1 image.; unwired: URLlist, UniqueTileNumbersColumnX, UniqueTileNumbersRowY
code_block_3 = CodeBlock { "https://nominatim.openstreetmap.org/search?q="; "+"; "&format=xml&polygon=1&addressdetails=1"; }
code_block_4 = CodeBlock { "werf van schouten"; "501"; "dordrecht"; "the netherlands"; }
concat = String.Concat(code_block_3.out0, code_block_4.out0, code_block_3.out1, code_block_4.out1, code_block_3.out1, code_block_4.out2, code_block_3.out1, code_block_4.out3, code_block_3.out2)
python_script = Python(IN[0]=concat)
# ---------- python_script.python (16 lines) ----------
import clr
clr.AddReference("System.Drawing")
clr.AddReference("System")
from System.Drawing import Image
from System.Drawing import Bitmap
from System.Drawing import Graphics
from System.Drawing.Imaging import ImageFormat
from System.Net import WebRequest
url= IN[0]

request = WebRequest.Create(url)
request.Accept = "text/html"
request.UserAgent = "Mozilla/5.0"
response = request.GetResponse()

OUT = response
# ----------------------------------------
watch = Watch(python_script)
web_request = WebRequest(concat)
