# Dynamo graph NominatimXML.dyn (Dynamo 1.3.3.4111)

geoCodingGoogleAPI = Custom[GIS2BIM.GeoCodingGoogleAPI]()  # gets coordinate from adress with google API; unwired: Streetname, Housenumber, Place, Country
code_block = CodeBlock()
# ---------- code_block.designscript (1 lines) ----------
https://nominatim.openstreetmap.org/search/werf%20van%20schouten%20501%20Dordrecht%20The%20Netherlands?format=xml&addressdetails=1&limit=1&polygon_svg=1
# ----------------------------------------
TMS_WMTS_WebrequestAndCombineImages = Custom[GIS2BIM.TMS_WMTS_WebrequestAndCombineImages]()  # Webrequest for list of WMTS or TMS/Google webrequests for tiles. Combines them to 1 image.; unwired: URLlist, UniqueTileNumbersColumnX, UniqueTileNumbersRowY
code_block_2 = CodeBlock { "https://nominatim.openstreetmap.org/search/"; "%20"; "?format=xml&addressdetails=1&limit=1&polygon_svg=1"; }
code_block_3 = CodeBlock { "werf van schouten"; "501"; "dordrecht"; "the netherlands"; }
concat = String.Concat(code_block_2.out0, code_block_3.out0, code_block_2.out1, code_block_3.out1, code_block_2.out1, code_block_3.out2, code_block_2.out1, code_block_3.out3, code_block_2.out2)
openBrowser = Custom[GIS2BIM.OpenBrowser](url=concat)  # Opens a new window in your default browser with the given url.
python_script = Python(IN[0]=concat)
# ---------- python_script.python (20 lines) ----------
import clr
clr.AddReference("System.Drawing")
clr.AddReference("System")
from System.Net import WebRequest
from System.IO import StreamReader
from System.Text import Encoding

url= IN[0]

request = WebRequest.Create(url)
request.Accept = "text/html"
request.UserAgent = "Mozilla/5.0"
response = request.GetResponse()

stream = response.GetResponseStream();

reader = StreamReader(stream, Encoding.UTF8)
ResponseString = reader.ReadToEnd();

OUT = ResponseString
# ----------------------------------------
code_block_4 = CodeBlock(t5=python_script)
# ---------- code_block_4.designscript (6 lines) ----------
t4 = String.Split(t5, {" lat='"});
t6 = DSCore.List.LastItem(t4);
t7 = String.Split(t6, {"' lon="});
t8 = DSCore.List.LastItem(t7);
t9 = String.Split(t8, {"' display_name"});
t10 = DSCore.List.FirstItem(t9);
# ----------------------------------------
watch = Watch(code_block_4.t7)
firstItem = List.FirstItem(code_block_4.t7)
