# Dynamo graph BAG 3D.dyn (Dynamo 2.1.0.7500)

# group: GEOCODING
code_block = CodeBlock { "Dordrecht"; "zuidendijk"; "315"; }
getLocationdataNetherlands = Custom[GIS2BIM.GetLocationdataNetherlands](City=code_block.out0, Streetname=code_block.out1, Housenumber=code_block.out2)  # Gives locationdata based on an adress in the Netherlands

code_block_2 = CodeBlock(RDX=getLocationdataNetherlands.RDcoordinateX_meters_double, RDY=getLocationdataNetherlands.RDcoordinateY_meters_double) { RDX; RDY; }
width_boundingbox = CodeBlock { 500; }

# group: BOUNDINGBOX EN CONSTRUEER WEBREQUEST
createBoundingBox = Custom[GIS2BIM.CreateBoundingBox](CoordinateX=code_block_2.RDX, CoordinateY=code_block_2.RDY, BoxWidth=width_boundingbox, BoxHeight=width_boundingbox)  # create boundingboxstring for webrequests based on coördinates and dimensions
geoservicesLibraryNetherlands = Custom[GIS2BIM.GeoservicesLibraryNetherlands](BoundingBox_var=createBoundingBox.Boxstring)  # Library with multiple webadresses which can be used for WFS and WMS webrequests

# group: WEBREQUEST & QUERY GML
web_request = WebRequest(url=geoservicesLibraryNetherlands.3D_BAG_TU_Delft_OGC_WFS)
string = StringInput(".//{3dbag}identificatie")  # graph input
string_2 = StringInput(".//{3dbag}bouwjaar")  # graph input
string_3 = StringInput(".//{http://www.opengis.net/gml}posList")  # graph input
string_4 = StringInput(".//{3dbag}ground-0.00")  # graph input
string_5 = StringInput(".//{3dbag}ground-0.50")  # graph input
string_6 = StringInput(".//{3dbag}roof-0.00")  # graph input
string_7 = StringInput(".//{3dbag}roof-0.50")  # graph input
string_8 = StringInput(".//{3dbag}roof-0.99")  # graph input
create = List.Create(item0=string, item1=string_2, item2=string_3, item3=string_4, item4=string_5, item5=string_6, item6=string_7, item7=string_8)
XMLXPath = Custom[GIS2BIM.XMLXPath](XMLString=web_request, XPathStrings=create)  # Run an XPathquery on an xml-string

watch = Watch(web_request)
peil_tov_nap_m = CodeBlock { 0; }

# group: CONVERT GML TO POINTS
code_block_3 = CodeBlock(a=XMLXPath) { polygons=a[2]; bottom=a[4]; top=a[7]; }
code_block_4 = CodeBlock(rdx=code_block_2.RDX, rdy=code_block_2.RDY, peil_NAP=peil_tov_nap_m) { rdx; rdy; peil_NAP; }
code_block_5 = CodeBlock(t8=code_block_3.polygons, rdx=code_block_4.rdx, rdy=code_block_4.rdy, zbottom=code_block_3.bottom, peil_NAP=code_block_4.peil_NAP, ztop=code_block_3.top)
# ---------- code_block_5.designscript (9 lines) ----------
t7 = String.Split(t8, [" "]);
t9 = DSCore.List.DropEveryNthItem(t7@-2<1>, 3, 0);
rdxlist = DSCore.String.ToNumber(DSCore.List.DropEveryNthItem(t9@-2<1>, 2, 0));
rdylist = DSCore.String.ToNumber(DSCore.List.DropEveryNthItem(t9@-2<1>, 2, 1));
xlocal= DSCore.Math.Round(1000*(rdxlist-rdx));
ylocal= DSCore.Math.Round(1000*(rdylist-rdy));
zlocalbottom=1000*(DSCore.String.ToNumber(zbottom)-peil_NAP);
zlocaltop=1000*(DSCore.String.ToNumber(ztop)-peil_NAP);
thickness=zlocaltop-zlocalbottom;
# ----------------------------------------

# group: CREATE SOLID GEOMETRY
byCoordinates = Point.ByCoordinates(x=code_block_5.xlocal, y=code_block_5.ylocal, z=code_block_5.zlocalbottom)
byPoints = PolyCurve.ByPoints(points=byCoordinates)
byPatch = Surface.ByPatch(closedCurve=byPoints)
boolean = BoolSelector(false)  # graph input
thicken = Surface.Thicken(surface=byPatch, thickness=code_block_5.thickness, both_sides=boolean)

byUnion = Solid.ByUnion(solids=thicken)
