# Dynamo graph SVG test.dyn (Dynamo 1.3.4.6666)

code_block = CodeBlock { "zwijndrecht"; "wattstraat"; "17"; }
code_block_2 = CodeBlock()
# ---------- code_block_2.designscript (11 lines) ----------
"https://geodata.nationaalgeoregister.nl/top10nlv2/wms?";
"&REQUEST=GetMap";
"&VERSION=1.3.0";
"&WIDTH=3000";
"&HEIGHT=3000";
"&LAYERS=top10nlv2";
"&STYLES=";
"&TRANSPARENT=TRUE";
"&FORMAT=image/png";
"&BBOX=";
"&CRS=urn:ogc:def:crs:EPSG::28992";
# ----------------------------------------
code_block_3 = CodeBlock { "dordrecht"; "werf van schouten"; "501"; }
getLocationdataNetherlands = Custom[GIS2BIM.GetLocationdataNetherlands](City=code_block_3.out0, Streetname=code_block_3.out1, Housenumber=code_block_3.out2)  # Gives locationdata based on an adress in the Netherlands
code_block_4 = CodeBlock { 400; }
createBoundingBox = Custom[GIS2BIM.CreateBoundingBox](CoordinateX=getLocationdataNetherlands.RDcoordinateXmeters, CoordinateY=getLocationdataNetherlands.RDcoordinateYmeters, BoxWidth=code_block_4, BoxHeight=code_block_4)  # create boundingboxstring for webrequests based on coördinates and dimensions
concat = String.Concat(code_block_2.out0, code_block_2.out1, code_block_2.out2, code_block_2.out3, code_block_2.out4, code_block_2.out5, code_block_2.out6, code_block_2.out7, code_block_2.out8, code_block_2.out9, createBoundingBox.Boxstring, code_block_2.out10)
webrequestWMS2 = Custom[GIS2BIM.WebrequestWMS2](WMSwebrequest=concat)  # a webrequest based on WMS-protocol
watch_image = WatchImageCore(webrequestWMS2)
code_block_5 = CodeBlock()
# ---------- code_block_5.designscript (15 lines) ----------
inrichtingselement_punt;
plantopografie_lijn
plantopografie_punt;
plantopografie_vlak
terrein_vlak;
terrein_vlak_contour;
waterdeel_lijn
waterdeel_vlak
waterdeel_vlak_contour
wegdeel_vlak
wegdeel_vlak_contour;


"waterdeelvlak"
"wegdeelvlak";
# ----------------------------------------
code_block_6 = CodeBlock()
# ---------- code_block_6.designscript (11 lines) ----------
"https://geodata.nationaalgeoregister.nl/top10nlv2/wms?";
"&REQUEST=GetMap";
"&VERSION=1.3.0";
"&WIDTH=3000";
"&HEIGHT=3000";
"&LAYERS=waterdeelvlak";
"&STYLES=";
"&TRANSPARENT=TRUE";
"&FORMAT=image/svg";
"&BBOX=";
"&CRS=urn:ogc:def:crs:EPSG::28992";
# ----------------------------------------
code_block_7 = CodeBlock { "&FORMAT=image/png"; }
concat_2 = String.Concat(code_block_6.out0, code_block_6.out1, code_block_6.out2, code_block_6.out3, code_block_6.out4, code_block_6.out5, code_block_6.out6, code_block_6.out7, code_block_7, code_block_6.out9, createBoundingBox.Boxstring, code_block_6.out10)
webrequestWMS2_2 = Custom[GIS2BIM.WebrequestWMS2](WMSwebrequest=concat_2)
watch_image_2 = WatchImageCore(webrequestWMS2_2)
code_block_8 = CodeBlock { "dordrecht"; "werf van schouten"; "501"; }
code_block_9 = CodeBlock { "dordrecht"; "lange geldersekade"; "1"; }
code_block_10 = CodeBlock { "&LAYERS=wegdeelvlak"; }
concat_3 = String.Concat(code_block_6.out0, code_block_6.out1, code_block_6.out2, code_block_6.out3, code_block_6.out4, code_block_10, code_block_6.out6, code_block_6.out7, code_block_6.out8, code_block_6.out9, createBoundingBox.Boxstring, code_block_6.out10)
openBrowser = Custom[GIS2BIM.OpenBrowser](url=concat_3)  # Opens a new window in your default browser with the given url.
code_block_11 = CodeBlock()
# ---------- code_block_11.designscript (17 lines) ----------
//Tree
Off = 2000;
 //offset from ground
D = 3500;
 //diameter
H = 10000;
 //total height
H2 = H-Off;
 //total height min offset
P1 = Point.ByCoordinates(0,0,H-H2/2);
plne = Plane.ByOriginNormal(P1,Vector.YAxis());
A2 = EllipseArc.ByPlaneRadiiAngles(plne,H2/2,D/2,0,180);
sld1 = Solid.ByRevolve(A2, Point.ByCoordinates(0, 0, 0), Vector.ByCoordinates(0, 0, 1), 0, 360);
crcle = Circle.ByCenterPointRadius(Point.ByCoordinates(0,0,0),200);
sld2 = crcle.ExtrudeAsSolid(Off+200);
solds = {sld1,sld2};
sld = Solid.ByUnion(solds);
# ----------------------------------------

# group: OPEN STREETMAPS
code_block_12 = CodeBlock { Point.ByCoordinates(0,0,0); }
code_block_13 = CodeBlock { "28992"; "4326"; }
doubleToString = Custom[GIS2BIM.DoubleToString](CoordinateDouble=getLocationdataNetherlands.RDcoordinateXmeters)  # Converts a double to a string
doubleToString_2 = Custom[GIS2BIM.DoubleToString](CoordinateDouble=getLocationdataNetherlands.RDcoordinateYmeters)
transformCRS_epsg = Custom[GIS2BIM.TransformCRS_epsg](sourceCRS=code_block_13.out0, targetCRS=code_block_13.out1, xCoordinate=doubleToString, yCoordinate=doubleToString_2)  # Uses the API of http://epsg.io to transform Coordinate Reference Systems
doubleToString_3 = Custom[GIS2BIM.DoubleToString](CoordinateDouble=transformCRS_epsg.Ytransformed)
doubleToString_4 = Custom[GIS2BIM.DoubleToString](CoordinateDouble=transformCRS_epsg.Xtransformed)
createBoundingBoxLATLONG = Custom[GIS2BIM.CreateBoundingBoxLATLONG](Lat=doubleToString_3, Long=doubleToString_4, WidthMeters=code_block_4)  # create boundingbox with from lat/long coordinate in degrees
code_block_14 = CodeBlock { "C:/TEMP/map6.osm"; }
downloadOSM = Custom[GIS2BIM.DownloadOSM](West=createBoundingBoxLATLONG.West, East=createBoundingBoxLATLONG.East, North=createBoundingBoxLATLONG.North, South=createBoundingBoxLATLONG.South, Directory=code_block_14)  # Download OSM data within a boundingbox
python_script = Python(IN[0]=downloadOSM.DownloadlinkOSM, IN[1]=downloadOSM.Directory)
# ---------- python_script.python (10 lines) ----------
import sys
sys.path.append("C:\Program Files (x86)\IronPython 2.7\Lib")
from System.Net import WebClient

url= IN[0]
filoc= IN[1]

WebClient().DownloadFile(url, filoc)

OUT= filoc
# ----------------------------------------
location = Elk.OSM.Location(python_script)
code_block_15 = CodeBlock { "natural"; "tree"; "building"; "tree"; }
OSMData = Elk.OSM.OSMData(location, python_script, code_block_15.out0, code_block_15.out1)
byOrigin = CoordinateSystem.ByOrigin()
code_block_16 = CodeBlock(b=code_block_4) { b; -b*1000/2; }
byOrigin_2 = CoordinateSystem.ByOrigin(code_block_16.out1, code_block_16.out1)
transform = Geometry.Transform(geometry=OSMData, fromCoordinateSystem=byOrigin, contextCoordinateSystem=byOrigin_2)
flatten = Flatten(transform)
byTwoPoints = Vector.ByTwoPoints(start=code_block_12, end=flatten)

translate = Geometry.Translate(geometry=code_block_11.sld, direction=byTwoPoints)
code_block_17 = CodeBlock(fces=translate) { Display.ByGeometryColor(fces,Color.ByARGB(255,223,230,208)); }
geoservicesLibraryNetherlands = Custom[GIS2BIM.GeoservicesLibraryNetherlands](BoundingBox=createBoundingBox.Boxstring)  # Library with multiple webadresses which can be used for WFS and WMS webrequests

# group: BAG 3D
BAG3D = Custom[GIS2BIM.BAG3D](3D_BAG_TU_Delft_OGC_WFS=geoservicesLibraryNetherlands.3D_BAG_TU_Delft_OGC_WFS, rdx=getLocationdataNetherlands.RDcoordinateXmeters, rdy=getLocationdataNetherlands.RDcoordinateYmeters)  # Perform a WFS(Web Feature Service) webrequest based on a boundingbox of RD-coordinates(28992). Retrieve an xml-file. Read the metadata and create 3D-solids. Maximum of 1000 buildings per request.

code_block_18 = CodeBlock { "boskoop"; "warmoeskade"; "2"; }
code_block_19 = CodeBlock()
# ---------- code_block_19.designscript (60 lines) ----------
"
import clr
clr.AddReference('ProtoGeometry')
from Autodesk.DesignScript.Geometry import *

import sys
pyt_path = 'C:/Program Files (x86)/IronPython 2.7/Lib'
sys.path.append(pyt_path)

strSVG = IN[0]
bPix = IN[1]
hPix = IN[2]
widthM = IN[3]
heightM = IN[4]

def readSVG(svgString):
 strSplit = svgString.split('d=')
 del strSplit[0]
 del strSplit[0]
 del strSplit[0]
 del strSplit[0]
 del strSplit[0]

 strPolygon = []
 strPolygonX = []
 strPolygonY = []
 strPolygon2 = []
 ratioX=float(widthM)/float(bPix)
 ratioY=float(heightM)/float(hPix)

 for i in strSplit:
  j = i.split('fill')[0]
  k = j[2:]
  l = k.replace('L','')
  m = l[:-3]
  n = m.split('ZM')
  strPolygon.append(n)

 for sublist in strPolygon:
     for item in sublist:
      strPolygon2.append(item)

 for i in strPolygon2:
  o = i.split(' ')
  p = list(filter(None, o))
  q = p[0::2]
  r = p[1::2]
  xCoord = (int(1000*(float(s)*ratioX-0.5*widthM)) for s in q)
  yCoord = (int(-1000*(float(t)*ratioY-0.5*heightM)) for t in r)
  strPolygonX.append(xCoord)
  strPolygonY.append(yCoord)

 return strPolygonX,strPolygonY,

SVGpts = readSVG(strSVG)

OUT = SVGpts

";
//SVGsplit.split('Z')
# ----------------------------------------
web_request = WebRequest(concat_3)
code_block_20 = CodeBlock()
# ---------- code_block_20.designscript (6 lines) ----------
b=3000;
 //width pixels;
h=3000;
 //height pixels;
width=400;
height=400;
# ----------------------------------------

# group: WEGDEEL
python_script_from_string = PythonStringNode(script=code_block_19, IN[0]=web_request, IN[1]=code_block_20.b, IN[2]=code_block_20.h, IN[3]=code_block_20.width, IN[4]=code_block_20.height)
code_block_21 = CodeBlock(t3=python_script_from_string, widthM=code_block_20.width, heightM=code_block_20.height)
# ---------- code_block_21.designscript (21 lines) ----------
a = t3;
point1 = Point.ByCoordinates(a[0], a[1]);
//Create big surface
widthM;
heightM;
b = widthM + 50;
h = heightM + 50;
bmax = (b * 1000) / 2;
bmin = -1 * bmax;
hmax = (h * 1000) / 2;
hmin = -1 * hmax;
p1 = Point.ByCoordinates(bmin, hmin);
p2 = Point.ByCoordinates(bmax, hmin);
p3 = Point.ByCoordinates(bmax, hmax);
p4 = Point.ByCoordinates(bmin, hmax);
t1 = {p1, p2, p3, p4};
surface1 = Surface.ByPerimeterPoints(t1);

polyCurve1 = PolyCurve.ByPoints(point1, false);
surface2 = polyCurve1.Extrude(1000);
geometry1 = surface1.Split(surface2);
# ----------------------------------------

code_block_22 = CodeBlock(t2=code_block_21.geometry1)
# ---------- code_block_22.designscript (4 lines) ----------
t1 = List.LastItem(t2@-2<1>);
t3 = DSCore.Object.IsNull(t1);
t4 = List.FilterByBoolMask(t1, t3);
t6 = __TryGetValueFromNestedDictionaries(t4, "out");
# ----------------------------------------
code_block_23 = CodeBlock(t6=code_block_22.t6) { fces = t6; display1 = Display.ByGeometryColor(fces, Color.ByARGB(255,234,234,234)); }
concat_4 = String.Concat(code_block_6.out0, code_block_6.out1, code_block_6.out2, code_block_6.out3, code_block_6.out4, code_block_6.out5, code_block_6.out6, code_block_6.out7, code_block_6.out8, code_block_6.out9, createBoundingBox.Boxstring, code_block_6.out10)
web_request_2 = WebRequest(concat_4)
watch = Watch(web_request_2)

# group: WATERDEEL
python_script_from_string_2 = PythonStringNode(script=code_block_19, IN[0]=watch, IN[1]=code_block_20.b, IN[2]=code_block_20.h, IN[3]=code_block_20.width, IN[4]=code_block_20.height)

code_block_24 = CodeBlock(t3=python_script_from_string_2, widthM=code_block_20.width, heightM=code_block_20.height)
# ---------- code_block_24.designscript (17 lines) ----------
a = t3;
point1 = Point.ByCoordinates(a[0], a[1]);
//Create big surface
widthM;
heightM;
b = widthM + 50;
h = heightM + 50;
bmax = (b * 1000) / 2;
bmin = -1 * bmax;
hmax = (h * 1000) / 2;
hmin = -1 * hmax;
p1 = Point.ByCoordinates(bmin, hmin);
p2 = Point.ByCoordinates(bmax, hmin);
p3 = Point.ByCoordinates(bmax, hmax);
p4 = Point.ByCoordinates(bmin, hmax);
t1 = {p1, p2, p3, p4};
surface1 = Surface.ByPerimeterPoints(t1);
# ----------------------------------------
code_block_25 = CodeBlock(point1=code_block_24.point1, surface1=code_block_24.surface1)
# ---------- code_block_25.designscript (6 lines) ----------
polyCurve1 = PolyCurve.ByPoints(point1, false);
t8 = DSCore.Object.IsNull(polyCurve1);
t4 = List.FilterByBoolMask(polyCurve1, t8);
t6 = __TryGetValueFromNestedDictionaries(t4, "out");
surface2 = t6.Extrude(1000);
geometry1 = surface1.Split(surface2);
# ----------------------------------------
code_block_26 = CodeBlock(t2=code_block_25.geometry1) { t1 = List.LastItem(t2@-2<1>); }
code_block_27 = CodeBlock(t6=code_block_26) { fces = t6; display1 = Display.ByGeometryColor(fces, Color.ByARGB(255, 205, 230, 237)); }
code_block_28 = CodeBlock { "C:/TEMP/TEST.tiff"; }
AHN3toPoints = Custom[GIS2BIM.AHN3toPoints](Rdx=getLocationdataNetherlands.RDcoordinateXmeters, Rdy=getLocationdataNetherlands.RDcoordinateYmeters, BoundinxboxWidth=code_block_4, FilepathName=code_block_28)  # Load AHN3 via Geotiff WCS. Transform to local coordinates
byPoints = Topography.ByPoints(AHN3toPoints.Points)
