# Dynamo graph Sandbox.dyn (Dynamo 1.3.1.1736)

# group: INPUT
code_block = CodeBlock { "2.5 mm"; "3.5 mm"; "2.5 mm zwart"; }
lineStyleKadaster = CodeBlock { "_0.25 mm CENTER"; }
boundingboxwidth_m = CodeBlock { 250; }
lineStyleBAGPand = StringInput("pen rood")

code_block_2 = CodeBlock { "dordrecht"; "rechte zandweg"; "27"; }

# group: GET GEOSERVICES
getLocationdataNetherlands = Custom[GIS2BIM.GetLocationdataNetherlands](City=code_block_2.out0, Streetname=code_block_2.out1, Housenumber=code_block_2.out2)  # Gives locationdata based on an adress in the Netherlands
createBoundingBox = Custom[GIS2BIM.CreateBoundingBox](CoordinateX=getLocationdataNetherlands.RDcoordinate_X_meters, CoordinateY=getLocationdataNetherlands.RDcoordinate_Y_meters, BoxWidth=boundingboxwidth_m, BoxHeight=boundingboxwidth_m)  # create boundingboxstring for webrequests based on coördinates and dimensions
geoservicesLibraryNetherlands = Custom[GIS2BIM.GeoservicesLibraryNetherlands](BoundingBox=createBoundingBox)  # Library with multiple webadresses which can be used for WFS and WMS webrequests

# group: KADASTRALE PERCELEN(GRENZEN)
web_request = WebRequest(geoservicesLibraryNetherlands.8_kadastrale_perceel)
createPointsPolygonFromGMLxy = Custom[GIS2BIM.CreatePointsPolygonFromGMLxy](XML=web_request, DeltaX=getLocationdataNetherlands.RDcoordinate_X_meters, DeltaY=getLocationdataNetherlands.RDcoordinate_Y_meters)  # Create point and polygons from a GML-file

filledregiontypebag_pand = FilledRegionTypes("FP_DP_90_pand")
current = Document.Current()
activeView = Document.ActiveView(current)

# group: BAG: pand
web_request_2 = WebRequest(geoservicesLibraryNetherlands.4_bag_pand_WFS)
boolean = BoolSelector(true)
createPointsPolygonFromGMLxyz = Custom[GIS2BIM.CreatePointsPolygonFromGMLxyz](XML=web_request_2, DeltaX=getLocationdataNetherlands.RDcoordinate_X_meters, DeltaY=getLocationdataNetherlands.RDcoordinate_Y_meters, Connectpolygon=boolean)  # Create points and polygons from a xml/gml-file with x,y and z value

string = StringInput(".//{http://www.opengis.net/gml}posList")
xpath_expression_find_for = Custom[XPATH Expression Find for Element Tree]()  # unwired: ElementTree, XPATH
python_script = Python(IN[0]=web_request_2)
# ---------- python_script.python (22 lines) ----------
import sys
sys.path.append("C:\Program Files (x86)\IronPython 2.7\Lib")

import clr
clr.AddReference('ProtoGeometry')
from Autodesk.DesignScript.Geometry import *

import xml.etree.ElementTree as ET

xml = IN[0]

root = ET.fromstring(xml)

# for loop to get each element in an array
XMLelements = []
for elem in root.iter():
	XMLelements.append(elem)
	
 #xpathfound = root.findall(xpathstr)

# put returnValue in OUT
OUT = XMLelements
# ----------------------------------------
get_xml_element_names_and = Custom[Get XML Element Names and Attributes](xml_elements=python_script)
code_block_3 = CodeBlock(tags=get_xml_element_names_and.tags) { tags[15]; }
string_2 = StringInput(".//{http://www.opengis.net/gml/3.2}posList")
python_script_2 = Python(IN[0]=web_request_2, IN[1]=string_2)
# ---------- python_script_2.python (53 lines) ----------
import clr
import sys
clr.AddReference('ProtoGeometry')
from Autodesk.DesignScript.Geometry import *
sys.path.append("C:\Program Files (x86)\IronPython 2.7\Lib")
#from xml.parsers.expat import expat -- can't find this
import xml.etree.ElementTree as ET
#The inputs to this node will be stored as a list in the IN variables.
xml = IN[0]
xpathstr = IN[1]

root = ET.fromstring(xml)

xpathfound = root.findall(xpathstr)
#xparentstr = xpathstr + "/.."
#xparentfound = root.findall(xpathstr+"/..")
xtags, xtext, xcountattrib, xattrib, xattvals, xcountiter, xitertags, xitervals, xparents = [], [], [], [], [], [], [], [], []
for x in xpathfound:
	xtags.append(x.tag)
	if x.text:
		try:
			xtext.append(x.text)
		except:
			xtext.append("_none_")
	else:
		xtext.append("_none_")
	if x.keys():
		xcountattrib.append(len(x.items()))
		for name, value in x.items():
			xattrib.append(name)
			xattvals.append(value)
#PARENT CODE BELOW IS TOO SLOW
#			try:
#				xparents.append(root.find(xpathstr + "/" + name + "/.."))
#			except:
#				xparents.append("no parent found")
	else:
		xcountattrib.append(1)
		xattrib.append("_none_")
		xattvals.append("_none_")

#THIS METHOD NOT GREAT
#	if x.iter():
#		xcountiter.append(len(x.iter()))
#		for name, value in x.iter():
#			xitertags.append(name)
#			xitervals.append(value)
#for y in xparentfound:
#	xparents.append(y.tag)

OUT = root, str(root), xpathfound, xtags, xtext, xcountattrib, xattrib, xattvals
#, xparents 
#, xparentfound#, xparents#, xcountiter, xitertags, xitervals
# ----------------------------------------
code_block_4 = CodeBlock { 4; }
getItemAtIndex = List.GetItemAtIndex(list=python_script_2, index=code_block_4)
createPointFromGML = Custom[GIS2BIM.CreatePointFromGML]()  # Create Points from space seperated GML; unwired: XML, ModX, ModY
