# Dynamo graph WMSSandbox.dyn (Dynamo 1.3.1.1736)

code_block = CodeBlock { "DORDRECHT"; "LANGE GELDERSEKADE"; "2"; }
getLocationdataNetherlands = Custom[GIS2BIM.GetLocationdataNetherlands](City=code_block.out0, Streetname=code_block.out1, Housenumber=code_block.out2)  # Gives locationdata based on an adress in the Netherlands
code_block_2 = CodeBlock { 500; }
createBoundingBox = Custom[GIS2BIM.CreateBoundingBox](CoordinateX=getLocationdataNetherlands.RDcoordinate_X_meters, CoordinateY=getLocationdataNetherlands.RDcoordinate_Y_meters, BoxWidth=code_block_2, BoxHeight=code_block_2)  # create boundingboxstring for webrequests based on coördinates and dimensions
geoservicesLibraryNetherlands = Custom[GIS2BIM.GeoservicesLibraryNetherlands](BoundingBox=createBoundingBox)  # Library with multiple webadresses which can be used for WFS and WMS webrequests
code_block_3 = CodeBlock()
# ---------- code_block_3.designscript (9 lines) ----------
"https://geodata.nationaalgeoregister.nl/wsaoppervlaktewaterenimwa/wms?";
"REQUEST=GetMap&SERVICE=WMS";
"&VERSION=1.3.0";
"&WIDTH=2000";
"&HEIGHT=2000";
"&LAYERS=Ondersteunendwaterdeel,Oppervlaktewaterlichaam,Profielverdediging,Waterbergingsgebied,Waterdeel";
"&FORMAT=image/png";
"&BBOX=";
"&CRS=urn:ogc:def:crs:EPSG::28992";
# ----------------------------------------
concat = String.Concat(code_block_3.out0, code_block_3.out1, code_block_3.out2, code_block_3.out3, code_block_3.out4, code_block_3.out5, code_block_3.out6, code_block_3.out7, arg9=code_block_3.out8)  # unwired: arg8
views = Views("Drafting 1 Copy 1")
code_block_4 = CodeBlock { "C:/TEMP/"; "ruimtelijkeplannen"; "waterschap"; }
webrequestWMS = Custom[GIS2BIM.WebrequestWMS](Boundingboxwidth=code_block_2, View=views, Tempfolder=code_block_4.out0, Filename=code_block_4.out1)  # imports the result(image) of a webrequest based on WMS-protocol into a view in Revit; unwired: WMSwebrequest
watch_image = WatchImageCore(webrequestWMS)
code_block_5 = CodeBlock()
# ---------- code_block_5.designscript (1 lines) ----------
http://services.rce.geovoorziening.nl/rce/wfs?&request=GetCapabilities&service=WFS
# ----------------------------------------
code_block_6 = CodeBlock()
# ---------- code_block_6.designscript (1 lines) ----------
http://services.rce.geovoorziening.nl/rce/wms?&request=GetCapabilities&service=WMS
# ----------------------------------------
code_block_7 = CodeBlock()
# ---------- code_block_7.designscript (9 lines) ----------
"http://services.rce.geovoorziening.nl/rce/wms?";
"REQUEST=GetMap&SERVICE=WMS";
"&VERSION=1.3.0";
"&WIDTH=2000";
"&HEIGHT=2000";
"&LAYERS=rce:NationalListedMonuments,rce:Townscapes";
"&FORMAT=image/png";
"&BBOX=";
"&CRS=urn:ogc:def:crs:EPSG::28992";
# ----------------------------------------
concat_2 = String.Concat(code_block_7.out0, code_block_7.out1, code_block_7.out2, code_block_7.out3, code_block_7.out4, code_block_7.out5, code_block_7.out6, code_block_7.out7, createBoundingBox, code_block_7.out8)
