# Dynamo graph WMTS Topo Tijdreis.dyn (Dynamo 1.3.4.6666)

code_block = CodeBlock()
# ---------- code_block.designscript (15 lines) ----------
Identifier=11;
ScaleDenominator=5669.654195558392;
Resolution=ScaleDenominator*0.28*0.001;
YCorner=-3.05155E7;
XCorner=3.1112399999999993E7;
TileWidth=256;
TileHeight=256;
MatrixWidth=75810;
MatrixHeight=76569;
bboxX1=-1280.7604000009596;
bboxX2=293512.95708775596;
bboxY1=-5049.074299998581;
bboxY2=659829.9918000016;
X=bboxX2-bboxX1;
Y=bboxY2-bboxY1;
# ----------------------------------------
code_block_2 = CodeBlock { "oud-beijerland"; "Laurens Janszoon Costerstraat"; "2"; }
getLocationdataNetherlands = Custom[GIS2BIM.GetLocationdataNetherlands](City=code_block_2.out0, Streetname=code_block_2.out1, Housenumber=code_block_2.out2)  # Gives locationdata based on an adress in the Netherlands
WMTSZoomLevelTileRow = Custom[GIS2BIM.WMTSZoomLevelTileRow](Resolution=code_block.Resolution, XCorner=code_block.XCorner, YCorner=code_block.YCorner, Rdx=getLocationdataNetherlands.RDcoordinateX_meters_double, Rdy=getLocationdataNetherlands.RDcoordinateY_meters_double)  # gives the tilerow and tilecolumn for the WMTS webrequest
WMTSScaleSetNetherlands = Custom[GIS2BIM.WMTSScaleSetNetherlands]()  # gives resolution, scaledenominator and number of tiles
pixelWidth = CodeBlock { 256; }
WMTSTileListFromBbox = Custom[GIS2BIM.WMTSTileListFromBbox](TileRow=WMTSZoomLevelTileRow.TileRow, TileColumn=WMTSZoomLevelTileRow.TileColumn, Resolution=WMTSScaleSetNetherlands.Resolutie_m_pixel, PixelWidth=pixelWidth)  # frozen; gives list of tilerows and tilecolums; unwired: BboxWidthInMeters
WMTSGeoservicesLibraryNetherlands = Custom[GIS2BIM.WMTSGeoservicesLibraryNetherlands](TileRows=WMTSTileListFromBbox.TileRows, TileColumns=WMTSTileListFromBbox.TileColumns, Zoomlevel=WMTSScaleSetNetherlands.Zoomlevel)  # library with webrequests of WMTS-services in the Netherlands; unwired: Layer
boolean = BoolSelector(true)
TMS_WMTS_WebrequestAndCombineImages = Custom[GIS2BIM.TMS_WMTS_WebrequestAndCombineImages](URLlist=WMTSGeoservicesLibraryNetherlands, UniqueTileNumbersColumnX=WMTSTileListFromBbox.UniqueTileColumns, UniqueTileNumbersRowY=WMTSTileListFromBbox.UniqueTileRows, Pixels=pixelWidth, WMTSorTMS=boolean)  # Webrequest for list of WMTS or TMS/Google webrequests for tiles. Combines them to 1 image.
systemDrawingBitmapToJPG = Custom[GIS2BIM.SystemDrawingBitmapToJPG](SystemDrawingBitmap=TMS_WMTS_WebrequestAndCombineImages.Image)  # Save an System.Drawing.Bitmap object as a jpg-file; unwired: FileName
importImageInView = Custom[GIS2BIM.ImportImageInView](ImageWidthMeters=WMTSTileListFromBbox.TileWidthMetrs, ImagePath=systemDrawingBitmapToJPG, DeltaX=WMTSZoomLevelTileRow.DeltaXmm, DeltaY=WMTSZoomLevelTileRow.DeltaYmm)  # Import rasterimage in view; unwired: View
code_block_3 = CodeBlock { "http://tiles.arcgis.com/tiles/nSZVuSZjHpEZZbRo/arcgis/rest/services/Historische_tijdreis_1950/MapServer/WMTS/1.0.0/WMTSCapabilities.xml"; }
web_request = WebRequest(code_block_3)
string = StringInput(".//{http://www.opengis.net/ows/1.1}Identifier")
create = List.Create(string)
XMLXPath = Custom[GIS2BIM.XMLXPath](XMLString=web_request, XPathStrings=create)  # Run an XPathquery on an xml-string
COMMENTS = CodeBlock()
# ---------- COMMENTS.designscript (3 lines) ----------
"Well-known scale set Nederland";
"https://www.geonovum.nl/sites/default/files/nederlandse_richtlijn_tiling_-_versie_1.1.pdf";
"Zoomlevel,Resolutie(m/pixel), scaleDenominator, numberofTiles)";
# ----------------------------------------
string_2 = StringInput(".//TileMatrix")
create_2 = List.Create(string_2)
XMLXPath_2 = Custom[GIS2BIM.XMLXPath](XMLString=web_request, XPathStrings=create_2)
code_block_4 = CodeBlock { 0.28*75810/1000; }
code_block_5 = CodeBlock { meter perpixel; }
watch = Watch(code_block.Resolution)
watch_2 = Watch(code_block.YCorner)
code_block_6 = CodeBlock()
# ---------- code_block_6.designscript (9 lines) ----------
"http://tiles.arcgis.com/tiles/nSZVuSZjHpEZZbRo/arcgis/rest/services/Historische_tijdreis_1950/MapServer/WMTS/tile/1.0.0/";
"Historische_tijdreis_1950/";
"default/";
 //style;
"default028mm/";
 //tilematrixset;
"1/";
"19/";
"19";
# ----------------------------------------
concat = String.Concat(code_block_6.out0, code_block_6.out1, arg3=code_block_6.out3, arg4=code_block_6.out4, arg5=code_block_6.out5)  # unwired: arg2
webrequestWMS2 = Custom[GIS2BIM.WebrequestWMS2](WMSwebrequest=concat)  # a webrequest based on WMS-protocol
openBrowser = Custom[GIS2BIM.OpenBrowser]()  # Opens a new window in your default browser with the given url.; unwired: url
code_block_7 = CodeBlock()
# ---------- code_block_7.designscript (13 lines) ----------
"http://geodata.nationaalgeoregister.nl/";
"tiles/service/wmts?";

"tiles.arcgis.com/tiles/nSZVuSZjHpEZZbRo/arcgis/rest/services/Historische_tijdreis_1950/MapServer/WMTS";
"&request=GetTile";
"&VERSION=1.0.0";
"&LAYER=";
"&STYLE=default";
"&TILEMATRIXSET=EPSG:28992";
"&TILEMATRIX=EPSG:28992:";
"&TILEROW=";
"&TILECOL=";
"&FORMAT=image/png8";
# ----------------------------------------

# group: close
code_block_8 = CodeBlock()
# ---------- code_block_8.designscript (13 lines) ----------
"http://geodata.nationaalgeoregister.nl/";
"tiles/service/wmts?";

"https://tiles.arcgis.com/tiles/nSZVuSZjHpEZZbRo/arcgis/rest/services/Historische_tijdreis_1950/MapServer/WMTS?";
"&VERSION=1.0.0";
"&request=GetTile";
"&TILEMATRIXSET=default028mm";
"&LAYER=Historische_tijdreis_1950";
"&crs=EPSG:28992";
"&STYLE=default";
"&TILEROW=37000";
"&TILECOL=37000";
"&FORMAT=image/jpgpng";
# ----------------------------------------
concat_2 = String.Concat(code_block_8.out2, code_block_8.out3, code_block_8.out4, code_block_8.out5, code_block_8.out6, code_block_8.out7, code_block_8.out8, code_block_8.out9, code_block_8.out10)
openBrowser_2 = Custom[GIS2BIM.OpenBrowser](url=concat_2)

code_block_9 = CodeBlock()
# ---------- code_block_9.designscript (3 lines) ----------
"http://tiles.arcgis.com/tiles/nSZVuSZjHpEZZbRo/arcgis/rest/services/Historische_tijdreis_1950/MapServer/WMTS/tile/1.0.0/Historische_tijdreis_1950/";
"default/default028mm/1/5/5";
//{Style}/{TileMatrixSet}/{TileMatrix}/{TileRow}/{TileCol};
# ----------------------------------------
concat_3 = String.Concat(code_block_9.out0, code_block_9.out1)
create_3 = List.Create(concat_3)
python_script = Python(IN[0]=create_3)
# ---------- python_script.python (19 lines) ----------
import clr
clr.AddReference("System.Drawing")
clr.AddReference("System")
from System.Drawing import Image
from System.Drawing import Bitmap
from System.Drawing import Graphics
from System.Drawing.Imaging import ImageFormat
from System.Net import WebRequest
urls= IN[0]

bitmaps = []
for i in urls:
	request = WebRequest.Create(i)
	request.Accept = "text/html"
	request.UserAgent = "Mozilla/5.0"
	response = request.GetResponse()
	bitmaps.append(Image.FromStream(response.GetResponseStream()))

OUT = bitmaps
# ----------------------------------------
openBrowser_3 = Custom[GIS2BIM.OpenBrowser](url=concat)
code_block_10 = CodeBlock { "&TILEROW=37000"; "&TILECOL=37000"; }
code_block_11 = CodeBlock()
# ---------- code_block_11.designscript (8 lines) ----------
"tiles.arcgis.com/tiles/nSZVuSZjHpEZZbRo/arcgis/rest/services/Historische_tijdreis_1950/MapServer/WMTS?";
"&request=GetTile";
"&VERSION=1.0.0";
"&LAYER=Historische_tijdreis_1950";
"&STYLE=default";
"&TILEMATRIXSET=default028mm";

"&FORMAT=image/png8";
# ----------------------------------------
concat_4 = String.Concat(code_block_11.out2, code_block_11.out3, code_block_11.out4, code_block_11.out5, code_block_11.out6)  # unwired: arg5, arg6
code_block_12 = CodeBlock()
# ---------- code_block_12.designscript (1 lines) ----------
https://tiles.arcgis.com/tiles/nSZVuSZjHpEZZbRo/arcgis/rest/services/Historische_tijdreis_1830_1849/MapServer/WMTS/tile/1.0.0/Historische_tijdreis_1830_1849/
# ----------------------------------------
openBrowser_4 = Custom[GIS2BIM.OpenBrowser](url=concat_3)
python_script_2 = Python(IN[0]=concat_3)
# ---------- python_script_2.python (16 lines) ----------
import sys
sys.path.append("C:\Program Files (x86)\IronPython 2.7\Lib")

import clr

clr.AddReference("System.Drawing")
clr.AddReference("System")
from System.Drawing import Image
from System.Net import WebRequest
url= IN[0]

request = WebRequest.Create(url)
response = request.GetResponse()
bitmap = Image.FromStream(response.GetResponseStream())

OUT = bitmap
# ----------------------------------------
code_block_13 = CodeBlock { "https://tiles.arcgis.com/tiles/nSZVuSZjHpEZZbRo/arcgis/rest/services/Historische_tijdreis_1830_1849/MapServer/WMTS/tile/1.0.0/Historische_tijdreis_1830_1849"; }
WMTSRequestAndImport = Custom[GIS2BIM.WMTSRequestAndImport]()  # total node with WMTS webrequest and import of image in view; unwired: Rdx, Rdy, Zoomlevel, Boundingboxwidth, TemppathFileName, View, Layer
code_block_14 = CodeBlock()
# ---------- code_block_14.designscript (11 lines) ----------
"http://geodata.nationaalgeoregister.nl/";
"tiles/service/wmts?";
"&request=GetTile";
"&VERSION=1.0.0";
"&LAYER=";
"&STYLE=default";
"&TILEMATRIXSET=EPSG:28992";
"&TILEMATRIX=EPSG:28992:";
"&TILEROW=";
"&TILECOL=";
"&FORMAT=image/png8";
# ----------------------------------------

# group: close #2
code_block_15 = CodeBlock()
# ---------- code_block_15.designscript (15 lines) ----------
"http://geodata.nationaalgeoregister.nl/";
"tiles/service/wmts?";

"https://tiles.arcgis.com/tiles/nSZVuSZjHpEZZbRo/arcgis/rest/services/Historische_tijdreis_1950/MapServer/WMTS?";
"service=WMTS";
"&version=1.0.0";
"&request=gettile";
"&layer=Historische_tijdreis_1950";
"&style=default";
"&tileMatrixSet=default028mm";
"&tileMatrix=11";
//"&crs=EPSG:28992";
"&TileRow=15";
"&TileCol=15";
"&format/jpgpng";
# ----------------------------------------
concat_5 = String.Concat(code_block_15.out2, code_block_15.out3, code_block_15.out4, code_block_15.out5, code_block_15.out6, code_block_15.out7, code_block_15.out8, code_block_15.out9, code_block_15.out10, code_block_15.out11, code_block_15.out12)
openBrowser_5 = Custom[GIS2BIM.OpenBrowser](url=concat_5)
