# Dynamo graph GermanyCadastre.dyn (Dynamo 1.3.1.1736)

code_block = CodeBlock { "25832"; }
searchCRS = Custom[GIS2BIM.SearchCRS](EPSG_Code=code_block)  # Search for a Coordinate Reference System
code_block_2 = CodeBlock { Application.Document.Current.ActiveView; }
belgiumGeoservicesLibrary = Custom[GIS2BIM.BelgiumGeoservicesLibrary]()  # frozen; Geoserviceslibrary in Belgium; unwired: BoundingboxString
code_block_3 = CodeBlock { "4326"; }
code_block_4 = CodeBlock { "Königstor"; "1"; "Kassel"; "Germany"; }
geoCodingGoogleAPI = Custom[GIS2BIM.GeoCodingGoogleAPI](Streetname=code_block_4.out0, Housenumber=code_block_4.out1, Place=code_block_4.out2, Country=code_block_4.out3)  # gets coordinate from adress with google API
transformCRS_epsg = Custom[GIS2BIM.TransformCRS_epsg](sourceCRS=code_block_3, targetCRS=code_block, xCoordinate=geoCodingGoogleAPI.Longitude, yCoordinate=geoCodingGoogleAPI.Latitude)  # Uses the API of http://epsg.io to transform Coordinate Reference Systems
code_block_5 = CodeBlock { "Thin Lines"; "Hidden Lines"; }

# group: CADASTRE PARCELS
web_request = WebRequest(belgiumGeoservicesLibrary.CadastreParcels_GRB_ADP_WFS_GML)
createPointsPolygonFromGMLxy = Custom[GIS2BIM.CreatePointsPolygonFromGMLxy](XML=web_request, DeltaX=transformCRS_epsg.Xtransformed, DeltaY=transformCRS_epsg.Ytransformed)  # Create point and polygons from a GML-file
createDetailLinesFromPolygons = Custom[GIS2BIM.CreateDetailLinesFromPolygons](View=code_block_2, PolyCurves=createPointsPolygonFromGMLxy.PolyCurves, Linestyle=code_block_5.out1)  # Create detaillines from polygons in a view

setSharedCoordinate = Custom[GIS2BIM.SetSharedCoordinate](x=transformCRS_epsg.Xtransformed, y=transformCRS_epsg.Ytransformed)  # Set shared coordinate/project basepoint; unwired: angle

# group: BUILDING OUTLINES
web_request_2 = WebRequest(belgiumGeoservicesLibrary.BuildingOutlines_GRB_GBG_WFS_GML)
createPointsPolygonFromGMLxy_2 = Custom[GIS2BIM.CreatePointsPolygonFromGMLxy](XML=web_request_2, DeltaX=transformCRS_epsg.Xtransformed, DeltaY=transformCRS_epsg.Ytransformed)
createDetailLinesFromPolygons_2 = Custom[GIS2BIM.CreateDetailLinesFromPolygons](View=code_block_2, PolyCurves=createPointsPolygonFromGMLxy_2.PolyCurves, Linestyle=code_block_5.out0)

code_block_6 = CodeBlock { "Center"; }

# group: HOUSENUMBER
web_request_3 = WebRequest(belgiumGeoservicesLibrary.Housenumbers_GRB_TBLGBGADR_WFS_GML)
createPointFromGML = Custom[GIS2BIM.CreatePointFromGML](XML=web_request_3, ModX=transformCRS_epsg.Xtransformed, ModY=transformCRS_epsg.Ytransformed)  # Create Points from space seperated GML
code_block_7 = CodeBlock { "GRB:HUISNR"; }
getXMLNode = Lists.DataSets.GetXMLNode(web_request_3, code_block_7)
flatten = Flatten(getXMLNode)
string_from_object = FromObject(flatten)
byLocation = TextNote.ByLocation(view=code_block_2, location=createPointFromGML, text=string_from_object, alignment=code_block_6)

code_block_8 = CodeBlock()
# ---------- code_block_8.designscript (6 lines) ----------
"https://www.wfs.nrw.de/";
"geobasis/wfs_nw_alkis_vereinfacht?";
"&request=GetFeature";
"&typeName=ave:KatasterBezirk";
"&SERVICE=WFS";
"&bbox=";
# ----------------------------------------
boundingboxWidth = CodeBlock { 250; }
createBoundingBox = Custom[GIS2BIM.CreateBoundingBox](CoordinateX=transformCRS_epsg.Xtransformed, CoordinateY=transformCRS_epsg.Ytransformed, BoxWidth=boundingboxWidth, BoxHeight=boundingboxWidth)  # create boundingboxstring for webrequests based on coördinates and dimensions
concat = String.Concat(code_block_8.out0, code_block_8.out1, code_block_8.out2, code_block_8.out3, code_block_8.out4, code_block_8.out5, createBoundingBox.Boxstring)
openBrowser = Custom[GIS2BIM.OpenBrowser](url=concat)  # Opens a new window in your default browser with the given url.
sendTo = Custom[Clipboard.SendTo](str=concat)  # Copies a string to the clipboard.
code_block_9 = CodeBlock()
# ---------- code_block_9.designscript (7 lines) ----------
"https://geoservices.informatievlaanderen.be/overdrachtdiensten/GRB/wfs?";
"&request=GetFeature";
"&typeName=GRB:ADP";
"&bbox=";

"&format=gml32";
"&crs=EPSG:31370";
# ----------------------------------------
