# Dynamo graph SlovakiaCadastre.dyn (Dynamo 1.3.1.1736)

geoservicesLibraryNetherlands = Custom[GIS2BIM.GeoservicesLibraryNetherlands]()  # Library with multiple webadresses which can be used for WFS and WMS webrequests; unwired: BoundingBox
code_block = CodeBlock()
# ---------- code_block.designscript (5 lines) ----------
"http://geodata.nationaalgeoregister.nl/";
"kadastralekaartv3/wfs?";
"&request=GetFeature";
"&typeName=kadastralekaartv3:annotatie";
"&bbox=";
# ----------------------------------------
code_block_2 = CodeBlock()
# ---------- code_block_2.designscript (9 lines) ----------
"https://prostor4.gov.si/ows2-ins/bu-core2d/wfs?service=wfs";
"&request=GetFeature";
"&typeName=bu-core2d:Building";
"&VERSION=1.1.0";
"&bbox=";

"&typeName=gurs_pub:SI.GURS.RPE.LS";
"&typeName=gurs_pub:SI.GURS.RPE.NA";
"&typeName=gurs_pub:SI.GURS.RPE.OGU";
# ----------------------------------------
code_block_3 = CodeBlock { "3912"; }
code_block_4 = CodeBlock { "rutnayovo namestie"; "1"; "bratislava"; "slovakia"; }
geoCodingGoogleAPI = Custom[GIS2BIM.GeoCodingGoogleAPI](Streetname=code_block_4.out0, Housenumber=code_block_4.out1, Place=code_block_4.out2, Country=code_block_4.out3)  # gets coordinate from adress with google API
transformCRS_epsg = Custom[GIS2BIM.TransformCRS_epsg](targetCRS=code_block_3, xCoordinate=geoCodingGoogleAPI.Longitude, yCoordinate=geoCodingGoogleAPI.Latitude)  # Uses the API of http://epsg.io to transform Coordinate Reference Systems
code_block_5 = CodeBlock { 400; }
createBoundingBox = Custom[GIS2BIM.CreateBoundingBox](CoordinateX=transformCRS_epsg.Xtransformed, CoordinateY=transformCRS_epsg.Ytransformed, BoxWidth=code_block_5, BoxHeight=code_block_5)  # create boundingboxstring for webrequests based on coördinates and dimensions
concat = String.Concat(code_block_2.out0, code_block_2.out1, code_block_2.out2, code_block_2.out3, code_block_2.out4, createBoundingBox.Boxstring)
openBrowser = Custom[GIS2BIM.OpenBrowser](url=concat)  # Opens a new window in your default browser with the given url.
code_block_6 = CodeBlock()
# ---------- code_block_6.designscript (1 lines) ----------
https://prostor4.gov.si/ows2-ins/bu-core2d/wfs?service=wfs&request=GetCapabilities&version=2.0.0
# ----------------------------------------
