# Dynamo graph SloveniaCadastre.dyn (Dynamo 1.3.1.1736)

boolean = BoolSelector(true)

# group: parcels inspire
code_block = CodeBlock()
# ---------- code_block.designscript (5 lines) ----------
"https://prostor4.gov.si/ows2-ins/cp/wfs?service=wfs";
"&request=GetFeature";
"&typeName=cp:CadastralParcel";
"&VERSION=1.1.0";
"&bbox=";
# ----------------------------------------

code_block_2 = CodeBlock { "4326"; }
code_block_3 = CodeBlock { "3912"; }
code_block_4 = CodeBlock { "Dunajska cesta"; "18"; "ljubljana"; "slovenia"; }
geoCodingGoogleAPI = Custom[GIS2BIM.GeoCodingGoogleAPI](Streetname=code_block_4.out0, Housenumber=code_block_4.out1, Place=code_block_4.out2, Country=code_block_4.out3)  # gets coordinate from adress with google API
transformCRS_epsg = Custom[GIS2BIM.TransformCRS_epsg](sourceCRS=code_block_2, targetCRS=code_block_3, xCoordinate=geoCodingGoogleAPI.Longitude, yCoordinate=geoCodingGoogleAPI.Latitude)  # Uses the API of http://epsg.io to transform Coordinate Reference Systems
code_block_5 = CodeBlock { 2000; }
createBoundingBox = Custom[GIS2BIM.CreateBoundingBox](CoordinateX=transformCRS_epsg.Xtransformed, CoordinateY=transformCRS_epsg.Ytransformed, BoxWidth=code_block_5, BoxHeight=code_block_5)  # create boundingboxstring for webrequests based on coördinates and dimensions
concat = String.Concat(code_block.out0, code_block.out1, code_block.out2, code_block.out3, code_block.out4, createBoundingBox.Boxstring)
openBrowser = Custom[GIS2BIM.OpenBrowser](toggle=boolean, url=concat)  # Opens a new window in your default browser with the given url.
code_block_6 = CodeBlock()
# ---------- code_block_6.designscript (1 lines) ----------
https://prostor4.gov.si/ows2-ins/bu-core2d/wfs?service=wfs&request=GetCapabilities&version=2.0.0
# ----------------------------------------
code_block_7 = CodeBlock()
# ---------- code_block_7.designscript (1 lines) ----------
https://prostor4.gov.si/ows2-pub/gurs_pub/ows?service=wfs&request=GetCapabilities&version=2.0.0
# ----------------------------------------

# group: parcels 2
code_block_8 = CodeBlock()
# ---------- code_block_8.designscript (5 lines) ----------
"https://prostor4.gov.si/ows2-pub/gurs_pub/ows?service=wfs";
"&request=GetFeature";
"&typeName=gurs_pub:SI.GURS.CBZK.KO";
"&VERSION=2.0.0";
"&bbox=";
# ----------------------------------------

concat_2 = String.Concat(code_block_8.out0, code_block_8.out1, code_block_8.out2, code_block_8.out3, code_block_8.out4, createBoundingBox.Boxstring)  # frozen
openBrowser_2 = Custom[GIS2BIM.OpenBrowser](url=concat_2)
searchCRS = Custom[GIS2BIM.SearchCRS](EPSG_Code=code_block_3)  # Search for a Coordinate Reference System
watch = Watch(searchCRS.Name_CRS)
