# Dynamo graph SwissCadastre.dyn (Dynamo 1.3.2.2480)

code_block = CodeBlock { "2056"; }
searchCRS = Custom[GIS2BIM.SearchCRS](EPSG_Code=code_block)  # Search for a Coordinate Reference System
code_block_2 = CodeBlock { "badenerstrasse"; "1"; "Zurich"; "Swiss"; }
geoCodingGoogleAPI = Custom[GIS2BIM.GeoCodingGoogleAPI](Streetname=code_block_2.out0, Housenumber=code_block_2.out1, Place=code_block_2.out2, Country=code_block_2.out3)  # gets coordinate from adress with google API
code_block_3 = CodeBlock { Application.Document.Current.ActiveView; }
code_block_4 = CodeBlock()
# ---------- code_block_4.designscript (6 lines) ----------
"http://maps.zh.ch/wfs/OerebKatasterZHWFS?SERVICE=WFS&";
"&VERSION=2.0.0";
"&REQUEST=GetFeature";
"&typeName=ms:ul-p-proj";
"&SERVICE=WFS";
"&bbox=";
# ----------------------------------------
code_block_5 = CodeBlock { "4326"; }
code_block_6 = CodeBlock { "8.5308"; "47.3733"; }
transformCRS_epsg = Custom[GIS2BIM.TransformCRS_epsg](sourceCRS=code_block_5, targetCRS=code_block, xCoordinate=code_block_6.out0, yCoordinate=code_block_6.out1)  # Uses the API of http://epsg.io to transform Coordinate Reference Systems
boundingboxWidth = CodeBlock { 20000; }
createBoundingBox = Custom[GIS2BIM.CreateBoundingBox](CoordinateX=transformCRS_epsg.Xtransformed, CoordinateY=transformCRS_epsg.Ytransformed, BoxWidth=boundingboxWidth, BoxHeight=boundingboxWidth)  # create boundingboxstring for webrequests based on coördinates and dimensions
concat = String.Concat(code_block_4.out0, code_block_4.out1, code_block_4.out2, code_block_4.out3, code_block_4.out4, code_block_4.out5, createBoundingBox.Boxstring)
code_block_7 = CodeBlock { "Thin Lines"; "Hidden Lines"; }

# group: CADASTRE PARCELS
web_request = WebRequest(concat)  # frozen
createPointsPolygonFromGMLxy = Custom[GIS2BIM.CreatePointsPolygonFromGMLxy](XML=web_request, DeltaX=transformCRS_epsg.Xtransformed, DeltaY=transformCRS_epsg.Ytransformed)  # Create point and polygons from a GML-file
createDetailLinesFromPolygons = Custom[GIS2BIM.CreateDetailLinesFromPolygons](View=code_block_3, PolyCurves=createPointsPolygonFromGMLxy.PolyCurves, Linestyle=code_block_7.out1)  # frozen; Create detaillines from polygons in a view

belgiumGeoservicesLibrary = Custom[GIS2BIM.BelgiumGeoservicesLibrary]()  # frozen; Geoserviceslibrary in Belgium; unwired: BoundingboxString

# group: BUILDING OUTLINES
web_request_2 = WebRequest(belgiumGeoservicesLibrary.BuildingOutlines_GRB_GBG_OGC_WFS)
createPointsPolygonFromGMLxy_2 = Custom[GIS2BIM.CreatePointsPolygonFromGMLxy](XML=web_request_2, DeltaX=transformCRS_epsg.Xtransformed, DeltaY=transformCRS_epsg.Ytransformed)
createDetailLinesFromPolygons_2 = Custom[GIS2BIM.CreateDetailLinesFromPolygons](View=code_block_3, PolyCurves=createPointsPolygonFromGMLxy_2.PolyCurves, Linestyle=code_block_7.out0)

code_block_8 = CodeBlock { "Center"; }

# group: HOUSENUMBER
web_request_3 = WebRequest(belgiumGeoservicesLibrary.Housenumbers_GRB_TBLGBGADR_OGC_WFS)
createPointFromGML = Custom[GIS2BIM.CreatePointFromGML](XML=web_request_3, ModX=transformCRS_epsg.Xtransformed, ModY=transformCRS_epsg.Ytransformed)  # Create Points from space seperated GML
code_block_9 = CodeBlock { "GRB:HUISNR"; }
getXMLNode = Lists.DataSets.GetXMLNode(web_request_3, code_block_9)
flatten = Flatten(getXMLNode)
string_from_object = FromObject(flatten)
byLocation = TextNote.ByLocation(view=code_block_3, location=createPointFromGML, text=string_from_object, alignment=code_block_8)

openBrowser = Custom[GIS2BIM.OpenBrowser](url=concat)  # Opens a new window in your default browser with the given url.
