# Dynamo graph sandboxBGT - Copy.dyn (Dynamo 1.3.3.4111)

code_block = CodeBlock { "https://geodata.nationaalgeoregister.nl/beta/bgt/wfs?service=wfs&version=2.0.0&request=GetFeature&typeNames=bgt:put&bbox=89016,469801,89066,469851"; }
web_request = WebRequest(code_block)
string = StringInput(".//{http://www.opengis.net/gml/3.2}pos")
code_block_2 = CodeBlock { rdx=89016; rdy=469801; bbox=200; }
string_2 = StringInput(".//{http://bgt.wfs.geonovum.nl}plus-type")
python_script = Python(IN[0]=web_request, IN[1]=string, IN[2]=code_block_2.rdx, IN[3]=code_block_2.rdy, IN[4]=code_block_2.bbox, IN[5]=string_2)
# ---------- python_script.python (84 lines) ----------
import sys
sys.path.append("C:\Program Files (x86)\IronPython 2.7\Lib")

import clr
clr.AddReference('ProtoGeometry')
from Autodesk.DesignScript.Geometry import *

import xml.etree.ElementTree as ET


def checkIfCoordIsInsideBoundingBox(coord, bounding_box):
    min_x = bounding_box[0] - (bounding_box[2] / 2)
    min_y = bounding_box[1] - (bounding_box[2] / 2)
    max_x = bounding_box[0] + (bounding_box[2] / 2)
    max_y = bounding_box[1] + (bounding_box[2] / 2)

    if min_x <= float(coord[0]) <= max_x and min_y <= float(coord[1]) <= max_y:
        return True
    else:
        return False

def mainFunction():
    # Inputs
    xml = IN[0]
    xpathstr = IN[1]
    # Bounding box definition
    bbx = IN[2]
    bby = IN[3]
    bb_size = IN[4]
    xpathstr2 = IN[5]
    bounding_box = [bbx, bby, bb_size]
    # get data from xml
    root = ET.fromstring(xml)
    #root = tree.getroot()
	
    # for loop to get each element in an array
    XMLelements = []
    for elem in root.iter():
        XMLelements.append(elem)

    xpathfound = root.findall(xpathstr)
    xpathfoundlabel = root.findall(xpathstr2)
    # for loop to get all points in an array
    points = []
    for x in xpathfound:
        if x.text:
            try:
                points.append(x.text)
            except:
                points.append("_none_")
        else:
            points.append("_none_")
	
	labels = []
    for i in xpathfoundlabel:
        if i.text:
            try:
                labels.append(i.text)
            except:
                labels.append("_none_")
        else:
            labels.append("_none_")
    
    # for loop to get each point as a list instead of a string
    newPoints = []
    for point in points:
        newPoints.append(point.split(" "))

    # for loop to get x,y coords and filter points inside Bounding Box
    xyPoints = []
    xyLabels = []
    for newPoint, label in zip(newPoints, labels):
    	point_is_inside_bounding_box = False
    	if checkIfCoordIsInsideBoundingBox(newPoint, bounding_box):
    		point_is_inside_bounding_box = True
    		xyPoints.append(newPoint)
    		xyLabels.append(label)
    return xyPoints, xyLabels

# execution of main function in python script
returnvalue = mainFunction()

# put returnValue in OUT
OUT = returnvalue
# ----------------------------------------
code_block_3 = CodeBlock { rdx=89016; rdy=469801; bbox=200; }
code_block_4 = CodeBlock(t4=python_script, t9=code_block_3.rdx, t10=code_block_3.rdy)
# ---------- code_block_4.designscript (15 lines) ----------
t3 = DSCore.List.FirstItem(t4);
t5 = DSCore.List.FirstItem(t3@-2<1>);
t6 = String.ToNumber(t5);
t7 = DSCore.List.LastItem(t3@-2<1>);
t8 = String.ToNumber(t7);
rdx = t9;
x = t6;
rdy = t10;
y = t8;
t1 = (rdx - x) * 1000;
t2 = (rdy - y) * 1000;
t11 = Math.Round(t1);
t12 = Math.Round(t2);
point1 = Point.ByCoordinates(t11, t12);
t4[1];
# ----------------------------------------
watch = Watch(code_block_4.point1)
watch_2 = Watch(code_block_4.out14)
code_block_5 = CodeBlock { "https://geodata.nationaalgeoregister.nl/beta/bgt/wfs?service=wfs&version=2.0.0&request=GetFeature&typeNames=bgt:wegdeel&bbox=89016,469801,89066,469851"; }
web_request_2 = WebRequest(code_block_5)
string_3 = StringInput(".//{http://www.opengis.net/gml/3.2}posList")
string_4 = StringInput(".//{http://bgt.wfs.geonovum.nl}bgt-functie")
python_script_2 = Python(IN[0]=web_request_2, IN[1]=string_3, IN[2]=string_4)
# ---------- python_script_2.python (68 lines) ----------
import sys
sys.path.append("C:\Program Files (x86)\IronPython 2.7\Lib")

import clr
clr.AddReference('ProtoGeometry')
from Autodesk.DesignScript.Geometry import *

import xml.etree.ElementTree as ET


def mainFunction():
    # Inputs
    xml = IN[0]
    xpathstr = IN[1]
    xpathstr2 = IN[2]
    # get data from xml
    root = ET.fromstring(xml)
    #root = tree.getroot()
	
    # for loop to get each element in an array
    XMLelements = []
    for elem in root.iter():
        XMLelements.append(elem)

    xpathfound = root.findall(xpathstr)
    xpathfoundlabel = root.findall(xpathstr2)
    # for loop to get all points in an array
    polygons = []
    for x in xpathfound:
        if x.text:
            try:
                polygons.append(x.text)
            except:
                polygons.append("_none_")
        else:
            polygons.append("_none_")
            
    # for loop to get each polygon as a list instead of a string
    newPolygons = []
    for polygon in polygons:
        newPolygons.append(polygon.split(" "))

    xyPolygons = []
    for newPolygon in newPolygons:
        x = 0
        xyPolygon = []
        for i in range(0, int(len(newPolygon) / 2)):
            xy_coord = [newPolygon[x], newPolygon[x + 1]]
            xyPolygon.append(xy_coord)
            x += 2
        xyPolygons.append(xyPolygon)
            
	labels = []
    for i in xpathfoundlabel:
        if i.text:
            try:
                labels.append(i.text)
            except:
                labels.append("_none_")
        else:
            labels.append("_none_")
    return xyPolygons, labels

# execution of main function in python script
returnvalue = mainFunction()

# put returnValue in OUT
OUT = returnvalue
# ----------------------------------------
code_block_6 = CodeBlock(a=python_script_2) { a[0]; }
code_block_7 = CodeBlock { rdx=89016; rdy=469801; }

# group: CURVES
firstItem = List.FirstItem()  # unwired: arg0
map = List.Map(f_x=firstItem)  # unwired: list
map_2 = List.Map(list=code_block_6, f_x=map)
toNumber = String.ToNumber(map_2)
lastItem = List.LastItem()  # unwired: arg0
map_3 = List.Map(f_x=lastItem)  # unwired: list
map_4 = List.Map(list=code_block_6, f_x=map_3)
toNumber_2 = String.ToNumber(map_4)
code_block_8 = CodeBlock(x=toNumber, rdx=code_block_7.rdx, y=toNumber_2, rdy=code_block_7.rdy) { (x-rdx)*1000; (y-rdy)*1000; }
code_block_9 = CodeBlock { 0; }
byCoordinates = Point.ByCoordinates(x=code_block_8.out0, y=code_block_8.out1, z=code_block_9)
byPoints = PolyCurve.ByPoints(points=byCoordinates)

code_block_10 = CodeBlock()
# ---------- code_block_10.designscript (22 lines) ----------
":plus-status_codespace";
":status_codespace";
":inonderzoek_leeg";
":lokaalid";
":plus-fysiekvoorkomen_leeg";
":functie_codespace";
":fysiekvoorkomen_codespace";
":creationdate";
":plus-status_leeg";
":terminationdate_leeg";
":plus-functie_codespace";
":plus-fysiekvoorkomen_codespace";
":optalud";
":relatievehoogteligging";
":status";
":lv-publicatiedatum";
":tijdstipregistratie";
":kruinlijn_leeg";
":plus-functie_leeg";
":bronhouder";
":bgt-functie";
":bgt-fysiekVoorkomen";
# ----------------------------------------
create = List.Create(code_block_10.out0, code_block_10.out1, code_block_10.out2, code_block_10.out3, code_block_10.out4, code_block_10.out5, code_block_10.out6, code_block_10.out7, code_block_10.out8, code_block_10.out9, code_block_10.out10, code_block_10.out11, code_block_10.out12, code_block_10.out13, code_block_10.out14, code_block_10.out15, code_block_10.out16, code_block_10.out17, code_block_10.out18, code_block_10.out19, code_block_10.out20, code_block_10.out21)
string_5 = StringInput(".//{http://bgt.wfs.geonovum.nl}")
concat = String.Concat(string_5)  # unwired: arg1
map_5 = List.Map(list=create, f_x=concat)
python_script_3 = Python(IN[0]=web_request_2, IN[1]=string_3, IN[2]=map_5)  # same code as python_script_2
code_block_11 = CodeBlock(a=python_script_2) { a[1]; }
openBrowser = Custom[GIS2BIM.OpenBrowser](url=code_block_5)  # Opens a new window in your default browser with the given url.
