# Dynamo graph sandboxPointcloudCreateGeometry.dyn (Dynamo 1.3.1.1736)

# group: INPUT
code_block = CodeBlock { "Rotterdam"; "Wilhelminakade"; "200"; }
code_block_2 = CodeBlock { 700; }
views = Views()
string = StringInput("pen rood")
code_block_3 = CodeBlock { "C:/TEMP/"; }

# group: GET GEOSERVICES
getLocationdataNetherlands = Custom[GIStoBIM.GetLocationdataNetherlands](City=code_block.out0, Streetname=code_block.out1, Housenumber=code_block.out2)  # "GIS2BIM.GetLocationdataNetherlands"; Gives locationdata based on an adress in the Netherlands
createBoundingBox = Custom[GIStoBIM.CreateBoundingBox](coordinateX=getLocationdataNetherlands.RDcoordinateX_meters_double, coordinateY=getLocationdataNetherlands.RDcoordinateY_meters_double, boxWidth=code_block_2, boxHeight=code_block_2)  # create boundingboxstring for webrequests based on coördinates and dimensions
geoservicesLibraryNetherlands = Custom[GIStoBIM.GeoservicesLibraryNetherlands](BoundingBox=createBoundingBox)  # Library with multiple webadresses which can be used for WFS and WMS webrequests

code_block_4 = CodeBlock()
# ---------- code_block_4.designscript (1 lines) ----------
http://services.rce.geovoorziening.nl/rce/wfs?&request=GetCapabilities&service=WFS
# ----------------------------------------

# group: BAG: pand
web_request = WebRequest()  # unwired: arg0
code_block_5 = CodeBlock { "gml:posList"; }
boolean = BoolSelector(true)
createPointsPolygonFromGMLxyz = Custom[GIStoBIM.CreatePointsPolygonFromGMLxyz](xml=web_request, xmltagname=code_block_5, deltaX=getLocationdataNetherlands.RDcoordinateX_meters_double, deltaY=getLocationdataNetherlands.RDcoordinateY_meters_double, connectpolygon=boolean)  # Create points and polygons from a xml/gml-file with x,y and z value
createDetailLinesFromPolygons = Custom[GIStoBIM.CreateDetailLinesFromPolygons](View=views, PolyCurves=createPointsPolygonFromGMLxyz.PolyCurves, Linestyle=string)  # "GIS2BIM.CreateDetailLinesFromPolygons"; Create detaillines from polygons in a view

code_block_6 = CodeBlock { 1; }
byPoints = NurbsSurface.ByPoints(arg1=code_block_6, arg2=code_block_6)  # unwired: arg0
file_path = Filename("..\..\..\..\..\..\..\3BM\50_projecten\1_3BM_cooperatie\867_Strandpaviljoen_Paal_9_Texel\867_40_terrein\867_export.pts")
readText = File.ReadText(file_path)
python_script = Python(IN[0]=readText)
# ---------- python_script.python (30 lines) ----------
import clr
# Import RevitNodes
clr.AddReference("RevitNodes")
import Revit
# Import types we need. Instead of listing individual types,
# you can do 'from Revit.Elements import *'

import sys
sys.path.append("C:\Program Files (x86)\IronPython 2.7\Lib")

import itertools

clr.AddReference('ProtoGeometry')
from Autodesk.DesignScript.Geometry import *

input = IN[0]

pointlist = input.split()

def grouper(n, it):
    "grouper(3, 'ABCDEFG') --> ABC DEF G"
    it = iter(it)
    return iter(lambda: list(itertools.islice(it, n)), [])

pointlist = list(grouper(3, pointlist))

#for item in input.split("\n")
 #   output.append(item)
#Assign your output to the OUT variable.
OUT = pointlist
# ----------------------------------------
getSharedCoordinate = Custom[GIS2BIM.GetSharedCoordinate]()  # Get the current shared coordinate
code_block_7 = CodeBlock(t2=python_script, x=getSharedCoordinate.E_W, y=getSharedCoordinate.N_S)
# ---------- code_block_7.designscript (7 lines) ----------
t1 = DSCore.List.Transpose(t2);
x;
y;
t5 = 1000*(x-String.ToNumber(DSCore.List.GetItemAtIndex(t1, 1)));
t6 = 1000*(y-String.ToNumber(DSCore.List.GetItemAtIndex(t1, 2)));
t7 = 1000*String.ToNumber(DSCore.List.GetItemAtIndex(t1, 0));
points = Point.ByCoordinates(t5,t6,t7);
# ----------------------------------------
code_block_8 = CodeBlock { 0; 55495; }
removeItemAtIndex = List.RemoveItemAtIndex(list=code_block_7.points, indices=code_block_8.out0)
removeItemAtIndex_2 = List.RemoveItemAtIndex(list=removeItemAtIndex, indices=code_block_8.out1)
code_block_9 = CodeBlock { 6; }
takeEveryNthItem = List.TakeEveryNthItem(removeItemAtIndex_2, code_block_9)
byPoints_2 = Topography.ByPoints(takeEveryNthItem)
byMesh = DirectShape.ByMesh()  # unwired: arg0, arg1
volume = Autodesk.Dynamo.MeshToolkit.Mesh.Volume()  # unwired: arg0
reduce = Autodesk.Dynamo.MeshToolkit.Mesh.Reduce()  # unwired: arg0, arg1
watch = Watch()  # unwired: arg0
