# Dynamo graph sandboxTMS.dyn (Dynamo 1.3.1.1736)

code_block = CodeBlock { "wattstraat"; "17"; "zwijndrecht"; "the netherlands"; }
geoCodingGoogleAPI = Custom[GIS2BIM.GeoCodingGoogleAPI](Streetname=code_block.out0, Housenumber=code_block.out1, Place=code_block.out2, Country=code_block.out3)  # gets coordinate from adress with google API
desired_width = CodeBlock { 300; }
createBoundingBoxLATLONG = Custom[GIS2BIM.CreateBoundingBoxLATLONG](Lat=geoCodingGoogleAPI.Latitude, Long=geoCodingGoogleAPI.Longitude, WidthMeters=desired_width)  # create boundingbox with from lat/long coordinate in degrees
zoomlevel = CodeBlock { 19; }

# group: LEFT BOTTOM
TMSTileNumberFromCoordinate = Custom[GIS2BIM.TMSTileNumberFromCoordinate](Latitude=createBoundingBoxLATLONG.South, Longitude=createBoundingBoxLATLONG.West, Zoomlevel=zoomlevel)  # Calculate TMS(Tile Map Service) Number from a lat/lon coördinate
TMSBoundingboxFromTileNumber = Custom[GIS2BIM.TMSBoundingboxFromTileNumber](TileX=TMSTileNumberFromCoordinate.dblXTile, TileY=TMSTileNumberFromCoordinate.dblYTile, Zoomlevel=zoomlevel)  # Calculate Lat/Lon boundaries from a TileNumber in TMS(Tile Map Service)

# group: TOP RIGHT
TMSTileNumberFromCoordinate_2 = Custom[GIS2BIM.TMSTileNumberFromCoordinate](Latitude=createBoundingBoxLATLONG.North, Longitude=createBoundingBoxLATLONG.East, Zoomlevel=zoomlevel)
TMSBoundingboxFromTileNumber_2 = Custom[GIS2BIM.TMSBoundingboxFromTileNumber](TileX=TMSTileNumberFromCoordinate_2.dblXTile, TileY=TMSTileNumberFromCoordinate_2.dblYTile, Zoomlevel=zoomlevel)

distanceBetweenCoordinatesWGS84 = Custom[GIS2BIM.DistanceBetweenCoordinatesWGS84](Latitude1=TMSBoundingboxFromTileNumber.South, Longitude1=TMSBoundingboxFromTileNumber_2.East, Latitude2=TMSBoundingboxFromTileNumber.South, Longitude2=TMSBoundingboxFromTileNumber.West)  # Calculate the distance between 2 lat/lon coördinates in meters
current = Document.Current()
activeView = Document.ActiveView(current)
code_block_2 = CodeBlock { "https://mt1.google.com/vt/lyrs=s"; "&x="; "&y="; "&z="; }
code_block_3 = CodeBlock(x2=TMSTileNumberFromCoordinate_2.dblXTile, x1=TMSTileNumberFromCoordinate.dblXTile, y2=TMSTileNumberFromCoordinate.dblYTile, y1=TMSTileNumberFromCoordinate_2.dblYTile) { deltax=x2-x1; deltay=y2-y1; listx=x1..x2..#deltax+1; listy=y2..y1..#deltay+1; }
python_script = Python(IN[0]=code_block_3.listx, IN[1]=code_block_3.listy)
# ---------- python_script.python (30 lines) ----------
import clr
clr.AddReference('ProtoGeometry')
from Autodesk.DesignScript.Geometry import *
#The inputs to this node will be stored as a list in the IN variables.
dataEnteringNode = IN

x=IN[0]
y=IN[1]

n = len(y)
xl1=[]
for i in x:
	xl1.append([i]*n)

xl2=[]
for sublist in xl1:
    for item in sublist:
        xl2.append(item)
        
yl1=[]
for i in x:
	yl1.append(y)

yl2=[]
for sublist in yl1:
    for item in sublist:
        yl2.append(item)

#Assign your output to the OUT variable.
OUT = xl2,yl2
# ----------------------------------------
code_block_4 = CodeBlock(out=python_script) { out[0]; out[1]; }
string_from_object = FromObject(code_block_4.out0)
string_from_object_2 = FromObject(code_block_4.out1)
code_block_5 = CodeBlock { 19; }
string_from_object_3 = FromObject(code_block_5)
python_script_2 = Python(IN[0]=code_block_2.out0, IN[1]=code_block_2.out1, IN[2]=string_from_object, IN[3]=code_block_2.out2, IN[4]=string_from_object_2, IN[5]=code_block_2.out3, IN[6]=string_from_object_3)
# ---------- python_script_2.python (25 lines) ----------
import clr
clr.AddReference('ProtoGeometry')
from Autodesk.DesignScript.Geometry import *
#The inputs to this node will be stored as a list in the IN variables.
dataEnteringNode = IN

str1=IN[0]
str2=IN[1]
lst3=IN[2]
str4=IN[3]
lst5=IN[4]
str6=IN[5]
zooml=IN[6]

n=len(lst3)

lst1=[str1]*n
lst2=[str2]*n
lst4=[str4]*n
lst6=[str6]*n
lst7=[zooml]*n

lstout=[a+b+c+d+e+f+g for a,b,c,d,e,f,g in zip(lst1,lst2,lst3,lst4,lst5,lst6,lst7)]

OUT = lstout
# ----------------------------------------
watch = Watch(code_block_3.listx)
watch_2 = Watch(code_block_3.listy)
boolean = BoolSelector(true)
TMS_WMTS_WebrequestAndCombineImages = Custom[GIS2BIM.TMS_WMTS_WebrequestAndCombineImages](URLlist=python_script_2, UniqueTileNumbersColumnX=watch, UniqueTileNumbersRowY=watch_2, ReverseYaxis=boolean)  # Webrequest for list of WMTS or TMS/Google webrequests for tiles. Combines them to 1 image.
watch_image = WatchImageCore(TMS_WMTS_WebrequestAndCombineImages.Image)
code_block_6 = CodeBlock { "C:/TEMP/map24.jpg"; }
systemDrawingBitmapToJPG = Custom[GIS2BIM.SystemDrawingBitmapToJPG](SystemDrawingBitmap=watch_image, FileName=code_block_6)  # frozen; Save an System.Drawing.Bitmap object as a jpg-file

# group: DIFF LEFT WIDTH(CALCULATED, TILES)
distanceBetweenCoordinatesWGS84_2 = Custom[GIS2BIM.DistanceBetweenCoordinatesWGS84](Latitude1=createBoundingBoxLATLONG.South, Longitude1=createBoundingBoxLATLONG.West, Latitude2=createBoundingBoxLATLONG.South, Longitude2=TMSBoundingboxFromTileNumber.West)

# group: HEIGHT OF TILES
distanceBetweenCoordinatesWGS84_3 = Custom[GIS2BIM.DistanceBetweenCoordinatesWGS84](Latitude1=TMSBoundingboxFromTileNumber.South, Longitude1=TMSBoundingboxFromTileNumber.West, Latitude2=TMSBoundingboxFromTileNumber_2.North, Longitude2=TMSBoundingboxFromTileNumber.West)

# group: DIFF BOTTOM HEIGHT(CALCULATED, TILES)
distanceBetweenCoordinatesWGS84_4 = Custom[GIS2BIM.DistanceBetweenCoordinatesWGS84](Latitude1=TMSBoundingboxFromTileNumber.South, Longitude1=TMSBoundingboxFromTileNumber.East, Latitude2=createBoundingBoxLATLONG.South, Longitude2=TMSBoundingboxFromTileNumber.East)

code_block_7 = CodeBlock(widthTiles=distanceBetweenCoordinatesWGS84, WidthDesired=desired_width, dxleft=distanceBetweenCoordinatesWGS84_2, heightTiles=distanceBetweenCoordinatesWGS84_3, dybottom=distanceBetweenCoordinatesWGS84_4)
# ---------- code_block_7.designscript (6 lines) ----------
deltawidth=widthTiles-WidthDesired;
a=deltawidth/2;
dximportimageMM=1000*((a-dxleft));
deltaheight=heightTiles-WidthDesired;
b=deltaheight/2;
dyimportimageMM=1000*((b-dybottom));
# ----------------------------------------
importImageInView = Custom[GIS2BIM.ImportImageInView](ImageWidthMeters=distanceBetweenCoordinatesWGS84, View=activeView, ImagePath=systemDrawingBitmapToJPG, DeltaX=code_block_7.dximportimageMM, DeltaY=code_block_7.dyimportimageMM)  # Import rasterimage in view
setRevitSiteLocation = Custom[GIS2BIM.SetRevitSiteLocation](lat=geoCodingGoogleAPI.Latitude, lon=geoCodingGoogleAPI.Longitude)  # Sets the properties of the current Site Location of the active Revit Project
code_block_8 = CodeBlock { "28992"; }
transformCRS_epsg = Custom[GIS2BIM.TransformCRS_epsg](targetCRS=code_block_8, xCoordinate=geoCodingGoogleAPI.Longitude, yCoordinate=geoCodingGoogleAPI.Latitude)  # Uses the API of http://epsg.io to transform Coordinate Reference Systems
setSharedCoordinate = Custom[GIS2BIM.SetSharedCoordinate](x=transformCRS_epsg.Xtransformed, y=transformCRS_epsg.Ytransformed)  # Set shared coordinate/project basepoint
webrequestWMTS = Custom[GIS2BIM.WebrequestWMTS]()  # unwired: WMTSWebrequestslinks, UniqueTileRows, UniqueTileColumns
TMSWebServices = Custom[GIS2BIM.TMSWebServices](TileX=string_from_object, TileY=string_from_object_2, Zoomlevel=zoomlevel)  # Library With TMS Webservices
