# Dynamo graph sandboxTMS2.dyn (Dynamo 1.3.2.2480)

code_block = CodeBlock { "https://mt1.google.com/vt/lyrs=s&x=268935&y=173664&z=19"; }
python_script = Python(IN[0]=code_block)  # starter script, not edited (OUT = 0)
downloadOSM = Custom[GIS2BIM.DownloadOSM]()  # Download OSM data within a boundingbox; unwired: West, East, North, South, Directory
code_block_2 = CodeBlock { "C:/TEMP/googletms.jpg"; }
python_script_2 = Python(IN[0]=code_block, IN[1]=code_block_2)
# ---------- python_script_2.python (11 lines) ----------
import sys
sys.path.append("C:\Program Files (x86)\IronPython 2.7\Lib")
from System.Net import WebClient
import urllib2

url= IN[0]
filoc= IN[1]

WebClient().DownloadFile(url, filoc)

OUT= filoc
# ----------------------------------------
webrequestWMS = Custom[GIS2BIM.WebrequestWMS](WMSwebrequest=code_block)  # a webrequest based on WMS-protocol
python_script_3 = Python(IN[0]=code_block)
# ---------- python_script_3.python (19 lines) ----------
import sys
sys.path.append("C:\Program Files (x86)\IronPython 2.7\Lib")

import clr

clr.AddReference("System.Drawing")
clr.AddReference("System")
from System.Drawing import Image
from System.Drawing import Bitmap
from System.Drawing import Graphics
from System.Drawing.Imaging import ImageFormat
from System.Net import WebRequest
url= IN[0]

request = WebRequest.Create(url)
response = request.GetResponse()
bitmap = Image.FromStream(response.GetResponseStream())

OUT = bitmap
# ----------------------------------------
code_block_3 = CodeBlock {  }
python_script_4 = Python()  # unwired: IN[0]; starter script, not edited (OUT = 0)
python_script_5 = Python(IN[0]=code_block, IN[1]=code_block_2)
# ---------- python_script_5.python (12 lines) ----------
import sys
sys.path.append("C:\Program Files (x86)\IronPython 2.7\Lib")
from System.Net import WebClient
from System import Uri

url= IN[0]
filoc= IN[1]

url2 = Uri(url)
test = WebClient().DownloadFileAsync(url2, filoc)

OUT= test
# ----------------------------------------
