# Dynamo graph sandboxTMS3.dyn (Dynamo 1.3.1.1736)

code_block = CodeBlock { "3857"; }
code_block_2 = CodeBlock { "werf van schouten"; "501"; "dordrecht"; }
getLocationdataNetherlands = Custom[GIS2BIM.GetLocationdataNetherlands](City=code_block_2.out2, Streetname=code_block_2.out0, Housenumber=code_block_2.out1)  # Gives locationdata based on an adress in the Netherlands
transformCRS_epsg = Custom[GIS2BIM.TransformCRS_epsg](targetCRS=code_block, xCoordinate=getLocationdataNetherlands.Longitude, yCoordinate=getLocationdataNetherlands.Latitude)  # Uses the API of http://epsg.io to transform Coordinate Reference Systems
desired_width = CodeBlock { 400; }
createBoundingBox = Custom[GIS2BIM.CreateBoundingBox](CoordinateX=transformCRS_epsg.Xtransformed, CoordinateY=transformCRS_epsg.Ytransformed, BoxWidth=desired_width, BoxHeight=desired_width)  # create boundingboxstring for webrequests based on coördinates and dimensions
code_block_3 = CodeBlock { 19; }

# group: RIGHT TOP XMAX YMAX
toNumber = String.ToNumber(createBoundingBox.Xmax)
toNumber_2 = String.ToNumber(createBoundingBox.Ymax)
python_script = Python(IN[0]=toNumber, IN[1]=toNumber_2, IN[2]=code_block_3)
# ---------- python_script.python (226 lines) ----------
import sys
sys.path.append("C:\Program Files (x86)\IronPython 2.7\Lib")
import math

x = IN[0]
y = IN[1]
zoom1 = IN[2]

class GlobalMercator(object):
    """
    TMS Global Mercator Profile
    ---------------------------

    Functions necessary for generation of tiles in Spherical Mercator projection,
    EPSG:900913 (EPSG:gOOglE, Google Maps Global Mercator), EPSG:3785, OSGEO:41001.

    Such tiles are compatible with Google Maps, Microsoft Virtual Earth, Yahoo Maps,
    UK Ordnance Survey OpenSpace API, ...
    and you can overlay them on top of base maps of those web mapping applications.
    
    Pixel and tile coordinates are in TMS notation (origin [0,0] in bottom-left).

    What coordinate conversions do we need for TMS Global Mercator tiles::

         LatLon      <->       Meters      <->     Pixels    <->       Tile     

     WGS84 coordinates   Spherical Mercator  Pixels in pyramid  Tiles in pyramid
         lat/lon            XY in metres     XY pixels Z zoom      XYZ from TMS 
        EPSG:4326           EPSG:900913                                         
         .----.              ---------               --                TMS      
        /      \     <->     |       |     <->     /----/    <->      Google    
        \      /             |       |           /--------/          QuadTree   
         -----               ---------         /------------/                   
       KML, public         WebMapService         Web Clients      TileMapService

    What is the coordinate extent of Earth in EPSG:900913?

      [-20037508.342789244, -20037508.342789244, 20037508.342789244, 20037508.342789244]
      Constant 20037508.342789244 comes from the circumference of the Earth in meters,
      which is 40 thousand kilometers, the coordinate origin is in the middle of extent.
      In fact you can calculate the constant as: 2 * math.pi * 6378137 / 2.0
      $ echo 180 85 | gdaltransform -s_srs EPSG:4326 -t_srs EPSG:900913
      Polar areas with abs(latitude) bigger then 85.05112878 are clipped off.

    What are zoom level constants (pixels/meter) for pyramid with EPSG:900913?

      whole region is on top of pyramid (zoom=0) covered by 256x256 pixels tile,
      every lower zoom level resolution is always divided by two
      initialResolution = 20037508.342789244 * 2 / 256 = 156543.03392804062

    What is the difference between TMS and Google Maps/QuadTree tile name convention?

      The tile raster itself is the same (equal extent, projection, pixel size),
      there is just different identification of the same raster tile.
      Tiles in TMS are counted from [0,0] in the bottom-left corner, id is XYZ.
      Google placed the origin [0,0] to the top-left corner, reference is XYZ.
      Microsoft is referencing tiles by a QuadTree name, defined on the website:
      http://msdn2.microsoft.com/en-us/library/bb259689.aspx

    The lat/lon coordinates are using WGS84 datum, yeh?

      Yes, all lat/lon we are mentioning should use WGS84 Geodetic Datum.
      Well, the web clients like Google Maps are projecting those coordinates by
      Spherical Mercator, so in fact lat/lon coordinates on sphere are treated as if
      the were on the WGS84 ellipsoid.
     
      From MSDN documentation:
      To simplify the calculations, we use the spherical form of projection, not
      the ellipsoidal form. Since the projection is used only for map display,
      and not for displaying numeric coordinates, we don't need the extra precision
      of an ellipsoidal projection. The spherical projection causes approximately
      0.33 percent scale distortion in the Y direction, which is not visually noticable.

    How do I create a raster in EPSG:900913 and convert coordinates with PROJ.4?

      You can use standard GIS tools like gdalwarp, cs2cs or gdaltransform.
      All of the tools supports -t_srs 'epsg:900913'.

      For other GIS programs check the exact definition of the projection:
      More info at http://spatialreference.org/ref/user/google-projection/
      The same projection is degined as EPSG:3785. WKT definition is in the official
      EPSG database.

      Proj4 Text:
        +proj=merc +a=6378137 +b=6378137 +lat_ts=0.0 +lon_0=0.0 +x_0=0.0 +y_0=0
        +k=1.0 +units=m +nadgrids=@null +no_defs

      Human readable WKT format of EPGS:900913:
         PROJCS["Google Maps Global Mercator",
             GEOGCS["WGS 84",
                 DATUM["WGS_1984",
                     SPHEROID["WGS 84",6378137,298.2572235630016,
                         AUTHORITY["EPSG","7030"]],
                     AUTHORITY["EPSG","6326"]],
                 PRIMEM["Greenwich",0],
                 UNIT["degree",0.0174532925199433],
                 AUTHORITY["EPSG","4326"]],
             PROJECTION["Mercator_1SP"],
             PARAMETER["central_meridian",0],
             PARAMETER["scale_factor",1],
             PARAMETER["false_easting",0],
             PARAMETER["false_northing",0],
             UNIT["metre",1,
                 AUTHORITY["EPSG","9001"]]]
    """

    def __init__(self, tileSize=256):
        "Initialize the TMS Global Mercator pyramid"
        self.tileSize = tileSize
        self.initialResolution = 2 * math.pi * 6378137 / self.tileSize
        # 156543.03392804062 for tileSize 256 pixels
        self.originShift = 2 * math.pi * 6378137 / 2.0
        # 20037508.342789244

    def LatLonToMeters(self, lat, lon ):
        "Converts given lat/lon in WGS84 Datum to XY in Spherical Mercator EPSG:900913"

        mx = lon * self.originShift / 180.0
        my = math.log( math.tan((90 + lat) * math.pi / 360.0 )) / (math.pi / 180.0)

        my = my * self.originShift / 180.0
        return mx, my

    def MetersToLatLon(self, mx, my ):
        "Converts XY point from Spherical Mercator EPSG:900913 to lat/lon in WGS84 Datum"

        lon = (mx / self.originShift) * 180.0
        lat = (my / self.originShift) * 180.0

        lat = 180 / math.pi * (2 * math.atan( math.exp( lat * math.pi / 180.0)) - math.pi / 2.0)
        return lat, lon

    def PixelsToMeters(self, px, py, zoom):
        "Converts pixel coordinates in given zoom level of pyramid to EPSG:900913"

        res = self.Resolution( zoom )
        mx = px * res - self.originShift
        my = py * res - self.originShift
        return mx, my
        
    def MetersToPixels(self, mx, my, zoom):
        "Converts EPSG:900913 to pyramid pixel coordinates in given zoom level"
                
        res = self.Resolution( zoom )
        px = (mx + self.originShift) / res
        py = (my + self.originShift) / res
        return px, py
    
    def PixelsToTile(self, px, py):
        "Returns a tile covering region in given pixel coordinates"

        tx = int( math.ceil( px / float(self.tileSize) ) - 1 )
        ty = int( math.ceil( py / float(self.tileSize) ) - 1 )
        return tx, ty

    def PixelsToRaster(self, px, py, zoom):
        "Move the origin of pixel coordinates to top-left corner"
        
        mapSize = self.tileSize << zoom
        return px, mapSize - py
        
    def MetersToTile(self, mx, my, zoom):
        "Returns tile for given mercator coordinates"
        
        px, py = self.MetersToPixels( mx, my, zoom)
        return self.PixelsToTile( px, py)

    def TileBounds(self, tx, ty, zoom):
        "Returns bounds of the given tile in EPSG:900913 coordinates"
        
        minx, miny = self.PixelsToMeters( tx*self.tileSize, ty*self.tileSize, zoom )
        maxx, maxy = self.PixelsToMeters( (tx+1)*self.tileSize, (ty+1)*self.tileSize, zoom )
        return ( minx, miny, maxx, maxy )

    def TileLatLonBounds(self, tx, ty, zoom ):
        "Returns bounds of the given tile in latutude/longitude using WGS84 datum"

        bounds = self.TileBounds( tx, ty, zoom)
        minLat, minLon = self.MetersToLatLon(bounds[0], bounds[1])
        maxLat, maxLon = self.MetersToLatLon(bounds[2], bounds[3])
         
        return ( minLat, minLon, maxLat, maxLon )
        
    def Resolution(self, zoom ):
        "Resolution (meters/pixel) for given zoom level (measured at Equator)"
        
        # return (2 * math.pi * 6378137) / (self.tileSize * 2**zoom)
        return self.initialResolution / (2**zoom)
        
    def ZoomForPixelSize(self, pixelSize ):
        "Maximal scaledown zoom of the pyramid closest to the pixelSize."
        
        for i in range(30):
            if pixelSize > self.Resolution(i):
                return i-1 if i!=0 else 0 # We don't want to scale up

    def GoogleTile(self, tx, ty, zoom):
        "Converts TMS tile coordinates to Google Tile coordinates"
        
        # coordinate origin is moved from bottom-left to top-left corner of the extent
        return tx, (2**zoom - 1) - ty

    def QuadTree(self, tx, ty, zoom ):
        "Converts TMS tile coordinates to Microsoft QuadTree"
        
        quadKey = ""
        ty = (2**zoom - 1) - ty
        for i in range(zoom, 0, -1):
            digit = 0
            mask = 1 << (i-1)
            if (tx & mask) != 0:
                digit += 1
            if (ty & mask) != 0:
                digit += 2
            quadKey += str(digit)
            
        return quadKey

#---------------------
a = GlobalMercator()

#b = GlobalMercator.self
b = a.MetersToTile(x,y, zoom1)
c = a.GoogleTile(b[0],b[1],zoom1)
d = a.TileBounds(b[0],b[1],zoom1)
OUT = c,d
# ----------------------------------------
code_block_4 = CodeBlock(a=python_script) { a[0][0]; a[0][1]; xmax=a[1][2]; ymax=-1*a[1][3]; }

# group: LEFT BOTTOM XMIN YMIN
toNumber_3 = String.ToNumber(createBoundingBox.Xmin)
toNumber_4 = String.ToNumber(createBoundingBox.Ymin)
python_script_2 = Python(IN[0]=toNumber_3, IN[1]=toNumber_4, IN[2]=code_block_3)
# ---------- python_script_2.python (228 lines) ----------
import sys
sys.path.append("C:\Program Files (x86)\IronPython 2.7\Lib")
import math

x = IN[0]
y = IN[1]
zoom = IN[2]

class GlobalMercator(object):
    """
    TMS Global Mercator Profile
    ---------------------------

    Functions necessary for generation of tiles in Spherical Mercator projection,
    EPSG:900913 (EPSG:gOOglE, Google Maps Global Mercator), EPSG:3785, OSGEO:41001.

    Such tiles are compatible with Google Maps, Microsoft Virtual Earth, Yahoo Maps,
    UK Ordnance Survey OpenSpace API, ...
    and you can overlay them on top of base maps of those web mapping applications.
    
    Pixel and tile coordinates are in TMS notation (origin [0,0] in bottom-left).

    What coordinate conversions do we need for TMS Global Mercator tiles::

         LatLon      <->       Meters      <->     Pixels    <->       Tile     

     WGS84 coordinates   Spherical Mercator  Pixels in pyramid  Tiles in pyramid
         lat/lon            XY in metres     XY pixels Z zoom      XYZ from TMS 
        EPSG:4326           EPSG:900913                                         
         .----.              ---------               --                TMS      
        /      \     <->     |       |     <->     /----/    <->      Google    
        \      /             |       |           /--------/          QuadTree   
         -----               ---------         /------------/                   
       KML, public         WebMapService         Web Clients      TileMapService

    What is the coordinate extent of Earth in EPSG:900913?

      [-20037508.342789244, -20037508.342789244, 20037508.342789244, 20037508.342789244]
      Constant 20037508.342789244 comes from the circumference of the Earth in meters,
      which is 40 thousand kilometers, the coordinate origin is in the middle of extent.
      In fact you can calculate the constant as: 2 * math.pi * 6378137 / 2.0
      $ echo 180 85 | gdaltransform -s_srs EPSG:4326 -t_srs EPSG:900913
      Polar areas with abs(latitude) bigger then 85.05112878 are clipped off.

    What are zoom level constants (pixels/meter) for pyramid with EPSG:900913?

      whole region is on top of pyramid (zoom=0) covered by 256x256 pixels tile,
      every lower zoom level resolution is always divided by two
      initialResolution = 20037508.342789244 * 2 / 256 = 156543.03392804062

    What is the difference between TMS and Google Maps/QuadTree tile name convention?

      The tile raster itself is the same (equal extent, projection, pixel size),
      there is just different identification of the same raster tile.
      Tiles in TMS are counted from [0,0] in the bottom-left corner, id is XYZ.
      Google placed the origin [0,0] to the top-left corner, reference is XYZ.
      Microsoft is referencing tiles by a QuadTree name, defined on the website:
      http://msdn2.microsoft.com/en-us/library/bb259689.aspx

    The lat/lon coordinates are using WGS84 datum, yeh?

      Yes, all lat/lon we are mentioning should use WGS84 Geodetic Datum.
      Well, the web clients like Google Maps are projecting those coordinates by
      Spherical Mercator, so in fact lat/lon coordinates on sphere are treated as if
      the were on the WGS84 ellipsoid.
     
      From MSDN documentation:
      To simplify the calculations, we use the spherical form of projection, not
      the ellipsoidal form. Since the projection is used only for map display,
      and not for displaying numeric coordinates, we don't need the extra precision
      of an ellipsoidal projection. The spherical projection causes approximately
      0.33 percent scale distortion in the Y direction, which is not visually noticable.

    How do I create a raster in EPSG:900913 and convert coordinates with PROJ.4?

      You can use standard GIS tools like gdalwarp, cs2cs or gdaltransform.
      All of the tools supports -t_srs 'epsg:900913'.

      For other GIS programs check the exact definition of the projection:
      More info at http://spatialreference.org/ref/user/google-projection/
      The same projection is degined as EPSG:3785. WKT definition is in the official
      EPSG database.

      Proj4 Text:
        +proj=merc +a=6378137 +b=6378137 +lat_ts=0.0 +lon_0=0.0 +x_0=0.0 +y_0=0
        +k=1.0 +units=m +nadgrids=@null +no_defs

      Human readable WKT format of EPGS:900913:
         PROJCS["Google Maps Global Mercator",
             GEOGCS["WGS 84",
                 DATUM["WGS_1984",
                     SPHEROID["WGS 84",6378137,298.2572235630016,
                         AUTHORITY["EPSG","7030"]],
                     AUTHORITY["EPSG","6326"]],
                 PRIMEM["Greenwich",0],
                 UNIT["degree",0.0174532925199433],
                 AUTHORITY["EPSG","4326"]],
             PROJECTION["Mercator_1SP"],
             PARAMETER["central_meridian",0],
             PARAMETER["scale_factor",1],
             PARAMETER["false_easting",0],
             PARAMETER["false_northing",0],
             UNIT["metre",1,
                 AUTHORITY["EPSG","9001"]]]
    """

    def __init__(self, tileSize=256):
        "Initialize the TMS Global Mercator pyramid"
        self.tileSize = tileSize
        self.initialResolution = 2 * math.pi * 6378137 / self.tileSize
        # 156543.03392804062 for tileSize 256 pixels
        self.originShift = 2 * math.pi * 6378137 / 2.0
        # 20037508.342789244

    def LatLonToMeters(self, lat, lon ):
        "Converts given lat/lon in WGS84 Datum to XY in Spherical Mercator EPSG:900913"

        mx = lon * self.originShift / 180.0
        my = math.log( math.tan((90 + lat) * math.pi / 360.0 )) / (math.pi / 180.0)

        my = my * self.originShift / 180.0
        return mx, my

    def MetersToLatLon(self, mx, my ):
        "Converts XY point from Spherical Mercator EPSG:900913 to lat/lon in WGS84 Datum"

        lon = (mx / self.originShift) * 180.0
        lat = (my / self.originShift) * 180.0

        lat = 180 / math.pi * (2 * math.atan( math.exp( lat * math.pi / 180.0)) - math.pi / 2.0)
        return lat, lon

    def PixelsToMeters(self, px, py, zoom):
        "Converts pixel coordinates in given zoom level of pyramid to EPSG:900913"

        res = self.Resolution( zoom )
        mx = px * res - self.originShift
        my = py * res - self.originShift
        return mx, my
        
    def MetersToPixels(self, mx, my, zoom):
        "Converts EPSG:900913 to pyramid pixel coordinates in given zoom level"
                
        res = self.Resolution( zoom )
        px = (mx + self.originShift) / res
        py = (my + self.originShift) / res
        return px, py
    
    def PixelsToTile(self, px, py):
        "Returns a tile covering region in given pixel coordinates"

        tx = int( math.ceil( px / float(self.tileSize) ) - 1 )
        ty = int( math.ceil( py / float(self.tileSize) ) - 1 )
        return tx, ty

    def PixelsToRaster(self, px, py, zoom):
        "Move the origin of pixel coordinates to top-left corner"
        
        mapSize = self.tileSize << zoom
        return px, mapSize - py
        
    def MetersToTile(self, mx, my, zoom):
        "Returns tile for given mercator coordinates"
        
        px, py = self.MetersToPixels( mx, my, zoom)
        return self.PixelsToTile( px, py)

    def TileBounds(self, tx, ty, zoom):
        "Returns bounds of the given tile in EPSG:900913 coordinates"
        
        minx, miny = self.PixelsToMeters( tx*self.tileSize, ty*self.tileSize, zoom )
        maxx, maxy = self.PixelsToMeters( (tx+1)*self.tileSize, (ty+1)*self.tileSize, zoom )
        return ( minx, miny, maxx, maxy )

    def TileLatLonBounds(self, tx, ty, zoom ):
        "Returns bounds of the given tile in latutude/longitude using WGS84 datum"

        bounds = self.TileBounds( tx, ty, zoom)
        minLat, minLon = self.MetersToLatLon(bounds[0], bounds[1])
        maxLat, maxLon = self.MetersToLatLon(bounds[2], bounds[3])
         
        return ( minLat, minLon, maxLat, maxLon )
        
    def Resolution(self, zoom ):
        "Resolution (meters/pixel) for given zoom level (measured at Equator)"
        
        # return (2 * math.pi * 6378137) / (self.tileSize * 2**zoom)
        return self.initialResolution / (2**zoom)
        
    def ZoomForPixelSize(self, pixelSize ):
        "Maximal scaledown zoom of the pyramid closest to the pixelSize."
        
        for i in range(30):
            if pixelSize > self.Resolution(i):
                return i-1 if i!=0 else 0 # We don't want to scale up

    def GoogleTile(self, tx, ty, zoom):
        "Converts TMS tile coordinates to Google Tile coordinates"
        
        # coordinate origin is moved from bottom-left to top-left corner of the extent
        return tx, (2**zoom - 1) - ty

    def QuadTree(self, tx, ty, zoom ):
        "Converts TMS tile coordinates to Microsoft QuadTree"
        
        quadKey = ""
        ty = (2**zoom - 1) - ty
        for i in range(zoom, 0, -1):
            digit = 0
            mask = 1 << (i-1)
            if (tx & mask) != 0:
                digit += 1
            if (ty & mask) != 0:
                digit += 2
            quadKey += str(digit)
            
        return quadKey

#---------------------
a = GlobalMercator()

#b = GlobalMercator.self
b = a.MetersToTile(x,y, zoom)
c = a.GoogleTile(b[0],b[1],zoom)
d = a.PixelsToTile(c[0],c[1])
e = a.TileBounds(b[0],b[1], zoom)

OUT = c,e
# ----------------------------------------
code_block_5 = CodeBlock(a=python_script_2) { a[0][0]; a[0][1]; xmin=a[1][0]; ymin=-1*a[1][1]; }

code_block_6 = CodeBlock(xmax=code_block_4.xmax, xmin=code_block_5.xmin, ymax=code_block_4.ymax, ymin=code_block_5.ymin, width=desired_width, height=desired_width, xleftbottomcalc=toNumber_3, yleftbottomcalc=toNumber_4)
# ---------- code_block_6.designscript (10 lines) ----------
widthtile=xmax-xmin;
heighttile=ymax-ymin;
dx=widthtile-width;
dy=heighttile-height;
dxcoord=-1*(xmin-xleftbottomcalc);
dycoord=-1*(ymin-yleftbottomcalc);
ew=0.5*width+dxcoord-0.5*widthtile;
ew*-1000;
eh=0.5*height+dycoord-0.5*heighttile;
eh*-1000;
# ----------------------------------------
current = Document.Current()
activeView = Document.ActiveView(current)
code_block_7 = CodeBlock { "https://mt1.google.com/vt/lyrs=s"; "&x="; "&y="; "&z="; }
code_block_8 = CodeBlock(x2=code_block_4.out0, x1=code_block_5.out0, y2=code_block_5.out1, y1=code_block_4.out1) { deltax=x2-x1; deltay=y2-y1; listx=x1..x2..#deltax+1; listy=y2..y1..#deltay+1; }
python_script_3 = Python(IN[0]=code_block_8.listx, IN[1]=code_block_8.listy)
# ---------- python_script_3.python (30 lines) ----------
import clr
clr.AddReference('ProtoGeometry')
from Autodesk.DesignScript.Geometry import *
#The inputs to this node will be stored as a list in the IN variables.
dataEnteringNode = IN

x=IN[0]
y=IN[1]

n = len(y)
xl1=[]
for i in x:
	xl1.append([i]*n)

xl2=[]
for sublist in xl1:
    for item in sublist:
        xl2.append(item)
        
yl1=[]
for i in x:
	yl1.append(y)

yl2=[]
for sublist in yl1:
    for item in sublist:
        yl2.append(item)

#Assign your output to the OUT variable.
OUT = xl2,yl2
# ----------------------------------------
code_block_9 = CodeBlock(out=python_script_3) { out[0]; out[1]; }
string_from_object = FromObject(code_block_9.out0)
string_from_object_2 = FromObject(code_block_9.out1)
string_from_object_3 = FromObject(code_block_3)
code_block_10 = CodeBlock { ","; }
split = String.Split(string_from_object_3, code_block_10)
firstItem = List.FirstItem(split)
python_script_4 = Python(IN[0]=code_block_7.out0, IN[1]=code_block_7.out1, IN[2]=string_from_object, IN[3]=code_block_7.out2, IN[4]=string_from_object_2, IN[5]=code_block_7.out3, IN[6]=firstItem)
# ---------- python_script_4.python (25 lines) ----------
import clr
clr.AddReference('ProtoGeometry')
from Autodesk.DesignScript.Geometry import *
#The inputs to this node will be stored as a list in the IN variables.
dataEnteringNode = IN

str1=IN[0]
str2=IN[1]
lst3=IN[2]
str4=IN[3]
lst5=IN[4]
str6=IN[5]
zooml=IN[6]

n=len(lst3)

lst1=[str1]*n
lst2=[str2]*n
lst4=[str4]*n
lst6=[str6]*n
lst7=[zooml]*n

lstout=[a+b+c+d+e+f+g for a,b,c,d,e,f,g in zip(lst1,lst2,lst3,lst4,lst5,lst6,lst7)]

OUT = lstout
# ----------------------------------------
python_script_5 = Python(IN[0]=python_script_4)
# ---------- python_script_5.python (19 lines) ----------
import clr
clr.AddReference("System.Drawing")
clr.AddReference("System")
from System.Drawing import Image
from System.Drawing import Bitmap
from System.Drawing import Graphics
from System.Drawing.Imaging import ImageFormat
from System.Net import WebRequest
url= IN[0]

bitmap = []
for i in url:
	request = WebRequest.Create(i)
	request.Accept = "text/html"
	request.UserAgent = "Mozilla/5.0"
	response = request.GetResponse()
	bitmap.append(Image.FromStream(response.GetResponseStream()))

OUT = bitmap
# ----------------------------------------
watch = Watch(code_block_8.listx)
watch_2 = Watch(code_block_8.listy)
code_block_11 = CodeBlock { 256; }
python_script_6 = Python(IN[0]=python_script_5, IN[1]=watch, IN[2]=watch_2, IN[3]=code_block_11)
# ---------- python_script_6.python (70 lines) ----------
import sys

sys.path.append("C:\Program Files (x86)\IronPython 2.7\Lib")
from math import *
import itertools
from itertools import islice

import clr

clr.AddReference("System.Drawing")
from System.Drawing import Image
from System.Drawing import Bitmap
from System.Drawing import Graphics
from System.Drawing.Imaging import ImageFormat
from System.IO import Path
from os import listdir

# The inputs to this node will be stored as a list in the IN variables.
bitmaps=IN[0]
x=IN[1]
y=IN[2]
pixels=IN[3]

TotalWidth= len(x)*pixels
TotalHeight= len(y)*pixels

# create image object for the new image
img = Bitmap(TotalWidth,TotalHeight)
g= Graphics.FromImage(img)

LPx=[]
n=0
for i in x:
	LPx.append(n*pixels)
	n=n+1

LPy=[]
n=0
for i in y:
	LPy.append(n*pixels)
	n=n+1

LPx2=[]
n=len(LPy)
for i in LPx:
	LPx2.append([i]*n)

LPx3=[]
for sublist in LPx2:
    for item in sublist:
        LPx3.append(item)

LPy2=[]
#n=len(LPy)
for i in LPx:
	LPy2.append(LPy)

LPy3=[]
for sublist in LPy2:
    for item in sublist:
        LPy3.append(item)
        
LPy4=reversed(LPy3)

for i,j,k in zip(bitmaps,LPx3,LPy4):
	g.DrawImage(i,j,k)

#h= Bitmap(512,512,g)

OUT = img
# ----------------------------------------
watch_image = WatchImageCore(python_script_6)
code_block_12 = CodeBlock { "C:/TEMP/map9.jpg"; }
systemDrawingBitmapToJPG = Custom[GIS2BIM.SystemDrawingBitmapToJPG](SystemDrawingBitmap=watch_image, FileName=code_block_12)  # frozen; Save an System.Drawing.Bitmap object as a jpg-file
watch_3 = Watch(code_block_6.out7)
watch_4 = Watch(code_block_6.out9)
importImageInView = Custom[GIS2BIM.ImportImageInView](ImageWidthMeters=code_block_6.widthtile, View=activeView, ImagePath=systemDrawingBitmapToJPG, DeltaX=watch_3, DeltaY=watch_4)  # Import rasterimage in view
setRevitSiteLocation = Custom[GIS2BIM.SetRevitSiteLocation](lat=getLocationdataNetherlands.Latitude, lon=getLocationdataNetherlands.Longitude)  # Sets the properties of the current Site Location of the active Revit Project
searchCRS = Custom[GIS2BIM.SearchCRS](EPSG_Code=code_block)  # Search for a Coordinate Reference System
python_script_7 = Python(IN[0]=toNumber, IN[1]=toNumber_2, IN[2]=code_block_3)
# ---------- python_script_7.python (226 lines) ----------
import sys
sys.path.append("C:\Program Files (x86)\IronPython 2.7\Lib")
import math

x = IN[0]
y = IN[1]
zoom = IN[2]

class GlobalMercator(object):
    """
    TMS Global Mercator Profile
    ---------------------------

    Functions necessary for generation of tiles in Spherical Mercator projection,
    EPSG:900913 (EPSG:gOOglE, Google Maps Global Mercator), EPSG:3785, OSGEO:41001.

    Such tiles are compatible with Google Maps, Microsoft Virtual Earth, Yahoo Maps,
    UK Ordnance Survey OpenSpace API, ...
    and you can overlay them on top of base maps of those web mapping applications.
    
    Pixel and tile coordinates are in TMS notation (origin [0,0] in bottom-left).

    What coordinate conversions do we need for TMS Global Mercator tiles::

         LatLon      <->       Meters      <->     Pixels    <->       Tile     

     WGS84 coordinates   Spherical Mercator  Pixels in pyramid  Tiles in pyramid
         lat/lon            XY in metres     XY pixels Z zoom      XYZ from TMS 
        EPSG:4326           EPSG:900913                                         
         .----.              ---------               --                TMS      
        /      \     <->     |       |     <->     /----/    <->      Google    
        \      /             |       |           /--------/          QuadTree   
         -----               ---------         /------------/                   
       KML, public         WebMapService         Web Clients      TileMapService

    What is the coordinate extent of Earth in EPSG:900913?

      [-20037508.342789244, -20037508.342789244, 20037508.342789244, 20037508.342789244]
      Constant 20037508.342789244 comes from the circumference of the Earth in meters,
      which is 40 thousand kilometers, the coordinate origin is in the middle of extent.
      In fact you can calculate the constant as: 2 * math.pi * 6378137 / 2.0
      $ echo 180 85 | gdaltransform -s_srs EPSG:4326 -t_srs EPSG:900913
      Polar areas with abs(latitude) bigger then 85.05112878 are clipped off.

    What are zoom level constants (pixels/meter) for pyramid with EPSG:900913?

      whole region is on top of pyramid (zoom=0) covered by 256x256 pixels tile,
      every lower zoom level resolution is always divided by two
      initialResolution = 20037508.342789244 * 2 / 256 = 156543.03392804062

    What is the difference between TMS and Google Maps/QuadTree tile name convention?

      The tile raster itself is the same (equal extent, projection, pixel size),
      there is just different identification of the same raster tile.
      Tiles in TMS are counted from [0,0] in the bottom-left corner, id is XYZ.
      Google placed the origin [0,0] to the top-left corner, reference is XYZ.
      Microsoft is referencing tiles by a QuadTree name, defined on the website:
      http://msdn2.microsoft.com/en-us/library/bb259689.aspx

    The lat/lon coordinates are using WGS84 datum, yeh?

      Yes, all lat/lon we are mentioning should use WGS84 Geodetic Datum.
      Well, the web clients like Google Maps are projecting those coordinates by
      Spherical Mercator, so in fact lat/lon coordinates on sphere are treated as if
      the were on the WGS84 ellipsoid.
     
      From MSDN documentation:
      To simplify the calculations, we use the spherical form of projection, not
      the ellipsoidal form. Since the projection is used only for map display,
      and not for displaying numeric coordinates, we don't need the extra precision
      of an ellipsoidal projection. The spherical projection causes approximately
      0.33 percent scale distortion in the Y direction, which is not visually noticable.

    How do I create a raster in EPSG:900913 and convert coordinates with PROJ.4?

      You can use standard GIS tools like gdalwarp, cs2cs or gdaltransform.
      All of the tools supports -t_srs 'epsg:900913'.

      For other GIS programs check the exact definition of the projection:
      More info at http://spatialreference.org/ref/user/google-projection/
      The same projection is degined as EPSG:3785. WKT definition is in the official
      EPSG database.

      Proj4 Text:
        +proj=merc +a=6378137 +b=6378137 +lat_ts=0.0 +lon_0=0.0 +x_0=0.0 +y_0=0
        +k=1.0 +units=m +nadgrids=@null +no_defs

      Human readable WKT format of EPGS:900913:
         PROJCS["Google Maps Global Mercator",
             GEOGCS["WGS 84",
                 DATUM["WGS_1984",
                     SPHEROID["WGS 84",6378137,298.2572235630016,
                         AUTHORITY["EPSG","7030"]],
                     AUTHORITY["EPSG","6326"]],
                 PRIMEM["Greenwich",0],
                 UNIT["degree",0.0174532925199433],
                 AUTHORITY["EPSG","4326"]],
             PROJECTION["Mercator_1SP"],
             PARAMETER["central_meridian",0],
             PARAMETER["scale_factor",1],
             PARAMETER["false_easting",0],
             PARAMETER["false_northing",0],
             UNIT["metre",1,
                 AUTHORITY["EPSG","9001"]]]
    """

    def __init__(self, tileSize=256):
        "Initialize the TMS Global Mercator pyramid"
        self.tileSize = tileSize
        self.initialResolution = 2 * math.pi * 6378137 / self.tileSize
        # 156543.03392804062 for tileSize 256 pixels
        self.originShift = 2 * math.pi * 6378137 / 2.0
        # 20037508.342789244

    def LatLonToMeters(self, lat, lon ):
        "Converts given lat/lon in WGS84 Datum to XY in Spherical Mercator EPSG:900913"

        mx = lon * self.originShift / 180.0
        my = math.log( math.tan((90 + lat) * math.pi / 360.0 )) / (math.pi / 180.0)

        my = my * self.originShift / 180.0
        return mx, my

    def MetersToLatLon(self, mx, my ):
        "Converts XY point from Spherical Mercator EPSG:900913 to lat/lon in WGS84 Datum"

        lon = (mx / self.originShift) * 180.0
        lat = (my / self.originShift) * 180.0

        lat = 180 / math.pi * (2 * math.atan( math.exp( lat * math.pi / 180.0)) - math.pi / 2.0)
        return lat, lon

    def PixelsToMeters(self, px, py, zoom):
        "Converts pixel coordinates in given zoom level of pyramid to EPSG:900913"

        res = self.Resolution( zoom )
        mx = px * res - self.originShift
        my = py * res - self.originShift
        return mx, my
        
    def MetersToPixels(self, mx, my, zoom):
        "Converts EPSG:900913 to pyramid pixel coordinates in given zoom level"
                
        res = self.Resolution( zoom )
        px = (mx + self.originShift) / res
        py = (my + self.originShift) / res
        return px, py
    
    def PixelsToTile(self, px, py):
        "Returns a tile covering region in given pixel coordinates"

        tx = int( math.ceil( px / float(self.tileSize) ) - 1 )
        ty = int( math.ceil( py / float(self.tileSize) ) - 1 )
        return tx, ty

    def PixelsToRaster(self, px, py, zoom):
        "Move the origin of pixel coordinates to top-left corner"
        
        mapSize = self.tileSize << zoom
        return px, mapSize - py
        
    def MetersToTile(self, mx, my, zoom):
        "Returns tile for given mercator coordinates"
        
        px, py = self.MetersToPixels( mx, my, zoom)
        return self.PixelsToTile( px, py)

    def TileBounds(self, tx, ty, zoom):
        "Returns bounds of the given tile in EPSG:900913 coordinates"
        
        minx, miny = self.PixelsToMeters( tx*self.tileSize, ty*self.tileSize, zoom )
        maxx, maxy = self.PixelsToMeters( (tx+1)*self.tileSize, (ty+1)*self.tileSize, zoom )
        return ( minx, miny, maxx, maxy )

    def TileLatLonBounds(self, tx, ty, zoom ):
        "Returns bounds of the given tile in latutude/longitude using WGS84 datum"

        bounds = self.TileBounds( tx, ty, zoom)
        minLat, minLon = self.MetersToLatLon(bounds[0], bounds[1])
        maxLat, maxLon = self.MetersToLatLon(bounds[2], bounds[3])
         
        return ( minLat, minLon, maxLat, maxLon )
        
    def Resolution(self, zoom ):
        "Resolution (meters/pixel) for given zoom level (measured at Equator)"
        
        # return (2 * math.pi * 6378137) / (self.tileSize * 2**zoom)
        return self.initialResolution / (2**zoom)
        
    def ZoomForPixelSize(self, pixelSize ):
        "Maximal scaledown zoom of the pyramid closest to the pixelSize."
        
        for i in range(30):
            if pixelSize > self.Resolution(i):
                return i-1 if i!=0 else 0 # We don't want to scale up

    def GoogleTile(self, tx, ty, zoom):
        "Converts TMS tile coordinates to Google Tile coordinates"
        
        # coordinate origin is moved from bottom-left to top-left corner of the extent
        return tx, (2**zoom - 1) - ty

    def QuadTree(self, tx, ty, zoom ):
        "Converts TMS tile coordinates to Microsoft QuadTree"
        
        quadKey = ""
        ty = (2**zoom - 1) - ty
        for i in range(zoom, 0, -1):
            digit = 0
            mask = 1 << (i-1)
            if (tx & mask) != 0:
                digit += 1
            if (ty & mask) != 0:
                digit += 2
            quadKey += str(digit)
            
        return quadKey

#---------------------
a = GlobalMercator()

#b = GlobalMercator.self
b = a.MetersToTile(x,y, zoom)
c = a.GoogleTile(b[0],b[1],zoom)
d = a.TileBounds(b[0],b[1],zoom)
OUT = d
# ----------------------------------------
watch_5 = Watch(code_block_6.widthtile)
code_block_13 = CodeBlock { 276; ca 0,6; }
createBoundingBoxLATLONG = Custom[GIS2BIM.CreateBoundingBoxLATLONG](Lat=getLocationdataNetherlands.Latitude, Long=getLocationdataNetherlands.Longitude, WidthMeters=desired_width)  # create boundingbox with from lat/long coordinate in degrees
distanceBetweenCoordinatesWGS84 = Custom[GIS2BIM.DistanceBetweenCoordinatesWGS84](Latitude1=createBoundingBoxLATLONG.North, Longitude1=createBoundingBoxLATLONG.West, Latitude2=createBoundingBoxLATLONG.North, Longitude2=createBoundingBoxLATLONG.East)  # Calculate the distance between 2 lat/lon coördinates in meters
toString = Element.ToString()  # unwired: arg0, arg1, arg2
doubleToString = Custom[GIS2BIM.DoubleToString](CoordinateDouble=createBoundingBoxLATLONG.South)  # Converts a double to a string
doubleToString_2 = Custom[GIS2BIM.DoubleToString](CoordinateDouble=createBoundingBoxLATLONG.East)
doubleToString_3 = Custom[GIS2BIM.DoubleToString](CoordinateDouble=createBoundingBoxLATLONG.North)
transformCRS_epsg_2 = Custom[GIS2BIM.TransformCRS_epsg](targetCRS=code_block, xCoordinate=doubleToString_2, yCoordinate=doubleToString_3)
doubleToString_4 = Custom[GIS2BIM.DoubleToString](CoordinateDouble=createBoundingBoxLATLONG.West)
transformCRS_epsg_3 = Custom[GIS2BIM.TransformCRS_epsg](targetCRS=code_block, xCoordinate=doubleToString_4, yCoordinate=doubleToString_3)
code_block_14 = CodeBlock(x2=transformCRS_epsg_2.Xtransformed, x1=transformCRS_epsg_3.Xtransformed, width=desired_width) { bm=x2-x1; fact=width/bm; 1/fact; }
