# Dynamo graph sandboxWMTS2.dyn (Dynamo 1.3.1.1736)

WMTSRequestAndImport = Custom[GIS2BIM.WMTSRequestAndImport]()  # total node with WMTS webrequest and import of image in view; unwired: Rdx, Rdy, Zoomlevel, BoundingboxWidth, TemppathFiles, View, Layer
WMTSScaleSetNetherlands = Custom[GIS2BIM.WMTSScaleSetNetherlands]()  # gives resolution, scaledenominator and number of tiles
code_block = CodeBlock { "werf van schouten"; "501"; "dordrecht"; }
getLocationdataNetherlands = Custom[GIS2BIM.GetLocationdataNetherlands](City=code_block.out2, Streetname=code_block.out0, Housenumber=code_block.out1)  # Gives locationdata based on an adress in the Netherlands
code_block_2 = CodeBlock { 256; }
WMTSZoomLevelTileRow = Custom[GIS2BIM.WMTSZoomLevelTileRow](Resolution=WMTSScaleSetNetherlands.Resolutie_m_pixel, Rdx=getLocationdataNetherlands.RDcoordinateX_meters_double, Rdy=getLocationdataNetherlands.RDcoordinateY_meters_double, PixelWidth=code_block_2)  # gives the tilerow and tilecolumn for the WMTS webrequest
code_block_3 = CodeBlock { 200; }
WMTSTileListFromBbox = Custom[GIS2BIM.WMTSTileListFromBbox](TileRow=WMTSZoomLevelTileRow.TileRow, TileColumn=WMTSZoomLevelTileRow.TileColumn, Resolution=WMTSScaleSetNetherlands.Resolutie_m_pixel, PixelWidth=code_block_2, BboxWidthInMeters=code_block_3)  # gives list of tilerows and tilecolums
current = Document.Current()
activeView = Document.ActiveView(current)
code_block_4 = CodeBlock { 14; }
WMTSLayersNetherlands = Custom[GIS2BIM.WMTSLayersNetherlands]()  # Library with layers for webrequests of WMTS-services in the Netherlands
WMTSGeoservicesLibraryNetherlands = Custom[GIS2BIM.WMTSGeoservicesLibraryNetherlands](TileRows=WMTSTileListFromBbox.TileRows, TileColumns=WMTSTileListFromBbox.TileColumns, Zoomlevel=code_block_4, Layer=WMTSLayersNetherlands.ahn2_05m_ruw)  # library with webrequests of WMTS-services in the Netherlands
TMS_WMTS_WebrequestAndCombineImages = Custom[GIS2BIM.TMS_WMTS_WebrequestAndCombineImages](URLlist=WMTSGeoservicesLibraryNetherlands, UniqueTileNumbersColumnX=WMTSTileListFromBbox.UniqueTileColumns, UniqueTileNumbersRowY=WMTSTileListFromBbox.UniqueTileRows)  # Webrequest for list of WMTS or TMS/Google webrequests for tiles. Combines them to 1 image.
watch_image = WatchImageCore(TMS_WMTS_WebrequestAndCombineImages.Image)
code_block_5 = CodeBlock { "C:/TEMP/IR.jpg"; }
systemDrawingBitmapToJPG = Custom[GIS2BIM.SystemDrawingBitmapToJPG](SystemDrawingBitmap=watch_image, FileName=code_block_5)  # frozen; Save an System.Drawing.Bitmap object as a jpg-file
code_block_6 = CodeBlock(dx=WMTSZoomLevelTileRow.DeltaX, dy=WMTSZoomLevelTileRow.DeltaY) { dx*1; dy*1; }
importImageInView = Custom[GIS2BIM.ImportImageInView](ImageWidthMeters=WMTSTileListFromBbox.TotalTileWidthMetrs, View=activeView, ImagePath=systemDrawingBitmapToJPG, DeltaX=code_block_6.out0, DeltaY=code_block_6.out1)  # Import rasterimage in view
