# Dynamo graph svg.dyn (Dynamo 1.3.4.6666)

code_block = CodeBlock { "zwijndrecht"; "wattstraat"; "17"; }
TMSBoundingboxFromTileNumber = Custom[GIS2BIM.TMSBoundingboxFromTileNumber]()  # Calculate Lat/Lon boundaries from a TileNumber in TMS(Tile Map Service); unwired: TileX, TileY, Zoomlevel
code_block_2 = CodeBlock()
# ---------- code_block_2.designscript (12 lines) ----------
"http://afnemers.ruimtelijkeplannen.nl/afnemers2012/services?";
"REQUEST=GetMap&SERVICE=WMS";
"&VERSION=1.3.0";
"&WIDTH=3000";
"&HEIGHT=3000";
"&LAYERS=BP:Bestemmingsplangebied,BP:Enkelbestemming,BP:Dubbelbestemming,BP:Functieaanduiding,BP:Figuur,BP:Gebiedsaanduiding,BP:Gebiedsaanduiding_overzicht,BP:Wijzigingsplangebied,BP:Bouwaanduiding,BP:Bouwvlak,BP:Inpassingsplangebied,BP:Lettertekenaanduiding,BP:Maatvoering,BP:Rijksbestemmingsplangebied,BP:Uitwerkingsplangebied";
"&STYLES=";
"&TRANSPARENT=TRUE";
"&FORMAT=image/png";
"&BBOX=";
"&CRS=urn:ogc:def:crs:EPSG::28992";
"&STYLES=default";
# ----------------------------------------
code_block_3 = CodeBlock { "dordrecht"; "lange geldersekade"; "1"; }
getLocationdataNetherlands = Custom[GIS2BIM.GetLocationdataNetherlands](City=code_block_3.out0, Streetname=code_block_3.out1, Housenumber=code_block_3.out2)  # Gives locationdata based on an adress in the Netherlands
code_block_4 = CodeBlock { 600; }
createBoundingBox = Custom[GIS2BIM.CreateBoundingBox](CoordinateX=getLocationdataNetherlands.RDcoordinateXmeters, CoordinateY=getLocationdataNetherlands.RDcoordinateYmeters, BoxWidth=code_block_4, BoxHeight=code_block_4)  # create boundingboxstring for webrequests based on coördinates and dimensions
concat = String.Concat(code_block_2.out0, code_block_2.out1, code_block_2.out2, code_block_2.out3, code_block_2.out4, code_block_2.out5, code_block_2.out6, code_block_2.out7, code_block_2.out8, code_block_2.out9, createBoundingBox.Boxstring, code_block_2.out10, code_block_2.out11)
openBrowser = Custom[GIS2BIM.OpenBrowser]()  # Opens a new window in your default browser with the given url.; unwired: url
code_block_5 = CodeBlock { "http://afnemers.ruimtelijkeplannen.nl/afnemers2012/services?REQUEST=GetCapabilities"; }
code_block_6 = CodeBlock()
# ---------- code_block_6.designscript (1 lines) ----------
https://geodata.nationaalgeoregister.nl/top10nlv2/wms?request=GetCapabilities&service=wms
# ----------------------------------------
webrequestWMS2 = Custom[GIS2BIM.WebrequestWMS2]()  # a webrequest based on WMS-protocol; unwired: WMSwebrequest
file_path = Filename("C:\Users\mikev\OneDrive\Bureaublad\TEMP\test.svg")
code_block_7 = CodeBlock { "C:/TEMP/test.svg"; }
python_script = Python(IN[0]=code_block_7)
# ---------- python_script.python (200 lines) ----------
import clr  
import re
clr.AddReference("System.Xml")  
import System.Xml

xmldoc = System.Xml.XmlDocument()  
xmldoc.Load(IN[0]) 

OUT=[]

#for shorthanded quadratic and cubic bezier curves
svgDict={}
svgDict["et"]=[]
svgDict["ed"]=[]

def segsFromPath(data):
    subOUT=[]
    splitPath=re.findall('[A-Za-z][^A-Za-z]*',"".join(line.strip() for line in data))
    return splitPath  

def ptsFromPoly(data):
    subOUT=[]
    pts=data.split(" ")
    for points in pts:
        ptList=points.split(",")
        if len(ptList)>1:
            numX=float(ptList[0])
            numY=float(ptList[1])
            geoPt=[numX,numY]
            subOUT.append(geoPt)
    return subOUT  

def rectangles():
    items = xmldoc.GetElementsByTagName("rect")  
    for item in items:  
        x=item.GetAttribute("x")
        y=item.GetAttribute("y")
        width=item.GetAttribute("width")
        height=item.GetAttribute("height")
        OUT.append(["rect",[x,y,width,height]])

def ellipses():
    items = xmldoc.GetElementsByTagName("ellipse")  
    for item in items:  
        cx=item.GetAttribute("cx")
        cy=item.GetAttribute("cy")
        rx=item.GetAttribute("rx")
        ry=item.GetAttribute("ry")
        OUT.append(["ellipse",[cx,cy,rx,ry]])

def circles():
    items = xmldoc.GetElementsByTagName("circle")  
    for item in items:  
        cx=item.GetAttribute("cx")
        cy=item.GetAttribute("cy")
        rad=item.GetAttribute("r")
        OUT.append(["circle",[cx,cy,rad]])

def lines():
    items = xmldoc.GetElementsByTagName("line")  
    for item in items:  
        x1=item.GetAttribute("x1")
        y1=item.GetAttribute("y1")
        x2=item.GetAttribute("x2")
        y2=item.GetAttribute("y2")
        OUT.append(["line",[x1,y1,x2,y2]])

def polylines():
    items = xmldoc.GetElementsByTagName("polyline")  
    for item in items:  
        ptList=item.GetAttribute("points")
        pts=ptsFromPoly(ptList)
        OUT.append(["polyline",pts])

def polygons():
    items = xmldoc.GetElementsByTagName("polygon")  
    for item in items:  
        ptList=item.GetAttribute("points")
        pts=ptsFromPoly(ptList)
        OUT.append(["polygon",pts])
def editDict(et,ed):
    svgDict["et"]=(et)
    svgDict["ed"]=(ed)
def paths():
    items = xmldoc.GetElementsByTagName("path")  
    pEndData=[0,0,0]
    sEndData=[0,0,0]
    for item in items:  
        pathOUT=[]
        segList=item.GetAttribute("d")
        segs=segsFromPath(segList)
        for j,seg in enumerate(segs):
            last=False
            subOUT=[]
            elementType=seg[0]
            eData=seg.split(elementType)[1].split(',')
            d ='-'
            elementData=[]
            for item in eData:
                splits=item.split('-')
                for i,e in enumerate(splits):
                    if i>0:
                        e=float(e)*-1
                    if i==1 and splits[0]=='':
                        elementData.remove(elementData[len(elementData)-1])
                    elementData.append(e)
#                print elementType, elementData
            if elementType=='Z' or elementType=='z':
                last=True
            if elementType=='M':
                endData=[float(elementData[0]),float(elementData[1])]
                subOUT=["point",endData]
                pEndData=endData
                sEndData=endData
                editDict(elementType,elementData)
            elif elementType=='l' or elementType=='L' or elementType=='a' or elementType=='A':
                endPt=[float(elementData[0]),float(elementData[1])]
                ePt=[float(elementData[0]),float(elementData[1])]
                if elementType=='l' or elementType=='a':
                    ePt=[ePt[0]+pEndData[0],ePt[1]+pEndData[1]]
                subOUT=["line",[pEndData,ePt]]
                pEndData=ePt
                editDict(elementType,elementData)
            elif elementType=='H' or elementType=='h':
                ePt=[float(elementData[0]), pEndData[1]]
                if elementType=='h':
                    ePt=[float(elementData[0])+pEndData[0], pEndData[1]]
                subOUT=["line",[pEndData,ePt]]
                pEndData=ePt
                editDict(elementType,elementData)
            elif elementType=='V' or elementType=='v':
                ePt=[float(pEndData[0]), float(elementData[0])]
                if elementType=='v':
                    ePt=[pEndData[0], pEndData[1]+float(elementData[0])]
                subOUT=["line",[pEndData,ePt]]
                pEndData=ePt
                editDict(elementType,elementData)
            elif elementType=='C' or elementType=='c' or elementType=='Q' or elementType=='q':
                cDataList=[pEndData]
                cData=[0,0,0]
                size=len(elementData)
                for i,val in enumerate(elementData):
                    if i%2==1:
                        cData=[float(elementData[i-1]),float(val)]
                        if elementType=='c' or elementType=='q':
                            cData=[pEndData[0]+cData[0],pEndData[1]+cData[1]]
                        cDataList.append(cData)
                degree=3
                if elementType=='Q' or elementType=='q':
                    degree=2
                    subOUT=["curve2",cDataList]
                else:
                    subOUT=["curve3",cDataList]
                pEndData=cData
#                print cDataList
                editDict(elementType,cDataList)
            elif elementType=='S' or elementType=='s' or elementType=='T' or elementType=='t':
                pType=svgDict["et"]
                cDataList=[pEndData]
                if pType=="C" or pType=="c" or pType=="s" or pType=="S":
                    ptForReflection=svgDict["ed"][len(svgDict["ed"])-2]
                    ptVecData=[pEndData[0]-ptForReflection[0],pEndData[1]-ptForReflection[1]]
                    reflectedData=[pEndData[0]+ptVecData[0],pEndData[1]+ptVecData[1]]
                    cDataList.append(reflectedData)
                else:
                    cDataList.append(pEndData)
                cData=[0,0]
                size=len(elementData)
                for i,val in enumerate(elementData):
                    if i%2==1:
                        cData=[float(elementData[i-1]),float(val)]
                        if elementType=='s' or elementType=='t':
                            cData=[pEndData[0]+cData[0],pEndData[1]+cData[1]]
                        cDataList.append(cData)
                degree=3
                if elementType=='T' or elementType=='t':
                    degree=2
                    subOUT=["curve2",cDataList]
                else:
                    subOUT=["curve3",cDataList]
                pEndData=cData
                editDict(elementType,cDataList)
            if last==False:
                pathOUT.append(subOUT)
            else:
                pathOUT.append(["line",[sEndData,pEndData]])
        OUT.append(["path",pathOUT])

def svgConvert():
    ellipses()
    circles()
    lines()
    polylines()
    polygons()
    rectangles()
    paths()



svgConvert()
# ----------------------------------------
python_script_2 = Python(IN[0]=python_script)
# ---------- python_script_2.python (40 lines) ----------
import clr
clr.AddReference('ProtoGeometry')
from Autodesk.DesignScript.Geometry import *

data=IN[0]
OUT=[]
for datum in data:
	subOUT=[]
	if datum[0]=='path':
		points=[]
		for dat in datum[1]:
			if dat[0]=='line':
				p1=Point.ByCoordinates(float(dat[1][0][0]),-float(dat[1][0][1]))
				p2=Point.ByCoordinates(float(dat[1][1][0]),-float(dat[1][1][1]))
				try:
					geo=Line.ByStartPointEndPoint(p1,p2)
				except:
					continue
				subOUT.append(geo)
			if dat[0]=='curve3':
				pts=[]
				for val in dat[1]:
					p=Point.ByCoordinates(float(val[0]),-float(val[1]))
					pts.append(p)
				try:
					geo=NurbsCurve.ByControlPoints(pts,3)
				except:
					continue
				subOUT.append(geo)
			if dat[0]=='curve2':
				pts=[]
				for val in dat[1]:
					p=Point.ByCoordinates(float(val[0]),-float(val[1]))
					pts.append(p)
				try:
					geo=NurbsCurve.ByControlPoints(pts,2)
				except:
					continue
				subOUT.append(geo)
		OUT.append(subOUT)
# ----------------------------------------
python_script_3 = Python(IN[0]=python_script)
# ---------- python_script_3.python (16 lines) ----------
import clr
clr.AddReference('ProtoGeometry')
from Autodesk.DesignScript.Geometry import *

data=IN[0]
OUT=[]
for datum in data:
	if datum[0]=='polygon':
		points=[]
		for dat in datum[1]:
			points.append(Point.ByCoordinates(float(dat[0]),-float(dat[1])))
		try:
			geo=Polygon.ByPoints(points)
		except:
			continue
		OUT.append(geo)
# ----------------------------------------
python_script_4 = Python(IN[0]=python_script)
# ---------- python_script_4.python (16 lines) ----------
import clr
clr.AddReference('ProtoGeometry')
from Autodesk.DesignScript.Geometry import *

data=IN[0]
OUT=[]
for datum in data:
	if datum[0]=='polyline':
		points=[]
		for dat in datum[1]:
			points.append(Point.ByCoordinates(float(dat[0]),-float(dat[1])))
		try:
			geo=PolyCurve.ByPoints(points,False)
		except:
			continue
		OUT.append(geo)
# ----------------------------------------
python_script_5 = Python(IN[0]=python_script)
# ---------- python_script_5.python (19 lines) ----------
import clr
clr.AddReference('ProtoGeometry')
from Autodesk.DesignScript.Geometry import *

data=IN[0]
OUT=[]
for datum in data:
	if datum[0]=='line':
		floats=[]
		for dat in datum[1]:
			floats.append(float(dat))
		e=floats
		p1=Point.ByCoordinates(e[0],-e[1])
		p2=Point.ByCoordinates(e[2],-e[3])
		try:
			geo=Line.ByStartPointEndPoint(p1,p2)
		except:
			continue
		OUT.append(geo)
# ----------------------------------------
python_script_6 = Python(IN[0]=python_script)
# ---------- python_script_6.python (18 lines) ----------
import clr
clr.AddReference('ProtoGeometry')
from Autodesk.DesignScript.Geometry import *

data=IN[0]
OUT=[]
for datum in data:
	if datum[0]=='circle':
		floats=[]
		for dat in datum[1]:
			floats.append(float(dat))
		e=floats
		p1=Point.ByCoordinates(e[0],-e[1])
		try:
			geo=Circle.ByCenterPointRadius(p1,e[2])
		except:
			continue
		OUT.append(geo)
# ----------------------------------------
python_script_7 = Python(IN[0]=python_script)
# ---------- python_script_7.python (21 lines) ----------
import clr
clr.AddReference('ProtoGeometry')
from Autodesk.DesignScript.Geometry import *

data=IN[0]
OUT=[]
for datum in data:
	if datum[0]=='rect':
		floats=[]
		for dat in datum[1]:
			floats.append(float(dat))
		e=floats
		p1=Point.ByCoordinates(e[0],-e[1])
		p2=Point.ByCoordinates(e[0]+e[2],-e[1])
		p3=Point.ByCoordinates(e[0]+e[2],-e[1]-e[3])
		p4=Point.ByCoordinates(e[0],-e[1]-e[3])
		try:
			geo=Rectangle.ByCornerPoints(p1,p2,p3,p4)
		except:
			continue
		OUT.append(geo)
# ----------------------------------------
python_script_8 = Python(IN[0]=python_script)
# ---------- python_script_8.python (17 lines) ----------
import clr
clr.AddReference('ProtoGeometry')
from Autodesk.DesignScript.Geometry import *

data=IN[0]
OUT=[]
for datum in data:
	if datum[0]=='ellipse':
		floats=[]
		for dat in datum[1]:
			floats.append(float(dat))
		e=floats
		try:
			geo=Ellipse.ByOriginRadii(Point.ByCoordinates(e[0],-e[1]),e[2],e[3])
		except:
			continue
		OUT.append(geo)
# ----------------------------------------
code_block_8 = CodeBlock()
# ---------- code_block_8.designscript (11 lines) ----------
"https://geodata.nationaalgeoregister.nl/top10nlv2/wms?";
"&REQUEST=GetMap";
"&VERSION=1.3.0";
"&WIDTH=3000";
"&HEIGHT=3000";
"&LAYERS=top10nlv2";
"&STYLES=";
"&TRANSPARENT=TRUE";
"&FORMAT=image/png";
"&BBOX=";
"&CRS=urn:ogc:def:crs:EPSG::28992";
# ----------------------------------------
concat_2 = String.Concat(code_block_8.out0, code_block_8.out1, code_block_8.out2, code_block_8.out3, code_block_8.out4, code_block_8.out5, code_block_8.out6, code_block_8.out7, code_block_8.out8, code_block_8.out9, createBoundingBox.Boxstring, code_block_8.out10)
webrequestWMS2_2 = Custom[GIS2BIM.WebrequestWMS2](WMSwebrequest=concat_2)
watch_image = WatchImageCore(webrequestWMS2_2)
code_block_9 = CodeBlock { "28992"; "4326"; }
doubleToString = Custom[GIS2BIM.DoubleToString](CoordinateDouble=getLocationdataNetherlands.RDcoordinateXmeters)  # Converts a double to a string
doubleToString_2 = Custom[GIS2BIM.DoubleToString](CoordinateDouble=getLocationdataNetherlands.RDcoordinateYmeters)
transformCRS_epsg = Custom[GIS2BIM.TransformCRS_epsg](sourceCRS=code_block_9.out0, targetCRS=code_block_9.out1, xCoordinate=doubleToString, yCoordinate=doubleToString_2)  # Uses the API of http://epsg.io to transform Coordinate Reference Systems
doubleToString_3 = Custom[GIS2BIM.DoubleToString](CoordinateDouble=transformCRS_epsg.Xtransformed)
doubleToString_4 = Custom[GIS2BIM.DoubleToString](CoordinateDouble=transformCRS_epsg.Ytransformed)
createBoundingBoxLATLONG = Custom[GIS2BIM.CreateBoundingBoxLATLONG](Lat=doubleToString_3, Long=doubleToString_4, WidthMeters=code_block_4)  # create boundingbox with from lat/long coordinate in degrees
code_block_10 = CodeBlock { "C:/TEMP/map2.osm"; "C:/TEMP/map3.osm"; }
downloadOSM = Custom[GIS2BIM.DownloadOSM](West=createBoundingBoxLATLONG.West, East=createBoundingBoxLATLONG.East, North=createBoundingBoxLATLONG.North, South=createBoundingBoxLATLONG.South, Directory=code_block_10.out0)  # Download OSM data within a boundingbox
openBrowser_2 = Custom[GIS2BIM.OpenBrowser]()  # unwired: url
location = Elk.OSM.Location(code_block_10.out1)
OSMData = Elk.OSM.OSMData(location)  # unwired: arg1, arg2, arg3
code_block_11 = CodeBlock()
# ---------- code_block_11.designscript (11 lines) ----------
inrichtingselement_punt;
plantopografie_lijn
plantopografie_punt;
plantopografie_vlak
terrein_vlak;
//terrein_vlak_contour;
waterdeel_lijn
waterdeel_vlak
///waterdeel_vlak_contour
wegdeel_vlak
wegdeel_vlak_contour;
# ----------------------------------------
openBrowser_3 = Custom[GIS2BIM.OpenBrowser]()  # unwired: url
writeToFile = Image.WriteToFile()  # unwired: arg0, arg1
sendTo = Custom[Clipboard.SendTo]()  # Copies a string to the clipboard.; unwired: str
code_block_12 = CodeBlock()
# ---------- code_block_12.designscript (11 lines) ----------
"https://geodata.nationaalgeoregister.nl/top10nlv2/wms?";
"&REQUEST=GetMap";
"&VERSION=1.3.0";
"&WIDTH=3000";
"&HEIGHT=3000";
"&LAYERS=waterdeel_vlak";
"&STYLES=";
"&TRANSPARENT=TRUE";
"&FORMAT=image/svg";
"&BBOX=";
"&CRS=urn:ogc:def:crs:EPSG::28992";
# ----------------------------------------
code_block_13 = CodeBlock { "&FORMAT=image/png"; }
concat_3 = String.Concat(code_block_12.out0, code_block_12.out1, code_block_12.out2, code_block_12.out3, code_block_12.out4, code_block_12.out5, code_block_12.out6, code_block_12.out7, code_block_13, code_block_12.out9, createBoundingBox.Boxstring, code_block_12.out10)
webrequestWMS2_3 = Custom[GIS2BIM.WebrequestWMS2](WMSwebrequest=concat_3)
watch_image_2 = WatchImageCore(webrequestWMS2_3)
filterGML = Custom[GIS2BIM.FilterGML]()  # filter GML-file based on boundingbox; unwired: GMLFile, xPATH, CoordinateX, CoordinateY, Boundingbox
concat_4 = String.Concat(code_block_12.out0, code_block_12.out1, code_block_12.out2, code_block_12.out3, code_block_12.out4, code_block_12.out5, code_block_12.out6, code_block_12.out7, code_block_12.out8, code_block_12.out9, createBoundingBox.Boxstring, code_block_12.out10)
web_request = WebRequest(concat_4)
watch = Watch(web_request)
sendTo_2 = Custom[Clipboard.SendTo](str=watch)
code_block_14 = CodeBlock {  }
code_block_15 = CodeBlock { 400/3000; }
code_block_16 = CodeBlock()
# ---------- code_block_16.designscript (58 lines) ----------
"
import sys

pyt_path = 'C:/Program Files (x86)/IronPython 2.7/Lib'
sys.path.append(pyt_path)

strSVG = IN[0]
bPix = IN[1]
hPix = IN[2]
widthM = IN[3]
heightM = IN[4]

ratioX=float(widthM)/float(bPix)
ratioY=float(heightM)/float(hPix)

def readSVG(svgString):
 strSplit = svgString.split('d=')
 del strSplit[0]
 del strSplit[0]
 del strSplit[0]
 del strSplit[0]
 del strSplit[0]
 #del strSplit[-1]

 strPolygon = []
 strPolygonX = []
 strPolygonY = []
 strPolygon2 = []

 for i in strSplit:
  j=i.split('fill')[0]
  k=j[2:]
  l=k.replace('L','')
  m=l[:-3]
  n=m.split('ZM')
  strPolygon.append(n)

 for sublist in strPolygon:
     for item in sublist:
      strPolygon2.append(item)

 for i in strPolygon2:
  o=i.split(' ')
  p=list(filter(None, o))
  q=p[0::2]
  r=p[1::2]
  xCoord=(int(1000*(float(s)*ratioX-0.5*widthM)) for s in q)
  yCoord=(int(-1000*(float(t)*ratioY-0.5*heightM)) for t in r)
  strPolygonX.append(xCoord)
  strPolygonY.append(yCoord)

 return strPolygonX,strPolygonY

SVGpix = readSVG(strSVG)

OUT = SVGpix
";
//SVGsplit.split('Z')
# ----------------------------------------
code_block_17 = CodeBlock()
# ---------- code_block_17.designscript (6 lines) ----------
b=3000;
 //width pixels;
h=3000;
 //height pixels;
width=400;
height=400;
# ----------------------------------------
python_script_from_string = PythonStringNode(script=code_block_16, IN[0]=watch, IN[1]=code_block_17.b, IN[2]=code_block_17.h, IN[3]=code_block_17.width, IN[4]=code_block_17.height)
code_block_18 = CodeBlock(a=python_script_from_string) { a[0]; a[1]; }
byCoordinates = Point.ByCoordinates(x=code_block_18.out0, y=code_block_18.out1)
byPoints = PolyCurve.ByPoints(points=byCoordinates)
code_block_19 = CodeBlock(a=python_script_from_string) { a[3]; }
code_block_20 = CodeBlock(a=python_script_from_string) { a[3]; }
code_block_21 = CodeBlock { a[8]; }  # unwired: a
code_block_22 = CodeBlock(a=byCoordinates) { a[8]; }
pruneDuplicates = Point.PruneDuplicates()  # unwired: points
byPoints_2 = PolyCurve.ByPoints(points=pruneDuplicates)
XMLXPath = Custom[GIS2BIM.XMLXPath](XMLString=watch)  # Run an XPathquery on an xml-string; unwired: XPathStrings
string = StringInput("")
code_block_23 = CodeBlock(a=python_script_from_string) { a[4]; }
