# Dynamo graph WFSKadsterBAG.dyn (Dynamo 1.3.1.1736)

# group: INPUT
code_block = CodeBlock { "Dordrecht"; "lange geldersekade"; "2"; }
views = Views("Situatietekening")
code_block_2 = CodeBlock { "2.5 mm"; "3.5 mm"; "2.5 mm zwart"; }
boundingboxwidth_m = CodeBlock { 250; }
code_block_3 = CodeBlock { "kadastrale_grens"; }
string = StringInput("pen rood")
code_block_4 = CodeBlock { "C:/TEMP/"; }
nameArialPhoto = CodeBlock { "luchtfoto14"; }

code_block_5 = CodeBlock { "eindhoven"; "waterland"; "174"; }

# group: GET GEOSERVICES
getLocationdataNetherlands = Custom[GIStoBIM.GetLocationdataNetherlands](city=code_block_5.out0, streetname=code_block_5.out1, housenumber=code_block_5.out2)  # Gives locationdata based on an adress in the Netherlands
createBoundingBox = Custom[GIStoBIM.CreateBoundingBox](coordinateX=getLocationdataNetherlands.RDcoordinate_X_meters, coordinateY=getLocationdataNetherlands.RDcoordinate_Y_meters, boxWidth=boundingboxwidth_m, boxHeight=boundingboxwidth_m)  # create boundingboxstring for webrequests based on coördinates and dimensions
geoservicesLibraryNetherlands = Custom[GIStoBIM.GeoservicesLibraryNetherlands](BoundingBox=createBoundingBox)  # Library with multiple webadresses which can be used for WFS and WMS webrequests

# group: KADASTER ANNOTATION
kadasterPercelen = Custom[GIStoBIM.KadasterPercelen](deltaX=getLocationdataNetherlands.RDcoordinate_X_meters, deltaY=getLocationdataNetherlands.RDcoordinate_Y_meters, view=views, TextTypePerceel=code_block_2.out2, UrlWebrequestKadasterPerceel=geoservicesLibraryNetherlands.8_kadastrale_perceel)  # Draw propertylines and place streetnames and housenumbers from the dutch kadaster
kadasterHouseNumbers = Custom[GIStoBIM.KadasterHouseNumbers](UrlWebrequestKadasterAnnotation=geoservicesLibraryNetherlands.7_kadastrale_annotatie, deltaX=getLocationdataNetherlands.RDcoordinate_X_meters, deltaY=getLocationdataNetherlands.RDcoordinate_Y_meters, view=views, TextTypeHousenumber=code_block_2.out0, TextTypeStreetname=code_block_2.out1)

# group: KADASTRALE PERCELEN(GRENZEN)
web_request = WebRequest(geoservicesLibraryNetherlands.8_kadastrale_perceel)
code_block_6 = CodeBlock { "gml:posList"; }
createPointsPolygonFromGMLxy = Custom[GIStoBIM.CreatePointsPolygonFromGMLxy](xml=web_request, xmltagname=code_block_6, deltaX=getLocationdataNetherlands.RDcoordinate_X_meters, deltaY=getLocationdataNetherlands.RDcoordinate_Y_meters)  # Create point and polygons from a GML-file
createDetailLinesFromPolygons = Custom[GIStoBIM.CreateDetailLinesFromPolygons](View=views, PolyCurves=createPointsPolygonFromGMLxy.PolyCurves, Linestyle=code_block_3)  # Create detaillines from polygons in a view

# group: GET AERIAL PHOTO
webrequestWMS = Custom[GIStoBIM.WebrequestWMS](WMSwebrequest=geoservicesLibraryNetherlands.5_luchtfoto_2016_WMS, boundingboxwidth=boundingboxwidth_m, view=views, tempfolder=code_block_4, filename=nameArialPhoto)  # imports the result(image) of a webrequest based on WMS-protocol into a view in Revit
watch_image = WatchImageCore(webrequestWMS)

filledregiontypebag_pand = FilledRegionTypes()

# group: BAG: pand
web_request_2 = WebRequest(geoservicesLibraryNetherlands.4_bag_pand_WFS)
code_block_7 = CodeBlock { "gml:posList"; }
boolean = BoolSelector(true)
createPointsPolygonFromGMLxyz = Custom[GIStoBIM.CreatePointsPolygonFromGMLxyz](xml=web_request_2, xmltagname=code_block_7, deltaX=getLocationdataNetherlands.RDcoordinate_X_meters, deltaY=getLocationdataNetherlands.RDcoordinate_Y_meters, connectpolygon=boolean)  # Create points and polygons from a xml/gml-file with x,y and z value
createDetailLinesFromPolygons_2 = Custom[GIStoBIM.CreateDetailLinesFromPolygons](View=views, PolyCurves=createPointsPolygonFromGMLxyz.PolyCurves, Linestyle=string)
explode = Geometry.Explode(createPointsPolygonFromGMLxyz.PolyCurves)
byCurves = FilledRegion.ByCurves(views, explode, filledregiontypebag_pand)

setSharedCoordinate = Custom[GIStoBIM.SetSharedCoordinate](X=getLocationdataNetherlands.RDcoordinate_X_meters, Y=getLocationdataNetherlands.RDcoordinate_Y_meters)  # Set shared coordinate/project basepoint
