# Dynamo graph GIS2BIM_CZ.dyn "MLA_GIS2BIM_CZ_REALplus" (Dynamo 2.12.1.8246)
# packages: GIS2BIM for Dynamo 2.x 0.11.24, archi-lab.net 2023.213.1523, spring nodes 210.1.1, Clockwork for Dynamo 2.x 2.4.0

# group: creates bigger squared boundingbox
code_block = CodeBlock { 1000; }
GIS2BIM_GetSharedCoordinate = Custom[GIS2BIM_GetSharedCoordinate]()  # package GIS2BIM for Dynamo 2.x; Get the current shared coordinate
GIS2BIM_CreateBoundingBox = Custom[GIS2BIM_CreateBoundingBox](CoordinateX=GIS2BIM_GetSharedCoordinate.NorthSouth, CoordinateY=GIS2BIM_GetSharedCoordinate.EastWest, BoxWidth=code_block, BoxHeight=code_block)  # package GIS2BIM for Dynamo 2.x; create boundingboxstring for webrequests based on coördinates and dimensions

code_block_2 = CodeBlock()
# ---------- code_block_2.designscript (8 lines) ----------
//geomorfologie
"cenia_geomorfologie";
// overzichtskaart van Tsjechië
"cenia_prehledka";
//schaduwmap
"cenia_stinovani";
//topo achtergond
"cenia_t_podklad";
# ----------------------------------------
GIS2BIM_CzechRepublicGeoservicesLibrary_ = Custom[GIS2BIM_CzechRepublicGeoservicesLibrary_geoportal](bbox=GIS2BIM_CreateBoundingBox.Boxstring, server=code_block_2.out0)  # package GIS2BIM for Dynamo 2.x; Czech_gov_geoportal

# group: wms foto`s
ꟿ_document_centralpath = Custom[ꟿ Document.CentralPath]()  # package spring nodes; If the document is workshared, the node returns the path to the central document as a string. Otherwise a null value will be returned.
getItemAtIndex = List.GetItemAtIndex(list=GIS2BIM_CzechRepublicGeoservicesLibrary_.layername, index=GIS2BIM_CzechRepublicGeoservicesLibrary_.layernumber)
code_block_3 = CodeBlock(path=ꟿ_document_centralpath, server=GIS2BIM_CzechRepublicGeoservicesLibrary_.server, name=getItemAtIndex) { directory=FileSystem.DirectoryName(path)+"/Gisdata/"+server+"/"; directory+"GIS2BIM_"+name+".png"; "GIS2BIM_"+name; }
GIS2BIM_WebrequestWMS = Custom[GIS2BIM_WebrequestWMS](WMSwebrequest=GIS2BIM_CzechRepublicGeoservicesLibrary_.url, lacing=Longest)  # package GIS2BIM for Dynamo 2.x; a webrequest based on WMS-protocol
directory_from_path = DirectoryObject(path=code_block_3.directory)
passthrough = Custom[Passthrough](passThrough=code_block_3.out1, waitFor=directory_from_path)  # package Clockwork for Dynamo 2.x; Forces a sequential order of execution. The node wired into the output of the Passthrough node will be executed *after* the node wired into the waitFor input (e.g. important for some Revit operations). The value of the passThrough input will be passed on to the node wired into the output port of the Passthrough node.
GIS2BIM_ImageToFile = Custom[GIS2BIM_ImageToFile](ImageObject=GIS2BIM_WebrequestWMS, FileNamePath=passthrough, lacing=Longest)  # package GIS2BIM for Dynamo 2.x; Write Image to file

# group: place downloaded images in view
code_block_4 = CodeBlock { "GIS2BIM"; "Duplicate"; }
MLA_SelectByName = Custom[View.MLA_SelectByName](Viewname=code_block_4.out0)  # select a view by its name
duplicate = archilab.Revit.Views.Views.Duplicate(view=MLA_SelectByName, name=code_block_3.out2, options=code_block_4.out1)
passthrough_2 = Custom[Passthrough](passThrough=code_block_3.out2, waitFor=duplicate)
selectByName = Custom[View.SelectByName](Viewname=passthrough_2, lacing=Longest)  # select a view by its name
GIS2BIM_ImportImageInView = Custom[GIS2BIM_ImportImageInView](ImageWidthMeters=code_block, view=selectByName, ImagePath=GIS2BIM_ImageToFile, lacing=Longest)  # package GIS2BIM for Dynamo 2.x; Import rasterimage in view

watch_image = WatchImageCore(image=GIS2BIM_WebrequestWMS)
