# Dynamo graph AHN3+BGT+BAG 3D+LUCHTFOTO.dyn (Dynamo 1.3.4.6666)

# group: OR USE REVIT SITE LOCATION
code_block = CodeBlock { "4326"; "28992"; }
getRevitSiteLocation = Custom[GIS2BIM.GetRevitSiteLocation]()  # Gets the properties of the current Site Location of the active Revit Project
transformCRS_epsg = Custom[GIS2BIM.TransformCRS_epsg](sourceCRS=code_block.out0, targetCRS=code_block.out1, xCoordinate=getRevitSiteLocation.Lon, yCoordinate=getRevitSiteLocation.Lat)  # Uses the API of http://epsg.io to transform Coordinate Reference Systems

# group: GEOCODING
code_block_2 = CodeBlock { "dordrecht"; "lange geldersekade"; "2"; }
getLocationdataNetherlands = Custom[GIS2BIM.GetLocationdataNetherlands](City=code_block_2.out0, Streetname=code_block_2.out1, Housenumber=code_block_2.out2)  # Gives locationdata based on an adress in the Netherlands

code_block_3 = CodeBlock(RDX=getLocationdataNetherlands.RDcoordinateX_meters_double, RDY=getLocationdataNetherlands.RDcoordinateY_meters_double) { RDX; RDY; }
width_boundingbox = CodeBlock { 200; }

# group: BOUNDINGBOX EN CONSTRUEER WEBREQUEST
createBoundingBox = Custom[GIS2BIM.CreateBoundingBox](CoordinateX=code_block_3.RDX, CoordinateY=code_block_3.RDY, BoxWidth=width_boundingbox, BoxHeight=width_boundingbox)  # create boundingboxstring for webrequests based on coördinates and dimensions
geoservicesLibraryNetherlands = Custom[GIS2BIM.GeoservicesLibraryNetherlands](BoundingBox=createBoundingBox.Boxstring)  # Library with multiple webadresses which can be used for WFS and WMS webrequests

BAG3D = Custom[GIS2BIM.BAG3D](3D_BAG_TU_Delft_OGC_WFS=geoservicesLibraryNetherlands.3D_BAG_TU_Delft_OGC_WFS, rdx=code_block_3.RDX, rdy=code_block_3.RDY)  # Perform a WFS(Web Feature Service) webrequest based on a boundingbox of RD-coordinates(28992). Retrieve an xml-file. Read the metadata and create 3D-solids. Maximum of 1000 buildings per request.
file_path = Filename(".\Metric Mass.rft")

# group: PLACE FAMILY
code_block_4 = CodeBlock { "NLRS_90_MA_BAG_3D.rfa"; ".rfa"; }
categories = Categories("Mass")
code_block_5 = CodeBlock { "Form"; }
byGeometry = Custom[Springs.FamilyInstance.ByGeometry](geometry=BAG3D.BAG_3DSolidUnion, familyTemplatePath=file_path, familyName=code_block_4.out0, category=categories, subcategoryName=code_block_5)  # You must provide a valid family template path that will be used for all input geometry objects. The project units(and not the templates) will be used to determine the size of the output geometry. The provided category will be used only if the family template supports it. If not, the default template category will be used instead. Likewise, the family material(provided as a string) will be set only if a material with that name exists in the template. If not, the default material will be used instead ("By Category"). For void cuts, the material settings will be ignored. The Subcategory name is an optional input. If you'd like to skip assigning a Subcategory to any new instance, simply use null. The node expects a unique family name for each geometry object. The rest of the input lists will be processed as if the node lacing is set to longest.

code_block_6 = CodeBlock()
# ---------- code_block_6.designscript (4 lines) ----------
//MATERIAL FOR TOPOGRAPHY
//MUST HAVE RENDERAPPAERANCE 'GENERIC'
//RENDERAPPAEANCE NOT READ ONLY(DUPLICATE OF
"a_maaiveld";
# ----------------------------------------
code_block_7 = CodeBlock { "C:/TEMP/map.jpg"; }
code_block_8 = CodeBlock()
# ---------- code_block_8.designscript (2 lines) ----------
//number of pixels Geotiff
"200";
# ----------------------------------------
code_block_9 = CodeBlock { -3; }
code_block_10 = CodeBlock()
# ---------- code_block_10.designscript (2 lines) ----------
//temp filepath Geotiff
"C:/TEMP/test20.tiff";
# ----------------------------------------
code_block_11 = CodeBlock()
# ---------- code_block_11.designscript (10 lines) ----------
//CHOOSE AHN-LAYER

//maaiveld resolutie 0.5 m
"ahn3_05m_dtm";
//maaiveld+bomen+gebouwen enz. resolutie 0.5 m
"ahn3_05m_dsm";
//maaiveld resolutie 5 m
"ahn3_5m_dtm";
//maaiveld+bomen+gebouwen enz. resolutie 5 m
"ahn3_5m_dsm";
# ----------------------------------------

# group: TOPOGRAPHY USING AHN3 GEOTIFF WCS
AHN3toPoints = Custom[GIS2BIM.AHN3toPoints](Rdx=getLocationdataNetherlands.RDcoordinateX_meters_double, Rdy=getLocationdataNetherlands.RDcoordinateY_meters_double, BoundinxboxWidth=width_boundingbox, ResolutionGeotiff=code_block_8, WaterlevelHeight=code_block_9, FilepathName=code_block_10, Layer=code_block_11.out0)  # Load AHN3 via Geotiff WCS. Transform to local coordinates
byPoints = Topography.ByPoints(AHN3toPoints.Points)

# group: WEB MAP SERVICE WEB REQUEST FOR AERIALPHOTO AND SET RENDERMATERIAL
byName = Material.ByName(code_block_6)
webrequestWMS2 = Custom[GIS2BIM.WebrequestWMS2](WMSwebrequest=geoservicesLibraryNetherlands.luchtfoto_2018_OGC_WMS)  # a webrequest based on WMS-protocol
boolean = BoolSelector(true)
boolean_2 = BoolSelector(false)
code_block_12 = CodeBlock { 270; }
bitmapRotateFlip = Custom[GIS2BIM.BitmapRotateFlip](Bitmap=webrequestWMS2, FlipX=boolean, FlipY=boolean_2, RotationFlip=code_block_12)  # Rotate and/or flip a bitmap/image
systemDrawingBitmapToJPG = Custom[GIS2BIM.SystemDrawingBitmapToJPG](SystemDrawingBitmap=bitmapRotateFlip.Bitmap, FileName=code_block_7)  # Save an System.Drawing.Bitmap object as a jpg-file
code_block_13 = CodeBlock(b=width_boundingbox) { 0; (b*1000)*2.54; 0; }
boolean_3 = BoolSelector(false)
setMaterialAppearanceTextureGeneric = Custom[GIS2BIM.SetMaterialAppearanceTextureGeneric](Material=byName, TextureFilelocation=systemDrawingBitmapToJPG, TextureOffsetX=code_block_13.out0, TextureOffsetY=code_block_13.out0, TextureSizeXMM=code_block_13.out1, TextureSizeYMM=code_block_13.out1, LockScale=boolean_3, RotationAngle=code_block_13.out2)  # Change the values of the texture of the appearanceasset of a Revit Material of the type 'generic'
code_block_14 = CodeBlock { "Material"; }
setParameterByNameTypeOrInstance = Rhythm.Revit.Elements.Elements.SetParameterByNameTypeOrInstance(byPoints, code_block_14, byName)

code_block_15 = CodeBlock { "dordrecht"; "2"; "lange geldersekade"; }
code_block_16 = CodeBlock { "gouda"; "58"; "gouderaksedijk"; }
code_block_17 = CodeBlock { "delft"; "134"; "julianalaan"; }
watch_image = WatchImageCore(bitmapRotateFlip.Bitmap)
