# Dynamo graph BAG 3D.dyn (Dynamo 1.3.4.6666)

# group: OR USE REVIT SITE LOCATION
code_block = CodeBlock { "4326"; "28992"; }
getRevitSiteLocation = Custom[GIS2BIM.GetRevitSiteLocation]()  # Gets the properties of the current Site Location of the active Revit Project
transformCRS_epsg = Custom[GIS2BIM.TransformCRS_epsg](sourceCRS=code_block.out0, targetCRS=code_block.out1, xCoordinate=getRevitSiteLocation.Lon, yCoordinate=getRevitSiteLocation.Lat)  # Uses the API of http://epsg.io to transform Coordinate Reference Systems

# group: GEOCODING
code_block_2 = CodeBlock { "dordrecht"; "zuidendijk"; "315"; }
getLocationdataNetherlands = Custom[GIS2BIM.GetLocationdataNetherlands](City=code_block_2.out0, Streetname=code_block_2.out1, Housenumber=code_block_2.out2)  # Gives locationdata based on an adress in the Netherlands

code_block_3 = CodeBlock(RDX=getLocationdataNetherlands.RDcoordinateX_meters_double, RDY=getLocationdataNetherlands.RDcoordinateY_meters_double) { RDX; RDY; }
width_boundingbox = CodeBlock { 300; }

# group: BOUNDINGBOX EN CONSTRUEER WEBREQUEST
createBoundingBox = Custom[GIS2BIM.CreateBoundingBox](CoordinateX=code_block_3.RDX, CoordinateY=code_block_3.RDY, BoxWidth=width_boundingbox, BoxHeight=width_boundingbox)  # create boundingboxstring for webrequests based on coördinates and dimensions
geoservicesLibraryNetherlands = Custom[GIS2BIM.GeoservicesLibraryNetherlands](BoundingBox=createBoundingBox.Boxstring)  # Library with multiple webadresses which can be used for WFS and WMS webrequests

BAG3D = Custom[GIS2BIM.BAG3D](3D_BAG_TU_Delft_OGC_WFS=geoservicesLibraryNetherlands.3D_BAG_TU_Delft_OGC_WFS, rdx=code_block_3.RDX, rdy=code_block_3.RDY)  # Perform a WFS(Web Feature Service) webrequest based on a boundingbox of RD-coordinates(28992). Retrieve an xml-file. Read the metadata and create 3D-solids. Maximum of 1000 buildings per request.
file_path = Filename(".\Metric Mass.rft")

# group: PLACE FAMILY
code_block_4 = CodeBlock { "NLRS_90_MA_BAG_3D.rfa"; ".rfa"; }
categories = Categories("Mass")
code_block_5 = CodeBlock { "Form"; }
byGeometry = Custom[Springs.FamilyInstance.ByGeometry](geometry=BAG3D.BAG_3DSolidUnion, familyTemplatePath=file_path, familyName=code_block_4.out0, category=categories, subcategoryName=code_block_5)  # frozen; You must provide a valid family template path that will be used for all input geometry objects. The project units(and not the templates) will be used to determine the size of the output geometry. The provided category will be used only if the family template supports it. If not, the default template category will be used instead. Likewise, the family material(provided as a string) will be set only if a material with that name exists in the template. If not, the default material will be used instead ("By Category"). For void cuts, the material settings will be ignored. The Subcategory name is an optional input. If you'd like to skip assigning a Subcategory to any new instance, simply use null. The node expects a unique family name for each geometry object. The rest of the input lists will be processed as if the node lacing is set to longest.

# group: DISPLAY YEAR OF CONSTRUCTION IN COLOR
code_block_6 = CodeBlock { 237; 28; 36; 128; 128; 128; }
byARGB = Color.ByARGB(r=code_block_6.out0, g=code_block_6.out1, b=code_block_6.out2)
byARGB_2 = Color.ByARGB(r=code_block_6.out3, g=code_block_6.out4, b=code_block_6.out5)
create = List.Create(byARGB, byARGB_2)
code_block_7 = CodeBlock { 0; 1; }
create_2 = List.Create(code_block_7.out0, code_block_7.out1)
code_block_8 = CodeBlock(a=BAG3D.BAG_3D_Metadata_Values)
# ---------- code_block_8.designscript (9 lines) ----------
bouwdatum=a[1];
gesplitst=String.Split(bouwdatum, {"-"});
bouwjaar=List.FirstItem(gesplitst@-2<1>);
bouwjaarNumb= String.ToNumber(bouwjaar);
oudste = String.ToNumber(List.MinimumItem(bouwjaar));
jongste = String.ToNumber(List.MaximumItem(bouwjaar));
range = jongste-oudste;
t2 = bouwjaarNumb-oudste;
t3 = t2/range;
# ----------------------------------------
color_range = ColorRange(create, create_2, code_block_8.t3)
byGeometryColor = Display.Display.ByGeometryColor(BAG3D.BAG_3DSolids_Per_Building, color_range)

watch_3d = Watch3D(BAG3D.BAG_3DSolidUnion)
