# Dynamo graph ImportImageInView.dyn (Dynamo 1.3.4.6666)

code_block = CodeBlock { 150; }
views = Views("Plattegrond Begane Grond")
code_block_2 = CodeBlock { "dordrecht"; "zuidendijk"; "315"; }
getLocationdataNetherlands = Custom[GIS2BIM.GetLocationdataNetherlands](City=code_block_2.out0, Streetname=code_block_2.out1, Housenumber=code_block_2.out2)  # Gives locationdata based on an adress in the Netherlands
locationAnalysisNetherlands = Custom[GIS2BIM.LocationAnalysisNetherlands](Rdx=getLocationdataNetherlands.RDcoordinateX_meters_double, Rdy=getLocationdataNetherlands.RDcoordinateY_meters_double)  # Location Analysis of a location in The Netherlands
code_block_3 = CodeBlock { "C:/TEMP/luchtfoto.jpg"; }
systemDrawingBitmapToJPG = Custom[GIS2BIM.SystemDrawingBitmapToJPG](SystemDrawingBitmap=locationAnalysisNetherlands.WMS_Small_Luchtfoto_2016, FileName=code_block_3)  # Save an System.Drawing.Bitmap object as a jpg-file
importImageInView = Custom[GIS2BIM.ImportImageInView](ImageWidthMeters=code_block, View=views, ImagePath=systemDrawingBitmapToJPG)  # Import rasterimage in view
