# Dynamo graph SetSharedCoordinates.dyn (Dynamo 2.12.1.8246)
# packages: GIS2BIM for Dynamo 2.x 0.11.24, Clockwork for Dynamo 2.x 2.4.0, Genius Loci 2022.8.5

# group: Input from revit
siteLocation = SiteLocation()
string_from_object = FromObject(object=siteLocation)
watch = Watch(string_from_object)
code_block = CodeBlock { ", "; }
split = String.Split(string=watch, separator0=code_block)
code_block_2 = CodeBlock(l=split) { l[0]; 0; 6; }
remove = String.Remove(string=code_block_2.out0, startIndex=code_block_2.out1, count=code_block_2.out2)
code_block_3 = CodeBlock(l=split) { l[1]; 0; 8; }
remove_2 = String.Remove(string=code_block_3.out0, startIndex=code_block_3.out1, count=code_block_3.out2)
code_block_4 = CodeBlock(adres=remove, stad=remove_2) { adres+", "+stad; }
code_block_5 = CodeBlock { "[0-9]+"; "[A-Z]+"; ""; true; "[ ]+"; }
replaceRegularExpression = Custom[Regex.ReplaceRegularExpression](RegEx=code_block_5.out0, str=remove, Replacement=code_block_5.out2)  # package Clockwork for Dynamo 2.x; Replaces all occurences of a regular expression within a given string (or list of strings) with another string. The syntax for regular expressions is explained at http://ironpython-test.readthedocs.org/en/latest/howto/regex.html
replaceRegularExpression_2 = Custom[Regex.ReplaceRegularExpression](RegEx=code_block_5.out1, str=remove, Replacement=code_block_5.out2, ignoreCase=code_block_5.out3)
replaceRegularExpression_3 = Custom[Regex.ReplaceRegularExpression](RegEx=code_block_5.out4, str=replaceRegularExpression_2, Replacement=code_block_5.out2, ignoreCase=code_block_5.out3)
GIS2BIM_GetLocationdataNetherlands = Custom[GIS2BIM_GetLocationdataNetherlands](City=remove_2, Streetname=replaceRegularExpression, Housenumber=replaceRegularExpression_3)  # package GIS2BIM for Dynamo 2.x; Gives locationdata based on an adress in the Netherlands

# group: move surveypoint
categories = Categories("OST_SharedBasePoint")  # graph input
all_elements_of_category = ElementsOfCategory(Category=categories)
code_block_6 = CodeBlock(x=all_elements_of_category) { x[0]; }
code_block_7 = CodeBlock(x=GIS2BIM_GetLocationdataNetherlands.RDcoordinateXmeters, y=GIS2BIM_GetLocationdataNetherlands.RDcoordinateYmeters) { x*-1000; y*-1000; }
byCoordinates = Point.ByCoordinates(x=code_block_7.out0, y=code_block_7.out1)
element_setlocation = Custom[Element SetLocation](element=code_block_6, location=byCoordinates)  # package Genius Loci; Modify the location of the given element. (Same as the Move command in Revit.) Works for point/ line/ sketch based elements, view-specific elements, groups and link instances.
