# Dynamo graph GIS2x_0.1_Create Views.dyn (Dynamo 2.3.0.5885)

levels = Levels("00_begane grond")
list_create = List.Create(item0=levels, item1=levels, item2=levels, item3=levels, item4=levels, item5=levels, item6=levels, item7=levels, item8=levels, item9=levels)
byLevel = FloorPlanView.ByLevel(level=list_create)
code_block = CodeBlock { "View Name"; }
code_block_2 = CodeBlock()
# ---------- code_block_2.designscript (10 lines) ----------
"Luchtfoto 2016";
"Luchtfoto 2017";
"Luchtfoto 2018";
"Geluidskaart";
"Bestemmingsplan totaal";
"Bestemmingsplan bouwvlak";
"Natura2000";
"Opentopo";
"Kadaster+BAG 2D";
"Bestemmingsplan";
# ----------------------------------------
list_create_2 = List.Create(item0=code_block_2.out0, item1=code_block_2.out1, item2=code_block_2.out2, item3=code_block_2.out3, item4=code_block_2.out4, item5=code_block_2.out5, item6=code_block_2.out6, item7=code_block_2.out7, item8=code_block_2.out8, item9=code_block_2.out9)
setParameterByName = Element.SetParameterByName(element=byLevel, parameterName=code_block, value=list_create_2)
