# Dynamo graph GIS2x_1.1 Bepaal locatie met adres.dyn (Dynamo 2.2.1.5175)

string = StringInput("Haal coordinaten op met behulp van adres")  # graph input
code_block = CodeBlock { "Logo"; }
GIS2BIM_CompanySettings = Custom[GIS2BIM_CompanySettings](SearchSetting=code_block)  # GIS2BIM Company Settings
string_2 = StringInput("OK")  # graph input
code_block_2 = CodeBlock { "Plaats"; }
code_block_3 = CodeBlock { "Project Information"; }
byName = Category.ByName(name=code_block_3)
all_elements_of_category = ElementsOfCategory(Category=byName)
code_block_4 = CodeBlock()
# ---------- code_block_4.designscript (3 lines) ----------
["project_place",
"project_streetname",
"project_housenumber"];
# ----------------------------------------
GIS2BIM_CompanySettings_2 = Custom[GIS2BIM_CompanySettings](SearchSetting=code_block_4)
code_block_5 = CodeBlock(a=GIS2BIM_CompanySettings_2.Setting) { a[0]; a[1]; a[2]; }
getParameterValueByName = Element.GetParameterValueByName(element=all_elements_of_category, parameterName=code_block_5.out0)
firstItem = List.FirstItem(list=getParameterValueByName)
boolean = BoolSelector(false)  # graph input
ui_textbox_data = Custom[UI.TextBox Data](InputName=code_block_2, DefaultText=firstItem, IsNumberEntry=boolean)  # Create Data for TextBox input in UI.MultipleInputForm ++ . Check out www.data-shapes.net for more informations
code_block_6 = CodeBlock { "Straatnaam"; }
getParameterValueByName_2 = Element.GetParameterValueByName(element=all_elements_of_category, parameterName=code_block_5.out1)
firstItem_2 = List.FirstItem(list=getParameterValueByName_2)
boolean_2 = BoolSelector(false)  # graph input
ui_textbox_data_2 = Custom[UI.TextBox Data](InputName=code_block_6, DefaultText=firstItem_2, IsNumberEntry=boolean_2)
code_block_7 = CodeBlock { "Huisnummer"; }
getParameterValueByName_3 = Element.GetParameterValueByName(element=all_elements_of_category, parameterName=code_block_5.out2)
firstItem_3 = List.FirstItem(list=getParameterValueByName_3)
boolean_3 = BoolSelector(false)  # graph input
ui_textbox_data_3 = Custom[UI.TextBox Data](InputName=code_block_7, DefaultText=firstItem_3, IsNumberEntry=boolean_3)
create = List.Create(item0=ui_textbox_data, item1=ui_textbox_data_2, item2=ui_textbox_data_3)
boolean_4 = BoolSelector(true)  # graph input
code_block_8 = CodeBlock { 100; }
ui_multipleinputform = Custom[UI.MultipleInputForm ++](Description_optional=string, Logo_optional=GIS2BIM_CompanySettings.Setting, ButtonText_optional=string_2, Inputs=create, Toggle=boolean_4, Width_optional=code_block_8)  # Create a form with multiple inputs. see www.data-shapes.net for tutorials and infos!
code_block_9 = CodeBlock(a=ui_multipleinputform.User_Inputs) { a[0]; a[1]; a[2]; }
GIS2BIM_GetLocationdataNetherlands = Custom[GIS2BIM_GetLocationdataNetherlands](City=code_block_9.out0, Streetname=code_block_9.out1, Housenumber=code_block_9.out2)  # Gives locationdata based on an adress in the Netherlands

# group: STEL PROJECTPARAMETERS IN
code_block_10 = CodeBlock { "Project Information"; }
byName_2 = Category.ByName(name=code_block_10)
all_elements_of_category_2 = ElementsOfCategory(Category=byName_2)
code_block_11 = CodeBlock()
# ---------- code_block_11.designscript (2 lines) ----------
["cadastral_number",
"cadastral_parcel"];
# ----------------------------------------
code_block_12 = CodeBlock()  # same code as code_block_4

GIS2BIM_CompanySettings_3 = Custom[GIS2BIM_CompanySettings](SearchSetting=code_block_11)

# group (continued): STEL PROJECTPARAMETERS IN
code_block_13 = CodeBlock(a=GIS2BIM_CompanySettings_3.Setting) { a[0]; a[1]; }
setParameterByName = Element.SetParameterByName(element=all_elements_of_category_2, parameterName=code_block_13.out0, value=GIS2BIM_GetLocationdataNetherlands.PerceelKadaster)
setParameterByName_2 = Element.SetParameterByName(element=all_elements_of_category_2, parameterName=code_block_13.out1, value=GIS2BIM_GetLocationdataNetherlands.SectieKadaster)

GIS2BIM_CompanySettings_4 = Custom[GIS2BIM_CompanySettings](SearchSetting=code_block_12)

# group (continued): STEL PROJECTPARAMETERS IN
setParameterByName_3 = Element.SetParameterByName(element=all_elements_of_category_2, parameterName=GIS2BIM_CompanySettings_4.Setting, value=ui_multipleinputform.User_Inputs)

GIS2BIM_SetRevitSiteLocation = Custom[GIS2BIM_SetRevitSiteLocation](lat=GIS2BIM_GetLocationdataNetherlands.Latitude, lon=GIS2BIM_GetLocationdataNetherlands.Longitude)  # Sets the properties of the current Site Location of the active Revit Project

# group: MESSAGEBOX
isNull = Object.IsNull(obj=GIS2BIM_GetLocationdataNetherlands.RDcoordinateXmeters)
passthrough = Custom[Passthrough](passThrough=isNull, waitFor=ui_multipleinputform.Was_Run)  # Forces a sequential order of execution. The node wired into the output of the Passthrough node will be executed *after* the node wired into the waitFor input (e.g. important for some Revit operations). The value of the passThrough input will be passed on to the node wired into the output port of the Passthrough node.
code_block_14 = CodeBlock { "Locatiegegevens ophalen"; }
code_block_15 = CodeBlock()
# ---------- code_block_15.designscript (2 lines) ----------
["notification_pass",
"notification_error"];
# ----------------------------------------
code_block_16 = CodeBlock { 0; }
code_block_17 = CodeBlock { 1; }
boolean_5 = BoolSelector(true)
code_block_18 = CodeBlock { "gelukt"; }

GIS2BIM_CompanySettings_5 = Custom[GIS2BIM_CompanySettings](SearchSetting=code_block_15)

# group (continued): MESSAGEBOX
code_block_19 = CodeBlock(a=GIS2BIM_CompanySettings_5.Setting) { a[1]; a[0]; }
if_ = If(test=isNull, true=code_block_19.out0, false=code_block_19.out1)
python_script = Python(IN[0]=code_block_14, IN[1]=if_, IN[2]=code_block_16, IN[3]=code_block_17, IN[4]=boolean_5, IN[5]=boolean_5)
# ---------- python_script.python (82 lines) ----------
#Copyright © 2017, Lingkon
# http://BattleBIM.blogspot.com
# @Lingkon, lingkonn@gmail.com
#Dated: 09/04/2017
####################################
import sys
sys.path.append(r'C:\Program Files (x86)\IronPython 2.7\Lib')
import ctypes

#################
if IN[0] == "":
	title = "BattleBIM.MessageBox"
else:
	title = IN[0]
	
if IN[1] == "":
	mgs="""@Lingkon, lingkonn@gmail.com
http://BattleBIM.blogspot.com
https://www.facebook.com/groups/DynamoSingapore
####################################
"""

else:
	mgs=IN[1]

#BTN################
OK = 0x00000000L
ABORTRETRYIGNORE = 0x00000002L
CANCELTRYCONTINUE = 0x00000006L
HELP = 0x00004000L
OKCANCEL = 0x00000001L
RETRYCANCEL = 0x00000005L
YESNO = 0x00000004L
YESNOCANCEL = 0x00000003L

##################
if IN[2] == 0:
	btn = OK
elif IN[2] == 1:
	btn = ABORTRETRYIGNORE
elif IN[2] == 2:
	btn = CANCELTRYCONTINUE
elif IN[2] == 3:
	btn = HELP
elif IN[2] == 4:
	btn = OKCANCEL
elif IN[2] == 5:
	btn = RETRYCANCEL
elif IN[2] == 6:
	btn = YESNO
elif IN[2] == 7:
	btn = YESNOCANCEL
else:
	btn = OK

#ICON################
WARNING = 0x00000030L
INFORMATION = 0x00000040L
QUESTION = 0x00000020L
STOP = 0x00000010L
NOICON = 0x40000
##################

if IN[3] == 0:
	icon = WARNING
elif IN[3] == 1:
	icon = INFORMATION
elif IN[3] == 2:
	icon = QUESTION
elif IN[3] == 3:
	icon = STOP
elif IN[3] == 4:
	icon = NOICON
else:
	icon = INFORMATION
##################
def Mbox(title, text, style):
    ctypes.windll.user32.MessageBoxW(0, text, title, style)
#################
testBlock=IN[4]
#OUT=
OUT = Mbox(title, mgs, btn|icon) if testBlock else None
# ----------------------------------------
