# Dynamo graph GIS2x_1.2 Set Shared Coordinate.dyn (Dynamo 2.18.1.5096)
# packages: GIS2BIM for Dynamo 2.x 0.12.1

code_block = CodeBlock { "28992"; }
GIS2BIM_GetRevitSiteLocation = Custom[GIS2BIM_GetRevitSiteLocation]()  # package GIS2BIM for Dynamo 2.x; Gets the properties of the current Site Location of the active Revit Project
toNumber = String.ToNumber(string=GIS2BIM_GetRevitSiteLocation.Lon)
toNumber_2 = String.ToNumber(string=GIS2BIM_GetRevitSiteLocation.Lat)
GIS2BIM_TransformCRS_epsg = Custom[GIS2BIM_TransformCRS_epsg](TargetCRS=code_block, xCoordinate=toNumber, yCoordinate=toNumber_2)  # package GIS2BIM for Dynamo 2.x; Uses the API of http://epsg.io to transform Coordinate Reference Systems
code_block_2 = CodeBlock(x=GIS2BIM_TransformCRS_epsg.Xtransformed, y=GIS2BIM_TransformCRS_epsg.Ytransformed) { x*-1000; y*-1000; }
code_block_3 = CodeBlock { 0; }

# group: move surveypoint
categories = Categories("OST_SharedBasePoint")  # graph input
all_elements_of_category = ElementsOfCategory(Category=categories)
code_block_4 = CodeBlock(x=all_elements_of_category) { x[0]; }
surveyPoint = Coordinates.SurveyPoint()
byCoordinates = Point.ByCoordinates(x=code_block_2.out0, y=code_block_2.out1, z=code_block_3)
byTwoPoints = Vector.ByTwoPoints(start=surveyPoint, end=byCoordinates)
start = Revit.Transaction.Transaction.Start(input=byTwoPoints)
moveByVector = Element.MoveByVector(element=code_block_4, vector=start)
end = Revit.Transaction.Transaction.End(input=moveByVector)
