# Dynamo graph GIS2x_2.10 Natura2000.dyn (Dynamo 2.2.1.5175)

zoomniveaukaart_0_16 = IntegerSlider(8, range=0..16 step 1)  # graph input
create = List.Create(item0=zoomniveaukaart_0_16)
code_block = CodeBlock { "28992"; }
GIS2BIM_GetRevitSiteLocation = Custom[GIS2BIM_GetRevitSiteLocation]()  # Gets the properties of the current Site Location of the active Revit Project
toNumber = String.ToNumber(str=GIS2BIM_GetRevitSiteLocation.Lon)
toNumber_2 = String.ToNumber(str=GIS2BIM_GetRevitSiteLocation.Lat)
GIS2BIM_TransformCRS_epsg = Custom[GIS2BIM_TransformCRS_epsg](TargetCRS=code_block, xCoordinate=toNumber, yCoordinate=toNumber_2)  # Uses the API of http://epsg.io to transform Coordinate Reference Systems
afmeting_boundingbox_in_meters = IntegerSlider(2000, range=100..3000 step 1)  # "Afmeting boundingbox in meters(breedte, hoogte)"; graph input
create_2 = List.Create(item0=afmeting_boundingbox_in_meters)
GIS2BIM_WMTSLayersNetherlands = Custom[GIS2BIM_WMTSLayersNetherlands]()  # Library with layers for webrequests of WMTS-services in the Netherlands
create_3 = List.Create(item0=GIS2BIM_WMTSLayersNetherlands.kadastralekaartv3)
python_script = Python(IN[0]=create, IN[1]=GIS2BIM_TransformCRS_epsg.Xtransformed, IN[2]=GIS2BIM_TransformCRS_epsg.Ytransformed, IN[3]=create_2, IN[4]=create_3)
# ---------- python_script.python (229 lines) ----------
import clr
clr.AddReference('ProtoGeometry')
clr.AddReference("System.Drawing")
clr.AddReference("System")
from System import Drawing
from System.Drawing import Image
from System.Drawing import Bitmap
from System.Drawing import Graphics
from System.Drawing.Imaging import ImageFormat
from System.Net import WebRequest
from System.IO import Path
#from os import listdir
import sys
sys.path.append("C:\Program Files (x86)\IronPython 2.7\Lib")

from Autodesk.DesignScript.Geometry import *
#The inputs to this node will be stored as a list in the IN variables.

import math
from math import *
import itertools
from itertools import islice

dataEnteringNode = IN

Zoomlevels = IN[0]
Rdx = IN[1]
Rdy = IN[2]
BoundingboxWidths = IN[3]
Layers = IN[4]

Zoomleveldata = {0:3440.640,
1:1720.320,
2:860.160,
3:430.080,
4:215.040,
5:107.520,
6:53.720,
7:26.880,
8:13.440,
9:6.720,
10:3.360,
11:1.680,
12:0.840,
13:0.420,
14:0.210,
15:0.105,
16:0.0575}

PixelWidth =256
Xcorner=-285401.92
Ycorner=903402.0

Resolutions = []
for i in Zoomlevels:
	Resolutions.append(Zoomleveldata[i])

TileColumns = []
TileRows = []
DeltaX = []
DeltaY= []

for i in Resolutions:
	a = PixelWidth*i
	#TileColumns.append(Rdx-Xcorner)
	#TileRows.append(a)
	TileY = (Ycorner-Rdy)/a
	TileX = (Rdx-Xcorner)/a
	TileYRound = int(TileY)
	TileXRound = int(TileX)
	TilePercentageY = TileX-TileXRound
	TilePercentageX = TileY-TileYRound
	DeltaYM = TilePercentageY*PixelWidth*i
	DeltaXM = TilePercentageX*PixelWidth*i
	
	TileRows.append(TileYRound)
	TileColumns.append(TileXRound)
	DeltaY.append(DeltaYM)
	DeltaX.append(DeltaXM)

UniqueTileColumns = []
UniqueTileRows = []
TileColumns2 = []
TileRows2 = []

for i,j,k,l in zip(TileColumns, TileRows, BoundingboxWidths, Resolutions):
	TileWidth=PixelWidth*l
	c = math.ceil(k/TileWidth)
	b = math.ceil(c/2)*2
	UniqueTileColumns.append(range(int((i-b/2)), 1+int(i+b/2)))
	UniqueTileRows.append(range((int(j-b/2)), 1+int(j+b/2)))


for i in UniqueTileColumns:
	#de list:
	a = []
	
	counter = len(i)
	
	for j in i: #elke unieke tile
		a.append(i)
	flatA= []
	
	for sublist in a:
		for item in sublist:
			flatA.append(item)
	TileColumns2.append(flatA)
	
	counter=0

for i in UniqueTileRows:
	#de list:
	a = []
	
	counter = len(i)
	for j in i: #elke unieke tile
		a.append([int(j)]*counter)
	flatA= []
	
	for sublist in a:
		for item in sublist:
			flatA.append(item)
	TileRows2.append(flatA)
	
	counter=0

TotalTileWidth = []
TotalTileHeight = []
RdxMin = []
RdyMax = []
Dx = []
Dy = []

for i, j in zip(Resolutions,UniqueTileColumns):
	a = len(j)*PixelWidth*i
	b = (min(j)-1)*PixelWidth*i+Xcorner
	c = 0.5*a-(Rdx-b)
	TotalTileWidth.append(a)
	RdxMin.append(b)
	Dx.append(c)
	

for i, j in zip(Resolutions,UniqueTileRows):
	a = len(j)*PixelWidth*i
	b = -1*((min(j))*PixelWidth*i-Ycorner)
	c = 0.5*a+(Rdy-b)
	TotalTileHeight.append(a)
	RdyMax.append(b)
	Dy.append(c)
	

string1 = "http://geodata.nationaalgeoregister.nl/tiles/service/wmts?&request=GetTile&VERSION=1.0.0&LAYER="
string3 = "&STYLE=default&TILEMATRIXSET=EPSG:28992&TILEMATRIX=EPSG:28992:"
string34 = "&TILEROW="
string5 = "&TILECOL="
string7 = "&FORMAT=image/png8";

urlList = []

for i,j,k,z in zip(TileColumns2,TileRows2,Layers,Zoomlevels):
	a = []
	for l,m in zip(i,j):
		b = string1 + str(k) + string3 + str(z) + string34 + str(m) + string5 + str(l) + string7
		a.append(b)
	urlList.append(a)

bitmaps2 = []


for i in urlList:
	bitmaps = []
	for j in i:
		request = WebRequest.Create(j)
		request.Accept = "text/html"
		request.UserAgent = "Mozilla/5.0"
		response = request.GetResponse()
		bitmaps.append(Image.FromStream(response.GetResponseStream()))
	bitmaps2.append(bitmaps)

combinedBitmaps = []
for a,b,c in zip(bitmaps2,UniqueTileColumns,UniqueTileRows):
	TotalWidth = len(b)*PixelWidth
	TotalHeight = len(c)*PixelWidth
	img = Bitmap(TotalWidth,TotalHeight)
	g = Graphics.FromImage(img)
	LPx = []
	n = 0
	for l in j:
		LPx.append(n*PixelWidth)
		n=n+1
	
	LPy = []
	n = 0
	for i in c:
		LPy.append(n*PixelWidth)
		n=n+1

	LPx2=[]
	n=len(LPy)
	for i in LPx:
		LPx2.append([i]*n)

	LPx3=[]
	for sublist in LPx2:
		for item in sublist:
			LPx3.append(item)

	LPy2=[]
	for i in LPx:
		LPy2.append(LPy)

	LPy3=[]
	for sublist in LPy2:
		for item in sublist:
			LPy3.append(item)
        
	LPy4=reversed(LPy3)

	for m,n,o in zip(a,LPy3,LPx3):
		g.DrawImage(m,n,o)
	combinedBitmaps.append(img)

	#else:
	#	for i,j,k in zip(bitmaps,LPx3,LPy4):
	#		g.DrawImage(i,j,k)
	
combinedBitmaps
#Assign your output to the OUT variable.
OUT = combinedBitmaps, TotalTileWidth, TotalTileHeight, DeltaX, DeltaY,RdxMin,RdyMax, Dx, Dy
# ----------------------------------------
code_block_2 = CodeBlock(a=python_script) { a[0]; a[1]; a[2]; a[7]*1000; a[8]*-1000; }
firstItem = List.FirstItem(list=code_block_2.out1)

# group: Bepaal actieve view & bestandsnaam
current = Document.Current()
activeView = Document.ActiveView(document=current)
filePath = Document.FilePath(document=current)
code_block_3 = CodeBlock { ".rvt"; "kadaster.jpg"; }
replace = String.Replace(str=filePath, searchFor=code_block_3.out0, replaceWith=code_block_3.out1)

firstItem_2 = List.FirstItem(list=code_block_2.out0)
firstItem_3 = List.FirstItem(list=code_block_2.out3)
firstItem_4 = List.FirstItem(list=code_block_2.out4)

# group: Afbeelding inladen
passthrough = Custom[Passthrough](passThrough=replace, waitFor=firstItem_2)  # Forces a sequential order of execution. The node wired into the output of the Passthrough node will be executed *after* the node wired into the waitFor input (e.g. important for some Revit operations). The value of the passThrough input will be passed on to the node wired into the output port of the Passthrough node.
GIS2BIM_ImportImageInView = Custom[GIS2BIM_ImportImageInView](ImageWidthMeters=firstItem, View=activeView, ImagePath=passthrough, DeltaX=firstItem_3, DeltaY=firstItem_4)  # frozen; Import rasterimage in view
writeToFile = Image.WriteToFile(path=replace, image=firstItem_2)

code_block_4 = CodeBlock { BoundinxboxWidth: double; }  # unwired: BoundinxboxWidth
code_block_5 = CodeBlock { Layer: string; }  # unwired: Layer
code_block_6 = CodeBlock { RdX: double; }  # unwired: RdX
code_block_7 = CodeBlock { RdY: double; }  # unwired: RdY
watch_image = WatchImageCore(image=firstItem_2)
firstItem_5 = List.FirstItem(list=code_block_2.out2)
