# Dynamo graph GIS2x_2.3 Luchtfoto 2019.dyn (Dynamo 2.18.1.5096)
# packages: GIS2BIM for Dynamo 2.x 0.11.10, Clockwork for Dynamo 2.x 2.1.2, GIS2BIM for Dynamo 2.x 0.12.2

afmeting_boundingbox_in_meters = IntegerSlider(400, range=100..400000 step 1)  # "Afmeting boundingbox in meters(breedte, hoogte)"; graph input

# group: Bepaal actieve view & bestandsnaam
current = Document.Current()
activeView = Document.ActiveView(document=current)
filePath = Document.FilePath(document=current)
code_block = CodeBlock { ".rvt"; "_luchtfoto2019.jpg"; }
replace = String.Replace(string=filePath, searchFor=code_block.out0, replaceWith=code_block.out1)

code_block_2 = CodeBlock { "28992"; }
GIS2BIM_GetRevitSiteLocation = Custom[GIS2BIM_GetRevitSiteLocation]()  # package GIS2BIM for Dynamo 2.x; Gets the properties of the current Site Location of the active Revit Project
toNumber = String.ToNumber(string=GIS2BIM_GetRevitSiteLocation.Lon)
toNumber_2 = String.ToNumber(string=GIS2BIM_GetRevitSiteLocation.Lat)
GIS2BIM_TransformCRS_epsg = Custom[GIS2BIM_TransformCRS_epsg](TargetCRS=code_block_2, xCoordinate=toNumber, yCoordinate=toNumber_2)  # package GIS2BIM for Dynamo 2.x; Uses the API of http://epsg.io to transform Coordinate Reference Systems
GIS2BIM_CreateBoundingBox = Custom[GIS2BIM_CreateBoundingBox](CoordinateX=GIS2BIM_TransformCRS_epsg.Xtransformed, CoordinateY=GIS2BIM_TransformCRS_epsg.Ytransformed, BoxWidth=afmeting_boundingbox_in_meters, BoxHeight=afmeting_boundingbox_in_meters)  # package GIS2BIM for Dynamo 2.x; create boundingboxstring for webrequests based on coördinates and dimensions
GIS2BIM_NetherlandsGeoservicesLibrary = Custom[GIS2BIM_NetherlandsGeoservicesLibrary](BoundingBoxEPSG28992=GIS2BIM_CreateBoundingBox.Boxstring)  # package GIS2BIM for Dynamo 2.x; Library with multiple webadresses which can be used for WFS and WMS webrequests
GIS2BIM_WebrequestWMS = Custom[GIS2BIM_WebrequestWMS](WMSwebrequest=GIS2BIM_NetherlandsGeoservicesLibrary.luchtfoto_2020_OGC_WMS)  # package GIS2BIM for Dynamo 2.x; a webrequest based on WMS-protocol

# group: Afbeelding inladen
passthrough = Custom[Passthrough](passThrough=replace, waitFor=GIS2BIM_WebrequestWMS)  # package Clockwork for Dynamo 2.x; Forces a sequential order of execution. The node wired into the output of the Passthrough node will be executed *after* the node wired into the waitFor input (e.g. important for some Revit operations). The value of the passThrough input will be passed on to the node wired into the output port of the Passthrough node.
GIS2BIM_ImportImageInView = Custom[GIS2BIM_ImportImageInView](ImageWidthMeters=afmeting_boundingbox_in_meters, view=activeView, ImagePath=passthrough)  # frozen; package GIS2BIM for Dynamo 2.x; Import rasterimage in view
writeToFile = Image.WriteToFile(path=replace, image=GIS2BIM_WebrequestWMS)

watch_image = WatchImageCore(image=GIS2BIM_WebrequestWMS)
watch = Watch(GIS2BIM_CreateBoundingBox.PolygonString)
GIS2BIM_OpenBrowser = Custom[GIS2BIM_OpenBrowser]()  # package GIS2BIM for Dynamo 2.x; Opens a new window in your default browser with the given url.; unwired: url
code_block_3 = CodeBlock { "NL_PDOK_Luchtfoto_actueel_28992"; "serverrequestprefix"; }
GIS2BIM_GetWebServerData = Custom[GIS2BIM_GetWebServerData](title=code_block_3.out0, parameter=code_block_3.out1)  # package GIS2BIM for Dynamo 2.x; Get webserverdata from github repository of GIS2BIM(up to date list of GIS-servers & requests)
