# Dynamo graph GIS2x_2.6a Bestemmingsplan.dyn "GIS2x_2.6 Bestemmingsplan" (Dynamo 2.2.1.5175)

afmeting_boundingbox_in_meters = IntegerSlider(400, range=100..400000 step 1)  # "Afmeting boundingbox in meters(breedte, hoogte)"; graph input

# group: Bepaal actieve view & bestandsnaam
current = Document.Current()
activeView = Document.ActiveView(document=current)
filePath = Document.FilePath(document=current)
code_block = CodeBlock { ".rvt"; "_bestemmingsplan.jpg"; }
replace = String.Replace(str=filePath, searchFor=code_block.out0, replaceWith=code_block.out1)

code_block_2 = CodeBlock { "28992"; }
GIS2BIM_GetRevitSiteLocation = Custom[GIS2BIM_GetRevitSiteLocation]()  # Gets the properties of the current Site Location of the active Revit Project
toNumber = String.ToNumber(str=GIS2BIM_GetRevitSiteLocation.Lon)
toNumber_2 = String.ToNumber(str=GIS2BIM_GetRevitSiteLocation.Lat)
GIS2BIM_TransformCRS_epsg = Custom[GIS2BIM_TransformCRS_epsg](TargetCRS=code_block_2, xCoordinate=toNumber, yCoordinate=toNumber_2)  # Uses the API of http://epsg.io to transform Coordinate Reference Systems
GIS2BIM_CreateBoundingBox = Custom[GIS2BIM_CreateBoundingBox](CoordinateX=GIS2BIM_TransformCRS_epsg.Xtransformed, CoordinateY=GIS2BIM_TransformCRS_epsg.Ytransformed, BoxWidth=afmeting_boundingbox_in_meters, BoxHeight=afmeting_boundingbox_in_meters)  # create boundingboxstring for webrequests based on coördinates and dimensions
GIS2BIM_NetherlandsGeoservicesLibrary = Custom[GIS2BIM_NetherlandsGeoservicesLibrary](BoundingBoxEPSG28992=GIS2BIM_CreateBoundingBox.Boxstring)  # Library with multiple webadresses which can be used for WFS and WMS webrequests
GIS2BIM_WebrequestWMS = Custom[GIS2BIM_WebrequestWMS](WMSwebrequest=GIS2BIM_NetherlandsGeoservicesLibrary.12_ruimtelijkeplannen_OGC_WMS)  # a webrequest based on WMS-protocol

# group: Afbeelding inladen
passthrough = Custom[Passthrough](passThrough=replace, waitFor=GIS2BIM_WebrequestWMS)  # Forces a sequential order of execution. The node wired into the output of the Passthrough node will be executed *after* the node wired into the waitFor input (e.g. important for some Revit operations). The value of the passThrough input will be passed on to the node wired into the output port of the Passthrough node.
GIS2BIM_ImportImageInView = Custom[GIS2BIM_ImportImageInView](ImageWidthMeters=afmeting_boundingbox_in_meters, View=activeView, ImagePath=passthrough)  # Import rasterimage in view
writeToFile = Image.WriteToFile(path=replace, image=GIS2BIM_WebrequestWMS)

watch_image = WatchImageCore(image=GIS2BIM_WebrequestWMS)
