# Dynamo graph GIS2x_3.1 Kadaster+BAG 2D.dyn (Dynamo 2.3.0.5885)
# packages: GIS2BIM for Dynamo 2.x 0.11.10

current = Document.Current()
activeView = Document.ActiveView(document=current)
code_block = CodeBlock { "28992"; }
GIS2BIM_GetRevitSiteLocation = Custom[GIS2BIM_GetRevitSiteLocation]()  # package GIS2BIM for Dynamo 2.x; Gets the properties of the current Site Location of the active Revit Project
code_block_2 = CodeBlock { ","; "."; }
replace = String.Replace(str=GIS2BIM_GetRevitSiteLocation.Lon, searchFor=code_block_2.out0, replaceWith=code_block_2.out1)
toNumber = String.ToNumber(str=replace)
replace_2 = String.Replace(str=GIS2BIM_GetRevitSiteLocation.Lat, searchFor=code_block_2.out0, replaceWith=code_block_2.out1)
toNumber_2 = String.ToNumber(str=replace_2)
GIS2BIM_TransformCRS_epsg = Custom[GIS2BIM_TransformCRS_epsg](TargetCRS=code_block, xCoordinate=toNumber, yCoordinate=toNumber_2)  # package GIS2BIM for Dynamo 2.x; Uses the API of http://epsg.io to transform Coordinate Reference Systems
afmeting_boundingbox_in_meters = IntegerSlider(300, range=100..1000 step 1)  # "Afmeting boundingbox in meters(breedte, hoogte)"; graph input
GIS2BIM_CreateBoundingBox = Custom[GIS2BIM_CreateBoundingBox](CoordinateX=GIS2BIM_TransformCRS_epsg.Xtransformed, CoordinateY=GIS2BIM_TransformCRS_epsg.Ytransformed, BoxWidth=afmeting_boundingbox_in_meters, BoxHeight=afmeting_boundingbox_in_meters)  # package GIS2BIM for Dynamo 2.x; create boundingboxstring for webrequests based on coördinates and dimensions
GIS2BIM_NetherlandsGeoservicesLibrary = Custom[GIS2BIM_NetherlandsGeoservicesLibrary](BoundingBoxEPSG28992=GIS2BIM_CreateBoundingBox.Boxstring)  # package GIS2BIM for Dynamo 2.x; Library with multiple webadresses which can be used for WFS and WMS webrequests

# group: KADASTRALE PERCELEN(GRENZEN)
code_block_3 = CodeBlock { ".//{http://www.opengis.net/gml/3.2}posList"; }
web_request = WebRequest(url=GIS2BIM_NetherlandsGeoservicesLibrary.8_kadastrale_perceel_OGC_WFS)

code_block_4 = CodeBlock()
# ---------- code_block_4.designscript (6 lines) ----------
["textstyle_BAG_kadaster_1",
"textstyle_BAG_kadaster_2",
"textstyle_BAG_kadaster_3",
"linestyle_cadastral_parcel",
"linestyle_buildingcontour",
"filledregion_building"];
# ----------------------------------------
GIS2BIM_CompanySettings = Custom[GIS2BIM_CompanySettings](SearchSetting=code_block_4)  # package GIS2BIM for Dynamo 2.x; GIS2BIM Company Settings
code_block_5 = CodeBlock(a=GIS2BIM_CompanySettings.Setting) { a[0]; a[1]; a[2]; a[3]; a[4]; a[5]; }
byName = FilledRegionType.ByName(name=code_block_5.out5)

# group: BAG: pand
web_request_2 = WebRequest(url=GIS2BIM_NetherlandsGeoservicesLibrary.4_bag_pand_OGC_WFS)
boolean = BoolSelector(true)  # graph input

GIS2BIM_CreatePointsPolygonFromGMLxyz = Custom[GIS2BIM_CreatePointsPolygonFromGMLxyz](XML=web_request_2, XPATHSTRING=code_block_3, DeltaX=GIS2BIM_TransformCRS_epsg.Xtransformed, DeltaY=GIS2BIM_TransformCRS_epsg.Ytransformed, Connectpolygon=boolean)  # package GIS2BIM for Dynamo 2.x; Create points and polygons from a xml/gml-file with x,y and z value

# group (continued): BAG: pand
explode = Geometry.Explode(geometry=GIS2BIM_CreatePointsPolygonFromGMLxyz.PolyCurves)
byCurves = FilledRegion.ByCurves(view=activeView, boundary=explode, regionType=byName)

GIS2BIM_KadasterPercelen = Custom[GIS2BIM_KadasterPercelen](DeltaX=GIS2BIM_TransformCRS_epsg.Xtransformed, DeltaY=GIS2BIM_TransformCRS_epsg.Ytransformed, view=activeView, TextTypePerceel=code_block_5.out2, UrlWebrequestKadasterPerceel=GIS2BIM_NetherlandsGeoservicesLibrary.8_kadastrale_perceel_OGC_WFS)  # package GIS2BIM for Dynamo 2.x; Draw propertylines and place streetnames and housenumbers from the dutch kadaster
GIS2BIM_KadasterHouseNumbers = Custom[GIS2BIM_KadasterHouseNumbers](UrlWebrequestKadasterAnnotation=GIS2BIM_NetherlandsGeoservicesLibrary.7_kadastrale_annotatie_OGC_WFS, DeltaX=GIS2BIM_TransformCRS_epsg.Xtransformed, DeltaY=GIS2BIM_TransformCRS_epsg.Ytransformed, view=activeView, TextTypeHousenumber=code_block_5.out0, TextTypeStreetname=code_block_5.out1)  # package GIS2BIM for Dynamo 2.x; Draw propertylines and place streetnames and housenumbers from the dutch kadaster
code_block_6 = CodeBlock { 1000; }
GIS2BIM_CreatePointsPolygonFromGMLxy = Custom[GIS2BIM_CreatePointsPolygonFromGMLxy](XML=web_request, XPATHSTRING=code_block_3, DeltaX=GIS2BIM_TransformCRS_epsg.Xtransformed, DeltaY=GIS2BIM_TransformCRS_epsg.Ytransformed, UnitsConversionFactor=code_block_6)  # package GIS2BIM for Dynamo 2.x; Create point and polygons from a GML-file
GIS2BIM_CreateDetailLinesFromPolygons = Custom[GIS2BIM_CreateDetailLinesFromPolygons](view=activeView, PolyCurves=GIS2BIM_CreatePointsPolygonFromGMLxy.PolyCurves, Linestyle=code_block_5.out3)  # package GIS2BIM for Dynamo 2.x; Create detaillines from polygons in a view
GIS2BIM_CreateDetailLinesFromPolygons_2 = Custom[GIS2BIM_CreateDetailLinesFromPolygons](view=activeView, PolyCurves=GIS2BIM_CreatePointsPolygonFromGMLxyz.PolyCurves, Linestyle=code_block_5.out4)
