# Dynamo graph GIS2x_3.2 Bouwvlak bestemmingsplan.dyn (Dynamo 2.2.1.5175)

current = Document.Current()
activeView = Document.ActiveView(document=current)
code_block = CodeBlock { "28992"; }
GIS2BIM_GetRevitSiteLocation = Custom[GIS2BIM_GetRevitSiteLocation]()  # Gets the properties of the current Site Location of the active Revit Project
toNumber = String.ToNumber(str=GIS2BIM_GetRevitSiteLocation.Lon)
toNumber_2 = String.ToNumber(str=GIS2BIM_GetRevitSiteLocation.Lat)
GIS2BIM_TransformCRS_epsg = Custom[GIS2BIM_TransformCRS_epsg](TargetCRS=code_block, xCoordinate=toNumber, yCoordinate=toNumber_2)  # Uses the API of http://epsg.io to transform Coordinate Reference Systems
afmeting_boundingbox_in_meters = IntegerSlider(2000, range=100..2000 step 1)  # "Afmeting boundingbox in meters(breedte, hoogte)"; graph input
GIS2BIM_CreateBoundingBox = Custom[GIS2BIM_CreateBoundingBox](CoordinateX=GIS2BIM_TransformCRS_epsg.Xtransformed, CoordinateY=GIS2BIM_TransformCRS_epsg.Ytransformed, BoxWidth=afmeting_boundingbox_in_meters, BoxHeight=afmeting_boundingbox_in_meters)  # create boundingboxstring for webrequests based on coördinates and dimensions
GIS2BIM_NetherlandsGeoservicesLibrary = Custom[GIS2BIM_NetherlandsGeoservicesLibrary](BoundingBoxEPSG28992=GIS2BIM_CreateBoundingBox.Boxstring)  # Library with multiple webadresses which can be used for WFS and WMS webrequests
web_request = WebRequest(url=GIS2BIM_NetherlandsGeoservicesLibrary.2_ruimtelijke_plannen_OGC_WFS)
string = StringInput("<gml:posList>")
string_2 = StringInput("</gml:posList>")
split = String.Split(str=web_request, separator0=string, separator1=string_2)
code_block_2 = CodeBlock { 2; 0; }
takeEveryNthItem = List.TakeEveryNthItem(list=split, n=code_block_2.out0, offset=code_block_2.out1)
GIS2BIM_GMLCoordinateListToGeometry = Custom[GIS2BIM_GMLCoordinateListToGeometry](ListOfcoordinates=takeEveryNthItem, dX=GIS2BIM_TransformCRS_epsg.Xtransformed, dY=GIS2BIM_TransformCRS_epsg.Ytransformed)  # List of GML Coordinates to Polycurves and Points
code_block_3 = CodeBlock { "linestyle_buildingarea"; }
GIS2BIM_CompanySettings = Custom[GIS2BIM_CompanySettings](SearchSetting=code_block_3)  # GIS2BIM Company Settings
GIS2BIM_CreateDetailLinesFromPolygons = Custom[GIS2BIM_CreateDetailLinesFromPolygons](View=activeView, PolyCurves=GIS2BIM_GMLCoordinateListToGeometry.PolyCurves, Linestyle=GIS2BIM_CompanySettings.Setting)  # Create detaillines from polygons in a view
