# Dynamo graph GIS2x_3.5 BGT 2D Lijnen.dyn (Dynamo 2.10.1.3976)
# packages: GIS2BIM for Dynamo 2.x 0.11.19, GIS2BIM for Dynamo 2.x 0.11.20

code_block = CodeBlock { "Gouda"; "Gouderaksedijk"; "58"; }
GIS2BIM_GetLocationdataNetherlands = Custom[GIS2BIM_GetLocationdataNetherlands](City=code_block.out0, Streetname=code_block.out1, Housenumber=code_block.out2)  # package GIS2BIM for Dynamo 2.x; Gives locationdata based on an adress in the Netherlands
afmeting_boundingbox_in_meters = IntegerSlider(300, range=100..1500 step 1)  # "Afmeting boundingbox in meters(breedte, hoogte)"; graph input

# group: BOUNDINGBOX IN DYNAMO
code_block_2 = CodeBlock(a=afmeting_boundingbox_in_meters) { a*1000; }
byWidthLength = Rectangle.ByWidthLength(width=code_block_2, length=code_block_2)

code_block_3 = CodeBlock { "28992"; }
GIS2BIM_GetRevitSiteLocation = Custom[GIS2BIM_GetRevitSiteLocation]()  # package GIS2BIM for Dynamo 2.x; Gets the properties of the current Site Location of the active Revit Project
toNumber = String.ToNumber(str=GIS2BIM_GetRevitSiteLocation.Lon)
toNumber_2 = String.ToNumber(str=GIS2BIM_GetRevitSiteLocation.Lat)
GIS2BIM_TransformCRS_epsg = Custom[GIS2BIM_TransformCRS_epsg](TargetCRS=code_block_3, xCoordinate=toNumber, yCoordinate=toNumber_2)  # package GIS2BIM for Dynamo 2.x; Uses the API of http://epsg.io to transform Coordinate Reference Systems
GIS2BIM_CreateBoundingBox = Custom[GIS2BIM_CreateBoundingBox](CoordinateX=GIS2BIM_TransformCRS_epsg.Xtransformed, CoordinateY=GIS2BIM_TransformCRS_epsg.Ytransformed, BoxWidth=afmeting_boundingbox_in_meters, BoxHeight=afmeting_boundingbox_in_meters)  # package GIS2BIM for Dynamo 2.x; create boundingboxstring for webrequests based on coördinates and dimensions

# group: Bepaal actieve view
current = Document.Current()
filePath = Document.FilePath(document=current)
string = StringInput("\")
string_2 = StringInput("/")
replace = String.Replace(string=filePath, searchFor=string, replaceWith=string_2)
activeView = Document.ActiveView(document=current)

# group: LINESTYLES/FILLED REGIONS
code_block_4 = CodeBlock { "tempfolder_name"; }
GIS2BIM_CompanySettings = Custom[GIS2BIM_CompanySettings](SearchSetting=code_block_4)  # package GIS2BIM for Dynamo 2.x; GIS2BIM Company Settings
code_block_5 = CodeBlock { "bgt_curve_linestyles"; }
GIS2BIM_CompanySettings_2 = Custom[GIS2BIM_CompanySettings](SearchSetting=code_block_5)
code_block_6 = CodeBlock { "textstyle_BGT"; }
GIS2BIM_CompanySettings_3 = Custom[GIS2BIM_CompanySettings](SearchSetting=code_block_6)
code_block_7 = CodeBlock { "filledregion_bgt_pand"; }
GIS2BIM_CompanySettings_4 = Custom[GIS2BIM_CompanySettings](SearchSetting=code_block_7)
code_block_8 = CodeBlock { "filledregion_bgt_groen_1"; }
GIS2BIM_CompanySettings_5 = Custom[GIS2BIM_CompanySettings](SearchSetting=code_block_8)
code_block_9 = CodeBlock { "filledregion_bgt_weg_2"; }
GIS2BIM_CompanySettings_6 = Custom[GIS2BIM_CompanySettings](SearchSetting=code_block_9)
code_block_10 = CodeBlock { "filledregion_bgt_water_2"; }
GIS2BIM_CompanySettings_7 = Custom[GIS2BIM_CompanySettings](SearchSetting=code_block_10)
code_block_11 = CodeBlock { "filledregion_bgt_weg_1"; }
GIS2BIM_CompanySettings_8 = Custom[GIS2BIM_CompanySettings](SearchSetting=code_block_11)

# group: Create subdirectory
python_script = Python(IN[0]=replace, IN[1]=GIS2BIM_CompanySettings.Setting)  # IronPython2
# ---------- python_script.python (12 lines) ----------
import os

revitfilepath = IN[0]
tempfoldername =  IN[1]

NewFolder = os.path.dirname(revitfilepath) + "/" + tempfoldername
if os.path.exists(NewFolder):
	NewFolder
else:
	os.mkdir(NewFolder)

OUT = NewFolder
# ----------------------------------------
code_block_12 = CodeBlock { "BGT"; }
python_script_2 = Python(IN[0]=python_script, IN[1]=code_block_12)  # IronPython2
# ---------- python_script_2.python (16 lines) ----------
import os
from datetime import datetime

filepath = IN[0]
BGTprefix =  IN[1]

NewFolder = filepath + "/" + BGTprefix 

if os.path.exists(NewFolder):
	NewFolder
else:
	os.mkdir(NewFolder)

zipfile = NewFolder + '.zip'

OUT = NewFolder,zipfile
# ----------------------------------------
code_block_13 = CodeBlock(a=python_script_2) { a[1]; a[0]; }

# group: CHECK IF THIS IS THE FOLDER OF THE GIS2BIM FOR DYNAMO 2.X PACKAGE
python_script_3 = Python()  # CPython3
# ---------- python_script_3.python (13 lines) ----------
from System.Reflection import Assembly
import os

dynamo = Assembly.Load('DynamoCore')
version = str(dynamo.GetName().Version)
versionsplit = version.split(".")
version = versionsplit[0] + "." + versionsplit[1]

basepath = os.getenv('APPDATA')

pathRequests = basepath + "/Dynamo/Dynamo Revit/" + version + "/packages/GIS2BIM for Dynamo 2.x/bin"

OUT = pathRequests
# ----------------------------------------
code_block_14 = CodeBlock {  }

# group: DOWNLOAD BGT USING POST/GET
code_block_15 = CodeBlock()
# ---------- code_block_15.designscript (2 lines) ----------
//timeout
120;
# ----------------------------------------
GIS2BIM_BGTDownload = Custom[GIS2BIM_BGTDownload](PolygonString=GIS2BIM_CreateBoundingBox.PolygonString, TimeOutDownload=code_block_15, FilePathZipFile=code_block_13.out0, FolderExtractedFiles=code_block_13.out1, PathOfCPythonLibraries=python_script_3)  # package GIS2BIM for Dynamo 2.x; Download BGT Dynamoversion > 2.8 Uses CPython Libraries
code_block_16 = CodeBlock(dir=GIS2BIM_BGTDownload.Directory, files=GIS2BIM_BGTDownload.Files, rdx=GIS2BIM_TransformCRS_epsg.Xtransformed, rdy=GIS2BIM_TransformCRS_epsg.Ytransformed) { dir; files; rdx; rdy; }

# group: BGT GEOMETRY
GIS2BIM_BGTGeometry = Custom[GIS2BIM_BGTGeometry](RdX=code_block_16.rdx, RdY=code_block_16.rdy, BoundingboxWidth=afmeting_boundingbox_in_meters, Directorypath=code_block_16.dir)  # package GIS2BIM for Dynamo 2.x; Returns BGT-curves and metadata(Dutch GEO)

# group: BGT DETAILLINES
python_script_4 = Python(IN[0]=GIS2BIM_BGTGeometry.Curves_BGT, IN[1]=activeView, IN[2]=GIS2BIM_CompanySettings_2.Setting)  # IronPython2
# ---------- python_script_4.python (55 lines) ----------
import clr
clr.AddReference('RevitAPI')
from Autodesk.Revit.DB import *

clr.AddReference("RevitNodes")
import Revit
clr.ImportExtensions(Revit.GeometryConversion)

clr.AddReference("RevitServices")
import RevitServices
from RevitServices.Persistence import DocumentManager
from RevitServices.Transactions import TransactionManager

doc = DocumentManager.Instance.CurrentDBDocument
curves = IN[0]
view = UnwrapElement(IN[1])
linetypes = IN[2]

def mainfunction(curves, linetype):
	curvesunwrap = []
	for i in curves:
		for j in i:
			curvesunwrap.append(UnwrapElement(j))	
	elementlist = []

	collector = FilteredElementCollector(doc)
	lstFilter = ElementClassFilter(GraphicsStyle)
	lstCollector = collector.WherePasses(lstFilter).ToElements()
	try:
		lstCollector = filter(lambda x: x.Name == linetype, lstCollector)
		linetype = filter(lambda x: x.GraphicsStyleCategory.CategoryType.__str__()=='Model', lstCollector)[0]
	except:
		linetype = []

	TransactionManager.Instance.EnsureInTransaction(doc)
	if doc.IsFamilyDocument: 
		doc_create = doc.FamilyCreate
	else: 
		doc_create = doc.Create
	for curve in curvesunwrap:
		detcurve = doc_create.NewDetailCurve(view, curve.ToRevitType())
		if linetype != []: 
			detcurve.LineStyle = linetype
		elementlist.append(detcurve)
	TransactionManager.Instance.TransactionTaskDone()
	return  elementlist

result = []
for i,j in zip(curves,linetypes):
	try:
		result.append(mainfunction(i,j))
	except: result.append("_none_")

	
OUT = result
# ----------------------------------------

# group: PLACE OPENBARE RUIMTE LABEL
toUpper = String.ToUpper(string=GIS2BIM_BGTGeometry.Text_openbareruimtelabel)
code_block_17 = CodeBlock { "left"; }
byName = TextNoteType.ByName(name=GIS2BIM_CompanySettings_3.Setting)
toNumber_3 = String.ToNumber(str=GIS2BIM_BGTGeometry.Rotation_openbareruimtelabel)
code_block_18 = CodeBlock(a=toNumber_3) { a*-1; }
byLocation = TextNote.ByLocation(view=activeView, location=GIS2BIM_BGTGeometry.Points_openbareruimtelabel, text=toUpper, alignment=code_block_17, type=byName, rotation=code_block_18)

# group: BGT VEGATATIEOBJECT ALS SCHEMATISCHE BOOM
code_block_19 = CodeBlock()
# ---------- code_block_19.designscript (11 lines) ----------
straal = 2500;
straalstam = 100;
line1 = Line.ByStartPointEndPoint(Point.ByCoordinates(Neg(straal), 0), Point.ByCoordinates(straal, 0));
circle1 = Circle.ByCenterPointRadius(Point.Origin(), straal);
circle2 = Circle.ByCenterPointRadius(Point.Origin(), straalstam);
n = (0..1..#15);
point1 = Autodesk.Curve.PointAtParameter(circle1, n);
vector1 = Autodesk.Curve.NormalAtParameter(circle1, n);
line2 = Line.ByStartPointDirectionLength(point1, vector1, straal);
t1 = [circle1, circle2];
t2 = List.Join([t1, line2]);
# ----------------------------------------
code_block_20 = CodeBlock(bgtpoint=GIS2BIM_BGTGeometry.Points_BGT, bgtdata=GIS2BIM_BGTGeometry.Metadata_BGT)
# ---------- code_block_20.designscript (3 lines) ----------
//boomdata
bgtpoint[8];
bgtdata[8];
# ----------------------------------------
X = Point.X(point=code_block_20.out0)
Y = Point.Y(point=code_block_20.out0)
translate = Geometry.Translate(xTranslation=X, yTranslation=Y)  # unwired: geometry
map = List.Map(list=code_block_19.t2, function=translate)
flatten = List.Flatten(list=map)
code_block_21 = CodeBlock { "bgt_vegatatieobject"; }
GIS2BIM_CreateDetailLinesFromPolygons = Custom[GIS2BIM_CreateDetailLinesFromPolygons](view=activeView, PolyCurves=flatten, Linestyle=code_block_21)  # package GIS2BIM for Dynamo 2.x; Create detaillines from polygons in a view

# group: Filled Regions are incomplete due to unresolved 'donut' problems, intersecting lines and duplicate points
code_block_22 = CodeBlock(curvesFilledRegions=GIS2BIM_BGTGeometry.Curves_BGT) { curvesFilledRegions; }  # frozen
code_block_23 = CodeBlock { a; }  # unwired: a

# group: FILLED REGION BGT PAND
code_block_24 = CodeBlock(bgtpand=code_block_22) { bgtpand[11]; }
byName_2 = FilledRegionType.ByName(name=GIS2BIM_CompanySettings_4.Setting)
byCurves = FilledRegion.ByCurves(view=activeView, boundary=code_block_24, regionType=byName_2)

# group: BGT OVERIGE PUNTVORMIGE OBJECTEN ALS CIRKEL
code_block_25 = CodeBlock { straal = 100; circle1 = Circle.ByCenterPointRadius(Point.Origin(), straal); }
code_block_26 = CodeBlock(bgtpoint=GIS2BIM_BGTGeometry.Points_BGT, bgtdata=GIS2BIM_BGTGeometry.Metadata_BGT)
# ---------- code_block_26.designscript (3 lines) ----------
//boomdata
bgtpoint;
bgtdata;
# ----------------------------------------
X_2 = Point.X(point=code_block_26.bgtpoint)
Y_2 = Point.Y(point=code_block_26.bgtpoint)
translate_2 = Geometry.Translate(geometry=code_block_25.circle1, xTranslation=X_2, yTranslation=Y_2)
flatten_2 = List.Flatten(list=translate_2)
code_block_27 = CodeBlock { "bgt_puntvormig object"; }
GIS2BIM_CreateDetailLinesFromPolygons_2 = Custom[GIS2BIM_CreateDetailLinesFromPolygons](view=activeView, PolyCurves=flatten_2, Linestyle=code_block_27)

# group: FILLED REGION BGT BEGROEID TERREINDEEL
byName_3 = FilledRegionType.ByName(name=GIS2BIM_CompanySettings_5.Setting)
byCurves_2 = FilledRegion.ByCurves(view=activeView, regionType=byName_3)  # unwired: boundary
code_block_28 = CodeBlock(bgt_begroeidterreindeel=code_block_22) { bgt_begroeidterreindeel[0]; }

code_block_29 = CodeBlock { "filledregion_bgt_water"; }
GIS2BIM_CompanySettings_9 = Custom[GIS2BIM_CompanySettings](SearchSetting=code_block_29)

# group: FILLED REGION BGT WATERDEEL
code_block_30 = CodeBlock(bgtwaterdeel=code_block_22) { bgtwaterdeel[15]; }
byName_4 = FilledRegionType.ByName(name=GIS2BIM_CompanySettings_9.Setting)
byCurves_3 = FilledRegion.ByCurves(view=activeView, boundary=code_block_30, regionType=byName_4)

# group: FILLED REGION BGT OVERIG BOUWWERK
code_block_31 = CodeBlock(bgtpand=code_block_22) { bgtpand[9]; }
byName_5 = FilledRegionType.ByName(name=GIS2BIM_CompanySettings_4.Setting)
byCurves_4 = FilledRegion.ByCurves(view=activeView, boundary=code_block_31, regionType=byName_5)

# group: FILLED REGION BGT ONDERSTEUNEND WEGDEEL
code_block_32 = CodeBlock(bgt=code_block_22) { bgt[6]; }  # frozen
byName_6 = FilledRegionType.ByName(name=GIS2BIM_CompanySettings_6.Setting)
byCurves_5 = FilledRegion.ByCurves(view=activeView, boundary=code_block_32, regionType=byName_6)

# group: FILLED REGION BGT ONDERSTEUNEND WATERDEEL
code_block_33 = CodeBlock(bgt=code_block_22) { bgt[5]; }  # frozen
byName_7 = FilledRegionType.ByName(name=GIS2BIM_CompanySettings_7.Setting)
byCurves_6 = FilledRegion.ByCurves(view=activeView, boundary=code_block_33, regionType=byName_7)

# group: FILLED REGION BGT ONBEGROEID TERREINDEEL
code_block_34 = CodeBlock(bgt=code_block_22) { bgt[4]; }
byName_8 = FilledRegionType.ByName(name=GIS2BIM_CompanySettings_5.Setting)
byCurves_7 = FilledRegion.ByCurves(view=activeView, boundary=code_block_34, regionType=byName_8)

# group: FILLED REGION BGT WEGDEEL
code_block_35 = CodeBlock(bgt=code_block_22) { bgt[16]; }
byName_9 = FilledRegionType.ByName(name=GIS2BIM_CompanySettings_8.Setting)
byCurves_8 = FilledRegion.ByCurves(view=activeView, boundary=code_block_35, regionType=byName_9)
