# Dynamo graph GIS2x_4.1 3D BAG V1.dyn "GIS2x_4.1 3D BAG" (Dynamo 2.3.0.5885)
# packages: spring nodes 203.1.0, GIS2BIM for Dynamo 2.x 0.11.10

code_block = CodeBlock { "28992"; }
GIS2BIM_GetRevitSiteLocation = Custom[GIS2BIM_GetRevitSiteLocation]()  # package GIS2BIM for Dynamo 2.x; Gets the properties of the current Site Location of the active Revit Project
toNumber = String.ToNumber(str=GIS2BIM_GetRevitSiteLocation.Lon)
toNumber_2 = String.ToNumber(str=GIS2BIM_GetRevitSiteLocation.Lat)
GIS2BIM_TransformCRS_epsg = Custom[GIS2BIM_TransformCRS_epsg](TargetCRS=code_block, xCoordinate=toNumber, yCoordinate=toNumber_2)  # package GIS2BIM for Dynamo 2.x; Uses the API of http://epsg.io to transform Coordinate Reference Systems
afmeting_boundingbox_in_meters = IntegerSlider(800, range=100..1000 step 1)  # "Afmeting boundingbox in meters(breedte, hoogte)"; graph input
GIS2BIM_CreateBoundingBox = Custom[GIS2BIM_CreateBoundingBox](CoordinateX=GIS2BIM_TransformCRS_epsg.Xtransformed, CoordinateY=GIS2BIM_TransformCRS_epsg.Ytransformed, BoxWidth=afmeting_boundingbox_in_meters, BoxHeight=afmeting_boundingbox_in_meters)  # package GIS2BIM for Dynamo 2.x; create boundingboxstring for webrequests based on coördinates and dimensions

# group: BOUNDINGBOX EN CONSTRUEER WEBREQUEST
GIS2BIM_NetherlandsGeoservicesLibrary = Custom[GIS2BIM_NetherlandsGeoservicesLibrary](BoundingBoxEPSG28992=GIS2BIM_CreateBoundingBox.Boxstring)  # package GIS2BIM for Dynamo 2.x; Library with multiple webadresses which can be used for WFS and WMS webrequests

GIS2BIM_BAG3D = Custom[GIS2BIM_BAG3D](BAG3DTUDelft_OGCWFS=GIS2BIM_NetherlandsGeoservicesLibrary.3D_BAG_TU_Delft_OGC_WFS, RdX=GIS2BIM_TransformCRS_epsg.Xtransformed, RdY=GIS2BIM_TransformCRS_epsg.Ytransformed)  # package GIS2BIM for Dynamo 2.x; Perform a WFS(Web Feature Service) webrequest based on a boundingbox of RD-coordinates(28992). Retrieve an xml-file. Read the metadata and create 3D-solids. Maximum of 1000 buildings per request.
isNull = Object.IsNull(obj=GIS2BIM_BAG3D.BAG_3DSolids_Per_Building)
filterByBoolMask = List.FilterByBoolMask(list=GIS2BIM_BAG3D.BAG_3DSolids_Per_Building, mask=isNull)
byUnion = Solid.ByUnion(solids=filterByBoolMask.out)
code_block_2 = CodeBlock { ["familytemplatepath_mass","materialname_building"]; }
GIS2BIM_CompanySettings = Custom[GIS2BIM_CompanySettings](SearchSetting=code_block_2)  # package GIS2BIM for Dynamo 2.x; GIS2BIM Company Settings
code_block_3 = CodeBlock(a=GIS2BIM_CompanySettings.Setting) { a[0]; a[1]; }
code_block_4 = CodeBlock { "Mass"; }
byName = Category.ByName(name=code_block_4)

# group: PLACE FAMILY
code_block_5 = CodeBlock { "NLRS_90_MA_BAG_3D.rfa"; ".rfa"; }
code_block_6 = CodeBlock { "Form"; }
byGeometry = Custom[Springs.FamilyInstance.ByGeometry](geometry=byUnion, familyTemplatePath=code_block_3.out0, familyName=code_block_5.out0, category=byName, materialName=code_block_3.out1, subcategoryName=code_block_6)  # package spring nodes; You must provide a valid family template path that will be used for all input geometry objects. The project units(and not the templates) will be used to determine the size of the output geometry. The provided category will be used only if the family template supports it. If not, the default template category will be used instead. Likewise, the family material(provided as a string) will be set only if a material with that name exists in the template. If not, the default material will be used instead ("By Category"). For void cuts, the material settings will be ignored. The Subcategory name is an optional input. If you'd like to skip assigning a Subcategory to any new instance, simply use null. The node expects a unique family name for each geometry object. The rest of the input lists will be processed as if the node lacing is set to longest.
