# Dynamo graph GIS2x_4.1 3D BAG V2.dyn (Dynamo 2.18.1.5096)
# packages: MeshToolkit 3.0.0, spring nodes 203.1.0, GIS2BIM for Dynamo 2.x 0.12.2, GIS2BIM for Dynamo 2.x 0.11.15

code_block = CodeBlock { 2; }
number = DoubleInput(1000)  # graph input

# group: GET REVIT SITE LOCATION AND TRANSFORM TO RD-COORDINATES(EPSG 28992)
code_block_2 = CodeBlock { "4326"; "28992"; }
GIS2BIM_GetRevitSiteLocation = Custom[GIS2BIM_GetRevitSiteLocation]()  # package GIS2BIM for Dynamo 2.x; Gets the properties of the current Site Location of the active Revit Project
toNumber = String.ToNumber(string=GIS2BIM_GetRevitSiteLocation.Lon)
toNumber_2 = String.ToNumber(string=GIS2BIM_GetRevitSiteLocation.Lat)
GIS2BIM_TransformCRS_epsg = Custom[GIS2BIM_TransformCRS_epsg](SourceCRS=code_block_2.out0, TargetCRS=code_block_2.out1, xCoordinate=toNumber, yCoordinate=toNumber_2)  # package GIS2BIM for Dynamo 2.x; Uses the API of http://epsg.io to transform Coordinate Reference Systems
round = Math.Round(number=GIS2BIM_TransformCRS_epsg.Xtransformed, digits=code_block)
round_2 = Math.Round(number=GIS2BIM_TransformCRS_epsg.Ytransformed, digits=code_block)
GIS2BIM_CreateBoundingBox = Custom[GIS2BIM_CreateBoundingBox](CoordinateX=round, CoordinateY=round_2, BoxWidth=number, BoxHeight=number)  # package GIS2BIM for Dynamo 2.x; create boundingboxstring for webrequests based on coördinates and dimensions

python_script = Python(IN[0]=GIS2BIM_CreateBoundingBox.Boxstring2)  # CPython3
# ---------- python_script.python (40 lines) ----------
# Load the Python Standard and DesignScript Libraries
import sys
import clr
import urllib
import urllib.request
import json
clr.AddReference('ProtoGeometry')
from Autodesk.DesignScript.Geometry import *

bbox = IN[0]

def GetWebServerData(servertitle, category, parameter):
	#Get webserverdata from github repository of GIS2BIM(up to date list of GIS-servers & requests)
	Serverlocation = "https://raw.githubusercontent.com/DutchSailor/GIS2BIM/master/GIS2BIM_Data.json"
	url = urllib.request.urlopen(Serverlocation)
	data = json.loads(url.read())['GIS2BIMserversRequests'][category]
	test = []
	for i in data:
		test.append(i["title"])
	result = data[test.index(servertitle)][parameter]
	return result

NLTUDelftBAG3D = GetWebServerData('NLTUDelftBAG3D_28992','webserverRequests','serverrequestprefix')
NLTUDelftxPathString3DBagTileId = GetWebServerData('NLTUDelftxPathString3DBagTileId','Querystrings','querystring')
NLPDOKxPathOpenGISposList = GetWebServerData('NLPDOKxPathOpenGISposList','Querystrings','querystring')
NLTUDelftxPathString3DBag2 = GetWebServerData('NLTUDelftxPathString3DBag2','Querystrings','querystring')
xPathStrings3DBAG2 = [NLTUDelftxPathString3DBagTileId, NLPDOKxPathOpenGISposList, NLTUDelftxPathString3DBag2]

def BAG3DURL(bboxString):
	#Get URL
	url = NLTUDelftBAG3D
	xPathString1 = xPathStrings3DBAG2[0]

	# Webrequest to obtain tilenumbers based on bbox
	urlreq = url + bboxString
 
	return urlreq
 
res = BAG3DURL(bbox)
OUT = res, xPathStrings3DBAG2
# ----------------------------------------
code_block_3 = CodeBlock(a=python_script) { a[1]; a[0]; }
watch = Watch(code_block_3.out0)
code_block_4 = CodeBlock(a=watch) { a[0]; }
list_create = List.Create(item0=code_block_4)

# group: DOWNLOAD LINKS
web_request = WebRequest(url=code_block_3.out1)
watch_2 = Watch(web_request)
GIS2BIM_XMLXPath = Custom[GIS2BIM_XMLXPath](XMLString=watch_2, XPathStrings=list_create)  # package GIS2BIM for Dynamo 2.x; Run an XPathquery on an xml-string
code_block_5 = CodeBlock(a=GIS2BIM_XMLXPath)
# ---------- code_block_5.designscript (2 lines) ----------
//list of tile-id's
a[0];
# ----------------------------------------

code_block_6 = CodeBlock { "NLTUDelftBAG3Ddownload_28992"; "webserverRequests"; "serverrequestprefix"; }
GIS2BIM_GetWebServerData = Custom[GIS2BIM_GetWebServerData](category=code_block_6.out1, title=code_block_6.out0, parameter=code_block_6.out2)  # package GIS2BIM for Dynamo 2.x; Get webserverdata from github repository of GIS2BIM(up to date list of GIS-servers & requests)
string = StringInput("C:\TEMP")

# group: Download zip
code_block_7 = CodeBlock(tilenumber=code_block_5)
# ---------- code_block_7.designscript (4 lines) ----------
basepath="https://data.3dbag.nl/obj/v20231008/tiles/";
filename = String.Replace(tilenumber,"/", "-");
file = filename + "-obj.zip";
subpath = tilenumber + "/" + file;
# ----------------------------------------
concat = String.Concat(string0=GIS2BIM_GetWebServerData)  # unwired: string1
map = List.Map(list=code_block_7.subpath, function=concat)
string_from_object = FromObject(object=string)
string_2 = StringInput("\")
concat_2 = String.Concat(string0=string_from_object, string1=string_2)  # unwired: string2
map_2 = List.Map(list=code_block_7.file, function=concat_2)
python_script_2 = Python(IN[0]=map, IN[1]=map_2)  # CPython3
# ---------- python_script_2.python (12 lines) ----------
import sys
sys.path.append("C:\Program Files (x86)\IronPython 2.7\Lib")
from System.Net import WebClient
import os

url= IN[0]
filoc= IN[1]

for i,j in zip(url,filoc):
    if not os.path.exists(j):
        WebClient().DownloadFile(i, j)
OUT= filoc
# ----------------------------------------
code_block_8 = CodeBlock { -4; 4; }
remove = String.Remove(string=map_2, startIndex=code_block_8.out0, count=code_block_8.out1)
python_script_3 = Python(IN[0]=python_script_2, IN[1]=remove)  # IronPython2
# ---------- python_script_3.python (17 lines) ----------
import clr
clr.AddReference("System.IO.Compression.FileSystem")
from System.IO.Compression import ZipFile
import os

#The inputs to this node will be stored as a list in the IN variables.
dataEnteringNode = IN
tzip = IN[0]
tpath = IN[1]

for i,j in zip(tzip, tpath):
    print(i + "  /  " + j)
    if not os.path.exists(j):
	ZipFile.ExtractToDirectory(i, j)
		
#Assign your output to the OUT variable.
OUT = tpath
# ----------------------------------------
string_3 = StringInput("\")
code_block_9 = CodeBlock(directory=python_script_3, filename=code_block_7.filename, slash=string_3)
# ---------- code_block_9.designscript (4 lines) ----------
// eample: directory + 8-864-880-LoD22-3D.obj
directory;
filename;
objfile = directory + slash + filename + "-LoD22-3D.obj";
# ----------------------------------------
firstItem = List.FirstItem(list=code_block_9.objfile)

# group: Import Mesh Translate over Rdx/Rdy and scale to mm
importFile = Autodesk.Dynamo.MeshToolkit.Mesh.ImportFile(fileName=code_block_9.objfile)
code_block_10 = CodeBlock(x=GIS2BIM_TransformCRS_epsg.Xtransformed, y=GIS2BIM_TransformCRS_epsg.Ytransformed) { x*-1; y*-1; }
translate = Autodesk.Dynamo.MeshToolkit.Mesh.Translate(mesh=importFile, x=code_block_10.out0, y=code_block_10.out1)
flatten = List.Flatten(list=translate)
code_block_11 = CodeBlock { 1000; }
scale = Autodesk.Dynamo.MeshToolkit.Mesh.Scale(mesh=flatten, scaleFactor=code_block_11)

code_block_12 = CodeBlock(B=number) { B; -0.5*B*1000; 0.5*B*1000; }
byCoordinates = Point.ByCoordinates(y=code_block_12.out1)
YAxis = Vector.YAxis()
byOriginNormal = Plane.ByOriginNormal(origin=byCoordinates, normal=YAxis)
planeCut = Autodesk.Dynamo.MeshToolkit.Mesh.PlaneCut(mesh=scale, plane=byOriginNormal)
byCoordinates_2 = Point.ByCoordinates(y=code_block_12.out2)
reverse = Vector.Reverse(vector=YAxis)
byOriginNormal_2 = Plane.ByOriginNormal(origin=byCoordinates_2, normal=reverse)
planeCut_2 = Autodesk.Dynamo.MeshToolkit.Mesh.PlaneCut(mesh=planeCut, plane=byOriginNormal_2)
byCoordinates_3 = Point.ByCoordinates(x=code_block_12.out1)
XAxis = Vector.XAxis()
byOriginNormal_3 = Plane.ByOriginNormal(origin=byCoordinates_3, normal=XAxis)
planeCut_3 = Autodesk.Dynamo.MeshToolkit.Mesh.PlaneCut(mesh=planeCut_2, plane=byOriginNormal_3)
byCoordinates_4 = Point.ByCoordinates(x=code_block_12.out2)
reverse_2 = Vector.Reverse(vector=XAxis)
byOriginNormal_4 = Plane.ByOriginNormal(origin=byCoordinates_4, normal=reverse_2)
planeCut_4 = Autodesk.Dynamo.MeshToolkit.Mesh.PlaneCut(mesh=planeCut_3, plane=byOriginNormal_4)
code_block_13 = CodeBlock { "Generic Models"; }
byName = Category.ByName(name=code_block_13)
code_block_14 = CodeBlock { "Default"; }
code_block_15 = CodeBlock { "NLRS_90_GM_3D_BAG"; }

# group: Place Mesh as DirectShape
ꟿ_tkmesh_tomesh = Custom[ꟿ TkMesh.ToMesh](tkMesh=planeCut_4)  # package spring nodes; Attempts to convert a toolkit mesh to a Dynamo mesh. You obviously need to have the appropriate version of the mesh toolkit package downloaded first.
byName_2 = Material.ByName(name=code_block_14)
byMesh = DirectShape.ByMesh(mesh=ꟿ_tkmesh_tomesh, category=byName, material=byName_2, name=code_block_15)
