# Dynamo graph GIS2x_4.2 AHN3 Toposurface.dyn (Dynamo 2.3.0.5885)
# packages: GIS2BIM for Dynamo 2.x 0.11.10

code_block = CodeBlock()
# ---------- code_block.designscript (2 lines) ----------
//number of pixels Geotiff
"200";
# ----------------------------------------
code_block_2 = CodeBlock { "28992"; }
GIS2BIM_GetRevitSiteLocation = Custom[GIS2BIM_GetRevitSiteLocation]()  # package GIS2BIM for Dynamo 2.x; Gets the properties of the current Site Location of the active Revit Project
toNumber = String.ToNumber(str=GIS2BIM_GetRevitSiteLocation.Lon)
toNumber_2 = String.ToNumber(str=GIS2BIM_GetRevitSiteLocation.Lat)
GIS2BIM_TransformCRS_epsg = Custom[GIS2BIM_TransformCRS_epsg](TargetCRS=code_block_2, xCoordinate=toNumber, yCoordinate=toNumber_2)  # package GIS2BIM for Dynamo 2.x; Uses the API of http://epsg.io to transform Coordinate Reference Systems
afmeting_boundingbox_in_meters = IntegerSlider(400, range=100..1000 step 1)  # "Afmeting boundingbox in meters(breedte, hoogte)"; graph input
resolutie_geotiff = IntegerSlider(200, range=100..300 step 1)  # graph input
string_from_object = FromObject(obj=resolutie_geotiff)
opvulhoogte_leeg_vlak_in_meters = IntegerSlider(-1, range=-30..300 step 1)  # "Opvulhoogte leeg vlak in meters NAP"; graph input

# group: Bepaal bestandsnaam
current = Document.Current()
filePath = Document.FilePath(document=current)
code_block_3 = CodeBlock { ".rvt"; "AHN3points.tiff"; }
replace = String.Replace(str=filePath, searchFor=code_block_3.out0, replaceWith=code_block_3.out1)

code_block_4 = CodeBlock()
# ---------- code_block_4.designscript (10 lines) ----------
//CHOOSE AHN-LAYER

//maaiveld resolutie 0.5 m
"ahn3_05m_dtm";
//maaiveld+bomen+gebouwen enz. resolutie 0.5 m
"ahn3_05m_dsm";
//maaiveld resolutie 5 m
"ahn3_5m_dtm";
//maaiveld+bomen+gebouwen enz. resolutie 5 m
"ahn3_5m_dsm";
# ----------------------------------------
GIS2BIM_AHN3toPoints = Custom[GIS2BIM_AHN3toPoints](RdX=GIS2BIM_TransformCRS_epsg.Xtransformed, RdY=GIS2BIM_TransformCRS_epsg.Ytransformed, BoundinxboxWidth=afmeting_boundingbox_in_meters, ResolutionGeotiff=string_from_object, WaterlevelHeight=opvulhoogte_leeg_vlak_in_meters, FilepathName=replace, Layer=code_block_4.out0)  # package GIS2BIM for Dynamo 2.x; Load AHN3 via Geotiff WCS. Transform to local coordinates
isNull = Object.IsNull(obj=GIS2BIM_AHN3toPoints.PointsSurface)
filterByBoolMask = List.FilterByBoolMask(list=GIS2BIM_AHN3toPoints.PointsSurface, mask=isNull)
flatten = List.Flatten(list=filterByBoolMask.out)
reductie_aantal_punten_in = IntegerSlider(10, range=1..20 step 1)  # "Reductie aantal punten in watervlak"; graph input

# group: Reduceer aantal punten zonder hoogtedata ten behoeve van snelheid
isNull_2 = Object.IsNull(obj=GIS2BIM_AHN3toPoints.PointsNoElevationData)
filterByBoolMask_2 = List.FilterByBoolMask(list=GIS2BIM_AHN3toPoints.PointsNoElevationData, mask=isNull_2)
flatten_2 = List.Flatten(list=filterByBoolMask_2.out)
code_block_5 = CodeBlock { 5; }
takeEveryNthItem = List.TakeEveryNthItem(list=flatten_2, n=reductie_aantal_punten_in, offset=code_block_5)

# group: Maak BAG-solids ten behoeve van filtering points onder gebouwen
GIS2BIM_CreateBoundingBox = Custom[GIS2BIM_CreateBoundingBox](CoordinateX=GIS2BIM_TransformCRS_epsg.Xtransformed, CoordinateY=GIS2BIM_TransformCRS_epsg.Ytransformed, BoxWidth=afmeting_boundingbox_in_meters, BoxHeight=afmeting_boundingbox_in_meters)  # package GIS2BIM for Dynamo 2.x; create boundingboxstring for webrequests based on coördinates and dimensions
GIS2BIM_NetherlandsGeoservicesLibrary = Custom[GIS2BIM_NetherlandsGeoservicesLibrary](BoundingBoxEPSG28992=GIS2BIM_CreateBoundingBox.Boxstring)  # package GIS2BIM for Dynamo 2.x; Library with multiple webadresses which can be used for WFS and WMS webrequests
web_request = WebRequest(url=GIS2BIM_NetherlandsGeoservicesLibrary.4_bag_pand_OGC_WFS)
GIS2BIM_CreatePointsPolygonFromGMLxyz = Custom[GIS2BIM_CreatePointsPolygonFromGMLxyz](XML=web_request, DeltaX=GIS2BIM_TransformCRS_epsg.Xtransformed, DeltaY=GIS2BIM_TransformCRS_epsg.Ytransformed)  # package GIS2BIM for Dynamo 2.x; Create points and polygons from a xml/gml-file with x,y and z value
byPatch = Surface.ByPatch(closedCurve=GIS2BIM_CreatePointsPolygonFromGMLxyz.PolyCurves)
code_block_6 = CodeBlock { 50000; }
thicken = Surface.Thicken(surface=byPatch, thickness=code_block_6)
byUnion = Solid.ByUnion(solids=thicken)

doesIntersect = Geometry.DoesIntersect(geometry=byUnion, other=takeEveryNthItem)
filterByBoolMask_3 = List.FilterByBoolMask(list=takeEveryNthItem, mask=doesIntersect)
join = List.Join(list0=flatten, list1=filterByBoolMask_3.out)
byPoints = Topography.ByPoints(points=join)
code_block_7 = CodeBlock { "Material"; }
code_block_8 = CodeBlock { "materialname_toposurface"; }
GIS2BIM_CompanySettings = Custom[GIS2BIM_CompanySettings](SearchSetting=code_block_8)  # package GIS2BIM for Dynamo 2.x; GIS2BIM Company Settings
byName = Material.ByName(name=GIS2BIM_CompanySettings.Setting)
setParameterByName = Element.SetParameterByName(element=byPoints, parameterName=code_block_7, value=byName)
GIS2BIM_SetMaterialAppearanceTextureGene = Custom[GIS2BIM_SetMaterialAppearanceTextureGeneric](Material=byName)  # package GIS2BIM for Dynamo 2.x; Change the values of the texture of the appearanceasset of a Revit Material of the type 'generic'; unwired: TextureFilelocation, TextureOffsetX, TextureOffsetY, TextureSizeXMM, TextureSizeYMM, LockScale, RotationAngle
code_block_9 = CodeBlock { ".rvt"; "luchtfoto.jpg"; }
replace_2 = String.Replace(str=filePath, searchFor=code_block_9.out0, replaceWith=code_block_9.out1)
GIS2BIM_WebrequestWMS = Custom[GIS2BIM_WebrequestWMS](WMSwebrequest=GIS2BIM_NetherlandsGeoservicesLibrary.luchtfoto_2018_OGC_WMS)  # package GIS2BIM for Dynamo 2.x; a webrequest based on WMS-protocol
boolean = BoolSelector(true)
boolean_2 = BoolSelector(true)
code_block_10 = CodeBlock { 0; }
GIS2BIM_ImageRotateFlip = Custom[GIS2BIM_ImageRotateFlip](image=GIS2BIM_WebrequestWMS, FlipX=boolean, FlipY=boolean_2, RotationFlip=code_block_10)  # package GIS2BIM for Dynamo 2.x; Rotate and/or flip a bitmap/image
writeToFile = Image.WriteToFile(path=replace_2, image=GIS2BIM_ImageRotateFlip.image)
watch_image = WatchImageCore(image=GIS2BIM_ImageRotateFlip.image)
