# Dynamo graph GIS2x_4.3 Set Material Toposurface.dyn (Dynamo 2.5.0.7460)
# packages: GIS2BIM for Dynamo 2.x 0.11.10, GIS2BIM for Dynamo 2.x 0.11.15, Clockwork for Dynamo 2.x 2.1.2

GIS2BIM_SetMaterialAppearanceTextureGene = Custom[GIS2BIM_SetMaterialAppearanceTextureGeneric]()  # package GIS2BIM for Dynamo 2.x; Change the values of the texture of the appearanceasset of a Revit Material of the type 'generic'; unwired: Material, TextureFilelocation, TextureOffsetX, TextureOffsetY, TextureSizeXMM, TextureSizeYMM, LockScale, RotationAngle

# group: Bepaal bestandsnaam
current = Document.Current()
filePath = Document.FilePath(document=current)
code_block = CodeBlock { ".rvt"; "luchtfoto.jpg"; }
replace = String.Replace(str=filePath, searchFor=code_block.out0, replaceWith=code_block.out1)

code_block_2 = CodeBlock { "28992"; }
GIS2BIM_GetRevitSiteLocation = Custom[GIS2BIM_GetRevitSiteLocation]()  # package GIS2BIM for Dynamo 2.x; Gets the properties of the current Site Location of the active Revit Project
toNumber = String.ToNumber(str=GIS2BIM_GetRevitSiteLocation.Lon)
toNumber_2 = String.ToNumber(str=GIS2BIM_GetRevitSiteLocation.Lat)
GIS2BIM_TransformCRS_epsg = Custom[GIS2BIM_TransformCRS_epsg](TargetCRS=code_block_2, xCoordinate=toNumber, yCoordinate=toNumber_2)  # package GIS2BIM for Dynamo 2.x; Uses the API of http://epsg.io to transform Coordinate Reference Systems
afmeting_boundingbox_in_meters = IntegerSlider(400, range=100..1000 step 1)  # "Afmeting boundingbox in meters(breedte, hoogte)"; graph input
GIS2BIM_CreateBoundingBox = Custom[GIS2BIM_CreateBoundingBox](CoordinateX=GIS2BIM_TransformCRS_epsg.Xtransformed, CoordinateY=GIS2BIM_TransformCRS_epsg.Ytransformed, BoxWidth=afmeting_boundingbox_in_meters, BoxHeight=afmeting_boundingbox_in_meters)  # package GIS2BIM for Dynamo 2.x; create boundingboxstring for webrequests based on coördinates and dimensions
GIS2BIM_NetherlandsGeoservicesLibrary = Custom[GIS2BIM_NetherlandsGeoservicesLibrary](BoundingBoxEPSG28992=GIS2BIM_CreateBoundingBox.Boxstring)  # package GIS2BIM for Dynamo 2.x; Library with multiple webadresses which can be used for WFS and WMS webrequests
GIS2BIM_WebrequestWMS = Custom[GIS2BIM_WebrequestWMS](WMSwebrequest=GIS2BIM_NetherlandsGeoservicesLibrary.luchtfoto_2019_OGC_WMS)  # package GIS2BIM for Dynamo 2.x; a webrequest based on WMS-protocol
boolean = BoolSelector(true)
boolean_2 = BoolSelector(false)
code_block_3 = CodeBlock { 90; }
GIS2BIM_ImageRotateFlip = Custom[GIS2BIM_ImageRotateFlip](image=GIS2BIM_WebrequestWMS, FlipX=boolean, FlipY=boolean_2, RotationFlip=code_block_3)  # package GIS2BIM for Dynamo 2.x; Rotate and/or flip a bitmap/image
writeToFile = Image.WriteToFile(path=replace, image=GIS2BIM_ImageRotateFlip.image)
watch_image = WatchImageCore(image=GIS2BIM_ImageRotateFlip.image)
watch_image_2 = WatchImageCore(image=GIS2BIM_WebrequestWMS)
code_block_4 = CodeBlock { 1; }
sendTo = Custom[Clipboard.SendTo](str=replace)  # package Clockwork for Dynamo 2.x; Copies a string to the clipboard.
code_block_5 = CodeBlock { "materialname_toposurface"; }
GIS2BIM_CompanySettings = Custom[GIS2BIM_CompanySettings](SearchSetting=code_block_5)  # package GIS2BIM for Dynamo 2.x; GIS2BIM Company Settings
byName = Material.ByName(name=GIS2BIM_CompanySettings.Setting)
string = StringInput("\")
string_2 = StringInput("/")
replace_2 = String.Replace(str=replace, searchFor=string, replaceWith=string_2)
code_block_6 = CodeBlock(b=afmeting_boundingbox_in_meters, h=afmeting_boundingbox_in_meters) { 0; 0; b*1000; h*1000; 90; }
boolean_3 = BoolSelector(true)
python_script = Python(IN[0]=byName, IN[1]=replace_2, IN[2]=code_block_6.out0, IN[3]=code_block_6.out1, IN[4]=code_block_6.out2, IN[5]=code_block_6.out3, IN[6]=boolean_3, IN[7]=code_block_6.out4)
# ---------- python_script.python (55 lines) ----------
import clr
clr.AddReference("RevitNodes")
import Revit
clr.ImportExtensions(Revit.Elements)
clr.AddReference("RevitAPI")
import Autodesk
from Autodesk.Revit.DB import *
from Autodesk.Revit.DB.Visual import *

clr.AddReference("RevitServices")
import RevitServices
from RevitServices.Persistence import DocumentManager
from RevitServices.Transactions import TransactionManager

doc = DocumentManager.Instance.CurrentDBDocument

import sys

pyt_path = 'C:\Program Files (x86)\IronPython 2.7\Lib'
sys.path.append(pyt_path)

mat1= IN[0]
var1 = IN[1]
offsetX1 = IN[2]
offsetY1 = IN[3]
scaleX1 = IN[4]
scaleY1 = IN[5]
lockScale = IN[6]
angle = IN[7]

offsetX = offsetX1/25.4
offsetY = offsetY1/25.4
scaleX = scaleX1/25.4
scaleY = scaleY1/25.4

mat = UnwrapElement(mat1)
doc = DocumentManager.Instance.CurrentDBDocument

AppearanceAsset = doc.GetElement(mat.AppearanceAssetId)
RenderingAsset = AppearanceAsset.GetRenderingAsset()
AppearanceAssetid =AppearanceAsset.Id

TransactionManager.Instance.EnsureInTransaction(doc)

editScope = AppearanceAssetEditScope(doc)
AssetEditable = editScope.Start(AppearanceAssetid)

Scalelock = AssetEditable[UnifiedBitmap.TextureScaleLock]
Scalelock.Value = lockScale

editScope.Commit(IFailuresPreprocessor)

TransactionManager.Instance.TransactionTaskDone()

OUT = mat1
# ----------------------------------------
