# Dynamo graph GIS2x_4.3 Toposurface set Material.dyn (Dynamo 2.10.1.3976)
# packages: GIS2BIM for Dynamo 2.x 0.11.24, Genius Loci 2020.11.8, Clockwork for Dynamo 2.x 2.3.0

code_block = CodeBlock { "28992"; }
GIS2BIM_GetRevitSiteLocation = Custom[GIS2BIM_GetRevitSiteLocation]()  # package GIS2BIM for Dynamo 2.x; Gets the properties of the current Site Location of the active Revit Project
toNumber = String.ToNumber(str=GIS2BIM_GetRevitSiteLocation.Lon)
toNumber_2 = String.ToNumber(str=GIS2BIM_GetRevitSiteLocation.Lat)
GIS2BIM_TransformCRS_epsg = Custom[GIS2BIM_TransformCRS_epsg](TargetCRS=code_block, xCoordinate=toNumber, yCoordinate=toNumber_2)  # package GIS2BIM for Dynamo 2.x; Uses the API of http://epsg.io to transform Coordinate Reference Systems
afmeting_boundingbox_in_meters = IntegerSlider(400, range=100..400000 step 1)  # "Afmeting boundingbox in meters(breedte, hoogte)"; graph input
GIS2BIM_CreateBoundingBox = Custom[GIS2BIM_CreateBoundingBox](CoordinateX=GIS2BIM_TransformCRS_epsg.Xtransformed, CoordinateY=GIS2BIM_TransformCRS_epsg.Ytransformed, BoxWidth=afmeting_boundingbox_in_meters, BoxHeight=afmeting_boundingbox_in_meters)  # package GIS2BIM for Dynamo 2.x; create boundingboxstring for webrequests based on coördinates and dimensions
GIS2BIM_NetherlandsGeoservicesLibrary = Custom[GIS2BIM_NetherlandsGeoservicesLibrary](BoundingBoxEPSG28992=GIS2BIM_CreateBoundingBox.Boxstring)  # package GIS2BIM for Dynamo 2.x; Library with multiple webadresses which can be used for WFS and WMS webrequests
GIS2BIM_WebrequestWMS = Custom[GIS2BIM_WebrequestWMS](WMSwebrequest=GIS2BIM_NetherlandsGeoservicesLibrary.luchtfoto_2020_OGC_WMS)  # package GIS2BIM for Dynamo 2.x; a webrequest based on WMS-protocol
watch_image = WatchImageCore(image=GIS2BIM_WebrequestWMS)
code_block_2 = CodeBlock()
# ---------- code_block_2.designscript (2 lines) ----------
//materiaalname
0;
# ----------------------------------------
select_model_element = DSModelElementSelection()  # 1 picked in the model; graph input
code_block_3 = CodeBlock { "Material"; }
string = StringInput("GIS2BIM_AHN14")  # graph input
byName = Material.ByName(name=string)
code_block_4 = CodeBlock { null; }
eq = byName == code_block_4
code_block_5 = CodeBlock { null; }
material_create = Custom[Material Create](document=code_block_5, Name=string)  # package Genius Loci; Create new materials or overwrite properties of existing materials. (All graphics inputs are optional)
if_ = If(test=eq, true=material_create, false=byName)
code_block_6 = CodeBlock { null; }
appearanceasset_create = Custom[AppearanceAsset Create](document=code_block_6, Name=string)  # package Genius Loci; Works only in Revit 2018.1 and later. Create an AppearanceAsset by duplicating an existing rendering asset. Please note : The asset will be duplicated with all its properties (category, color, image...) For use with the AppearanceAsset Schema node.
material_set_appearanceasset = Custom[Material Set AppearanceAsset](material=if_, appearanceAsset=appearanceasset_create)  # package Genius Loci; Set the AppearanceAsset Element of the given material.
code_block_7 = CodeBlock { null; }
eq_2 = material_set_appearanceasset == code_block_7
if_2 = If(test=eq_2, true=if_, false=material_set_appearanceasset)

# group: Bepaal actieve view & bestandsnaam
current = Document.Current()
filePath = Document.FilePath(document=current)
code_block_8 = CodeBlock { ".rvt"; "_luchtfoto2020_"; ".jpg"; }

concat = String.Concat(string0=code_block_8.out1, string1=string, string2=code_block_8.out2)

# group (continued): Bepaal actieve view & bestandsnaam
replace = String.Replace(string=filePath, searchFor=code_block_8.out0, replaceWith=concat)

# group: Afbeelding inladen
writeToFile = Image.WriteToFile(path=replace, image=GIS2BIM_WebrequestWMS)

passthrough = Custom[Passthrough](passThrough=if_2, waitFor=writeToFile)  # package Clockwork for Dynamo 2.x; Forces a sequential order of execution. The node wired into the output of the Passthrough node will be executed *after* the node wired into the waitFor input (e.g. important for some Revit operations). The value of the passThrough input will be passed on to the node wired into the output port of the Passthrough node.
string_2 = StringInput("\")
string_3 = StringInput("/")
replace_2 = String.Replace(string=replace, searchFor=string_2, replaceWith=string_3)
passthrough_2 = Custom[Passthrough](passThrough=replace_2, waitFor=writeToFile)
code_block_9 = CodeBlock(b=afmeting_boundingbox_in_meters) { 0; b*(4000000000/131233.6); }
code_block_10 = CodeBlock { 0; }
boolean = BoolSelector(true)
material_change_image_and_edit = Custom[Material Change Image and Edit it](material=passthrough, filePath=passthrough_2, Offset_X=code_block_9.out0, Offset_Y=code_block_9.out0, Rotation=code_block_10, Scale_Widht=code_block_9.out1, Scale_Height=code_block_9.out1, Scale_Lock=boolean)  # package Genius Loci; Works only in Revit 2018.1 and later. The material must already have an assigned texture. Changes the image and edit its properties. (All inputs are optional)
setParameterByName = Element.SetParameterByName(element=select_model_element, parameterName=code_block_3, value=material_change_image_and_edit)
