# Dynamo graph GIS2x_4.4 KLIC.dyn (Dynamo 2.18.1.5096)

# note: tested with:
# - revit 2022.1
# - dynamo 2.12.1
# python (default) dependencies:
# -json
# -Path
# -time
# input = list of klicfiles generated with the klicviewer

string = StringInput("C:/TEMP/KLIC/json/")
directory_from_path = DirectoryObject(path=string)
getDirectoryContents = FileSystem.GetDirectoryContents(directory=directory_from_path)
code_block = CodeBlock { 103775.229; 488208.811; }
KLICToCurves = Custom[KLICToCurves](filepaths=getDirectoryContents.files, RDX=code_block.out0, RDY=code_block.out1)  # Reads the KLIC json files and filters the lines
byCurve = ModelCurve.ByCurve(curve=KLICToCurves.1_curves)
code_block_2 = CodeBlock { "Line Style"; }
getAll = Custom[GetAll]()  # Gets all Graphic Styles in the project.
byName = Custom[ByName](LineTypeName=KLICToCurves.3_LineTypeNames, LineTypeNamesInProject=getAll.01_Names, GraphicstylesInProject=getAll.02_Graphicstyles)  # Get a Graphic Style by name
setParameterByName = Element.SetParameterByName(element=byCurve@@L2, parameterName=code_block_2, value=byName@L1)
code_block_3 = CodeBlock { GIS2BIM; }  # unwired: GIS2BIM
