# Dynamo graph GIS2x_5.1 LocationAnalysis.dyn (Dynamo 2.10.1.3976)
# packages: GIS2BIM for Dynamo 2.x 0.11.24, Clockwork for Dynamo 2.x 2.3.0

afmeting_boundingbox_in_meters = IntegerSlider(400, range=100..400000 step 1)  # "Afmeting boundingbox in meters(breedte, hoogte)"; graph input

# group: Bepaal actieve view & bestandsnaam
current = Document.Current()
activeView = Document.ActiveView(document=current)
filePath = Document.FilePath(document=current)
code_block = CodeBlock { ".rvt"; "_luchtfoto2018.jpg"; }
replace = String.Replace(string=filePath, searchFor=code_block.out0, replaceWith=code_block.out1)

code_block_2 = CodeBlock { "28992"; }
GIS2BIM_GetRevitSiteLocation = Custom[GIS2BIM_GetRevitSiteLocation]()  # frozen; package GIS2BIM for Dynamo 2.x; Gets the properties of the current Site Location of the active Revit Project
toNumber = String.ToNumber(str=GIS2BIM_GetRevitSiteLocation.Lon)
toNumber_2 = String.ToNumber(str=GIS2BIM_GetRevitSiteLocation.Lat)
GIS2BIM_TransformCRS_epsg = Custom[GIS2BIM_TransformCRS_epsg](TargetCRS=code_block_2, xCoordinate=toNumber, yCoordinate=toNumber_2)  # package GIS2BIM for Dynamo 2.x; Uses the API of http://epsg.io to transform Coordinate Reference Systems
GIS2BIM_CreateBoundingBox = Custom[GIS2BIM_CreateBoundingBox](CoordinateX=GIS2BIM_TransformCRS_epsg.Xtransformed, CoordinateY=GIS2BIM_TransformCRS_epsg.Ytransformed, BoxWidth=afmeting_boundingbox_in_meters, BoxHeight=afmeting_boundingbox_in_meters)  # package GIS2BIM for Dynamo 2.x; create boundingboxstring for webrequests based on coördinates and dimensions
GIS2BIM_NetherlandsGeoservicesLibrary = Custom[GIS2BIM_NetherlandsGeoservicesLibrary](BoundingBoxEPSG28992=GIS2BIM_CreateBoundingBox.Boxstring)  # package GIS2BIM for Dynamo 2.x; Library with multiple webadresses which can be used for WFS and WMS webrequests
GIS2BIM_WebrequestWMS = Custom[GIS2BIM_WebrequestWMS](WMSwebrequest=GIS2BIM_NetherlandsGeoservicesLibrary.Geluidscontouren_alle_bronnen_OGC_WMS)  # package GIS2BIM for Dynamo 2.x; a webrequest based on WMS-protocol

# group: Afbeelding inladen
passthrough = Custom[Passthrough](passThrough=replace, waitFor=GIS2BIM_WebrequestWMS)  # frozen; package Clockwork for Dynamo 2.x; Forces a sequential order of execution. The node wired into the output of the Passthrough node will be executed *after* the node wired into the waitFor input (e.g. important for some Revit operations). The value of the passThrough input will be passed on to the node wired into the output port of the Passthrough node.
GIS2BIM_ImportImageInView = Custom[GIS2BIM_ImportImageInView](ImageWidthMeters=afmeting_boundingbox_in_meters, view=activeView, ImagePath=passthrough)  # package GIS2BIM for Dynamo 2.x; Import rasterimage in view
writeToFile = Image.WriteToFile(path=replace, image=GIS2BIM_WebrequestWMS)  # frozen

watch_image = WatchImageCore(image=GIS2BIM_WebrequestWMS)
GIS2BIM_LocationAnalysisNetherlands = Custom[GIS2BIM_LocationAnalysisNetherlands](Rdx=GIS2BIM_TransformCRS_epsg.Xtransformed, Rdy=GIS2BIM_TransformCRS_epsg.Ytransformed)  # frozen; package GIS2BIM for Dynamo 2.x; Location Analysis of a location in The Netherlands
GIS2BIM_OpenBrowser = Custom[GIS2BIM_OpenBrowser](url=GIS2BIM_NetherlandsGeoservicesLibrary.Geluidscontouren_alle_bronnen_OGC_WMS)  # package GIS2BIM for Dynamo 2.x; Opens a new window in your default browser with the given url.

# group: use Requests from GIS2BIM Folder
python_script = Python()  # CPython3
# ---------- python_script.python (13 lines) ----------
from System.Reflection import Assembly
import os

dynamo = Assembly.Load('DynamoCore')
version = str(dynamo.GetName().Version)
versionsplit = version.split(".")
version = versionsplit[0] + "." + versionsplit[1]

basepath = os.getenv('APPDATA')

pathRequests = basepath + "/Dynamo/Dynamo Revit/" + version + "/packages/GIS2BIM for Dynamo 2.x/bin"

OUT = pathRequests
# ----------------------------------------

string = StringInput("C:\Users\mikev\3BM Dropbox\Maarten Vroegindeweij\Maarten\GIS2BIM\DenHaag.json")
python_script_2 = Python(IN[0]=python_script, IN[1]=string)  # CPython3
# ---------- python_script_2.python (17 lines) ----------
import os

pathLibrary = IN[0] 
cj_path = IN[1]

#sys.path.append(pathLibrary)
sys.path.append("C:\Users\mikev\AppData\Roaming\Python\Python37\site-packages")

import cjio
import click
import numpy
from cjio import cityjson

cj_file = open(cj_path,'r')
#cm = cjio.cityjson.reader(file=cj_file)

OUT = pathLibrary
# ----------------------------------------
string_2 = StringInput("/")
string_3 = StringInput("\")
replace_2 = String.Replace(string=python_script, searchFor=string_2, replaceWith=string_3)
string_4 = StringInput("C:/TEMP/")
