# Dynamo graph GIS2BIM_GeoTIFF.dyn (Dynamo 2.2.1.5175)

watch = Watch()  # unwired: arg0
code_block = CodeBlock(t3=watch)
# ---------- code_block.designscript (7 lines) ----------
t2 = String.Split(t3, [","]);
t4 = String.ToNumber(t2);
a = t4;
b = a[2] - a[0];
h = a[3] - a[1];
bpix = 3000;
hpix = (bpix * h) / b;
# ----------------------------------------
string_from_object = FromObject(obj=code_block.hpix)
code_block_2 = CodeBlock(t5=string_from_object) { t4 = String.Split(t5, ["."]); a = t4; t6 = String.Concat(["&height=", a[0]]); }

# group: GEOCODING
code_block_3 = CodeBlock { "Hoek van Holland"; "Zeekant"; "103"; }
GIS2BIM_GetLocationdataNetherlands = Custom[GIS2BIM_GetLocationdataNetherlands](City=code_block_3.out0, Streetname=code_block_3.out1, Housenumber=code_block_3.out2)  # Gives locationdata based on an adress in the Netherlands

code_block_4 = CodeBlock()
# ---------- code_block_4.designscript (2 lines) ----------
//width boundingbox
300;
# ----------------------------------------
code_block_5 = CodeBlock()
# ---------- code_block_5.designscript (2 lines) ----------
//number of pixels Geotiff
"200";
# ----------------------------------------
code_block_6 = CodeBlock()
# ---------- code_block_6.designscript (2 lines) ----------
//temp filepath Geotiff
"C:/TEMP/test20.tiff";
# ----------------------------------------
code_block_7 = CodeBlock()
# ---------- code_block_7.designscript (10 lines) ----------
//CHOOSE AHN-LAYER

//maaiveld resolutie 0.5 m
"ahn3_05m_dtm";
//maaiveld+bomen+gebouwen enz. resolutie 0.5 m
"ahn3_05m_dsm";
//maaiveld resolutie 5 m
"ahn3_5m_dtm";
//maaiveld+bomen+gebouwen enz. resolutie 5 m
"ahn3_5m_dsm";
# ----------------------------------------
GIS2BIM_AHN3toPoints = Custom[GIS2BIM_AHN3toPoints](RdX=GIS2BIM_GetLocationdataNetherlands.RDcoordinateXmeters, RdY=GIS2BIM_GetLocationdataNetherlands.RDcoordinateYmeters, BoundinxboxWidth=code_block_4, ResolutionGeotiff=code_block_5, FilepathName=code_block_6, Layer=code_block_7.out0)  # Load AHN3 via Geotiff WCS. Transform to local coordinates
byPoints = Topography.ByPoints(points=GIS2BIM_AHN3toPoints.Points)  # frozen
mesh = Topography.Mesh(topography=byPoints)
