# Dynamo graph GIS2BIM_ImportImageInView.dyn (Dynamo 2.2.1.5175)

code_block = CodeBlock { 150; }
views = Views("Plattegrond Begane Grond")  # graph input
code_block_2 = CodeBlock { "C:/TEMP/luchtfoto.jpg"; }
GIS2BIM_ImportImageInView = Custom[GIS2BIM_ImportImageInView](ImageWidthMeters=code_block, View=views, ImagePath=code_block_2)  # Import rasterimage in view
code_block_3 = CodeBlock { "dordrecht"; "zuidendijk"; "315"; }
GIS2BIM_GetLocationdataNetherlands = Custom[GIS2BIM_GetLocationdataNetherlands](City=code_block_3.out0, Streetname=code_block_3.out1, Housenumber=code_block_3.out2)  # Gives locationdata based on an adress in the Netherlands
GIS2BIM_LocationAnalysisNetherlands = Custom[GIS2BIM_LocationAnalysisNetherlands](Rdx=GIS2BIM_GetLocationdataNetherlands.RDcoordinateXmeters, Rdy=GIS2BIM_GetLocationdataNetherlands.RDcoordinateYmeters, WidthSmallBoundingbox=code_block)  # Location Analysis of a location in The Netherlands
writeToFile = Image.WriteToFile(path=code_block_2, image=GIS2BIM_LocationAnalysisNetherlands.WMS_Small_Luchtfoto_2016)
