# Dynamo graph GIS2BIM_LocationAnalysisNetherlands.dyn (Dynamo 2.2.1.5175)

code_block = CodeBlock { "dordrecht"; "lange geldersekade"; "2"; }

# group: 2. GEOCODING/COORDINATE REFERENCE SYSTEM
GIS2BIM_GetLocationdataNetherlands = Custom[GIS2BIM_GetLocationdataNetherlands](City=code_block.out0, Streetname=code_block.out1, Housenumber=code_block.out2)  # Gives locationdata based on an adress in the Netherlands

code_block_2 = CodeBlock { 150; }
GIS2BIM_LocationAnalysisNetherlands = Custom[GIS2BIM_LocationAnalysisNetherlands](Rdx=GIS2BIM_GetLocationdataNetherlands.RDcoordinateXmeters, Rdy=GIS2BIM_GetLocationdataNetherlands.RDcoordinateYmeters, WidthSmallBoundingbox=code_block_2)  # Location Analysis of a location in The Netherlands
watch_image = WatchImageCore(image=GIS2BIM_LocationAnalysisNetherlands.WMTS_Opentopo_Medium)
watch_image_2 = WatchImageCore(image=GIS2BIM_LocationAnalysisNetherlands.WMTS_Opentopo_Large)
watch_image_3 = WatchImageCore(image=GIS2BIM_LocationAnalysisNetherlands.WMTS_BGT_Small)
watch_image_4 = WatchImageCore(image=GIS2BIM_LocationAnalysisNetherlands.WMTS_AHN3_Small)
watch_image_5 = WatchImageCore(image=GIS2BIM_LocationAnalysisNetherlands.WMTS_geomorfologischekaart50000)
watch_image_6 = WatchImageCore(image=GIS2BIM_LocationAnalysisNetherlands.WMTS_bodemkaart50000)
watch_image_7 = WatchImageCore(image=GIS2BIM_LocationAnalysisNetherlands.WMTS_natura2000)
watch_image_8 = WatchImageCore(image=GIS2BIM_LocationAnalysisNetherlands.WMS_Small_Luchtfoto_2016)
watch_image_9 = WatchImageCore(image=GIS2BIM_LocationAnalysisNetherlands.WMS_Small_Luchtfoto_2017)
watch_image_10 = WatchImageCore(image=GIS2BIM_LocationAnalysisNetherlands.WMS_Small_Luchtfoto_2018)
watch_image_11 = WatchImageCore(image=GIS2BIM_LocationAnalysisNetherlands.WMS_Geluidskaart_alle_bronnen)
watch_image_12 = WatchImageCore(image=GIS2BIM_LocationAnalysisNetherlands.WMS_Bestemmingsplan_bouwvlak)
watch_image_13 = WatchImageCore(image=GIS2BIM_LocationAnalysisNetherlands.WMTS_Opentopo_Small)
watch_image_14 = WatchImageCore(image=GIS2BIM_LocationAnalysisNetherlands.WMTS_Kadaster_Small)
create = List.Create(item0=watch_image_13, item1=watch_image_14)
GIS2BIM_MergeImages = Custom[GIS2BIM_MergeImages](images=create)  # Merges a list of images to 1 image
watch_image_15 = WatchImageCore(image=GIS2BIM_MergeImages)
watch_image_16 = WatchImageCore(image=GIS2BIM_LocationAnalysisNetherlands.WMS_Bestemmingsplankaart)
watch_image_17 = WatchImageCore(image=GIS2BIM_LocationAnalysisNetherlands.WMS_CBS_WOZ_waarde_2011)
watch_image_18 = WatchImageCore(image=GIS2BIM_LocationAnalysisNetherlands.WMS_CBS_WOZ_waarde_2011_Legenda)
