# Dynamo graph GIS2BIM_WebMapService.dyn (Dynamo 2.2.1.5175)

code_block = CodeBlock { "4326"; }
code_block_2 = CodeBlock { "31370"; }
code_block_3 = CodeBlock { "Grootkanonplein"; "2"; "Gent"; "Belgium"; }
GIS2BIM_GeocodingNominatimAPI = Custom[GIS2BIM_GeocodingNominatimAPI](Streetname=code_block_3.out0, Housenumber=code_block_3.out1, Place=code_block_3.out2, Country=code_block_3.out3)  # gets WGS-84 coordinate from address with Open Streets Maps API
GIS2BIM_TransformCRS_epsg = Custom[GIS2BIM_TransformCRS_epsg](SourceCRS=code_block, TargetCRS=code_block_2, xCoordinate=GIS2BIM_GeocodingNominatimAPI.Longitude, yCoordinate=GIS2BIM_GeocodingNominatimAPI.Latitude)  # Uses the API of http://epsg.io to transform Coordinate Reference Systems
boundingboxWidth = CodeBlock { 400; }
GIS2BIM_CreateBoundingBox = Custom[GIS2BIM_CreateBoundingBox](CoordinateX=GIS2BIM_TransformCRS_epsg.Xtransformed, CoordinateY=GIS2BIM_TransformCRS_epsg.Ytransformed, BoxWidth=boundingboxWidth, BoxHeight=boundingboxWidth)  # create boundingboxstring for webrequests based on coördinates and dimensions
GIS2BIM_BelgiumGeoservicesLibrary = Custom[GIS2BIM_BelgiumGeoservicesLibrary](BoundingboxString=GIS2BIM_CreateBoundingBox.Boxstring)  # Geoserviceslibrary in Belgium
GIS2BIM_WebrequestWMS = Custom[GIS2BIM_WebrequestWMS](WMSwebrequest=GIS2BIM_BelgiumGeoservicesLibrary.AerialPhoto_OGWRGB13_15VL_OGC_WMS)  # a webrequest based on WMS-protocol
watch_image = WatchImageCore(image=GIS2BIM_WebrequestWMS)
GIS2BIM_SearchCRS = Custom[GIS2BIM_SearchCRS](EPSG_Code=code_block_2)  # Search for a Coordinate Reference System
