# Dynamo graph sandbox.dyn (Dynamo 1.3.1.1736)

code_block = CodeBlock()
# ---------- code_block.designscript (1 lines) ----------
http://services.rce.geovoorziening.nl/rce/wfs?&request=GetCapabilities&service=WFS
# ----------------------------------------

# group: TEXT ANNOTATIE
boolean = BoolSelector(false)
kadaster = Custom[GIStoBIM.Kadaster](PercelenaAnnotatie=boolean)  # Draw propertylines and place streetnames and housenumbers from the dutch kadaster; unwired: UrlWebrequestKadastraleAnnotatie, deltaX, deltaY, view, TextTypeHousenumber, TextTypeStreetname, TextTypePerceel, UrlWebrequestKadastraleGrenzen

views = Views("Situation")
code_block_2 = CodeBlock { "Zwartsluis"; "De Velde"; "8"; }
getLocationdataNetherlands = Custom[GIStoBIM.GetLocationdataNetherlands](city=code_block_2.out0, streetname=code_block_2.out1, housenumber=code_block_2.out2)  # Gives locationdata based on an adress in the Netherlands
code_block_3 = CodeBlock { 200; }
createBoundingBox = Custom[GIStoBIM.CreateBoundingBox](coordinateX=getLocationdataNetherlands.RDcoordinate_X_meters, coordinateY=getLocationdataNetherlands.RDcoordinate_Y_meters, boxWidth=code_block_3, boxHeight=code_block_3)  # create boundingboxstring for webrequests based on coördinates and dimensions
geoservicesLibraryNetherlands = Custom[GIStoBIM.GeoservicesLibraryNetherlands](BoundingBox=createBoundingBox)  # Library with multiple webadresses which can be used for WFS and WMS webrequests
code_block_4 = CodeBlock { "kadastrale_grens"; }

# group: KADASTRALE PERCELEN(GRENZEN)
web_request = WebRequest(geoservicesLibraryNetherlands.8_kadastrale_perceel)
code_block_5 = CodeBlock { "gml:posList"; }
createPointsPolygonFromGMLxy = Custom[GIStoBIM.CreatePointsPolygonFromGMLxy](xml=web_request, xmltagname=code_block_5, deltaX=getLocationdataNetherlands.RDcoordinate_X_meters, deltaY=getLocationdataNetherlands.RDcoordinate_Y_meters)  # Create point and polygons from a GML-file
createDetailLinesFromPolygons = Custom[GIStoBIM.CreateDetailLinesFromPolygons](view=views, polyCurves=createPointsPolygonFromGMLxy.PolyCurves, linestyle=code_block_4)  # Create detaillines from polygons in a view

string = StringInput("pen rood")

# group: BAG: pand
web_request_2 = WebRequest(geoservicesLibraryNetherlands.4_bag_pand_WFS)
code_block_6 = CodeBlock { "gml:posList"; }
boolean_2 = BoolSelector(true)
createPointsPolygonFromGMLxyz = Custom[GIStoBIM.CreatePointsPolygonFromGMLxyz](xml=web_request_2, xmltagname=code_block_6, deltaX=getLocationdataNetherlands.RDcoordinate_X_meters, deltaY=getLocationdataNetherlands.RDcoordinate_Y_meters, connectpolygon=boolean_2)  # Create points and polygons from a xml/gml-file with x,y and z value
createDetailLinesFromPolygons_2 = Custom[GIStoBIM.CreateDetailLinesFromPolygons](view=views, polyCurves=createPointsPolygonFromGMLxyz.PolyCurves, linestyle=string)

code_block_7 = CodeBlock(view=views) { view: Revit.View; }
code_block_8 = CodeBlock(UrlWebrequestKadastraleAnnotatie=geoservicesLibraryNetherlands.7_kadastrale_annotatie) { UrlWebrequestKadastraleAnnotatie; }
web_request_3 = WebRequest(code_block_8)
code_block_9 = CodeBlock(deltaX=getLocationdataNetherlands.RDcoordinate_X_meters)
# ---------- code_block_9.designscript (2 lines) ----------
//X-value of transformation of points and polygons
deltaX;
# ----------------------------------------
code_block_10 = CodeBlock(deltaY=getLocationdataNetherlands.RDcoordinate_Y_meters)
# ---------- code_block_10.designscript (2 lines) ----------
//Y-value of transformation of points and polygons
deltaY;
# ----------------------------------------
createPointFromGML = Custom[GIStoBIM.CreatePointFromGML](XML=web_request_3, modX=code_block_9, modY=code_block_10)  # Create Points from space seperated GML

# group: GET DATA FROM XML FOR HOUSENUMBER AND STREETNAME
code_block_11 = CodeBlock { "kadastralekaartv3:classificatiecode"; }
getXMLNode = Lists.DataSets.GetXMLNode(web_request_3, code_block_11)
flatten = Flatten(getXMLNode)
code_block_12 = CodeBlock { "kadastralekaartv3:tekst"; }
getXMLNode_2 = Lists.DataSets.GetXMLNode(web_request_3, code_block_12)
flatten_2 = Flatten(getXMLNode_2)
code_block_13 = CodeBlock { "kadastralekaartv3:rotatiehoek"; }
getXMLNode_3 = Lists.DataSets.GetXMLNode(web_request_3, code_block_13)
flatten_3 = Flatten(getXMLNode_3)

code_block_14 = CodeBlock { "2.5 mm"; "3.5 mm"; "2.5 mm zwart"; }
code_block_15 = CodeBlock(TextTypeHousenumber=code_block_14.out0) { TextTypeHousenumber; }
byName = TextNoteType.ByName(code_block_15)

# group: PLACE TEXTNOTE FOR HOUSENUMBER
string_2 = StringInput("Z02")
eq = string_2 == flatten
filterByBoolMask = List.FilterByBoolMask(list=flatten_2, mask=eq)
flatten_4 = Flatten(filterByBoolMask.in)
string_3 = StringInput("Center")

code_block_16 = CodeBlock(TextTypeStreetname=code_block_14.out1) { TextTypeStreetname; }
byName_2 = TextNoteType.ByName(code_block_16)

# group: PLACE TEXTNOTE FOR STREETNAME
filterByBoolMask_2 = List.FilterByBoolMask(list=createPointFromGML, mask=eq)
filterByBoolMask_3 = List.FilterByBoolMask(list=flatten_3, mask=eq)
flatten_5 = Flatten(filterByBoolMask_2.out)
flatten_6 = Flatten(filterByBoolMask.out)
boolean_3 = BoolSelector(true)
changeCase = String.ChangeCase(flatten_6, boolean_3)
string_4 = StringInput("Center")
flatten_7 = Flatten(filterByBoolMask_3.out)
toNumber = String.ToNumber(flatten_7)
byLocation = TextNote.ByLocation(view=code_block_7, location=flatten_5, text=changeCase, alignment=string_4, type=byName_2, rotation=toNumber)

# group (continued): PLACE TEXTNOTE FOR HOUSENUMBER
flatten_8 = Flatten(filterByBoolMask_2.in)
flatten_9 = Flatten(filterByBoolMask_3.in)
toNumber_2 = String.ToNumber(flatten_9)
byLocation_2 = TextNote.ByLocation(view=code_block_7, location=flatten_8, text=flatten_4, alignment=string_3, type=byName, rotation=toNumber_2)

code_block_17 = CodeBlock(UrlWebrequestKadastraleGrenzen=geoservicesLibraryNetherlands.8_kadastrale_perceel) { UrlWebrequestKadastraleGrenzen; }
code_block_18 = CodeBlock(TextTypePerceel=code_block_14.out2) { TextTypePerceel; }

# group: PLACE TEXTNOTE FOR KADASTRAAL PERCEEL
web_request_4 = WebRequest(code_block_17)
code_block_19 = CodeBlock { "gml:pos"; }
code_block_20 = CodeBlock { "kadastralekaartv3:perceelnummer_deltax"; }
getXMLNode_4 = Lists.DataSets.GetXMLNode(web_request_4, code_block_20)
flatten_10 = Flatten(getXMLNode_4)
toNumber_3 = String.ToNumber(flatten_10)
add = code_block_9 + toNumber_3
code_block_21 = CodeBlock { "kadastralekaartv3:perceelnummer_deltay"; }
getXMLNode_5 = Lists.DataSets.GetXMLNode(web_request_4, code_block_21)
flatten_11 = Flatten(getXMLNode_5)
toNumber_4 = String.ToNumber(flatten_11)
add_2 = code_block_10 + toNumber_4
createPointFromGML_2 = Custom[GIStoBIM.CreatePointFromGML](XML=web_request_4, Tagname=code_block_19, modX=add, modY=add_2)
code_block_22 = CodeBlock { "kadastralekaartv3:perceelnummer"; }
getXMLNode_6 = Lists.DataSets.GetXMLNode(web_request_4, code_block_22)
flatten_12 = Flatten(getXMLNode_6)
string_5 = StringInput("Center")
byName_3 = TextNoteType.ByName(code_block_18)
code_block_23 = CodeBlock { "kadastralekaartv3:perceelnummer_rotatie"; }
getXMLNode_7 = Lists.DataSets.GetXMLNode(web_request_4, code_block_23)
flatten_13 = Flatten(getXMLNode_7)
flatten_14 = Flatten(flatten_13)
toNumber_5 = String.ToNumber(flatten_14)
byLocation_3 = TextNote.ByLocation(view=code_block_7, location=createPointFromGML_2, text=flatten_12, alignment=string_5, type=byName_3, rotation=toNumber_5)

code_block_24 = CodeBlock { "C:/TEMP/"; }
code_block_25 = CodeBlock { "luchtfoto3"; }
webrequestWMS = Custom[GIStoBIM.WebrequestWMS](WMSwebrequest=geoservicesLibraryNetherlands.5_luchtfoto_2016_WMS, boundingboxwidth=code_block_3, view=views, tempfolder=code_block_24, filename=code_block_25)  # imports the result(image) of a webrequest based on WMS-protocol into a view in Revit
watch_image = WatchImageCore(webrequestWMS)
