# Dynamo graph sandboxBGT.dyn (Dynamo 1.3.1.1736)

code_block = CodeBlock { "Dordrecht"; "lange geldersekade"; "2"; }
getLocationdataNetherlands = Custom[GIStoBIM.GetLocationdataNetherlands](city=code_block.out0, streetname=code_block.out1, housenumber=code_block.out2)  # Gives locationdata based on an adress in the Netherlands
getMortonCodeCoordinate = Custom[GIStoBIM.GetMortonCodeCoordinate](X=getLocationdataNetherlands.RDcoordinate_X_meters, Y=getLocationdataNetherlands.RDcoordinate_Y_meters)  # Get mortoncode given 2 coordinates and tiledimension
string = StringInput("C:\TEMP")
downloadBGTdata = Custom[GIStoBIM.DownloadBGTdata](mortoncode=getMortonCodeCoordinate, directory=string)  # Download BGT-data(dutch GIS-information)
string_2 = StringInput("\")
python_script = Python()  # unwired: IN[0]
# ---------- python_script.python (21 lines) ----------
#Copyright(c) 2016, Dimitar Venkov
# @5devene, dimitar.ven@gmail.com

import clr

def tolist(obj1):
	if hasattr(obj1,"__iter__"): return obj1
	else: return [obj1]

def output1(l1):
	if len(l1) == 1: return l1[0]
	else: return l1

num1 = tolist(IN[0])
out1 = []
for i in xrange(len(num1)):
	s1 = str(num1[i])
	if s1[-2:] == ".0": out1.append(s1[:-2])
	else: out1.append(s1)

OUT = output1(out1)
# ----------------------------------------
concat = String.Concat(string, string_2, python_script)
unzipFile = Custom[GIStoBIM.UnzipFile](FilePathZipFile=downloadBGTdata, DirectoryToExtractTo=concat)  # Unzip zip-file
bgt_lagen = CodeBlock()
# ---------- bgt_lagen.designscript (32 lines) ----------
/*
Panden;
0 bgt_overigbouwwerk;

Groen;
1 bgt_begroeidterreindeel;

Lijnen(aparte lagen);
2 bgt_functioneelgebied;
3 bgt_gebouwinstallatie;
4 bgt_kunstwerkdeel;
5 bgt_onbegroeidterreindeel;
6 bgt_ondersteunendwegdeel;
7 bgt_overigescheiding;
8 bgt_scheiding;
9 bgt_spoor;
10 bgt_tunneldeel;

Wegen bruggen en kunstwerken;
11 bgt_kunstwerkdeel;
12 bgt_overbruggingsdeel;
13 bgt_wegdeel;

Water;
14 bgt_ondersteunendwaterdeel;
15 bgt_waterdeel;

Labels;
16 bgt_openbareruimtelabel;

Puntobject;
17 bgt_vegetatieobject;
# ----------------------------------------
string_3 = StringInput("C:\TEMP\BGT_Dordrecht2")

# group: GML INPUT
bgt_lagen_2 = CodeBlock()
# ---------- bgt_lagen_2.designscript (18 lines) ----------
"bgt_overigbouwwerk.gml";
"bgt_begroeidterreindeel.gml";
"bgt_functioneelgebied.gml";
"bgt_gebouwinstallatie.gml";
"bgt_kunstwerkdeel.gml";
"bgt_onbegroeidterreindeel.gml";
"bgt_ondersteunendwegdeel.gml";
"bgt_overigescheiding.gml";
"bgt_scheiding.gml";
"bgt_spoor.gml";
"bgt_tunneldeel.gml";
"bgt_kunstwerkdeel.gml";
"bgt_overbruggingsdeel.gml";
"bgt_wegdeel.gml";
"bgt_ondersteunendwaterdeel.gml";
"bgt_waterdeel.gml";
"bgt_openbareruimtelabel.gml";
"bgt_vegetatieobject.gml";
# ----------------------------------------
create = List.Create(bgt_lagen_2.out0, bgt_lagen_2.out1, bgt_lagen_2.out2, bgt_lagen_2.out3, bgt_lagen_2.out4, bgt_lagen_2.out5, bgt_lagen_2.out6, bgt_lagen_2.out7, bgt_lagen_2.out8, bgt_lagen_2.out9, bgt_lagen_2.out10, bgt_lagen_2.out11, bgt_lagen_2.out12, bgt_lagen_2.out13, bgt_lagen_2.out14, bgt_lagen_2.out15, bgt_lagen_2.out16, bgt_lagen_2.out17)
string_4 = StringInput("\")
concat_2 = String.Concat(string_3, string_4)  # unwired: arg2
map = List.Map(list=create, f_x=concat_2)

code_block_2 = CodeBlock { 16; }
getItemAtIndex = List.GetItemAtIndex(list=map, index=code_block_2)
string_5 = StringInput(".//{http://www.opengis.net/gml}pos")
code_block_3 = CodeBlock { 3000; }
filterGML = Custom[GIStoBIM.FilterGML](gmlFile=getItemAtIndex, xPATH=string_5, coordinateX=getLocationdataNetherlands.RDcoordinate_X_meters, coordinateY=getLocationdataNetherlands.RDcoordinate_Y_meters, boundingbox=code_block_3)  # filter GML-file based on boundingbox
flatten = Flatten(filterGML.points)
string_6 = StringInput(".//{http://www.geostandaarden.nl/imgeo/2.1}tekst")
xpath_expression_find_for = Custom[XPATH Expression Find for Element Tree](XPATH=string_6)  # unwired: ElementTree
python_script_2 = Python(IN[0]=getItemAtIndex)
# ---------- python_script_2.python (18 lines) ----------
import clr
import sys
clr.AddReference('ProtoGeometry')
from Autodesk.DesignScript.Geometry import *
sys.path.append("C:\Program Files (x86)\IronPython 2.7\Lib")
import xml.etree.ElementTree as ET

filePath = IN[0]

tree=ET.parse(filePath)
root=tree.getroot()

XMLelements = []
for elem in root.iter():
	XMLelements.append(elem)

#Assign your output to the OUT variable.
OUT = XMLelements
# ----------------------------------------
code_block_4 = CodeBlock { "Center"; }
python_script_3 = Python(IN[0]=getItemAtIndex)
# ---------- python_script_3.python (18 lines) ----------
import clr
import sys
clr.AddReference('ProtoGeometry')
from Autodesk.DesignScript.Geometry import *
sys.path.append("C:\Program Files (x86)\IronPython 2.7\Lib")
import xml.etree.ElementTree as ET

filePath = IN[0]

tree=ET.parse(filePath)
root=tree.getroot()

XMLelements = []
for elem in root.iter():
	XMLelements.append(elem)

#Assign your output to the OUT variable.
OUT = tree
# ----------------------------------------
string_7 = StringInput(".//{http://www.geostandaarden.nl/imgeo/2.1}hoek")
xpath_expression_find_for_2 = Custom[XPATH Expression Find for Element Tree](ElementTree=python_script_3, XPATH=string_7)
code_block_5 = CodeBlock { 300; }
views = Views("Situation")

# group: 2D SETTINGS
family_types = FamilyTypes("90_DI_boom:90_DI_boom")
PANDEN = FilledRegionTypes("FP_DP_90_pand")
GROEN1 = FilledRegionTypes("FP_DP_90_groen1")
GROEN2 = FilledRegionTypes("FP_DP_90_groen2")
WEG = FilledRegionTypes("FP_DP_90_weg")
weg_ondergeschikt = FilledRegionTypes("FP_DP_90_weg2")
WATER = FilledRegionTypes("FP_DP_90_water")
line_styles = CodeBlock()
# ---------- line_styles.designscript (9 lines) ----------
"bgt_functioneelgebied";
"bgt_gebouwinstallatie";
"bgt_kunstwerkdeel";
"bgt_onbegroeidterreindeel";
"bgt_ondersteunendwegdeel";
"bgt_overigescheiding";
"bgt_scheiding";
"bgt_spoor";
"bgt_tunneldeel";
# ----------------------------------------

BGT2D = Custom[GIStoBIM.BGT2D](Directory=string_3, rdx=getLocationdataNetherlands.RDcoordinate_X_meters, rdy=getLocationdataNetherlands.RDcoordinate_Y_meters, bbox=code_block_5, view=views, DetailcomponentTree=family_types, FilledRegionPand=PANDEN, FilledRegionGreen1=GROEN1, FilledRegionGreen2=GROEN2, FilledRegionRoad=WEG, FilledRegionRoad2=weg_ondergeschikt, FilledRegionWater=WATER, LineStyleBGT_functioneelgebied=line_styles.out0, LineStyleBGT_gebouwinstallatie=line_styles.out1, LineStyleBGT_kunstwerkdeel=line_styles.out2, LineStyleBGT_onbegroeidterreindeel=line_styles.out3, LineStyleBGT_ondersteunendwegdeel=line_styles.out4, LineStyleBGT_overigescheiding=line_styles.out5, LineStyleBGT_scheiding=line_styles.out6, LineStyleBGT_spoor=line_styles.out7, LineStyleBGT_tunneldeel=line_styles.out8)  # Create 2D BGT siteplan from set of GML-files
