# Dynamo graph sandboxDownloadBGT.dyn (Dynamo 1.3.1.1736)

code_block = CodeBlock { "Boskoop"; "warmoeskade"; "2"; }
getLocationdataNetherlands = Custom[GIStoBIM.GetLocationdataNetherlands](city=code_block.out0, streetname=code_block.out1, housenumber=code_block.out2)  # Gives locationdata based on an adress in the Netherlands
getMortonCodeCoordinate = Custom[GIStoBIM.GetMortonCodeCoordinate](X=getLocationdataNetherlands.RDcoordinate_X_meters, Y=getLocationdataNetherlands.RDcoordinate_Y_meters)  # Get mortoncode given 2 coordinates and tiledimension
string = StringInput("C:\TEMP")
downloadBGTdata = Custom[GIStoBIM.DownloadBGTdata](mortoncode=getMortonCodeCoordinate, directory=string)  # Download BGT-data(dutch GIS-information)
unzipFile = Custom[GIStoBIM.UnzipFile](FilePathZipFile=downloadBGTdata.Location, DirectoryToExtractTo=downloadBGTdata.Directory)  # Unzip zip-file
bgt_lagen = CodeBlock()
# ---------- bgt_lagen.designscript (32 lines) ----------
/*
Panden;
0 bgt_overigbouwwerk;

Groen;
1 bgt_begroeidterreindeel;

Lijnen(aparte lagen);
2 bgt_functioneelgebied;
3 bgt_gebouwinstallatie;
4 bgt_kunstwerkdeel;
5 bgt_onbegroeidterreindeel;
6 bgt_ondersteunendwegdeel;
7 bgt_overigescheiding;
8 bgt_scheiding;
9 bgt_spoor;
10 bgt_tunneldeel;

Wegen bruggen en kunstwerken;
11 bgt_kunstwerkdeel;
12 bgt_overbruggingsdeel;
13 bgt_wegdeel;

Water;
14 bgt_ondersteunendwaterdeel;
15 bgt_waterdeel;

Labels;
16 bgt_openbareruimtelabel;

Puntobject;
17 bgt_vegetatieobject;
# ----------------------------------------
code_block_2 = CodeBlock { 300; }
views = Views("Situation Copy 1")

# group: 2D SETTINGS
family_types = FamilyTypes("90_DI_boom:90_DI_boom")
PANDEN = FilledRegionTypes("FP_DP_90_pand")
GROEN1 = FilledRegionTypes("FP_DP_90_groen1")
GROEN2 = FilledRegionTypes("FP_DP_90_groen2")
WEG = FilledRegionTypes("FP_DP_90_weg")
weg_ondergeschikt = FilledRegionTypes("FP_DP_90_weg2")
WATER = FilledRegionTypes("FP_DP_90_water")
line_styles = CodeBlock()
# ---------- line_styles.designscript (9 lines) ----------
"bgt_functioneelgebied";
"bgt_gebouwinstallatie";
"bgt_kunstwerkdeel";
"bgt_onbegroeidterreindeel";
"bgt_ondersteunendwegdeel";
"bgt_overigescheiding";
"bgt_scheiding";
"bgt_spoor";
"bgt_tunneldeel";
# ----------------------------------------

BGT2D = Custom[GIStoBIM.BGT2D](Directory=downloadBGTdata.Directory, rdx=getLocationdataNetherlands.RDcoordinate_X_meters, rdy=getLocationdataNetherlands.RDcoordinate_Y_meters, bbox=code_block_2, view=views, DetailcomponentTree=family_types, FilledRegionPand=PANDEN, FilledRegionGreen1=GROEN1, FilledRegionGreen2=GROEN2, FilledRegionRoad=WEG, FilledRegionRoad2=weg_ondergeschikt, FilledRegionWater=WATER, LineStyleBGT_functioneelgebied=line_styles.out0, LineStyleBGT_gebouwinstallatie=line_styles.out1, LineStyleBGT_kunstwerkdeel=line_styles.out2, LineStyleBGT_onbegroeidterreindeel=line_styles.out3, LineStyleBGT_ondersteunendwegdeel=line_styles.out4, LineStyleBGT_overigescheiding=line_styles.out5, LineStyleBGT_scheiding=line_styles.out6, LineStyleBGT_spoor=line_styles.out7, LineStyleBGT_tunneldeel=line_styles.out8)  # Create 2D BGT siteplan from set of GML-files
