# Dynamo graph sandboxGoogleAPI.dyn (Dynamo 1.3.1.1736)

downloadOSM = Custom[GIStoBIM.DownloadOSM]()  # Download OSM data within a boundingbox; unwired: West, East, North, South, directory
code_block = CodeBlock { "https://overpass.api.de/api/map?bbox="; ","; }
code_block_2 = CodeBlock { "george silundika street"; "10"; "bulawayo"; "zimbabwe"; }
geoCodingGoogleAPI = Custom[GIStoBIM.GeoCodingGoogleAPI](streetname=code_block_2.out0, housenumber=code_block_2.out1, place=code_block_2.out2, country=code_block_2.out3)  # gets coordinate from adress with google API
code_block_3 = CodeBlock { 2000; }
createBoundingBoxLATLONG = Custom[GIStoBIM.CreateBoundingBoxLATLONG](lat=geoCodingGoogleAPI.latitude, long=geoCodingGoogleAPI.longitude, width_meters=code_block_3)  # create boundingbox with from lat/long coordinate in degrees
code_block_4 = CodeBlock(West=createBoundingBoxLATLONG.West) { West; }
python_script = Python(IN[0]=code_block_4)
# ---------- python_script.python (21 lines) ----------
#Copyright(c) 2016, Dimitar Venkov
# @5devene, dimitar.ven@gmail.com

import clr

def tolist(obj1):
	if hasattr(obj1,"__iter__"): return obj1
	else: return [obj1]

def output1(l1):
	if len(l1) == 1: return l1[0]
	else: return l1

num1 = tolist(IN[0])
out1 = []
for i in xrange(len(num1)):
	s1 = str(num1[i])
	if s1[-2:] == ".0": out1.append(s1[:-2])
	else: out1.append(s1)

OUT = output1(out1)
# ----------------------------------------
code_block_5 = CodeBlock(South=createBoundingBoxLATLONG.South) { South; }
python_script_2 = Python(IN[0]=code_block_5)  # same code as python_script
code_block_6 = CodeBlock(East=createBoundingBoxLATLONG.East) { East; }
python_script_3 = Python(IN[0]=code_block_6)  # same code as python_script
code_block_7 = CodeBlock(North=createBoundingBoxLATLONG.North) { North; }
python_script_4 = Python(IN[0]=code_block_7)  # same code as python_script
concat = String.Concat(code_block.out0, python_script, code_block.out1, python_script_2, code_block.out1, python_script_3, python_script_4)
code_block_8 = CodeBlock { "C:/TEMP"; }
code_block_9 = CodeBlock(directory=code_block_8) { directory; }
string = StringInput("/")
code_block_10 = CodeBlock { "map"; }
code_block_11 = CodeBlock { ".osm"; }
concat_2 = String.Concat(code_block_9, string, code_block_10, code_block_11)
python_script_5 = Python(IN[0]=concat, IN[1]=concat_2)
# ---------- python_script_5.python (10 lines) ----------
import sys
sys.path.append("C:\Program Files (x86)\IronPython 2.7\Lib")
from System.Net import WebClient

url= IN[0]
filoc= IN[1]

WebClient().DownloadFile(url, filoc)

OUT= filoc
# ----------------------------------------
code_block_12 = CodeBlock { Location; }
code_block_13 = CodeBlock { Directory; }
