# Dynamo graph sandboxPointcloud.dyn (Dynamo 1.3.1.1736)

# group: INPUT
code_block = CodeBlock { "Rotterdam"; "Wilhelminakade"; "200"; }
code_block_2 = CodeBlock { 700; }
views = Views("Situation")
string = StringInput("pen rood")
code_block_3 = CodeBlock { "C:/TEMP/"; }

# group: GET GEOSERVICES
getLocationdataNetherlands = Custom[GIStoBIM.GetLocationdataNetherlands](city=code_block.out0, streetname=code_block.out1, housenumber=code_block.out2)  # Gives locationdata based on an adress in the Netherlands
createBoundingBox = Custom[GIStoBIM.CreateBoundingBox](coordinateX=getLocationdataNetherlands.RDcoordinate_X_meters, coordinateY=getLocationdataNetherlands.RDcoordinate_Y_meters, boxWidth=code_block_2, boxHeight=code_block_2)  # create boundingboxstring for webrequests based on coördinates and dimensions
geoservicesLibraryNetherlands = Custom[GIStoBIM.GeoservicesLibraryNetherlands](BoundingBox=createBoundingBox)  # Library with multiple webadresses which can be used for WFS and WMS webrequests

code_block_4 = CodeBlock()
# ---------- code_block_4.designscript (1 lines) ----------
http://services.rce.geovoorziening.nl/rce/wfs?&request=GetCapabilities&service=WFS
# ----------------------------------------

# group: BAG: pand
web_request = WebRequest()  # unwired: arg0
code_block_5 = CodeBlock { "gml:posList"; }
boolean = BoolSelector(true)
createPointsPolygonFromGMLxyz = Custom[GIStoBIM.CreatePointsPolygonFromGMLxyz](xml=web_request, xmltagname=code_block_5, deltaX=getLocationdataNetherlands.RDcoordinate_X_meters, deltaY=getLocationdataNetherlands.RDcoordinate_Y_meters, connectpolygon=boolean)  # Create points and polygons from a xml/gml-file with x,y and z value
createDetailLinesFromPolygons = Custom[GIStoBIM.CreateDetailLinesFromPolygons](view=views, polyCurves=createPointsPolygonFromGMLxyz.PolyCurves, linestyle=string)  # Create detaillines from polygons in a view

python_script = Python()  # unwired: IN[0]; starter script, not edited (OUT = 0)
code_block_6 = CodeBlock { 10; }
code_block_7 = CodeBlock { 6; }
file_path = Filename("D:\GEO\LAZ\exports2.pts")
readText = File.ReadText(file_path)
code_block_8 = CodeBlock()
# ---------- code_block_8.designscript (2 lines) ----------
"
";
# ----------------------------------------
split = String.Split(readText, code_block_8)
code_block_9 = CodeBlock { 0; }
removeItemAtIndex = List.RemoveItemAtIndex(list=split, indices=code_block_9)
code_block_10 = CodeBlock { " "; }
split_2 = String.Split(removeItemAtIndex, code_block_10)
code_block_11 = CodeBlock { 0; }
getItemAtIndex = List.GetItemAtIndex(index=code_block_11)  # unwired: list
map = List.Map(list=split_2, f_x=getItemAtIndex)
toNumber = String.ToNumber(map)
code_block_12 = CodeBlock { 106802; 426774; }
sub = toNumber - code_block_12.out0
code_block_13 = CodeBlock(x=sub) { x*1000; }
code_block_14 = CodeBlock { 1; }
roundToPrecision = Custom[Math.RoundToPrecision](Number=code_block_13, Precision=code_block_14)  # Rounds a number to a specified precision
code_block_15 = CodeBlock { 1; }
getItemAtIndex_2 = List.GetItemAtIndex(index=code_block_15)  # unwired: list
map_2 = List.Map(list=split_2, f_x=getItemAtIndex_2)
toNumber_2 = String.ToNumber(map_2)
sub_2 = toNumber_2 - code_block_12.out1
code_block_16 = CodeBlock(y=sub_2) { y*1000; }
roundToPrecision_2 = Custom[Math.RoundToPrecision](Number=code_block_16, Precision=code_block_14)
code_block_17 = CodeBlock { 2; }
getItemAtIndex_3 = List.GetItemAtIndex(index=code_block_17)  # unwired: list
map_3 = List.Map(list=split_2, f_x=getItemAtIndex_3)
toNumber_3 = String.ToNumber(map_3)
code_block_18 = CodeBlock(z=toNumber_3) { z*1000; }
roundToPrecision_3 = Custom[Math.RoundToPrecision](Number=code_block_18, Precision=code_block_14)
byCoordinates = Point.ByCoordinates(x=roundToPrecision, y=roundToPrecision_2, z=roundToPrecision_3)
byPoints = NurbsSurface.ByPoints(byCoordinates)
watch = Watch(readText)
createTopo = Elk.Topography.CreateTopo()  # unwired: arg0, arg1
byPoints_2 = Topography.ByPoints()  # unwired: arg0
