# Dynamo graph sandboxPointcloud3.dyn (Dynamo 1.3.1.1736)

python_script = Python()  # unwired: IN[0]
# ---------- python_script.python (10 lines) ----------
import sys
sys.path.append("C:\Program Files (x86)\IronPython 2.7\Lib")
from pathlib import os.path

myfile = IN[0]
my_file = os.path(myfile)
if my_file.is_file():
    message = "true"
#Assign your output to the OUT variable.
OUT = message
# ----------------------------------------
code_block = CodeBlock { "papendrecht"; "westeind"; "85"; }
getLocationdataNetherlands = Custom[GIStoBIM.GetLocationdataNetherlands](city=code_block.out0, streetname=code_block.out1, housenumber=code_block.out2)  # Gives locationdata based on an adress in the Netherlands
code_block_2 = CodeBlock { 200; }
code_block_3 = CodeBlock { "D:/GEO/AHN2"; }
code_block_4 = CodeBlock { "AHNtest2"; }
code_block_5 = CodeBlock { 6; }
code_block_6 = CodeBlock { 20; }
code_block_7 = CodeBlock { "D:/GEO/AHN2/C_38CZ2.LAZ"; }
LASZIPCommands = Custom[GIStoBIM.LASZIPCommands](x=getLocationdataNetherlands.RDcoordinate_X_meters, y=getLocationdataNetherlands.RDcoordinate_Y_meters, boundingboxwidthMeters=code_block_2, Targetdirectory=code_block_3, Filename=code_block_4, ClassificationToKeep=code_block_5, KeepEveryNthPoint=code_block_6, LAZFile=code_block_7)  # commandline options for LASZIP
watch = Watch(LASZIPCommands.FilePathTXT)
code_block_8 = CodeBlock { "D:/GEO/AHN2"; }
downloadLASZIP = Custom[GIStoBIM.DownloadLASZIP](directory=code_block_8)  # download and unzip laszip
string = StringInput("/")
string_2 = StringInput("\")
replace = String.Replace(str=code_block_8, searchFor=string, replaceWith=string_2)
buildCMDLASZIP = Custom[GIStoBIM.BuildCMDLASZIP](FilePathLASZIP=downloadLASZIP.laszip, DirectoryPointcloud=replace, Files=LASZIPCommands.AllLAZ, Filter=LASZIPCommands.FilterClassification, Reduce=LASZIPCommands.ReducePointCLoudSize, Crop=LASZIPCommands.Cropoptions, Merge=LASZIPCommands.Merged, FilePathNew=LASZIPCommands.TXT)  # create scriptfile to run laszip
python_script_2 = Python(IN[0]=buildCMDLASZIP)  # starter script, not edited (OUT = 0)
