# Dynamo graph sandboxWMTS.dyn (Dynamo 1.3.1.1736)

WMTSGeoservicesLibraryNetherlands = Custom[GIStoBIM.WMTSGeoservicesLibraryNetherlands]()  # library with webrequests of WMTS-services in the Netherlands; unwired: TileRow, TileColumn, Zoomlevel, Layer
code_block = CodeBlock { "Dordrecht"; "lange geldersekade"; "2"; }
getLocationdataNetherlands = Custom[GIStoBIM.GetLocationdataNetherlands](city=code_block.out0, streetname=code_block.out1, housenumber=code_block.out2)  # Gives locationdata based on an adress in the Netherlands
code_block_2 = CodeBlock { 450; }
createBoundingBox = Custom[GIStoBIM.CreateBoundingBox](coordinateX=getLocationdataNetherlands.RDcoordinate_X_meters, coordinateY=getLocationdataNetherlands.RDcoordinate_Y_meters, boxWidth=code_block_2, boxHeight=code_block_2)  # create boundingboxstring for webrequests based on coördinates and dimensions
code_block_3 = CodeBlock { 14; }
WMTSScaleSetNetherlands = Custom[GIStoBIM.WMTSScaleSetNetherlands](Zoomlevel=code_block_3)  # gives resolution, scaledenominator and number of tiles
code_block_4 = CodeBlock { 256; }
WMTSZoomLevelTileRow = Custom[GIStoBIM.WMTSZoomLevelTileRow](Zoomlevel=WMTSScaleSetNetherlands.Zoomlevel, Resolution=WMTSScaleSetNetherlands.Resolutie_m_pixel, NumberofTiles=WMTSScaleSetNetherlands.numberoftiles, Rdx=getLocationdataNetherlands.RDcoordinate_X_meters, Rdy=getLocationdataNetherlands.RDcoordinate_Y_meters, PixelWidth=code_block_4)  # gives the tilerow and tilecolumn for the WMTS webrequest
toNumber = String.ToNumber(WMTSZoomLevelTileRow.TileRow)
code_block_5 = CodeBlock(pixel=code_block_4, resolutie=WMTSScaleSetNetherlands.Resolutie_m_pixel) { tilewidth=pixel*resolutie; }
code_block_6 = CodeBlock(bbox=code_block_2, tilewidth=code_block_5) { Math.Ceiling(bbox/tilewidth); }
code_block_7 = CodeBlock(a=code_block_6) { Math.Ceiling(a/2)*2; }
code_block_8 = CodeBlock(TileRow=toNumber, n=code_block_7) { (TileRow-(n/2))..(TileRow+(n/2))..#n+1; }
toNumber_2 = String.ToNumber(WMTSZoomLevelTileRow.TileColumn)
code_block_9 = CodeBlock(TileColumn=toNumber_2, n=code_block_7) { (TileColumn-(n/2))..(TileColumn+(n/2))..#n+1; }
byCoordinates = Point.ByCoordinates(x=code_block_8, y=code_block_9, lacing=CrossProduct)
X = Point.X(byCoordinates)
flatten = Flatten(X)
Y = Point.Y(byCoordinates)
flatten_2 = Flatten(Y)
count = List.Count(code_block_9)
mul = count * count
code_block_10 = CodeBlock(n=mul) { 0..n-1; }
create = List.Create(flatten, flatten_2, code_block_10)
transpose = List.Transpose(create)
Z = Point.Z()  # unwired: arg0
link_kadaster = CodeBlock()
# ---------- link_kadaster.designscript (11 lines) ----------
"http://geodata.nationaalgeoregister.nl/";
"tiles/service/wmts?";
"&request=GetTile";
"&VERSION=1.0.0";
"&LAYER=";
"&STYLE=default";
"&TILEMATRIXSET=EPSG:28992";
"&TILEMATRIX=EPSG:28992:";
"&TILEROW=";
"&TILECOL=";
"&FORMAT=image/png8";
# ----------------------------------------
WMTSLayersNetherlands = Custom[GIStoBIM.WMTSLayersNetherlands]()  # Library with layers for webrequests of WMTS-services in the Netherlands
code_block_11 = CodeBlock(Layer=WMTSLayersNetherlands.ahn2_05m_ruw) { Layer; }
code_block_12 = CodeBlock(Zoomlevel=WMTSScaleSetNetherlands.Zoomlevel) { Zoomlevel; }
python_script = Python(IN[0]=code_block_12)
# ---------- python_script.python (21 lines) ----------
#Copyright(c) 2016, Dimitar Venkov
# @5devene, dimitar.ven@gmail.com

import clr

def tolist(obj1):
	if hasattr(obj1,"__iter__"): return obj1
	else: return [obj1]

def output1(l1):
	if len(l1) == 1: return l1[0]
	else: return l1

num1 = tolist(IN[0])
out1 = []
for i in xrange(len(num1)):
	s1 = str(num1[i])
	if s1[-2:] == ".0": out1.append(s1[:-2])
	else: out1.append(s1)

OUT = output1(out1)
# ----------------------------------------
concat = String.Concat(link_kadaster.out0, link_kadaster.out1, link_kadaster.out2, link_kadaster.out3, link_kadaster.out4, code_block_11, link_kadaster.out5, link_kadaster.out6, link_kadaster.out7, python_script, link_kadaster.out8)
code_block_13 = CodeBlock(URL=concat) { URL; }
code_block_14 = CodeBlock(TileRow=flatten) { TileRow; }
code_block_15 = CodeBlock(TileColumn=WMTSZoomLevelTileRow.TileColumn) { TileColumn; }
concat_2 = String.Concat(code_block_14, link_kadaster.out9, code_block_15, link_kadaster.out10)
