# Dynamo graph sandboxWMTS2.dyn (Dynamo 1.3.1.1736)

code_block = CodeBlock { "Dordrecht"; "lange geldersekade"; "2"; }
getLocationdataNetherlands = Custom[GIStoBIM.GetLocationdataNetherlands](city=code_block.out0, streetname=code_block.out1, housenumber=code_block.out2)  # Gives locationdata based on an adress in the Netherlands
boundingbox = CodeBlock { 250; }
createBoundingBox = Custom[GIStoBIM.CreateBoundingBox](coordinateX=getLocationdataNetherlands.RDcoordinate_X_meters, coordinateY=getLocationdataNetherlands.RDcoordinate_Y_meters, boxWidth=boundingbox, boxHeight=boundingbox)  # create boundingboxstring for webrequests based on coördinates and dimensions
WMTSZoomLevelTileRow = Custom[GIStoBIM.WMTSZoomLevelTileRow]()  # gives the tilerow and tilecolumn for the WMTS webrequest; unwired: Resolution, NumberofTiles, Rdx, Rdy
zoomlevel = CodeBlock { 14; }
WMTSScaleSetNetherlands = Custom[GIStoBIM.WMTSScaleSetNetherlands](Zoomlevel=zoomlevel)  # gives resolution, scaledenominator and number of tiles
pixelWidth = CodeBlock { 256; }
WMTSTileListFromBbox = Custom[GIStoBIM.WMTSTileListFromBbox](TileRow=WMTSZoomLevelTileRow.TileRow, TileColumn=WMTSZoomLevelTileRow.TileColumn, Resolution=WMTSScaleSetNetherlands.Resolutie_m_pixel, PixelWidth=pixelWidth, bbox=boundingbox)  # gives list of tilerows and tilecolums
WMTSLayersNetherlands = Custom[GIStoBIM.WMTSLayersNetherlands]()  # Library with layers for webrequests of WMTS-services in the Netherlands
WMTSGeoservicesLibraryNetherlands = Custom[GIStoBIM.WMTSGeoservicesLibraryNetherlands](TileRow=WMTSTileListFromBbox.TileRows, TileColumn=WMTSTileListFromBbox.TileColumns, Zoomlevel=WMTSScaleSetNetherlands.Zoomlevel, Layer=WMTSLayersNetherlands.2016_ortho25)  # library with webrequests of WMTS-services in the Netherlands
code_block_2 = CodeBlock { "C:/TEMP/WMTS/"; }
webrequestWMTS = Custom[GIStoBIM.WebrequestWMTS](temppath=code_block_2, TileRow=WMTSTileListFromBbox.TileRows, TileColumn=WMTSTileListFromBbox.TileColumns, Layer=WMTSLayersNetherlands.2016_ortho25, Zoomlevel=zoomlevel)  # unwired: WMTSWebrequest
combineImages = Custom[GIStoBIM.CombineImages](ImageList=webrequestWMTS.TileFiles, TileRows=WMTSTileListFromBbox.TileRows, TileColumns=WMTSTileListFromBbox.TileColumns, NumberOfPixels=pixelWidth, Layer=webrequestWMTS.Layer)  # combine images from wmts webrequest
watch_image = WatchImageCore(combineImages.watch_image)
views = Views("Situation")
importImageInView = Custom[GIStoBIM.ImportImageInView](ImageWidthMeters=WMTSTileListFromBbox.TotalTileWidthMetrs, view=views, ImagePath=combineImages.ImagePath, deltax=WMTSZoomLevelTileRow.DeltaX, deltay=WMTSZoomLevelTileRow.DeltaY)  # Import rasterimage in view
code_block_3 = CodeBlock { 16080; -17680; 376.32; }
code_block_4 = CodeBlock { "C:/TEMP/WMTS/2016_ortho25220937.png"; }
code_block_5 = CodeBlock { YCorner: double=903402.0; }
code_block_6 = CodeBlock(Rdy=getLocationdataNetherlands.RDcoordinate_Y_meters) { Rdy; }
sub = code_block_5 - code_block_6
code_block_7 = CodeBlock { PixelWidth: int=256; }
code_block_8 = CodeBlock(Resolution=WMTSScaleSetNetherlands.Resolutie_m_pixel) { Resolution: double; }
code_block_9 = CodeBlock(PixelWidth=code_block_7, MetersPerPixel=code_block_8) { PixelWidth*MetersPerPixel; }
code_block_10 = CodeBlock(NumberofTiles=WMTSScaleSetNetherlands.numberoftiles) { NumberofTiles: int; }
width_height_sum_tiles = code_block_9 * code_block_10
div = sub / width_height_sum_tiles
mul = div * code_block_10
round = Math.Round(mul)
sub_2 = mul - round
code_block_11 = CodeBlock(Tilepercentage=sub_2, Pixel=code_block_7, MeterPerPixel=code_block_8) { Tilepercentage*Pixel*MeterPerPixel*1000; }
round_2 = Math.Round(code_block_11)
code_block_12 = CodeBlock(DeltaY=round_2) { DeltaY; }
code_block_13 = CodeBlock(Rdx=getLocationdataNetherlands.RDcoordinate_X_meters) { Rdx; }
code_block_14 = CodeBlock { XCorner: double=-285401.92; }
sub_3 = code_block_13 - code_block_14
div_2 = sub_3 / width_height_sum_tiles
mul_2 = div_2 * code_block_10
round_3 = Math.Round(mul_2)
sub_4 = mul_2 - round_3
code_block_15 = CodeBlock(Tilepercentage=sub_4, Pixel=code_block_7, MeterPerPixel=code_block_8) { Tilepercentage*Pixel*MeterPerPixel*1000; }
round_4 = Math.Round(code_block_15)
code_block_16 = CodeBlock(DeltaX=round_4) { DeltaX; }
code_block_17 = CodeBlock(row=round) { row; }
python_script = Python(IN[0]=code_block_17)
# ---------- python_script.python (21 lines) ----------
#Copyright(c) 2016, Dimitar Venkov
# @5devene, dimitar.ven@gmail.com

import clr

def tolist(obj1):
	if hasattr(obj1,"__iter__"): return obj1
	else: return [obj1]

def output1(l1):
	if len(l1) == 1: return l1[0]
	else: return l1

num1 = tolist(IN[0])
out1 = []
for i in xrange(len(num1)):
	s1 = str(num1[i])
	if s1[-2:] == ".0": out1.append(s1[:-2])
	else: out1.append(s1)

OUT = output1(out1)
# ----------------------------------------
code_block_18 = CodeBlock(TileRow=python_script) { TileRow; }
code_block_19 = CodeBlock(column=round_3) { column; }
python_script_2 = Python(IN[0]=code_block_19)  # same code as python_script
code_block_20 = CodeBlock(TileColumn=python_script_2) { TileColumn; }
code_block_21 = CodeBlock(number=round_3, total=code_block_10) { (number/total); }
