# Dynamo graph sandbox_.dyn (Dynamo 1.3.1.1736)

file_path = Filename("..\..\..\Users\Maarten\Documents\GitHub\GIStoBIM\supportfiles\ExampleFiles\GEF1.GEF")
readText = File.ReadText(file_path)
watch = Watch(readText)
integer_slider = IntegerSlider(0, range=0..100 step 1)
family_types = FamilyTypes()
number = DoubleInput(0)
number_2 = DoubleInput(10)
string = StringInput("e")
split = String.Split(arg1=string)  # unwired: arg0
transpose = List.Transpose(split)
lastItem = List.LastItem(transpose)
toNumber = String.ToNumber(lastItem)
pow = Math.Pow(number=number_2, power=toNumber)
firstItem = List.FirstItem(transpose)
toNumber_2 = String.ToNumber(firstItem)
depthInMeters = pow * toNumber_2
number_3 = DoubleInput(1000)
depthInMM = depthInMeters * number_3
number_4 = DoubleInput(-1)
depth = depthInMM * number_4
byCoordinates = FamilyInstance.ByCoordinates(family_types, number, number, depth)
string_2 = StringInput("Thickness")
integer_slider_2 = IntegerSlider(0, range=0..100 step 1)
removeItemAtIndex = List.RemoveItemAtIndex(list=depthInMM, indices=integer_slider_2)
thickness = removeItemAtIndex - depthInMM
setParameterByName = Element.SetParameterByName(element=byCoordinates, parameterName=string_2, value=thickness)
string_3 = StringInput("Material")
number_5 = DoubleInput(10)
watch_2 = Watch()  # unwired: arg0
integer_slider_3 = IntegerSlider(3, range=0..100 step 1)
getItemAtIndex = List.GetItemAtIndex(list=watch_2, index=integer_slider_3)
string_4 = StringInput("e")
split_2 = String.Split(getItemAtIndex, string_4)
transpose_2 = List.Transpose(split_2)
lastItem_2 = List.LastItem(transpose_2)
toNumber_3 = String.ToNumber(lastItem_2)
pow_2 = Math.Pow(number=number_5, power=toNumber_3)
firstItem_2 = List.FirstItem(transpose_2)
toNumber_4 = String.ToNumber(firstItem_2)
frictionRatio = pow_2 * toNumber_4
fractionRatioPeat = DoubleInput(5)
lt = frictionRatio < fractionRatioPeat
fractionRatioClay = DoubleInput(2.5)
gt = frictionRatio > fractionRatioClay
lt_2 = frictionRatio < fractionRatioPeat
eq = gt == lt_2
string_5 = StringInput("90_klei")
fractionRatioSilt = DoubleInput(1)
gt_2 = frictionRatio > fractionRatioSilt
lt_3 = frictionRatio < fractionRatioClay
eq_2 = gt_2 == lt_3
string_6 = StringInput("90_silt")
lt_4 = frictionRatio < fractionRatioSilt
string_7 = StringInput("90_zand")
string_8 = StringInput("")
sandLayers = If(test=lt_4, true=string_7, false=string_8)
siltLayers = If(test=eq_2, true=string_6, false=sandLayers)
clayLayers = If(test=eq, true=string_5, false=siltLayers)
string_9 = StringInput("90_veen")
peatLayers = If(test=lt, true=clayLayers, false=string_9)
byName = Material.ByName(peatLayers)
setParameterByName_2 = Element.SetParameterByName(element=byCoordinates, parameterName=string_3, value=byName)
fractionRatioSand = DoubleInput(0.2)
code_block = CodeBlock {  }
code_block_2 = CodeBlock(t8=readText)
# ---------- code_block_2.designscript (10 lines) ----------
t7 = " ";
t3 = t8;
t1 = "#EOH=";
t2 = String.Split(t3, {t1});
t4 = DSCore.List.LastItem(t2);
t5 = "
";
t6 = String.Split(t4, {t5});
t9 = String.Split(t6, {t7});
t10 = DSCore.List.Transpose(t9);
# ----------------------------------------
watch_3 = Watch(code_block_2.t10)
pressure_column = CodeBlock { 1; }
frictionratio_column = CodeBlock { 6; }
contains = Custom[String.Contains]()  # This node takes a list of strings and checks if any string contains a matching string from filter input.; unwired: StringList, FilterList
transform_origin = Custom[Transform Origin]()  # This node will query an element for its Transform (Coordinate System) and then return its Origin point.; unwired: Element
depth_column = CodeBlock { 0; }
getItemAtIndex_2 = List.GetItemAtIndex(list=code_block_2.t10, index=depth_column)
firstItem_3 = List.FirstItem(getItemAtIndex_2)
flatten = Flatten(firstItem_3)
python_script = Python(IN[0]=flatten)
# ---------- python_script.python (12 lines) ----------
import clr
clr.AddReference('ProtoGeometry')
from Autodesk.DesignScript.Geometry import *
#The inputs to this node will be stored as a list in the IN variables.
dataEnteringNode = IN

Depth = IN[0]

A = float(Depth)

#Assign your output to the OUT variable.
OUT = A
# ----------------------------------------
map = List.Map(list=getItemAtIndex_2, f_x=python_script)
